# Grasshopper definition 200624_Sewing.gh (Grasshopper 1.0.7)
# plug-ins: Firefly.Core

# STREAM
timer = Timer(TimerInterval=5000, Target=c_script)
c_script = CSharpScript(Enable=Toggle(True))  # -> out, Boolean; inputs Enable: Boolean
# ---------- c_script: C# ----------
    if (Enable == true)
    {
      if (toggle == false)
        toggle = true;
      else
        toggle = false;
      Boolean = toggle;
    }
# ---------- c_script: C# additional code ----------
  bool toggle = false;
# ---------- end c_script ----------
panel = Panel(c_script.Boolean)

bool = Boolean(c_script.Boolean)
uno_write = UnoWrite(
    StartWritingValues=Toggle(True),
    DigitalPin13=0,
    DigitalPin12=0,
    DigitalPin11=0,
    DigitalPin10=0,
    DigitalPin9=bool,
    DigitalPin8=0,
    DigitalPin6=0,
    DigitalPin5=0,
    DigitalPin3=0,
    PortNumber="3")  # -> ArduinoOutput, StatusMessage
# Relative correction
open_port = OpenClosePort(OpenClosePort=Toggle(True), PortNumber="3", BaudRate=115200)
