# Grasshopper definition Sewing Machine Button.gh (Grasshopper 1.0.7)
# plug-ins: Firefly.Core

# 1
number_slider = Slider(9600, range=0..10000)

# ----
# check button arduino's Port
panel = Panel("0005")
integer = Integer(panel)

# ----
# 2
open_close_port = OpenClosePort(OpenClosePort=Toggle(True), PortNumber=integer, BaudRate=number_slider)
panel_2 = Panel(open_close_port)
timer = Timer(TimerInterval=20, Target=serial_read_generic)  # disabled
# 3
serial_read_generic = SerialReadGeneric(StartReadingValues=Toggle(True), PortNumber=integer)  # -> SerialOutput, StatusMessage
panel_3 = Panel(serial_read_generic.SerialOutput)
panel_4 = Panel(serial_read_generic.StatusMessage)
c_script = CSharpScript(x=panel_3)  # -> out, A; inputs x: Boolean
# ---------- c_script: C# ----------
    if(x == true){
      trigger = !trigger;}
    
    A = trigger;
# ---------- c_script: C# additional code ----------
  bool trigger = false;
# ---------- end c_script ----------

# ----
# 4
# check sewingmachine arduino's Port
panel_5 = Panel("3")

panel_6 = Panel(c_script.A)
# 5
toggle = BooleanToggle(False)
# 6
toggle_2 = BooleanToggle(False)
open_port = OpenClosePort(OpenClosePort=toggle, PortNumber=panel_5, BaudRate=115200)
bool = Boolean(panel_6)
uno_write = UnoWrite(
    StartWritingValues=toggle_2,
    DigitalPin13=0,
    DigitalPin12=0,
    DigitalPin11=0,
    DigitalPin10=0,
    DigitalPin9=bool,
    DigitalPin8=0,
    DigitalPin6=0,
    DigitalPin5=0,
    DigitalPin3=0,
    PortNumber=panel_5)  # -> ArduinoOutput, StatusMessage
