# Grasshopper definition 200128_Channels on Blob_Using Coincidental.gh (Grasshopper 1.0.7)
# plug-ins: MeshEdit Components, Kangaroo Components, Weaverbird, Kangaroo2 Components

surface = Surface(<surface referenced from the Rhino model>)

# ----
# Creating channels using Coincidental and adding a upwards unary force to simulate
# lifting behaviour.
# 
# Works on a few scale. but Lifting is not
# realistic and is a result of cheating.
# Could experiment more to see if it can be
# used to simulate actual behaviour
mesh_surface = MeshSurface(Surface=surface, UCount=Slider(46, range=0..100), VCount=Slider(28, range=0..100), Overhang=True, Equalize=False)
mesh_edges = MeshEdges(Mesh=mesh_surface)  # -> NakedEdges, InteriorEdges, NonManifoldEdges
demesh = DeconstructMesh(Mesh=mesh_surface)  # -> Vertices, Faces, Colours, Normals

join = JoinCurves(Curves=mesh_edges.NakedEdges, Preserve=False)
cp = ControlPoints(Curve=join)  # -> Points, Weights, Knots
duppt = RemoveDuplicatePts(Points=cp.Points, Tolerance=0.01)

number_slider = Slider(1, range=0..1)
neg = Negative(Value=number_slider)
merge = Merge(Data1=neg, Data2=number_slider)  # -> graft(Result)
Z = UnitZ(Factor=merge)  # -> simplify(UnitVector)

cp_2 = ClosestPoint(Point=demesh.Vertices, Cloud=duppt)  # -> ClosestPoint, CPIndex, Distance
larger = LargerThan(FirstNumber=cp_2.Distance, SecondNumber=0)  # -> LargerThan, OrEqualTo
dispatch = Dispatch(List=demesh.Vertices, DispatchPattern=larger.LargerThan)  # -> ListA, ListB
move = Move(Geometry=dispatch.ListA, Motion=Z)  # -> simplify(Geometry), Transform
weave = Weave(Pattern=larger.LargerThan, Stream0=dispatch.ListB, Stream1=move.Geometry, NullGaps=False)  # -> simplify(Weave)
conmesh = ConstructMesh(Vertices=weave, Faces=demesh.Faces)  # -> simplify(Mesh)
bang = ExplodeTree(Data=conmesh)  # -> Branch0, Branch1
flip = MeshFlip(Mesh=bang.Branch0)
merge_2 = Merge(Data1=flip, Data2=bang.Branch1)  # -> flatten(Result)
mjoin = MeshJoin(Meshes=merge_2)
weldvertices = MeshWeldVertices(Mesh=mjoin, Tolerance=0.01)  # -> RuntimeMessage, Mesh

geometry_pipeline = GeometryPipeline(
    GroupByLayer=False,
    GroupByType=False,
    IncludeHidden=True,
    IncludeLocked=True,
    LayerFilter="anchor",
    NameFilter="*",
    SublayerFiltering=True,
    TypeFilter=1073741848)
medges = MeshEdges(Mesh=mjoin)  # -> NakedEdges, InteriorEdges, NonManifoldEdges
medges_2 = MeshEdges(Mesh=mjoin)  # -> NakedEdges, InteriorEdges, NonManifoldEdges
point_in_breps = PointInBreps(Brep=geometry_pipeline, Point=duppt, Strict=False)  # -> Inside, Index
merge_3 = Merge(Data1=medges.NakedEdges, Data2=medges.InteriorEdges)
merge_4 = Merge(Data1=medges_2.NakedEdges, Data2=medges_2.InteriorEdges)
geometry_pipeline_2 = GeometryPipeline(
    GroupByLayer=False,
    GroupByType=False,
    IncludeHidden=True,
    IncludeLocked=True,
    LayerFilter="stiff area",
    NameFilter="*",
    SublayerFiltering=True,
    TypeFilter=1073741848)
cull_pattern = CullPattern(List=duppt, CullPattern=point_in_breps.Inside)
list_item = ListItem(List=merge_2, Index=0, Wrap=True)  # -> Item, Item1
demesh_2 = DeconstructMesh(Mesh=list_item.Item)  # -> Vertices, Faces, Colours, Normals
evaluate_curve = EvaluateCurve(Curve=reparameterize(merge_3), Parameter=Slider(0.5, range=0..1))  # -> Point, Tangent, Angle
geometry_pipeline_3 = GeometryPipeline(
    GroupByLayer=False,
    GroupByType=False,
    IncludeHidden=True,
    IncludeLocked=True,
    LayerFilter="stiff area",
    NameFilter="*",
    SublayerFiltering=True,
    TypeFilter=1073741848)
demesh_3 = DeconstructMesh(Mesh=list_item.Item1)  # -> Vertices, Faces, Colours, Normals
point_in_breps_2 = PointInBreps(Brep=geometry_pipeline_2, Point=demesh_2.Vertices, Strict=False)  # -> Inside, Index
point_in_breps_3 = PointInBreps(Brep=geometry_pipeline_3, Point=evaluate_curve.Point, Strict=False)  # -> Inside, Index
point_in_breps_4 = PointInBreps(Brep=geometry_pipeline_2, Point=demesh_3.Vertices, Strict=False)  # -> Inside, Index
dispatch_2 = Dispatch(List=merge_3, DispatchPattern=point_in_breps_3.Inside)  # -> ListA, ListB
dispatch_3 = Dispatch(List=demesh_3.Vertices, DispatchPattern=point_in_breps_4.Inside)  # -> ListA, ListB
dispatch_4 = Dispatch(List=demesh_2.Vertices, DispatchPattern=point_in_breps_2.Inside)  # -> ListA, ListB
demesh_4 = DeconstructMesh(Mesh=mjoin)  # -> Vertices, Faces, Colours, Normals
geometry = Geometry(dispatch_4.ListA)
geometry_2 = Geometry(dispatch_3.ListA)
geometry_3 = Geometry(dispatch_2.ListB)
length = Length(Curve=dispatch_2.ListA)
unit_z = UnitZ(Factor=Slider(0.422, range=0..1.01))
unit_z_2 = UnitZ(Factor=Slider(0.242, range=0..1.01))
length_2 = Length(Curve=merge_4)
length_3 = Length(Curve=geometry_3)
geometry_4 = Geometry([dispatch_4.ListB, dispatch_3.ListB])
unit_z_3 = UnitZ(Factor=expr("-x", Slider(0, range=0..1.01)))
coincident = Coincident(Point0=geometry_2, Point1=geometry, Strength=Slider(47, range=0..1000))
floor = Floor(Strength=Slider(500, range=0..1000))
load = Load(Point=demesh_4.Vertices, ForceVector=unit_z_3)
pressure = Pressure(M=mjoin, Strength=Slider(0.1, range=0..0.1))
multiplication = Multiplication(A=length, B=Slider(1, range=0..1))
anchor = Anchor(Point=cull_pattern, Strength=1000)
show = Show(G=weldvertices.Mesh)
load_2 = Load(Point=demesh_3.Vertices, ForceVector=unit_z_2)
load_3 = Load(Point=geometry_4, ForceVector=unit_z)
length_line = LengthLine(Line=merge_4, Length=length_2, Strength=Slider(393, range=0..1000))
length_line_2 = LengthLine(Line=geometry_3, Length=length_3, Strength=Slider(1000, range=0..1000))
clamplength = ClampLength(Line=dispatch_2.ListA, LowerLimit=multiplication, UpperLimit=multiplication, Strength=Slider(1000, range=0..1000))
merge_5 = Merge(
    Data1=flatten(show),
    Data2=flatten(anchor),
    Data5=floor,
    Data6=flatten(load_2),
    Data7=coincident,
    Data8=flatten(length_line),
    Data9=load,
    Data10=pressure)
solver = Solver(GoalObjects=merge_5, Reset=Button(), Threshold=1e-15, Tolerance=0.01, On=Toggle(False))  # -> I, V, O
mesh = Mesh(solver.O)
weaverbird_s_catmull_clark_subdivision = WeaverbirdsCatmullClarkSubdivision(MeshCurves=mesh, Level=1, SmoothNakedEdges=1)
medges_3 = MeshEdges(Mesh=mesh)  # -> NakedEdges, InteriorEdges, NonManifoldEdges
surface_2 = Surface(<surface referenced from the Rhino model>)

number_slider_2 = Slider(63, range=0..100)
mesh_surface_2 = MeshSurface(Surface=surface_2, UCount=number_slider_2, VCount=number_slider_2, Overhang=True, Equalize=False)
mesh_edges_2 = MeshEdges(Mesh=mesh_surface_2)  # -> NakedEdges, InteriorEdges, NonManifoldEdges
demesh_5 = DeconstructMesh(Mesh=mesh_surface_2)  # -> Vertices, Faces, Colours, Normals

join_2 = JoinCurves(Curves=mesh_edges_2.NakedEdges, Preserve=False)
cp_3 = ControlPoints(Curve=join_2)  # -> Points, Weights, Knots
duppt_2 = RemoveDuplicatePts(Points=cp_3.Points, Tolerance=0.01)

number_slider_3 = Slider(1, range=0..1)
neg_2 = Negative(Value=number_slider_3)
merge_6 = Merge(Data1=neg_2, Data2=number_slider_3)  # -> graft(Result)
Z_2 = UnitZ(Factor=merge_6)  # -> simplify(UnitVector)

cp_4 = ClosestPoint(Point=demesh_5.Vertices, Cloud=duppt_2)  # -> ClosestPoint, CPIndex, Distance
larger_2 = LargerThan(FirstNumber=cp_4.Distance, SecondNumber=0)  # -> LargerThan, OrEqualTo
dispatch_5 = Dispatch(List=demesh_5.Vertices, DispatchPattern=larger_2.LargerThan)  # -> ListA, ListB
move_2 = Move(Geometry=dispatch_5.ListA, Motion=Z_2)  # -> simplify(Geometry), Transform
weave_2 = Weave(Pattern=larger_2.LargerThan, Stream0=dispatch_5.ListB, Stream1=move_2.Geometry, NullGaps=False)  # -> simplify(Weave)
conmesh_2 = ConstructMesh(Vertices=weave_2, Faces=demesh_5.Faces)  # -> simplify(Mesh)
bang_2 = ExplodeTree(Data=conmesh_2)  # -> Branch0, Branch1
flip_2 = MeshFlip(Mesh=bang_2.Branch0)
merge_7 = Merge(Data1=flip_2, Data2=bang_2.Branch1)  # -> flatten(Result)
mjoin_2 = MeshJoin(Meshes=merge_7)
weldvertices_2 = MeshWeldVertices(Mesh=mjoin_2, Tolerance=0.01)  # -> RuntimeMessage, Mesh

geometry_pipeline_4 = GeometryPipeline(
    GroupByLayer=False,
    GroupByType=False,
    IncludeHidden=True,
    IncludeLocked=True,
    LayerFilter="stiff area",
    NameFilter="*",
    SublayerFiltering=True,
    TypeFilter=1073741848)
list_item_2 = ListItem(List=merge_7, Index=0, Wrap=True)  # -> Item, Item1
demesh_6 = DeconstructMesh(Mesh=list_item_2.Item1)  # -> Vertices, Faces, Colours, Normals
demesh_7 = DeconstructMesh(Mesh=list_item_2.Item)  # -> Vertices, Faces, Colours, Normals
point_in_breps_5 = PointInBreps(Brep=geometry_pipeline_4, Point=demesh_7.Vertices, Strict=False)  # -> Inside, Index
point_in_breps_6 = PointInBreps(Brep=geometry_pipeline_4, Point=demesh_6.Vertices, Strict=False)  # -> Inside, Index
dispatch_6 = Dispatch(List=demesh_6.Vertices, DispatchPattern=point_in_breps_6.Inside)  # -> ListA, ListB
dispatch_7 = Dispatch(List=demesh_7.Vertices, DispatchPattern=point_in_breps_5.Inside)  # -> ListA, ListB

geometry_pipeline_5 = GeometryPipeline(
    GroupByLayer=False,
    GroupByType=False,
    IncludeHidden=True,
    IncludeLocked=True,
    LayerFilter="anchor",
    NameFilter="*",
    SublayerFiltering=True,
    TypeFilter=1073741848)
point_in_breps_7 = PointInBreps(Brep=geometry_pipeline_5, Point=duppt_2, Strict=False)  # -> Inside, Index
cull_pattern_2 = CullPattern(List=duppt_2, CullPattern=point_in_breps_7.Inside)

medges_4 = MeshEdges(Mesh=mjoin_2)  # -> NakedEdges, InteriorEdges, NonManifoldEdges
merge_8 = Merge(Data1=medges_4.NakedEdges, Data2=medges_4.InteriorEdges)
length_4 = Length(Curve=merge_8)
length_line_3 = LengthLine(Line=merge_8, Length=length_4, Strength=Slider(393, range=0..1000))

unit_z_4 = UnitZ(Factor=Slider(1.01, range=0..1.01))
load_4 = Load(Point=demesh_6.Vertices, ForceVector=unit_z_4)

demesh_8 = DeconstructMesh(Mesh=mjoin_2)  # -> Vertices, Faces, Colours, Normals
geometry_5 = Geometry(dispatch_6.ListB)
geometry_6 = Geometry(dispatch_7.ListB)

pressure_2 = Pressure(M=mjoin_2, Strength=Slider(0.275, range=0..1.1))

floor_2 = Floor(Strength=Slider(500, range=0..1000))
anchor_2 = Anchor(Point=cull_pattern_2, Strength=1000)
show_2 = Show(G=weldvertices_2.Mesh)
coincident_2 = Coincident(Point0=geometry_5, Point1=geometry_6, Strength=Slider(47, range=0..1000))
merge_9 = Merge(
    Data1=flatten(show_2),
    Data2=flatten(anchor_2),
    Data3=floor_2,
    Data4=flatten(load_4),
    Data5=coincident_2,
    Data6=flatten(length_line_3),
    Data7=pressure_2)
solver_2 = Solver(GoalObjects=merge_9, Reset=Button(), Threshold=1e-15, Tolerance=0.01, On=Toggle(False))  # -> I, V, O
mesh_2 = Mesh(solver_2.O)
weaverbird_s_catmull_clark_subdivision_2 = WeaverbirdsCatmullClarkSubdivision(MeshCurves=mesh_2, Level=1, SmoothNakedEdges=1)
medges_5 = MeshEdges(Mesh=weaverbird_s_catmull_clark_subdivision_2)  # -> NakedEdges, InteriorEdges, NonManifoldEdges
