# Grasshopper definition 200129_Channels on Blob_Using Millipede.gh (Grasshopper 1.0.7)
# plug-ins: Kangaroo Components, Millipede, Weaverbird

# I was trying to create channels on a Blob
# informed by the stress lines.
# 
# First, the brep is mesh and remesh to achieve equal length edges.
# 
# Then, the mesh is baked and fed into the millipede.
# 
# The stress lines are converted into pseudo
# channels looking lines using millipede.
# 
# They look promising but the lines are broken.
# Furthermore, analysis not set up correctly.
# 
# Could be used again in the future. looks promising.
brep = Brep(<brep referenced from the Rhino model>)
mesh = Mesh()

settings_custom = SettingsCustom(
    StitchSeams=True,
    SimplePlanes=False,
    Refine=True,
    MinCount=16,
    MaxCount=400,
    AspectRatio=20,
    MaxDistance=0,
    MaxAngle=20,
    MinEdge=0,
    MaxEdge=Slider(1, range=0..1))
mesh_brep = MeshBrep(Brep=brep, Settings=settings_custom)
weaverbird_s_loop_subdivision = WeaverbirdsLoopSubdivision(MeshCurves=mesh_brep, Level=1, SmoothNakedEdges=1)

mesh_join = MeshJoin(Meshes=flatten(mesh))
weld_mesh = WeldMesh(Mesh=mesh_join, Angle=3.141592654)
deconstruct_mesh = DeconstructMesh(Mesh=weld_mesh)  # -> Vertices, Faces, Colours, Normals

weaverbird_s_naked_boundary = WeaverbirdsNakedBoundary(MeshClosedPolylines=weld_mesh)
explode = Explode(Curve=weaverbird_s_naked_boundary, Recursive=True)  # -> Segments, Vertices
removeduplicatepts = RemoveDuplicatePts(Points=flatten(deconstruct_mesh.Vertices), Tolerance=0.01)
geometry = Geometry(removeduplicatepts)

timer = Timer(TimerInterval=50, Target=remesh)  # disabled
remesh = ReMesh(
    InitialMesh=weaverbird_s_loop_subdivision,
    EdgeLength=Slider(0.2, range=0..1),
    Tolerance=0.1,
    PullStrength=1,
    TargetMesh=weaverbird_s_loop_subdivision,
    Reset=Toggle(False))  # -> ReMesh, Iterations

deconstruct = Deconstruct(Point=geometry)  # -> XComponent, YComponent, ZComponent
evaluate = Evaluate(Expression="x>0.1", x=deconstruct.ZComponent)
dispatch = Dispatch(List=geometry, DispatchPattern=evaluate)  # -> ListA, ListB
geometry_2 = Geometry(dispatch.ListA)
geometry_3 = Geometry(dispatch.ListB)

deconstruct_2 = Deconstruct(Point=explode.Vertices)  # -> XComponent, YComponent, ZComponent
evaluate_2 = Evaluate(Expression="x>0.1", x=deconstruct_2.ZComponent)
dispatch_2 = Dispatch(List=explode.Vertices, DispatchPattern=evaluate_2)  # -> ListA, ListB
geometry_4 = Geometry(dispatch_2.ListA)
geometry_5 = Geometry(dispatch_2.ListB)

mesh_edges = MeshEdges(Mesh=remesh.ReMesh)  # -> NakedEdges, InteriorEdges, NonManifoldEdges

# ----
# Anchors
brep_2 = Brep([<brep referenced from the Rhino model> x5])
point_in_breps = PointInBreps(Brep=brep_2, Point=geometry_3, Strict=False)  # -> Inside, Index

cull_pattern = CullPattern(List=geometry_3, CullPattern=point_in_breps.Inside)

# ----
# press repeatedly on the "step" button until a shape emerges
panel = Panel("analysis and optimization")
toggle = BooleanToggle(True)
mat = Material(MaterialType=2)
Z = UnitZ(Factor=Slider(-300, range=-10000..1))
mat_2 = MillC_StockSupportType(X=True, Y=True, Z=True, RX=toggle, RY=toggle, RZ=toggle)
femesh = FEMesh(Meshes=weld_mesh, Material=mat, Thickness=Slider(0.25, range=0..1), AreaLoad=Vector(0, 0, 0), NormalAreaLoad=0)
fepointsupports = FEPointSupports(Point=cull_pattern, SupportType=mat_2)
fepointload = FEPointLoad(Point=geometry_2, Load=Z)
selfweight = Slider(1, range=0..1)
optimization_steps = Slider(3, range=0..5)
fea_system = FEASystem(
    ModelComponents=flatten([femesh, fepointsupports, fepointload]),
    IntersectAddedCurves=True,
    MergeTolerance=0.0001,
    MinimumCurveSpan=0.05,
    MaximumCurveSpan=10000,
    CurveTolerance=0.1)
fe_solver = FESolver(
    FEModel=fea_system,
    SelfWeightCoefficient=selfweight,
    BeamOptimisationIterations=0,
    QuadOptimisationIterations=optimization_steps,
    OptimizationTarget=0.3,
    OptimizationPenalization=1.5,
    LoadCase=0,
    AllCases=True)  # -> FEModel, MaxDeflection, Weight

Z_2 = UnitZ(Factor=Slider(-800, range=-10000..1))
fepointload_2 = FEPointLoad(Point=geometry_4, Load=Z_2)

panel_2 = Panel("visualization")
division = Division(A=Slider(0, range=0..101), B=fe_solver.MaxDeflection)
mesh_visualization = MeshVisualization(FEModel=fe_solver.FEModel, Deflection=division, Plane=1, ShowThickness=Toggle(False), ColorMode=8)  # -> Mesh, CompleteRange, VisibleRange

# ----
# Channel looking patterns are created here
slider = Slider(4.83, range=0..5)
stress_pattern = StressPattern(
    FEModel=fe_solver.FEModel,
    Omega=slider,
    Scalefield=Toggle(True),
    Uselambda=Toggle(False),
    Smoothfactor=Slider(0, range=0..1),
    SmoothModulo=1,
    Iterations=Slider(1666, range=0..5000),
    MeshDenisty=Slider(1, range=0..5),
    Layer=1,
    Thickness=0,
    Bending=Toggle(False))
crv = Curve([<curve referenced from the Rhino model> x4])
pattern = Pattern(System=stress_pattern, Pattern=crv)  # -> Patterns, PatternPoints

number_slider = Slider(0, range=0..0.31)
negative = Negative(Value=number_slider)

quad_results = QuadResults(FEModel=fe_solver.FEModel, Plane=1)  # -> PrincipalStressFrame, Area, NormalDisplacement, MaxVonMisesStress, PS1, PS2, StiffnessMultiplier, Bending
stresslines = StressLines(FEModel=fe_solver.FEModel, Points=quad_results.PrincipalStressFrame, Plane=1)  # -> Stress1, Stress2
preview = CustomPreview(Geometry=stresslines.Stress1, Shader=ColourSwatch(SwatchColor=RGB(0, 0, 0)))

c_script = CSharpScript(m=mesh_visualization.Mesh, dh=negative)  # -> out, A; inputs m: Mesh, dh: Double
# ---------- c_script: C# usings ----------
using System.IO;
using System.Linq;
using System.Data;
using System.Drawing;
using System.Reflection;
using System.Windows.Forms;
using System.Xml;
using System.Xml.Linq;
using System.Runtime.InteropServices;

using Rhino.DocObjects;
using Rhino.Collections;
using GH_IO;
using GH_IO.Serialization;
# ---------- c_script: C# ----------
    m.FaceNormals.ComputeFaceNormals();
    m.Normals.ComputeNormals();

    for(int i = 0; i < m.Vertices.Count; ++i) {
      Point3d p = new Point3d(m.Vertices[i]);
      Vector3d n = new Vector3d(m.Normals[i]);

      m.Vertices.SetVertex(i, p + n * dh * m.TextureCoordinates[i].X);
    }

    m.VertexColors.Clear();

    m.FaceNormals.ComputeFaceNormals();
    m.Normals.ComputeNormals();


    A = m;
# ---------- end c_script ----------

panel_3 = Panel("visualization of thickness")
c_script_2 = CSharpScript(m=mesh_visualization.Mesh, dh=number_slider)  # -> out, A; inputs m: Mesh, dh: Double
# ---------- c_script_2: C# ----------
    m.FaceNormals.ComputeFaceNormals();
    m.Normals.ComputeNormals();

    for(int i = 0; i < m.Vertices.Count; ++i) {
      Point3d p = new Point3d(m.Vertices[i]);
      Vector3d n = new Vector3d(m.Normals[i]);

      m.Vertices.SetVertex(i, p + n * dh * m.TextureCoordinates[i].X);
    }

    //m.VertexColors.Clear();

    m.FaceNormals.ComputeFaceNormals();
    m.Normals.ComputeNormals();


    A = m;
# ---------- end c_script_2 ----------
preview_2 = CustomPreview(Geometry=[c_script.A, c_script_2.A], Shader=ColourSwatch(SwatchColor=RGB(255, 255, 255)))

join_curves = JoinCurves(Curves=pattern.Patterns, Preserve=False)
deconstruct_mesh_2 = DeconstructMesh(Mesh=c_script_2.A)  # -> Vertices, Faces, Colours, Normals
discontinuity = Discontinuity(Curve=join_curves, Level=1)  # -> Points, Parameters
interpolate = Interpolate(Vertices=discontinuity.Points, Degree=3, Periodic=False, KnotStyle=1)  # -> Curve, Length, Domain
