# Grasshopper definition 200129_Controlled Inflation_Using Coincidental.gh (Grasshopper 1.0.7)
# plug-ins: MeshEdit Components, Kangaroo Components, Weaverbird, Kangaroo2 Components

# ----
# I was trying to create channels by using curves
# as markers over an inflatable using the component [COINCIDENTAL] from kangaroo
# Only areas near the curves will be inflated.
# 
# However I failed to increase the complexity of it.
# Also, areas that are not supposed to inflate
# gets very wobbly and jerky because
# forces are constantly pushing it to inflate from
# inside but the the contraint is resisting it. resulting in instability
surface = Surface(<surface referenced from the Rhino model>)

# ----
# Attempt 2
surface_2 = Surface(<surface referenced from the Rhino model>)
mesh_surface = MeshSurface(Surface=surface_2, UCount=Slider(26, range=0..100), VCount=Slider(38, range=0..100), Overhang=True, Equalize=False)
mesh_edges = MeshEdges(Mesh=mesh_surface)  # -> NakedEdges, InteriorEdges, NonManifoldEdges
mesh_surface_2 = MeshSurface(Surface=surface, UCount=Slider(26, range=0..100), VCount=Slider(38, range=0..100), Overhang=True, Equalize=False)

mesh = Mesh(mesh_surface_2)
mesh_edges_2 = MeshEdges(Mesh=mesh)  # -> NakedEdges, InteriorEdges, NonManifoldEdges
demesh = DeconstructMesh(Mesh=mesh)  # -> Vertices, Faces, Colours, Normals

mesh_2 = Mesh(mesh_surface)

mesh_edges_3 = MeshEdges(Mesh=mesh_2)  # -> NakedEdges, InteriorEdges, NonManifoldEdges
demesh_2 = DeconstructMesh(Mesh=mesh_2)  # -> Vertices, Faces, Colours, Normals

join = JoinCurves(Curves=mesh_edges_3.NakedEdges, Preserve=False)
cp = ControlPoints(Curve=join)  # -> Points, Weights, Knots
duppt = RemoveDuplicatePts(Points=flatten(cp.Points), Tolerance=0.01)

cp_2 = ClosestPoint(Point=demesh_2.Vertices, Cloud=duppt)  # -> ClosestPoint, CPIndex, Distance
larger = LargerThan(FirstNumber=cp_2.Distance, SecondNumber=Slider(0, range=0..101))  # -> LargerThan, OrEqualTo
dispatch = Dispatch(List=demesh_2.Vertices, DispatchPattern=larger.LargerThan)  # -> ListA, ListB

number_slider = Slider(20, range=0..121)
neg = Negative(Value=number_slider)
merge = Merge(Data1=neg, Data2=number_slider)  # -> graft(Result)
mesh_closest_point = MeshClosestPoint(Point=dispatch.ListA, Mesh=mesh_2)  # -> Point, Index, Parameter
mesh_eval = MeshEval(Mesh=mesh_2, Parameter=mesh_closest_point.Parameter)  # -> Point, Normal, Colour
amplitude = Amplitude(Vector=mesh_eval.Normal, Amplitude=merge)
move = Move(Geometry=dispatch.ListA, Motion=amplitude)  # -> simplify(Geometry), Transform

geometry_pipeline = GeometryPipeline(
    GroupByLayer=False,
    GroupByType=False,
    IncludeHidden=True,
    IncludeLocked=True,
    LayerFilter="Channels",
    NameFilter="*",
    SublayerFiltering=True,
    TypeFilter=4)

join_2 = JoinCurves(Curves=mesh_edges_2.NakedEdges, Preserve=False)
cp_3 = ControlPoints(Curve=join_2)  # -> Points, Weights, Knots
duppt_2 = RemoveDuplicatePts(Points=flatten(cp_3.Points), Tolerance=0.01)

geometry_pipeline_2 = GeometryPipeline(
    GroupByLayer=False,
    GroupByType=False,
    IncludeHidden=True,
    IncludeLocked=True,
    LayerFilter="Channels",
    NameFilter="*",
    SublayerFiltering=True,
    TypeFilter=4)

cp_4 = ClosestPoint(Point=demesh.Vertices, Cloud=duppt_2)  # -> ClosestPoint, CPIndex, Distance
larger_2 = LargerThan(FirstNumber=cp_4.Distance, SecondNumber=Slider(0, range=0..101))  # -> LargerThan, OrEqualTo
dispatch_2 = Dispatch(List=demesh.Vertices, DispatchPattern=larger_2.LargerThan)  # -> ListA, ListB

number_slider_2 = Slider(20, range=0..121)
neg_2 = Negative(Value=number_slider_2)
merge_2 = Merge(Data1=neg_2, Data2=number_slider_2)  # -> graft(Result)
mesh_closest_point_2 = MeshClosestPoint(Point=dispatch_2.ListA, Mesh=mesh)  # -> Point, Index, Parameter
mesh_eval_2 = MeshEval(Mesh=mesh, Parameter=mesh_closest_point_2.Parameter)  # -> Point, Normal, Colour
amplitude_2 = Amplitude(Vector=mesh_eval_2.Normal, Amplitude=merge_2)
move_2 = Move(Geometry=dispatch_2.ListA, Motion=amplitude_2)  # -> simplify(Geometry), Transform

weave = Weave(Pattern=larger.LargerThan, Stream0=dispatch.ListB, Stream1=move.Geometry, NullGaps=False)  # -> simplify(Weave)
conmesh = ConstructMesh(Vertices=weave, Faces=demesh_2.Faces)  # -> simplify(Mesh)
bang = ExplodeTree(Data=conmesh)  # -> Branch0, Branch1
flip = MeshFlip(Mesh=bang.Branch0)
merge_3 = Merge(Data1=flip, Data2=bang.Branch1)  # -> flatten(Result)
mjoin = MeshJoin(Meshes=merge_3)
mesh_unifynormals = MeshUnifyNormals(Mesh=mjoin)
weldvertices = MeshWeldVertices(Mesh=mesh_unifynormals, Tolerance=0.01)  # -> RuntimeMessage, Mesh

pipe = Pipe(Curve=geometry_pipeline, Radius=Slider(100, range=0..100), Caps=1)  # -> flatten(Pipe)

pipe_2 = Pipe(Curve=geometry_pipeline_2, Radius=Slider(40, range=0..100), Caps=1)  # -> flatten(Pipe)

geometry = Geometry(dispatch.ListA)
point_in_breps = PointInBreps(Brep=pipe, Point=geometry, Strict=False)  # -> Inside, Index

geometry_2 = Geometry(dispatch_2.ListA)
point_in_breps_2 = PointInBreps(Brep=pipe_2, Point=geometry_2, Strict=False)  # -> Inside, Index

weave_2 = Weave(Pattern=larger_2.LargerThan, Stream0=dispatch_2.ListB, Stream1=move_2.Geometry, NullGaps=False)  # -> simplify(Weave)
conmesh_2 = ConstructMesh(Vertices=weave_2, Faces=demesh.Faces)  # -> simplify(Mesh)
bang_2 = ExplodeTree(Data=conmesh_2)  # -> Branch0, Branch1
flip_2 = MeshFlip(Mesh=bang_2.Branch0)
merge_4 = Merge(Data1=flip_2, Data2=bang_2.Branch1)  # -> flatten(Result)
mjoin_2 = MeshJoin(Meshes=merge_4)
mesh_unifynormals_2 = MeshUnifyNormals(Mesh=mjoin_2)
weldvertices_2 = MeshWeldVertices(Mesh=mesh_unifynormals_2, Tolerance=0.01)  # -> RuntimeMessage, Mesh

list_item = ListItem(List=merge_3, Index=0, Wrap=True)  # -> Item, Item1
geometry_3 = Geometry(list_item.Item1)
geometry_4 = Geometry(list_item.Item)
mesh_edges_4 = MeshEdges(Mesh=geometry_3)  # -> NakedEdges, InteriorEdges, NonManifoldEdges
mesh_edges_5 = MeshEdges(Mesh=geometry_4)  # -> NakedEdges, InteriorEdges, NonManifoldEdges
geometry_5 = Geometry(flatten([mesh_edges_5.InteriorEdges, mesh_edges_5.NakedEdges]))
geometry_6 = Geometry(flatten([mesh_edges_4.NakedEdges, mesh_edges_4.InteriorEdges]))
point_on_curve = PointOnCurve(geometry_6, parameter=0.5)
point_on_curve_2 = PointOnCurve(geometry_5, parameter=0.5)

geometry_7 = Geometry(weldvertices_2.Mesh)
mesh_edges_6 = MeshEdges(Mesh=geometry_7)  # -> NakedEdges, InteriorEdges, NonManifoldEdges
geometry_8 = Geometry(flatten([mesh_edges_6.NakedEdges, mesh_edges_6.InteriorEdges]))
point_on_curve_3 = PointOnCurve(geometry_8, parameter=0.5)
point_in_breps_3 = PointInBreps(Brep=pipe_2, Point=point_on_curve_3, Strict=False)  # -> Inside, Index
dispatch_3 = Dispatch(List=geometry_8, DispatchPattern=point_in_breps_3.Inside)  # -> ListA, ListB
geometry_9 = Geometry(dispatch_3.ListA)
geometry_10 = Geometry(dispatch_3.ListB)

point_in_breps_4 = PointInBreps(Brep=pipe, Point=point_on_curve, Strict=False)  # -> Inside, Index
point_in_breps_5 = PointInBreps(Brep=pipe, Point=point_on_curve_2, Strict=False)  # -> Inside, Index
list_item_2 = ListItem(List=merge_4, Index=0, Wrap=True)  # -> Item, Item1
demesh_3 = DeconstructMesh(Mesh=weldvertices.Mesh)  # -> Vertices, Faces, Colours, Normals

demesh_4 = DeconstructMesh(Mesh=list_item.Item)  # -> Vertices, Faces, Colours, Normals
dispatch_4 = Dispatch(List=demesh_4.Vertices, DispatchPattern=larger.LargerThan)  # -> ListA, ListB
dispatch_5 = Dispatch(List=dispatch_4.ListA, DispatchPattern=point_in_breps.Inside)  # -> ListA, ListB

demesh_5 = DeconstructMesh(Mesh=list_item.Item1)  # -> Vertices, Faces, Colours, Normals
dispatch_6 = Dispatch(List=demesh_5.Vertices, DispatchPattern=larger.LargerThan)  # -> ListA, ListB
dispatch_7 = Dispatch(List=dispatch_6.ListA, DispatchPattern=point_in_breps.Inside)  # -> ListA, ListB

dispatch_8 = Dispatch(List=geometry_6, DispatchPattern=point_in_breps_4.Inside)  # -> ListA, ListB
dispatch_9 = Dispatch(List=geometry_5, DispatchPattern=point_in_breps_5.Inside)  # -> ListA, ListB

demesh_6 = DeconstructMesh(Mesh=list_item_2.Item)  # -> Vertices, Faces, Colours, Normals
dispatch_10 = Dispatch(List=demesh_6.Vertices, DispatchPattern=larger_2.LargerThan)  # -> ListA, ListB
dispatch_11 = Dispatch(List=dispatch_10.ListA, DispatchPattern=point_in_breps_2.Inside)  # -> ListA, ListB

demesh_7 = DeconstructMesh(Mesh=list_item_2.Item1)  # -> Vertices, Faces, Colours, Normals
dispatch_12 = Dispatch(List=demesh_7.Vertices, DispatchPattern=larger_2.LargerThan)  # -> ListA, ListB
dispatch_13 = Dispatch(List=dispatch_12.ListA, DispatchPattern=point_in_breps_2.Inside)  # -> ListA, ListB

geometry_11 = Geometry(dispatch_8.ListA)
geometry_12 = Geometry(dispatch_9.ListA)
geometry_13 = Geometry(dispatch_9.ListB)
geometry_14 = Geometry(dispatch_8.ListB)
curve = Curve(flatten([geometry_11, geometry_14, geometry_13]))
geometry_15 = Geometry(dispatch_5.ListA)
geometry_16 = Geometry(flatten(geometry_12))

geometry_pipeline_3 = GeometryPipeline(
    GroupByLayer=False,
    GroupByType=False,
    IncludeHidden=True,
    IncludeLocked=True,
    LayerFilter="anchor",
    NameFilter="*",
    SublayerFiltering=True,
    TypeFilter=1073741848)
point_in_breps_6 = PointInBreps(Brep=geometry_pipeline_3, Point=duppt, Strict=False)  # -> Inside, Index
cull_pattern = CullPattern(List=duppt, CullPattern=point_in_breps_6.Inside)

unit_z = UnitZ(Factor=expr("-x", Slider(40.318, range=0..50)))
load = Load(Point=demesh_3.Vertices, ForceVector=unit_z)

length = Length(Curve=geometry_16)

geometry_pipeline_4 = GeometryPipeline(
    GroupByLayer=False,
    GroupByType=False,
    IncludeHidden=True,
    IncludeLocked=True,
    LayerFilter="anchor",
    NameFilter="*",
    SublayerFiltering=True,
    TypeFilter=1073741848)
point_in_breps_7 = PointInBreps(Brep=geometry_pipeline_4, Point=duppt_2, Strict=False)  # -> Inside, Index
cull_pattern_2 = CullPattern(List=duppt_2, CullPattern=point_in_breps_7.Inside)

length_2 = Length(Curve=geometry_10)
multiplication = Multiplication(A=length_2, B=Slider(1, range=0..1))
clamplength = ClampLength(Line=geometry_10, LowerLimit=multiplication, UpperLimit=multiplication, Strength=Slider(500, range=0..1000))

unit_z_2 = UnitZ(Factor=Slider(1.01, range=0..1.01))
load_2 = Load(Point=demesh_7.Vertices, ForceVector=unit_z_2)

anchor = Anchor(Point=cull_pattern, Strength=Slider(50000, range=0..100000))

spherecollide = SphereCollide(Points=demesh_3.Vertices, Radius=Slider(10, range=0..100), Strength=Slider(500, range=0..1000))

floor = Floor(Strength=Slider(500, range=0..1000))

deconstruct_mesh = DeconstructMesh(Mesh=weldvertices_2.Mesh)  # -> Vertices, Faces, Colours, Normals

pressure = Pressure(M=weldvertices.Mesh, Strength=Slider(0.187, range=0..1.1))

multiplication_2 = Multiplication(A=length, B=Slider(0.3, range=0..1))

geometry_17 = Geometry(dispatch_5.ListB)
geometry_18 = Geometry(dispatch_7.ListB)

coincident = Coincident(Point0=geometry_18, Point1=geometry_17, Strength=Slider(1000, range=0..1000))

length_3 = Length(Curve=curve)

anchor_2 = Anchor(Point=cull_pattern_2, Strength=Slider(50000, range=0..100000))

curve_2 = Curve(flatten([geometry_9, geometry_10]))
length_4 = Length(Curve=curve_2)
length_line = LengthLine(Line=curve_2, Length=length_4, Strength=Slider(896, range=0..1000))

floor_2 = Floor(Strength=Slider(500, range=0..1000))

spherecollide_2 = SphereCollide(Points=deconstruct_mesh.Vertices, Radius=Slider(17, range=0..100), Strength=Slider(668, range=0..1000))

geometry_19 = Geometry(dispatch_11.ListB)
geometry_20 = Geometry(dispatch_13.ListB)

length_line_2 = LengthLine(Line=curve, Length=length_3, Strength=Slider(8326, range=0..101000))
show = Show(G=weldvertices.Mesh)
clamplength_2 = ClampLength(Line=geometry_16, LowerLimit=multiplication_2, UpperLimit=multiplication_2, Strength=Slider(1000, range=0..1000))
edgelengths = EdgeLengths(Mesh=weldvertices.Mesh, LengthFactor=1, Strength=Slider(500, range=0..1000))
coincident_2 = Coincident(Point0=geometry_20, Point1=geometry_19, Strength=Slider(504, range=0..1000))
show_2 = Show(G=weldvertices_2.Mesh)
merge_5 = Merge(
    Data1=flatten(show),
    Data2=flatten(anchor),
    Data4=flatten(length_line_2),
    Data5=pressure,
    Data6=floor,
    Data7=clamplength_2,
    Data8=edgelengths,
    Data9=coincident)
solver = Solver(GoalObjects=merge_5, Reset=Button(), Threshold=1e-15, Tolerance=0.01, On=Toggle(False))  # -> I, V, O
merge_6 = Merge(
    Data1=flatten(show_2),
    Data2=flatten(anchor_2),
    Data3=spherecollide_2,
    Data4=flatten(length_line),
    Data6=floor_2,
    Data7=coincident_2)
solver_2 = Solver(GoalObjects=merge_6, Reset=Button(), Threshold=1e-15, Tolerance=0.01, On=Toggle(False))  # -> I, V, O
mesh_3 = Mesh(solver.O)
weaverbird_s_catmull_clark_subdivision = WeaverbirdsCatmullClarkSubdivision(MeshCurves=mesh_3, Level=Slider(1, range=0..10), SmoothNakedEdges=1)
mesh_4 = Mesh(solver_2.O)
medges = MeshEdges(Mesh=weaverbird_s_catmull_clark_subdivision)  # -> NakedEdges, InteriorEdges, NonManifoldEdges
custom_preview = CustomPreview(Geometry=weaverbird_s_catmull_clark_subdivision, Material=ColourSwatch(SwatchColor=RGB(255, 255, 255)))
weaverbird_s_catmull_clark_subdivision_2 = WeaverbirdsCatmullClarkSubdivision(MeshCurves=mesh_4, Level=Slider(1, range=0..10), SmoothNakedEdges=1)
medges_2 = MeshEdges(Mesh=weaverbird_s_catmull_clark_subdivision_2)  # -> NakedEdges, InteriorEdges, NonManifoldEdges
custom_preview_2 = CustomPreview(Geometry=weaverbird_s_catmull_clark_subdivision_2, Material=ColourSwatch(SwatchColor=RGB(255, 255, 255)))
