# Grasshopper definition 200130_Channels Creation_on Global Geometry(Manual).gh (Grasshopper 1.0.7)
# plug-ins: Nursery

# Manual tracing/simplifying/rationalising
# of the stress lines and try to make
# mesh pipes from them.
# The idea was to then relax, and try to do
# inflation simulation with them.
# Didn't get far. forgot why. but looks promising tho.
# Mesh Pipe from plugin call Nursery. Agent based simulation plugin totally useless.
curve = Curve([<curve referenced from the Rhino model> x25])
rebuild_curve = RebuildCurve(Curve=curve, Degree=Slider(3, range=0..10), Count=Slider(16, range=0..100), Tangents=False)
divide_length = DivideLength(Curve=rebuild_curve, Length=Slider(200, range=0..1000))  # -> Points, Tangents, Parameters
polyline = PolyLine(Vertices=divide_length.Points, Closed=False)
mesh_pipe = MeshPipe(
    Curve=polyline,
    NumberOfSections=Slider(10, range=0..100),
    Radius=Slider(75, range=0..100),
    NumberOfSides=Slider(7, range=0..10))
mesh_edges = MeshEdges(Mesh=mesh_pipe)  # -> NakedEdges, InteriorEdges, NonManifoldEdges
