# Grasshopper definition 200210_Controlled Inflation_Yulia Thesis Attempt_1.gh (Grasshopper 1.0.7)
# plug-ins: Pufferfish, Kangaroo Components, Kangaroo2 Components

brep = Brep(<brep referenced from the Rhino model>)
geometry = Geometry([<point referenced from the Rhino model> x2306])
# Step2.5: correlate curvature to flatten sheet
point = Point([<point referenced from the Rhino model> x2306])

# ----
# First Attempt to replicate Yulia's thesis
# 
# tried to vary stiffness to shape with pneumatic.
# The strategy is to get curvature from geometry,
# remap the curvature into stiffness(springs),
# apply air pressure and hope that it
# shapes into what it should be. But it didnt work.
# Step1: Rebuild curve
curve = Curve(<curve referenced from the Rhino model>)
rebuild_curve = RebuildCurve(Curve=curve, Count=Slider(10, range=0..10), Degree=Slider(3, range=0..10), EndTangents=False)
pipe = Pipe(Curve=rebuild_curve, Radius=Slider(0.1, range=0..1), Caps=0)
c_script = CSharpScript(x=pipe)  # -> out, A; inputs x: Brep
# ---------- c_script: C# ----------
    Unroller unroll = new Unroller(x);
    
    int b = unroll.PerformUnroll(unrolled);
    A = b;
# ---------- c_script: C# additional code ----------
  //Brep[] unrolled = new Brep[1];
  List<Brep> unrolled = new List<Brep>();
# ---------- end c_script ----------
panel = Panel(c_script.A)

# ----
# Step2: Squish and get Points + flatten sheet
# Step2: Analyse Cruvature at Points
toggle = BooleanToggle(False)
guid = Guid(brep)
python = PythonScript(ids=guid, squish=toggle)  # -> out, a; inputs ids: list, squish: Boolean; disabled
# ---------- python: Python ----------
import rhinoscriptsyntax as rs
import scriptcontext as sc
import Rhino

if squish:
    sc.doc = Rhino.RhinoDoc.ActiveDoc
    rs.EnableRedraw(False)
    for i,id in enumerate(ids):
        rs.Command("_-Squish _SelId %s _Decorate=Yes _Enter _Enter" % id)
        squishedId = rs.FirstObject()
        squishedIdMoved = rs.MoveObject(squishedId, [i*20,0,0])
    groupNames = rs.GroupNames()
    groupIndices = []
    for k in range(i+1):
        groupIndices.append(-((k+1)*2))
    groupIndices.reverse()
    for j,index in enumerate(groupIndices):
        ptCloudGroupName = groupNames[index]
        rs.Command("_-SelGroup %s " % ptCloudGroupName)
        rs.Command("_-Move 0,0,0 %s,0,0 " % j*20)
        rs.Command("_-SelNone ")
    rs.EnableRedraw(True)
    sc.doc = ghdoc
# ---------- end python ----------

surface_closest_point = SurfaceClosestPoint(Point=point, Surface=reparameterize(brep))  # -> Point, UVPoint, Distance
entwine = Entwine(Branch00=point, Branch01=geometry, FlattenInputs=True)
surface_curvature = SurfaceCurvature(Surface=reparameterize(brep), Point=surface_closest_point.UVPoint)  # -> Frame, Gaussian, Mean
list_item = ListItem(List=entwine, Index=Slider(277, range=0..1200), Wrap=True)
bounds = Bounds(Numbers=surface_curvature.Gaussian)
geometry_2 = Geometry(surface_curvature.Frame)
deconstruct_domain = DeconstructDomain(Domain=bounds)  # -> Start, End
panel_2 = Panel(surface_curvature.Gaussian)
gradient = Gradient(
    LowerLimit=deconstruct_domain.Start,
    UpperLimit=deconstruct_domain.End,
    Parameter=surface_curvature.Gaussian,
    stops=[0: RGB(234, 38, 0), 0.25: RGB(234, 126, 0), 0.5: RGB(254, 244, 84), 0.75: RGB(173, 203, 249), 1: RGB(75, 107, 169)])

delaunay_mesh = DelaunayMesh(Points=geometry, Plane=PlaneXY(0, 0, 0))
face_boundaries = FaceBoundaries(Mesh=delaunay_mesh)
area = Area(Geometry=face_boundaries)  # -> Area, Centroid
cluster = Cluster(start=area.Centroid)
surface = Surface(<surface referenced from the Rhino model>)
geometry_3 = Geometry(cluster)
collision_one_many = CollisionOneMany(Collider=geometry_3, Obstacles=surface)  # -> Collision, Index
deconstruct_mesh = DeconstructMesh(Mesh=delaunay_mesh)  # -> Vertices, Faces, Colours, Normals
cull_pattern = CullPattern(List=deconstruct_mesh.Faces, CullPattern=collision_one_many.Collision)
construct_mesh = ConstructMesh(Vertices=deconstruct_mesh.Vertices, Faces=cull_pattern, Colours=gradient)
weld_mesh = WeldMesh(Mesh=construct_mesh, Angle=3.141592654)

geometry_4 = Geometry(<brep referenced from the Rhino model>)
mesh = Mesh(<mesh referenced from the Rhino model>)
mesh_edges = MeshEdges(Mesh=mesh)  # -> NakedEdges, InteriorEdges, NonManifoldEdges
deconstruct_mesh_2 = DeconstructMesh(Mesh=mesh)  # -> Vertices, Faces, Colours, Normals

pi = Pi(Factor=1)
multiplication = Multiplication(A=Slider(2, range=0..10), B=pi)
number_slider = Slider(32, range=0..100)
division = Division(A=Slider(579, range=0..1000), B=multiplication)
curve_2 = Curve(<curve referenced from the Rhino model>)
pipe_2 = Pipe(Curve=curve_2, Radius=division, Caps=0)
evaluate_surface = EvaluateSurface(Surface=reparameterize(pipe_2), Point=surface_closest_point.UVPoint)  # -> Point, Normal, UDirection, VDirection, Frame
point_2 = Point(evaluate_surface.Point)
custom_preview = CustomPreview(Geometry=point_2, Material=deconstruct_mesh_2.Colours)

mesh_surface = MeshSurface(Surface=pipe_2, UCount=Slider(100, range=0..100), VCount=Slider(32, range=0..100), Overhang=True, Equalize=False)
mesh_caps = MeshCaps(M=mesh_surface, W=True, O=True, D=0)  # -> out, A, E; inputs M: Mesh, clr: Color
# ---------- mesh_caps: VB ----------
    Component.Params.Input(0).Name = "Mesh"
    Component.Params.Input(0).Description = "An open mesh"
    Component.Params.Input(1).Name = "Join and Weld"
    Component.Params.Input(1).Description = "If true the original mesh will be joined and welded to the new caps, else the caps will be output as a list of new meshes"
    Component.Params.Input(2).Name = "Simplify Faces"
    Component.Params.Input(2).Description = "If true, naked edges consisting of 3 to 4 segments will be replaced with a single face, else faces will use new center vertex method"
    Component.Params.Input(3).Name = "Distance (Optional, Rhino Units)"
    Component.Params.Input(3).Description = "A single number which sets the Rhino unit based distance that the center point will be offset from the vertex averages"

    Component.Params.Output(1).Name = "Mesh"
    Component.Params.Output(1).Description = "If successful, a list or single of valid meshes"
    Component.Params.Output(2).Name = "Polylines"
    Component.Params.Output(2).Description = "If successful, a list of valid edge polylines"

    If M IsNot Nothing Then
      Dim i,j,k,kk,ka As Integer
      Dim arrP() As polyline
      Dim P As polyline
      Dim arrM As New list(Of Mesh)
      Dim mj As New mesh
      Dim clrB,clrC,blnN() As Boolean
      Dim oc,tcc As New list(Of color)
      If (clr <> Nothing) Then clrC = True
      If ((m.VertexColors.count() > 0) Or (clr <> Nothing)) Then clrB = True
      If (m.VertexColors.count() = 0) Then  m.vertexcolors.CreateMonotoneMesh(color.LightGray)
      oc = m.VertexColors.ToArray.tolist()
      Dim mv() As point3d
      Dim mo As New list(Of mesh)
      Dim fc As New list(Of MeshFace)
      Dim np As New list(Of point3d)
      Dim ni As New list(Of Integer)
      Dim ind(3) As Integer

      mv = m.Vertices.ToPoint3dArray()
      blnN = m.GetNakedEdgePointStatus()
      arrP = m.GetNakedEdges()

      For i = 0 To ubound(blnN) Step 1
        If blnN(i) Then
          np.add(mv(i))
          ni.add(i)
        End If
      Next

      Dim cld As New pointcloud(np.toarray())
      For i = 0 To ubound(arrP) Step 1
        Dim tm As New mesh
        tm.Vertices.Clear()
        tm.Faces.Clear()

        p = arrP(i)
        If (O And (p.count() < 6)) Then
          ind(0) = ni(cld.ClosestPoint(p(0)))
          ind(1) = ni(cld.ClosestPoint(p(1)))
          ind(2) = ni(cld.ClosestPoint(p(2)))
          ind(3) = ni(cld.ClosestPoint(p(3)))
          tm.Vertices.Add(mv(ind(0)))
          tm.Vertices.Add(mv(ind(1)))
          tm.Vertices.Add(mv(ind(2)))

          tm.VertexColors.Add(oc(ind(0)))
          tm.VertexColors.Add(oc(ind(1)))
          tm.VertexColors.Add(oc(ind(2)))
          If p.count() = 5 Then
            fc.add(New meshface(ind(0), ind(1), ind(2), ind(3)))
            tm.Vertices.Add(mv(ind(3)))
            tm.VertexColors.Add(oc(ind(3)))
            tm.Faces.addface(New meshface(0, 1, 2, 3))
          ElseIf p.count() = 4 Then
            fc.add(New meshface(ind(0), ind(1), ind(2)))
            tm.Faces.addface(New meshface(0, 1, 2))
          End If
          tm.FaceNormals.ComputeFaceNormals()
          tm.Normals.ComputeNormals()
          mo.add(tm)

        Else
          Dim tx As New mesh
          Dim vec As New vector3d
          Dim tv As New list(Of point3d)
          Dim tc As New list(Of color)
          Dim tfc As New list(Of meshface)
          Dim r,g,b As Integer
          Dim tcl As color
          k = cld.ClosestPoint(p(0))
          ka = k
          tx.Vertices.AddVertices(p.ToArray())
          tx.Faces.AddFaces(p.TriangulateClosedPolyline())
          tx.Normals.ComputeNormals()

          vec = tx.Normals(0)

          tv.add(p(0))
          tc.add(oc(k))
          r = oc(ni(k)).R
          g = oc(ni(k)).G
          b = oc(ni(k)).B
          For j = 1 To p.count() - 2 Step 1
            kk = cld.ClosestPoint(p(j))
            fc.add(New meshface(m.Vertices.count(), ni(k), ni(kk)))
            vec += tx.Normals(j)
            k = kk

            tv.add(p(j))
            tc.add(oc(k))
            r += oc(ni(k)).R
            g += oc(ni(k)).G
            b += oc(ni(k)).B
            tfc.add(New meshface(p.count() - 1, j - 1, j))
          Next
          fc.add(New meshface(m.Vertices.count(), ni(k), ni(ka)))
          vec.Unitize()
          vec *= D
          m.Vertices.add(p.CenterPoint() + vec)

          r /= (p.count() - 1)
          g /= (p.count() - 1)
          b /= (p.count() - 1)
          If r > 255 Then r = 255 Else If r < 0 Then r = 0
          If g > 255 Then g = 255 Else If g < 0 Then g = 0
          If b > 255 Then b = 255 Else If b < 0 Then b = 0
          If clrC Then tcl = clr Else tcl = color.FromArgb(r, g, b)
          m.VertexColors.Add(tcl)

          tv.add(p.CenterPoint() + vec)
          tc.add(tcl)
          tfc.add(New meshface(p.count() - 1, p.count() - 2, 0))
          tm.vertices.AddVertices(tv.toarray())
          If clrB Then tm.VertexColors.AppendColors(tc.toarray())
          tm.faces.addfaces(tfc)
          tm.FaceNormals.ComputeFaceNormals()
          tm.Normals.ComputeNormals()
          mo.add(tm)
        End If
      Next

      If w Then
        m.Faces.AddFaces(fc)
        m.FaceNormals.ComputeFaceNormals()
        m.UnifyNormals()
        m.Normals.ComputeNormals()
        If Not clrB Then m.VertexColors.Clear()
        A = m
      Else
        A = mo
      End If
      E = arrP
    End If
# ---------- mesh_caps: VB additional code ----------
  Private Function avgC(ByVal R As Double, ByVal G As Double, ByVal B As Double, ByVal T As Integer)

    R /= t
    G /= t
    B /= t
    If R > 255 Then R = 255 Else If R < 0 Then R = 0
    If G > 255 Then G = 255 Else If G < 0 Then G = 0
    If B > 255 Then B = 255 Else If B < 0 Then B = 0

    Return color.FromArgb(CInt(R), CInt(G), CInt(B))
  End Function
# ---------- end mesh_caps ----------
deconstruct_brep = DeconstructBrep(Brep=pipe_2)  # -> Faces, Edges, Vertices
nakedvertices = NakedVertices(Mesh=mesh_caps.A)  # -> ClothedIndex, NakedIndex, ClothedPts, NakedPts
mesh_edges_2 = MeshEdges(Mesh=mesh_caps.A)  # -> NakedEdges, InteriorEdges, NonManifoldEdges
deconstruct_mesh_3 = DeconstructMesh(Mesh=mesh_caps.A)  # -> Vertices, Faces, Colours, Normals
list_item_2 = ListItem(List=deconstruct_brep.Edges, Index=0, Wrap=True)
geometry_5 = Geometry(nakedvertices.NakedPts)
geometry_6 = Geometry([mesh_edges_2.NakedEdges, mesh_edges_2.InteriorEdges])
pipe_3 = Pipe(Curve=list_item_2, Radius=Slider(14, range=0..100), Caps=1)
point_on_curve = PointOnCurve(geometry_6, parameter=0.5)
point_in_brep = PointInBrep(Brep=pipe_3, Point=geometry_5, Strict=False)
closest_points = ClosestPoints(Point=point_on_curve, Cloud=evaluate_surface.Point, Count=1)  # -> ClosestPoint, CPIndex, Distance
cull_pattern_2 = CullPattern(List=geometry_5, CullPattern=point_in_brep)

number_slider_2 = Slider(2, range=0..10)  # disabled
list_length = ListLength(List=cull_pattern_2)  # disabled
division_2 = Division(A=list_length, B=number_slider_2)  # disabled
number_slider_3 = Slider(50, range=0..50)  # disabled
partition_list = PartitionList(List=cull_pattern_2, Size=division_2)  # disabled
list_item_3 = ListItem(List=partition_list, Index=number_slider_3, Wrap=True)  # disabled

list_item_4 = ListItem(List=surface_curvature.Gaussian, Index=closest_points.CPIndex, Wrap=True)
face_boundaries_2 = FaceBoundaries(Mesh=mesh)
point_in_brep_2 = PointInBrep(Brep=geometry_4, Point=deconstruct_mesh_3.Vertices, Strict=False)
nakedvertices_2 = NakedVertices(Mesh=mesh)  # -> ClothedIndex, NakedIndex, ClothedPts, NakedPts
curve_3 = Curve([<curve referenced from the Rhino model> x2])
bounds_2 = Bounds(Numbers=flatten(list_item_4))
pipe_4 = Pipe(Curve=curve_3, Radius=Slider(3, range=0..100), Caps=1)
list_item_5 = ListItem(List=deconstruct_mesh_2.Colours, Index=closest_points.CPIndex, Wrap=True)
flatten_tree = FlattenTree(Tree=list_item_4, Path="{0}")
cull_pattern_3 = CullPattern(List=deconstruct_mesh_3.Vertices, CullPattern=point_in_brep_2)
custom_preview_2 = CustomPreview(Geometry=point, Material=gradient)
custom_preview_3 = CustomPreview(Geometry=geometry, Material=gradient)
mesh_edges_3 = MeshEdges(Mesh=weld_mesh)  # -> NakedEdges, InteriorEdges, NonManifoldEdges
geometry_7 = Geometry([mesh_edges.NakedEdges, mesh_edges.InteriorEdges])
geometry_8 = Geometry(nakedvertices_2.NakedPts)
colour = Colour(flatten(list_item_5))
point_in_brep_3 = PointInBrep(Brep=pipe_4, Point=geometry_8, Strict=False)
remap_numbers = RemapNumbers(Value=flatten_tree, Source=bounds_2, Target="0.9 to 1.10")  # -> Mapped, Clipped
coincident = Coincident(Strength=100)  # disabled
custom_preview_4 = CustomPreview(Geometry=face_boundaries_2, Material=deconstruct_mesh_2.Colours)
cull_pattern_4 = CullPattern(List=geometry_8, CullPattern=point_in_brep_3)
brep_2 = Brep(<brep referenced from the Rhino model>)
custom_preview_5 = CustomPreview(Geometry=geometry_6, Material=colour)
length = Length(Curve=geometry_6)
point_in_brep_4 = PointInBrep(Brep=brep_2, Point=geometry_5, Strict=False)

floor = Floor(Strength=Slider(500, range=0..1000))

explode_tree = ExplodeTree(Data=cull_pattern_4)  # -> Branch0, Branch1

anchor = Anchor(Point=cull_pattern_3, Strength=Slider(5000, range=0..10000))

line = Line(StartPoint=explode_tree.Branch0, EndPoint=explode_tree.Branch1)
multiplication_2 = Multiplication(A=length, B=remap_numbers.Mapped)
cull_pattern_5 = CullPattern(List=geometry_5, CullPattern=point_in_brep_4)
clamplength = ClampLength(Line=geometry_6, LowerLimit=length, UpperLimit=multiplication_2, Strength=Slider(30000, range=0..100000))
length_line = LengthLine(Length=remap_numbers.Mapped, Strength=10)  # disabled
lengthsnap = LengthSnap(Line=geometry_6, Factor=remap_numbers.Mapped, Strength=1)
pressure = Pressure(M=mesh_caps.A, Strength=Slider(0.375, range=0.055..1))
magnetsnap = MagnetSnap(Points=cull_pattern_2, Range=Slider(0.1, range=0..0.1), Strength=Slider(83320, range=0..100000))
magnetsnap_2 = MagnetSnap(Points=cull_pattern_5, Range=Slider(32, range=0..1000), Strength=Slider(5000, range=0..10000))
show = Show(G=mesh_caps.A)
spherecollide = SphereCollide(Points=deconstruct_mesh_3.Vertices, Radius=Slider(24, range=0..100), Strength=Slider(1701, range=0..10000))
solver = Solver(
    GoalObjects=flatten([floor, anchor, show, pressure, clamplength, magnetsnap_2, spherecollide]),
    Reset=Button(),
    Threshold=1e-15,
    Tolerance=0.01,
    On=Toggle(False))  # -> I, V, O
mesh_2 = Mesh(solver.O)
mesh_edges_4 = MeshEdges(Mesh=mesh_2)  # -> NakedEdges, InteriorEdges, NonManifoldEdges
geometry_9 = Geometry(flatten([mesh_edges_4.NakedEdges, mesh_edges_4.InteriorEdges]))
# Floor
# Create Pockets
# Load
# Pneumatic
# Anchors
# Floor
# Load
# Floor
# Load
custom_preview_6 = CustomPreview(Geometry=geometry_9, Material=colour)

# ==== cluster Cluster
number_slider = Slider(123.6, range=0..201)
division = Division(A=number_slider, B=2)
unit_z = UnitZ(Factor=expr("-x", simplify(division)))
start = ClusterInput()
line_sdl = LineSDL(Start=start, Direction=Vector(0, 0, 1), Length=number_slider)
move = Move(Geometry=line_sdl, Motion=unit_z)  # -> Geometry, Transform
geometry = ClusterOutput(move.Geometry)
