# Grasshopper definition 200211_Analysis on Column Geometry.gh (Grasshopper 1.0.7)
# plug-ins: MeshEdit Components, Kangaroo Components, Millipede, Weaverbird, Kangaroo2 Components

curve = Curve([<curve referenced from the Rhino model> x3])
loft = Loft(Curves=curve, Options={Adjust=False, Closed=False, LoftEnds=0, LoftSimp=0, LoftType=0, Rebuild=10, Refit=0.01})

surface = Surface(loft)

mesh_surface = MeshSurface(Surface=surface, UCount=Slider(27, range=0..100), VCount=Slider(44, range=0..100), Overhang=True, Equalize=False)

mesh_edges = MeshEdges(Mesh=mesh_surface)  # -> NakedEdges, InteriorEdges, NonManifoldEdges
negative = Negative(Value=Slider(1, range=0..1))
unit_z = UnitZ(Factor=negative)
Z = UnitZ(Factor=Slider(-800, range=-10000..1))

number_slider = Slider(200, range=0..1000)  # disabled
mesh = Mesh(<mesh referenced from the Rhino model>)  # disabled
boolean_toggle = BooleanToggle(False)  # disabled
timer = Timer(TimerInterval=50, Target=remesh)  # disabled
remesh = ReMesh(InitialMesh=mesh, EdgeLength=number_slider, Tolerance=0.1, PullStrength=1, TargetMesh=mesh, Reset=boolean_toggle)  # -> ReMesh, Iterations; disabled
weaverbird_s_loop_subdivision = WeaverbirdsLoopSubdivision(MeshCurves=remesh.ReMesh, Level=1, SmoothNakedEdges=1)  # disabled
mesh_edges_2 = MeshEdges(Mesh=weaverbird_s_loop_subdivision)  # -> NakedEdges, InteriorEdges, NonManifoldEdges; disabled

colour_swatch = ColourSwatch(SwatchColor=RGB(255, 255, 255))  # disabled
mesh_2 = Mesh(weaverbird_s_loop_subdivision)  # disabled
custom_preview = CustomPreview(Geometry=mesh_2, Material=colour_swatch)  # disabled

mesh_edges_3 = MeshEdges(Mesh=mesh_2)  # -> NakedEdges, InteriorEdges, NonManifoldEdges
demesh = DeconstructMesh(Mesh=mesh_2)  # -> Vertices, Faces, Colours, Normals

join = JoinCurves(Curves=mesh_edges_3.NakedEdges, Preserve=False)
cp = ControlPoints(Curve=join)  # -> Points, Weights, Knots
duppt = RemoveDuplicatePts(Points=flatten(cp.Points), Tolerance=0.01)

number_slider_2 = Slider(19.4, range=0..121)
neg = Negative(Value=number_slider_2)
merge = Merge(Data1=neg, Data2=number_slider_2)  # -> graft(Result)

geometry_pipeline = GeometryPipeline(
    GroupByLayer=False,
    GroupByType=False,
    IncludeHidden=True,
    IncludeLocked=True,
    LayerFilter="anchor",
    NameFilter="*",
    SublayerFiltering=True,
    TypeFilter=1073741848)
point_in_breps = PointInBreps(Brep=geometry_pipeline, Point=duppt, Strict=False)  # -> Inside, Index
cull_pattern = CullPattern(List=duppt, CullPattern=point_in_breps.Inside)

floor = Floor(Strength=Slider(500, range=0..1000))
anchor = Anchor(Point=cull_pattern, Strength=Slider(50000, range=0..100000))

mesh_join = MeshJoin(Meshes=flatten(mesh_surface))
weld_mesh = WeldMesh(Mesh=mesh_join, Angle=3.141592654)

mesh_3 = Mesh(weld_mesh)

deconstruct_mesh = DeconstructMesh(Mesh=mesh_3)  # -> Vertices, Faces, Colours, Normals

weaverbird_s_naked_boundary = WeaverbirdsNakedBoundary(MeshClosedPolylines=mesh_3)
explode = Explode(Curve=weaverbird_s_naked_boundary, Recursive=True)  # -> Segments, Vertices
removeduplicatepts = RemoveDuplicatePts(Points=flatten(deconstruct_mesh.Vertices), Tolerance=0.01)
geometry = Geometry(removeduplicatepts)

deconstruct = Deconstruct(Point=geometry)  # -> XComponent, YComponent, ZComponent
evaluate = Evaluate(Expression="x>0.1", x=deconstruct.ZComponent)
dispatch = Dispatch(List=geometry, DispatchPattern=evaluate)  # -> ListA, ListB
geometry_2 = Geometry(dispatch.ListA)
geometry_3 = Geometry(dispatch.ListB)

deconstruct_2 = Deconstruct(Point=explode.Vertices)  # -> XComponent, YComponent, ZComponent
evaluate_2 = Evaluate(Expression="x>0.1", x=deconstruct_2.ZComponent)
dispatch_2 = Dispatch(List=explode.Vertices, DispatchPattern=evaluate_2)  # -> ListA, ListB
geometry_4 = Geometry(dispatch_2.ListA)
geometry_5 = Geometry(dispatch_2.ListB)

vector_display = VectorDisplay(Anchor=geometry_4, Vector=unit_z)
fepointload = FEPointLoad(Point=geometry_4, Load=Z)

# ----
# press repeatedly on the "step" button until a shape emerges
panel = Panel("analysis and optimization")
toggle = BooleanToggle(True)
mat = Material(MaterialType=2)
Z_2 = UnitZ(Factor=Slider(-300, range=-10000..1))
mat_2 = MillC_StockSupportType(X=True, Y=True, Z=True, RX=toggle, RY=toggle, RZ=toggle)
femesh = FEMesh(Meshes=mesh_3, Material=mat, Thickness=Slider(0.25, range=0..1), AreaLoad=Vector(0, 0, 0), NormalAreaLoad=0)
fepointsupports = FEPointSupports(Point=geometry_3, SupportType=mat_2)
fepointload_2 = FEPointLoad(Point=geometry_2, Load=Z_2)
selfweight = Slider(1, range=0..1)
optimization_steps = Slider(3, range=0..5)
fea_system = FEASystem(
    ModelComponents=flatten([femesh, fepointsupports, fepointload_2, fepointload]),
    IntersectAddedCurves=True,
    MergeTolerance=0.0001,
    MinimumCurveSpan=0.05,
    MaximumCurveSpan=10000,
    CurveTolerance=0.1)
fe_solver = FESolver(
    FEModel=fea_system,
    SelfWeightCoefficient=selfweight,
    BeamOptimisationIterations=0,
    QuadOptimisationIterations=optimization_steps,
    OptimizationTarget=0.3,
    OptimizationPenalization=1.5,
    LoadCase=0,
    AllCases=True)  # -> FEModel, MaxDeflection, Weight

panel_2 = Panel("visualization")
division = Division(A=Slider(0, range=0..101), B=fe_solver.MaxDeflection)
mesh_visualization = MeshVisualization(FEModel=fe_solver.FEModel, Deflection=division, Plane=1, ShowThickness=Toggle(False), ColorMode=8)  # -> Mesh, CompleteRange, VisibleRange

stress_pattern = StressPattern(
    FEModel=fe_solver.FEModel,
    Omega=Slider(5, range=0..5),
    Scalefield=Toggle(True),
    Uselambda=Toggle(False),
    Smoothfactor=0,
    SmoothModulo=1,
    Iterations=Slider(0, range=0..5000),
    MeshDenisty=1,
    Layer=Slider(1, range=-1..1),
    Thickness=0,
    Bending=Toggle(False))
crv = Curve([<curve referenced from the Rhino model> x4])
pattern = Pattern(System=stress_pattern, Pattern=crv)  # -> Patterns, PatternPoints

panel_3 = Panel("visualization of thickness")
slider = Slider(0, range=-1..61)
c_script = CSharpScript(m=mesh_visualization.Mesh, dh=slider)  # -> out, A; inputs m: Mesh, dh: Double
# ---------- c_script: C# usings ----------
using System.IO;
using System.Linq;
using System.Data;
using System.Drawing;
using System.Reflection;
using System.Windows.Forms;
using System.Xml;
using System.Xml.Linq;
using System.Runtime.InteropServices;

using Rhino.DocObjects;
using Rhino.Collections;
using GH_IO;
using GH_IO.Serialization;
# ---------- c_script: C# ----------
    m.FaceNormals.ComputeFaceNormals();
    m.Normals.ComputeNormals();

    for(int i = 0; i < m.Vertices.Count; ++i) {
      Point3d p = new Point3d(m.Vertices[i]);
      Vector3d n = new Vector3d(m.Normals[i]);

      m.Vertices.SetVertex(i, p + n * dh * m.TextureCoordinates[i].X);
    }

    m.VertexColors.Clear();

    m.FaceNormals.ComputeFaceNormals();
    m.Normals.ComputeNormals();


    A = m;
# ---------- end c_script ----------
preview = CustomPreview(Geometry=c_script.A, Shader=ColourSwatch(SwatchColor=RGB(255, 255, 255)))  # disabled

quad_results = QuadResults(FEModel=fe_solver.FEModel, Plane=1)  # -> PrincipalStressFrame, Area, NormalDisplacement, MaxVonMisesStress, PS1, PS2, StiffnessMultiplier, Bending
stresslines = StressLines(FEModel=fe_solver.FEModel, Points=quad_results.PrincipalStressFrame, Plane=1)  # -> Stress1, Stress2
preview_2 = CustomPreview(Geometry=stresslines.Stress1, Shader=ColourSwatch(SwatchColor=RGBA(255, 225, 255, 177)))

negative_2 = Negative(Value=slider)

list_length = ListLength(List=stresslines.Stress1)
multiplication = Multiplication(A=list_length, B=Slider(0.9, range=0..1))

preview_3 = CustomPreview(Geometry=pattern.Patterns, Shader=ColourSwatch(SwatchColor=RGB(0, 0, 0)))

random_reduce = RandomReduce(List=stresslines.Stress1, Reduction=multiplication, Seed=Slider(454, range=0..1000))

join_2 = JoinCurves(Curves=random_reduce, Preserve=False)
cp_2 = ControlPoints(Curve=join_2)  # -> Points, Weights, Knots
duppt_2 = RemoveDuplicatePts(Points=cp_2.Points, Tolerance=0.01)
interpolate = Interpolate(Vertices=duppt_2, Degree=3, Periodic=False, KnotStyle=1)  # -> Curve, Length, Domain
rebuild_curve = RebuildCurve(Curve=interpolate.Curve, Count=Slider(64, range=0..100), Tangents=False)
pipe = Pipe(Curve=rebuild_curve, Radius=Slider(60, range=0..100), Caps=1)
list_length_2 = ListLength(List=flatten(pipe))
multiplication_2 = Multiplication(A=list_length_2, B=Slider(0.8, range=0..1))
random_reduce_2 = RandomReduce(List=flatten(pipe), Reduction=multiplication_2, Seed=Slider(454, range=0..1000))
geometry_6 = Geometry(random_reduce_2)

cp_3 = ClosestPoint(Point=demesh.Vertices, Cloud=duppt)  # -> ClosestPoint, CPIndex, Distance
larger = LargerThan(FirstNumber=cp_3.Distance, SecondNumber=Slider(0, range=0..101))  # -> LargerThan, OrEqualTo
dispatch_3 = Dispatch(List=demesh.Vertices, DispatchPattern=larger.LargerThan)  # -> ListA, ListB

mesh_closest_point = MeshClosestPoint(Point=dispatch_3.ListA, Mesh=mesh_2)  # -> Point, Index, Parameter
mesh_eval = MeshEval(Mesh=mesh_2, Parameter=mesh_closest_point.Parameter)  # -> Point, Normal, Colour
geometry_7 = Geometry(dispatch_3.ListA)
point_in_breps_2 = PointInBreps(Brep=geometry_6, Point=geometry_7, Strict=False)  # -> Inside, Index
amplitude = Amplitude(Vector=mesh_eval.Normal, Amplitude=merge)

move = Move(Geometry=dispatch_3.ListA, Motion=amplitude)  # -> simplify(Geometry), Transform
weave = Weave(Pattern=larger.LargerThan, Stream0=dispatch_3.ListB, Stream1=move.Geometry, NullGaps=False)  # -> simplify(Weave)
conmesh = ConstructMesh(Vertices=weave, Faces=demesh.Faces)  # -> simplify(Mesh)
bang = ExplodeTree(Data=conmesh)  # -> Branch0, Branch1
flip = MeshFlip(Mesh=bang.Branch0)
merge_2 = Merge(Data1=flip, Data2=bang.Branch1)  # -> flatten(Result)
mjoin = MeshJoin(Meshes=merge_2)
weldvertices = MeshWeldVertices(Mesh=mjoin, Tolerance=0.01)  # -> RuntimeMessage, Mesh

list_item = ListItem(List=merge_2, Index=0, Wrap=True)  # -> Item, Item1
demesh_2 = DeconstructMesh(Mesh=list_item.Item1)  # -> Vertices, Faces, Colours, Normals
demesh_3 = DeconstructMesh(Mesh=list_item.Item)  # -> Vertices, Faces, Colours, Normals
dispatch_4 = Dispatch(List=demesh_2.Vertices, DispatchPattern=larger.LargerThan)  # -> ListA, ListB
dispatch_5 = Dispatch(List=demesh_3.Vertices, DispatchPattern=larger.LargerThan)  # -> ListA, ListB
dispatch_6 = Dispatch(List=dispatch_4.ListA, DispatchPattern=point_in_breps_2.Inside)  # -> ListA, ListB
dispatch_7 = Dispatch(List=dispatch_5.ListA, DispatchPattern=point_in_breps_2.Inside)  # -> ListA, ListB

medges = MeshEdges(Mesh=weldvertices.Mesh)  # -> NakedEdges, InteriorEdges, NonManifoldEdges
merge_3 = Merge(Data1=medges.NakedEdges, Data2=medges.InteriorEdges, Data3=medges.NonManifoldEdges)
length = Length(Curve=merge_3)
length_line = LengthLine(Line=merge_3, Length=length, Strength=Slider(393, range=0..1000))

unit_z_2 = UnitZ(Factor=Slider(1.01, range=0..1.01))
load = Load(Point=demesh_2.Vertices, ForceVector=unit_z_2)

pressure = Pressure(M=weldvertices.Mesh, Strength=Slider(0.36, range=0..1.1))

geometry_8 = Geometry(dispatch_6.ListB)
geometry_9 = Geometry(dispatch_7.ListB)
show = Show(G=weldvertices.Mesh)
coincident = Coincident(Point0=geometry_8, Point1=geometry_9, Strength=Slider(1000, range=0..1000))
merge_4 = Merge(Data1=flatten(show), Data2=flatten(anchor), Data3=coincident, Data4=flatten(length_line), Data5=pressure)
solver = Solver(GoalObjects=merge_4, Reset=Button(), Threshold=1e-15, Tolerance=0.01, On=Toggle(False))  # -> I, V, O
mesh_4 = Mesh(solver.O)
weaverbird_s_catmull_clark_subdivision = WeaverbirdsCatmullClarkSubdivision(MeshCurves=mesh_4, Level=Slider(3, range=0..10), SmoothNakedEdges=1)
medges_2 = MeshEdges(Mesh=mesh_4)  # -> NakedEdges, InteriorEdges, NonManifoldEdges
custom_preview_2 = CustomPreview(Geometry=weaverbird_s_catmull_clark_subdivision, Material=ColourSwatch(SwatchColor=RGB(255, 255, 255)))
