# Grasshopper definition Controlled Inflation_2.gh (Grasshopper 1.0.7)
# plug-ins: MeshEdit Components, Pufferfish, Kangaroo Components, LunchBox, Weaverbird, Kangaroo2 Components, TT Toolbox

# YULIA'S THESIS ATTEMPT 1
# Tried to inflate channels created from stresslines.
# 
# Also tried flat pocket channels isntead of cylinder. didnt work, didnt finish.
# METHOD 2
curve = Curve(<curve referenced from the Rhino model>)

rebuild_curve = RebuildCurve(Curve=curve, Count=Slider(10, range=0..10), Degree=3, EndTangents=False)

number_slider = Slider(60, range=0..100)
pipe = Pipe(Curve=rebuild_curve, Radius=number_slider, Caps=0)

number_slider_2 = Slider(80, range=0..200)
number_slider_3 = Slider(16, range=0..100)
divide_surface = DivideSurface(Surface=pipe, UCount=number_slider_2, VCount=number_slider_3)  # -> Points, Normals, Parameters
surface_closest_point = SurfaceClosestPoint(Point=flatten(divide_surface.Points), Surface=pipe)  # -> Point, UVPoint, Distance
surface_curvature = SurfaceCurvature(Surface=pipe, Point=surface_closest_point.UVPoint)  # -> Frame, Gaussian, Mean

curve_2 = Curve(<curve referenced from the Rhino model>)

pipe_2 = Pipe(Curve=curve_2, Radius=number_slider, Caps=0)
mesh_surface = MeshSurface(Surface=pipe_2, UCount=number_slider_2, VCount=number_slider_3, Overhang=True, Equalize=False)
mesh_caps = MeshCaps(M=mesh_surface, W=True, O=True, D=0)  # -> out, A, E; inputs M: Mesh, clr: Color
# ---------- mesh_caps: VB ----------
    Component.Params.Input(0).Name = "Mesh"
    Component.Params.Input(0).Description = "An open mesh"
    Component.Params.Input(1).Name = "Join and Weld"
    Component.Params.Input(1).Description = "If true the original mesh will be joined and welded to the new caps, else the caps will be output as a list of new meshes"
    Component.Params.Input(2).Name = "Simplify Faces"
    Component.Params.Input(2).Description = "If true, naked edges consisting of 3 to 4 segments will be replaced with a single face, else faces will use new center vertex method"
    Component.Params.Input(3).Name = "Distance (Optional, Rhino Units)"
    Component.Params.Input(3).Description = "A single number which sets the Rhino unit based distance that the center point will be offset from the vertex averages"

    Component.Params.Output(1).Name = "Mesh"
    Component.Params.Output(1).Description = "If successful, a list or single of valid meshes"
    Component.Params.Output(2).Name = "Polylines"
    Component.Params.Output(2).Description = "If successful, a list of valid edge polylines"

    If M IsNot Nothing Then
      Dim i,j,k,kk,ka As Integer
      Dim arrP() As polyline
      Dim P As polyline
      Dim arrM As New list(Of Mesh)
      Dim mj As New mesh
      Dim clrB,clrC,blnN() As Boolean
      Dim oc,tcc As New list(Of color)
      If (clr <> Nothing) Then clrC = True
      If ((m.VertexColors.count() > 0) Or (clr <> Nothing)) Then clrB = True
      If (m.VertexColors.count() = 0) Then  m.vertexcolors.CreateMonotoneMesh(color.LightGray)
      oc = m.VertexColors.ToArray.tolist()
      Dim mv() As point3d
      Dim mo As New list(Of mesh)
      Dim fc As New list(Of MeshFace)
      Dim np As New list(Of point3d)
      Dim ni As New list(Of Integer)
      Dim ind(3) As Integer

      mv = m.Vertices.ToPoint3dArray()
      blnN = m.GetNakedEdgePointStatus()
      arrP = m.GetNakedEdges()

      For i = 0 To ubound(blnN) Step 1
        If blnN(i) Then
          np.add(mv(i))
          ni.add(i)
        End If
      Next

      Dim cld As New pointcloud(np.toarray())
      For i = 0 To ubound(arrP) Step 1
        Dim tm As New mesh
        tm.Vertices.Clear()
        tm.Faces.Clear()

        p = arrP(i)
        If (O And (p.count() < 6)) Then
          ind(0) = ni(cld.ClosestPoint(p(0)))
          ind(1) = ni(cld.ClosestPoint(p(1)))
          ind(2) = ni(cld.ClosestPoint(p(2)))
          ind(3) = ni(cld.ClosestPoint(p(3)))
          tm.Vertices.Add(mv(ind(0)))
          tm.Vertices.Add(mv(ind(1)))
          tm.Vertices.Add(mv(ind(2)))

          tm.VertexColors.Add(oc(ind(0)))
          tm.VertexColors.Add(oc(ind(1)))
          tm.VertexColors.Add(oc(ind(2)))
          If p.count() = 5 Then
            fc.add(New meshface(ind(0), ind(1), ind(2), ind(3)))
            tm.Vertices.Add(mv(ind(3)))
            tm.VertexColors.Add(oc(ind(3)))
            tm.Faces.addface(New meshface(0, 1, 2, 3))
          ElseIf p.count() = 4 Then
            fc.add(New meshface(ind(0), ind(1), ind(2)))
            tm.Faces.addface(New meshface(0, 1, 2))
          End If
          tm.FaceNormals.ComputeFaceNormals()
          tm.Normals.ComputeNormals()
          mo.add(tm)

        Else
          Dim tx As New mesh
          Dim vec As New vector3d
          Dim tv As New list(Of point3d)
          Dim tc As New list(Of color)
          Dim tfc As New list(Of meshface)
          Dim r,g,b As Integer
          Dim tcl As color
          k = cld.ClosestPoint(p(0))
          ka = k
          tx.Vertices.AddVertices(p.ToArray())
          tx.Faces.AddFaces(p.TriangulateClosedPolyline())
          tx.Normals.ComputeNormals()

          vec = tx.Normals(0)

          tv.add(p(0))
          tc.add(oc(k))
          r = oc(ni(k)).R
          g = oc(ni(k)).G
          b = oc(ni(k)).B
          For j = 1 To p.count() - 2 Step 1
            kk = cld.ClosestPoint(p(j))
            fc.add(New meshface(m.Vertices.count(), ni(k), ni(kk)))
            vec += tx.Normals(j)
            k = kk

            tv.add(p(j))
            tc.add(oc(k))
            r += oc(ni(k)).R
            g += oc(ni(k)).G
            b += oc(ni(k)).B
            tfc.add(New meshface(p.count() - 1, j - 1, j))
          Next
          fc.add(New meshface(m.Vertices.count(), ni(k), ni(ka)))
          vec.Unitize()
          vec *= D
          m.Vertices.add(p.CenterPoint() + vec)

          r /= (p.count() - 1)
          g /= (p.count() - 1)
          b /= (p.count() - 1)
          If r > 255 Then r = 255 Else If r < 0 Then r = 0
          If g > 255 Then g = 255 Else If g < 0 Then g = 0
          If b > 255 Then b = 255 Else If b < 0 Then b = 0
          If clrC Then tcl = clr Else tcl = color.FromArgb(r, g, b)
          m.VertexColors.Add(tcl)

          tv.add(p.CenterPoint() + vec)
          tc.add(tcl)
          tfc.add(New meshface(p.count() - 1, p.count() - 2, 0))
          tm.vertices.AddVertices(tv.toarray())
          If clrB Then tm.VertexColors.AppendColors(tc.toarray())
          tm.faces.addfaces(tfc)
          tm.FaceNormals.ComputeFaceNormals()
          tm.Normals.ComputeNormals()
          mo.add(tm)
        End If
      Next

      If w Then
        m.Faces.AddFaces(fc)
        m.FaceNormals.ComputeFaceNormals()
        m.UnifyNormals()
        m.Normals.ComputeNormals()
        If Not clrB Then m.VertexColors.Clear()
        A = m
      Else
        A = mo
      End If
      E = arrP
    End If
# ---------- mesh_caps: VB additional code ----------
  Private Function avgC(ByVal R As Double, ByVal G As Double, ByVal B As Double, ByVal T As Integer)

    R /= t
    G /= t
    B /= t
    If R > 255 Then R = 255 Else If R < 0 Then R = 0
    If G > 255 Then G = 255 Else If G < 0 Then G = 0
    If B > 255 Then B = 255 Else If B < 0 Then B = 0

    Return color.FromArgb(CInt(R), CInt(G), CInt(B))
  End Function
# ---------- end mesh_caps ----------
mesh_edges = MeshEdges(Mesh=mesh_caps.A)  # -> NakedEdges, InteriorEdges, NonManifoldEdges

mesh = Mesh(mesh_caps.A)
triangulate = Triangulate(Mesh=mesh)  # -> Mesh, Count
mesh_edges_2 = MeshEdges(Mesh=mesh)  # -> NakedEdges, InteriorEdges, NonManifoldEdges
weld_mesh = WeldMesh(Mesh=mesh, Angle=3.141592654)
weaverbird_s_face_polylines = WeaverbirdsFacePolylines(Mesh=weld_mesh)

mesh_surface_2 = MeshSurface(Surface=pipe, UCount=number_slider_2, VCount=number_slider_3, Overhang=True, Equalize=False)
mesh_caps_2 = MeshCaps(M=mesh_surface_2, W=True, O=True, D=0)  # -> out, A, E; inputs M: Mesh, clr: Color; same code as mesh_caps
deconstruct_mesh = DeconstructMesh(Mesh=mesh_caps_2.A)  # -> Vertices, Faces, Colours, Normals

weaverbird_s_face_polylines_2 = WeaverbirdsFacePolylines(Mesh=mesh_caps_2.A)
polygon_center = PolygonCenter(Polyline=weaverbird_s_face_polylines_2)  # -> CenterV, CenterE, CenterA
deconstruct_mesh_2 = DeconstructMesh(Mesh=weld_mesh)  # -> Vertices, Faces, Colours, Normals
closest_points = ClosestPoints(Point=polygon_center.CenterA, Cloud=surface_closest_point.Point, Count=1)  # -> ClosestPoint, CPIndex, Distance

mesh_edges_3 = MeshEdges(Mesh=mesh_caps_2.A)  # -> NakedEdges, InteriorEdges, NonManifoldEdges
geometry = Geometry([mesh_edges_3.NakedEdges, mesh_edges_3.InteriorEdges])
point_on_curve = PointOnCurve(geometry, parameter=0.5)
closest_points_2 = ClosestPoints(Point=point_on_curve, Cloud=surface_closest_point.Point, Count=1)  # -> ClosestPoint, CPIndex, Distance

area = Area(Geometry=weaverbird_s_face_polylines)  # -> Area, Centroid
list_item = ListItem(List=surface_curvature.Gaussian, Index=closest_points.CPIndex, Wrap=True)

bounds = Bounds(Numbers=surface_curvature.Gaussian)
deconstruct_domain = DeconstructDomain(Domain=bounds)  # -> Start, End
gradient = Gradient(
    LowerLimit=deconstruct_domain.Start,
    UpperLimit=deconstruct_domain.End,
    Parameter=surface_curvature.Gaussian,
    stops=[0: RGB(234, 38, 0), 0.25: RGB(234, 126, 0), 0.5: RGB(254, 244, 84), 0.75: RGB(173, 203, 249), 1: RGB(75, 107, 169)])
panel = Panel(bounds)

brep = Brep(<brep referenced from the Rhino model>)
point_in_brep = PointInBrep(Brep=brep, Point=deconstruct_mesh_2.Vertices, Strict=False)
dispatch = Dispatch(List=deconstruct_mesh_2.Vertices, DispatchPattern=point_in_brep)  # -> ListA, ListB
geometry_2 = Geometry(dispatch.ListA)

list_item_2 = ListItem(List=surface_curvature.Gaussian, Index=closest_points_2.CPIndex, Wrap=True)
bounds_2 = Bounds(Numbers=flatten(list_item_2))
flatten_tree = FlattenTree(Tree=list_item_2, Path="{0}")
remap_numbers = RemapNumbers(Value=flatten_tree, Source=bounds_2, Target="0.6 to 1")  # -> Mapped, Clipped

mesh_edges_4 = MeshEdges(Mesh=weld_mesh)  # -> NakedEdges, InteriorEdges, NonManifoldEdges

bounds_3 = Bounds(Numbers=flatten(list_item))
flatten_tree_2 = FlattenTree(Tree=list_item, Path="{0}")
remap_numbers_2 = RemapNumbers(Value=flatten_tree_2, Source=bounds_3, Target="0.7 to 2.5")  # -> Mapped, Clipped

geometry_3 = Geometry([mesh_edges_4.NakedEdges, mesh_edges_4.InteriorEdges])
custom_preview = CustomPreview(Geometry=flatten(divide_surface.Points), Material=gradient)
length = Length(Curve=geometry_3)
list_item_3 = ListItem(List=gradient, Index=closest_points_2.CPIndex, Wrap=True)
custom_preview_2 = CustomPreview(Geometry=flatten(mesh_edges.InteriorEdges), Material=flatten(list_item_3))

floor = Floor(Strength=Slider(1000, range=0..1000))

number_slider_4 = Slider(44637, range=0..100000)

anchor = Anchor(Point=geometry_2, Strength=Slider(5000, range=0..10000))

multiplication = Multiplication(A=area.Area, B=remap_numbers_2.Mapped)

pressure = Pressure(M=weld_mesh, Strength=Slider(3, range=0..100))

multiplication_2 = Multiplication(A=length, B=remap_numbers.Mapped)
sort_duplicate_points = SortDuplicatePoints(Points=dispatch.ListB)  # -> UniquePoints, Indices

spherecollide = SphereCollide(Points=sort_duplicate_points.UniquePoints, Radius=Slider(4, range=0..100), Strength=Slider(50, range=0..10000))

construct_mesh = ConstructMesh(Vertices=deconstruct_mesh.Vertices, Faces=deconstruct_mesh.Faces, Colours=gradient)
custom_preview_3 = CustomPreview(Geometry=flatten(geometry), Material=flatten(list_item_3))
clamplength = ClampLength(Line=geometry_3, LowerLimit=length, UpperLimit=multiplication_2, Strength=number_slider_4)
length_line = LengthLine(Line=geometry_3, Length=multiplication_2, Strength=number_slider_4)
show = Show(G=weld_mesh)
polygonarea = PolygonArea(Polyline=weaverbird_s_face_polylines, Area=multiplication, Strength=Slider(2759.2, range=0..21001))
solver = Solver(
    GoalObjects=flatten([floor, show, clamplength, spherecollide, pressure, anchor, polygonarea]),
    Reset=Button(),
    Threshold=1e-15,
    Tolerance=0.01,
    On=Toggle(False))  # -> I, V, O
mesh_2 = Mesh(solver.O)
mesh_edges_5 = MeshEdges(Mesh=mesh_2)  # -> NakedEdges, InteriorEdges, NonManifoldEdges
geometry_4 = Geometry(flatten([mesh_edges_5.NakedEdges, mesh_edges_5.InteriorEdges]))
custom_preview_4 = CustomPreview(Geometry=geometry_4, Material=flatten(list_item_3))
# FLAT POCKET INSTEAD OF CHANNELS
curve_3 = Curve(<curve referenced from the Rhino model>)  # disabled
brep_2 = Brep(<brep referenced from the Rhino model>)  # disabled
deconstruct_brep = DeconstructBrep(Brep=brep_2)  # -> Faces, Edges, Vertices; disabled
surface = Surface(<surface referenced from the Rhino model>)  # disabled

number_slider_5 = Slider(18, range=0..100)  # disabled
number_slider_6 = Slider(3, range=0..10)  # disabled
number_slider_7 = Slider(11, range=0..100)  # disabled
rebuild_curve_2 = RebuildCurve(Curve=curve_3, Degree=number_slider_6, Count=number_slider_5, Tangents=False)  # disabled
pull_curve = PullCurve(Curve=rebuild_curve_2, Surface=surface)  # disabled
divide_curve = DivideCurve(Curve=pull_curve, Count=number_slider_7, Kinks=False)  # -> Points, Tangents, Parameters; disabled
polyline = PolyLine(Vertices=divide_curve.Points, Closed=False)  # disabled

surface_closest_point_2 = SurfaceClosestPoint(Point=divide_curve.Points, Surface=surface)  # -> Point, UVPoint, Distance; disabled
evaluate_surface = EvaluateSurface(Surface=surface, Point=surface_closest_point_2.UVPoint)  # -> Point, Normal, UDirection, VDirection, Frame; disabled

number_slider_8 = Slider(100, range=0..1000)  # disabled
number_slider_9 = Slider(2, range=0..10)  # disabled
division = Division(A=number_slider_8, B=number_slider_9)  # disabled
negative = Negative(Value=division)  # disabled
amplitude = Amplitude(Vector=evaluate_surface.VDirection, Amplitude=negative)  # disabled
line_sdl = LineSDL(Start=divide_curve.Points, Direction=evaluate_surface.VDirection, Length=number_slider_8)  # disabled
move = Move(Geometry=line_sdl, Motion=amplitude)  # -> Geometry, Transform; disabled

loft = Loft(Curves=move.Geometry, Options={Adjust=False, Closed=False, LoftEnds=0, LoftSimp=2, LoftType=2, Rebuild=10, Refit=0.01})  # disabled

number_slider_10 = Slider(7.4, range=0..51)  # disabled
negative_2 = Negative(Value=number_slider_10)  # disabled
merge = Merge(Data1=negative_2, Data2=number_slider_10)  # -> graft(Result); disabled
unit_z = UnitZ(Factor=merge)  # -> simplify(UnitVector); disabled

number_slider_11 = Slider(6.1, range=0..51)  # disabled
negative_3 = Negative(Value=number_slider_11)  # disabled
merge_2 = Merge(Data1=negative_3, Data2=number_slider_11)  # -> graft(Result); disabled
unit_z_2 = UnitZ(Factor=merge_2)  # -> simplify(UnitVector); disabled

explode = Explode(Curve=polyline, Recursive=True)  # -> Segments, Vertices; disabled
graft_tree = GraftTree(Tree=explode.Segments, IncludeEmptyLists=True, IncludeNullItems=True)  # disabled
shift_list = ShiftList(List=explode.Segments, Shift=1, Wrap=False)  # disabled
number_slider_12 = Slider(9, range=0..11)  # disabled
end_points = EndPoints(Curve=graft_tree)  # -> Start, End; disabled
graft_tree_2 = GraftTree(Tree=shift_list, IncludeEmptyLists=True, IncludeNullItems=True)  # disabled
vector_2pt = Vector2Pt(PointA=end_points.Start, PointB=end_points.End, Unitize=False)  # -> Vector, Length; disabled
list_item_4 = ListItem(List=[explode.Segments, shift_list], Index=number_slider_12, Wrap=True)  # disabled
end_points_2 = EndPoints(Curve=graft_tree_2)  # -> Start, End; disabled
vector_2pt_2 = Vector2Pt(PointA=end_points_2.End, PointB=end_points_2.Start, Unitize=False)  # -> Vector, Length; disabled
angle = Angle(VectorA=vector_2pt.Vector, VectorB=vector_2pt_2.Vector)  # -> Angle, Reflex; disabled
degrees = Degrees(Radians=angle.Angle)  # disabled
panel_2 = Panel(degrees)  # disabled

polygonarea_2 = PolygonArea(Strength=1)  # disabled
panel_3 = Panel("1.01 to 0.94")  # disabled
panel_4 = Panel("0.94 to 1.01")  # disabled

number_slider_13 = Slider(1000, range=0..1000)  # disabled
floor_2 = Floor(Strength=number_slider_13)  # disabled

number_slider_14 = Slider(44637, range=0..100000)  # disabled
boolean_toggle = BooleanToggle(True)  # disabled
button = Button()  # disabled

loft_2 = Loft(Curves=move.Geometry, Options={Adjust=False, Closed=False, LoftEnds=0, LoftSimp=2, LoftType=3, Rebuild=10, Refit=0.01})  # disabled
deconstruct_brep_2 = DeconstructBrep(Brep=loft_2)  # -> Faces, Edges, Vertices; disabled

unfold = Unfold(Brep=loft_2, Curves=move.Geometry, Plane=PlaneXY(0, 0, 0))  # -> UnfoldedBrep, UnfoldedPoints, UnfoldedCurves; disabled
loft_3 = Loft(
    Curves=unfold.UnfoldedCurves,
    Options={Adjust=False, Closed=False, LoftEnds=0, LoftSimp=0, LoftType=3, Rebuild=10, Refit=0.01})  # disabled
brep_join = BrepJoin(Breps=loft_3)  # -> Breps, Closed; disabled

number_slider_15 = Slider(6, range=0..100)  # disabled
number_slider_16 = Slider(16, range=0..100)  # disabled
mesh_surface_3 = MeshSurface(Surface=deconstruct_brep_2.Faces, UCount=number_slider_16, VCount=number_slider_15, Overhang=True, Equalize=False)  # disabled
mesh_join = MeshJoin(Meshes=mesh_surface_3)  # disabled
deconstruct_mesh_3 = DeconstructMesh(Mesh=mesh_join)  # -> Vertices, Faces, Colours, Normals; disabled
mesh_edges_6 = MeshEdges(Mesh=mesh_join)  # -> NakedEdges, InteriorEdges, NonManifoldEdges; disabled

join_curves = JoinCurves(Curves=mesh_edges_6.NakedEdges, Preserve=False)  # disabled
control_points = ControlPoints(Curve=join_curves)  # -> Points, Weights, Knots; disabled
removeduplicatepts = RemoveDuplicatePts(Points=control_points.Points, Tolerance=0.01)  # disabled

closest_point = ClosestPoint(Point=deconstruct_mesh_3.Vertices, Cloud=removeduplicatepts)  # -> ClosestPoint, CPIndex, Distance; disabled
larger_than = LargerThan(FirstNumber=closest_point.Distance, SecondNumber=0)  # -> LargerThan, OrEqualTo; disabled
dispatch_2 = Dispatch(List=deconstruct_mesh_3.Vertices, DispatchPattern=larger_than.LargerThan)  # -> ListA, ListB; disabled
move_2 = Move(Geometry=dispatch_2.ListA, Motion=unit_z)  # -> simplify(Geometry), Transform; disabled
weave = Weave(Pattern=larger_than.LargerThan, Stream0=dispatch_2.ListB, Stream1=move_2.Geometry, NullGaps=False)  # -> simplify(Weave); disabled
construct_mesh_2 = ConstructMesh(Vertices=weave, Faces=deconstruct_mesh_3.Faces)  # -> simplify(Mesh); disabled
explode_tree = ExplodeTree(Data=construct_mesh_2)  # -> Branch0, Branch1; disabled
mesh_flip = MeshFlip(Mesh=explode_tree.Branch0)  # disabled
merge_3 = Merge(Data1=mesh_flip, Data2=explode_tree.Branch1)  # -> flatten(Result); disabled
mesh_join_2 = MeshJoin(Meshes=merge_3)  # disabled
mesh_weldvertices = MeshWeldVertices(Mesh=mesh_join_2, Tolerance=0.01)  # -> RuntimeMessage, Mesh; disabled
mesh_edges_7 = MeshEdges(Mesh=mesh_join_2)  # -> NakedEdges, InteriorEdges, NonManifoldEdges; disabled

surface_closest_point_3 = SurfaceClosestPoint(Point=flatten(deconstruct_mesh_3.Vertices), Surface=reparameterize(loft))  # -> Point, UVPoint, Distance; disabled
surface_curvature_2 = SurfaceCurvature(Surface=reparameterize(pipe), Point=surface_closest_point_3.UVPoint)  # -> Frame, Gaussian, Mean; disabled

bounds_4 = Bounds(Numbers=surface_curvature_2.Gaussian)  # disabled
deconstruct_domain_2 = DeconstructDomain(Domain=bounds_4)  # -> Start, End; disabled
gradient_2 = Gradient(
    LowerLimit=deconstruct_domain_2.Start,
    UpperLimit=deconstruct_domain_2.End,
    Parameter=surface_curvature_2.Gaussian,
    stops=[0: RGB(234, 38, 0), 0.25: RGB(234, 126, 0), 0.5: RGB(254, 244, 84), 0.75: RGB(173, 203, 249), 1: RGB(75, 107, 169)])  # disabled
panel_5 = Panel(bounds_4)  # disabled

custom_preview_5 = CustomPreview(Geometry=flatten(deconstruct_mesh_3.Vertices), Material=gradient_2)  # disabled
mesh_3 = Mesh(mesh_flip)  # disabled

mesh_edges_8 = MeshEdges(Mesh=mesh_3)  # -> NakedEdges, InteriorEdges, NonManifoldEdges; disabled
geometry_5 = Geometry([mesh_edges_8.NakedEdges, mesh_edges_8.InteriorEdges])  # disabled
point_on_curve_2 = PointOnCurve(geometry_5, parameter=0.5)  # disabled
closest_points_3 = ClosestPoints(Point=point_on_curve_2, Cloud=surface_closest_point_3.Point, Count=1)  # -> ClosestPoint, CPIndex, Distance; disabled

list_item_5 = ListItem(List=gradient_2, Index=closest_points_3.CPIndex, Wrap=True)  # disabled

list_item_6 = ListItem(List=surface_curvature_2.Gaussian, Index=closest_points_3.CPIndex, Wrap=True)  # disabled
bounds_5 = Bounds(Numbers=flatten(list_item_6))  # disabled
flatten_tree_3 = FlattenTree(Tree=list_item_6, Path="{0}")  # disabled
remap_numbers_3 = RemapNumbers(Value=flatten_tree_3, Source=bounds_5, Target=panel_4)  # -> Mapped, Clipped; disabled

custom_preview_6 = CustomPreview(Geometry=flatten(geometry_5), Material=flatten(list_item_5))  # disabled
remap_numbers_4 = RemapNumbers(Value=flatten_tree_3, Source=bounds_5, Target=panel_3)  # -> Mapped, Clipped; disabled

number_slider_17 = Slider(6, range=0..100)  # disabled
number_slider_18 = Slider(16, range=0..100)  # disabled
mesh_surface_4 = MeshSurface(Surface=deconstruct_brep.Faces, UCount=number_slider_18, VCount=number_slider_17, Overhang=True, Equalize=False)  # disabled
mesh_join_3 = MeshJoin(Meshes=mesh_surface_4)  # disabled

weld_mesh_2 = WeldMesh(Mesh=mesh_join_3, Angle=3.141592654)  # disabled
weaverbird_s_naked_boundary = WeaverbirdsNakedBoundary(MeshClosedPolylines=weld_mesh_2)  # disabled

mesh_edges_9 = MeshEdges(Mesh=weld_mesh_2)  # -> NakedEdges, InteriorEdges, NonManifoldEdges; disabled
deconstruct_mesh_4 = DeconstructMesh(Mesh=weld_mesh_2)  # -> Vertices, Faces, Colours, Normals; disabled

join_curves_2 = JoinCurves(Curves=mesh_edges_9.NakedEdges, Preserve=False)  # disabled
control_points_2 = ControlPoints(Curve=join_curves_2)  # -> Points, Weights, Knots; disabled
removeduplicatepts_2 = RemoveDuplicatePts(Points=control_points_2.Points, Tolerance=0.01)  # disabled

closest_point_2 = ClosestPoint(Point=deconstruct_mesh_4.Vertices, Cloud=removeduplicatepts_2)  # -> ClosestPoint, CPIndex, Distance; disabled
larger_than_2 = LargerThan(FirstNumber=closest_point_2.Distance, SecondNumber=0)  # -> LargerThan, OrEqualTo; disabled
dispatch_3 = Dispatch(List=deconstruct_mesh_4.Vertices, DispatchPattern=larger_than_2.LargerThan)  # -> ListA, ListB; disabled
move_3 = Move(Geometry=dispatch_3.ListA, Motion=unit_z_2)  # -> simplify(Geometry), Transform; disabled
weave_2 = Weave(Pattern=larger_than_2.LargerThan, Stream0=dispatch_3.ListB, Stream1=move_3.Geometry, NullGaps=False)  # -> simplify(Weave); disabled
construct_mesh_3 = ConstructMesh(Vertices=weave_2, Faces=deconstruct_mesh_4.Faces)  # -> simplify(Mesh); disabled
explode_tree_2 = ExplodeTree(Data=construct_mesh_3)  # -> Branch0, Branch1; disabled
mesh_flip_2 = MeshFlip(Mesh=explode_tree_2.Branch0)  # disabled
mesh_4 = Mesh(explode_tree_2.Branch1)  # disabled
merge_4 = Merge(Data1=mesh_flip_2, Data2=explode_tree_2.Branch1)  # -> flatten(Result); disabled
mesh_join_4 = MeshJoin(Meshes=merge_4)  # disabled

mesh_edges_10 = MeshEdges(Mesh=mesh_4)  # -> NakedEdges, InteriorEdges, NonManifoldEdges; disabled
mesh_edges_11 = MeshEdges(Mesh=mesh_flip_2)  # -> NakedEdges, InteriorEdges, NonManifoldEdges; disabled
mesh_5 = Mesh(mesh_join_4)  # disabled
weld_mesh_3 = WeldMesh(Mesh=mesh_5, Angle=3.141592654)  # disabled
geometry_6 = Geometry([mesh_edges_10.NakedEdges, mesh_edges_10.InteriorEdges])  # disabled
geometry_7 = Geometry([mesh_edges_11.NakedEdges, mesh_edges_11.InteriorEdges])  # disabled
custom_preview_7 = CustomPreview(Geometry=flatten(geometry_6), Material=flatten(list_item_5))  # disabled
deconstruct_mesh_5 = DeconstructMesh(Mesh=weld_mesh_3)  # -> Vertices, Faces, Colours, Normals; disabled
geometry_8 = Geometry(geometry_6)  # disabled
geometry_9 = Geometry(geometry_7)  # disabled

brep_3 = Brep(<brep referenced from the Rhino model>)  # disabled
point_in_brep_2 = PointInBrep(Brep=brep_3, Point=deconstruct_mesh_5.Vertices, Strict=False)  # disabled
dispatch_4 = Dispatch(List=deconstruct_mesh_5.Vertices, DispatchPattern=point_in_brep_2)  # -> ListA, ListB; disabled
geometry_10 = Geometry(dispatch_4.ListA)  # disabled

length_2 = Length(Curve=geometry_8)  # disabled
length_3 = Length(Curve=geometry_9)  # disabled

number_slider_19 = Slider(5000, range=0..10000)  # disabled
anchor_2 = Anchor(Point=geometry_10, Strength=number_slider_19)  # disabled

number_slider_20 = Slider(0.616, range=0..11)  # disabled
pressure_2 = Pressure(M=weld_mesh_3, Strength=number_slider_20)  # disabled

multiplication_3 = Multiplication(A=length_2, B=remap_numbers_3.Mapped)  # disabled
sort_duplicate_points_2 = SortDuplicatePoints(Points=dispatch_4.ListB)  # -> UniquePoints, Indices; disabled

number_slider_21 = Slider(50, range=0..10000)  # disabled
number_slider_22 = Slider(4, range=0..100)  # disabled
spherecollide_2 = SphereCollide(Points=sort_duplicate_points_2.UniquePoints, Radius=number_slider_22, Strength=number_slider_21)  # disabled

multiplication_4 = Multiplication(A=length_3, B=remap_numbers_4.Mapped)  # disabled
clamplength_2 = ClampLength(Line=geometry_8, LowerLimit=length_2, UpperLimit=multiplication_3, Strength=number_slider_14)  # disabled
clamplength_3 = ClampLength(Line=geometry_9, LowerLimit=length_3, UpperLimit=multiplication_4, Strength=number_slider_14)  # disabled
show_2 = Show(G=weld_mesh_3)  # disabled
solver_2 = Solver(
    GoalObjects=flatten([show_2, clamplength_2, spherecollide_2, pressure_2, clamplength_3, anchor_2]),
    Reset=button,
    Threshold=1e-15,
    Tolerance=0.01,
    On=boolean_toggle)  # -> I, V, O; disabled
mesh_6 = Mesh(solver_2.O)  # disabled
mesh_edges_12 = MeshEdges(Mesh=mesh_6)  # -> NakedEdges, InteriorEdges, NonManifoldEdges; disabled
geometry_11 = Geometry(flatten([mesh_edges_12.NakedEdges, mesh_edges_12.InteriorEdges]))  # disabled
