# Grasshopper definition 200223_Diagram_Process Graphic.gh (Grasshopper 1.0.7)
# plug-ins: Pufferfish, Human, Millipede, Shortest Walk in Gh

# ---- group: Stage2 Slide
number_slider = Slider(0, range=-40..0)

# ----
surface = Surface(<surface referenced from the Rhino model>)
number_slider_2 = Slider(1, range=0..1)  # disabled

# ---- group: Stage 1 slider
# Process Diagram visualisation,
# nothing fancy. needs to move on from this soon.
number_slider_3 = Slider(1, range=0..1)

# ----
mesh_surface = MeshSurface(Surface=surface, UCount=Slider(21, range=0..100), VCount=Slider(25, range=0..100), Overhang=True, Equalize=False)
mesh_join = MeshJoin(Meshes=mesh_surface)
triangulate = Triangulate(Mesh=mesh_join)  # -> Mesh, Count

brep = Brep(<brep referenced from the Rhino model>)  # disabled

# ---- group: Target Point
geometry_pipeline = GeometryPipeline(
    GroupByLayer=False,
    GroupByType=False,
    IncludeHidden=True,
    IncludeLocked=True,
    LayerFilter="Points",
    SublayerFiltering=True,
    TypeFilter=1)

# ---- group: Starting Point
pt = Point([Point(50.12122444, -40.77740285, 0), Point(34.2224602, -40.77740285, 0), Point(47.7557062, -15.48594016, 0), Point(36.58797844, -15.48594016, 0)])

# ----
center_box = CenterBox(Base=pt, X=number_slider_2, Y=number_slider_2, Z=number_slider_2)  # disabled

medges = MeshEdges(Mesh=triangulate.Mesh)  # -> NakedEdges, InteriorEdges, NonManifoldEdges
demesh = DeconstructMesh(Mesh=triangulate.Mesh)  # -> Vertices, Faces, Colours, Normals

point_in_breps = PointInBreps(Brep=brep, Point=demesh.Vertices, Strict=False)  # -> Inside, Index; disabled
point_in_breps_2 = PointInBreps(Brep=center_box, Point=demesh.Vertices, Strict=False)  # -> Inside, Index; disabled
cull_pattern = CullPattern(List=demesh.Vertices, CullPattern=point_in_breps.Inside)  # disabled
cull_pattern_2 = CullPattern(List=demesh.Vertices, CullPattern=point_in_breps_2.Inside)  # disabled
ln = Line(StartPoint=graft(geometry_pipeline), EndPoint=flatten(pt))
shortwalk = ShortestWalk(Curves=medges.InteriorEdges, WantedPath=ln)  # -> ShortestWalk, Succession, Direction, Length

# ----
# I was trying to create inflatable channels using some stress lines as guide
# but the stress lines was far too complicated and the analysis was not
# done properly anyway(materials, loadilng conditions etc)
# press repeatedly on the "step" button until a shape emerges
panel = Panel("analysis and optimization")
toggle = BooleanToggle(True)
mat = Material(MaterialType=2)
Z = UnitZ(Factor=Slider(-300, range=-10000..1))
mat_2 = MillC_StockSupportType(X=True, Y=True, Z=True, RX=toggle, RY=toggle, RZ=toggle)
fepointload = FEPointLoad(Point=cull_pattern, Load=Z)
femesh = FEMesh(Meshes=triangulate.Mesh, Material=mat, Thickness=Slider(1, range=0..1), AreaLoad=Vector(0, 0, 0), NormalAreaLoad=0)
fepointsupports = FEPointSupports(Point=cull_pattern_2, SupportType=mat_2)
selfweight = Slider(1, range=0..1)
optimization_steps = Slider(3, range=0..5)
fea_system = FEASystem(
    ModelComponents=flatten([femesh, fepointsupports, fepointload]),
    IntersectAddedCurves=True,
    MergeTolerance=0.0001,
    MinimumCurveSpan=0.05,
    MaximumCurveSpan=10000,
    CurveTolerance=0.1)
fe_solver = FESolver(
    FEModel=fea_system,
    SelfWeightCoefficient=selfweight,
    BeamOptimisationIterations=0,
    QuadOptimisationIterations=optimization_steps,
    OptimizationTarget=0.3,
    OptimizationPenalization=1.5,
    LoadCase=0,
    AllCases=True)  # -> FEModel, MaxDeflection, Weight

# ---- group: Division of Curve(how smooth)
len = Length(Curve=shortwalk.ShortestWalk)
division = Division(A=len, B=Slider(5.8, range=1..7))
divide = DivideCurve(Curve=shortwalk.ShortestWalk, Count=division, Kinks=False)  # -> Points, Tangents, Parameters

# ----
Z_2 = UnitZ(Factor=Slider(-300, range=-10000..1))

intcrv = Interpolate(Vertices=divide.Points, Degree=3, Periodic=False, KnotStyle=1)  # -> flatten(Curve), Length, Domain

# ---- group: Tube
number_slider_4 = Slider(0.16, range=0..0.5)
number_slider_5 = Slider(0.05, range=0..0.1)

# ----
fepointload_2 = FEPointLoad(Point=demesh.Vertices, Load=Z_2)
ext = ExtendCurve(Curve=intcrv.Curve, Type=0, Start=number_slider, End=Slider(0, range=0..100))

topoly = CurveToPolyline(Curve=ext, ToleranceDistance=0, ToleranceAngle=0, MinEdge=Slider(1, range=0..2))  # -> Polyline, Segments
explode = Explode(Curve=topoly.Polyline, Recursive=True)  # -> Segments, Vertices

curvepoint = PointOnCurve(explode.Segments, parameter=0.5)
dist = Distance(PointA=pt, PointB=curvepoint)
sort = SortList(Keys=dist, ValuesA=explode.Segments)  # -> Keys, ValuesA
lng = ListLength(List=sort.ValuesA)
series = Series(Start=0, Step=1, Count=lng)  # -> reverse(Series)

panel_2 = Panel("visualization")
division_2 = Division(A=Slider(0, range=0..101), B=fe_solver.MaxDeflection)
mesh_visualization = MeshVisualization(FEModel=fe_solver.FEModel, Deflection=division_2, Plane=1, ShowThickness=Toggle(False), ColorMode=8)  # -> Mesh, CompleteRange, VisibleRange

number_slider_6 = Slider(0, range=0..0.31)

# ---- group: Colour
bnd = Bounds(Numbers=series)
dom = ConstructDomain(DomainStart=Slider(255, range=0..255), DomainEnd=Slider(255, range=0..255))
remap = RemapNumbers(Value=series, Source=bnd, Target=dom)  # -> Mapped, Clipped
rgb = ColourRGB(Alpha=255, Red=0, Green=0, Blue=reverse(remap.Mapped))

# ----
negative = Negative(Value=number_slider_6)

quad_results = QuadResults(FEModel=fe_solver.FEModel, Plane=1)  # -> PrincipalStressFrame, Area, NormalDisplacement, MaxVonMisesStress, PS1, PS2, StiffnessMultiplier, Bending
stresslines = StressLines(FEModel=fe_solver.FEModel, Points=quad_results.PrincipalStressFrame, Plane=1)  # -> Stress1, Stress2

# ---- group: Line Thickness
bnd_2 = Bounds(Numbers=series)
dom_2 = ConstructDomain(DomainStart=Slider(3, range=0..3), DomainEnd=Slider(6, range=0..10))
remap_2 = RemapNumbers(Value=series, Source=bnd_2, Target=dom_2)  # -> Mapped, Clipped
int = Integer(remap_2.Mapped)

# ----
previewlw = CustomPreviewLineweights(Geometry=sort.ValuesA, Shader=ColourSwatch(SwatchColor=RGB(44, 234, 255)), Thickness=int)
list_length = ListLength(List=stresslines.Stress1)
c_script = CSharpScript(m=mesh_visualization.Mesh, dh=negative)  # -> out, A; inputs m: Mesh, dh: Double
# ---------- c_script: C# usings ----------
using System.IO;
using System.Linq;
using System.Data;
using System.Drawing;
using System.Reflection;
using System.Windows.Forms;
using System.Xml;
using System.Xml.Linq;
using System.Runtime.InteropServices;

using Rhino.DocObjects;
using Rhino.Collections;
using GH_IO;
using GH_IO.Serialization;
# ---------- c_script: C# ----------
    m.FaceNormals.ComputeFaceNormals();
    m.Normals.ComputeNormals();

    for(int i = 0; i < m.Vertices.Count; ++i) {
      Point3d p = new Point3d(m.Vertices[i]);
      Vector3d n = new Vector3d(m.Normals[i]);

      m.Vertices.SetVertex(i, p + n * dh * m.TextureCoordinates[i].X);
    }

    m.VertexColors.Clear();

    m.FaceNormals.ComputeFaceNormals();
    m.Normals.ComputeNormals();


    A = m;
# ---------- end c_script ----------

panel_3 = Panel("visualization of thickness")
c_script_2 = CSharpScript(m=mesh_visualization.Mesh, dh=number_slider_6)  # -> out, A; inputs m: Mesh, dh: Double
# ---------- c_script_2: C# ----------
    m.FaceNormals.ComputeFaceNormals();
    m.Normals.ComputeNormals();

    for(int i = 0; i < m.Vertices.Count; ++i) {
      Point3d p = new Point3d(m.Vertices[i]);
      Vector3d n = new Vector3d(m.Normals[i]);

      m.Vertices.SetVertex(i, p + n * dh * m.TextureCoordinates[i].X);
    }

    //m.VertexColors.Clear();

    m.FaceNormals.ComputeFaceNormals();
    m.Normals.ComputeNormals();


    A = m;
# ---------- end c_script_2 ----------
preview = CustomPreview(Geometry=[c_script.A, c_script_2.A], Shader=ColourSwatch(SwatchColor=RGB(255, 255, 255)))

multiplication = Multiplication(A=list_length, B=Slider(0.26, range=0..1))
random_reduce = RandomReduce(List=stresslines.Stress1, Reduction=multiplication, Seed=1)
deconstruct_mesh = DeconstructMesh(Mesh=c_script_2.A)  # -> Vertices, Faces, Colours, Normals

preview_2 = CustomPreview(Geometry=random_reduce, Shader=ColourSwatch(SwatchColor=RGB(255, 255, 255)))

number_slider_7 = Slider(52, range=0..100)  # disabled
number_slider_8 = Slider(80, range=0..100)  # disabled
populate_geometry = PopulateGeometry(Geometry=surface, Count=number_slider_8, Seed=number_slider_7)  # disabled
ln_2 = Line(StartPoint=graft(populate_geometry), EndPoint=flatten(pt))  # disabled
number_slider_9 = Slider(5.9, range=1..7)  # disabled

number_slider_10 = Slider(0, range=0..1000)  # disabled
reduce = RandomReduce(List=flatten(ln_2), Reduction=number_slider_10, Seed=1)  # disabled

shortwalk_2 = ShortestWalk(Curves=medges.InteriorEdges, WantedPath=reduce)  # -> ShortestWalk, Succession, Direction, Length; disabled

# ---- group: Division of Curve(how smooth)
len_2 = Length(Curve=shortwalk_2.ShortestWalk)  # disabled
division_3 = Division(A=len_2, B=number_slider_9)  # disabled
divide_2 = DivideCurve(Curve=shortwalk_2.ShortestWalk, Count=division_3, Kinks=False)  # -> Points, Tangents, Parameters; disabled

# ----
intcrv_2 = Interpolate(Vertices=divide_2.Points, Degree=3, Periodic=False, KnotStyle=1)  # -> flatten(Curve), Length, Domain; disabled

geometry = Geometry(<brep referenced from the Rhino model>)
map_to_surface = MapToSurface(Curve=intcrv.Curve, Source=surface, Target=geometry)

construct_domain = ConstructDomain(DomainStart=number_slider_4, DomainEnd=number_slider_5)
subtraction = Subtraction(A=1, B=number_slider_3)
remap_numbers = RemapNumbers(Value=subtraction, Source=Domain(0, 1), Target=construct_domain)  # -> Mapped, Clipped

tween_two_curves = TweenTwoCurves(CurveA=graft(intcrv.Curve), CurveB=graft(map_to_surface), Factor=subtraction, Refit=False, SamplePoint=0)

tween_two_surfaces = TweenTwoSurfaces(SurfaceA=surface, SurfaceB=geometry, Factor=subtraction, Refit=False, SamplePoint=0)

pipe = Pipe(Curve=tween_two_curves, Radius=remap_numbers.Mapped, Caps=0)

custom_preview = CustomPreview(Geometry=pipe, Material=ColourSwatch(SwatchColor=RGBA(255, 0, 255, 128)))

custom_preview_2 = CustomPreview(Geometry=tween_two_surfaces, Material=ColourSwatch(SwatchColor=RGBA(230, 234, 230, 117)))
