# Grasshopper definition 200329_Channel Network Study_Millipede.gh (Grasshopper 1.0.7)
# plug-ins: Kangaroo Components, PlanktonGh, Millipede, Weaverbird

curve = Curve([<curve referenced from the Rhino model> x4])
loft = Loft(Curves=curve, Options={Adjust=False, Closed=False, LoftEnds=0, LoftSimp=1, LoftType=0, Rebuild=10, Refit=0.01})
mesh_brep = MeshBrep(
    Brep=loft,
    Settings={GridMaxCount=0, GridMinCount=16, JaggedSeams=False, MaxEdgeLength=0, MinEdgeLength=0.0001, MinTolerance=0, Refine=True, RefineAngle=0, RelativeTolerance=0.65, SimplePlanes=True, Tolerance=0})
weld_mesh = WeldMesh(Mesh=mesh_brep, Angle=3.141592654)
mesh = Mesh(weld_mesh)
weaverbird_s_naked_boundary = WeaverbirdsNakedBoundary(MeshClosedPolylines=mesh)
nakedvertices = NakedVertices(Mesh=mesh)  # -> ClothedIndex, NakedIndex, ClothedPts, NakedPts
geometry = Geometry(nakedvertices.NakedPts)
timer = Timer(TimerInterval=20, Target=meshmachine)
meshmachine = MeshMachine(
    Geometry=mesh,
    Length=Slider(1, range=0..10),
    FixCurves=weaverbird_s_naked_boundary,
    Flip=1,
    PullStrength=Slider(1, range=0..1),
    CurvatureAdaptivity=0,
    BoundaryScale=1,
    BoundaryDistance=5,
    Exponent=2,
    Background=0.5,
    Iterations=1,
    Reset=Toggle(False))
planktonmesh = PlanktonMesh(meshmachine)
mesh_2 = Mesh(planktonmesh)
mesh_edges = MeshEdges(Mesh=planktonmesh)  # -> NakedEdges, InteriorEdges, NonManifoldEdges

mesh_surface = MeshSurface(Surface=loft, UCount=Slider(37, range=0..100), VCount=Slider(15, range=0..100), Overhang=True, Equalize=False)
geometry_2 = Geometry(<brep referenced from the Rhino model>)
mesh_3 = Mesh(mesh_surface)
mesh_surface_2 = MeshSurface(Surface=geometry_2, UCount=Slider(26, range=0..100), VCount=Slider(12, range=0..100), Overhang=True, Equalize=False)
mesh_edges_2 = MeshEdges(Mesh=mesh_surface_2)  # -> NakedEdges, InteriorEdges, NonManifoldEdges
mesh_edges_3 = MeshEdges(Mesh=mesh_3)  # -> NakedEdges, InteriorEdges, NonManifoldEdges
geometry_pipeline = GeometryPipeline(
    GroupByLayer=False,
    GroupByType=False,
    IncludeHidden=True,
    IncludeLocked=True,
    LayerFilter="Support",
    NameFilter="*",
    SublayerFiltering=True,
    TypeFilter=1073741848)
geometry_pipeline_2 = GeometryPipeline(
    GroupByLayer=False,
    GroupByType=False,
    IncludeHidden=True,
    IncludeLocked=True,
    LayerFilter="Support",
    NameFilter="*",
    SublayerFiltering=True,
    TypeFilter=1073741848)
mesh_4 = Mesh(mesh_surface_2)

brep = Brep(<brep referenced from the Rhino model>)
deconstruct_mesh = DeconstructMesh(Mesh=mesh_4)  # -> Vertices, Faces, Colours, Normals
point_in_breps = PointInBreps(Brep=brep, Point=deconstruct_mesh.Vertices, Strict=False)  # -> Inside, Index
cull_pattern = CullPattern(List=deconstruct_mesh.Vertices, CullPattern=point_in_breps.Inside)

brep_2 = Brep(geometry_pipeline)
deconstruct_mesh_2 = DeconstructMesh(Mesh=mesh_4)  # -> Vertices, Faces, Colours, Normals
point_in_breps_2 = PointInBreps(Brep=brep_2, Point=deconstruct_mesh_2.Vertices, Strict=False)  # -> Inside, Index
cull_pattern_2 = CullPattern(List=deconstruct_mesh_2.Vertices, CullPattern=point_in_breps_2.Inside)

brep_3 = Brep(<brep referenced from the Rhino model>)
deconstruct_mesh_3 = DeconstructMesh(Mesh=mesh_3)  # -> Vertices, Faces, Colours, Normals
point_in_breps_3 = PointInBreps(Brep=brep_3, Point=deconstruct_mesh_3.Vertices, Strict=False)  # -> Inside, Index
cull_pattern_3 = CullPattern(List=deconstruct_mesh_3.Vertices, CullPattern=point_in_breps_3.Inside)

brep_4 = Brep(geometry_pipeline_2)
deconstruct_mesh_4 = DeconstructMesh(Mesh=mesh_3)  # -> Vertices, Faces, Colours, Normals
point_in_breps_4 = PointInBreps(Brep=brep_4, Point=deconstruct_mesh_4.Vertices, Strict=False)  # -> Inside, Index
cull_pattern_4 = CullPattern(List=deconstruct_mesh_4.Vertices, CullPattern=point_in_breps_4.Inside)

# ---- group: Self Load Points(on all vertices)
geometry_3 = Geometry(deconstruct_mesh_2.Vertices)  # disabled

# ---- group: Mesh Global Geometry
mesh_5 = Mesh(mesh_4)  # disabled

# ---- group: Support Points
geometry_4 = Geometry(cull_pattern_2)  # disabled

# ---- group: Load Points(external load)
geometry_5 = Geometry(cull_pattern)  # disabled

# ---- group: Self Load Points(on all vertices)
geometry_6 = Geometry(deconstruct_mesh_4.Vertices)  # disabled

# ---- group: Mesh Global Geometry
mesh_6 = Mesh(mesh_3)  # disabled

# ---- group: Support Points
geometry_7 = Geometry(cull_pattern_4)  # disabled

# ---- group: Load Points(external load)
geometry_8 = Geometry(cull_pattern_3)  # disabled

# ----
slider = Slider(-30, range=-10000..1)  # disabled
Z = UnitZ(Factor=slider)  # disabled
fepointload = FEPointLoad(Point=geometry_3, Load=Z)  # disabled

slider_2 = Slider(-100, range=-10000..1)  # disabled
Z_2 = UnitZ(Factor=slider_2)  # disabled
fepointload_2 = FEPointLoad(Point=geometry_5, Load=Z_2)  # disabled

toggle = BooleanToggle(True)  # disabled
mat = MillC_StockSupportType(X=True, Y=True, Z=True, RX=toggle, RY=toggle, RZ=toggle)  # disabled
fepointsupports = FEPointSupports(Point=geometry_4, SupportType=mat)  # disabled

slider_3 = Slider(1, range=0..1)  # disabled
mat_2 = Material(MaterialType=2)  # disabled
femesh = FEMesh(Meshes=mesh_5, Material=mat_2, Thickness=slider_3, AreaLoad=Vector(0, 0, 0), NormalAreaLoad=0)  # disabled

slider_4 = Slider(-800, range=-10000..1)  # disabled
Z_3 = UnitZ(Factor=slider_4)  # disabled
fepointload_3 = FEPointLoad(Point=geometry_8, Load=Z_3)  # disabled

slider_5 = Slider(-300, range=-10000..1)  # disabled
Z_4 = UnitZ(Factor=slider_5)  # disabled
fepointload_4 = FEPointLoad(Point=geometry_6, Load=Z_4)  # disabled

toggle_2 = BooleanToggle(True)  # disabled
mat_3 = MillC_StockSupportType(X=True, Y=True, Z=True, RX=toggle_2, RY=toggle_2, RZ=toggle_2)  # disabled
fepointsupports_2 = FEPointSupports(Point=geometry_7, SupportType=mat_3)  # disabled

panel = Panel("analysis and optimization")  # disabled

slider_6 = Slider(0.1, range=0..1)  # disabled
mat_4 = Material(MaterialType=2)  # disabled
femesh_2 = FEMesh(Meshes=mesh_6, Material=mat_4, Thickness=slider_6, AreaLoad=Vector(0, 0, 0), NormalAreaLoad=0)  # disabled

optimization_steps = Slider(3, range=0..5)  # disabled
selfweight = Slider(1, range=0..1)  # disabled
optimization_steps_2 = Slider(3, range=0..5)  # disabled
selfweight_2 = Slider(1, range=0..1)  # disabled
fea_system = FEASystem(
    ModelComponents=flatten([femesh, fepointsupports, fepointload, fepointload_2]),
    IntersectAddedCurves=True,
    MergeTolerance=0.0001,
    MinimumCurveSpan=0.05,
    MaximumCurveSpan=10000,
    CurveTolerance=0.1)  # disabled
fea_system_2 = FEASystem(
    ModelComponents=flatten([femesh_2, fepointsupports_2, fepointload_4, fepointload_3]),
    IntersectAddedCurves=True,
    MergeTolerance=0.0001,
    MinimumCurveSpan=0.05,
    MaximumCurveSpan=10000,
    CurveTolerance=0.1)  # disabled
fe_solver = FESolver(
    FEModel=fea_system,
    SelfWeightCoefficient=selfweight,
    BeamOptimisationIterations=0,
    QuadOptimisationIterations=optimization_steps,
    OptimizationTarget=0.3,
    OptimizationPenalization=1.5,
    LoadCase=0,
    AllCases=True)  # -> FEModel, MaxDeflection, Weight; disabled
fe_solver_2 = FESolver(
    FEModel=fea_system_2,
    SelfWeightCoefficient=selfweight_2,
    BeamOptimisationIterations=0,
    QuadOptimisationIterations=optimization_steps_2,
    OptimizationTarget=0.3,
    OptimizationPenalization=1.5,
    LoadCase=0,
    AllCases=True)  # -> FEModel, MaxDeflection, Weight; disabled

slider_7 = Slider(0, range=0..101)  # disabled
panel_2 = Panel("visualization")  # disabled
boolean_toggle = BooleanToggle(False)  # disabled
division = Division(A=slider_7, B=fe_solver.MaxDeflection)  # disabled
mesh_visualization = MeshVisualization(FEModel=fe_solver.FEModel, Deflection=division, Plane=1, ShowThickness=boolean_toggle, ColorMode=4)  # -> Mesh, CompleteRange, VisibleRange; disabled

slider_8 = Slider(0, range=0..101)  # disabled
boolean_toggle_2 = BooleanToggle(False)  # disabled
division_2 = Division(A=slider_8, B=fe_solver_2.MaxDeflection)  # disabled
mesh_visualization_2 = MeshVisualization(FEModel=fe_solver_2.FEModel, Deflection=division_2, Plane=1, ShowThickness=boolean_toggle_2, ColorMode=4)  # -> Mesh, CompleteRange, VisibleRange; disabled

toggle_3 = BooleanToggle(False)  # disabled

slider_9 = Slider(0, range=0..5000)  # disabled
slider_10 = Slider(1, range=-1..1)  # disabled
toggle_4 = BooleanToggle(True)  # disabled
toggle_5 = BooleanToggle(False)  # disabled
toggle_6 = BooleanToggle(False)  # disabled
slider_11 = Slider(5, range=0..5)  # disabled
stress_pattern = StressPattern(
    FEModel=fe_solver_2.FEModel,
    Omega=slider_11,
    Scalefield=toggle_4,
    Uselambda=toggle_5,
    Smoothfactor=toggle_3,
    SmoothModulo=1,
    Iterations=slider_9,
    MeshDenisty=1,
    Layer=slider_10,
    Thickness=0,
    Bending=toggle_6)  # disabled
crv = Curve([<curve referenced from the Rhino model> x4])  # disabled
pattern = Pattern(System=stress_pattern, Pattern=crv)  # -> Patterns, PatternPoints; disabled

quad_results = QuadResults(FEModel=fe_solver_2.FEModel, Plane=1)  # -> PrincipalStressFrame, Area, NormalDisplacement, MaxVonMisesStress, PS1, PS2, StiffnessMultiplier, Bending; disabled
stresslines = StressLines(FEModel=fe_solver_2.FEModel, Points=quad_results.PrincipalStressFrame, Plane=1)  # -> Stress1, Stress2; disabled

slider_12 = Slider(0, range=0..5000)  # disabled
slider_13 = Slider(1, range=-1..1)  # disabled
toggle_7 = BooleanToggle(False)  # disabled
toggle_8 = BooleanToggle(True)  # disabled
toggle_9 = BooleanToggle(False)  # disabled
toggle_10 = BooleanToggle(False)  # disabled
slider_14 = Slider(5, range=0..5)  # disabled
stress_pattern_2 = StressPattern(
    FEModel=fe_solver.FEModel,
    Omega=slider_14,
    Scalefield=toggle_8,
    Uselambda=toggle_9,
    Smoothfactor=toggle_7,
    SmoothModulo=1,
    Iterations=slider_12,
    MeshDenisty=1,
    Layer=slider_13,
    Thickness=0,
    Bending=toggle_10)  # disabled
crv_2 = Curve([<curve referenced from the Rhino model> x4])  # disabled
pattern_2 = Pattern(System=stress_pattern_2, Pattern=crv_2)  # -> Patterns, PatternPoints; disabled

quad_results_2 = QuadResults(FEModel=fe_solver.FEModel, Plane=1)  # -> PrincipalStressFrame, Area, NormalDisplacement, MaxVonMisesStress, PS1, PS2, StiffnessMultiplier, Bending; disabled
stresslines_2 = StressLines(FEModel=fe_solver.FEModel, Points=quad_results_2.PrincipalStressFrame, Plane=1)  # -> Stress1, Stress2; disabled

panel_4 = Panel("visualization of thickness")  # disabled
slider_15 = Slider(0, range=-1..61)  # disabled
c_script = CSharpScript(m=mesh_visualization.Mesh, dh=slider_15)  # -> out, A; inputs m: Mesh, dh: Double; disabled
# ---------- c_script: C# usings ----------
using System.IO;
using System.Linq;
using System.Data;
using System.Drawing;
using System.Reflection;
using System.Windows.Forms;
using System.Xml;
using System.Xml.Linq;
using System.Runtime.InteropServices;

using Rhino.DocObjects;
using Rhino.Collections;
using GH_IO;
using GH_IO.Serialization;
# ---------- c_script: C# ----------
    m.FaceNormals.ComputeFaceNormals();
    m.Normals.ComputeNormals();

    for(int i = 0; i < m.Vertices.Count; ++i) {
      Point3d p = new Point3d(m.Vertices[i]);
      Vector3d n = new Vector3d(m.Normals[i]);

      m.Vertices.SetVertex(i, p + n * dh * m.TextureCoordinates[i].X);
    }

    m.VertexColors.Clear();

    m.FaceNormals.ComputeFaceNormals();
    m.Normals.ComputeNormals();


    A = m;
# ---------- end c_script ----------

slider_16 = Slider(0, range=-1..61)  # disabled
c_script_2 = CSharpScript(m=mesh_visualization_2.Mesh, dh=slider_16)  # -> out, A; inputs m: Mesh, dh: Double; disabled; same code as c_script

swatch = ColourSwatch(SwatchColor=RGBA(255, 3, 255, 177))  # disabled
preview = CustomPreview(Geometry=stresslines_2.Stress1, Shader=swatch)  # disabled

swatch_2 = ColourSwatch(SwatchColor=RGB(255, 255, 255))  # disabled
preview_2 = CustomPreview(Geometry=c_script.A, Shader=swatch_2)  # disabled

swatch_3 = ColourSwatch(SwatchColor=RGB(0, 0, 0))  # disabled
preview_3 = CustomPreview(Geometry=pattern_2.Patterns, Shader=swatch_3)  # disabled

swatch_4 = ColourSwatch(SwatchColor=RGBA(255, 3, 255, 177))  # disabled
preview_4 = CustomPreview(Geometry=stresslines.Stress1, Shader=swatch_4)  # disabled

swatch_5 = ColourSwatch(SwatchColor=RGB(255, 255, 255))  # disabled
preview_5 = CustomPreview(Geometry=c_script_2.A, Shader=swatch_5)  # disabled

swatch_6 = ColourSwatch(SwatchColor=RGB(0, 0, 0))  # disabled
preview_6 = CustomPreview(Geometry=pattern.Patterns, Shader=swatch_6)  # disabled
