# Grasshopper definition 200410_Inflatable_Lift Geometry by Inflating Network.gh (Grasshopper 1.0.7)
# plug-ins: Exoskeleton2, Fattener, Kangaroo2 Components

curve = Curve([<curve referenced from the Rhino model> x318])

fatten = Fatten(
    Skeleton=curve,
    Thickness=Slider(0.1, range=0..0.1),
    LengthSubdivisions=Slider(2, range=0..10),
    EndType=2,
    AdjustForAngle=False)

number_slider = Slider(2.6, range=0..10)
exowireframe = ExoWireframe(
    Lines=curve,
    Sides=6,
    StartRadius=number_slider,
    EndRadius=number_slider,
    NodeDepth=Slider(0.07, range=0..0.1),
    Division=Slider(0.02, range=0..0.1),
    Open=True)  # disabled

triangulate = Triangulate(Mesh=fatten)  # -> Mesh, Count
weld_mesh = WeldMesh(Mesh=triangulate.Mesh, Angle=3.141592654)
flip_mesh = FlipMesh(Mesh=weld_mesh, VertexNormals=True, FaceNormals=True, FaceOrientation=True)
unify_mesh = UnifyMesh(Mesh=flip_mesh)  # -> Result, Count

mesh = Mesh(unify_mesh.Result)
deconstruct_mesh = DeconstructMesh(Mesh=mesh)  # -> Vertices, Faces, Colours, Normals

brep = Brep([<brep referenced from the Rhino model> x4])
point_in_breps = PointInBreps(Brep=brep, Point=deconstruct_mesh.Vertices, Strict=False)  # -> Inside, Index
cull_pattern = CullPattern(List=deconstruct_mesh.Vertices, CullPattern=point_in_breps.Inside)

mesh_edges = MeshEdges(Mesh=mesh)  # -> NakedEdges, InteriorEdges, NonManifoldEdges
dispatch = Dispatch(List=deconstruct_mesh.Vertices, DispatchPattern=point_in_breps.Inside)  # -> ListA, ListB

number_slider_2 = Slider(1, range=0..1)
mesh_join = MeshJoin(Meshes=mesh)

pressure = Pressure(M=mesh_join, Strength=Slider(12110, range=0..12110))

geometry = Geometry(dispatch.ListA)

floor = Floor(Strength=Slider(5000, range=0..10000))

grab = Grab(On=True, Strength=Slider(500, range=0..1000), Range=3)  # -> Grab, Anchors

solidpointcollide = SolidPointCollide(Points=dispatch.ListB, Solid=brep, Interior=False, Unidirectional=True, Strength=Slider(1000, range=0..1000))

number_slider_3 = Slider(0.05, range=0..0.1)
spherecollide = SphereCollide(Points=dispatch.ListB, Radius=number_slider_3, Strength=Slider(500, range=0..1000))

length_line = LengthLine(Line=mesh_edges.InteriorEdges, Strength=Slider(9080, range=0..10000))
anchor = Anchor(Point=geometry, Strength=Slider(15, range=0..100))
show = Show(G=mesh)

boolean_toggle = BooleanToggle(False)  # disabled
button = Button()  # disabled

negative = Negative(Value=Slider(0, range=0..100))
unit_z = UnitZ(Factor=negative)

load = Load(Point=deconstruct_mesh.Vertices, ForceVector=unit_z)

solver = Solver(
    GoalObjects=flatten([show, length_line, pressure, load, anchor, floor, grab.Grab, solidpointcollide]),
    Reset=button,
    Threshold=1e-15,
    Tolerance=0.01,
    On=boolean_toggle)  # -> I, V, O; disabled
list_item = ListItem(List=solver.O, Index=0, Wrap=True)  # disabled
deconstruct_mesh_2 = DeconstructMesh(Mesh=list_item)  # -> Vertices, Faces, Colours, Normals; disabled
mesh_edges_2 = MeshEdges(Mesh=list_item)  # -> NakedEdges, InteriorEdges, NonManifoldEdges; disabled
mesh_sphere = MeshSphere(Base=deconstruct_mesh_2.Vertices, Radius=number_slider_3, UCount=10, VCount=20)  # disabled
