# Grasshopper definition 200413_Inflatable_Saddle.gh (Grasshopper 1.0.7)
# plug-ins: K2Engineering, MeshEdit Components, Pufferfish, Fattener, Topologizer, Kangaroo Components, PlanktonGh, LunchBox, Millipede, Weaverbird, Kangaroo2 Components, TT Toolbox

curve = Curve([<curve referenced from the Rhino model> x2])
curve_2 = Curve([<curve referenced from the Rhino model> x2])
list_item = ListItem(List=curve, Index=0, Wrap=True)  # -> Item, Item1
sweep2 = Sweep2(Rail1=list_item.Item, Rail2=list_item.Item1, Sections=curve_2, SameHeight=False)

# ----
# INPUT GEOMETRY
number_slider = Slider(30, range=0..100)
mesh_surface = MeshSurface(Surface=sweep2, UCount=number_slider, VCount=Slider(38, range=0..100), Overhang=True, Equalize=False)
mesh_edges = MeshEdges(Mesh=mesh_surface)  # -> NakedEdges, InteriorEdges, NonManifoldEdges

# ---- group: EVEN!
number_slider_2 = Slider(6, range=0..100)

# ----
srf = Surface(sweep2)
wires = BrepWireframe(Brep=srf, Density=-1)
trib = TrianglePanelsB(Surface=srf, UDivisions=number_slider_2, VDivisions=Slider(8, range=0..100))
disc = Discontinuity(Curve=trib, Level=1)  # -> Points, Parameters
triangle = MeshTriangle(CornerA=0, CornerB=1, CornerC=2)
conmesh = ConstructMesh(Vertices=disc.Points, Faces=triangle)
wbjoin = WeaverbirdsJoinMeshesAndWeld(Mesh=flatten(conmesh), Weld=Toggle(True))
unim = UnifyMesh(Mesh=wbjoin)  # -> Result, Count
wbdual = WeaverbirdsDualGraph(MeshCurves=unim.Result, DualMode=0)

# ---- group: EVEN!
number_slider_3 = Slider(6, range=0..100)

# ----
# MAKE HEXAGON ON GEOMETRY
srf_2 = Surface(sweep2)
wires_2 = BrepWireframe(Brep=srf_2, Density=-1)
trib_2 = TrianglePanelsB(Surface=srf_2, UDivisions=number_slider_3, VDivisions=Slider(8, range=0..100))
disc_2 = Discontinuity(Curve=trib_2, Level=1)  # -> Points, Parameters
triangle_2 = MeshTriangle(CornerA=0, CornerB=1, CornerC=2)
conmesh_2 = ConstructMesh(Vertices=disc_2.Points, Faces=triangle_2)
wbjoin_2 = WeaverbirdsJoinMeshesAndWeld(Mesh=flatten(conmesh_2), Weld=Toggle(True))
unim_2 = UnifyMesh(Mesh=wbjoin_2)  # -> Result, Count
wbdual_2 = WeaverbirdsDualGraph(MeshCurves=unim_2.Result, DualMode=0)

curve_3 = Curve([<curve referenced from the Rhino model> x71])  # disabled
mesh = Mesh(<mesh referenced from the Rhino model>)
# ANALYSIS W/ MILLIPEDE
mesh_2 = Mesh(mesh_surface)
triangulate = Triangulate(Mesh=mesh_2)  # -> Mesh, Count

end_points = EndPoints(Curve=curve_3)  # -> Start, End; disabled
brep = Brep([<brep referenced from the Rhino model> x2])  # disabled
point = Point([end_points.Start, end_points.End])  # disabled
point_in_breps = PointInBreps(Brep=brep, Point=point, Strict=False)  # -> Inside, Index; disabled
cull_pattern = CullPattern(List=point, CullPattern=point_in_breps.Inside)  # disabled

geometry_pipeline = GeometryPipeline(
    GroupByLayer=False,
    GroupByType=False,
    IncludeHidden=True,
    IncludeLocked=True,
    LayerFilter="Support",
    NameFilter="*",
    SublayerFiltering=True,
    TypeFilter=1073741848)
explode = Explode(Curve=wbdual, Recursive=True)  # -> flatten(Segments), Vertices

brep_2 = Brep(geometry_pipeline)
deconstruct_mesh = DeconstructMesh(Mesh=triangulate.Mesh)  # -> Vertices, Faces, Colours, Normals
point_in_breps_2 = PointInBreps(Brep=brep_2, Point=deconstruct_mesh.Vertices, Strict=False)  # -> Inside, Index
cull_pattern_2 = CullPattern(List=deconstruct_mesh.Vertices, CullPattern=point_in_breps_2.Inside)

brep_3 = Brep(<brep referenced from the Rhino model>)
deconstruct_mesh_2 = DeconstructMesh(Mesh=triangulate.Mesh)  # -> Vertices, Faces, Colours, Normals
point_in_breps_3 = PointInBreps(Brep=brep_3, Point=deconstruct_mesh_2.Vertices, Strict=False)  # -> Inside, Index
cull_pattern_3 = CullPattern(List=deconstruct_mesh_2.Vertices, CullPattern=point_in_breps_3.Inside)

brep_4 = Brep(<brep referenced from the Rhino model>)
deconstruct_mesh_3 = DeconstructMesh(Mesh=triangulate.Mesh)  # -> Vertices, Faces, Colours, Normals
point_in_breps_4 = PointInBreps(Brep=brep_4, Point=deconstruct_mesh_3.Vertices, Strict=False)  # -> Inside, Index
cull_pattern_4 = CullPattern(List=deconstruct_mesh_3.Vertices, CullPattern=point_in_breps_4.Inside)

remove_duplicate_points = RemoveDuplicatePoints(InputPoints=flatten(explode.Vertices), Tolerance=0.001)  # -> OutputPoints, FirstPointIndexes
boolean_toggle = BooleanToggle(True)
clean_tree = CleanTree(
    RemoveNulls=boolean_toggle,
    RemoveInvalid=boolean_toggle,
    RemoveEmpty=boolean_toggle,
    Tree=remove_duplicate_points.OutputPoints)

load_pt = Point()  # disabled
load_vec = Vector()  # disabled
beam_segments = Curve(curve_3)  # disabled
supportpt = Point(cull_pattern)  # disabled

# ---- group: Truss geometry
truss_elements = Curve(curve_3)  # disabled
support_pts = Point(cull_pattern)  # disabled
load_pt_2 = Point(Point(2.5, 0, 0.5))  # disabled

# ----
toggle = BooleanToggle(True)  # disabled
crv = Curve(beam_segments)  # disabled
beamorientation = BeamOrientation(Line=crv, FlipVertical=toggle)  # -> StartPlane, EndPlane; disabled
pln = Plane(beamorientation.EndPlane)  # disabled
pln_2 = Plane(beamorientation.StartPlane)  # disabled

mesh_3 = Mesh(<mesh referenced from the Rhino model>)
deconstruct_mesh_4 = DeconstructMesh(Mesh=mesh_3)  # -> Vertices, Faces, Colours, Normals

# ---- group: Self Load Points(on all vertices)
geometry = Geometry(deconstruct_mesh.Vertices)

# ---- group: Mesh Global Geometry
mesh_4 = Mesh(triangulate.Mesh)

# ---- group: Support Points
geometry_2 = Geometry(cull_pattern_2)

# ---- group: Load Points(external load)
geometry_3 = Geometry(cull_pattern_3)

# ----
construct_domain = ConstructDomain(DomainStart=Slider(0, range=-1..4), DomainEnd=Slider(-6, range=-6..207))

split_ahsl = SplitAHSL(Colour=deconstruct_mesh_4.Colours)  # -> Alpha, Hue, Saturation, Luminance

toggle_2 = BooleanToggle(True)
mat = MillC_StockSupportType(X=True, Y=True, Z=True, RX=toggle_2, RY=toggle_2, RZ=toggle_2)
fepointsupports = FEPointSupports(Point=geometry_2, SupportType=mat)

Z = UnitZ(Factor=Slider(-30, range=-10000..1))
fepointload = FEPointLoad(Point=geometry, Load=Z)

Z_2 = UnitZ(Factor=Slider(-100, range=-10000..1))
fepointload_2 = FEPointLoad(Point=geometry_3, Load=Z_2)

mat_2 = Material(MaterialType=2)
femesh = FEMesh(Meshes=mesh_4, Material=mat_2, Thickness=Slider(1, range=0..1), AreaLoad=Vector(0, 0, 0), NormalAreaLoad=0)

bounds = Bounds(Numbers=split_ahsl.Luminance)

number_slider_4 = Slider(5, range=0..5)  # disabled
number_slider_5 = Slider(5, range=0..10)  # disabled
number_slider_6 = Slider(100, range=0..100)  # disabled
mat_3 = Materials(MaterialIndex=number_slider_4)  # -> MaterialName, Density, YoungsModulus, ShearModulus, Strength; disabled
circle = CircularCS(Diameter=number_slider_6, Thickness=number_slider_5)  # -> A, I, Z, It; disabled
panel = Panel(mat_3.MaterialName)  # disabled
bar = Bar(Line=truss_elements, EModulus=mat_3.YoungsModulus, Area=circle.A)  # disabled

# ---- group: Selfweight of truss
blength = BarLength(Bars=truss_elements)  # -> Points, NodalLengths; disabled
bselfweight = BarSelfweight(NodalLengths=blength.NodalLengths, CrossSectionArea=circle.A, MaterialDensity=mat_3.Density)  # disabled
ma = MassAddition(Input=bselfweight)  # -> Result, PartialResults; disabled
vlen = VectorLength(Vector=ma.Result)  # disabled
load = Load(Point=blength.Points, NodalForce=bselfweight)  # disabled
vdis = VectorDisplay(Anchor=blength.Points, Vector=expr("X/100", bselfweight))  # disabled
kn = Number(expr("X*1e-3", vlen))  # disabled
total_weight_kn = Panel(kn)  # disabled

# ----
blength_2 = BarLength(Bars=beam_segments)  # -> Points, NodalLengths; disabled
remap_numbers = RemapNumbers(Value=split_ahsl.Luminance, Source=bounds, Target=construct_domain)  # -> Mapped, Clipped

end = EndPoints(Curve=truss_elements)  # -> Start, End; disabled
duppt = RemoveDuplicatePts(Points=flatten([end.Start, end.End]), Tolerance=0.01)  # disabled
allpts = Point(duppt)  # disabled
show = Show(G=allpts)  # disabled

# ---- group: Point load
size_n = Panel("50.0e3")  # disabled
pt = Point(load_pt_2)  # disabled
Z_3 = UnitZ(Factor=size_n)  # -> expr("-X", UnitVector); disabled
kn_2 = Number(expr("X*1e-3", size_n))  # disabled
vdis_2 = VectorDisplay(Anchor=pt, Vector=expr("X/50000", Z_3))  # disabled
load_2 = Load(Point=pt, NodalForce=Z_3)  # disabled

# ----
point_charge = PointCharge(Point=deconstruct_mesh_4.Vertices, Charge=remap_numbers.Mapped, Decay=2)

# ---- group: Pinned and roller support
item = ListItem(List=support_pts, Index=0, Wrap=True)  # -> Item, Item1; disabled
toggle_3 = BooleanToggle(True)  # disabled
panel_2 = Panel("1e9")  # disabled
support = Support(XFixed=True, YFixed=True, ZFixed=True, Strength=1e+15)  # disabled
support_2 = Support(PinnedSupportPt=support_pts, XFixed=toggle_3, YFixed=toggle_3, ZFixed=toggle_3, Strength=panel_2)  # disabled

# ----
vec = Vector(load_vec)  # disabled
pt_2 = Point(load_pt)  # disabled
N = Vector(expr("X*1e3", vec))  # disabled
load_3 = Load(Point=pt_2, NodalForce=N)  # disabled

optimization_steps = Slider(5, range=0..5)

toggle_4 = BooleanToggle(True)  # disabled
toggle_5 = BooleanToggle(True)  # disabled
toggle_6 = BooleanToggle(False)  # disabled
toggle_7 = BooleanToggle(False)  # disabled
panel_3 = Panel("1e9")  # disabled
support6dof = Support6DOF(
    SupportPt=supportpt,
    XFixed=toggle_5,
    YFixed=toggle_5,
    ZFixed=toggle_5,
    RXFixed=toggle_4,
    RYFixed=toggle_6,
    RZFixed=toggle_7,
    Strength=panel_3)  # disabled

selfweight = Slider(1, range=0..1)

duppt_2 = RemoveDuplicatePts(Points=flatten([pln_2, pln]), Tolerance=0.01)  # disabled
show_2 = Show(G=duppt_2)  # disabled

merge_fields = MergeFields(Fields=point_charge)
fea_system = FEASystem(
    ModelComponents=flatten([femesh, fepointsupports, fepointload, fepointload_2]),
    IntersectAddedCurves=True,
    MergeTolerance=0.0001,
    MinimumCurveSpan=0.05,
    MaximumCurveSpan=10000,
    CurveTolerance=0.1)

weaverbird_s_naked_boundary = WeaverbirdsNakedBoundary(MeshClosedPolylines=wbdual)
discontinuity = Discontinuity(Curve=weaverbird_s_naked_boundary, Level=1)  # -> Points, Parameters

brep_5 = Brep([<brep referenced from the Rhino model> x2])  # disabled
point_in_breps_5 = PointInBreps(Brep=brep_5, Point=clean_tree, Strict=False)  # -> Inside, Index; disabled
cull_pattern_5 = CullPattern(List=clean_tree, CullPattern=point_in_breps_5.Inside)  # disabled

fe_solver = FESolver(
    FEModel=fea_system,
    SelfWeightCoefficient=selfweight,
    BeamOptimisationIterations=0,
    QuadOptimisationIterations=optimization_steps,
    OptimizationTarget=0.3,
    OptimizationPenalization=1.5,
    LoadCase=0,
    AllCases=True)  # -> FEModel, MaxDeflection, Weight; disabled
evaluate_field = EvaluateField(Field=merge_fields, Point=clean_tree)  # -> Tensor, Strength
addition = Addition(A=kn, B=kn_2)  # disabled
number_slider_7 = Slider(0.22, range=0..1)
num = Number(expr("X/2", addition))  # disabled
amplitude = Amplitude(Vector=evaluate_field.Tensor, Amplitude=Slider(58, range=0..510))
hingepoints = HingePoints(Mesh=unim.Result)  # -> _1, _2, _3, _4
load_sum_kn = Panel(addition)  # disabled
reaction_force_kn = Panel(num)  # disabled

panel_4 = Panel("visualization")
division = Division(A=Slider(0, range=0..101), B=fe_solver.MaxDeflection)
mesh_visualization = MeshVisualization(FEModel=fe_solver.FEModel, Deflection=division, Plane=1, ShowThickness=Toggle(False), ColorMode=8)  # -> Mesh, CompleteRange, VisibleRange

length_line = LengthLine(Line=explode.Segments, Strength=Slider(146, range=0..1000))
nofoldthrough = NoFoldThrough(
    FoldStart=hingepoints._1,
    FoldEnd=hingepoints._2,
    Tip1=hingepoints._3,
    Tip2=hingepoints._4,
    Strength=Slider(1000, range=0..1000))
load_4 = Load(Point=clean_tree, ForceVector=amplitude)
entwine = Entwine(Branch00=show, Branch01=support_2, Branch02=bar, Branch03=[load, load_2], FlattenInputs=True)  # disabled
onmesh = OnMesh(Points=clean_tree, Mesh=mesh_3, Strength=Slider(925, range=0..1000))
anchor = Anchor(Point=flatten(discontinuity.Points), Strength=Slider(261064, range=0..301000))
spherecollide = SphereCollide(Points=clean_tree, Radius=number_slider_7, Strength=Slider(112, range=0..1000))
show_3 = Show(G=clean_tree)
show_4 = Show(G=explode.Segments)
button = Button()  # disabled
toggle_8 = BooleanToggle(False)  # disabled
panel_5 = Panel("1e-15")  # disabled

stress_pattern = StressPattern(
    FEModel=fe_solver.FEModel,
    Omega=Slider(5, range=0..5),
    Scalefield=Toggle(True),
    Uselambda=Toggle(False),
    Smoothfactor=Toggle(False),
    SmoothModulo=1,
    Iterations=Slider(0, range=0..5000),
    MeshDenisty=1,
    Layer=Slider(1, range=-1..1),
    Thickness=0,
    Bending=Toggle(False))
crv_2 = Curve([<curve referenced from the Rhino model> x4])
pattern = Pattern(System=stress_pattern, Pattern=crv_2)  # -> Patterns, PatternPoints

solver = Solver(GoalObjects=entwine, Reset=button, Threshold=panel_5, Tolerance=0.01, On=toggle_8)  # -> I, V, O; disabled

quad_results = QuadResults(FEModel=fe_solver.FEModel, Plane=1)  # -> PrincipalStressFrame, Area, NormalDisplacement, MaxVonMisesStress, PS1, PS2, StiffnessMultiplier, Bending
stresslines = StressLines(FEModel=fe_solver.FEModel, Points=quad_results.PrincipalStressFrame, Plane=1)  # -> Stress1, Stress2

bang = ExplodeTree(Data=solver.O)  # -> Branch0, Branch1, Branch2, Branch3; disabled

panel_6 = Panel("visualization of thickness")
slider = Slider(-1, range=-1..61)
c_script = CSharpScript(m=mesh_visualization.Mesh)  # -> out, A; inputs m: Mesh, dh: Double
# ---------- c_script: C# usings ----------
using System.IO;
using System.Linq;
using System.Data;
using System.Drawing;
using System.Reflection;
using System.Windows.Forms;
using System.Xml;
using System.Xml.Linq;
using System.Runtime.InteropServices;

using Rhino.DocObjects;
using Rhino.Collections;
using GH_IO;
using GH_IO.Serialization;
# ---------- c_script: C# ----------
    m.FaceNormals.ComputeFaceNormals();
    m.Normals.ComputeNormals();

    for(int i = 0; i < m.Vertices.Count; ++i) {
      Point3d p = new Point3d(m.Vertices[i]);
      Vector3d n = new Vector3d(m.Normals[i]);

      m.Vertices.SetVertex(i, p + n * dh * m.TextureCoordinates[i].X);
    }

    m.VertexColors.Clear();

    m.FaceNormals.ComputeFaceNormals();
    m.Normals.ComputeNormals();


    A = m;
# ---------- end c_script ----------

# ---- group: Axial forces
baroutput = BarOutput(BarData=bang.Branch2)  # -> Line, AxialForce, AxialStress; disabled
abs = Absolute(Value=baroutput.AxialStress)  # disabled
sort = SortList(Keys=abs)  # -> reverse(Keys), ValuesA; disabled
number_slider_8 = Slider(14, range=0..100)  # disabled
curvepoint = PointOnCurve(baroutput.Line, parameter=0.5)  # disabled
number_slider_9 = Slider(0.101, range=0..1)  # disabled
expression = Expression(x=baroutput.AxialForce, Expression="Round(x,2)")  # disabled
fy = Number(expr("X/1.2", mat_3.Strength))  # disabled
item_2 = ListItem(List=sort.Keys, Index=0, Wrap=True)  # disabled
swatch = ColourSwatch(SwatchColor=RGB(0, 0, 0))  # disabled
xz = XZPlane(Origin=curvepoint)  # disabled
division_2 = Division(A=item_2, B=fy)  # disabled
axialdisplay = AxialVisualisation(Line=baroutput.Line, AxialForces=baroutput.AxialForce, ThicknessMax=number_slider_8)  # disabled
max_util = Panel(division_2)  # disabled
tag = TextTag3D(Location=xz, Text=expression, Size=number_slider_9, Colour=swatch, Justification=8)  # disabled

# ---- group: Reaction forces
supportoutput = SupportOutput(SupportData=bang.Branch1)  # -> SupportPt, ReactionForce; disabled
vdis_3 = VectorDisplay(Anchor=supportoutput.SupportPt, Vector=expr("X/30", supportoutput.ReactionForce))  # disabled
expression_2 = Expression(x=supportoutput.ReactionForce, Expression="Round(x,1)")  # disabled
swatch_2 = ColourSwatch(SwatchColor=RGB(0, 255, 174))  # disabled
xz_2 = XZPlane(Origin=supportoutput.SupportPt)  # disabled
tag_2 = TextTag3D(Location=xz_2, Text=expression_2, Size=number_slider_9, Colour=swatch_2, Justification=5)  # disabled

# ---- group: Displacements
range = Range(Domain=Domain(0, 1), Steps=expr("20", 10))  # disabled
displ = Displacements(InitialPositions=allpts, FinalPositions=bang.Branch0)  # -> TotalDisplacements, MaximumDisplacementX, MaximumDisplacementY, MaximumDisplacementZ; disabled
gradient = Gradient(LowerLimit=0, UpperLimit=1, Parameter=range, stops=[0: RGB(0, 128, 0), 0.5: RGB(255, 255, 0), 1: RGB(255, 0, 0)])  # disabled
displ_mm = Panel(displ.MaximumDisplacementZ)  # disabled
vlen_2 = VectorLength(Vector=displ.TotalDisplacements)  # disabled
displvis = DisplacementVisualisation(Lines=baroutput.Line, DisplacedNodes=bang.Branch0, Displacement=vlen_2, ColourRange=gradient)  # disabled

# ----
number_slider_10 = Slider(200, range=0..10000)

preview = CustomPreview(Geometry=c_script.A, Shader=ColourSwatch(SwatchColor=RGB(255, 255, 255)))

preview_2 = CustomPreview(Geometry=stresslines.Stress1, Shader=ColourSwatch(SwatchColor=RGBA(255, 3, 255, 177)))

preview_3 = CustomPreview(Geometry=pattern.Patterns, Shader=ColourSwatch(SwatchColor=RGB(0, 0, 0)))

boolean_toggle_2 = BooleanToggle(False)
button_2 = Button()

file_path = FilePath("C:\Users\User\Desktop\Thesis Drive\Graphics\2_Animation\200626\Simulation_Network Optimisation\")
panel_7 = Panel(file_path)
c_script_2 = CSharpScript(iReset=button_2, iStart=boolean_toggle_2, Path=panel_7, Name="image", iFrames=Slider(300, range=0..1700))  # -> out; inputs iReset: Boolean, iStart: Boolean, Path: String, Name: String, iFrames: Int32
# ---------- c_script_2: C# usings ----------
using Rhino.Display;
using System.Threading;
# ---------- c_script_2: C# ----------
    if(iReset) counter = 0;

    if(iStart) {
      var view = doc.Views.ActiveView;
      var view_capture = new ViewCapture
        {
          Width = view.ActiveViewport.Size.Width,
          Height = view.ActiveViewport.Size.Height,
          ScaleScreenItems = false,
          DrawAxes = false,
          DrawGrid = false,
          DrawGridAxes = false,
          TransparentBackground = false
          };

      if(counter < iFrames){
        var screenshot = view_capture.CaptureToBitmap(view);
        if(screenshot != null)
        {
          string filename = Path + Name + counter + ".png";
          screenshot.Save(filename, System.Drawing.Imaging.ImageFormat.Png);
          Print("Count: " + counter);
          counter += 1;
        }
      }
    }
# ---------- c_script_2: C# additional code ----------
    int counter = 0;
# ---------- end c_script_2 ----------
panel_8 = Panel(c_script_2)

timer = Timer(TimerInterval=50, Target=[c_script_2, c_script_3])  # disabled
c_script_3 = CSharpScript(iReset=button_2, iRun=boolean_toggle_2)  # -> out, A; inputs iReset: Boolean, iRun: Boolean
# ---------- c_script_3: C# ----------
    if(iReset){
      counter = 0.0;}
    
    if(iRun){
      counter += 0.1;
    }
    A = counter;
# ---------- c_script_3: C# additional code ----------
  double counter = 0.0;
# ---------- end c_script_3 ----------
panel_9 = Panel(c_script_3.A)

explode_2 = Explode(Curve=wbdual_2, Recursive=True)  # -> flatten(Segments), Vertices; disabled
# K2ENGINEERING - TRUSS
removeduplicatelines = RemoveDuplicateLines(Lines=explode_2.Segments, Tolerance=0.01)  # disabled

surface = Surface(srf_2)  # disabled

# ----
# MESHING CHANNEL POCKETS
brep_6 = Brep(<brep referenced from the Rhino model>)
settings_custom = SettingsCustom(
    StitchSeams=True,
    SimplePlanes=False,
    Refine=True,
    MinCount=16,
    MaxCount=400,
    AspectRatio=20,
    MaxDistance=0,
    MaxAngle=20,
    MinEdge=Slider(0.12, range=0..1),
    MaxEdge=Slider(0.24, range=0..1))
mesh_brep = MeshBrep(Brep=brep_6, Settings=settings_custom)

mesh_edges_2 = MeshEdges(Mesh=mesh_brep)  # -> NakedEdges, InteriorEdges, NonManifoldEdges
weld_mesh = WeldMesh(Mesh=mesh_brep, Angle=3.141592654)
nakedvertices = NakedVertices(Mesh=weld_mesh)  # -> ClothedIndex, NakedIndex, ClothedPts, NakedPts

geometry_4 = Geometry(nakedvertices.NakedPts)
timer_2 = Timer(TimerInterval=20, Target=meshmachine)  # disabled
meshmachine = MeshMachine(
    Geometry=weld_mesh,
    Length=Slider(0.16, range=0..1),
    FixVertices=geometry_4,
    Flip=1,
    PullStrength=0.8,
    CurvatureAdaptivity=0,
    BoundaryScale=1,
    BoundaryDistance=5,
    Exponent=2,
    Background=0.5,
    Iterations=1,
    Reset=Toggle(False))
planktonmesh = PlanktonMesh(meshmachine)
mesh_5 = Mesh(planktonmesh)
mesh_edges_3 = MeshEdges(Mesh=mesh_5)  # -> NakedEdges, InteriorEdges, NonManifoldEdges

# ----
# MAKING CHANNEL POCKETS STAGE2
mesh_6 = Mesh(<mesh referenced from the Rhino model>)
# SIMULATING INFLATABLE
number_slider_11 = Slider(1, range=0..1)  # disabled
number_slider_12 = Slider(1.005, range=0..1.01)  # disabled
number_slider_13 = Slider(500, range=0..1000)  # disabled
number_slider_14 = Slider(500, range=0..1000)  # disabled
number_slider_15 = Slider(5000, range=0..10000)  # disabled
number_slider_16 = Slider(1000, range=0..1000)  # disabled
number_slider_17 = Slider(500, range=0..1000)  # disabled
boolean_toggle_3 = BooleanToggle(False)  # disabled
number_slider_18 = Slider(10000, range=0..10000)  # disabled
grab = Grab(On=boolean_toggle_3, Strength=number_slider_15, Range=3)  # -> Grab, Anchors; disabled
floor = Floor(Strength=number_slider_17)  # disabled
number_slider_19 = Slider(0, range=0..1)  # disabled
number_slider_20 = Slider(1, range=0..1)  # disabled
subtraction = Subtraction(A=number_slider_11, B=number_slider_20)  # disabled
negative = Negative(Value=subtraction)  # disabled
number_slider_21 = Slider(200, range=0..10000)  # disabled

button_3 = Button()  # disabled
boolean_toggle_4 = BooleanToggle(False)  # disabled

timer_3 = Timer(TimerInterval=1000, Target=[c_script_4, c_script_5])  # disabled
boolean_toggle_5 = BooleanToggle(False)  # disabled
button_4 = Button()  # disabled

# ----
# EXPORTING FRAMES TO LOCAL FOLDER
file_path_2 = FilePath("C:\Users\User\Desktop\Thesis Drive\Graphics\2_Animation\200626\Simulation_Saddle Inflation\")  # disabled
panel_10 = Panel(file_path_2)  # disabled
number_slider_22 = Slider(1700, range=0..1700)  # disabled
panel_11 = Panel("image")  # disabled
c_script_4 = CSharpScript(iReset=button_4, iStart=boolean_toggle_5, Path=panel_10, Name=panel_11, iFrames=number_slider_22)  # -> out; inputs iReset: Boolean, iStart: Boolean, Path: String, Name: String, iFrames: Int32; disabled; same code as c_script_2
panel_12 = Panel(c_script_4)  # disabled

c_script_5 = CSharpScript(iReset=button_4, iRun=boolean_toggle_5)  # -> out, A; inputs iReset: Boolean, iRun: Boolean; disabled; same code as c_script_3
panel_13 = Panel(c_script_5.A)  # disabled
mesh_7 = Mesh([<mesh referenced from the Rhino model> x3])  # disabled

number_slider_23 = Slider(5, range=0..10)  # disabled
w_mm = Panel("300")  # disabled
t_mm = Panel("5")  # disabled
mat_4 = Materials(MaterialIndex=number_slider_23)  # -> MaterialName, Density, YoungsModulus, ShearModulus, Strength; disabled
panel_14 = Panel(mat_4.MaterialName)  # disabled

circularcs = CircularCS(Diameter=w_mm, Thickness=t_mm)  # -> A, I, Z, It; disabled
bselfweight_2 = BarSelfweight(NodalLengths=blength_2.NodalLengths, CrossSectionArea=circularcs.A, MaterialDensity=mat_4.Density)  # disabled
ma_2 = MassAddition(Input=bselfweight_2)  # -> Result, PartialResults; disabled
vlen_3 = VectorLength(Vector=ma_2.Result)  # disabled
load_5 = Load(Point=blength_2.Points, NodalForce=bselfweight_2)  # disabled
kn_3 = Number(expr("X*1e-3", vlen_3))  # disabled
vdis_4 = VectorDisplay(Anchor=blength_2.Points, Vector=expr("X/100", bselfweight_2))  # disabled

beam = Beam(
    StartPlane=pln_2,
    EndPlane=pln,
    EModulus=mat_4.YoungsModulus,
    GModulus=mat_4.ShearModulus,
    A=circularcs.A,
    Iy=circularcs.I,
    Iz=circularcs.Z,
    It=circularcs.It)  # disabled

total_weight_kn_2 = Panel(kn_3)  # disabled
entwine_2 = Entwine(Branch00=show_2, Branch01=support6dof, Branch02=beam, Branch03=load_5, FlattenInputs=True)  # disabled

button_5 = Button()  # disabled
toggle_9 = BooleanToggle(False)  # disabled
panel_15 = Panel("1e-20")  # disabled
solver_2 = Solver(GoalObjects=entwine_2, Reset=button_5, Threshold=panel_15, Tolerance=0.01, On=toggle_9)  # -> I, V, O; disabled

bang_2 = ExplodeTree(Data=solver_2.O)  # -> Branch0, Branch1, Branch2, Branch3; disabled

beamoutput = BeamOutput(BeamData=bang_2.Branch2)  # -> P0, P1, N, Vy, Vz, Mt, My0, Mz0, My1, Mz1; disabled
ln = Line(StartPoint=beamoutput.P0, EndPoint=beamoutput.P1)  # disabled
abs_2 = Absolute(Value=[beamoutput.My0, beamoutput.My1])  # disabled
abs_3 = Absolute(Value=beamoutput.Vy)  # disabled
abs_4 = Absolute(Value=beamoutput.Mt)  # disabled
abs_5 = Absolute(Value=[beamoutput.Mz0, beamoutput.Mz1])  # disabled
abs_6 = Absolute(Value=beamoutput.Vz)  # disabled
sort_2 = SortList(Keys=abs_2)  # -> reverse(Keys), ValuesA; disabled
number_slider_24 = Slider(8, range=0..100)  # disabled
number_slider_25 = Slider(1, range=0..10)  # disabled
sort_3 = SortList(Keys=abs_3)  # -> reverse(Keys), ValuesA; disabled
sort_4 = SortList(Keys=abs_4)  # -> reverse(Keys), ValuesA; disabled
sort_5 = SortList(Keys=abs_5)  # -> reverse(Keys), ValuesA; disabled
sort_6 = SortList(Keys=abs_6)  # -> reverse(Keys), ValuesA; disabled
item_3 = ListItem(List=sort_2.Keys, Index=0, Wrap=True)  # disabled
swatch_3 = ColourSwatch(SwatchColor=RGB(0, 187, 255))  # disabled
item_4 = ListItem(List=sort_3.Keys, Index=0, Wrap=True)  # disabled
item_5 = ListItem(List=sort_4.Keys, Index=0, Wrap=True)  # disabled
item_6 = ListItem(List=sort_5.Keys, Index=0, Wrap=True)  # disabled
item_7 = ListItem(List=sort_6.Keys, Index=0, Wrap=True)  # disabled
list = ValueList({"Vy": 0, "Vz": 1, "Mt": 2, "My": 3, "Mz": 4}, selected="My")  # disabled
my_max_knm = Panel(item_3)  # disabled
mt_max_knm = Panel(item_5)  # disabled
mz_max_knm = Panel(item_6)  # disabled
vy_max_kn = Panel(item_4)  # disabled
vz_max_kn = Panel(item_7)  # disabled
axialdisplay_2 = AxialVisualisation(Line=ln, AxialForces=beamoutput.N, ThicknessMax=number_slider_24)  # disabled
bendingdisplay = BendingVisualisation6DOF(
    P0=beamoutput.P0,
    P1=beamoutput.P1,
    Vy=beamoutput.Vy,
    Vz=beamoutput.Vz,
    Mt=beamoutput.Mt,
    My0=beamoutput.My0,
    Mz0=beamoutput.Mz0,
    My1=beamoutput.My1,
    Mz1=beamoutput.Mz1,
    Option=list,
    ScaleFactor=number_slider_25,
    Colour=swatch_3)  # disabled

displ_2 = Displacements(InitialPositions=duppt_2, FinalPositions=bang_2.Branch0)  # -> TotalDisplacements, MaximumDisplacementX, MaximumDisplacementY, MaximumDisplacementZ; disabled
vlen_4 = VectorLength(Vector=displ_2.TotalDisplacements)  # disabled
sort_7 = SortList(Keys=vlen_4, ValuesA=bang_2.Branch0)  # -> reverse(Keys), reverse(ValuesA); disabled
item_8 = ListItem(List=sort_7.ValuesA, Index=0, Wrap=True)  # disabled
item_9 = ListItem(List=sort_7.Keys, Index=0, Wrap=True)  # disabled
int = Integer(item_9)  # disabled
pt_3 = Point(item_8)  # disabled
panel_16 = Panel(int)  # disabled

support6dofoutput = Support6DOFOutput(Support6DOFData=bang_2.Branch1)  # -> SupportPlane, ReactionForce, ReactionMoment; disabled
pln_3 = Plane(support6dofoutput.SupportPlane)  # disabled
vec_2 = Vector(expr("Round(X,1)", support6dofoutput.ReactionMoment))  # disabled
vec_3 = Vector(expr("Round(X,1)", support6dofoutput.ReactionForce))  # disabled
panel_17 = Panel(vec_3)  # disabled
global_reaction_moment = Panel(vec_2)  # disabled
vdis_5 = VectorDisplay(Anchor=support6dofoutput.SupportPlane, Vector=expr("X*1e-1", support6dofoutput.ReactionForce))  # disabled

number_slider_26 = Slider(0.4, range=0..10)  # disabled
shear = Shear(Line=ln, BendingMoment=beamoutput.My0, BendingPlane=beamoutput.P0)  # disabled
shearvisualisation = ShearVisualisation(Line=ln, ShearVectors=shear, ScaleFactor=number_slider_26)  # disabled

# ---- group: Displacements
range_2 = Range(Domain=Domain(0, 1), Steps=expr("20", 10))  # disabled
gradient_2 = Gradient(LowerLimit=0, UpperLimit=1, Parameter=range_2, stops=[0: RGB(0, 128, 0), 0.5: RGB(255, 255, 0), 1: RGB(255, 0, 0)])  # disabled
vlen_5 = VectorLength(Vector=displ_2.TotalDisplacements)  # disabled
displ_mm_2 = Panel(displ_2.MaximumDisplacementZ)  # disabled
displvis_2 = DisplacementVisualisation(DisplacedNodes=bang_2.Branch0, Displacement=vlen_5, ColourRange=gradient_2)  # disabled

# ----
loadvisualisation = LoadVisualisation(Load=bang_2.Branch3, Colour=RGB(0, 139, 139), Scale=1)  # disabled
panel_18 = Panel(vlen_5)  # disabled

# ----
# OPTIMISATION:
# MOVING NODES ACCORDING TO
# ANALYSIS COLOUR FIELD
number_slider_27 = Slider(0.3, range=0..1)

length = Length(Curve=explode.Segments)

multiplication = Multiplication(A=length, B=number_slider_27)

multiplication_2 = Multiplication(A=length, B=Slider(1, range=0..1.5))

clamplength = ClampLength(Line=explode.Segments, LowerLimit=multiplication, UpperLimit=multiplication_2, Strength=Slider(892, range=0..1000))

merge = Merge(
    Data1=show_4,
    Data2=show_3,
    Data3=clamplength,
    Data4=onmesh,
    Data5=spherecollide,
    Data6=anchor,
    Data7=load_4,
    Data8=nofoldthrough)
solver_3 = Solver(GoalObjects=flatten(merge), Reset=Button(), Threshold=1e-15, Tolerance=0.01, On=Toggle(False))  # -> I, V, O
curve_4 = Curve(solver_3.O)

number_slider_28 = Slider(0.15, range=0..1)  # disabled
topologizer = Topologizer(LinesInput=curve_4, Tolerance=number_slider_28)  # -> Lines, Points, LineStart, LineStart_2, Neighbours, Incoming, Outgoing, Graph; disabled

boolean_toggle_6 = BooleanToggle(True)
point_2 = Point(solver_3.O)  # disabled
clean_tree_2 = CleanTree(RemoveNulls=boolean_toggle_6, RemoveInvalid=boolean_toggle_6, RemoveEmpty=boolean_toggle_6, Tree=point_2)

number_slider_29 = Slider(0.07, range=0..1)  # disabled
pipe = Pipe(Curve=curve_4, Radius=number_slider_29, Caps=0)  # disabled

c_script_6 = CSharpScript(x=solver_3.O)  # -> out, A; inputs x: list; disabled
# ---------- c_script_6: C# usings ----------
using System.Linq;
# ---------- c_script_6: C# ----------
    //List <double> output = new List<double>{};

    A = getRadius(x);

    //A = output;
# ---------- c_script_6: C# additional code ----------
  public List<double> getRadius(List<object> item)
  {
    return item.OfType<double>().ToList();
  }
# ---------- end c_script_6 ----------
mesh_sphere = MeshSphere(Base=clean_tree_2, Radius=number_slider_7, UCount=10, VCount=20)  # disabled
stepsolver = StepSolver(GoalObjects=flatten(merge), Tolerance=0.01, Momentum=False, Damping=0.99, SubIterations=10, Animate=c_script_3.A)  # -> I, V, O; disabled
line = Line(stepsolver.O)
pipe_2 = Pipe(Curve=line, Radius=Slider(0.02, range=0..0.1), Caps=0)
custom_preview = CustomPreview(Geometry=pipe_2, Material=ColourSwatch(SwatchColor=RGB(255, 0, 0)))

boolean_toggle_7 = BooleanToggle(True)  # disabled
clean_tree_3 = CleanTree(RemoveNulls=boolean_toggle_7, RemoveInvalid=boolean_toggle_7, RemoveEmpty=boolean_toggle_7, Tree=curve_4)  # disabled
removeduplicatelines_2 = RemoveDuplicateLines(Lines=clean_tree_3, Tolerance=0.01)  # disabled

curve_5 = Curve(removeduplicatelines_2)  # disabled
# MAKING CHANNEL POCKETS STAGE1
curve_6 = Curve(curve_5)  # disabled

number_slider_30 = Slider(0, range=0..0.1)  # disabled
length_2 = Length(Curve=curve_6)  # disabled
list_length = ListLength(List=curve_6)  # disabled
duplicate_data = DuplicateData(Data=number_slider_30, Number=list_length, Order=True)  # disabled
subtraction_2 = Subtraction(A=length_2, B=number_slider_30)  # disabled
merge_2 = Merge(Data1=simplify(graft(subtraction_2)), Data2=simplify(graft(duplicate_data)))  # disabled
evaluate_length = EvaluateLength(Curve=graft(curve_6), Length=merge_2, Normalized=False)  # -> Point, Tangent, Parameter; disabled
number_slider_31 = Slider(1, range=0..1)  # disabled
shatter = Shatter(Curve=graft(curve_6), Parameters=evaluate_length.Parameter)  # disabled
list_item_2 = ListItem(List=shatter, Index=number_slider_31, Wrap=True)  # disabled

point_on_curve = PointOnCurve(list_item_2, parameter=0.5)  # disabled
end_points_2 = EndPoints(Curve=list_item_2)  # -> Start, End; disabled
surface_closest_point = SurfaceClosestPoint(Point=point_on_curve, Surface=surface)  # -> Point, UVPoint, Distance; disabled
vector_2pt = Vector2Pt(PointA=end_points_2.Start, PointB=end_points_2.End, Unitize=False)  # -> Vector, Length; disabled
evaluate_surface = EvaluateSurface(Surface=surface, Point=surface_closest_point.UVPoint)  # -> Point, Normal, UDirection, VDirection, Frame; disabled
align_plane = AlignPlane(Plane=evaluate_surface.Frame, Direction=vector_2pt.Vector)  # -> Plane, Angle; disabled

number_slider_32 = Slider(0.06, range=0..0.1)  # disabled
number_slider_33 = Slider(0, range=0..3)  # disabled
offset_curve = OffsetCurve(Curve=list_item_2, Distance=number_slider_32, Plane=align_plane.Plane, BothSides=True, Kinks=0, CapType=number_slider_33)  # disabled

plane_origin = PlaneOrigin(Base=align_plane.Plane, Origin=point_on_curve)  # disabled
deconstruct_plane = DeconstructPlane(Plane=plane_origin)  # -> Origin, XAxis, YAxis, ZAxis; disabled

number_slider_34 = Slider(0.25, range=0..1.1)  # disabled
number_slider_35 = Slider(0, range=0..10)  # disabled
number_slider_36 = Slider(0, range=0..10)  # disabled
fatten = Fatten(
    Skeleton=curve_5,
    Thickness=number_slider_34,
    LengthSubdivisions=number_slider_35,
    EndType=number_slider_36,
    AdjustForAngle=False)  # disabled

number_slider_37 = Slider(0.1, range=0..0.1)  # disabled
negative_2 = Negative(Value=number_slider_34)  # disabled
merge_3 = Merge(Data1=number_slider_34, Data2=negative_2)  # disabled
line_sdl = LineSDL(Start=deconstruct_plane.Origin, Direction=deconstruct_plane.YAxis, Length=merge_3)  # disabled

number_slider_38 = Slider(0.25, range=0..1.1)  # disabled
number_slider_39 = Slider(1, range=0..10)  # disabled
number_slider_40 = Slider(0, range=0..10)  # disabled
fatten_2 = Fatten(
    Skeleton=curve_5,
    Thickness=number_slider_38,
    LengthSubdivisions=number_slider_39,
    EndType=number_slider_40,
    AdjustForAngle=False)  # disabled

number_slider_41 = Slider(0.076, range=0..0.1)  # disabled
pipe_3 = Pipe(Curve=line_sdl, Radius=number_slider_41, Caps=1)  # disabled

mesh_edges_4 = MeshEdges(Mesh=fatten)  # -> NakedEdges, InteriorEdges, NonManifoldEdges; disabled
weaverbird_s_loop_subdivision = WeaverbirdsLoopSubdivision(MeshCurves=fatten_2, Level=1, SmoothNakedEdges=1)  # disabled
mesh_edges_5 = MeshEdges(Mesh=weaverbird_s_loop_subdivision)  # -> NakedEdges, InteriorEdges, NonManifoldEdges; disabled
collision_one_many = CollisionOneMany(Collider=flatten(mesh_edges_4.InteriorEdges), Obstacles=pipe_3)  # -> Collision, Index; disabled
cull_pattern_6 = CullPattern(List=simplify(mesh_edges_4.InteriorEdges), CullPattern=collision_one_many.Collision)  # disabled
mesh_volume = MeshVolume(Mesh=weaverbird_s_loop_subdivision)  # -> Volume, Centroid; disabled
shift_paths = ShiftPaths(Data=cull_pattern_6, Offset=-1)  # disabled
loft = Loft(Curves=shift_paths, Options={Adjust=False, Closed=False, LoftEnds=0, LoftSimp=0, LoftType=0, Rebuild=10, Refit=0.01})  # disabled
absolute = Absolute(Value=mesh_volume.Volume)  # disabled
data = Data(absolute)  # disabled
multiplication_3 = Multiplication(A=number_slider_20, B=data)  # disabled

mesh_8 = Mesh(<mesh referenced from the Rhino model>)
weld_mesh_2 = WeldMesh(Mesh=mesh_8, Angle=3.141592654)
weaverbird_s_naked_boundary_2 = WeaverbirdsNakedBoundary(MeshClosedPolylines=weld_mesh_2)
mesh_edges_6 = MeshEdges(Mesh=weld_mesh_2)  # -> NakedEdges, InteriorEdges, NonManifoldEdges
deconstruct_mesh_5 = DeconstructMesh(Mesh=weld_mesh_2)  # -> Vertices, Faces, Colours, Normals
number_slider_42 = Slider(0.073, range=0..0.1)

join_curves = JoinCurves(Curves=mesh_edges_6.NakedEdges, Preserve=False)
control_points = ControlPoints(Curve=join_curves)  # -> Points, Weights, Knots
removeduplicatepts = RemoveDuplicatePts(Points=control_points.Points, Tolerance=0.01)

negative_3 = Negative(Value=number_slider_42)
merge_4 = Merge(Data1=negative_3, Data2=number_slider_42)  # -> graft(Result)
unit_z = UnitZ(Factor=merge_4)  # -> simplify(UnitVector)

closest_point = ClosestPoint(Point=deconstruct_mesh_5.Vertices, Cloud=flatten(removeduplicatepts))  # -> ClosestPoint, CPIndex, Distance
larger_than = LargerThan(FirstNumber=closest_point.Distance, SecondNumber=0)  # -> LargerThan, OrEqualTo
dispatch = Dispatch(List=deconstruct_mesh_5.Vertices, DispatchPattern=larger_than.LargerThan)  # -> ListA, ListB
move = Move(Geometry=dispatch.ListA, Motion=unit_z)  # -> simplify(Geometry), Transform
weave = Weave(Pattern=larger_than.LargerThan, Stream0=dispatch.ListB, Stream1=move.Geometry, NullGaps=False)  # -> simplify(Weave)
construct_mesh = ConstructMesh(Vertices=weave, Faces=deconstruct_mesh_5.Faces)  # -> simplify(Mesh)
explode_tree = ExplodeTree(Data=construct_mesh)  # -> Branch0, Branch1
mesh_flip = MeshFlip(Mesh=explode_tree.Branch0)
merge_5 = Merge(Data1=mesh_flip, Data2=explode_tree.Branch1)  # -> flatten(Result)
mesh_join = MeshJoin(Meshes=merge_5)

mesh_9 = Mesh(mesh_join)
weld_mesh_3 = WeldMesh(Mesh=mesh_9, Angle=3.141592654)  # disabled
unify_mesh = UnifyMesh(Mesh=weld_mesh_3)  # -> Result, Count; disabled

brep_7 = Brep([<brep referenced from the Rhino model> x4])  # disabled
deconstruct_mesh_6 = DeconstructMesh(Mesh=unify_mesh.Result)  # -> Vertices, Faces, Colours, Normals; disabled
point_in_breps_6 = PointInBreps(Brep=brep_7, Point=deconstruct_mesh_6.Vertices, Strict=False)  # -> Inside, Index; disabled
dispatch_2 = Dispatch(List=deconstruct_mesh_6.Vertices, DispatchPattern=point_in_breps_6.Inside)  # -> ListA, ListB; disabled

number_slider_43 = Slider(0.005, range=0..0.01)  # disabled
multiplication_4 = Multiplication(A=deconstruct_mesh_6.Normals, B=number_slider_43)  # disabled
vector_display = VectorDisplay(Anchor=deconstruct_mesh_6.Vertices, Vector=multiplication_4)  # disabled

mesh_edges_7 = MeshEdges(Mesh=unify_mesh.Result)  # -> NakedEdges, InteriorEdges, NonManifoldEdges; disabled
geometry_5 = Geometry([mesh_edges_7.NakedEdges, mesh_edges_7.InteriorEdges])  # disabled
pt_4 = Point(dispatch_2.ListA)  # disabled

sort_duplicate_points = SortDuplicatePoints(Points=dispatch_2.ListB)  # -> UniquePoints, Indices; disabled
number_slider_44 = Slider(0.029, range=0.005..0.25)  # disabled
number_slider_45 = Slider(7810, range=0..10000)  # disabled
spherecollide_2 = SphereCollide(Points=sort_duplicate_points.UniquePoints, Radius=number_slider_44, Strength=number_slider_45)  # disabled

solidpointcollide = SolidPointCollide(Points=sort_duplicate_points.UniquePoints, Solid=brep_7, Interior=False, Unidirectional=True, Strength=number_slider_16)  # disabled
volume = Volume(Mesh=unify_mesh.Result, Volume=multiplication_3, Strength=number_slider_14)  # disabled
anchor_2 = Anchor(Point=pt_4, Strength=number_slider_18)  # disabled
show_5 = Show(G=unify_mesh.Result)  # disabled
vertexloads = VertexLoads(Mesh=unify_mesh.Result, Strength=negative)  # disabled
length_line_2 = LengthLine(Line=geometry_5, Strength=number_slider_13)  # disabled

length_3 = Length(Curve=geometry_5)  # disabled
number_slider_46 = Slider(0.986, range=0..1)  # disabled
multiplication_5 = Multiplication(A=length_3, B=number_slider_46)  # disabled

multiplication_6 = Multiplication(A=length_3, B=number_slider_12)  # disabled

clamplength_2 = ClampLength(Line=geometry_5, LowerLimit=multiplication_5, UpperLimit=multiplication_6, Strength=number_slider_13)  # disabled

number_slider_47 = Slider(181, range=0..181)  # disabled

multiplication_7 = Multiplication(A=number_slider_20, B=number_slider_47)  # disabled

pressure = Pressure(M=unify_mesh.Result, Strength=multiplication_7)  # disabled

stream_gate = StreamGate(
    Stream=[show_5, clamplength_2, pressure, anchor_2, floor, vertexloads, spherecollide_2, grab.Grab, volume],
    Gate=number_slider_19)  # -> Target0, Target1; disabled
solver_4 = Solver(GoalObjects=flatten(stream_gate.Target1), Reset=button_3, Threshold=1e-15, Tolerance=0.01, On=boolean_toggle_4)  # -> I, V, O; disabled
stepsolver_2 = StepSolver(
    GoalObjects=flatten(stream_gate.Target0),
    Tolerance=0.01,
    Momentum=False,
    Damping=0.99,
    SubIterations=number_slider_21,
    Animate=c_script_5.A)  # -> I, V, O; disabled
stream_filter = StreamFilter(Gate=number_slider_19, Stream0=stepsolver_2.O, Stream1=solver_4.O)  # disabled

boolean_toggle_8 = BooleanToggle(True)  # disabled
mesh_10 = Mesh(stream_filter)  # disabled
clean_tree_4 = CleanTree(RemoveNulls=boolean_toggle_8, RemoveInvalid=boolean_toggle_8, RemoveEmpty=boolean_toggle_8, Tree=mesh_10)  # disabled

weaverbird_s_loop_subdivision_2 = WeaverbirdsLoopSubdivision(MeshCurves=clean_tree_4, Level=1, SmoothNakedEdges=1)  # disabled
mesh_edges_8 = MeshEdges(Mesh=weaverbird_s_loop_subdivision_2)  # -> NakedEdges, InteriorEdges, NonManifoldEdges; disabled
geometry_6 = Geometry(flatten([mesh_edges_8.NakedEdges, mesh_edges_8.InteriorEdges]))  # disabled

colour_swatch = ColourSwatch(SwatchColor=RGB(84, 84, 84))  # disabled
custom_preview_2 = CustomPreview(Geometry=weaverbird_s_loop_subdivision_2, Material=colour_swatch)  # disabled

colour_swatch_2 = ColourSwatch(SwatchColor=RGB(255, 0, 255))  # disabled
custom_preview_3 = CustomPreview(Geometry=mesh_7, Material=colour_swatch)  # disabled
