# Grasshopper definition 200501_Inflatable_Cutting Pattern for a Spline.gh (Grasshopper 1.0.7)
# plug-ins: OpenNest, LunchBox

curve = Curve(<curve referenced from the Rhino model>)
divide_curve = DivideCurve(Curve=curve, Count=Slider(12, range=0..100), Kinks=False)  # -> Points, Tangents, Parameters
polyline = PolyLine(Vertices=divide_curve.Points, Closed=False)
pipe = Pipe(Curve=polyline, Radius=Slider(0.2, range=0..1), Caps=0)

# ---- group: Input Geometry
brep = Brep(pipe)

# ----
# Unroll_ only works for developable surface
deconstruct_brep = DeconstructBrep(Brep=brep)  # -> Faces, Edges, Vertices
unroll_brep = UnrollBrep(Brep=deconstruct_brep.Faces, JoinUnrolled=False)
brep_wireframe = BrepWireframe(Brep=unroll_brep, Density=-1)
join_curves = JoinCurves(Curves=brep_wireframe, Preserve=False)  # -> flatten(Curves)

number_slider = Slider(0.3, range=0..10)
unit_x = UnitX(Factor=1)
area = Area(Geometry=deconstruct_brep.Faces)  # -> Area, Centroid
line_sdl = LineSDL(Start=area.Centroid, Direction=unit_x, Length=expr("-x", Slider(1.15, range=0..10)))

geometry = Geometry(deconstruct_brep.Edges)

end_points = EndPoints(Curve=line_sdl)  # -> Start, End
point_list = PointList(Points=end_points.End, Size=number_slider)

# ---- group: Spacing between nested objects
number_slider_2 = Slider(0.04, range=0..1)

# ---- group: Sheets to lay on(curve only)
# nesting, moving flatten curves onto sheets
crv = Curve(<curve referenced from the Rhino model>)

# ----
colour_swatch = ColourSwatch(SwatchColor=RGB(255, 0, 255))
custom_preview = CustomPreview(Geometry=brep, Material=colour_swatch)

opennest = OpenNest(
    Sheets=crv,
    Geo=join_curves,
    Spacing=number_slider_2,
    Placement=1,
    Tolerance=0.1,
    Rotations=4,
    Iterations=1,
    Seed=1,
    Reset=True,
    Run=False)  # -> Sheets, Geo, ID, Transform, IDS
transform = Transform(Geometry=join_curves, Transform=opennest.Transform)
boundary_surfaces = BoundarySurfaces(Edges=opennest.Geo)
custom_preview_2 = CustomPreview(Geometry=boundary_surfaces, Material=colour_swatch)

area_2 = Area(Geometry=boundary_surfaces)  # -> Area, Centroid
unit_z = UnitZ(Factor=Slider(0.11, range=0..10))
move = Move(Geometry=area_2.Centroid, Motion=unit_z)  # -> Geometry, Transform

point_list_2 = PointList(Points=move.Geometry, Size=number_slider)
