# Grasshopper definition 200504_Global Design_V2.gh (Grasshopper 1.0.7)
# plug-ins: MeshEdit Components, Pufferfish, Fattener, Kangaroo Components, PlanktonGh, Weaverbird, Kangaroo2 Components

number_slider = Slider(37, range=0..100)  # disabled
geometry = Geometry([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])  # disabled
divide_curve = DivideCurve(Curve=geometry, Count=number_slider, Kinks=False)  # -> Points, Tangents, Parameters; disabled
curve = Curve([<curve referenced from the Rhino model> x4])  # disabled

number_slider_2 = Slider(2, range=0..10)  # disabled
boolean_toggle = BooleanToggle(True)  # disabled
loft_options = LoftOptions(Closed=False, Adjust=boolean_toggle, Rebuild=0, Refit=0, Type=number_slider_2)  # disabled
loft = Loft(Curves=curve, Options=loft_options)  # disabled

mesh = Mesh(loft)  # disabled
nakedvertices = NakedVertices(Mesh=mesh)  # -> ClothedIndex, NakedIndex, ClothedPts, NakedPts; disabled
geometry_2 = Geometry(nakedvertices.NakedPts)  # disabled
number_slider_3 = Slider(1.14, range=0..5)  # disabled
boolean_toggle_2 = BooleanToggle(False)  # disabled
timer = Timer(TimerInterval=1000, Target=meshmachine)  # disabled
meshmachine = MeshMachine(
    Geometry=mesh,
    Length=number_slider_3,
    FixVertices=geometry_2,
    Flip=1,
    PullStrength=0.8,
    CurvatureAdaptivity=0,
    BoundaryScale=1,
    BoundaryDistance=5,
    Exponent=2,
    Background=0.5,
    Iterations=1,
    Reset=boolean_toggle_2)  # disabled
planktonmesh = PlanktonMesh(meshmachine)  # disabled
mesh_edges = MeshEdges(Mesh=planktonmesh)  # -> NakedEdges, InteriorEdges, NonManifoldEdges; disabled
mesh_2 = Mesh(planktonmesh)  # disabled

convexhull = _3DConvexHull(Points=flatten(divide_curve.Points))  # disabled
wbtriangles = WeaverbirdsSplitTrianglesSubdivision(MeshCurves=convexhull, Level=3)  # disabled
close_mesh = CloseMesh(Mesh=wbtriangles, Quadrangulate=True)  # -> Closed, Amount, Openings, ResultBoolean; disabled

mesh_3 = Mesh(convexhull)  # disabled
deconstruct_mesh = DeconstructMesh(Mesh=convexhull)  # -> Vertices, Faces, Colours, Normals; disabled
mesh_edges_2 = MeshEdges(Mesh=mesh_3)  # -> NakedEdges, InteriorEdges, NonManifoldEdges; disabled

number_slider_4 = Slider(10, range=0..100)  # disabled
list_item = ListItem(List=curve, Index=0, Wrap=True)  # -> Item1, Item; disabled
divide_curve_2 = DivideCurve(Curve=list_item.Item, Count=number_slider_4, Kinks=False)  # -> Points, Tangents, Parameters; disabled
divide_curve_3 = DivideCurve(Curve=list_item.Item1, Count=number_slider_4, Kinks=False)  # -> Points, Tangents, Parameters; disabled
geodesic = Geodesic(Surface=loft, Start=divide_curve_2.Points, End=reverse(divide_curve_3.Points))  # disabled

number_slider_5 = Slider(19, range=0..100)  # disabled
number_slider_6 = Slider(8, range=0..10)  # disabled
bounding_box = BoundingBox(Content=geometry, Plane=PlaneXY(0, 0, 0), UnionBox=True)  # -> Box, Box_2; disabled
polygon = Polygon(Plane=PlaneXY(0, 0, 0), Radius=4, Segments=13, FilletRadius=0)  # -> Polygon, Length; disabled
button = Button()  # disabled
mesh_4 = Mesh(close_mesh.Closed)  # disabled
geometry_3 = Geometry(deconstruct_mesh.Vertices)  # disabled
button_2 = Button()  # disabled
number_slider_7 = Slider(0.15, range=0..1)  # disabled
pt = Point([Point(17, 17, 0), Point(21, 4, 0), Point(31, 16, 0)])  # disabled
number_slider_8 = Slider(1.1, range=0..10)  # disabled
number_slider_9 = Slider(1, range=0..1)  # disabled
explode = Explode(Curve=polygon.Polygon, Recursive=True)  # -> Segments, Vertices; disabled
boolean_toggle_3 = BooleanToggle(False)  # disabled
brep = Brep(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)  # disabled
timer_2 = Timer(TimerInterval=1, Target=customiteration_2)  # disabled
timer_3 = Timer(TimerInterval=1, Target=customiteration)  # disabled
mesh_box = MeshBox(Base=bounding_box.Box, XCount=number_slider_5, YCount=number_slider_5, ZCount=number_slider_6)  # disabled
customiteration = CSharpScript(
    StartSegments=explode.Segments,
    Reset=button,
    Reference=["C:\Users\Daniel\Documents\GitHub\Kangaroo2\bin\Release\KangarooSolver.dll", "C:\Users\User\AppData\Roaming\Grasshopper\Libraries\KangarooSolver.dll"])  # -> out, A, B; inputs StartSegments: list of Line, Reset: Boolean; disabled
# ---------- customiteration: C# ----------
    double increment = 0.01;
    double collisionRadius = 1.0;
    double splitLength = 2.0;

    if(Reset || Springs == null)
    {
      PS = new KangarooSolver.PhysicalSystem();
      Springs = new List<IGoal>();

      foreach(Line L in StartSegments)
      {
        IGoal G = new Spring(L.From, L.To, L.Length, 1);
        PS.AssignPIndex(G, 0.0001);  //this ensures coincident endpoints are combined into single particles
        Springs.Add(G);
      }
    }

    else
    {
      int count = Springs.Count;

      for(int i = 0; i < count;i++)
      {
        Spring S = Springs[i] as Spring;
        Point3d Start = PS.GetPosition(S.PIndex[0]);
        Point3d End = PS.GetPosition(S.PIndex[1]);

        double LineLength = Start.DistanceTo(End);
        if(LineLength > splitLength)
        {
          Point3d MidPt = 0.5 * (Start + End);
          PS.AddParticle(MidPt, 1);
          int newParticleIndex = PS.ParticleCount() - 1;
          int endIndex = S.PIndex[1];
          //set the end of the original spring to be the newly created midpoint
          //and make a new spring from the midpoint to the original endpoint
          S.PIndex[1] = newParticleIndex;
          S.RestLength = 0.5 * LineLength;
          Spring otherHalf = new Spring(newParticleIndex, endIndex, 0.5 * LineLength, 1);
          Springs[i] = S;
          Springs.Add(otherHalf);
        }
        else
        {
          S.RestLength += increment;
          Springs[i] = S;
        }
      }

      //add collisions
      var GoalList = new List<IGoal>();
      GoalList.AddRange(Springs);

      var IndexList = Enumerable.Range(0, PS.ParticleCount()).ToList();
      IGoal Collisions = new SphereCollide2(IndexList, collisionRadius, 1);

      GoalList.Add(Collisions);

      PS.Step(GoalList, false, 0.001);
      A = PS.GetOutput(GoalList);
    }
# ---------- customiteration: C# additional code ----------
  KangarooSolver.PhysicalSystem PS;
  List<IGoal> Springs;


  public class SphereCollide2 : GoalObject
  {
    public double Strength;
    public double SqDiam;
    public double Diam;

    public SphereCollide2(List<Point3d> V, double r, double k)
    {
      int L = V.Count;
      PPos = V.ToArray();
      Move = new Vector3d[L];
      Weighting = new double[L];
      for (int i = 0; i < L; i++)
      {
        Weighting[i] = k;
      }
      Diam = r + r;
      SqDiam = Diam * Diam;
      Strength = k;
    }

    public SphereCollide2(List<int> V, double r, double k)
    {
      int L = V.Count;
      PIndex = V.ToArray();
      Move = new Vector3d[L];
      Weighting = new double[L];
      for (int i = 0; i < L; i++)
      {
        Weighting[i] = k;
      }
      Diam = r + r;
      SqDiam = Diam * Diam;
      Strength = k;
    }

    public override void Calculate(List<KangarooSolver.Particle> p)
    {
      int L = PIndex.Length;
      double[] Xcoord = new double[L];
      for (int i = 0; i < L; i++)
      {
        Xcoord[i] = p[PIndex[i]].Position.X;
      }
      Array.Sort(Xcoord, PIndex);

      for (int i = 0; i < L; i++)
      {
        Move[i] = Vector3d.Zero;
        Weighting[i] = 0;
      }

      for (int i = 0; i < (PIndex.Length - 1); i++)
      {
        for (int j = 1; (i + j) < PIndex.Length; j++)
        {
          int k = i + j;
          Vector3d Separation = p[PIndex[k]].Position - p[PIndex[i]].Position;
          if (Separation.X < Diam)
          {
            if (Separation.SquareLength < SqDiam)
            {
              double LengthNow = Separation.Length;
              double stretchfactor = 1.0 - Diam / LengthNow;
              Vector3d SpringMove = 0.5 * Separation * stretchfactor;
              Move[i] += SpringMove;
              Move[k] -= SpringMove;
              Weighting[i] = Strength;
              Weighting[k] = Strength;
            }
          }

          else { break; }
        }
      }
    }

  }
# ---------- end customiteration ----------
customiteration_2 = CSharpScript(
    StartPoints=pt,
    TargetMesh=brep,
    Reset=button_2,
    Reference=["C:\Users\Daniel\Documents\GitHub\Kangaroo2\bin\Release\KangarooSolver.dll", "C:\Users\User\AppData\Roaming\Grasshopper\Libraries\KangarooSolver.dll"])  # -> out, A; inputs StartPoints: list of Point3d, TargetMesh: Mesh, Reset: Boolean; disabled
# ---------- customiteration_2: C# usings ----------
using System.IO;
using System.Linq;
using System.Data;
using System.Drawing;
using System.Reflection;
using System.Windows.Forms;
using System.Xml;
using System.Xml.Linq;
using System.Runtime.InteropServices;

using Rhino.DocObjects;
using Rhino.Collections;
using GH_IO;
using GH_IO.Serialization;
// [using] failed for 'C:\Users\Daniel\Documents\GitHub\Kangaroo2\bin\Release\KangarooSolver.dll'. File not found.
using KangarooSolver;
using KangarooSolver.Goals;
# ---------- customiteration_2: C# ----------
    if(Reset || Points == null)
    {
      Points = StartPoints;
      counter = 0;
    }

    else
    {
      if(counter < 300)
      {
        // add a new point in the middle of the current ones
        var AveragePoint = new Point3d();
        foreach (Point3d P in Points)
        {
          AveragePoint = AveragePoint + P;
        }
        AveragePoint *= 1.0 / Points.Count;
        Points.Add(AveragePoint);

        //make an instance of the kangaroo solver
        var PS = new KangarooSolver.PhysicalSystem();

        //make the goals we need - one for collisions between all particles, and one keeping them all on the mesh
        List<IGoal> MyGoals = new List<IGoal>();
        var CollideGoal = new KangarooSolver.Goals.SphereCollide(Points, 1, 1);
        MyGoals.Add(CollideGoal);
        var OnMeshGoal = new KangarooSolver.Goals.OnMesh(Points, TargetMesh, 1);
        MyGoals.Add(OnMeshGoal);

        //assign the indexing
        foreach(IGoal G in MyGoals)
        {
          PS.AssignPIndex(G, 0.01);
        }

        //take a step in the simulation and assign the new positions to the list of points
        PS.Step(MyGoals, true, 0);
        Points = PS.GetPositions().ToList();
        counter++;
      }
    }

    A = Points;
# ---------- customiteration_2: C# additional code ----------
  List<Point3d> Points;
  // because this list is outside the main RunScript section,
  // it is preserved from one iteration to the next

  int counter;
# ---------- end customiteration_2 ----------
mesh_5 = Mesh(mesh_box)  # disabled
timer_4 = Timer(TimerInterval=50, Target=meshmachine_2)  # disabled

number_slider_10 = Slider(21, range=0..100)  # disabled
divide_curve_4 = DivideCurve(Curve=geodesic, Count=number_slider_10, Kinks=False)  # -> Points, Tangents, Parameters; disabled

meshmachine_2 = MeshMachine(
    Geometry=mesh_3,
    Length=number_slider_8,
    FixVertices=geometry_3,
    Flip=1,
    PullStrength=number_slider_9,
    CurvatureAdaptivity=number_slider_7,
    BoundaryScale=1,
    BoundaryDistance=5,
    Exponent=2,
    Background=0.5,
    Iterations=1,
    Reset=boolean_toggle_3)  # disabled
deconstruct_mesh_2 = DeconstructMesh(Mesh=mesh_5)  # -> Vertices, Faces, Colours, Normals; disabled
mesh_edges_3 = MeshEdges(Mesh=mesh_box)  # -> NakedEdges, InteriorEdges, NonManifoldEdges; disabled
deconstruct_mesh_3 = DeconstructMesh(Mesh=mesh_box)  # -> Vertices, Faces, Colours, Normals; disabled
panel = Panel(customiteration_2.out)  # disabled
number_slider_11 = Slider(0, range=0..1)  # disabled
planktonmesh_2 = PlanktonMesh(meshmachine_2)  # disabled
length = Length(Curve=mesh_edges_3.InteriorEdges)  # disabled
number_slider_12 = Slider(211000, range=0..211000)  # disabled
number_slider_13 = Slider(50, range=0..100)  # disabled
mesh_edges_4 = MeshEdges(Mesh=planktonmesh_2)  # -> NakedEdges, InteriorEdges, NonManifoldEdges; disabled
closest_point = ClosestPoint(Point=geometry_3, Cloud=deconstruct_mesh_2.Vertices)  # -> ClosestPoint, CPIndex, Distance; disabled
number_slider_14 = Slider(0.5, range=0..1)  # disabled
number_slider_15 = Slider(0.312, range=0..1)  # disabled
boolean_toggle_4 = BooleanToggle(False)  # disabled
number_slider_16 = Slider(500, range=0..1000)  # disabled
multiplication = Multiplication(A=length, B=number_slider_11)  # disabled
length_line = LengthLine(Line=flatten(mesh_edges_3.InteriorEdges), Length=multiplication, Strength=number_slider_13)  # disabled
button_3 = Button()  # disabled
c_script = CSharpScript(
    iStartPoints=simplify(divide_curve_4.Points),
    iMesh=mesh_2,
    Reset=button_3,
    Reference="C:\Users\User\AppData\Roaming\Grasshopper\Libraries\KangarooSolver.dll")  # -> out, A; inputs iStartPoints: tree of Point3d, iMesh: Mesh, Reset: Boolean; disabled
# ---------- c_script: C# usings ----------
using System.IO;
using System.Linq;
using System.Data;
using System.Drawing;
using System.Reflection;
using System.Windows.Forms;
using System.Xml;
using System.Xml.Linq;
using System.Runtime.InteropServices;

using Rhino.DocObjects;
using Rhino.Collections;
using GH_IO;
using GH_IO.Serialization;

using KangarooSolver;
using KangarooSolver.Goals;
# ---------- c_script: C# ----------
    if(Reset || Points == null)
    {
      for(int i = 0; i < iStartPoints.BranchCount; i++){
        List<Point3d> points = new List<Point3d>{};

        for(int j = 0; j < iStartPoints.Branch(i).Count; j++){
          points.Add(iStartPoints.Branch(i)[j]);
        }
        Points.Add(points);
      }
      counter = 0;
    }

    else
    {
      if(counter < 300){
        //instance of kangaroo solver
        var PS = new KangarooSolver.PhysicalSystem();

        //Goals
        List<IGoal> myGoals = new List<IGoal>();

        for(int i = 0; i < Points.Count; i++)
        {
          var CollideGoal = new KangarooSolver.Goals.SphereCollide(Points[i], 0.8, 1);
          myGoals.Add(CollideGoal);
          var OnMeshGoal = new KangarooSolver.Goals.OnMesh(Points[i], iMesh, 1);
          myGoals.Add(OnMeshGoal);
        }


        //assign indexing
        foreach(IGoal G in myGoals)
        {
          PS.AssignPIndex(G, 0.01);
        }

        //take a step in simulation and assign new pos to list of points
        PS.Step(myGoals, true, 0);
        //Points = PS.GetPositions().ToList();
        counter++;
      }
    }

    A = ListOfListsToTree(Points);
# ---------- c_script: C# additional code ----------
  int counter;
  List<List<Point3d>> Points = new List<List<Point3d>>{};





  //double point_param;
  static Grasshopper.DataTree<T> ListOfListsToTree<T > (List < List < T >> s){
  Grasshopper.DataTree<T> tree = new DataTree<T>();
  for(int i = 0;i < s.Count; i++){
  tree.AddRange(s[i], new GH_Path(i));
}
      return tree;
    }
# ---------- end c_script ----------
timer_5 = Timer(TimerInterval=20, Target=[c_script, c_script_2])  # disabled
solidpointcollide = SolidPointCollide(
    Points=flatten(deconstruct_mesh_3.Vertices),
    Solid=flatten(mesh_5),
    Interior=boolean_toggle_4,
    Unidirectional=True,
    Strength=number_slider_12)  # disabled
edgelengths = EdgeLengths(Mesh=mesh_5, LengthFactor=number_slider_15, Strength=number_slider_14)  # disabled
anchor = Anchor(Point=closest_point.ClosestPoint, Target=geometry_3, Strength=number_slider_16)  # disabled
show = Show(G=mesh_5)  # disabled
c_script_2 = CSharpScript(
    iStartPoints=flatten(divide_curve_4.Points),
    iMesh=mesh_2,
    Reset=button_3,
    Reference="C:\Users\User\AppData\Roaming\Grasshopper\Libraries\KangarooSolver.dll")  # -> out, A; inputs iStartPoints: list of Point3d, iMesh: Mesh, Reset: Boolean; disabled
# ---------- c_script_2: C# ----------
    if(Reset || Points == null)
    {
      Points = iStartPoints;
      counter = 0;
    }



    else
    {
      if(counter < 300){
        //instance of kangaroo solver
        var PS = new KangarooSolver.PhysicalSystem();

        //Goals
        List<IGoal> myGoals = new List<IGoal>();

        var CollideGoal = new KangarooSolver.Goals.SphereCollide(Points, 0.8, 1);
        myGoals.Add(CollideGoal);
        var OnMeshGoal = new KangarooSolver.Goals.OnMesh(Points, iMesh, 1);
        myGoals.Add(OnMeshGoal);

        //assign indexing
        foreach(IGoal G in myGoals)
        {
          PS.AssignPIndex(G, 0.01);
        }

        //take a step in simulation and assign new pos to list of points
        PS.Step(myGoals, true, 0);
        Points = PS.GetPositions().ToList();
        counter++;
      }
    }

    A = Points;
# ---------- c_script_2: C# additional code ----------
  int counter;
  List<Point3d> Points;
# ---------- end c_script_2 ----------
button_4 = Button()  # disabled
partition_list = PartitionList(List=c_script_2.A, Size=expr("x+1", number_slider_10))  # disabled
toggle = BooleanToggle(False)  # disabled
solver = Solver(GoalObjects=flatten([show, anchor, edgelengths]), Reset=button_4, Threshold=1e-15, Tolerance=0.01, On=toggle)  # -> I, V, O; disabled
mesh_6 = Mesh(solver.O)  # disabled
polyline = PolyLine(Vertices=partition_list, Closed=False)  # disabled
interpolate = Interpolate(Vertices=partition_list, Degree=3, Periodic=False, KnotStyle=1)  # -> Curve, Length, Domain; disabled
colour_swatch = ColourSwatch(SwatchColor=RGBA(255, 255, 255, 113))  # disabled
mesh_edges_5 = MeshEdges(Mesh=mesh_6)  # -> NakedEdges, InteriorEdges, NonManifoldEdges; disabled
custom_preview = CustomPreview(Geometry=mesh_6, Material=colour_swatch)  # disabled
brep_2 = Brep([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])  # disabled
number_slider_17 = Slider(0.25, range=0.1..1)  # disabled
bbox = BoundingBox(Content=brep_2, Plane=PlaneXY(0, 0, 0), UnionBox=True)  # -> Box, Box_2; disabled
volume = Volume(Geometry=bbox.Box)  # -> Volume, Centroid; disabled
custom_mesh_settings = SettingsCustom(
    StitchSeams=True,
    SimplePlanes=False,
    Refine=True,
    MinCount=16,
    MaxCount=400,
    AspectRatio=20,
    MaxDistance=0,
    MaxAngle=20,
    MinEdge=0,
    MaxEdge=number_slider_17)  # disabled
scale = Scale(Geometry=bbox.Box, Center=volume.Centroid, Factor=1.1)  # -> Geometry, Transform; disabled
mesh_7 = MeshBrep(Brep=scale.Geometry, Settings=custom_mesh_settings)  # disabled
tri = Triangulate(Mesh=mesh_7)  # -> Mesh, Count; disabled
clean = CombineClean(Meshes=tri.Mesh)  # disabled
medges = MeshEdges(Mesh=clean)  # -> NakedEdges, InteriorEdges, NonManifoldEdges; disabled
demesh = DeconstructMesh(Mesh=clean)  # -> Vertices, Faces, Colours, Normals; disabled
number_slider_18 = Slider(0.5, range=0..1)  # disabled
panel_2 = Panel("0.05")  # disabled
panel_3 = Panel("0")  # disabled
toggle_2 = BooleanToggle(True)  # disabled
len = Length(Curve=medges.InteriorEdges)  # disabled
multiplication_2 = Multiplication(A=len, B=number_slider_18)  # disabled
spc = SolidPointCollide(Points=demesh.Vertices, Solid=graft(brep_2), Interior=False, Unidirectional=toggle_2, Strength=10)  # disabled
show_2 = Show(G=clean)  # disabled
volume_2 = Volume(Mesh=clean, Volume=panel_3, Strength=panel_2)  # disabled
length_line_2 = LengthLine(Line=medges.InteriorEdges, Length=multiplication_2, Strength=1)  # disabled

reset = Button()  # disabled
on = BooleanToggle(False)  # disabled

entwine = Entwine(Branch00=[spc, length_line_2, volume_2], Branch01=show_2, FlattenInputs=True)  # disabled
solver_2 = Solver(GoalObjects=entwine, Reset=reset, Threshold=1e-15, Tolerance=0.01, On=on)  # -> I, V, O; disabled
unflatten = UnflattenTree(Tree=solver_2.O, Guide=entwine)  # disabled
bang = ExplodeTree(Data=unflatten)  # -> Branch0, Branch1; disabled
mesh_8 = Mesh(bang.Branch1)  # disabled
geometry_4 = Geometry([<curve referenced from the Rhino model> x9])
cluster = Cluster(curve=geometry_4)
divide_curve_5 = DivideCurve(Curve=flatten(cluster), Count=Slider(13, range=0..100), Kinks=False)  # -> Points, Tangents, Parameters
polyline_2 = PolyLine(Vertices=divide_curve_5.Points, Closed=False)
fatten = Fatten(
    Skeleton=flatten(polyline_2),
    Thickness=Slider(0.6, range=0..1),
    LengthSubdivisions=Slider(0, range=0..10),
    EndType=2,
    AdjustForAngle=False)
weaverbird_s_loop_subdivision = WeaverbirdsLoopSubdivision(MeshCurves=fatten, Level=1, SmoothNakedEdges=1)
deconstruct_mesh_4 = DeconstructMesh(Mesh=weaverbird_s_loop_subdivision)  # -> Vertices, Faces, Colours, Normals
mesh_edges_6 = MeshEdges(Mesh=fatten)  # -> NakedEdges, InteriorEdges, NonManifoldEdges
mesh_edges_7 = MeshEdges(Mesh=weaverbird_s_loop_subdivision)  # -> NakedEdges, InteriorEdges, NonManifoldEdges
custom_preview_2 = CustomPreview(Geometry=weaverbird_s_loop_subdivision, Material=ColourSwatch(SwatchColor=RGBA(0, 0, 0, 182)))
number_slider_19 = Slider(30, range=0..100)
bounding_box_2 = BoundingBox(Content=flatten(geometry_4), Plane=PlaneXY(0, 0, 0), UnionBox=True)  # -> Box, Box_2
brep_3 = Brep(<brep referenced from the Rhino model>)
mesh_box_2 = MeshBox(Base=bounding_box_2.Box_2, XCount=number_slider_19, YCount=number_slider_19, ZCount=Slider(11, range=0..20))
number_slider_20 = Slider(25, range=0..100)
deconstruct_brep = DeconstructBrep(Brep=brep_3)  # -> Faces, Edges, Vertices
weaverbird_s_join_meshes_and_weld = WeaverbirdsJoinMeshesAndWeld(Mesh=mesh_box_2, Weld=True)

divide_curve_6 = DivideCurve(Curve=geometry_4, Count=Slider(100, range=0..160), Kinks=False)  # -> Points, Tangents, Parameters
flatten_tree = FlattenTree(Tree=divide_curve_6.Points, Path="{0}")

combine_clean = CombineClean(Meshes=weaverbird_s_join_meshes_and_weld)
mesh_edges_8 = MeshEdges(Mesh=combine_clean)  # -> NakedEdges, InteriorEdges, NonManifoldEdges
mesh_9 = Mesh(combine_clean)
mesh_box_3 = MeshBox(Base=brep_3, XCount=number_slider_20, YCount=number_slider_20, ZCount=Slider(12, range=0..100))
deconstruct_mesh_5 = DeconstructMesh(Mesh=combine_clean)  # -> Vertices, Faces, Colours, Normals

list_length = ListLength(List=deconstruct_mesh_5.Vertices)
random = Random(Range=list_length, Number=Slider(0, range=0..10), Seed=Slider(14, range=0..100))

deconstruct_mesh_6 = DeconstructMesh(Mesh=mesh_box_3)  # -> Vertices, Faces, Colours, Normals
geometry_5 = Geometry(deconstruct_mesh_6.Vertices)
point = Point(flatten_tree)
list_item_2 = ListItem(List=deconstruct_mesh_5.Vertices, Index=random, Wrap=True)
timer_6 = Timer(TimerInterval=50, Target=c_script_3)  # disabled
button_5 = Button()  # disabled
timer_7 = Timer(TimerInterval=1000, Target=c_script_4)  # disabled
mesh_10 = Mesh(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)  # disabled
c_script_3 = CSharpScript(
    iCollider=point,
    iAnchors=list_item_2,
    iMesh=combine_clean,
    Reset=Button(),
    Reference="C:\Users\User\AppData\Roaming\Grasshopper\Libraries\KangarooSolver.dll")  # -> out, A; inputs iCollider: list of Point3d, iAnchors: list of Point3d, iMesh: Mesh, Reset: Boolean
# ---------- c_script_3: C# ----------
    if(Reset)
    {
      Wrapper = iMesh;
      counter = 0;

      Springs.Clear();
      Anchors.Clear();
      myGoals.Clear();

      //make an instance of the kangaroo solver
      PS = new KangarooSolver.PhysicalSystem();

      //Anchors
      Pts = Wrapper.Vertices.ToPoint3dArray();
      for(int i = 0; i < Pts.Length;i++)
      {
        PS.AddParticle(Pts[i], 1);
        for(int j = 0; j < iAnchors.Count;j++)
        {
          if(Pts[i] == iAnchors[j])
          {
            Anchors.Add(new KangarooSolver.Goals.Anchor(i, Pts[i], 100000));
          }
        }
      }


      //Spring
      for(int i = 0; i < Wrapper.TopologyEdges.Count;i++)
      {
        var Ends = Wrapper.TopologyEdges.GetTopologyVertices(i);
        int Start = Wrapper.TopologyVertices.MeshVertexIndices(Ends.I)[0];
        int End = Wrapper.TopologyVertices.MeshVertexIndices(Ends.J)[0];
        Springs.Add(new KangarooSolver.Goals.Spring(Start, End, 0, 1)); //for each edge, a spring with rest length 0, and strength 1
      }

      myGoals.AddRange(Springs);
      myGoals.AddRange(Anchors);


    }


    else
    {
      if(counter < 300){
        for(int i = 0; i < iCollider.Count; i++)
        {
          if(Wrapper.IsPointInside(iCollider[i], 0.00001, true) == false)
          {
            PointCloud points = new PointCloud(Pts);
            int index = points.ClosestPoint(iCollider[i]);
            myGoals.Add(new KangarooSolver.Goals.Anchor(index, iCollider[i], 10000));
          }
        }
      }


      //PS.SimpleStep(myGoals);
      //PS.MomentumStep(myGoals, threshold, 5);
      PS.Step(myGoals, true, threshold);

      //draw new mesh
      Wrapper.Vertices.Clear();
      Wrapper.Vertices.AddVertices(KangarooSolver.Util.RemoveDupPts2(PS.GetPositions().ToList(), 0.00001));

      //clean up Mesh
      Wrapper.Vertices.CombineIdentical(true, true);
      Wrapper.Vertices.CullUnused();
      Wrapper.Weld(Math.PI);
      Wrapper.FaceNormals.ComputeFaceNormals();
      Wrapper.Normals.ComputeNormals();



      counter++;

    }


    A = Wrapper;
# ---------- c_script_3: C# additional code ----------
  KangarooSolver.PhysicalSystem PS;
  //Goals
  List<IGoal> Springs = new List<IGoal>();
  List<IGoal> Anchors = new List<IGoal>();
  List<IGoal> myGoals = new List<IGoal>();

  Point3d[] Pts;
  int counter;
  int index;
  Mesh Wrapper;
  double threshold = 0.00001;
# ---------- end c_script_3 ----------
c_script_4 = CSharpScript(
    iCollider=point,
    iAnchors=list_item_2,
    iMesh=combine_clean,
    Reset=button_5,
    Reference="C:\Users\User\AppData\Roaming\Grasshopper\Libraries\KangarooSolver.dll")  # -> out, A; inputs iCollider: list of Point3d, iAnchors: list of Point3d, iMesh: Mesh, Reset: Boolean; disabled
# ---------- c_script_4: C# ----------
    if(Reset)
    {
      Wrapper = iMesh;
      counter = 0;

    }


    else
    {
      if(counter < 300){
        //make an instance of the kangaroo solver
        PS = new KangarooSolver.PhysicalSystem();


        //Goals
        List<IGoal> myGoals = new List<IGoal>();
        List<IGoal> Springs = new List<IGoal>();
        List<IGoal> Anchors = new List<IGoal>();
        List<IGoal> Colliders = new List<IGoal>();
        

        //Spring
        for(int i = 0; i < Wrapper.TopologyEdges.Count;i++)
        {
          var Ends = Wrapper.TopologyEdges.GetTopologyVertices(i);
          int Start = Wrapper.TopologyVertices.MeshVertexIndices(Ends.I)[0];
          int End = Wrapper.TopologyVertices.MeshVertexIndices(Ends.J)[0];
          Springs.Add(new KangarooSolver.Goals.Spring(Start, End, 0, 1)); //for each edge, a spring with rest length 0, and strength 1
        }
        

        //Anchors
        Point3d[] Pts = Wrapper.Vertices.ToPoint3dArray();
        for(int i = 0; i < Pts.Length;i++)
        {
          PS.AddParticle(Pts[i], 1);
          for(int j = 0; j < iAnchors.Count;j++)
          {
            if(Pts[i] == iAnchors[j])
            {
              Anchors.Add(new KangarooSolver.Goals.Anchor(i, Pts[i], 100000));
            }
          }
        }



        //Collide
        Points = iCollider.ToArray();
        //var CollideGoal = new KangarooSolver.Goals.SphereCollide(iCollider, 1, 1);
        //var CollideGoal = new KangarooSolver.Goals.SolidPoint(iCollider, Wrapper, false, 1);
        //var CollideGoal = new KangarooSolver.Goals.CollidePointMesh(Points, Wrapper, false, 1);
        //Colliders.Add(CollideGoal);

        
        
        
        myGoals.AddRange(Springs);
        myGoals.AddRange(Anchors);
        myGoals.AddRange(Colliders);

        //Step forward, using these goals, with multi-threading on, and stopping if the threshold is reached
        do
        {
          PS.Step(myGoals, true, threshold);
          counter++;
          
          Wrapper.Vertices.Clear();
          Wrapper.Vertices.AddVertices(PS.GetPositions());
          for(int i = 0; i < iCollider.Count; i++)
          {
            if(Wrapper.IsPointInside(iCollider[i], 0, true))
            {
              Anchors.Add(new KangarooSolver.Goals.Anchor(i, iCollider[i], 100000));
            }
          }
        }while(PS.GetvSum() > threshold && counter < 100);



        //Shrink Mesh
        /*for(int i = 0; i < Springs.Count; i++)
        {
        Spring S = Springs[i] as Spring;
        S.RestLength -= increment;
        }*/
        //Wrapper.Vertices.Clear();
        //Wrapper.Vertices.AddVertices(PS.GetPositions());
      }

      A = Wrapper;

    }
# ---------- c_script_4: C# additional code ----------
  KangarooSolver.PhysicalSystem PS;

  Point3d[] Points;
  int counter;
  Mesh Wrapper;
  double threshold = 1e-6;
# ---------- end c_script_4 ----------
customiteration_3 = CSharpScript(
    M=mesh_10,
    Reference=["C:\Users\Daniel\Documents\GitHub\Kangaroo2\bin\Release\KangarooSolver.dll", "C:\Users\User\AppData\Roaming\Grasshopper\Libraries\KangarooSolver.dll"])  # -> out, A, B; inputs M: Mesh; disabled
# ---------- customiteration_3: C# ----------
    //initialize the solver
    var PS = new KangarooSolver.PhysicalSystem();
    var Goals = new List<IGoal>();

    //get the Mesh points and boundary status
    Point3d[] Pts = M.Vertices.ToPoint3dArray();
    bool[] Naked = M.GetNakedEdgePointStatus();

    for(int i = 0; i < M.Vertices.Count;i++)
    {
      PS.AddParticle(Pts[i], 1); //add a particle for every mesh vertex
      if(Naked[i])
      {Goals.Add(new KangarooSolver.Goals.Anchor(i, Pts[i], 10000));}// fix the boundaries strongly in place
    }

    for(int i = 0; i < M.TopologyEdges.Count;i++)
    {
      var Ends = M.TopologyEdges.GetTopologyVertices(i);
      int Start = M.TopologyVertices.MeshVertexIndices(Ends.I)[0];
      int End = M.TopologyVertices.MeshVertexIndices(Ends.J)[0];
      Goals.Add(new KangarooSolver.Goals.Spring(Start, End, 0, 1)); //for each edge, a spring with rest length 0, and strength 1
    }

    int counter = 0;
    double threshold = 1e-6;
    do
    {
      //Step forward, using these goals, with multi-threading on, and stopping if the threshold is reached
      PS.Step(Goals, true, threshold);
      counter++;
    }while(PS.GetvSum() > threshold && counter < 100);
    //GetvSum returns the current kinetic energy
    //always include a counter to prevent it getting stuck forever in case it cannot reach the given threshold

    //replace the mesh vertices with the relaxed ones
    M.Vertices.Clear();
    M.Vertices.AddVertices(PS.GetPositions());

    //Output the mesh, and how many iterations it took to converge
    A = M;
    B = counter;
# ---------- customiteration_3: C# additional code ----------
  /// <summary>
  /// This method will be called once every solution, before any calls to RunScript.
  /// </summary>
  public override void BeforeRunScript()
  { }
  /// <summary>
  /// This method will be called once every solution, after any calls to RunScript.
  /// </summary>
  public override void AfterRunScript()
  { }
# ---------- end customiteration_3 ----------
combine_clean_2 = CombineClean(Meshes=c_script_3.A)
panel_4 = Panel(customiteration_3.A)  # disabled
custom_preview_3 = CustomPreview(Geometry=combine_clean_2, Material=ColourSwatch(SwatchColor=RGBA(255, 255, 255, 172)))
panel_5 = Panel(c_script_3.out)
mesh_edges_9 = MeshEdges(Mesh=combine_clean_2)  # -> NakedEdges, InteriorEdges, NonManifoldEdges
panel_6 = Panel(c_script_3.A)
panel_7 = Panel(combine_clean_2)

# ==== cluster Cluster
curve = ClusterInput()
curve_2 = Curve(curve)
discontinuity = Discontinuity(Curve=reparameterize(curve_2), Level=1)  # -> Points, Parameters
curve_closest_point = CurveClosestPoint(Point=flatten(discontinuity.Points), Curve=reparameterize(graft(curve_2)))  # -> Point, Parameter, Distance
evaluate = Evaluate(Expression="x<0.00001", x=curve_closest_point.Distance)
cull_pattern = CullPattern(List=curve_closest_point.Parameter, CullPattern=evaluate)
shatter = Shatter(Curve=reparameterize(graft(curve_2)), Parameters=cull_pattern)
segments = ClusterOutput(shatter)
list_item = ListItem(List=shatter, Index=0, Wrap=True)
