# Grasshopper definition 200529_Table_V1.gh (Grasshopper 1.0.7)
# plug-ins: MeshEdit Components, Pufferfish, Fattener, LunchBoxML, EleFront, LunchBox, Weaverbird, GH_CPython, Kangaroo2 Components, TT Toolbox

curve = Curve([<curve referenced from the Rhino model> x15])

discontinuity = Discontinuity(Curve=curve, Level=1)  # -> Points, Parameters
create_rtree = CreateRTree(InputGeometry=flatten(discontinuity.Points))
cull_duplicates = CullDuplicates(Points=flatten(discontinuity.Points), Tolerance=0.1, CullMode=3)  # -> Points, Indices, Valence
rtree_points_in_range = RTreePointsInRange(SearchPoints=cull_duplicates.Points, SearchDistance=Slider(50, range=0..100), RTree=create_rtree)  # -> simplify(PointsWithinRange), IndicesWithinRange

c_script = CSharpScript(x=rtree_points_in_range.PointsWithinRange)  # -> out, A; inputs x: tree of Point3d
# ---------- c_script: C# ----------
    for(int i = 0; i < x.BranchCount; i++){
      if(x.Branch(i).Count > 2){
        points.Add(x.Branch(i));
      }
    }

    A = ListOfListsToTree(points);
# ---------- c_script: C# additional code ----------
  List<List<Point3d>> points = new List<List<Point3d>>();


  static Grasshopper.DataTree<T> ListOfListsToTree<T > (List < List < T >> s){
  Grasshopper.DataTree<T> tree = new DataTree<T>();
  for(int i = 0;i < s.Count; i++){
  tree.AddRange(s[i], new GH_Path(i));
}
        return tree;
      }
# ---------- end c_script ----------
cull_duplicates_2 = CullDuplicates(Points=flatten(c_script.A), Tolerance=0.1, CullMode=3)  # -> Points, Indices, Valence

sphere = Sphere(Base=cull_duplicates_2.Points, Radius=Slider(60, range=0..1000))

surface_curve = SurfaceCurve(Surface=graft(sphere), Curve=curve)  # -> Curves, simplify(Points), UVPoints, Normals, Parameters, Tangents
point = Point(flatten(surface_curve.Points))

curve_closest_point = CurveClosestPoint(Point=point, Curve=reparameterize(graft(curve)))  # -> Point, Parameter, Distance
evaluate = Evaluate(Expression="x < 0.1", x=curve_closest_point.Distance)
cull_pattern = CullPattern(List=curve_closest_point.Parameter, CullPattern=evaluate)  # -> simplify(List)

shatter = Shatter(Curve=reparameterize(graft(curve)), Parameters=cull_pattern)  # -> simplify(Segments)
length = Length(Curve=shatter)
sort_list = SortList(Keys=length, ValuesValuesA=shatter)  # -> Keys, ValuesValuesA
list_item = ListItem(List=sort_list.ValuesValuesA, Index=0, Wrap=True)  # -> Item1, Item

shift_paths = ShiftPaths(Data=surface_curve.Points, Offset=-1)
line = Line(StartPoint=graft(cull_duplicates_2.Points), EndPoint=shift_paths)

fatten = Fatten(
    Skeleton=line,
    Thickness=Slider(30, range=0..1000),
    LengthSubdivisions=0,
    EndType=Slider(0, range=0..3),
    AdjustForAngle=False)
mesh_edges = MeshEdges(Mesh=fatten)  # -> NakedEdges, InteriorEdges, NonManifoldEdges

polyline = PolyLine(Vertices=shift_paths, Closed=True)  # disabled
boundary_surfaces = BoundarySurfaces(Edges=polyline)  # disabled

area = Area(Geometry=boundary_surfaces)  # -> Area, Centroid; disabled

refine = Refine(Mesh=fatten, Level="1")
clean = CombineClean(Meshes=refine)
md = MeshDirection(Mesh=clean)
turn = MeshTurn(Mesh=md)

boolean_toggle = BooleanToggle(True)
flip_mesh = FlipMesh(Mesh=md, VertexNormals=boolean_toggle, FaceNormals=boolean_toggle, FaceOrientation=boolean_toggle)
mesh = Mesh(flip_mesh)

face_normals = FaceNormals(Mesh=flip_mesh)  # -> Centers, Normals
vector_display = VectorDisplay(Anchor=face_normals.Centers, Vector=face_normals.Normals)

strips = RefineStrips(Mesh=mesh, Level="3")

medges = MeshEdges(Mesh=strips)  # -> NakedEdges, InteriorEdges, NonManifoldEdges
warpweft = WarpWeft(Mesh=strips)  # -> Warp, Weft, NakedA, NakedB
join = JoinCurves(Curves=medges.NakedEdges, Preserve=False)
number_slider = Slider(0, range=0..100)
explode = Explode(Curve=join, Recursive=True)  # -> Segments, Vertices
strength = Strength(0.1)
end = EndPoints(Curve=explode.Segments)  # -> Start, End
multiplication = Multiplication(A=strength, B=64)
fcircle = CircleFit(Points=end.Start)  # -> Circle, Radius, Deviation
pressure = Pressure(M=strips, Strength=Slider(0.05, range=0..0.1))
oncurve = OnCurve(Points=end.Start, Curve=graft(fcircle.Circle), Strength=100)
planarize = Planarize(M=strips, Strength=100)
length_line = LengthLine(Line=warpweft.Warp, Length=number_slider, Strength=strength)
length_line_2 = LengthLine(Line=warpweft.Weft, Length=number_slider, Strength=multiplication)
equallength = EqualLength(Line=explode.Segments, Strength=1)
show = Show(G=strips)
entwine = Entwine(Branch00=show, Branch01=[length_line, length_line_2, oncurve, planarize, equallength, pressure], FlattenInputs=True)
solver = Solver(GoalObjects=entwine, Reset=Button(), Threshold=1e-15, Tolerance=0.01, On=Toggle(False))  # -> I, V, O
bang = ExplodeTree(Data=solver.O)  # -> Branch0, Branch1
mesh_edges_2 = MeshEdges(Mesh=bang.Branch0)  # -> NakedEdges, InteriorEdges, NonManifoldEdges
custom_preview = CustomPreview(Geometry=bang.Branch0, Material=ColourSwatch(SwatchColor=RGB(255, 255, 255)))
point_2 = Point(cull_duplicates_2.Points)
geometry = Geometry(point_2)
dam = DataDam(DataA=graft(bang.Branch0), BufferDelay=10000000, BufferMode=0)
stripper = Stripper(Mesh=dam)
mesh_2 = Mesh(stripper)  # disabled
mesh_3 = Mesh(bang.Branch0)
unroller = Unroller(Strip=stripper, Unroll=Slider(0, range=0..1))  # -> graft(Unrolled)
mesh_edges_3 = MeshEdges(Mesh=unroller)  # -> NakedEdges, InteriorEdges, NonManifoldEdges
dam_2 = DataDam(DataA=unroller, BufferDelay=10000000, BufferMode=0)

list_length = ListLength(List=mesh_3)
series = Series(Start=0, Step=Slider(252, range=0..1000), Count=list_length)
unit_x = UnitX(Factor=series)

point_3 = Point(Point(-39.78202891, 450.1876353, 0))

# ---- group: laying out
explode_2 = MeshExplode(Mesh=dam_2, Interpolate=False)
item = ListItem(List=explode_2, Index=0, Wrap=True)
item_2 = ListItem(List=explode_2, Index=-1, Wrap=True)
facen = FaceNormals(Mesh=item)  # -> Centers, Normals
facen_2 = FaceNormals(Mesh=item_2)  # -> Centers, Normals
pl = PlaneNormal(Origin=facen.Centers, ZAxis=facen.Normals)
vec2pt = Vector2Pt(PointA=facen.Centers, PointB=facen_2.Centers, Unitize=False)  # -> Vector, Length
align = AlignPlane(Plane=pl, Direction=vec2pt.Vector)  # -> flatten(Plane), Angle
bbox = BoundingBox(Content=dam_2, Plane=graft(align.Plane))  # -> flatten(Box), Box_2
box_corners = BoxCorners(Box=bbox.Box)  # -> CornerA, CornerB, CornerC, CornerD, CornerE, CornerF, CornerG, CornerH
pl_origin = PlaneOrigin(Base=align.Plane, Origin=box_corners.CornerD)
debox = DeconstructBox(Box=bbox.Box)  # -> Plane, X, Y, Z
dedomain = DeconstructDomain(Domain=debox.Y)  # -> Start, End
subtraction = Subtraction(A=dedomain.End, B=dedomain.Start)
ma = MassAddition(Input=subtraction)  # -> Result, PartialResults
xy = XYPlane(Origin=Point(0, 0, 0))
X = UnitX(Factor=ma.PartialResults)
rotate = Rotate(Geometry=xy, Angle=1.570796327, Plane=PlaneXY(0, 0, 0))  # -> Geometry, Transform
neg = Negative(Value=X)
move = Move(Geometry=rotate.Geometry, Motion=neg)  # -> Geometry, Transform
pln = Plane(move.Geometry)

# ----
xy_plane = XYPlane(Origin=point_3)
merge = Merge(Data1=graft(mesh_3), Data2=graft(point_2))
move_2 = Move(Geometry=xy_plane, Motion=unit_x)  # -> Geometry, Transform
group = Group(Objects=merge)
xy_plane_2 = XYPlane(Origin=point_2)
orient = Orient(Geometry=flatten(group), Source=xy_plane_2, Target=move_2.Geometry)  # -> Geometry, Transform
ungroup = Ungroup(Group=orient.Geometry)
list_item_2 = ListItem(List=ungroup, Index=0, Wrap=True)  # -> Item, Item1

mesh_area = MeshArea(Mesh=mesh_2)  # -> Area, Centroid; disabled
mesh_closest_point = MeshClosestPoint(Point=mesh_area.Centroid, Mesh=mesh_2)  # -> Point, Index, Parameter; disabled

stripper_2 = Stripper(Mesh=list_item_2.Item)
mesh_4 = Mesh(stripper_2)
unroller_2 = Unroller(Strip=mesh_4, Unroll=Slider(0, range=0..1))  # -> graft(Unrolled)

face_normals_2 = FaceNormals(Mesh=simplify(mesh_4))  # -> Centers, Normals
mesh_area_2 = MeshArea(Mesh=mesh_4)  # -> Area, Centroid
average = Average(Input=face_normals_2.Normals)
mesh_closest_point_2 = MeshClosestPoint(Point=mesh_area_2.Centroid, Mesh=mesh_4)  # -> simplify(Point), Index, Parameter
shift_paths_2 = ShiftPaths(Data=average, Offset=-1)

geometry_2 = Geometry(mesh_closest_point_2.Point)
point_4 = Point(list_item_2.Item1)
vector_2pt = Vector2Pt(PointA=point_4, PointB=geometry_2, Unitize=False)  # -> Vector, Length

orient_2 = Orient(Geometry=flatten(dam_2), Source=pl_origin, Target=pln)  # -> Geometry, Transform
mesh_5 = Mesh(orient_2.Geometry)
vector_display_2 = VectorDisplay(Anchor=point_4, Vector=vector_2pt.Vector)
vector_display_3 = VectorDisplay(Anchor=mesh_closest_point_2.Point, Vector=shift_paths_2)

# ---- group: Input Your File Path
panel = Panel("C:\Users\User\Desktop\Thesis Drive\Model_Digital\ML\CSV\YConnectorDataset.xlsx")

# ----
wo = WriteOptions(
    FilePath=panel,
    ClearDataOverwrite=True,
    SaveAfterWrite=Toggle(True),
    CloseAfterWrite=Toggle(False),
    ColumnStartPosition=Slider(1, range=0..10),
    RowStartPosition=Slider(1, range=0..10))  # -> UserMessages, WriteOptions

path = FilePath("C:\Users\User\Desktop\Thesis Drive\Model_Digital\ML\Y Connector Separator.py")
gh_cpython = GH_CPython()  # -> a, output; inputs input: list
#   port input: [required] - [type = int] - [default = None] Descripe your input here * bullet point. * bullet point
#   port output: indicate your output description here. refers to a new line.
# ---------- gh_cpython: Python ----------
print("hello world")
# ---------- end gh_cpython ----------

curve_2 = Curve(curve)
number_slider_2 = Slider(0.03, range=0..0.1)

number_slider_3 = Slider(0.1, range=0..0.1)
divide_length = DivideLength(Curve=curve_2, Length=Slider(100, range=0..100))  # -> Points, Tangents, Parameters
end_points = EndPoints(Curve=curve_2)  # -> Start, End
merge_2 = Merge(Data1=graft(end_points.Start), Data2=divide_length.Points, Data3=graft(end_points.End))
sort_duplicate_points = SortDuplicatePoints(Points=merge_2)  # -> UniquePoints, Indices

sort_along_curve = SortAlongCurve(Points=sort_duplicate_points.UniquePoints, Curve=graft(curve_2))  # -> Points, Indices
polyline_2 = PolyLine(Vertices=sort_along_curve.Points, Closed=False)
fatten_2 = Fatten(Skeleton=flatten(polyline_2), Thickness=Slider(30, range=0..1000), LengthSubdivisions=0, EndType=2, AdjustForAngle=False)
weaverbird_s_loop_subdivision = WeaverbirdsLoopSubdivision(MeshCurves=fatten_2, Level=1, SmoothNakedEdges=1)
mesh_edges_4 = MeshEdges(Mesh=fatten_2)  # -> NakedEdges, InteriorEdges, NonManifoldEdges

curve_3 = Curve(list_item.Item1)
number_slider_4 = Slider(0.05, range=0..0.1)

number_slider_5 = Slider(0.1, range=0..0.1)
divide_length_2 = DivideLength(Curve=curve_3, Length=Slider(100, range=0..100))  # -> Points, Tangents, Parameters
end_points_2 = EndPoints(Curve=curve_3)  # -> Start, End
merge_3 = Merge(Data1=graft(end_points_2.Start), Data2=divide_length_2.Points, Data3=graft(end_points_2.End))
sort_duplicate_points_2 = SortDuplicatePoints(Points=merge_3)  # -> UniquePoints, Indices

sort_along_curve_2 = SortAlongCurve(Points=sort_duplicate_points_2.UniquePoints, Curve=graft(curve_3))  # -> Points, Indices
polyline_3 = PolyLine(Vertices=sort_along_curve_2.Points, Closed=False)
fatten_3 = Fatten(Skeleton=flatten(polyline_3), Thickness=Slider(34, range=0..1000), LengthSubdivisions=0, EndType=0, AdjustForAngle=False)
weaverbird_s_loop_subdivision_2 = WeaverbirdsLoopSubdivision(MeshCurves=fatten_3, Level=1, SmoothNakedEdges=1)
mesh_edges_5 = MeshEdges(Mesh=weaverbird_s_loop_subdivision_2)  # -> NakedEdges, InteriorEdges, NonManifoldEdges

custom_preview_2 = CustomPreview(Geometry=weaverbird_s_loop_subdivision_2, Material=ColourSwatch(SwatchColor=RGB(255, 255, 255)))

boolean_toggle_2 = BooleanToggle(True)

deconstruct_mesh = DeconstructMesh(Mesh=simplify(mesh_2))  # -> Vertices, Faces, Colours, Normals; disabled
number_slider_6 = Slider(0.5, range=0..0.5)  # disabled
shift_paths_3 = ShiftPaths(Data=deconstruct_mesh.Vertices, Offset=-1)  # disabled
sort_duplicate_points_3 = SortDuplicatePoints(Points=shift_paths_3)  # -> UniquePoints, Indices; disabled
mesh_sphere = MeshSphere(Base=sort_duplicate_points_3.UniquePoints, Radius=number_slider_6, UCount=10, VCount=20)  # disabled
mesh_inclusion = MeshInclusion(Mesh=graft(mesh_sphere), Point=flatten(shift_paths_3), Strict=False)  # disabled
cull_pattern_2 = CullPattern(List=flatten(shift_paths_3), CullPattern=mesh_inclusion)  # disabled
boolean_toggle_3 = BooleanToggle(True)  # disabled
clean_tree = CleanTree(RemoveNulls=boolean_toggle_3, RemoveInvalid=boolean_toggle_3, RemoveEmpty=boolean_toggle_3, Tree=cull_pattern_2)  # -> simplify(Tree); disabled
param_viewer = ParamViewer(clean_tree)  # disabled

list_length_2 = ListLength(List=clean_tree)  # disabled
panel_2 = Panel("x>2")  # disabled
evaluate_2 = Evaluate(Expression=panel_2, x=list_length_2)  # disabled

dispatch = Dispatch(List=flatten(param_viewer), DispatchPattern=flatten(evaluate_2))  # -> ListA, ListB; disabled
tree_branch = TreeBranch(Tree=clean_tree, Path=dispatch.ListA, MaintainPaths=True)  # disabled
shift_paths_4 = ShiftPaths(Data=tree_branch, Offset=-1)  # disabled
cull_duplicates_3 = CullDuplicates(Points=shift_paths_4, Tolerance=0.1, CullMode=3)  # -> simplify(Points), Indices, Valence; disabled

weaverbird_s_naked_boundary = WeaverbirdsNakedBoundary(MeshClosedPolylines=mesh_2)  # disabled
cross_reference = CrossReference(ListListA=mesh_2, ListListB=cull_duplicates_3.Points, CrossMode=1)  # -> ListListA, ListListB; disabled

cross_reference_2 = CrossReference(ListListA=mesh_closest_point.Point, ListListB=cull_duplicates_3.Points, CrossMode=1)  # -> ListListA, ListListB; disabled

number_slider_7 = Slider(5, range=0..10)  # disabled
sphere_2 = Sphere(Base=cull_duplicates_3.Points, Radius=number_slider_7)  # disabled

line_2 = Line(StartPoint=cross_reference_2.ListListA, EndPoint=cross_reference_2.ListListB)  # -> simplify(Line); disabled
length_2 = Length(Curve=line_2)  # disabled
list_item_3 = ListItem(List=sphere_2, Index=0, Wrap=True)  # -> Item, Item1; disabled

number_slider_8 = Slider(2, range=0..10)  # disabled
list_length_3 = ListLength(List=length_2)  # disabled
division = Division(A=list_length_3, B=number_slider_8)  # disabled

sort_list_2 = SortList(Keys=length_2, ValuesValuesA=line_2, ValuesA=cross_reference.ListListA)  # -> Keys, ValuesValuesA, ValuesA; disabled
split_list = SplitList(List=sort_list_2.ValuesValuesA, Index=division)  # -> simplify(ListA), ListB; disabled
split_list_2 = SplitList(List=sort_list_2.ValuesA, Index=division)  # -> simplify(ListA), ListB; disabled
geometry_3 = Geometry(split_list.ListA)  # disabled
geometry_4 = Geometry(split_list_2.ListA)  # disabled
collision_one_many = CollisionOneMany(Collider=simplify(flatten(geometry_3)), Obstacles=graft(list_item_3.Item))  # -> simplify(Collision), Index; disabled
collision_one_many_2 = CollisionOneMany(Collider=simplify(flatten(geometry_3)), Obstacles=graft(list_item_3.Item1))  # -> simplify(Collision), Index; disabled
dispatch_2 = Dispatch(List=flatten(geometry_4), DispatchPattern=simplify(collision_one_many_2.Collision))  # -> ListA, ListB; disabled
geometry_5 = Geometry(dispatch_2.ListA)

mesh_area_3 = MeshArea(Mesh=geometry_5)  # -> Area, Centroid
mesh_closest_point_3 = MeshClosestPoint(Point=mesh_area_3.Centroid, Mesh=geometry_5)  # -> Point, Index, Parameter

define_text_dot = DefineTextDot(Text="1", Location=mesh_closest_point_3.Point, Font="Arial", Size=14)

list_length_4 = ListLength(List=define_text_dot)
duplicate_data = DuplicateData(Data="1", Number=list_length_4, Order=True)

dispatch_3 = Dispatch(List=flatten(geometry_4), DispatchPattern=simplify(collision_one_many.Collision))  # -> ListA, ListB; disabled
# DATASET FOR ML_Y CONNECTOR SEPARATOR
geometry_6 = Geometry(dispatch_3.ListA)
merge_4 = Merge(Data1=geometry_6, Data2=geometry_5)
mesh_6 = Mesh(merge_4)

mesh_area_4 = MeshArea(Mesh=geometry_6)  # -> Area, Centroid
mesh_closest_point_4 = MeshClosestPoint(Point=mesh_area_4.Centroid, Mesh=geometry_6)  # -> Point, Index, Parameter

mesh_area_5 = MeshArea(Mesh=mesh_6)  # -> Area, Centroid
mesh_closest_point_5 = MeshClosestPoint(Point=mesh_area_5.Centroid, Mesh=mesh_6)  # -> Point, Index, Parameter

define_text_dot_2 = DefineTextDot(Text="0", Location=mesh_closest_point_4.Point, Font="Arial", Size=14)

merge_5 = Merge(Data1=define_text_dot_2, Data2=define_text_dot)  # -> graft(Result)

# ----
# Distance from Center(strips) to Center(connector)
line_3 = Line(StartPoint=graft(geometry), EndPoint=mesh_closest_point_5.Point)  # -> simplify(Line)

geometry_7 = Geometry(line_3)
end_points_3 = EndPoints(Curve=geometry_7)  # -> Start, End
vector_2pt_2 = Vector2Pt(PointA=end_points_3.Start, PointB=end_points_3.End, Unitize=False)  # -> Vector, Length
vector_display_4 = VectorDisplay(Anchor=end_points_3.Start, Vector=vector_2pt_2.Vector)
weaverbird_s_naked_boundary_2 = WeaverbirdsNakedBoundary(MeshClosedPolylines=mesh_6)  # -> graft(NakedCurves)

list_length_5 = ListLength(List=define_text_dot_2)
duplicate_data_2 = DuplicateData(Data="0", Number=list_length_5, Order=True)

length_3 = Length(Curve=line_3)  # -> graft(Length)
merge_6 = Merge(Data1=duplicate_data_2, Data2=duplicate_data)  # -> graft(Result)
geometry_8 = Geometry(dispatch_2.ListA)  # disabled
geometry_9 = Geometry(dispatch_3.ListA)  # disabled
mesh_join = MeshJoin(Meshes=geometry_9)  # disabled
mesh_join_2 = MeshJoin(Meshes=geometry_8)  # disabled
merge_7 = Merge(Data1=mesh_join, Data2=mesh_join_2)  # disabled

deconstruct_mesh_2 = DeconstructMesh(Mesh=simplify(mesh_6))  # -> Vertices, Faces, Colours, Normals
shift_paths_5 = ShiftPaths(Data=deconstruct_mesh_2.Vertices, Offset=-1)
sort_duplicate_points_4 = SortDuplicatePoints(Points=shift_paths_5)  # -> UniquePoints, Indices
mesh_sphere_2 = MeshSphere(Base=sort_duplicate_points_4.UniquePoints, Radius=Slider(0.5, range=0..0.5), UCount=10, VCount=20)
mesh_inclusion_2 = MeshInclusion(Mesh=graft(mesh_sphere_2), Point=flatten(shift_paths_5), Strict=False)
cull_pattern_3 = CullPattern(List=flatten(shift_paths_5), CullPattern=mesh_inclusion_2)
clean_tree_2 = CleanTree(RemoveNulls=boolean_toggle_2, RemoveInvalid=boolean_toggle_2, RemoveEmpty=boolean_toggle_2, Tree=cull_pattern_3)  # -> simplify(Tree)
param_viewer_2 = ParamViewer(clean_tree_2)

list_length_6 = ListLength(List=clean_tree_2)
evaluate_3 = Evaluate(Expression="x>2", x=list_length_6)

dispatch_4 = Dispatch(List=flatten(param_viewer_2), DispatchPattern=flatten(evaluate_3))  # -> ListA, ListB
tree_branch_2 = TreeBranch(Tree=clean_tree_2, Path=dispatch_4.ListA, MaintainPaths=True)
shift_paths_6 = ShiftPaths(Data=tree_branch_2, Offset=-1)
cull_duplicates_4 = CullDuplicates(Points=shift_paths_6, Tolerance=0.1, CullMode=3)  # -> simplify(Points), Indices, Valence

line_4 = Line(StartPoint=graft(geometry), EndPoint=cull_duplicates_4.Points)  # -> simplify(Line)
list_item_4 = ListItem(List=line_4, Index=0, Wrap=True)  # -> Item, Item1

# ----
# POLE A
geometry_10 = Geometry(list_item_4.Item)

list_item_5 = ListItem(List=cull_duplicates_4.Points, Index=0, Wrap=True)  # -> Item, Item1

# ----
# POLE B
geometry_11 = Geometry(list_item_4.Item1)

end_points_4 = EndPoints(Curve=geometry_11)  # -> Start, End
end_points_5 = EndPoints(Curve=geometry_10)  # -> Start, End
vector_2pt_3 = Vector2Pt(PointA=end_points_4.Start, PointB=end_points_4.End, Unitize=False)  # -> Vector, Length
vector_2pt_4 = Vector2Pt(PointA=end_points_5.Start, PointB=end_points_5.End, Unitize=False)  # -> Vector, Length
vector_display_5 = VectorDisplay(Anchor=end_points_4.Start, Vector=vector_2pt_3.Vector)
vector_display_6 = VectorDisplay(Anchor=end_points_5.Start, Vector=vector_2pt_4.Vector)

# ----
# Distance from Center(strips) to Pole B
line_5 = Line(StartPoint=mesh_closest_point_5.Point, EndPoint=list_item_5.Item1)  # -> simplify(Line)

# ----
# Distance from Center(strips) to Pole A
line_6 = Line(StartPoint=mesh_closest_point_5.Point, EndPoint=list_item_5.Item)  # -> simplify(Line)

# ----
# Angle from Center(strips) to Pole A
angle = Angle(VectorA=vector_2pt_4.Vector, VectorB=vector_2pt_2.Vector)  # -> Angle, Reflex
# Angle from Center(strips) to Pole B
angle_2 = Angle(VectorA=vector_2pt_3.Vector, VectorB=vector_2pt_2.Vector)  # -> Angle, Reflex
degrees = Degrees(Radians=angle.Angle)  # -> graft(Degrees)
degrees_2 = Degrees(Radians=angle_2.Angle)  # -> graft(Degrees)
length_4 = Length(Curve=line_6)  # -> graft(Length)
length_5 = Length(Curve=line_5)  # -> graft(Length)
merge_8 = Merge(Data1=length_3, Data2=length_4, Data3=length_5, Data4=degrees, Data5=degrees_2)
round_to_decimal_place = RoundToDecimalPlace(NumberX=merge_8, DecimalPlace=2, RoundType=0)  # -> Rounded, Difference
merge_9 = Merge(Data1=simplify(merge_6), Data2=simplify(round_to_decimal_place.Rounded))
panel_3 = Panel(merge_9)

param_viewer_3 = ParamViewer(merge_9)
jitter = Jitter(List=param_viewer_3, Jitter=1, Seed=Slider(405, range=0..1000))  # -> Values, Indices

flatten_tree = FlattenTree(Tree=degrees, Path="{0}")  # -> graft(Tree)
flatten_tree_2 = FlattenTree(Tree=length_5, Path="{0}")  # -> graft(Tree)
flatten_tree_3 = FlattenTree(Tree=degrees_2, Path="{0}")  # -> graft(Tree)
flatten_tree_4 = FlattenTree(Tree=weaverbird_s_naked_boundary_2, Path="{0}")  # -> graft(Tree)
flatten_tree_5 = FlattenTree(Tree=length_3, Path="{0}")  # -> graft(Tree)
flatten_tree_6 = FlattenTree(Tree=length_4, Path="{0}")  # -> graft(Tree)
flatten_tree_7 = FlattenTree(Tree=merge_5, Path="{0}")  # -> graft(Tree)
merge_10 = Merge(
    Data1=flatten_tree_4,
    Data2=flatten_tree_7,
    Data3=flatten_tree_5,
    Data4=flatten_tree_6,
    Data5=flatten_tree_2,
    Data6=flatten_tree,
    Data7=flatten_tree_3)
tree_branch_3 = TreeBranch(Tree=simplify(merge_10), Path=Slider(0, range=0..72), MaintainPaths=True)
panel_4 = Panel(merge_10)

tree_branch_4 = TreeBranch(Tree=merge_9, Path=jitter.Values, MaintainPaths=False)
panel_5 = Panel(tree_branch_4)
flip_matrix = FlipMatrix(Data=tree_branch_4)

panel_6 = Panel("""LABEL
DIST_SC
DIST_SA
DIST_SB
ANGLE_SA
ANGLE_SB""")
writexl = WriteToExcel(
    Run=Toggle(False),
    ExcelWorksheet="1",
    ColumnNames=panel_6,
    WriteOptions=wo.WriteOptions,
    ColumnnsOrRows=Toggle(False),
    DataToWriteIntoColumns=flip_matrix)
panel_7 = Panel(writexl)

lng = ListLength(List=param_viewer_3)
series_2 = Series(Start=0, Step=1, Count=lng)
