# Grasshopper definition 200612_Table_V3.gh (Grasshopper 1.0.7)
# plug-ins: MeshEdit Components, Pufferfish, Fattener, LunchBoxML, Kangaroo Components, EleFront, LunchBox, Weaverbird, GH_CPython, Kangaroo2 Components, TT Toolbox

curve = Curve([<curve referenced from the Rhino model> x6])

curve_2 = Curve([<curve referenced from the Rhino model> x12])  # disabled
curve_3 = Curve([<curve referenced from the Rhino model> x18])  # disabled

# ----
# Y JUNCTION LINES
discontinuity = Discontinuity(Curve=curve, Level=1)  # -> Points, Parameters
create_rtree = CreateRTree(InputGeometry=flatten(discontinuity.Points))
cull_duplicates = CullDuplicates(Points=flatten(discontinuity.Points), Tolerance=0.1, CullMode=3)  # -> Points, Indices, Valence
rtree_points_in_range = RTreePointsInRange(SearchPoints=cull_duplicates.Points, SearchDistance=Slider(50, range=0..100), RTree=create_rtree)  # -> simplify(PointsWithinRange), IndicesWithinRange

end_points = EndPoints(Curve=curve_2)  # -> Start, End; disabled
line = Line(StartPoint=end_points.Start, EndPoint=end_points.End)  # disabled
line_2 = Line(line)  # disabled

number_slider = Slider(0, range=0..3)  # disabled
number_slider_2 = Slider(30, range=0..1000)  # disabled
number_slider_3 = Slider(0.03, range=0..0.1)  # disabled
fatten = Fatten(Skeleton=line_2, Thickness=number_slider_2, LengthSubdivisions=0, EndType=number_slider, AdjustForAngle=False)  # disabled
mesh_edges = MeshEdges(Mesh=fatten)  # -> NakedEdges, InteriorEdges, NonManifoldEdges; disabled
disjoint_mesh = DisjointMesh(Mesh=fatten)  # -> graft(Meshes); disabled

number_slider_4 = Slider(0.05, range=0..0.1)
c_script = CSharpScript(x=rtree_points_in_range.PointsWithinRange)  # -> out, A; inputs x: tree of Point3d
# ---------- c_script: C# ----------
    for(int i = 0; i < x.BranchCount; i++){
      if(x.Branch(i).Count > 2){
        points.Add(x.Branch(i));
      }
    }

    A = ListOfListsToTree(points);
# ---------- c_script: C# additional code ----------
  List<List<Point3d>> points = new List<List<Point3d>>();


  static Grasshopper.DataTree<T> ListOfListsToTree<T > (List < List < T >> s){
  Grasshopper.DataTree<T> tree = new DataTree<T>();
  for(int i = 0;i < s.Count; i++){
  tree.AddRange(s[i], new GH_Path(i));
}
        return tree;
      }
# ---------- end c_script ----------
mesh = Mesh(graft([<mesh referenced from the Rhino model> x4]))  # disabled

face_normals = FaceNormals(Mesh=disjoint_mesh)  # -> Centers, Normals; disabled
vector_display = VectorDisplay(Anchor=face_normals.Centers, Vector=face_normals.Normals)  # disabled

cull_duplicates_2 = CullDuplicates(Points=flatten(c_script.A), Tolerance=0.1, CullMode=3)  # -> Points, Indices, Valence

number_slider_5 = Slider(0.06, range=0..0.1)
sphere = Sphere(Base=cull_duplicates_2.Points, Radius=Slider(250, range=0..1000))

surface_curve = SurfaceCurve(Surface=graft(sphere), Curve=curve)  # -> Curves, simplify(Points), UVPoints, Normals, Parameters, Tangents
shift_paths = ShiftPaths(Data=surface_curve.Points, Offset=-1)

# ----
# SINGLE LIEANR ELEMENT
point = Point(flatten(surface_curve.Points))

curve_closest_point = CurveClosestPoint(Point=point, Curve=reparameterize(graft(curve)))  # -> Point, Parameter, Distance
evaluate = Evaluate(Expression="x < 0.1", x=curve_closest_point.Distance)
cull_pattern = CullPattern(List=curve_closest_point.Parameter, CullPattern=evaluate)  # -> simplify(List)

shatter = Shatter(Curve=reparameterize(graft(curve)), Parameters=cull_pattern)  # -> simplify(Segments)

panel = Panel("1")  # disabled
refine = Refine(Mesh=mesh, Level=panel)  # disabled
clean = CombineClean(Meshes=refine)  # disabled
md = MeshDirection(Mesh=clean)  # disabled
turn = MeshTurn(Mesh=md)  # disabled

line_3 = Line(StartPoint=graft(cull_duplicates_2.Points), EndPoint=shift_paths)

point_on_curve = PointOnCurve(line_3, parameter=0.5)
sphere_2 = Sphere(Base=point_on_curve, Radius=1)

collision_one_many = CollisionOneMany(Collider=shatter, Obstacles=flatten(sphere_2))  # -> Collision, Index
dispatch = Dispatch(List=shatter, DispatchPattern=collision_one_many.Collision)  # -> ListA, ListB
geometry = Geometry(dispatch.ListB)

number_slider_6 = Slider(0.03, range=0..0.1)
fatten_2 = Fatten(
    Skeleton=geometry,
    Thickness=Slider(30, range=0..1000),
    LengthSubdivisions=0,
    EndType=Slider(0, range=0..3),
    AdjustForAngle=False)
disjoint_mesh_2 = DisjointMesh(Mesh=fatten_2)  # -> graft(Meshes)

weaverbird_s_catmull_clark_subdivision = WeaverbirdsCatmullClarkSubdivision(MeshCurves=disjoint_mesh_2, Level=1, SmoothNakedEdges=1)

# ----
# FATTENER
number_slider_7 = Slider(0.03, range=0..0.1)
fatten_3 = Fatten(
    Skeleton=line_3,
    Thickness=Slider(30, range=0..1000),
    LengthSubdivisions=0,
    EndType=Slider(0, range=0..3),
    AdjustForAngle=False)
disjoint_mesh_3 = DisjointMesh(Mesh=fatten_3)  # -> graft(Meshes)

boolean_toggle = BooleanToggle(False)  # disabled
flip_mesh = FlipMesh(Mesh=md, VertexNormals=boolean_toggle, FaceNormals=boolean_toggle, FaceOrientation=boolean_toggle)  # disabled
mesh_2 = Mesh(flip_mesh)  # disabled

face_normals_2 = FaceNormals(Mesh=weaverbird_s_catmull_clark_subdivision)  # -> Centers, Normals
mesh_edges_2 = MeshEdges(Mesh=weaverbird_s_catmull_clark_subdivision)  # -> NakedEdges, InteriorEdges, NonManifoldEdges
vector_display_2 = VectorDisplay(Anchor=face_normals_2.Centers, Vector=face_normals_2.Normals)

weaverbird_s_naked_boundary = WeaverbirdsNakedBoundary(MeshClosedPolylines=disjoint_mesh_3)
join = JoinCurves(Curves=weaverbird_s_naked_boundary, Preserve=False)
explode = Explode(Curve=join, Recursive=True)  # -> Segments, Vertices
cull_duplicates_3 = CullDuplicates(Points=explode.Vertices, Tolerance=0.1, CullMode=3)  # -> simplify(Points), Indices, Valence
shift_paths_2 = ShiftPaths(Data=cull_duplicates_3.Points, Offset=-1)  # -> flatten(Data)

face_normals_3 = FaceNormals(Mesh=disjoint_mesh_3)  # -> Centers, Normals
mesh_edges_3 = MeshEdges(Mesh=disjoint_mesh_3)  # -> NakedEdges, InteriorEdges, NonManifoldEdges
vector_display_3 = VectorDisplay(Anchor=face_normals_3.Centers, Vector=face_normals_3.Normals)

weaverbird_s_naked_boundary_2 = WeaverbirdsNakedBoundary(MeshClosedPolylines=disjoint_mesh_2)
join_2 = JoinCurves(Curves=weaverbird_s_naked_boundary_2, Preserve=False)
explode_2 = Explode(Curve=join_2, Recursive=True)  # -> Segments, Vertices
cull_duplicates_4 = CullDuplicates(Points=explode_2.Vertices, Tolerance=0.1, CullMode=3)  # -> simplify(Points), Indices, Valence

panel_2 = Panel("2")  # disabled
strips = RefineStrips(Mesh=mesh_2, Level=panel_2)  # disabled

mesh_edges_4 = MeshEdges(Mesh=strips)  # -> NakedEdges, InteriorEdges, NonManifoldEdges; disabled

face_normals_4 = FaceNormals(Mesh=strips)  # -> Centers, Normals; disabled
vector_display_4 = VectorDisplay(Anchor=face_normals_4.Centers, Vector=face_normals_4.Normals)  # disabled

number_slider_8 = Slider(2, range=0..10)
weaverbird_s_catmull_clark_subdivision_2 = WeaverbirdsCatmullClarkSubdivision(MeshCurves=disjoint_mesh_3, Level=number_slider_8, SmoothNakedEdges=Slider(2, range=0..10))

# ----
# PREPARE WEFT AND WARP
panel_3 = Panel("1")
refine_2 = Refine(Mesh=disjoint_mesh_3, Level=panel_3)
clean_2 = CombineClean(Meshes=refine_2)
md_2 = MeshDirection(Mesh=clean_2)
turn_2 = MeshTurn(Mesh=md_2)

medges = MeshEdges(Mesh=simplify(strips))  # -> NakedEdges, InteriorEdges, NonManifoldEdges; disabled

closest_point = ClosestPoint(Point=cull_duplicates_4.Points, Cloud=shift_paths_2)  # -> ClosestPoint, CPIndex, Distance; disabled
deconstruct_mesh = DeconstructMesh(Mesh=disjoint_mesh_2)  # -> Vertices, Faces, Colours, Normals; disabled
shift_paths_3 = ShiftPaths(Data=cull_duplicates_4.Points, Offset=-1)  # disabled
shift_paths_4 = ShiftPaths(Data=closest_point.ClosestPoint, Offset=-1)  # disabled
closest_point_2 = ClosestPoint(Point=simplify(shift_paths_3), Cloud=simplify(deconstruct_mesh.Vertices))  # -> ClosestPoint, CPIndex, Distance; disabled
replace_items = ReplaceItems(List=deconstruct_mesh.Vertices, Item=shift_paths_4, Indices=closest_point_2.CPIndex, Wrap=False)  # disabled
construct_mesh = ConstructMesh(Vertices=replace_items, Faces=deconstruct_mesh.Faces, Colours=deconstruct_mesh.Colours)  # disabled

weaverbird_s_catmull_clark_subdivision_3 = WeaverbirdsCatmullClarkSubdivision(MeshCurves=construct_mesh, Level=number_slider_8, SmoothNakedEdges=Slider(2, range=0..10))  # disabled

mesh_caps = MeshCaps(M=mesh, W=True, O=True, D=0)  # -> out, A, E; inputs M: Mesh, clr: Color; disabled
# ---------- mesh_caps: VB ----------
    Component.Params.Input(0).Name = "Mesh"
    Component.Params.Input(0).Description = "An open mesh"
    Component.Params.Input(1).Name = "Join and Weld"
    Component.Params.Input(1).Description = "If true the original mesh will be joined and welded to the new caps, else the caps will be output as a list of new meshes"
    Component.Params.Input(2).Name = "Simplify Faces"
    Component.Params.Input(2).Description = "If true, naked edges consisting of 3 to 4 segments will be replaced with a single face, else faces will use new center vertex method"
    Component.Params.Input(3).Name = "Distance (Optional, Rhino Units)"
    Component.Params.Input(3).Description = "A single number which sets the Rhino unit based distance that the center point will be offset from the vertex averages"

    Component.Params.Output(1).Name = "Mesh"
    Component.Params.Output(1).Description = "If successful, a list or single of valid meshes"
    Component.Params.Output(2).Name = "Polylines"
    Component.Params.Output(2).Description = "If successful, a list of valid edge polylines"

    If M IsNot Nothing Then
      Dim i,j,k,kk,ka As Integer
      Dim arrP() As polyline
      Dim P As polyline
      Dim arrM As New list(Of Mesh)
      Dim mj As New mesh
      Dim clrB,clrC,blnN() As Boolean
      Dim oc,tcc As New list(Of color)
      If (clr <> Nothing) Then clrC = True
      If ((m.VertexColors.count() > 0) Or (clr <> Nothing)) Then clrB = True
      If (m.VertexColors.count() = 0) Then  m.vertexcolors.CreateMonotoneMesh(color.LightGray)
      oc = m.VertexColors.ToArray.tolist()
      Dim mv() As point3d
      Dim mo As New list(Of mesh)
      Dim fc As New list(Of MeshFace)
      Dim np As New list(Of point3d)
      Dim ni As New list(Of Integer)
      Dim ind(3) As Integer

      mv = m.Vertices.ToPoint3dArray()
      blnN = m.GetNakedEdgePointStatus()
      arrP = m.GetNakedEdges()

      For i = 0 To ubound(blnN) Step 1
        If blnN(i) Then
          np.add(mv(i))
          ni.add(i)
        End If
      Next

      Dim cld As New pointcloud(np.toarray())
      For i = 0 To ubound(arrP) Step 1
        Dim tm As New mesh
        tm.Vertices.Clear()
        tm.Faces.Clear()

        p = arrP(i)
        If (O And (p.count() < 6)) Then
          ind(0) = ni(cld.ClosestPoint(p(0)))
          ind(1) = ni(cld.ClosestPoint(p(1)))
          ind(2) = ni(cld.ClosestPoint(p(2)))
          ind(3) = ni(cld.ClosestPoint(p(3)))
          tm.Vertices.Add(mv(ind(0)))
          tm.Vertices.Add(mv(ind(1)))
          tm.Vertices.Add(mv(ind(2)))

          tm.VertexColors.Add(oc(ind(0)))
          tm.VertexColors.Add(oc(ind(1)))
          tm.VertexColors.Add(oc(ind(2)))
          If p.count() = 5 Then
            fc.add(New meshface(ind(0), ind(1), ind(2), ind(3)))
            tm.Vertices.Add(mv(ind(3)))
            tm.VertexColors.Add(oc(ind(3)))
            tm.Faces.addface(New meshface(0, 1, 2, 3))
          ElseIf p.count() = 4 Then
            fc.add(New meshface(ind(0), ind(1), ind(2)))
            tm.Faces.addface(New meshface(0, 1, 2))
          End If
          tm.FaceNormals.ComputeFaceNormals()
          tm.Normals.ComputeNormals()
          mo.add(tm)

        Else
          Dim tx As New mesh
          Dim vec As New vector3d
          Dim tv As New list(Of point3d)
          Dim tc As New list(Of color)
          Dim tfc As New list(Of meshface)
          Dim r,g,b As Integer
          Dim tcl As color
          k = cld.ClosestPoint(p(0))
          ka = k
          tx.Vertices.AddVertices(p.ToArray())
          tx.Faces.AddFaces(p.TriangulateClosedPolyline())
          tx.Normals.ComputeNormals()

          vec = tx.Normals(0)

          tv.add(p(0))
          tc.add(oc(k))
          r = oc(ni(k)).R
          g = oc(ni(k)).G
          b = oc(ni(k)).B
          For j = 1 To p.count() - 2 Step 1
            kk = cld.ClosestPoint(p(j))
            fc.add(New meshface(m.Vertices.count(), ni(k), ni(kk)))
            vec += tx.Normals(j)
            k = kk

            tv.add(p(j))
            tc.add(oc(k))
            r += oc(ni(k)).R
            g += oc(ni(k)).G
            b += oc(ni(k)).B
            tfc.add(New meshface(p.count() - 1, j - 1, j))
          Next
          fc.add(New meshface(m.Vertices.count(), ni(k), ni(ka)))
          vec.Unitize()
          vec *= D
          m.Vertices.add(p.CenterPoint() + vec)

          r /= (p.count() - 1)
          g /= (p.count() - 1)
          b /= (p.count() - 1)
          If r > 255 Then r = 255 Else If r < 0 Then r = 0
          If g > 255 Then g = 255 Else If g < 0 Then g = 0
          If b > 255 Then b = 255 Else If b < 0 Then b = 0
          If clrC Then tcl = clr Else tcl = color.FromArgb(r, g, b)
          m.VertexColors.Add(tcl)

          tv.add(p.CenterPoint() + vec)
          tc.add(tcl)
          tfc.add(New meshface(p.count() - 1, p.count() - 2, 0))
          tm.vertices.AddVertices(tv.toarray())
          If clrB Then tm.VertexColors.AppendColors(tc.toarray())
          tm.faces.addfaces(tfc)
          tm.FaceNormals.ComputeFaceNormals()
          tm.Normals.ComputeNormals()
          mo.add(tm)
        End If
      Next

      If w Then
        m.Faces.AddFaces(fc)
        m.FaceNormals.ComputeFaceNormals()
        m.UnifyNormals()
        m.Normals.ComputeNormals()
        If Not clrB Then m.VertexColors.Clear()
        A = m
      Else
        A = mo
      End If
      E = arrP
    End If
# ---------- mesh_caps: VB additional code ----------
  Private Function avgC(ByVal R As Double, ByVal G As Double, ByVal B As Double, ByVal T As Integer)

    R /= t
    G /= t
    B /= t
    If R > 255 Then R = 255 Else If R < 0 Then R = 0
    If G > 255 Then G = 255 Else If G < 0 Then G = 0
    If B > 255 Then B = 255 Else If B < 0 Then B = 0

    Return color.FromArgb(CInt(R), CInt(G), CInt(B))
  End Function
# ---------- end mesh_caps ----------
warpweft = WarpWeft(Mesh=strips)  # -> Warp, Weft, NakedA, NakedB; disabled
join_3 = JoinCurves(Curves=medges.NakedEdges, Preserve=False)  # disabled
weaverbird_s_loop_subdivision = WeaverbirdsLoopSubdivision(MeshCurves=mesh_caps.A, Level=2, SmoothNakedEdges=1)  # disabled
explode_3 = Explode(Curve=join_3, Recursive=True)  # -> Segments, Vertices; disabled
end = EndPoints(Curve=explode_3.Segments)  # -> Start, End; disabled

boolean_toggle_2 = BooleanToggle(True)
flip_mesh_2 = FlipMesh(Mesh=md_2, VertexNormals=boolean_toggle_2, FaceNormals=boolean_toggle_2, FaceOrientation=boolean_toggle_2)
mesh_3 = Mesh(flip_mesh_2)

geometry_2 = Geometry(warpweft.Warp)  # disabled
geometry_3 = Geometry(warpweft.Weft)  # disabled
fcircle = CircleFit(Points=end.Start)  # -> Circle, Radius, Deviation; disabled

boolean_toggle_3 = BooleanToggle(True)  # disabled
flip_mesh_3 = FlipMesh(
    Mesh=weaverbird_s_catmull_clark_subdivision_3,
    VertexNormals=boolean_toggle_3,
    FaceNormals=boolean_toggle_3,
    FaceOrientation=boolean_toggle_3)  # disabled

boolean_toggle_4 = BooleanToggle(True)
flip_mesh_4 = FlipMesh(
    Mesh=weaverbird_s_catmull_clark_subdivision_2,
    VertexNormals=boolean_toggle_4,
    FaceNormals=boolean_toggle_4,
    FaceOrientation=boolean_toggle_4)

number_slider_9 = Slider(0, range=0..1)  # disabled
length = Length(Curve=geometry_3)  # disabled
multiplication = Multiplication(A=length, B=number_slider_9)  # disabled

number_slider_10 = Slider(1, range=0..1)  # disabled
length_2 = Length(Curve=geometry_2)  # disabled
multiplication_2 = Multiplication(A=length_2, B=number_slider_10)  # disabled

curve_closest_point_2 = CurveClosestPoint(Point=end.Start, Curve=fcircle.Circle)  # -> Point, Parameter, Distance; disabled
number_slider_11 = Slider(10, range=0..10)  # disabled
number_slider_12 = Slider(8.9, range=0..51)  # disabled
number_slider_13 = Slider(0.04, range=0..0.13)  # disabled
number_slider_14 = Slider(1000, range=0..1000)  # disabled

panel_4 = Panel("2")  # disabled
strips_2 = RefineStrips(Mesh=flip_mesh_3, Level=panel_4)  # disabled

deconstruct_mesh_2 = DeconstructMesh(Mesh=strips)  # -> Vertices, Faces, Colours, Normals; disabled
number_slider_15 = Slider(1000, range=0..1000)  # disabled

strips_3 = RefineStrips(Mesh=flip_mesh_4, Level="2")

mesh_edges_5 = MeshEdges(Mesh=strips_3)  # -> NakedEdges, InteriorEdges, NonManifoldEdges
face_normals_5 = FaceNormals(Mesh=strips_3)  # -> Centers, Normals
vector_display_5 = VectorDisplay(Anchor=face_normals_5.Centers, Vector=face_normals_5.Normals)

strips_4 = RefineStrips(Mesh=mesh_3, Level="2")

solidpointcollide = SolidPointCollide(
    Points=simplify(deconstruct_mesh_2.Vertices),
    Solid=weaverbird_s_loop_subdivision,
    Interior=False,
    Unidirectional=True,
    Strength=number_slider_14)  # disabled
pressure = Pressure(M=strips, Strength=number_slider_13)  # disabled
length_line = LengthLine(Line=geometry_2, Length=multiplication_2, Strength=number_slider_12)  # disabled
oncurve = OnCurve(Points=end.Start, Curve=graft(fcircle.Circle), Strength=100)  # disabled
planarize = Planarize(M=strips, Strength=100)  # disabled
equallength = EqualLength(Line=explode_3.Segments, Strength=1)  # disabled
length_line_2 = LengthLine(Line=geometry_3, Length=multiplication, Strength=number_slider_11)  # disabled
anchor = Anchor(Point=end.Start, Target=curve_closest_point_2.Point, Strength=number_slider_15)  # disabled
show = Show(G=strips)  # disabled
number_slider_16 = Slider(0, range=0..100)  # disabled
boolean_toggle_5 = BooleanToggle(False)  # disabled
button = Button()  # disabled
number_slider_17 = Slider(0.02, range=0..0.1)  # disabled
entwine = Entwine(
    Branch00=show,
    Branch01=[planarize, equallength, anchor, length_line, pressure, length_line_2, solidpointcollide],
    FlattenInputs=True)  # disabled
number_slider_18 = Slider(1000, range=0..1000)  # disabled
strength = Strength(0.1)  # disabled
number_slider_19 = Slider(500, range=0..1000)  # disabled
number_slider_20 = Slider(5000, range=0..10000)  # disabled
multiplication_3 = Multiplication(A=strength, B=64)  # disabled
solver = Solver(GoalObjects=entwine, Reset=button, Threshold=1e-15, Tolerance=0.01, On=boolean_toggle_5)  # -> I, V, O; disabled
mesh_4 = Mesh(simplify(strips_3))
solidpointcollide_2 = SolidPointCollide(Interior=False, Unidirectional=True, Strength=number_slider_18)  # disabled
bang = ExplodeTree(Data=solver.O)  # -> Branch0, Branch1; disabled
mesh_5 = Mesh(simplify(strips_3))
mesh_edges_6 = MeshEdges(Mesh=bang.Branch0)  # -> NakedEdges, InteriorEdges, NonManifoldEdges; disabled

number_slider_21 = Slider(0.03, range=0..0.1)
# KANGAROO FORM RELAXATION
fatten_4 = Fatten(
    Skeleton=line_3,
    Thickness=Slider(32, range=30..100),
    LengthSubdivisions=0,
    EndType=Slider(3, range=0..3),
    AdjustForAngle=False)
disjoint_mesh_4 = DisjointMesh(Mesh=fatten_4)  # -> graft(Meshes)

mesh_edges_7 = MeshEdges(Mesh=mesh_4)  # -> NakedEdges, InteriorEdges, NonManifoldEdges
deconstruct_mesh_3 = DeconstructMesh(Mesh=mesh_4)  # -> simplify(Vertices), Faces, Colours, Normals
warpweft_2 = WarpWeft(Mesh=mesh_4)  # -> Warp, Weft, NakedA, NakedB

colour_swatch = ColourSwatch(SwatchColor=RGBA(0, 0, 0, 171))  # disabled
custom_preview = CustomPreview(Geometry=mesh_edges_6.InteriorEdges, Material=colour_swatch)  # disabled

colour_swatch_2 = ColourSwatch(SwatchColor=RGBA(255, 255, 255, 171))  # disabled
custom_preview_2 = CustomPreview(Geometry=bang.Branch0, Material=colour_swatch_2)  # disabled

stripper = Stripper(Mesh=bang.Branch0)  # disabled

join_4 = JoinCurves(Curves=mesh_edges_7.NakedEdges, Preserve=False)
explode_4 = Explode(Curve=join_4, Recursive=True)  # -> Segments, Vertices
end_2 = EndPoints(Curve=explode_4.Segments)  # -> Start, End

mesh_edges_8 = MeshEdges(Mesh=stripper)  # -> NakedEdges, InteriorEdges, NonManifoldEdges; disabled

weaverbird_s_catmull_clark_subdivision_4 = WeaverbirdsCatmullClarkSubdivision(MeshCurves=disjoint_mesh_4, Level=Slider(2, range=0..10), SmoothNakedEdges=Slider(2, range=0..10))

mesh_edges_9 = MeshEdges(Mesh=mesh_5)  # -> NakedEdges, InteriorEdges, NonManifoldEdges

# ----
# FIND PEAK AND VALLEY
# OF Y CONNECTOR
cluster = Cluster(M=mesh_5)

stripper_2 = Stripper(Mesh=strips)  # disabled
geometry_4 = Geometry(warpweft_2.Warp)
geometry_5 = Geometry(warpweft_2.Weft)
cluster_2 = Cluster_2(point=cluster, geometry=[mesh_edges_9.NakedEdges, mesh_edges_9.InteriorEdges, mesh_edges_9.NonManifoldEdges])  # -> valley_2, peak_2

length_3 = Length(Curve=geometry_4)
multiplication_4 = Multiplication(A=length_3, B=Slider(0, range=0..1))

length_4 = Length(Curve=geometry_4)
multiplication_5 = Multiplication(A=length_4, B=Slider(0.944, range=0..1))

geometry_6 = Geometry(cluster_2.peak_2)
length_5 = Length(Curve=geometry_5)
mesh_closest_point = MeshClosestPoint(Point=geometry_6, Mesh=simplify(weaverbird_s_catmull_clark_subdivision_4))  # -> Point, Index, Parameter
multiplication_6 = Multiplication(A=length_5, B=Slider(0.521, range=0..1))

custom_preview_3 = CustomPreview(Geometry=weaverbird_s_catmull_clark_subdivision_4, Material=ColourSwatch(SwatchColor=RGBA(255, 255, 255, 95)))

solidpointcollide_3 = SolidPointCollide(
    Points=deconstruct_mesh_3.Vertices,
    Solid=simplify(weaverbird_s_catmull_clark_subdivision_4),
    Interior=False,
    Unidirectional=True,
    Strength=Slider(1000, range=0..1000))
pressure_2 = Pressure(M=mesh_4, Strength=Slider(0.02, range=0..0.1))
clamplength = ClampLength(Line=geometry_4, LowerLimit=multiplication_4, UpperLimit=multiplication_5, Strength=Slider(1, range=0.1..20))
length_line_3 = LengthLine(Line=geometry_5, Length=multiplication_6, Strength=Slider(9.7, range=0.5..20))
anchor_2 = Anchor(Point=simplify(end_2.Start), Strength=Slider(201000, range=0..201000))
equallength_2 = EqualLength(Line=simplify(explode_4.Segments), Strength=Slider(97, range=0..1000))
anchor_3 = Anchor(Point=geometry_6, Target=mesh_closest_point.Point, Strength=Slider(1000, range=0..1000))
planarize_2 = Planarize(M=mesh_4, Strength=Slider(384, range=0..1000))
show_2 = Show(G=mesh_4)
entwine_2 = Entwine(
    Branch00=show_2,
    Branch01=flatten([pressure_2, anchor_2, planarize_2, equallength_2, clamplength, length_line_3, solidpointcollide_3, anchor_3]),
    FlattenInputs=True)
solver_2 = Solver(GoalObjects=entwine_2, Reset=Button(), Threshold=1e-15, Tolerance=0.01, On=Toggle(False))  # -> I, V, O
bang_2 = ExplodeTree(Data=solver_2.O)  # -> Branch0, Branch1
mesh_6 = Mesh(bang_2.Branch0)  # disabled
mesh_edges_10 = MeshEdges(Mesh=mesh_6)  # -> NakedEdges, InteriorEdges, NonManifoldEdges; disabled

# ----
# DIVIDE INTO STRIPS
dam = DataDam(DataA=graft(mesh_6), BufferDelay=10000000, BufferMode=0)  # -> flatten(DataA)
stripper_3 = Stripper(Mesh=dam)
unroller = Unroller(Strip=stripper_3, Unroll=Slider(0, range=0..1))  # -> graft(Unrolled)
mesh_edges_11 = MeshEdges(Mesh=unroller)  # -> NakedEdges, InteriorEdges, NonManifoldEdges
dam_2 = DataDam(DataA=unroller, BufferDelay=10000000, BufferMode=0)

mesh_7 = Mesh(simplify(dam_2))
# Splitting top & bottom face
shift_paths_5 = ShiftPaths(Data=mesh_7, Offset=-1)
mesh_join = MeshJoin(Meshes=shift_paths_5)

mesh_area = MeshArea(Mesh=shift_paths_5)  # -> Area, Centroid
mesh_closest_point_2 = MeshClosestPoint(Point=mesh_area.Centroid, Mesh=shift_paths_5)  # -> Point, Index, Parameter

cluster_3 = Cluster(M=mesh_join)
weaverbird_s_naked_boundary_3 = WeaverbirdsNakedBoundary(MeshClosedPolylines=shift_paths_5)
mesh_edges_12 = MeshEdges(Mesh=shift_paths_5)  # -> NakedEdges, InteriorEdges, NonManifoldEdges

tree_statistics = TreeStatistics(Tree=mesh_closest_point_2.Point)  # -> Paths, Length, Count
series = Series(Start=0, Step=1, Count=tree_statistics.Count)
duplicate_data = DuplicateData(Data=graft(series), Number=2, Order=True)  # -> simplify(Data)

dam_3 = DataDam(DataA=graft(bang.Branch0), BufferDelay=10000000, BufferMode=0)  # disabled
number_slider_22 = Slider(0, range=0..1)  # disabled
mesh_8 = Mesh(bang.Branch0)  # disabled
point_2 = Point(cull_duplicates_2.Points)  # disabled
geometry_7 = Geometry(point_2)  # disabled

tree_branch = TreeBranch(Tree=mesh_closest_point_2.Point, Path=graft(duplicate_data), MaintainPaths=False)

stripper_4 = Stripper(Mesh=dam_3)  # disabled
mesh_9 = Mesh(stripper_4)  # disabled
unroller_2 = Unroller(Strip=stripper_4, Unroll=number_slider_22)  # -> graft(Unrolled); disabled
mesh_edges_13 = MeshEdges(Mesh=unroller_2)  # -> NakedEdges, InteriorEdges, NonManifoldEdges; disabled
line_4 = Line(StartPoint=graft(cluster_3), EndPoint=tree_branch)  # -> simplify(Line)
cluster_4 = Cluster_2(
    point=cluster_3,
    geometry=simplify([mesh_edges_12.NakedEdges, mesh_edges_12.InteriorEdges, mesh_edges_12.NonManifoldEdges]))  # -> valley_2, peak_2
dam_4 = DataDam(DataA=unroller_2, BufferDelay=10000000, BufferMode=0)  # disabled
tree_branch_2 = TreeBranch(Tree=shift_paths_5, Path=graft(duplicate_data), MaintainPaths=False)
length_6 = Length(Curve=line_4)

number_slider_23 = Slider(252, range=0..1000)  # disabled
list_length = ListLength(List=mesh_8)  # disabled
series_2 = Series(Start=0, Step=number_slider_23, Count=list_length)  # disabled
unit_x = UnitX(Factor=series_2)  # disabled

list_length_2 = ListLength(List=length_6)
division = Division(A=list_length_2, B=Slider(2, range=0..10))

geometry_8 = Geometry(cluster_4.valley_2)
sphere_3 = Sphere(Base=geometry_8, Radius=1)

geometry_9 = Geometry(cluster_4.peak_2)
sphere_4 = Sphere(Base=geometry_9, Radius=1)

sort_list = SortList(Keys=length_6, ValuesValuesA=line_4, ValuesA=tree_branch_2)  # -> Keys, ValuesValuesA, ValuesA
point_3 = Point(Point(-39.78202891, 450.1876353, 0))  # disabled

# ---- group: laying out
explode_5 = MeshExplode(Mesh=dam_4, Interpolate=False)  # disabled
item = ListItem(List=explode_5, Index=0, Wrap=True)  # disabled
item_2 = ListItem(List=explode_5, Index=-1, Wrap=True)  # disabled
facen = FaceNormals(Mesh=item)  # -> Centers, Normals; disabled
facen_2 = FaceNormals(Mesh=item_2)  # -> Centers, Normals; disabled
pl = PlaneNormal(Origin=facen.Centers, ZAxis=facen.Normals)  # disabled
vec2pt = Vector2Pt(PointA=facen.Centers, PointB=facen_2.Centers, Unitize=False)  # -> Vector, Length; disabled
align = AlignPlane(Plane=pl, Direction=vec2pt.Vector)  # -> flatten(Plane), Angle; disabled
bbox = BoundingBox(Content=dam_4, Plane=graft(align.Plane))  # -> flatten(Box), Box_2; disabled
box_corners = BoxCorners(Box=bbox.Box)  # -> CornerA, CornerB, CornerC, CornerD, CornerE, CornerF, CornerG, CornerH; disabled
pl_origin = PlaneOrigin(Base=align.Plane, Origin=box_corners.CornerD)  # disabled
debox = DeconstructBox(Box=bbox.Box)  # -> Plane, X, Y, Z; disabled
dedomain = DeconstructDomain(Domain=debox.Y)  # -> Start, End; disabled
subtraction = Subtraction(A=dedomain.End, B=dedomain.Start)  # disabled
ma = MassAddition(Input=subtraction)  # -> Result, PartialResults; disabled
xy = XYPlane(Origin=Point(0, 0, 0))  # disabled
X = UnitX(Factor=ma.PartialResults)  # disabled
rotate = Rotate(Geometry=xy, Angle=1.570796327, Plane=PlaneXY(0, 0, 0))  # -> Geometry, Transform; disabled
neg = Negative(Value=X)  # disabled
move = Move(Geometry=rotate.Geometry, Motion=neg)  # -> Geometry, Transform; disabled
pln = Plane(move.Geometry)  # disabled

# ----
xy_plane = XYPlane(Origin=point_3)  # disabled
merge = Merge(Data1=graft(mesh_8), Data2=graft(point_2))  # disabled
move_2 = Move(Geometry=xy_plane, Motion=unit_x)  # -> Geometry, Transform; disabled
group = Group(Objects=merge)  # disabled
xy_plane_2 = XYPlane(Origin=point_2)  # disabled
orient = Orient(Geometry=flatten(group), Source=xy_plane_2, Target=move_2.Geometry)  # -> Geometry, Transform; disabled
ungroup = Ungroup(Group=orient.Geometry)  # disabled
list_item = ListItem(List=ungroup, Index=0, Wrap=True)  # -> Item, Item1; disabled

mesh_area_2 = MeshArea(Mesh=mesh_9)  # -> Area, Centroid; disabled
mesh_closest_point_3 = MeshClosestPoint(Point=mesh_area_2.Centroid, Mesh=mesh_9)  # -> Point, Index, Parameter; disabled

number_slider_24 = Slider(0, range=0..1)  # disabled
stripper_5 = Stripper(Mesh=list_item.Item)  # disabled
mesh_10 = Mesh(stripper_5)  # disabled
unroller_3 = Unroller(Strip=mesh_10, Unroll=number_slider_24)  # -> graft(Unrolled); disabled

mesh_11 = Mesh(strips_2)
mesh_edges_14 = MeshEdges(Mesh=mesh_11)  # -> NakedEdges, InteriorEdges, NonManifoldEdges
nakedvertices = NakedVertices(Mesh=mesh_11)  # -> ClothedIndex, NakedIndex, ClothedPts, NakedPts

face_normals_6 = FaceNormals(Mesh=simplify(mesh_10))  # -> Centers, Normals; disabled
mesh_area_3 = MeshArea(Mesh=mesh_10)  # -> Area, Centroid; disabled
average = Average(Input=face_normals_6.Normals)  # disabled
mesh_closest_point_4 = MeshClosestPoint(Point=mesh_area_3.Centroid, Mesh=mesh_10)  # -> simplify(Point), Index, Parameter; disabled
shift_paths_6 = ShiftPaths(Data=average, Offset=-1)  # disabled

geometry_10 = Geometry(simplify(nakedvertices.NakedPts))

geometry_11 = Geometry(mesh_closest_point_4.Point)  # disabled
point_4 = Point(list_item.Item1)  # disabled
vector_2pt = Vector2Pt(PointA=point_4, PointB=geometry_11, Unitize=False)  # -> Vector, Length; disabled

orient_2 = Orient(Geometry=flatten(dam_4), Source=pl_origin, Target=pln)  # -> Geometry, Transform; disabled
mesh_12 = Mesh(orient_2.Geometry)  # disabled
vector_display_6 = VectorDisplay(Anchor=point_4, Vector=vector_2pt.Vector)  # disabled
vector_display_7 = VectorDisplay(Anchor=mesh_closest_point_4.Point, Vector=shift_paths_6)  # disabled

# ---- group: Input Your File Path
panel_5 = Panel("C:\Users\User\Desktop\Thesis Drive\Model_Digital\ML\CSV\YConnectorDataset.xlsx")  # disabled

# ----
number_slider_25 = Slider(1, range=0..10)  # disabled
number_slider_26 = Slider(1, range=0..10)  # disabled
toggle = BooleanToggle(True)  # disabled
toggle_2 = BooleanToggle(False)  # disabled
wo = WriteOptions(
    FilePath=panel_5,
    ClearDataOverwrite=True,
    SaveAfterWrite=toggle,
    CloseAfterWrite=toggle_2,
    ColumnStartPosition=number_slider_25,
    RowStartPosition=number_slider_26)  # -> UserMessages, WriteOptions; disabled

path = FilePath("C:\Users\User\Desktop\Thesis Drive\Model_Digital\ML\Y Connector Separator.py")  # disabled
gh_cpython = GH_CPython()  # -> a, output; inputs input: list; disabled
#   port input: [required] - [type = int] - [default = None] Descripe your input here * bullet point. * bullet point
#   port output: indicate your output description here. refers to a new line.
# ---------- gh_cpython: Python ----------
print("hello world")
# ---------- end gh_cpython ----------

# ----
# ALL LINES
curve_4 = Curve(curve)
number_slider_27 = Slider(0.03, range=0..0.1)

number_slider_28 = Slider(0.1, range=0..0.1)
divide_length = DivideLength(Curve=curve_4, Length=Slider(100, range=0..100))  # -> Points, Tangents, Parameters
end_points_2 = EndPoints(Curve=curve_4)  # -> Start, End
merge_2 = Merge(Data1=graft(end_points_2.Start), Data2=divide_length.Points, Data3=graft(end_points_2.End))
sort_duplicate_points = SortDuplicatePoints(Points=merge_2)  # -> UniquePoints, Indices

sort_along_curve = SortAlongCurve(Points=sort_duplicate_points.UniquePoints, Curve=graft(curve_4))  # -> Points, Indices
polyline = PolyLine(Vertices=sort_along_curve.Points, Closed=False)
fatten_5 = Fatten(
    Skeleton=flatten(polyline),
    Thickness=Slider(30, range=0..1000),
    LengthSubdivisions=0,
    EndType=Slider(0, range=0..100),
    AdjustForAngle=False)
weaverbird_s_catmull_clark_subdivision_5 = WeaverbirdsCatmullClarkSubdivision(MeshCurves=fatten_5, Level=1, SmoothNakedEdges=1)
weaverbird_s_loop_subdivision_2 = WeaverbirdsLoopSubdivision(MeshCurves=fatten_5, Level=1, SmoothNakedEdges=1)
mesh_edges_15 = MeshEdges(Mesh=fatten_5)  # -> NakedEdges, InteriorEdges, NonManifoldEdges

curve_5 = Curve(curve_3)  # disabled
number_slider_29 = Slider(50, range=0..100)  # disabled
number_slider_30 = Slider(0.03, range=0..0.1)  # disabled
number_slider_31 = Slider(30, range=0..1000)  # disabled

number_slider_32 = Slider(0.05, range=0..0.1)  # disabled
divide_length_2 = DivideLength(Curve=curve_5, Length=number_slider_29)  # -> Points, Tangents, Parameters; disabled
end_points_3 = EndPoints(Curve=curve_5)  # -> Start, End; disabled
merge_3 = Merge(Data1=graft(end_points_3.Start), Data2=divide_length_2.Points, Data3=graft(end_points_3.End))  # disabled
sort_duplicate_points_2 = SortDuplicatePoints(Points=merge_3)  # -> UniquePoints, Indices; disabled

sort_along_curve_2 = SortAlongCurve(Points=sort_duplicate_points_2.UniquePoints, Curve=graft(curve_5))  # -> Points, Indices; disabled
polyline_2 = PolyLine(Vertices=sort_along_curve_2.Points, Closed=False)  # disabled
fatten_6 = Fatten(Skeleton=flatten(polyline_2), Thickness=number_slider_31, LengthSubdivisions=0, EndType=0, AdjustForAngle=False)  # disabled
weaverbird_s_loop_subdivision_3 = WeaverbirdsLoopSubdivision(MeshCurves=fatten_6, Level=1, SmoothNakedEdges=1)  # disabled
mesh_edges_16 = MeshEdges(Mesh=weaverbird_s_loop_subdivision_3)  # -> NakedEdges, InteriorEdges, NonManifoldEdges; disabled

colour_swatch_3 = ColourSwatch(SwatchColor=RGB(255, 255, 255))  # disabled
custom_preview_4 = CustomPreview(Geometry=weaverbird_s_loop_subdivision_3, Material=colour_swatch_3)  # disabled

mesh_13 = Mesh(fatten_6)  # disabled

disjoint_mesh_5 = DisjointMesh(Mesh=mesh_13)  # disabled
unify_mesh = UnifyMesh(Mesh=disjoint_mesh_5)  # -> Result, Count; disabled
weld_mesh = WeldMesh(Mesh=unify_mesh.Result, Angle=3.141592654)  # disabled
mesh_weldvertices = MeshWeldVertices(Mesh=weld_mesh, Tolerance=0.01)  # -> RuntimeMessage, Mesh; disabled

panel_6 = Panel("1")  # disabled
refine_3 = Refine(Mesh=graft(mesh_weldvertices.Mesh), Level=panel_6)  # disabled
clean_3 = CombineClean(Meshes=refine_3)  # disabled
md_3 = MeshDirection(Mesh=clean_3)  # disabled
turn_3 = MeshTurn(Mesh=md_3)  # disabled

boolean_toggle_6 = BooleanToggle(True)  # disabled
flip_mesh_5 = FlipMesh(Mesh=md_3, VertexNormals=boolean_toggle_6, FaceNormals=boolean_toggle_6, FaceOrientation=boolean_toggle_6)  # disabled
mesh_14 = Mesh(flip_mesh_5)  # disabled

weaverbird_s_naked_boundary_4 = WeaverbirdsNakedBoundary(MeshClosedPolylines=mesh_weldvertices.Mesh)  # disabled
nakedvertices_2 = NakedVertices(Mesh=mesh_weldvertices.Mesh)  # -> ClothedIndex, NakedIndex, ClothedPts, NakedPts; disabled

panel_7 = Panel("1")  # disabled
strips_5 = RefineStrips(Mesh=mesh_14, Level=panel_7)  # disabled

mesh_edges_17 = MeshEdges(Mesh=strips_5)  # -> NakedEdges, InteriorEdges, NonManifoldEdges; disabled

face_normals_7 = FaceNormals(Mesh=strips_5)  # -> Centers, Normals; disabled
vector_display_8 = VectorDisplay(Anchor=face_normals_7.Centers, Vector=face_normals_7.Normals)  # disabled

geometry_12 = Geometry(nakedvertices_2.NakedPts)  # disabled
weaverbird_s_loop_subdivision_4 = WeaverbirdsLoopSubdivision(MeshCurves=strips_5, Level=1, SmoothNakedEdges=1)  # disabled
deconstruct_mesh_4 = DeconstructMesh(Mesh=strips_5)  # -> Vertices, Faces, Colours, Normals; disabled
medges_2 = MeshEdges(Mesh=simplify(strips_5))  # -> NakedEdges, InteriorEdges, NonManifoldEdges; disabled
join_5 = JoinCurves(Curves=medges_2.NakedEdges, Preserve=False)  # disabled
warpweft_3 = WarpWeft(Mesh=strips_5)  # -> Warp, Weft, NakedA, NakedB; disabled
explode_6 = Explode(Curve=join_5, Recursive=True)  # -> Segments, Vertices; disabled
end_3 = EndPoints(Curve=simplify(explode_6.Segments))  # -> Start, End; disabled

fcircle_2 = CircleFit(Points=end_3.Start)  # -> Circle, Radius, Deviation; disabled
number_slider_33 = Slider(1, range=0..1)  # disabled
curve_closest_point_3 = CurveClosestPoint(Point=end_3.Start, Curve=fcircle_2.Circle)  # -> Point, Parameter, Distance; disabled
closest_points = ClosestPoints(Point=curve_closest_point_3.Point, Cloud=flatten(curve_closest_point_2.Point), Count=number_slider_33)  # -> ClosestPoint, CPIndex, Distance; disabled
shift_paths_7 = ShiftPaths(Data=closest_points.ClosestPoint, Offset=-1)  # disabled

pressure_3 = Pressure(M=strips_5, Strength=number_slider_17)  # disabled
onmesh = OnMesh(Points=simplify(deconstruct_mesh_4.Vertices), Mesh=simplify(weaverbird_s_loop_subdivision_4), Strength=number_slider_19)  # disabled
length_line_4 = LengthLine(Line=warpweft_3.Warp, Length=number_slider_16, Strength=strength)  # disabled
oncurve_2 = OnCurve(Points=end_3.Start, Strength=100)  # disabled
planarize_3 = Planarize(M=strips_5, Strength=100)  # disabled
equallength_3 = EqualLength(Line=explode_6.Segments, Strength=1)  # disabled
anchor_4 = Anchor(Point=end_3.Start, Target=shift_paths_7, Strength=number_slider_20)  # disabled
length_line_5 = LengthLine(Line=warpweft_3.Weft, Length=number_slider_16, Strength=multiplication_3)  # disabled
show_3 = Show(G=strips_5)  # disabled
entwine_3 = Entwine(
    Branch00=show_3,
    Branch01=[planarize_3, length_line_4, length_line_5, equallength_3, anchor_4, pressure_3, onmesh],
    FlattenInputs=True)  # disabled
solver_3 = Solver(GoalObjects=entwine_3, Reset=button, Threshold=1e-15, Tolerance=0.01, On=boolean_toggle_5)  # -> I, V, O; disabled
bang_3 = ExplodeTree(Data=solver_3.O)  # -> Branch0, Branch1; disabled
mesh_edges_18 = MeshEdges(Mesh=bang_3.Branch0)  # -> NakedEdges, InteriorEdges, NonManifoldEdges; disabled

colour_swatch_4 = ColourSwatch(SwatchColor=RGBA(164, 104, 255, 171))  # disabled
custom_preview_5 = CustomPreview(Geometry=[bang_3.Branch0, mesh_edges_18.NakedEdges], Material=colour_swatch_4)  # disabled

colour_swatch_5 = ColourSwatch(SwatchColor=RGBA(0, 0, 0, 171))  # disabled
custom_preview_6 = CustomPreview(Geometry=mesh_edges_18.InteriorEdges, Material=colour_swatch_5)  # disabled

# ----
# POLE OF Y CONNECTORS
deconstruct_mesh_5 = DeconstructMesh(Mesh=simplify(stripper_2))  # -> Vertices, Faces, Colours, Normals; disabled
number_slider_34 = Slider(0.1, range=0..0.5)  # disabled
shift_paths_8 = ShiftPaths(Data=deconstruct_mesh_5.Vertices, Offset=-1)  # disabled
sort_duplicate_points_3 = SortDuplicatePoints(Points=shift_paths_8)  # -> UniquePoints, Indices; disabled
mesh_sphere = MeshSphere(Base=sort_duplicate_points_3.UniquePoints, Radius=number_slider_34, UCount=10, VCount=20)  # disabled
mesh_inclusion = MeshInclusion(Mesh=graft(mesh_sphere), Point=flatten(shift_paths_8), Strict=False)  # disabled
cull_pattern_2 = CullPattern(List=flatten(shift_paths_8), CullPattern=mesh_inclusion)  # disabled
boolean_toggle_7 = BooleanToggle(True)  # disabled
clean_tree = CleanTree(RemoveNulls=boolean_toggle_7, RemoveInvalid=boolean_toggle_7, RemoveEmpty=boolean_toggle_7, Tree=cull_pattern_2)  # -> simplify(Tree); disabled
param_viewer = ParamViewer(clean_tree)  # disabled

list_length_3 = ListLength(List=clean_tree)  # disabled
panel_8 = Panel("x>2")  # disabled
evaluate_2 = Evaluate(Expression=panel_8, x=list_length_3)  # disabled

dispatch_2 = Dispatch(List=flatten(param_viewer), DispatchPattern=flatten(evaluate_2))  # -> ListA, ListB; disabled
tree_branch_3 = TreeBranch(Tree=clean_tree, Path=dispatch_2.ListA, MaintainPaths=True)  # disabled
shift_paths_9 = ShiftPaths(Data=tree_branch_3, Offset=-1)  # disabled
cull_duplicates_5 = CullDuplicates(Points=shift_paths_9, Tolerance=0.1, CullMode=3)  # -> simplify(Points), Indices, Valence; disabled

anchor_5 = Anchor(Point=cull_duplicates_5.Points, Strength=10000)  # disabled

# ----
# POLE OF Y CONNECTORS
deconstruct_mesh_6 = DeconstructMesh(Mesh=simplify(mesh_9))  # -> Vertices, Faces, Colours, Normals; disabled
number_slider_35 = Slider(0.1, range=0..0.5)  # disabled
shift_paths_10 = ShiftPaths(Data=deconstruct_mesh_6.Vertices, Offset=-1)  # disabled
sort_duplicate_points_4 = SortDuplicatePoints(Points=shift_paths_10)  # -> UniquePoints, Indices; disabled
mesh_sphere_2 = MeshSphere(Base=sort_duplicate_points_4.UniquePoints, Radius=number_slider_35, UCount=10, VCount=20)  # disabled
mesh_inclusion_2 = MeshInclusion(Mesh=graft(mesh_sphere_2), Point=flatten(shift_paths_10), Strict=False)  # disabled
cull_pattern_3 = CullPattern(List=flatten(shift_paths_10), CullPattern=mesh_inclusion_2)  # disabled
boolean_toggle_8 = BooleanToggle(True)  # disabled
clean_tree_2 = CleanTree(RemoveNulls=boolean_toggle_8, RemoveInvalid=boolean_toggle_8, RemoveEmpty=boolean_toggle_8, Tree=cull_pattern_3)  # -> simplify(Tree); disabled
param_viewer_2 = ParamViewer(clean_tree_2)  # disabled

list_length_4 = ListLength(List=clean_tree_2)  # disabled
panel_9 = Panel("x>2")  # disabled
evaluate_3 = Evaluate(Expression=panel_9, x=list_length_4)  # disabled

dispatch_3 = Dispatch(List=flatten(param_viewer_2), DispatchPattern=flatten(evaluate_3))  # -> ListA, ListB; disabled
tree_branch_4 = TreeBranch(Tree=clean_tree_2, Path=dispatch_3.ListA, MaintainPaths=True)  # disabled
shift_paths_11 = ShiftPaths(Data=tree_branch_4, Offset=-1)  # disabled
cull_duplicates_6 = CullDuplicates(Points=shift_paths_11, Tolerance=0.1, CullMode=3)  # -> simplify(Points), Indices, Valence; disabled

weaverbird_s_naked_boundary_5 = WeaverbirdsNakedBoundary(MeshClosedPolylines=mesh_9)  # disabled
cross_reference = CrossReference(ListListA=mesh_9, ListListB=cull_duplicates_6.Points, CrossMode=1)  # -> ListListA, ListListB; disabled

cross_reference_2 = CrossReference(ListListA=mesh_closest_point_3.Point, ListListB=cull_duplicates_6.Points, CrossMode=1)  # -> ListListA, ListListB; disabled

number_slider_36 = Slider(5, range=0..10)  # disabled
sphere_5 = Sphere(Base=cull_duplicates_6.Points, Radius=number_slider_36)  # disabled

line_5 = Line(StartPoint=cross_reference_2.ListListA, EndPoint=cross_reference_2.ListListB)  # -> simplify(Line); disabled
length_7 = Length(Curve=line_5)  # disabled
list_item_2 = ListItem(List=sphere_5, Index=0, Wrap=True)  # -> Item, Item1; disabled

number_slider_37 = Slider(2, range=0..10)  # disabled
list_length_5 = ListLength(List=length_7)  # disabled
division_2 = Division(A=list_length_5, B=number_slider_37)  # disabled

sort_list_2 = SortList(Keys=length_7, ValuesValuesA=line_5, ValuesA=cross_reference.ListListA)  # -> Keys, ValuesValuesA, ValuesA; disabled
split_list = SplitList(List=sort_list_2.ValuesValuesA, Index=division_2)  # -> simplify(ListA), ListB; disabled
split_list_2 = SplitList(List=sort_list_2.ValuesA, Index=division_2)  # -> simplify(ListA), ListB; disabled
geometry_13 = Geometry(split_list.ListA)  # disabled
geometry_14 = Geometry(split_list_2.ListA)  # disabled
collision_one_many_2 = CollisionOneMany(Collider=simplify(flatten(geometry_13)), Obstacles=graft(list_item_2.Item))  # -> simplify(Collision), Index; disabled
collision_one_many_3 = CollisionOneMany(Collider=simplify(flatten(geometry_13)), Obstacles=graft(list_item_2.Item1))  # -> simplify(Collision), Index; disabled
dispatch_4 = Dispatch(List=flatten(geometry_14), DispatchPattern=simplify(collision_one_many_3.Collision))  # -> ListA, ListB; disabled
geometry_15 = Geometry(dispatch_4.ListA)  # disabled

mesh_area_4 = MeshArea(Mesh=geometry_15)  # -> Area, Centroid; disabled
mesh_closest_point_5 = MeshClosestPoint(Point=mesh_area_4.Centroid, Mesh=geometry_15)  # -> Point, Index, Parameter; disabled

panel_10 = Panel("1")  # disabled
define_text_dot = DefineTextDot(Text=panel_10, Location=mesh_closest_point_5.Point, Font="Arial", Size=14)  # disabled

list_length_6 = ListLength(List=define_text_dot)  # disabled
duplicate_data_2 = DuplicateData(Data=panel_10, Number=list_length_6, Order=True)  # disabled

dispatch_5 = Dispatch(List=flatten(geometry_14), DispatchPattern=simplify(collision_one_many_2.Collision))  # -> ListA, ListB; disabled
# DATASET FOR ML_Y CONNECTOR SEPARATOR
geometry_16 = Geometry(dispatch_5.ListA)  # disabled
merge_4 = Merge(Data1=geometry_16, Data2=geometry_15)  # disabled
mesh_15 = Mesh(merge_4)  # disabled

mesh_area_5 = MeshArea(Mesh=geometry_16)  # -> Area, Centroid; disabled
mesh_closest_point_6 = MeshClosestPoint(Point=mesh_area_5.Centroid, Mesh=geometry_16)  # -> Point, Index, Parameter; disabled

mesh_area_6 = MeshArea(Mesh=mesh_15)  # -> Area, Centroid; disabled
mesh_closest_point_7 = MeshClosestPoint(Point=mesh_area_6.Centroid, Mesh=mesh_15)  # -> Point, Index, Parameter; disabled

panel_11 = Panel("0")  # disabled
define_text_dot_2 = DefineTextDot(Text=panel_11, Location=mesh_closest_point_6.Point, Font="Arial", Size=14)  # disabled

merge_5 = Merge(Data1=define_text_dot_2, Data2=define_text_dot)  # -> graft(Result); disabled

# ----
# Distance from Center(strips) to Center(connector)
line_6 = Line(StartPoint=graft(geometry_7), EndPoint=mesh_closest_point_7.Point)  # -> simplify(Line); disabled

geometry_17 = Geometry(line_6)  # disabled
end_points_4 = EndPoints(Curve=geometry_17)  # -> Start, End; disabled
vector_2pt_2 = Vector2Pt(PointA=end_points_4.Start, PointB=end_points_4.End, Unitize=False)  # -> Vector, Length; disabled
vector_display_9 = VectorDisplay(Anchor=end_points_4.Start, Vector=vector_2pt_2.Vector)  # disabled
weaverbird_s_naked_boundary_6 = WeaverbirdsNakedBoundary(MeshClosedPolylines=mesh_15)  # -> graft(NakedCurves); disabled

list_length_7 = ListLength(List=define_text_dot_2)  # disabled
duplicate_data_3 = DuplicateData(Data=panel_11, Number=list_length_7, Order=True)  # disabled

length_8 = Length(Curve=line_6)  # -> graft(Length); disabled
merge_6 = Merge(Data1=duplicate_data_3, Data2=duplicate_data_2)  # -> graft(Result); disabled
geometry_18 = Geometry(dispatch_5.ListA)  # disabled
geometry_19 = Geometry(dispatch_4.ListA)  # disabled
mesh_join_2 = MeshJoin(Meshes=geometry_18)  # disabled
mesh_join_3 = MeshJoin(Meshes=geometry_19)  # disabled
merge_7 = Merge(Data1=mesh_join_2, Data2=mesh_join_3)  # disabled

deconstruct_mesh_7 = DeconstructMesh(Mesh=simplify(mesh_15))  # -> Vertices, Faces, Colours, Normals; disabled
number_slider_38 = Slider(0.5, range=0..0.5)  # disabled
shift_paths_12 = ShiftPaths(Data=deconstruct_mesh_7.Vertices, Offset=-1)  # disabled
sort_duplicate_points_5 = SortDuplicatePoints(Points=shift_paths_12)  # -> UniquePoints, Indices; disabled
mesh_sphere_3 = MeshSphere(Base=sort_duplicate_points_5.UniquePoints, Radius=number_slider_38, UCount=10, VCount=20)  # disabled
mesh_inclusion_3 = MeshInclusion(Mesh=graft(mesh_sphere_3), Point=flatten(shift_paths_12), Strict=False)  # disabled
cull_pattern_4 = CullPattern(List=flatten(shift_paths_12), CullPattern=mesh_inclusion_3)  # disabled
boolean_toggle_9 = BooleanToggle(True)  # disabled
clean_tree_3 = CleanTree(RemoveNulls=boolean_toggle_9, RemoveInvalid=boolean_toggle_9, RemoveEmpty=boolean_toggle_9, Tree=cull_pattern_4)  # -> simplify(Tree); disabled
param_viewer_3 = ParamViewer(clean_tree_3)  # disabled

list_length_8 = ListLength(List=clean_tree_3)  # disabled
panel_12 = Panel("x>2")  # disabled
evaluate_4 = Evaluate(Expression=panel_12, x=list_length_8)  # disabled

dispatch_6 = Dispatch(List=flatten(param_viewer_3), DispatchPattern=flatten(evaluate_4))  # -> ListA, ListB; disabled
tree_branch_5 = TreeBranch(Tree=clean_tree_3, Path=dispatch_6.ListA, MaintainPaths=True)  # disabled
shift_paths_13 = ShiftPaths(Data=tree_branch_5, Offset=-1)  # disabled
cull_duplicates_7 = CullDuplicates(Points=shift_paths_13, Tolerance=0.1, CullMode=3)  # -> simplify(Points), Indices, Valence; disabled

line_7 = Line(StartPoint=graft(geometry_7), EndPoint=cull_duplicates_7.Points)  # -> simplify(Line); disabled
list_item_3 = ListItem(List=line_7, Index=0, Wrap=True)  # -> Item, Item1; disabled

# ----
# POLE A
geometry_20 = Geometry(list_item_3.Item)  # disabled

list_item_4 = ListItem(List=cull_duplicates_7.Points, Index=0, Wrap=True)  # -> Item, Item1; disabled

# ----
# POLE B
geometry_21 = Geometry(list_item_3.Item1)  # disabled

end_points_5 = EndPoints(Curve=geometry_21)  # -> Start, End; disabled
end_points_6 = EndPoints(Curve=geometry_20)  # -> Start, End; disabled
vector_2pt_3 = Vector2Pt(PointA=end_points_5.Start, PointB=end_points_5.End, Unitize=False)  # -> Vector, Length; disabled
vector_2pt_4 = Vector2Pt(PointA=end_points_6.Start, PointB=end_points_6.End, Unitize=False)  # -> Vector, Length; disabled
vector_display_10 = VectorDisplay(Anchor=end_points_5.Start, Vector=vector_2pt_3.Vector)  # disabled
vector_display_11 = VectorDisplay(Anchor=end_points_6.Start, Vector=vector_2pt_4.Vector)  # disabled

# ----
# Distance from Center(strips) to Pole B
line_8 = Line(StartPoint=mesh_closest_point_7.Point, EndPoint=list_item_4.Item1)  # -> simplify(Line); disabled

# ----
# Distance from Center(strips) to Pole A
line_9 = Line(StartPoint=mesh_closest_point_7.Point, EndPoint=list_item_4.Item)  # -> simplify(Line); disabled

angle = Angle(VectorA=vector_2pt_4.Vector, VectorB=vector_2pt_2.Vector)  # -> Angle, Reflex; disabled
angle_2 = Angle(VectorA=vector_2pt_3.Vector, VectorB=vector_2pt_2.Vector)  # -> Angle, Reflex; disabled
degrees = Degrees(Radians=angle.Angle)  # -> graft(Degrees); disabled
degrees_2 = Degrees(Radians=angle_2.Angle)  # -> graft(Degrees); disabled
length_9 = Length(Curve=line_9)  # -> graft(Length); disabled
length_10 = Length(Curve=line_8)  # -> graft(Length); disabled
merge_8 = Merge(Data1=length_8, Data2=length_9, Data3=length_10, Data4=degrees, Data5=degrees_2)  # disabled
round_to_decimal_place = RoundToDecimalPlace(NumberX=merge_8, DecimalPlace=2, RoundType=0)  # -> Rounded, Difference; disabled
merge_9 = Merge(Data1=simplify(merge_6), Data2=simplify(round_to_decimal_place.Rounded))  # disabled
panel_13 = Panel(merge_9)  # disabled

param_viewer_4 = ParamViewer(merge_9)  # disabled
number_slider_39 = Slider(405, range=0..1000)  # disabled
jitter = Jitter(List=param_viewer_4, Jitter=1, Seed=number_slider_39)  # -> Values, Indices; disabled

flatten_tree = FlattenTree(Tree=degrees, Path="{0}")  # -> graft(Tree); disabled
flatten_tree_2 = FlattenTree(Tree=length_10, Path="{0}")  # -> graft(Tree); disabled
flatten_tree_3 = FlattenTree(Tree=degrees_2, Path="{0}")  # -> graft(Tree); disabled
flatten_tree_4 = FlattenTree(Tree=weaverbird_s_naked_boundary_6, Path="{0}")  # -> graft(Tree); disabled
flatten_tree_5 = FlattenTree(Tree=length_8, Path="{0}")  # -> graft(Tree); disabled
flatten_tree_6 = FlattenTree(Tree=length_9, Path="{0}")  # -> graft(Tree); disabled
flatten_tree_7 = FlattenTree(Tree=merge_5, Path="{0}")  # -> graft(Tree); disabled
merge_10 = Merge(
    Data1=flatten_tree_4,
    Data2=flatten_tree_7,
    Data3=flatten_tree_5,
    Data4=flatten_tree_6,
    Data5=flatten_tree_2,
    Data6=flatten_tree,
    Data7=flatten_tree_3)  # disabled
number_slider_40 = Slider(0, range=0..72)  # disabled
tree_branch_6 = TreeBranch(Tree=simplify(merge_10), Path=number_slider_40, MaintainPaths=True)  # disabled
panel_14 = Panel(merge_10)  # disabled

tree_branch_7 = TreeBranch(Tree=merge_9, Path=jitter.Values, MaintainPaths=False)  # disabled
panel_15 = Panel(tree_branch_7)  # disabled
flip_matrix = FlipMatrix(Data=tree_branch_7)  # disabled

panel_16 = Panel("""LABEL
DIST_SC
DIST_SA
DIST_SB
ANGLE_SA
ANGLE_SB""")  # disabled
toggle_3 = BooleanToggle(False)  # disabled
toggle_4 = BooleanToggle(False)  # disabled
writexl = WriteToExcel(
    Run=toggle_4,
    ExcelWorksheet="1",
    ColumnNames=panel_16,
    WriteOptions=wo.WriteOptions,
    ColumnnsOrRows=toggle_3,
    DataToWriteIntoColumns=flip_matrix)  # disabled
panel_17 = Panel(writexl)  # disabled

lng = ListLength(List=param_viewer_4)  # disabled
series_3 = Series(Start=0, Step=1, Count=lng)  # disabled

split_list_3 = SplitList(List=simplify(sort_list.ValuesA), Index=division)  # -> simplify(ListA), ListB
geometry_22 = Geometry(split_list_3.ListA)

split_list_4 = SplitList(List=sort_list.ValuesValuesA, Index=division)  # -> simplify(ListA), ListB
geometry_23 = Geometry(split_list_4.ListA)
# Peak face
collision_one_many_4 = CollisionOneMany(Collider=simplify(flatten(geometry_23)), Obstacles=graft(sphere_4))  # -> simplify(Collision), Index
dispatch_7 = Dispatch(List=flatten(geometry_22), DispatchPattern=simplify(collision_one_many_4.Collision))  # -> ListA, ListB
geometry_24 = Geometry(dispatch_7.ListA)
mesh_join_4 = MeshJoin(Meshes=geometry_24)
mesh_edges_19 = MeshEdges(Mesh=mesh_join_4)  # -> NakedEdges, InteriorEdges, NonManifoldEdges

# ----
# Valley face
collision_one_many_5 = CollisionOneMany(Collider=simplify(flatten(geometry_23)), Obstacles=graft(sphere_3))  # -> simplify(Collision), Index
dispatch_8 = Dispatch(List=flatten(geometry_22), DispatchPattern=simplify(collision_one_many_5.Collision))  # -> ListA, ListB
geometry_25 = Geometry(dispatch_8.ListA)
mesh_join_5 = MeshJoin(Meshes=geometry_25)
mesh_edges_20 = MeshEdges(Mesh=mesh_join_5)  # -> NakedEdges, InteriorEdges, NonManifoldEdges

meshcorners = MeshCorners(Mesh=mesh_join_4, Angle=2.35619449)
meshcorners_2 = MeshCorners(Mesh=mesh_join_5, Angle=2.35619449)
merge_11 = Merge(Data1=meshcorners_2, Data2=meshcorners)
cull_duplicates_8 = CullDuplicates(Points=merge_11, Tolerance=0.1, CullMode=3)  # -> Points, Indices, Valence
closest_point_3 = ClosestPoint(Point=cull_duplicates_8.Points)  # -> ClosestPoint, CPIndex, Distance
merge_12 = Merge(Data1=mesh_join_5, Data2=mesh_join_4)

custom_preview_7 = CustomPreview(
    Geometry=[mesh_join_5, mesh_edges_20.NakedEdges, mesh_edges_20.InteriorEdges, mesh_edges_20.NonManifoldEdges],
    Material=ColourSwatch(SwatchColor=RGBA(0, 255, 255, 206)))

custom_preview_8 = CustomPreview(
    Geometry=[mesh_join_4, mesh_edges_19.NakedEdges, mesh_edges_19.InteriorEdges, mesh_edges_19.NonManifoldEdges],
    Material=ColourSwatch(SwatchColor=RGBA(255, 0, 255, 94)))

# ==== cluster Cluster
M = ClusterInput()
stripper = Stripper(Mesh=M)

# ----
# POLE OF Y CONNECTORS
deconstruct_mesh = DeconstructMesh(Mesh=simplify(stripper))  # -> Vertices, Faces, Colours, Normals
shift_paths = ShiftPaths(Data=deconstruct_mesh.Vertices, Offset=-1)
sort_duplicate_points = SortDuplicatePoints(Points=shift_paths)  # -> UniquePoints, Indices
mesh_sphere = MeshSphere(Base=sort_duplicate_points.UniquePoints, Radius=Slider(0.1, range=0..0.5), UCount=10, VCount=20)
mesh_inclusion = MeshInclusion(Mesh=graft(mesh_sphere), Point=flatten(shift_paths), Strict=False)
cull_pattern = CullPattern(List=flatten(shift_paths), CullPattern=mesh_inclusion)
boolean_toggle = BooleanToggle(True)
clean_tree = CleanTree(RemoveNulls=boolean_toggle, RemoveInvalid=boolean_toggle, RemoveEmpty=boolean_toggle, Tree=cull_pattern)  # -> simplify(Tree)
param_viewer = ParamViewer(clean_tree)

list_length = ListLength(List=clean_tree)
evaluate = Evaluate(Expression="x>2", x=list_length)

dispatch = Dispatch(List=flatten(param_viewer), DispatchPattern=flatten(evaluate))  # -> ListA, ListB
tree_branch = TreeBranch(Tree=clean_tree, Path=dispatch.ListA, MaintainPaths=True)
shift_paths_2 = ShiftPaths(Data=tree_branch, Offset=-1)
cull_duplicates = CullDuplicates(Points=shift_paths_2, Tolerance=0.1, CullMode=3)  # -> simplify(Points), Indices, Valence

points = ClusterOutput(cull_duplicates.Points)

# ==== cluster Cluster_2
point = ClusterInput()
geometry = ClusterInput()
point_2 = Point(point)
geometry_2 = Geometry(geometry)

sphere = Sphere(Base=graft(point_2), Radius=Slider(1, range=0..1))

collision_one_many = CollisionOneMany(Collider=geometry_2, Obstacles=point_2)  # -> Collision, Index
cull_pattern = CullPattern(List=geometry_2, CullPattern=collision_one_many.Collision)  # -> simplify(List)

collision_one_many_2 = CollisionOneMany(Collider=flatten(cull_pattern), Obstacles=sphere)  # -> Collision, Index
cull_pattern_2 = CullPattern(List=flatten(cull_pattern), CullPattern=collision_one_many_2.Collision)

length = Length(Curve=cull_pattern_2)
mass_addition = MassAddition(Input=length)  # -> Result, PartialResults
shift_paths = ShiftPaths(Data=mass_addition.Result, Offset=-1)
sort_list = SortList(Keys=shift_paths, ValuesValuesA=point_2)  # -> Keys, ValuesValuesA
list_item = ListItem(List=sort_list.ValuesValuesA, Index=0, Wrap=True)  # -> Item, Item1
valley = Data(list_item.Item)
peak = Data(list_item.Item1)
valley_2 = ClusterOutput(valley)
peak_2 = ClusterOutput(peak)
