# Grasshopper definition 200612_Table_V4.gh (Grasshopper 1.0.7)
# plug-ins: MeshEdit Components, Fattener, LunchBoxML, Kangaroo Components, LunchBox, Weaverbird, Kangaroo2 Components

curve = Curve([<curve referenced from the Rhino model> x21])

# ----
# Y JUNCTION LINES
discontinuity = Discontinuity(Curve=curve, Level=1)  # -> Points, Parameters
create_rtree = CreateRTree(InputGeometry=flatten(discontinuity.Points))
cull_duplicates = CullDuplicates(Points=flatten(discontinuity.Points), Tolerance=0.1, CullMode=3)  # -> Points, Indices, Valence
rtree_points_in_range = RTreePointsInRange(SearchPoints=cull_duplicates.Points, SearchDistance=Slider(50, range=0..100), RTree=create_rtree)  # -> simplify(PointsWithinRange), IndicesWithinRange

number_slider = Slider(0.05, range=0..0.1)
c_script = CSharpScript(x=rtree_points_in_range.PointsWithinRange)  # -> out, A; inputs x: tree of Point3d
# ---------- c_script: C# ----------
    for(int i = 0; i < x.BranchCount; i++){
      if(x.Branch(i).Count > 2){
        points.Add(x.Branch(i));
      }
    }

    A = ListOfListsToTree(points);
# ---------- c_script: C# additional code ----------
  List<List<Point3d>> points = new List<List<Point3d>>();


  static Grasshopper.DataTree<T> ListOfListsToTree<T > (List < List < T >> s){
  Grasshopper.DataTree<T> tree = new DataTree<T>();
  for(int i = 0;i < s.Count; i++){
  tree.AddRange(s[i], new GH_Path(i));
}
        return tree;
      }
# ---------- end c_script ----------
cull_duplicates_2 = CullDuplicates(Points=flatten(c_script.A), Tolerance=0.1, CullMode=3)  # -> Points, Indices, Valence

number_slider_2 = Slider(0.06, range=0..0.1)
sphere = Sphere(Base=cull_duplicates_2.Points, Radius=Slider(100, range=0..1000))

surface_curve = SurfaceCurve(Surface=graft(sphere), Curve=curve)  # -> Curves, simplify(Points), UVPoints, Normals, Parameters, Tangents
shift_paths = ShiftPaths(Data=surface_curve.Points, Offset=-1)

# ----
# SINGLE LIEANR ELEMENT
point = Point(flatten(surface_curve.Points))

curve_closest_point = CurveClosestPoint(Point=point, Curve=reparameterize(graft(curve)))  # -> Point, Parameter, Distance
evaluate = Evaluate(Expression="x < 0.1", x=curve_closest_point.Distance)
cull_pattern = CullPattern(List=curve_closest_point.Parameter, CullPattern=evaluate)  # -> simplify(List)

shatter = Shatter(Curve=reparameterize(graft(curve)), Parameters=cull_pattern)  # -> simplify(Segments)
line = Line(StartPoint=graft(cull_duplicates_2.Points), EndPoint=shift_paths)

point_on_curve = PointOnCurve(line, parameter=0.5)
sphere_2 = Sphere(Base=point_on_curve, Radius=5)

collision_one_many = CollisionOneMany(Collider=shatter, Obstacles=flatten(sphere_2))  # -> Collision, Index
dispatch = Dispatch(List=shatter, DispatchPattern=collision_one_many.Collision)  # -> ListA, ListB

line_2 = Line(dispatch.ListB)
null_item = NullItem(Item=line_2)  # -> NullFlags, InvalidFlags, Description
cull_pattern_2 = CullPattern(List=dispatch.ListB, CullPattern=null_item.NullFlags)
divide_curve = DivideCurve(Curve=cull_pattern_2, Count=Slider(4, range=0..10), Kinks=False)  # -> Points, Tangents, Parameters
polyline = PolyLine(Vertices=divide_curve.Points, Closed=False)
clean_tree = CleanTree(RemoveNulls=True, RemoveInvalid=True, RemoveEmpty=False, Tree=polyline)
replace_nulls = ReplaceNulls(Items=line_2, Replacements=simplify(clean_tree))  # -> Items, Count

geometry = Geometry(replace_nulls.Items)

# ----
# FATTENER
number_slider_3 = Slider(0.03, range=0..0.1)
fatten = Fatten(
    Skeleton=flatten(line),
    Thickness=Slider(40, range=0..1000),
    LengthSubdivisions=0,
    EndType=Slider(0, range=0..3),
    AdjustForAngle=False)
disjoint_mesh = DisjointMesh(Mesh=fatten)  # -> graft(Meshes)

number_slider_4 = Slider(0.03, range=0..0.1)
fatten_2 = Fatten(
    Skeleton=flatten(geometry),
    Thickness=Slider(40, range=0..1000),
    LengthSubdivisions=0,
    EndType=Slider(0, range=0..3),
    AdjustForAngle=False)
disjoint_mesh_2 = DisjointMesh(Mesh=fatten_2)  # -> graft(Meshes)

weaverbird_s_catmull_clark_subdivision = WeaverbirdsCatmullClarkSubdivision(MeshCurves=disjoint_mesh_2, Level=1, SmoothNakedEdges=1)

weaverbird_s_naked_boundary = WeaverbirdsNakedBoundary(MeshClosedPolylines=disjoint_mesh)
join = JoinCurves(Curves=weaverbird_s_naked_boundary, Preserve=False)
explode = Explode(Curve=join, Recursive=True)  # -> Segments, Vertices
cull_duplicates_3 = CullDuplicates(Points=explode.Vertices, Tolerance=0.1, CullMode=3)  # -> simplify(Points), Indices, Valence
shift_paths_2 = ShiftPaths(Data=cull_duplicates_3.Points, Offset=-1)  # -> flatten(Data)

face_normals = FaceNormals(Mesh=disjoint_mesh)  # -> Centers, Normals
mesh_edges = MeshEdges(Mesh=disjoint_mesh)  # -> NakedEdges, InteriorEdges, NonManifoldEdges
vector_display = VectorDisplay(Anchor=face_normals.Centers, Vector=face_normals.Normals)

weaverbird_s_naked_boundary_2 = WeaverbirdsNakedBoundary(MeshClosedPolylines=disjoint_mesh_2)
join_2 = JoinCurves(Curves=weaverbird_s_naked_boundary_2, Preserve=False)
explode_2 = Explode(Curve=join_2, Recursive=True)  # -> Segments, Vertices
cull_duplicates_4 = CullDuplicates(Points=explode_2.Vertices, Tolerance=0.1, CullMode=3)  # -> simplify(Points), Indices, Valence

number_slider_5 = Slider(2, range=0..10)
weaverbird_s_catmull_clark_subdivision_2 = WeaverbirdsCatmullClarkSubdivision(MeshCurves=disjoint_mesh, Level=number_slider_5, SmoothNakedEdges=Slider(2, range=0..10))

# ----
# PREPARE WEFT AND WARP
panel = Panel("1")
refine = Refine(Mesh=disjoint_mesh, Level=panel)
clean = CombineClean(Meshes=refine)
md = MeshDirection(Mesh=clean)
turn = MeshTurn(Mesh=md)

deconstruct_mesh = DeconstructMesh(Mesh=disjoint_mesh_2)  # -> Vertices, Faces, Colours, Normals
closest_point = ClosestPoint(Point=cull_duplicates_4.Points, Cloud=shift_paths_2)  # -> ClosestPoint, CPIndex, Distance
shift_paths_3 = ShiftPaths(Data=cull_duplicates_4.Points, Offset=-1)
closest_point_2 = ClosestPoint(Point=simplify(shift_paths_3), Cloud=simplify(deconstruct_mesh.Vertices))  # -> ClosestPoint, CPIndex, Distance
shift_paths_4 = ShiftPaths(Data=closest_point.ClosestPoint, Offset=-1)
replace_items = ReplaceItems(List=deconstruct_mesh.Vertices, Item=shift_paths_4, Indices=closest_point_2.CPIndex, Wrap=False)
construct_mesh = ConstructMesh(Vertices=replace_items, Faces=deconstruct_mesh.Faces, Colours=deconstruct_mesh.Colours)  # -> simplify(Mesh)

boolean_toggle = BooleanToggle(True)
flip_mesh = FlipMesh(Mesh=md, VertexNormals=boolean_toggle, FaceNormals=boolean_toggle, FaceOrientation=boolean_toggle)
mesh = Mesh(flip_mesh)

boolean_toggle_2 = BooleanToggle(True)
flip_mesh_2 = FlipMesh(
    Mesh=weaverbird_s_catmull_clark_subdivision_2,
    VertexNormals=boolean_toggle_2,
    FaceNormals=boolean_toggle_2,
    FaceOrientation=boolean_toggle_2)

strips = RefineStrips(Mesh=flip_mesh_2, Level="2")

mesh_edges_2 = MeshEdges(Mesh=strips)  # -> NakedEdges, InteriorEdges, NonManifoldEdges
face_normals_2 = FaceNormals(Mesh=strips)  # -> Centers, Normals
vector_display_2 = VectorDisplay(Anchor=face_normals_2.Centers, Vector=face_normals_2.Normals)

strips_2 = RefineStrips(Mesh=mesh, Level="2")

combine_clean = CombineClean(Meshes=construct_mesh)

weaverbird_s_catmull_clark_subdivision_3 = WeaverbirdsCatmullClarkSubdivision(MeshCurves=combine_clean, Level=number_slider_5, SmoothNakedEdges=Slider(2, range=0..10))

boolean_toggle_3 = BooleanToggle(True)
flip_mesh_3 = FlipMesh(
    Mesh=weaverbird_s_catmull_clark_subdivision_3,
    VertexNormals=boolean_toggle_3,
    FaceNormals=boolean_toggle_3,
    FaceOrientation=boolean_toggle_3)

strips_3 = RefineStrips(Mesh=flip_mesh_3, Level="2")

face_normals_3 = FaceNormals(Mesh=weaverbird_s_catmull_clark_subdivision)  # -> Centers, Normals
mesh_edges_3 = MeshEdges(Mesh=strips_3)  # -> NakedEdges, InteriorEdges, NonManifoldEdges
vector_display_3 = VectorDisplay(Anchor=face_normals_3.Centers, Vector=face_normals_3.Normals)

mesh_2 = Mesh(simplify(strips))
mesh_3 = Mesh(simplify(strips))

number_slider_6 = Slider(0.03, range=0..0.1)
# KANGAROO FORM RELAXATION
fatten_3 = Fatten(
    Skeleton=flatten(line),
    Thickness=Slider(40, range=30..100),
    LengthSubdivisions=0,
    EndType=Slider(3, range=0..3),
    AdjustForAngle=False)
disjoint_mesh_3 = DisjointMesh(Mesh=fatten_3)  # -> simplify(graft(Meshes))

number_slider_7 = Slider(0, range=0..3)  # disabled
mesh_edges_4 = MeshEdges(Mesh=mesh_2)  # -> NakedEdges, InteriorEdges, NonManifoldEdges
deconstruct_mesh_2 = DeconstructMesh(Mesh=mesh_2)  # -> simplify(Vertices), Faces, Colours, Normals
warpweft = WarpWeft(Mesh=mesh_2)  # -> Warp, Weft, NakedA, NakedB
stripper = Stripper(Mesh=mesh_3)
tree_branch = TreeBranch(Tree=simplify(deconstruct_mesh_2.Vertices), Path=number_slider_7, MaintainPaths=True)  # disabled
# POLE OF Y CONNECTORS
deconstruct_mesh_3 = DeconstructMesh(Mesh=simplify(stripper))  # -> Vertices, Faces, Colours, Normals

join_3 = JoinCurves(Curves=mesh_edges_4.NakedEdges, Preserve=False)
explode_3 = Explode(Curve=join_3, Recursive=True)  # -> Segments, Vertices
end = EndPoints(Curve=explode_3.Segments)  # -> Start, End

shift_paths_5 = ShiftPaths(Data=deconstruct_mesh_3.Vertices, Offset=-1)
sort_duplicate_points = SortDuplicatePoints(Points=shift_paths_5)  # -> UniquePoints, Indices

weaverbird_s_catmull_clark_subdivision_4 = WeaverbirdsCatmullClarkSubdivision(MeshCurves=disjoint_mesh_3, Level=Slider(2, range=0..10), SmoothNakedEdges=Slider(2, range=0..10))

mesh_edges_5 = MeshEdges(Mesh=mesh_3)  # -> NakedEdges, InteriorEdges, NonManifoldEdges
c_script_2 = CSharpScript(iPoints=sort_duplicate_points.UniquePoints, iVertex=shift_paths_5)  # -> out, A; inputs iPoints: tree of Point3d, iVertex: tree of Point3d
# ---------- c_script_2: C# ----------
    //
    for(int i = 0; i < iPoints.BranchCount; i++){
      List<Point3d> extremePoints = new List<Point3d>();
      
      for(int j = 0; j < iPoints.Branch(i).Count; j++){
        Point3d point1 = iPoints.Branch(i)[j];
        List<Point3d> points = new List<Point3d>();
        int count = 0;
        

        for(int k = 0; k < iVertex.Branch(i).Count; k++){
          double dist = point1.DistanceTo(iVertex.Branch(i)[k]);
          
          if(dist < 0.0001){
            //points.Add(iVertex.Branch(i)[k]);
            count += 1;}
          
        }
        if(count > 2){
          extremePoints.Add(point1);
        }
      }
      allPoints.Add(extremePoints);
    }


    A = ListOfListsToTree(allPoints);
# ---------- c_script_2: C# additional code ----------
  List<List<Point3d>> allPoints = new List<List<Point3d>>();

  static Grasshopper.DataTree<T> ListOfListsToTree<T > (List < List < T >> s){
  Grasshopper.DataTree<T> tree = new DataTree<T>();
  for(int i = 0;i < s.Count; i++){
  tree.AddRange(s[i], new GH_Path(i));
}
      return tree;
    }
# ---------- end c_script_2 ----------
geometry_2 = Geometry(warpweft.Warp)
geometry_3 = Geometry(warpweft.Weft)
cluster = Cluster(point=c_script_2.A, geometry=[mesh_edges_5.NakedEdges, mesh_edges_5.InteriorEdges, mesh_edges_5.NonManifoldEdges])  # -> valley_2, peak_2

length = Length(Curve=geometry_2)
multiplication = Multiplication(A=length, B=Slider(0, range=0..1))

length_2 = Length(Curve=geometry_2)
multiplication_2 = Multiplication(A=length_2, B=Slider(0.944, range=0..1))

geometry_4 = Geometry(cluster.peak_2)
length_3 = Length(Curve=geometry_3)
mesh_closest_point = MeshClosestPoint(Point=geometry_4, Mesh=simplify(weaverbird_s_catmull_clark_subdivision_4))  # -> Point, Index, Parameter
multiplication_3 = Multiplication(A=length_3, B=Slider(0.521, range=0..1))

custom_preview = CustomPreview(Geometry=weaverbird_s_catmull_clark_subdivision_4, Material=ColourSwatch(SwatchColor=RGBA(255, 255, 255, 95)))

solidpointcollide = SolidPointCollide(
    Points=deconstruct_mesh_2.Vertices,
    Solid=simplify(flatten(weaverbird_s_catmull_clark_subdivision_4)),
    Interior=False,
    Unidirectional=True,
    Strength=Slider(1000, range=0..1000))
pressure = Pressure(M=mesh_2, Strength=Slider(0.01, range=0..0.1))
clamplength = ClampLength(Line=geometry_2, LowerLimit=multiplication, UpperLimit=multiplication_2, Strength=Slider(1, range=0.1..20))
length_line = LengthLine(Line=geometry_3, Length=multiplication_3, Strength=Slider(9.7, range=0.5..20))
anchor = Anchor(Point=simplify(end.Start), Strength=Slider(201000, range=0..201000))
equallength = EqualLength(Line=simplify(explode_3.Segments), Strength=Slider(97, range=0..1000))
anchor_2 = Anchor(Point=geometry_4, Target=mesh_closest_point.Point, Strength=Slider(1000, range=0..1000))
planarize = Planarize(M=mesh_2, Strength=Slider(384, range=0..1000))
show = Show(G=mesh_2)
entwine = Entwine(
    Branch00=show,
    Branch01=flatten([pressure, anchor, planarize, equallength, clamplength, length_line, solidpointcollide, anchor_2]),
    FlattenInputs=True)
solver = Solver(GoalObjects=entwine, Reset=Button(), Threshold=1e-15, Tolerance=0.01, On=Toggle(False))  # -> I, V, O
bang = ExplodeTree(Data=solver.O)  # -> Branch0, Branch1
mesh_4 = Mesh(bang.Branch0)
mesh_edges_6 = MeshEdges(Mesh=mesh_4)  # -> NakedEdges, InteriorEdges, NonManifoldEdges

# ----
# DIVIDE INTO STRIPS
dam = DataDam(DataA=graft(mesh_4), BufferDelay=10000000, BufferMode=0)  # -> flatten(DataA)
stripper_2 = Stripper(Mesh=dam)
unroller = Unroller(Strip=stripper_2, Unroll=Slider(0, range=0..1))  # -> graft(Unrolled)
mesh_edges_7 = MeshEdges(Mesh=unroller)  # -> NakedEdges, InteriorEdges, NonManifoldEdges
dam_2 = DataDam(DataA=unroller, BufferDelay=10000000, BufferMode=0)

weaverbird_s_naked_boundary_3 = WeaverbirdsNakedBoundary(MeshClosedPolylines=unroller)
mesh_5 = Mesh(simplify(dam_2))  # disabled
# Splitting top & bottom face
shift_paths_6 = ShiftPaths(Data=mesh_5, Offset=-1)  # disabled
mesh_join = MeshJoin(Meshes=shift_paths_6)  # disabled

mesh_area = MeshArea(Mesh=shift_paths_6)  # -> Area, Centroid; disabled
mesh_closest_point_2 = MeshClosestPoint(Point=mesh_area.Centroid, Mesh=shift_paths_6)  # -> Point, Index, Parameter; disabled

cluster_2 = Cluster_2(M=mesh_join)  # disabled
weaverbird_s_naked_boundary_4 = WeaverbirdsNakedBoundary(MeshClosedPolylines=shift_paths_6)  # disabled
mesh_edges_8 = MeshEdges(Mesh=shift_paths_6)  # -> NakedEdges, InteriorEdges, NonManifoldEdges; disabled

tree_statistics = TreeStatistics(Tree=mesh_closest_point_2.Point)  # -> Paths, Length, Count; disabled
series = Series(Start=0, Step=1, Count=tree_statistics.Count)  # disabled
duplicate_data = DuplicateData(Data=graft(series), Number=2, Order=True)  # -> simplify(Data); disabled

tree_branch_2 = TreeBranch(Tree=mesh_closest_point_2.Point, Path=graft(duplicate_data), MaintainPaths=False)  # disabled

line_3 = Line(StartPoint=graft(cluster_2), EndPoint=tree_branch_2)  # -> simplify(Line); disabled
cluster_3 = Cluster(point=cluster_2, geometry=simplify([mesh_edges_8.NakedEdges, mesh_edges_8.InteriorEdges, mesh_edges_8.NonManifoldEdges]))  # -> valley_2, peak_2; disabled
tree_branch_3 = TreeBranch(Tree=shift_paths_6, Path=graft(duplicate_data), MaintainPaths=False)  # disabled
length_4 = Length(Curve=line_3)  # disabled

number_slider_8 = Slider(2, range=0..10)  # disabled
list_length = ListLength(List=length_4)  # disabled
division = Division(A=list_length, B=number_slider_8)  # disabled

geometry_5 = Geometry(cluster_3.valley_2)  # disabled
sphere_3 = Sphere(Base=geometry_5, Radius=1)  # disabled

geometry_6 = Geometry(cluster_3.peak_2)  # disabled
sphere_4 = Sphere(Base=geometry_6, Radius=1)  # disabled

sort_list = SortList(Keys=length_4, ValuesValuesA=line_3, ValuesA=tree_branch_3)  # -> Keys, ValuesValuesA, ValuesA; disabled
mesh_6 = Mesh(strips_3)  # disabled
mesh_edges_9 = MeshEdges(Mesh=mesh_6)  # -> NakedEdges, InteriorEdges, NonManifoldEdges; disabled
nakedvertices = NakedVertices(Mesh=mesh_6)  # -> ClothedIndex, NakedIndex, ClothedPts, NakedPts; disabled
geometry_7 = Geometry(simplify(nakedvertices.NakedPts))  # disabled

# ----
# ALL LINES
curve_2 = Curve(curve)  # disabled
number_slider_9 = Slider(100, range=0..100)  # disabled
number_slider_10 = Slider(30, range=0..1000)  # disabled
number_slider_11 = Slider(0.03, range=0..0.1)  # disabled
number_slider_12 = Slider(0, range=0..100)  # disabled

number_slider_13 = Slider(0.1, range=0..0.1)  # disabled
divide_length = DivideLength(Curve=curve_2, Length=number_slider_9)  # -> Points, Tangents, Parameters; disabled
end_points = EndPoints(Curve=curve_2)  # -> Start, End; disabled
merge = Merge(Data1=graft(end_points.Start), Data2=divide_length.Points, Data3=graft(end_points.End))  # disabled
sort_duplicate_points_2 = SortDuplicatePoints(Points=merge)  # -> UniquePoints, Indices; disabled

sort_along_curve = SortAlongCurve(Points=sort_duplicate_points_2.UniquePoints, Curve=graft(curve_2))  # -> Points, Indices; disabled
polyline_2 = PolyLine(Vertices=sort_along_curve.Points, Closed=False)  # disabled
fatten_4 = Fatten(
    Skeleton=flatten(polyline_2),
    Thickness=number_slider_10,
    LengthSubdivisions=0,
    EndType=number_slider_12,
    AdjustForAngle=False)  # disabled
weaverbird_s_catmull_clark_subdivision_5 = WeaverbirdsCatmullClarkSubdivision(MeshCurves=fatten_4, Level=1, SmoothNakedEdges=1)  # disabled
weaverbird_s_loop_subdivision = WeaverbirdsLoopSubdivision(MeshCurves=fatten_4, Level=1, SmoothNakedEdges=1)  # disabled
mesh_edges_10 = MeshEdges(Mesh=fatten_4)  # -> NakedEdges, InteriorEdges, NonManifoldEdges; disabled

split_list = SplitList(List=simplify(sort_list.ValuesA), Index=division)  # -> simplify(ListA), ListB; disabled
geometry_8 = Geometry(split_list.ListA)  # disabled

split_list_2 = SplitList(List=sort_list.ValuesValuesA, Index=division)  # -> simplify(ListA), ListB; disabled
geometry_9 = Geometry(split_list_2.ListA)  # disabled
collision_one_many_2 = CollisionOneMany(Collider=simplify(flatten(geometry_9)), Obstacles=graft(sphere_4))  # -> simplify(Collision), Index; disabled
dispatch_2 = Dispatch(List=flatten(geometry_8), DispatchPattern=simplify(collision_one_many_2.Collision))  # -> ListA, ListB; disabled
geometry_10 = Geometry(dispatch_2.ListA)  # disabled
mesh_join_2 = MeshJoin(Meshes=geometry_10)  # disabled
mesh_edges_11 = MeshEdges(Mesh=mesh_join_2)  # -> NakedEdges, InteriorEdges, NonManifoldEdges; disabled

meshcorners = MeshCorners(Mesh=mesh_join_2, Angle=2.35619449)  # disabled

collision_one_many_3 = CollisionOneMany(Collider=simplify(flatten(geometry_9)), Obstacles=graft(sphere_3))  # -> simplify(Collision), Index; disabled
dispatch_3 = Dispatch(List=flatten(geometry_8), DispatchPattern=simplify(collision_one_many_3.Collision))  # -> ListA, ListB; disabled
geometry_11 = Geometry(dispatch_3.ListA)  # disabled
mesh_join_3 = MeshJoin(Meshes=geometry_11)  # disabled
mesh_edges_12 = MeshEdges(Mesh=mesh_join_3)  # -> NakedEdges, InteriorEdges, NonManifoldEdges; disabled

meshcorners_2 = MeshCorners(Mesh=mesh_join_3, Angle=2.35619449)  # disabled
merge_2 = Merge(Data1=meshcorners_2, Data2=meshcorners)  # disabled
cull_duplicates_5 = CullDuplicates(Points=merge_2, Tolerance=0.1, CullMode=3)  # -> Points, Indices, Valence; disabled
closest_point_3 = ClosestPoint(Point=cull_duplicates_5.Points)  # -> ClosestPoint, CPIndex, Distance; disabled
merge_3 = Merge(Data1=mesh_join_3, Data2=mesh_join_2)  # disabled

colour_swatch = ColourSwatch(SwatchColor=RGBA(0, 255, 255, 206))  # disabled
custom_preview_2 = CustomPreview(
    Geometry=[mesh_join_3, mesh_edges_12.NakedEdges, mesh_edges_12.InteriorEdges, mesh_edges_12.NonManifoldEdges],
    Material=colour_swatch)  # disabled

colour_swatch_2 = ColourSwatch(SwatchColor=RGBA(255, 0, 255, 94))  # disabled
custom_preview_3 = CustomPreview(
    Geometry=[mesh_join_2, mesh_edges_11.NakedEdges, mesh_edges_11.InteriorEdges, mesh_edges_11.NonManifoldEdges],
    Material=colour_swatch_2)  # disabled

# ==== cluster Cluster
point = ClusterInput()
geometry = ClusterInput()
point_2 = Point(point)
geometry_2 = Geometry(geometry)

sphere = Sphere(Base=graft(point_2), Radius=Slider(1, range=0..1))

collision_one_many = CollisionOneMany(Collider=geometry_2, Obstacles=point_2)  # -> Collision, Index
cull_pattern = CullPattern(List=geometry_2, CullPattern=collision_one_many.Collision)  # -> simplify(List)

collision_one_many_2 = CollisionOneMany(Collider=flatten(cull_pattern), Obstacles=sphere)  # -> Collision, Index
cull_pattern_2 = CullPattern(List=flatten(cull_pattern), CullPattern=collision_one_many_2.Collision)

length = Length(Curve=cull_pattern_2)
mass_addition = MassAddition(Input=length)  # -> Result, PartialResults
shift_paths = ShiftPaths(Data=mass_addition.Result, Offset=-1)
sort_list = SortList(Keys=shift_paths, ValuesValuesA=point_2)  # -> Keys, ValuesValuesA
list_item = ListItem(List=sort_list.ValuesValuesA, Index=0, Wrap=True)  # -> Item, Item1
valley = Data(list_item.Item)
peak = Data(list_item.Item1)
valley_2 = ClusterOutput(valley)
peak_2 = ClusterOutput(peak)

# ==== cluster Cluster_2
M = ClusterInput()
stripper = Stripper(Mesh=M)

# ----
# POLE OF Y CONNECTORS
deconstruct_mesh = DeconstructMesh(Mesh=simplify(stripper))  # -> Vertices, Faces, Colours, Normals
shift_paths = ShiftPaths(Data=deconstruct_mesh.Vertices, Offset=-1)
sort_duplicate_points = SortDuplicatePoints(Points=shift_paths)  # -> UniquePoints, Indices
mesh_sphere = MeshSphere(Base=sort_duplicate_points.UniquePoints, Radius=Slider(0.1, range=0..0.5), UCount=10, VCount=20)
mesh_inclusion = MeshInclusion(Mesh=graft(mesh_sphere), Point=flatten(shift_paths), Strict=False)
cull_pattern = CullPattern(List=flatten(shift_paths), CullPattern=mesh_inclusion)
boolean_toggle = BooleanToggle(True)
clean_tree = CleanTree(RemoveNulls=boolean_toggle, RemoveInvalid=boolean_toggle, RemoveEmpty=boolean_toggle, Tree=cull_pattern)  # -> simplify(Tree)
param_viewer = ParamViewer(clean_tree)

list_length = ListLength(List=clean_tree)
evaluate = Evaluate(Expression="x>2", x=list_length)

dispatch = Dispatch(List=flatten(param_viewer), DispatchPattern=flatten(evaluate))  # -> ListA, ListB
tree_branch = TreeBranch(Tree=clean_tree, Path=dispatch.ListA, MaintainPaths=True)
shift_paths_2 = ShiftPaths(Data=tree_branch, Offset=-1)
cull_duplicates = CullDuplicates(Points=shift_paths_2, Tolerance=0.1, CullMode=3)  # -> simplify(Points), Indices, Valence

panel = Panel(list_length)
points = ClusterOutput(cull_duplicates.Points)
