# Grasshopper definition 200625_Table_V4_2_Cutting Pattern.gh (Grasshopper 1.0.7)
# plug-ins: MeshEdit Components, Pufferfish, Fattener, LunchBoxML, EleFront, LunchBox, Weaverbird, Kangaroo2 Components

curve = Curve([<curve referenced from the Rhino model> x21])
curve_2 = Curve(curve)

# ----
# Y JUNCTION LINES
discontinuity = Discontinuity(Curve=curve, Level=1)  # -> Points, Parameters
number_slider = Slider(0.05, range=0..0.1)
create_rtree = CreateRTree(InputGeometry=flatten(discontinuity.Points))
cull_duplicates = CullDuplicates(Points=flatten(discontinuity.Points), Tolerance=0.1, CullMode=3)  # -> Points, Indices, Valence
rtree_points_in_range = RTreePointsInRange(SearchPoints=cull_duplicates.Points, SearchDistance=Slider(50, range=0..100), RTree=create_rtree)  # -> simplify(PointsWithinRange), IndicesWithinRange

c_script = CSharpScript(x=rtree_points_in_range.PointsWithinRange)  # -> out, A; inputs x: tree of Point3d
# ---------- c_script: C# ----------
    List<List<Point3d>> points = new List<List<Point3d>>();
    
    for(int i = 0; i < x.BranchCount; i++){
      if(x.Branch(i).Count > 2){
        points.Add(x.Branch(i));
      }
    }

    A = ListOfListsToTree(points);
# ---------- c_script: C# additional code ----------
  


  static Grasshopper.DataTree<T> ListOfListsToTree<T > (List < List < T >> s){
  Grasshopper.DataTree<T> tree = new DataTree<T>();
  for(int i = 0;i < s.Count; i++){
  tree.AddRange(s[i], new GH_Path(i));
}
        return tree;
      }
# ---------- end c_script ----------
cull_duplicates_2 = CullDuplicates(Points=flatten(c_script.A), Tolerance=0.1, CullMode=3)  # -> Points, Indices, Valence

number_slider_2 = Slider(0.06, range=0..0.1)
sphere = Sphere(Base=cull_duplicates_2.Points, Radius=Slider(100, range=0..1000))

surface_curve = SurfaceCurve(Surface=graft(sphere), Curve=curve)  # -> Curves, simplify(Points), UVPoints, Normals, Parameters, Tangents
shift_paths = ShiftPaths(Data=surface_curve.Points, Offset=-1)

# ----
# SINGLE LIEANR ELEMENT
point = Point(flatten(surface_curve.Points))

curve_closest_point = CurveClosestPoint(Point=point, Curve=reparameterize(graft(curve)))  # -> Point, Parameter, Distance
evaluate = Evaluate(Expression="x < 0.1", x=curve_closest_point.Distance)
cull_pattern = CullPattern(List=curve_closest_point.Parameter, CullPattern=evaluate)  # -> simplify(List)

shatter = Shatter(Curve=reparameterize(graft(curve)), Parameters=cull_pattern)  # -> simplify(Segments)
line = Line(StartPoint=graft(cull_duplicates_2.Points), EndPoint=shift_paths)

point_on_curve = PointOnCurve(line, parameter=0.5)
sphere_2 = Sphere(Base=point_on_curve, Radius=1)

collision_one_many = CollisionOneMany(Collider=shatter, Obstacles=flatten(sphere_2))  # -> Collision, Index
dispatch = Dispatch(List=shatter, DispatchPattern=collision_one_many.Collision)  # -> ListA, ListB

join_curves = JoinCurves(Curves=dispatch.ListB, Preserve=False)
line_2 = Line(flatten(join_curves))
null_item = NullItem(Item=line_2)  # -> NullFlags, InvalidFlags, Description
dispatch_2 = Dispatch(List=flatten(join_curves), DispatchPattern=null_item.NullFlags)  # -> ListA, ListB

divide_curve = DivideCurve(Curve=dispatch_2.ListA, Count=Slider(7, range=0..10), Kinks=False)  # -> Points, Tangents, Parameters

# ----
# Diameter of channels
diameter = Slider(40, range=0..1000)

polyline = PolyLine(Vertices=divide_curve.Points, Closed=False)
geometry = Geometry(flatten([polyline, dispatch_2.ListB]))

fatten = Fatten(
    Skeleton=flatten(geometry),
    Thickness=diameter,
    LengthSubdivisions=0,
    EndType=Slider(0, range=0..3),
    AdjustForAngle=False)
disjoint_mesh = DisjointMesh(Mesh=fatten)  # -> graft(Meshes)

# ----
# FATTENER
number_slider_3 = Slider(0, range=0..3)
fatten_2 = Fatten(Skeleton=flatten(line), Thickness=diameter, LengthSubdivisions=0, EndType=number_slider_3, AdjustForAngle=False)
disjoint_mesh_2 = DisjointMesh(Mesh=fatten_2)  # -> graft(Meshes)

weaverbird_s_catmull_clark_subdivision = WeaverbirdsCatmullClarkSubdivision(MeshCurves=disjoint_mesh, Level=1, SmoothNakedEdges=1)

weaverbird_s_naked_boundary = WeaverbirdsNakedBoundary(MeshClosedPolylines=simplify(disjoint_mesh_2))
join = JoinCurves(Curves=weaverbird_s_naked_boundary, Preserve=False)
explode = Explode(Curve=join, Recursive=True)  # -> Segments, Vertices
cull_duplicates_3 = CullDuplicates(Points=explode.Vertices, Tolerance=0.1, CullMode=3)  # -> simplify(Points), Indices, Valence
shift_paths_2 = ShiftPaths(Data=cull_duplicates_3.Points, Offset=-1)  # -> flatten(Data)

weaverbird_s_naked_boundary_2 = WeaverbirdsNakedBoundary(MeshClosedPolylines=simplify(disjoint_mesh))
join_2 = JoinCurves(Curves=weaverbird_s_naked_boundary_2, Preserve=False)
explode_2 = Explode(Curve=join_2, Recursive=True)  # -> Segments, Vertices
cull_duplicates_4 = CullDuplicates(Points=explode_2.Vertices, Tolerance=0.1, CullMode=3)  # -> simplify(Points), Indices, Valence

face_normals = FaceNormals(Mesh=disjoint_mesh_2)  # -> Centers, Normals
mesh_edges = MeshEdges(Mesh=disjoint_mesh_2)  # -> NakedEdges, InteriorEdges, NonManifoldEdges
vector_display = VectorDisplay(Anchor=face_normals.Centers, Vector=face_normals.Normals)

number_slider_4 = Slider(2, range=0..10)
weaverbird_s_catmull_clark_subdivision_2 = WeaverbirdsCatmullClarkSubdivision(MeshCurves=disjoint_mesh_2, Level=number_slider_4, SmoothNakedEdges=Slider(2, range=0..10))

# ----
# PREPARE WEFT AND WARP
panel = Panel("1")
refine = Refine(Mesh=disjoint_mesh_2, Level=panel)
clean = CombineClean(Meshes=refine)
md = MeshDirection(Mesh=clean)
turn = MeshTurn(Mesh=md)

deconstruct_mesh = DeconstructMesh(Mesh=disjoint_mesh)  # -> Vertices, Faces, Colours, Normals
closest_point = ClosestPoint(Point=cull_duplicates_4.Points, Cloud=shift_paths_2)  # -> ClosestPoint, CPIndex, Distance
shift_paths_3 = ShiftPaths(Data=cull_duplicates_4.Points, Offset=-1)
closest_point_2 = ClosestPoint(Point=simplify(shift_paths_3), Cloud=simplify(deconstruct_mesh.Vertices))  # -> ClosestPoint, CPIndex, Distance
shift_paths_4 = ShiftPaths(Data=closest_point.ClosestPoint, Offset=-1)
replace_items = ReplaceItems(List=deconstruct_mesh.Vertices, Item=shift_paths_4, Indices=closest_point_2.CPIndex, Wrap=False)
construct_mesh = ConstructMesh(Vertices=replace_items, Faces=deconstruct_mesh.Faces, Colours=deconstruct_mesh.Colours)

weaverbird_s_catmull_clark_subdivision_3 = WeaverbirdsCatmullClarkSubdivision(MeshCurves=construct_mesh, Level=number_slider_4, SmoothNakedEdges=Slider(2, range=0..10))

boolean_toggle = BooleanToggle(True)
flip_mesh = FlipMesh(Mesh=md, VertexNormals=boolean_toggle, FaceNormals=boolean_toggle, FaceOrientation=boolean_toggle)
mesh = Mesh(flip_mesh)

boolean_toggle_2 = BooleanToggle(True)
flip_mesh_2 = FlipMesh(
    Mesh=weaverbird_s_catmull_clark_subdivision_3,
    VertexNormals=boolean_toggle_2,
    FaceNormals=boolean_toggle_2,
    FaceOrientation=boolean_toggle_2)  # -> simplify(Result)

boolean_toggle_3 = BooleanToggle(True)
flip_mesh_3 = FlipMesh(
    Mesh=weaverbird_s_catmull_clark_subdivision_2,
    VertexNormals=boolean_toggle_3,
    FaceNormals=boolean_toggle_3,
    FaceOrientation=boolean_toggle_3)

strips = RefineStrips(Mesh=flip_mesh_2, Level="2")

custom_preview = CustomPreview(Geometry=strips, Material=ColourSwatch(SwatchColor=RGB(84, 84, 84)))

face_normals_2 = FaceNormals(Mesh=weaverbird_s_catmull_clark_subdivision)  # -> Centers, Normals
mesh_edges_2 = MeshEdges(Mesh=strips)  # -> NakedEdges, InteriorEdges, NonManifoldEdges
vector_display_2 = VectorDisplay(Anchor=face_normals_2.Centers, Vector=face_normals_2.Normals)

strips_2 = RefineStrips(Mesh=flip_mesh_3, Level="2")

mesh_edges_3 = MeshEdges(Mesh=strips_2)  # -> NakedEdges, InteriorEdges, NonManifoldEdges
face_normals_3 = FaceNormals(Mesh=strips_2)  # -> Centers, Normals
vector_display_3 = VectorDisplay(Anchor=face_normals_3.Centers, Vector=face_normals_3.Normals)

strips_3 = RefineStrips(Mesh=mesh, Level="2")

mesh_2 = Mesh(simplify(strips_2))  # disabled
mesh_3 = Mesh(simplify(strips_2))  # disabled

number_slider_5 = Slider(0.03, range=0..0.1)  # disabled
number_slider_6 = Slider(35, range=30..100)  # disabled
number_slider_7 = Slider(3, range=0..3)  # disabled
# KANGAROO FORM RELAXATION
fatten_3 = Fatten(Skeleton=flatten(line), Thickness=number_slider_6, LengthSubdivisions=0, EndType=number_slider_7, AdjustForAngle=False)  # disabled
disjoint_mesh_3 = DisjointMesh(Mesh=fatten_3)  # -> simplify(graft(Meshes)); disabled

number_slider_8 = Slider(0, range=0..3)  # disabled
mesh_edges_4 = MeshEdges(Mesh=mesh_2)  # -> NakedEdges, InteriorEdges, NonManifoldEdges; disabled
deconstruct_mesh_2 = DeconstructMesh(Mesh=mesh_2)  # -> simplify(Vertices), Faces, Colours, Normals; disabled
warpweft = WarpWeft(Mesh=mesh_2)  # -> Warp, Weft, NakedA, NakedB; disabled
tree_branch = TreeBranch(Tree=simplify(deconstruct_mesh_2.Vertices), Path=number_slider_8, MaintainPaths=True)  # disabled

join_3 = JoinCurves(Curves=mesh_edges_4.NakedEdges, Preserve=False)  # disabled
explode_3 = Explode(Curve=join_3, Recursive=True)  # -> Segments, Vertices; disabled
end = EndPoints(Curve=explode_3.Segments)  # -> Start, End; disabled

number_slider_9 = Slider(2, range=0..10)  # disabled
number_slider_10 = Slider(2, range=0..10)  # disabled
weaverbird_s_catmull_clark_subdivision_4 = WeaverbirdsCatmullClarkSubdivision(MeshCurves=disjoint_mesh_3, Level=number_slider_9, SmoothNakedEdges=number_slider_10)  # disabled

mesh_edges_5 = MeshEdges(Mesh=mesh_3)  # -> NakedEdges, InteriorEdges, NonManifoldEdges; disabled
# FIND PEAK AND VALLEY
# OF Y CONNECTOR
cluster = Cluster(M=mesh_3)  # disabled
geometry_2 = Geometry(warpweft.Warp)  # disabled
geometry_3 = Geometry(warpweft.Weft)  # disabled
cluster_2 = Cluster_2(point=cluster, geometry=[mesh_edges_5.NakedEdges, mesh_edges_5.InteriorEdges, mesh_edges_5.NonManifoldEdges])  # -> valley_2, peak_2; disabled

number_slider_11 = Slider(0, range=0..1)  # disabled
length = Length(Curve=geometry_2)  # disabled
multiplication = Multiplication(A=length, B=number_slider_11)  # disabled

number_slider_12 = Slider(0.944, range=0..1)  # disabled
length_2 = Length(Curve=geometry_2)  # disabled
multiplication_2 = Multiplication(A=length_2, B=number_slider_12)  # disabled

list_item = ListItem(List=cluster_2.peak_2, Index=0, Wrap=True)  # disabled
number_slider_13 = Slider(0.521, range=0..1)  # disabled
geometry_4 = Geometry(cluster_2.peak_2)  # disabled
number_slider_14 = Slider(9.7, range=0.5..20)  # disabled
length_3 = Length(Curve=geometry_3)  # disabled
number_slider_15 = Slider(1, range=0.1..20)  # disabled
number_slider_16 = Slider(1000, range=0..1000)  # disabled
number_slider_17 = Slider(0.01, range=0..0.1)  # disabled
number_slider_18 = Slider(1000, range=0..1000)  # disabled
number_slider_19 = Slider(201000, range=0..201000)  # disabled
number_slider_20 = Slider(97, range=0..1000)  # disabled
mesh_closest_point = MeshClosestPoint(Point=geometry_4, Mesh=simplify(weaverbird_s_catmull_clark_subdivision_4))  # -> Point, Index, Parameter; disabled
number_slider_21 = Slider(384, range=0..1000)  # disabled
multiplication_3 = Multiplication(A=length_3, B=number_slider_13)  # disabled

colour_swatch = ColourSwatch(SwatchColor=RGBA(255, 255, 255, 95))  # disabled
custom_preview_2 = CustomPreview(Geometry=weaverbird_s_catmull_clark_subdivision_4, Material=colour_swatch)  # disabled

solidpointcollide = SolidPointCollide(
    Points=deconstruct_mesh_2.Vertices,
    Solid=simplify(weaverbird_s_catmull_clark_subdivision_4),
    Interior=False,
    Unidirectional=True,
    Strength=number_slider_16)  # disabled
pressure = Pressure(M=mesh_2, Strength=number_slider_17)  # disabled
clamplength = ClampLength(Line=geometry_2, LowerLimit=multiplication, UpperLimit=multiplication_2, Strength=number_slider_15)  # disabled
length_line = LengthLine(Line=geometry_3, Length=multiplication_3, Strength=number_slider_14)  # disabled
anchor = Anchor(Point=simplify(end.Start), Strength=number_slider_19)  # disabled
equallength = EqualLength(Line=simplify(explode_3.Segments), Strength=number_slider_20)  # disabled
anchor_2 = Anchor(Point=geometry_4, Target=mesh_closest_point.Point, Strength=number_slider_18)  # disabled
planarize = Planarize(M=mesh_2, Strength=number_slider_21)  # disabled
show = Show(G=mesh_2)  # disabled
boolean_toggle_4 = BooleanToggle(False)  # disabled
button = Button()  # disabled
entwine = Entwine(
    Branch00=show,
    Branch01=flatten([pressure, anchor, planarize, equallength, clamplength, length_line, solidpointcollide, anchor_2]),
    FlattenInputs=True)  # disabled
solver = Solver(GoalObjects=entwine, Reset=button, Threshold=1e-15, Tolerance=0.01, On=boolean_toggle_4)  # -> I, V, O; disabled
bang = ExplodeTree(Data=solver.O)  # -> Branch0, Branch1; disabled
mesh_4 = Mesh(bang.Branch0)  # disabled
mesh_edges_6 = MeshEdges(Mesh=mesh_4)  # -> NakedEdges, InteriorEdges, NonManifoldEdges

# ----
# DIVIDE INTO STRIPS
dam = DataDam(DataA=graft(mesh_4), BufferDelay=10000000, BufferMode=0)  # -> flatten(DataA)
stripper = Stripper(Mesh=dam)
unroller = Unroller(Strip=stripper, Unroll=Slider(0, range=0..1))  # -> graft(Unrolled)
weaverbird_s_naked_boundary_3 = WeaverbirdsNakedBoundary(MeshClosedPolylines=unroller)
mesh_edges_7 = MeshEdges(Mesh=unroller)  # -> NakedEdges, InteriorEdges, NonManifoldEdges
dam_2 = DataDam(DataA=unroller, BufferDelay=10000000, BufferMode=0)  # -> simplify(DataA)

simplify_tree = SimplifyTree(Tree=line, Front=False)
end_points = EndPoints(Curve=simplify_tree)  # -> Start, End
point_2 = Point([end_points.Start, end_points.End])
cull_duplicates_5 = CullDuplicates(Points=point_2, Tolerance=0.1, CullMode=3)  # -> Points, Indices, Valence
bounding_box = BoundingBox(Content=cull_duplicates_5.Points, Plane=PlaneXY(0, 0, 0), UnionBox=True)  # -> Box, Box_2

shift_paths_5 = ShiftPaths(Data=dam_2, Offset=-1)
tree_statistics = TreeStatistics(Tree=shift_paths_5)  # -> Paths, Length, Count

volume = Volume(Geometry=bounding_box.Box)  # -> flatten(Volume), Centroid
c_script_2 = CSharpScript(x=volume.Volume)  # -> out, A; inputs x: list of Double
# ---------- c_script_2: C# ----------
    List<int> types = new List<int>();
    
    for(int i = 0; i < x.Count; i++){
      if(x[i] < 2){
        types.Add(0);
      }
      else types.Add(1);
      
    }
    
    A = types;
# ---------- end c_script_2 ----------

dispatch_3 = Dispatch(List=tree_statistics.Paths, DispatchPattern=c_script_2.A)  # -> ListA, ListB

tree_branch_2 = TreeBranch(Tree=shift_paths_5, Path=dispatch_3.ListB, MaintainPaths=True)
graft_tree = GraftTree(Tree=tree_branch_2, IncludeEmptyLists=True, IncludeNullItems=True)

tree_branch_3 = TreeBranch(Tree=shift_paths_5, Path=dispatch_3.ListA, MaintainPaths=True)
graft_tree_2 = GraftTree(Tree=tree_branch_3, IncludeEmptyLists=True, IncludeNullItems=True)

dispatch_4 = Dispatch(List=mesh_4, DispatchPattern=c_script_2.A)  # -> ListA, ListB
mesh_5 = Mesh(simplify(graft_tree_2))
mesh_6 = Mesh(simplify(graft_tree))
mesh_7 = Mesh(dispatch_4.ListA)
deconstruct_mesh_3 = DeconstructMesh(Mesh=graft(mesh_7))  # -> Vertices, Faces, Colours, Normals
# TABS FOR STRAIGHT ELEMENTS
mesh_8 = Mesh(strips)
deconstruct_mesh_4 = DeconstructMesh(Mesh=simplify(graft(mesh_8)))  # -> Vertices, Faces, Colours, Normals
warpweft_2 = WarpWeft(Mesh=simplify(mesh_8))  # -> Warp, Weft, NakedA, NakedB
join_curves_2 = JoinCurves(Curves=warpweft_2.Weft, Preserve=False)  # -> simplify(Curves)
mesh_9 = Mesh([<mesh referenced from the Rhino model> x3])  # disabled
mesh_area = MeshArea(Mesh=mesh_9)  # -> Area, Centroid; disabled
lng = ListLength(List=mesh_9)  # disabled
toggle = BooleanToggle(False)  # disabled
id = Guid(mesh_9)  # disabled
toggle_2 = BooleanToggle(False)  # disabled
button_2 = Button()  # disabled
series = Series(Start=0, Step=1, Count=lng)  # disabled
python = PythonScript(ids=id, squish=toggle_2)  # -> out, squishedObjs; inputs ids: list, squish: Boolean; disabled
# ---------- python: Python ----------
import rhinoscriptsyntax as rs
import scriptcontext as sc
import Rhino

if squish:
    sc.doc = Rhino.RhinoDoc.ActiveDoc
    rs.EnableRedraw(False)
    squishedIdsMoved = []
    squishedObjs = []
    echo = False
    for i,id in enumerate(ids):
        rs.Command("_-Squish _SelId %s _PreserveBoundary = Yes _ SplitSeams=No _Decorate=Yes _Enter _Enter" % id, echo)
        squishedId = rs.FirstObject()
        squishedIdMoved = rs.MoveObject(squishedId, [i*500,0,0])
        squishedIdsMoved.append(squishedIdMoved)
        squishedObj = sc.doc.Objects.Find(squishedIdMoved).Geometry
        squishedObjs.append(squishedObj)
    rs.DeleteObjects(squishedIdsMoved)
    rs.EnableRedraw(True)
    sc.doc = ghdoc
# ---------- end python ----------
int = Integer(series)  # disabled
python_2 = PythonScript(geo=id, squish=button_2)  # -> out, a; inputs squish: Boolean; disabled
# ---------- python_2: Python ----------
import rhinoscriptsyntax as rs

if squish:
    rs.Command("_-Squish _SelId %s _Enter _Enter" % geo)
# ---------- end python_2 ----------
tag = TextTag(Location=mesh_area.Centroid, Text=int)  # disabled

# ----
# ALL LINES
curve_3 = Curve(curve_2)

number_slider_22 = Slider(0.1, range=0..0.1)
divide_length = DivideLength(Curve=curve_3, Length=Slider(100, range=0..100))  # -> Points, Tangents, Parameters
end_points_2 = EndPoints(Curve=curve_3)  # -> Start, End
merge = Merge(Data1=graft(end_points_2.Start), Data2=divide_length.Points, Data3=graft(end_points_2.End))
sort_duplicate_points = SortDuplicatePoints(Points=merge)  # -> UniquePoints, Indices

sort_along_curve = SortAlongCurve(Points=sort_duplicate_points.UniquePoints, Curve=graft(curve_3))  # -> Points, Indices
polyline_2 = PolyLine(Vertices=sort_along_curve.Points, Closed=False)
fatten_4 = Fatten(
    Skeleton=flatten(polyline_2),
    Thickness=Slider(40, range=0..1000),
    LengthSubdivisions=0,
    EndType=Slider(0, range=0..100),
    AdjustForAngle=False)
weaverbird_s_catmull_clark_subdivision_5 = WeaverbirdsCatmullClarkSubdivision(MeshCurves=fatten_4, Level=1, SmoothNakedEdges=1)
weaverbird_s_loop_subdivision = WeaverbirdsLoopSubdivision(MeshCurves=fatten_4, Level=1, SmoothNakedEdges=1)
mesh_edges_8 = MeshEdges(Mesh=fatten_4)  # -> NakedEdges, InteriorEdges, NonManifoldEdges

shift_paths_6 = ShiftPaths(Data=mesh_5, Offset=-1)
param_viewer = ParamViewer(shift_paths_6)

tree_statistics_2 = TreeStatistics(Tree=shift_paths_6)  # -> Paths, Length, Count
list_length = ListLength(List=tree_statistics_2.Paths)
series_2 = Series(Start=0, Step=1, Count=list_length)
construct_path = ConstructPath(Indices=simplify(graft(series_2)))

replace_paths = ReplacePaths(Data=shift_paths_6, Search=param_viewer, Replace=flatten(construct_path))

graft_tree_3 = GraftTree(Tree=replace_paths, IncludeEmptyLists=True, IncludeNullItems=True)
mesh_10 = Mesh(simplify(graft_tree_3))

mesh_join = MeshJoin(Meshes=replace_paths)
mesh_edges_9 = MeshEdges(Mesh=replace_paths)  # -> NakedEdges, InteriorEdges, NonManifoldEdges
# Splitting into 3 faces
cluster_3 = Cluster(M=mesh_join)
cluster_4 = Cluster_2(point=cluster_3, geometry=simplify([mesh_edges_9.NakedEdges, mesh_edges_9.InteriorEdges, mesh_edges_9.NonManifoldEdges]))  # -> valley_2, peak_2

geometry_5 = Geometry(cluster_4.peak_2)
sphere_3 = Sphere(Base=geometry_5, Radius=10)

geometry_6 = Geometry(cluster_4.valley_2)
sphere_4 = Sphere(Base=geometry_6, Radius=1)

radians = Radians(Degrees=Slider(140, range=0..140))
meshcorners = MeshCorners(Mesh=mesh_10, Angle=radians)  # -> simplify(Corners)

radians_2 = Radians(Degrees=Slider(140, range=0..150))
meshcorners_2 = MeshCorners(Mesh=mesh_10, Angle=radians_2)  # -> simplify(Corners)

weaverbird_s_naked_boundary_4 = WeaverbirdsNakedBoundary(MeshClosedPolylines=mesh_10)
curve_closest_point_2 = CurveClosestPoint(Point=meshcorners_2, Curve=weaverbird_s_naked_boundary_4)  # -> Point, Parameter, Distance
shatter_2 = Shatter(Curve=weaverbird_s_naked_boundary_4, Parameters=curve_closest_point_2.Parameter)  # -> simplify(Segments)
length_4 = Length(Curve=shatter_2)  # -> simplify(Length)
panel_2 = Panel("""0
1""")
sort_list = SortList(Keys=length_4, ValuesValuesA=shatter_2)  # -> Keys, ValuesValuesA
cull_index = CullIndex(List=sort_list.ValuesValuesA, Indices=panel_2, Wrap=True)  # -> simplify(List)
join_curves_3 = JoinCurves(Curves=cull_index, Preserve=True)  # -> simplify(Curves)
rebuild_curve = RebuildCurve(Curve=join_curves_3, Count=Slider(15, range=0..100), Degree=3, EndTangents=False)  # -> flatten(Rebuilt)
shift_paths_7 = ShiftPaths(Data=join_curves_3, Offset=-1)
collision_one_many_2 = CollisionOneMany(Collider=shift_paths_7, Obstacles=sphere_3)  # -> Collision, Index
cull_pattern_2 = CullPattern(List=shift_paths_7, CullPattern=collision_one_many_2.Collision)

geometry_7 = Geometry(geometry_5)
geometry_8 = Geometry(geometry_6)
mesh_11 = Mesh(replace_paths)
mesh_strips_center_point = MeshStripsCenterPoint(mesh=mesh_11)

tree_statistics_3 = TreeStatistics(Tree=mesh_11)  # -> Paths, Length, Count
duplicate_data = DuplicateData(Data=graft(tree_statistics_3.Paths), Number=Slider(3, range=0..10), Order=False)  # -> simplify(graft(Data))
tree_branch_4 = TreeBranch(Tree=mesh_11, Path=duplicate_data, MaintainPaths=False)
shiftmatch = ShiftMatch(Data=tree_branch_4, Guide=duplicate_data)

shift_paths_8 = ShiftPaths(Data=mesh_6, Offset=-1)
param_viewer_2 = ParamViewer(shift_paths_8)

tree_statistics_4 = TreeStatistics(Tree=shift_paths_8)  # -> Paths, Length, Count
list_length_2 = ListLength(List=tree_statistics_4.Paths)
series_3 = Series(Start=0, Step=1, Count=list_length_2)
construct_path_2 = ConstructPath(Indices=simplify(graft(series_3)))

replace_paths_2 = ReplacePaths(Data=shift_paths_8, Search=param_viewer_2, Replace=flatten(construct_path_2))

# ----
# Splitting top & bottom face
mesh_join_2 = MeshJoin(Meshes=replace_paths_2)
cluster_5 = Cluster(M=mesh_join_2)

average = Average(Input=cluster_5)
list_item_2 = ListItem(List=cluster_5, Index=0, Wrap=True)  # -> Item, Item1
number_slider_23 = Slider(100, range=0..100)
line_3 = Line(StartPoint=list_item_2.Item, EndPoint=list_item_2.Item1)
xy_plane = XYPlane(Origin=average)
center_box = CenterBox(Base=xy_plane, X=number_slider_23, Y=number_slider_23, Z=1)  # -> graft(Box)

mesh_area_2 = MeshArea(Mesh=replace_paths_2)  # -> Area, Centroid
mesh_closest_point_2 = MeshClosestPoint(Point=mesh_area_2.Centroid, Mesh=replace_paths_2)  # -> Point, Index, Parameter

weaverbird_s_naked_boundary_5 = WeaverbirdsNakedBoundary(MeshClosedPolylines=replace_paths_2)
mesh_edges_10 = MeshEdges(Mesh=replace_paths_2)  # -> NakedEdges, InteriorEdges, NonManifoldEdges

tree_statistics_5 = TreeStatistics(Tree=mesh_closest_point_2.Point)  # -> Paths, Length, Count
series_4 = Series(Start=0, Step=1, Count=tree_statistics_5.Count)
duplicate_data_2 = DuplicateData(Data=graft(series_4), Number=2, Order=True)  # -> simplify(Data)

tree_statistics_6 = TreeStatistics(Tree=replace_paths_2)  # -> Paths, Length, Count
series_5 = Series(Start=0, Step=1, Count=tree_statistics_6.Count)
duplicate_data_3 = DuplicateData(Data=graft(series_5), Number=2, Order=True)  # -> simplify(Data)

tree_statistics_7 = TreeStatistics(Tree=center_box)  # -> Paths, Length, Count
series_6 = Series(Start=0, Step=1, Count=tree_statistics_7.Count)
duplicate_data_4 = DuplicateData(Data=graft(series_6), Number=2, Order=True)  # -> simplify(Data)

tree_branch_5 = TreeBranch(Tree=replace_paths_2, Path=graft(duplicate_data_3), MaintainPaths=False)

tree_branch_6 = TreeBranch(Tree=mesh_closest_point_2.Point, Path=graft(duplicate_data_2), MaintainPaths=False)

tree_branch_7 = TreeBranch(Tree=simplify(center_box), Path=graft(duplicate_data_4), MaintainPaths=False)

cluster_6 = Cluster_2(
    point=cluster_5,
    geometry=simplify([mesh_edges_10.NakedEdges, mesh_edges_10.InteriorEdges, mesh_edges_10.NonManifoldEdges]))  # -> valley_2, peak_2
line_4 = Line(StartPoint=graft(cluster_5), EndPoint=tree_branch_6)  # -> simplify(Line)
collision_one_many_3 = CollisionOneMany(Collider=simplify(line_4), Obstacles=tree_branch_7)  # -> simplify(Collision), Index

dispatch_5 = Dispatch(List=tree_branch_5, DispatchPattern=collision_one_many_3.Collision)  # -> ListA, ListB
# Valley face
geometry_9 = Geometry(dispatch_5.ListB)
# Peak face
mesh_join_3 = MeshJoin(Meshes=geometry_9)
shift_paths_9 = ShiftPaths(Data=mesh_join_3, Offset=-1)

list_item_3 = ListItem(List=shift_paths_9, Index=0, Wrap=True)  # -> Item, Item1

colour_swatch_2 = ColourSwatch(SwatchColor=RGB(88, 128, 255))
custom_preview_3 = CustomPreview(Geometry=list_item_3.Item, Material=colour_swatch_2)

colour_swatch_3 = ColourSwatch(SwatchColor=RGB(173, 203, 249))
custom_preview_4 = CustomPreview(Geometry=list_item_3.Item1, Material=colour_swatch_3)

flip_matrix = FlipMatrix(Data=shift_paths_9)
merge_2 = Merge(Data1=colour_swatch_2, Data2=colour_swatch_3)  # -> graft(Result)
object_bake = ObjectBake(
    BakeToggle=Button(),
    GeometryObjects=flip_matrix,
    Layer="Y Connectors",
    ObjectName="Planar Y Connectors",
    ObjectColor=merge_2,
    LayerColor=RGB(255, 255, 255))

weaverbird_s_naked_boundary_6 = WeaverbirdsNakedBoundary(MeshClosedPolylines=mesh_10)
curve_closest_point_3 = CurveClosestPoint(Point=meshcorners, Curve=weaverbird_s_naked_boundary_6)  # -> Point, Parameter, Distance
shatter_3 = Shatter(Curve=weaverbird_s_naked_boundary_6, Parameters=curve_closest_point_3.Parameter)  # -> simplify(Segments)
length_5 = Length(Curve=shatter_3)  # -> simplify(Length)
panel_3 = Panel("""0
1""")
sort_list_2 = SortList(Keys=length_5, ValuesValuesA=shatter_3)  # -> Keys, ValuesValuesA
cull_index_2 = CullIndex(List=sort_list_2.ValuesValuesA, Indices=panel_3, Wrap=True)  # -> simplify(List)

join_curves_4 = JoinCurves(Curves=cull_index_2, Preserve=True)  # -> simplify(Curves)

rebuild_curve_2 = RebuildCurve(Curve=join_curves_4, Count=Slider(15, range=0..100), Degree=3, EndTangents=False)  # -> flatten(Rebuilt)
shift_paths_10 = ShiftPaths(Data=join_curves_4, Offset=-1)
collision_one_many_4 = CollisionOneMany(Collider=shift_paths_10, Obstacles=sphere_4)  # -> Collision, Index
cull_pattern_3 = CullPattern(List=shift_paths_10, CullPattern=collision_one_many_4.Collision)

c_script_3 = CSharpScript(iShatter=geometry_8, iCurves=cull_pattern_3)  # -> out, A; inputs iShatter: tree of Point3d, iCurves: tree of Curve
# ---------- c_script_3: C# usings ----------
using System.Linq;
# ---------- c_script_3: C# ----------
    List<List<Curve>> allCurves = new List<List<Curve>>();
    
    double param;
    
    for(int i = 0; i < iShatter.BranchCount; i++){
      List<Curve> Curves = new List<Curve>();


      for(int j = 0; j < iCurves.Branch(i).Count; j++){
        iCurves.Branch(i)[j].Domain = new Interval(0, 1.0);
        
        iCurves.Branch(i)[j].ClosestPoint(iShatter.Branch(i)[0], out param);
        //Point3d closestPt = iPeakEdges.Branch(i)[j].PointAt(param);
        
        Curve[] curves = iCurves.Branch(i)[j].Split(param);
        //List<Curve> Curves = curves.ToList();
        for(int k = 0; k < curves.Length; k++){
          Curves.Add(curves[k]);}
      }
      allCurves.Add(Curves);
    }
    
    
    
    
    
    
    
    A = ListOfListsToTree(allCurves);
# ---------- c_script_3: C# additional code ----------
  static Grasshopper.DataTree<T> ListOfListsToTree<T > (List < List < T >> s){
  Grasshopper.DataTree<T> tree = new DataTree<T>();
  for(int i = 0;i < s.Count; i++){
  tree.AddRange(s[i], new GH_Path(i));
}
        return tree;
      }
# ---------- end c_script_3 ----------

point_on_curve_2 = PointOnCurve(c_script_3.A, parameter=0.5)
cull_duplicates_6 = CullDuplicates(Points=point_on_curve_2, Tolerance=0.1, CullMode=1)  # -> Points, Indices, Valence

cull_index_3 = CullIndex(List=c_script_3.A, Indices=cull_duplicates_6.Indices, Wrap=True)

# ----
# very shady rearrangement of list sequence
# haha, will fix later
panel_4 = Panel("""0
2
1""")
list_item_4 = ListItem(List=cull_index_3, Index=panel_4, Wrap=True)

c_script_4 = CSharpScript(iShatter=geometry_7, iCurves=cull_pattern_2)  # -> out, A; inputs iShatter: tree of Point3d, iCurves: tree of Curve; same code as c_script_3

point_on_curve_3 = PointOnCurve(c_script_4.A, parameter=0.5)
cull_duplicates_7 = CullDuplicates(Points=point_on_curve_3, Tolerance=0.1, CullMode=1)  # -> Points, Indices, Valence

cull_index_4 = CullIndex(List=c_script_4.A, Indices=cull_duplicates_7.Indices, Wrap=True)

point_on_curve_4 = PointOnCurve(cull_index_3, parameter=1)  # disabled
c_script_5 = CSharpScript(iPeakEdges=simplify(cull_index_4), iValleyEdgePts=simplify(point_on_curve_4))  # -> out, A; inputs iPeakEdges: tree of Curve, iValleyEdgePts: tree of Point3d; disabled
# ---------- c_script_5: C# ----------
    List<List<int>> allIndexes = new List<List<int>>();
    
    double param;
    double dist = 10000;
    int index = -1;




    for(int i = 0; i < iPeakEdges.BranchCount; i++){
      List<int> indexes = new List<int>();


      for(int j = 0; j < iPeakEdges.Branch(i).Count; j++){

        //index = -1;


        for(int k = 0; k < iValleyEdgePts.Branch(i).Count; k++){
          iPeakEdges.Branch(i)[j].Domain = new Interval(0, 1.0);

          iPeakEdges.Branch(i)[j].ClosestPoint(iValleyEdgePts.Branch(i)[k], out param);
          Point3d closestPt = iPeakEdges.Branch(i)[j].PointAt(param);

          double tempDist = iValleyEdgePts.Branch(i)[k].DistanceTo(closestPt);

          if(tempDist < dist){
            dist = tempDist;
            index = k;
          }

        }
        indexes.Add(index);

        dist = 100000;
        param = 0;
      }
      allIndexes.Add(indexes);
    }





    A = ListOfListsToTree(allIndexes);
# ---------- c_script_5: C# additional code ----------
  


  static Grasshopper.DataTree<T> ListOfListsToTree<T > (List < List < T >> s){
  Grasshopper.DataTree<T> tree = new DataTree<T>();
  for(int i = 0;i < s.Count; i++){
  tree.AddRange(s[i], new GH_Path(i));
}
        return tree;
      }
# ---------- end c_script_5 ----------

merge_3 = Merge(Data1=simplify(graft(cull_index_4)), Data2=simplify(graft(list_item_4)))

loft = Loft(Curves=merge_3, Options={Adjust=True, Closed=False, LoftEnds=0, LoftSimp=1, LoftType=2, Rebuild=10, Refit=0.01})
shift_paths_11 = ShiftPaths(Data=loft, Offset=-1)
mesh_surface = MeshSurface(Surface=shift_paths_11, UCount=5, VCount=5, Overhang=True, Equalize=False)
mesh_join_4 = MeshJoin(Meshes=mesh_surface)

area = Area(Geometry=loft)  # -> Area, Centroid
shift_paths_12 = ShiftPaths(Data=area.Centroid, Offset=-1)

polyline_3 = PolyLine(Vertices=shift_paths_12, Closed=True)
explode_4 = Explode(Curve=polyline_3, Recursive=True)  # -> Segments, Vertices
point_on_curve_5 = PointOnCurve(explode_4.Segments, parameter=0.5)

# ----
# TABS FOR Y CONNECTORS
geometry_10 = Geometry(merge_3)
explode_5 = Explode(Curve=geometry_10, Recursive=True)  # -> simplify(Segments), Vertices

c_script_6 = CSharpScript(iMeshCenter=simplify(mesh_strips_center_point), iDivider=simplify(point_on_curve_5))  # -> out, AllLines, AllLengths; inputs iMeshCenter: tree of Point3d, iDivider: tree of Point3d
# ---------- c_script_6: C# ----------
    
    List<List<List<Line>>> allLines = new List<List<List<Line>>>();
    List<List<List<double>>> allLengths = new List<List<List<double>>>();



    for(int i = 0; i < iDivider.BranchCount; i++){
      List<List<Line>> linesBranch = new List<List<Line>>();
      List<List<double>> lengthsBranch = new List<List<double>>();


      for(int j = 0; j < iDivider.Branch(i).Count; j++){
        List<Line> lines = new List<Line>();
        List<double> lengths = new List<double>();


        for(int k = 0; k < iMeshCenter.Branch(i).Count; k++){
          Line line = new Line(iDivider.Branch(i)[j], iMeshCenter.Branch(i)[k]);
          double length = line.Length;

          lines.Add(line);
          lengths.Add(length);
        }

        linesBranch.Add(lines);
        lengthsBranch.Add(lengths);
      }


      allLines.Add(linesBranch);
      allLengths.Add(lengthsBranch);
    }


    AllLines = allLines;
    AllLines = allLengths;


    AllLines = ListOfListsOfListsToTree(allLines);
    AllLengths = ListOfListsOfListsToTree(allLengths);
# ---------- c_script_6: C# additional code ----------
  //List<List<Line>> allLines = new List<List<Line>>();
  //List<List<double>> allLengths = new List<List<double>>();





  /*static Grasshopper.DataTree<T> ListOfListsToTree<T > (List < List < T >> s){
  Grasshopper.DataTree<T> tree = new DataTree<T>();
  for(int i = 0;i < s.Count; i++){
  tree.AddRange(s[i], new GH_Path(i));
}
        return tree;
      }*/

  DataTree<T> ListOfListsOfListsToTree<T>(List<List<List<T>>> list){
  DataTree<T> tree = new DataTree<T>();
  int i = 0;
  int j = 0;

  foreach(List<List<T>> innerList in list){
  foreach(List<T> innestList in innerList){
tree.AddRange(innestList, new GH_Path(new int[]{i,j}));
        j++;
        }
      i++;
      }
     return tree;
   }
# ---------- end c_script_6 ----------
param_viewer_3 = ParamViewer(c_script_6.AllLines)

number_slider_24 = Slider(6, range=0..10)
tree_statistics_8 = TreeStatistics(Tree=deconstruct_mesh_3.Normals)  # -> Paths, Length, Count
duplicate_data_5 = DuplicateData(Data=graft(tree_statistics_8.Paths), Number=number_slider_24, Order=False)  # -> simplify(graft(Data))
tree_branch_8 = TreeBranch(Tree=deconstruct_mesh_3.Normals, Path=duplicate_data_5, MaintainPaths=False)
shiftmatch_2 = ShiftMatch(Data=tree_branch_8, Guide=explode_5.Vertices)

tree_statistics_9 = TreeStatistics(Tree=c_script_6.AllLines)  # -> Paths, Length, Count

tree_statistics_10 = TreeStatistics(Tree=deconstruct_mesh_3.Vertices)  # -> Paths, Length, Count
duplicate_data_6 = DuplicateData(Data=graft(tree_statistics_10.Paths), Number=number_slider_24, Order=False)  # -> simplify(graft(Data))
tree_branch_9 = TreeBranch(Tree=deconstruct_mesh_3.Vertices, Path=duplicate_data_6, MaintainPaths=False)
shiftmatch_3 = ShiftMatch(Data=tree_branch_9, Guide=explode_5.Vertices)

collision_one_many_5 = CollisionOneMany(Collider=c_script_6.AllLines, Obstacles=flatten(mesh_join_4))  # -> Collision, Index
series_7 = Series(Start=0, Step=1, Count=tree_statistics_9.Length)  # -> simplify(Series)
closest_point_3 = ClosestPoint(Point=simplify(explode_5.Vertices), Cloud=simplify(shiftmatch_3))  # -> ClosestPoint, CPIndex, Distance
dispatch_6 = Dispatch(List=series_7, DispatchPattern=collision_one_many_5.Collision)  # -> ListA, ListB
dispatch_7 = Dispatch(List=c_script_6.AllLines, DispatchPattern=collision_one_many_5.Collision)  # -> ListA, ListB
geometry_11 = Geometry(dispatch_7.ListB)

number_slider_25 = Slider(5, range=0..100)
list_item_5 = ListItem(List=shiftmatch_2, Index=closest_point_3.CPIndex, Wrap=True)
amplitude = Amplitude(Vector=list_item_5, Amplitude=number_slider_25)
move = Move(Geometry=closest_point_3.ClosestPoint, Motion=amplitude)  # -> Geometry, Transform

list_item_6 = ListItem(List=shiftmatch, Index=dispatch_6.ListB, Wrap=True)
mesh_join_5 = MeshJoin(Meshes=list_item_6)
shift_paths_13 = ShiftPaths(Data=mesh_join_5, Offset=-1)

tree_statistics_11 = TreeStatistics(Tree=shift_paths_13)  # -> Paths, Length, Count
series_8 = Series(Start=0, Step=1, Count=tree_statistics_11.Length)
bounds = Bounds(Numbers=series_8)
remap_numbers = RemapNumbers(Value=series_8, Source=bounds, Target=Domain(0, 1))  # -> Mapped, Clipped
gradient = Gradient(
    LowerLimit=0,
    UpperLimit=1,
    Parameter=remap_numbers.Mapped,
    stops=[0: RGB(234, 126, 0), 0: RGB(234, 38, 0), 0.485: RGB(173, 203, 249), 1: RGB(128, 128, 255), 1: RGB(75, 107, 169)])
mesh_edges_11 = MeshEdges(Mesh=shift_paths_13)  # -> NakedEdges, InteriorEdges, NonManifoldEdges
custom_preview_5 = CustomPreview(Geometry=shift_paths_13, Material=simplify(gradient))

interpolate = Interpolate(Vertices=move.Geometry, Degree=3, Periodic=False, KnotStyle=1)  # -> Curve, Length, Domain
shiftmatch_4 = ShiftMatch(Data=interpolate.Curve, Guide=geometry_10)

merge_4 = Merge(Data1=graft(geometry_10), Data2=graft(shiftmatch_4))
rebuild_curve_3 = RebuildCurve(Curve=merge_4, Degree=3, Count=Slider(10, range=0..100), Tangents=False)
loft_2 = Loft(Curves=rebuild_curve_3, Options={Adjust=False, Closed=False, LoftEnds=0, LoftSimp=0, LoftType=0, Rebuild=10, Refit=0.01})

collision_one_many_6 = CollisionOneMany(Collider=join_curves_2, Obstacles=flatten(loft_2))  # -> Collision, Index
cull_pattern_4 = CullPattern(List=join_curves_2, CullPattern=collision_one_many_6.Collision)
explode_6 = Explode(Curve=cull_pattern_4, Recursive=True)  # -> Segments, Vertices

number_slider_26 = Slider(2, range=0..10)
tree_statistics_12 = TreeStatistics(Tree=deconstruct_mesh_4.Vertices)  # -> Paths, Length, Count
duplicate_data_7 = DuplicateData(Data=graft(tree_statistics_12.Paths), Number=number_slider_26, Order=False)  # -> simplify(graft(Data))
tree_branch_10 = TreeBranch(Tree=deconstruct_mesh_4.Vertices, Path=duplicate_data_7, MaintainPaths=False)
shiftmatch_5 = ShiftMatch(Data=tree_branch_10, Guide=explode_6.Vertices)

tree_statistics_13 = TreeStatistics(Tree=deconstruct_mesh_4.Normals)  # -> Paths, Length, Count
duplicate_data_8 = DuplicateData(Data=graft(tree_statistics_13.Paths), Number=number_slider_26, Order=False)  # -> simplify(graft(Data))
tree_branch_11 = TreeBranch(Tree=deconstruct_mesh_4.Normals, Path=duplicate_data_8, MaintainPaths=False)
shiftmatch_6 = ShiftMatch(Data=tree_branch_11, Guide=explode_6.Vertices)

geometry_12 = Geometry(cull_pattern_4)
closest_point_4 = ClosestPoint(Point=simplify(explode_6.Vertices), Cloud=simplify(shiftmatch_5))  # -> ClosestPoint, CPIndex, Distance

list_item_7 = ListItem(List=shiftmatch_6, Index=closest_point_4.CPIndex, Wrap=True)
amplitude_2 = Amplitude(Vector=list_item_7, Amplitude=number_slider_25)
move_2 = Move(Geometry=closest_point_4.ClosestPoint, Motion=amplitude_2)  # -> Geometry, Transform
interpolate_2 = Interpolate(Vertices=move_2.Geometry, Degree=3, Periodic=False, KnotStyle=1)  # -> Curve, Length, Domain

merge_5 = Merge(Data1=simplify(graft(cull_pattern_4)), Data2=simplify(graft(interpolate_2.Curve)))
rebuild_curve_4 = RebuildCurve(Curve=merge_5, Degree=3, Count=Slider(10, range=0..100), Tangents=False)
loft_3 = Loft(Curves=rebuild_curve_4, Options={Adjust=False, Closed=False, LoftEnds=0, LoftSimp=0, LoftType=0, Rebuild=10, Refit=0.01})

custom_preview_6 = CustomPreview(Geometry=loft_2, Material=ColourSwatch(SwatchColor=RGB(84, 84, 84)))

custom_preview_7 = CustomPreview(Geometry=loft_3, Material=ColourSwatch(SwatchColor=RGB(84, 84, 84)))

object_bake_2 = ObjectBake(
    BakeToggle=Button(),
    GeometryObjects=shift_paths_13,
    Layer="Y Connectors",
    ObjectName="GH_Obj",
    ObjectColor=gradient,
    LayerColor=RGB(255, 255, 255))

# ==== cluster Cluster
M = ClusterInput()
stripper = Stripper(Mesh=M)
deconstruct_mesh = DeconstructMesh(Mesh=simplify(stripper))  # -> Vertices, Faces, Colours, Normals
shift_paths = ShiftPaths(Data=deconstruct_mesh.Vertices, Offset=-1)
sort_duplicate_points = SortDuplicatePoints(Points=shift_paths)  # -> UniquePoints, Indices
c_script = CSharpScript(iPoints=sort_duplicate_points.UniquePoints, iVertex=shift_paths)  # -> out, A; inputs iPoints: tree of Point3d, iVertex: tree of Point3d
# ---------- c_script: C# ----------
    List<List<Point3d>> allPoints = new List<List<Point3d>>();
    
    
    
    for(int i = 0; i < iPoints.BranchCount; i++){
      List<Point3d> extremePoints = new List<Point3d>();

      for(int j = 0; j < iPoints.Branch(i).Count; j++){
        Point3d point1 = iPoints.Branch(i)[j];
        List<Point3d> points = new List<Point3d>();
        int count = 0;


        for(int k = 0; k < iVertex.Branch(i).Count; k++){
          double dist = point1.DistanceTo(iVertex.Branch(i)[k]);

          if(dist < 0.0001){
            //points.Add(iVertex.Branch(i)[k]);
            count += 1;}

        }
        if(count > 2){
          extremePoints.Add(point1);
        }
      }
      allPoints.Add(extremePoints);
    }


    A = ListOfListsToTree(allPoints);
# ---------- c_script: C# additional code ----------
  

  static Grasshopper.DataTree<T> ListOfListsToTree<T > (List < List < T >> s){
  Grasshopper.DataTree<T> tree = new DataTree<T>();
  for(int i = 0;i < s.Count; i++){
  tree.AddRange(s[i], new GH_Path(i));
}
      return tree;
    }
# ---------- end c_script ----------
A = ClusterOutput(c_script.A)

# ==== cluster Cluster_2
point = ClusterInput()
geometry = ClusterInput()
point_2 = Point(point)
geometry_2 = Geometry(geometry)
shift_paths = ShiftPaths(Data=geometry_2, Offset=-1)

sphere = Sphere(Base=graft(point_2), Radius=Slider(1, range=0..1))

collision_one_many = CollisionOneMany(Collider=shift_paths, Obstacles=point_2)  # -> Collision, Index
cull_pattern = CullPattern(List=shift_paths, CullPattern=collision_one_many.Collision)  # -> simplify(List)

collision_one_many_2 = CollisionOneMany(Collider=flatten(cull_pattern), Obstacles=sphere)  # -> Collision, Index
cull_pattern_2 = CullPattern(List=flatten(cull_pattern), CullPattern=collision_one_many_2.Collision)

length = Length(Curve=cull_pattern_2)
mass_addition = MassAddition(Input=length)  # -> Result, PartialResults
shift_paths_2 = ShiftPaths(Data=mass_addition.Result, Offset=-1)
sort_list = SortList(Keys=shift_paths_2, ValuesValuesA=point_2)  # -> Keys, ValuesValuesA
list_item = ListItem(List=sort_list.ValuesValuesA, Index=0, Wrap=True)  # -> Item, Item1
valley = Data(list_item.Item)
peak = Data(list_item.Item1)
valley_2 = ClusterOutput(valley)
peak_2 = ClusterOutput(peak)

# ==== cluster MeshStripsCenterPoint
mesh = ClusterInput()
mesh_2 = Mesh(mesh)

radians = Radians(Degrees=Slider(130, range=0..130))
meshcorners = MeshCorners(Mesh=mesh_2, Angle=radians)  # -> simplify(Corners)

weaverbird_s_naked_boundary = WeaverbirdsNakedBoundary(MeshClosedPolylines=mesh_2)
curve_closest_point = CurveClosestPoint(Point=meshcorners, Curve=graft(weaverbird_s_naked_boundary))  # -> Point, Parameter, Distance
shatter = Shatter(Curve=graft(weaverbird_s_naked_boundary), Parameters=curve_closest_point.Parameter)
length = Length(Curve=shatter)
panel = Panel("""0
1""")
sort_list = SortList(Keys=length, ValuesValuesA=shatter)  # -> Keys, simplify(ValuesValuesA)
cull_index = CullIndex(List=sort_list.ValuesValuesA, Indices=panel, Wrap=True)
list_item = ListItem(List=sort_list.ValuesValuesA, Index=panel, Wrap=True)
join_curves = JoinCurves(Curves=cull_index, Preserve=False)
rebuild_curve = RebuildCurve(Curve=join_curves, Count=Slider(49, range=0..100), Degree=3, EndTangents=False)  # -> simplify(Rebuilt)

merge = Merge(Data1=list_item, Data2=rebuild_curve)
list_item_2 = ListItem(List=merge, Index=0, Wrap=True)  # -> Item, Item1, Item2, Item3
edge_surface = EdgeSurface(CurveA=list_item_2.Item, CurveB=list_item_2.Item1, CurveC=list_item_2.Item2, CurveD=list_item_2.Item3)

md_slider = MDSlider(SliderMode=0, slider_value=Point(0.5, 0.5, 0.5), x_domain=Domain(0, 1), y_domain=Domain(0, 1), z_domain=Domain(0, 1))
evaluate_surface = EvaluateSurface(Surface=reparameterize(edge_surface), Point=md_slider)  # -> Point, Normal, UDirection, VDirection, Frame
shift_paths = ShiftPaths(Data=evaluate_surface.Point, Offset=-1)
mesh_closest_point = MeshClosestPoint(Point=shift_paths, Mesh=mesh_2)  # -> Point, Index, Parameter

point = ClusterOutput(mesh_closest_point.Point)
