# Grasshopper definition AddingPoints.gh (Grasshopper 0.9.76)

pt = Point([Point(17, 17, 0), Point(21, 4, 0), Point(31, 16, 0)])
brep = Brep(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)
timer = Timer(TimerInterval=1, Target=customiteration)  # disabled
customiteration = CSharpScript(
    StartPoints=pt,
    TargetMesh=brep,
    Reset=Button(),
    Reference="C:\Users\Daniel\Documents\GitHub\Kangaroo2\bin\Release\KangarooSolver.dll")  # -> out, A; inputs StartPoints: list of Point3d, TargetMesh: Mesh, Reset: Boolean
# ---------- customiteration: C# ----------
    if(Reset || Points == null)
    {
      Points = StartPoints;
      counter = 0;
    }

    else
    {
      if(counter < 300)
      {
        // add a new point in the middle of the current ones
        var AveragePoint = new Point3d();
        foreach (Point3d P in Points)
        {
          AveragePoint = AveragePoint + P;
        }
        AveragePoint *= 1.0 / Points.Count;
        Points.Add(AveragePoint);

        //make an instance of the kangaroo solver
        var PS = new KangarooSolver.PhysicalSystem();

        //make the goals we need - one for collisions between all particles, and one keeping them all on the mesh
        List<IGoal> MyGoals = new List<IGoal>();
        var CollideGoal = new KangarooSolver.Goals.SphereCollide(Points, 1, 1);
        MyGoals.Add(CollideGoal);
        var OnMeshGoal = new KangarooSolver.Goals.OnMesh(Points, TargetMesh, 1);
        MyGoals.Add(OnMeshGoal);

        //assign the indexing
        foreach(IGoal G in MyGoals)
        {
          PS.AssignPIndex(G, 0.01);
        }

        //take a step in the simulation and assign the new positions to the list of points
        PS.Step(MyGoals, true, 0);
        Points = PS.GetPositions().ToList();
        counter++;
      }
    }

    A = Points;
# ---------- customiteration: C# additional code ----------
  List<Point3d> Points;
  // because this list is outside the main RunScript section,
  // it is preserved from one iteration to the next

  int counter;
# ---------- end customiteration ----------
panel = Panel(customiteration.out)
