# Grasshopper definition Utilities_AndrewsAnimationRecorder.gh (Grasshopper 1.0.7)

slider = Slider(0.552, range=0..1)
slider_2 = Slider(0.128, range=0..1)
slider_3 = Slider(1, range=0..1)
# ANIMATION SCRIPT FOR MULTIPLE SLIDERS
# Definition by Andrew Heumann
# 
# http://heumanndesigntech.wordpress.com
slider_4 = Slider(0, range=0..1)
animation_slider = Slider(0.983, range=0..1)
use_smoothing = BooleanToggle(True)
# Step 6. Control your animation with the Animation slider. If you wish to record an animation with more frames than you recorded, enable "use smoothing."
smoothing = Slider(0, range=0..1)
# Step 1.
# Connect your sliders to the Merge component
merge = Merge(Data1=slider_4, Data2=slider, Data3=slider_2, Data4=slider_3)  # -> graft(Result)

# ---- group: Example Definition
box = CenterBox(Base="-2,0,0", X=slider_4, Y=slider, Z=slider_2)
rotate = Rotate(Geometry=box, Angle=slider_3, Plane="-2,0,0")  # -> Geometry, Transform

# ----
# Step 3. Move your sliders in the desired way
panel = Panel("Step 2. Clear Record")

rec = DataRecorder(merge, DataLimit=-10, RecordData=True)
# Step 4. Right click the "D" input above and choose "internalize data"
# Step 5. Go to the end of the definition and replace your slider inputs with the outputs from the "Bang" component
snip = Snip(
    Data=rec,
    Data_2=rec,
    Data_3=snip.Data,
    D=snip.D,
    Data_4=snip.Data,
    InternalDocument_plugin_version=(1, 0, 7),
    InternalDocument_DocumentHeader_PreviewMeshType=1,
    InternalDocument_DocumentHeader_PreviewNormal=RGBA(150, 0, 0, 100),
    InternalDocument_DocumentHeader_PreviewSelected=RGBA(0, 150, 0, 100),
    InternalDocument_DefinitionProperties_Projection_Zoom=1.25)  # -> D, D_2

lng = ListLength(List=snip.D_2)
subtraction = Subtraction(A=lng, B="1")
X = UnitX(Factor=1)
origin = Origin(Point(0, 0, 0))
multiplication = Multiplication(A=subtraction, B=animation_slider)
line = LineSDL(Start=origin, Direction=X, Length="5")
range = Range(Domain="5", Steps=subtraction)
Y = UnitY(Factor=1)
item = IT(List=snip.D_2, Index=multiplication, Wrap=False)
eval = EvaluateCurve(Curve=line, Parameter=animation_slider)  # -> Point, Tangent, Length
pt = PointXYZ(XComponent=range, YComponent=snip.D_2, ZComponent=0, System=PlaneXY(0, 0, 0))
line_2 = LineSDL(Start=eval.Point, Direction=Y, Length=1)
subtraction_2 = Subtraction(A="1", B=smoothing)
intcrv = Interpolate(Vertices=pt, Degree=3, Periodic=False)  # -> Curve, Length, Domain
multiplication_2 = Multiplication(A=subtraction, B=subtraction_2)
reb = Rebuild(Curve=intcrv.Curve, Count=multiplication_2, Tangents=False)
clx = CurveLine(Curve=reb, Line=line_2, First=True)  # -> Points, Params, Count
pcomp = Decompose(Point=clx.Points, System=PlaneXY(0, 0, 0))  # -> XComponent, YComponent, ZComponent
filter = StreamFilter(Gate=use_smoothing, Stream0=item, Stream1=pcomp.YComponent)
bang = ExplodeTree(Data=filter)  # -> _0000, _0100, _0200, _0300
