# Grasshopper definition Utilities_Animation thing.gh (Grasshopper 1.0.7)
# plug-ins: Kangaroo Components

panel = Panel("simulatin capture - animation")

# ---- group: input mesh
mesh = Mesh(<mesh referenced from the Rhino model>)

# ---- group: input animation handles
crv = Curve(reparameterize(graft([<curve referenced from the Rhino model> x12])))

# ---- group: crv domain
D = Domain(Domain(0, 1))

# ----
mesh_div = Panel("10")
gravity_factor = Panel("9.8")
Z = UnitZ(Factor=gravity_factor)
subiterations = Panel("16")
kangaroo_settings = KangarooSettings(
    Tolerance=0.01,
    TimeStep=0.01,
    SubIterations=subiterations,
    Floor=False,
    Drag=1,
    Restitution=0.7,
    StaticFriction=10,
    KineticFriction=10,
    Settle=2,
    Tumble=1,
    Sound=False,
    Solver=0)
pt = Point([<point referenced from the Rhino model> x3])
current_frame = Slider(0, range=0..239)

# ---- group: quad div
quaddiv = QuadDivide(Mesh=mesh, Divisions=mesh_div)

# ---- group: springs from mesh
springsfrommesh = SpringsFromMesh(M=quaddiv, stiffness=1000, B=Slider(1.2, range=0.5..2.5))

# ---- group: deconstruct mesh
demesh = DeconstructMesh(Mesh=quaddiv)  # -> Vertices, Faces, Colours, Normals

# ---- group: mesh corners
meshcorners = MeshCorners(M=quaddiv, A=0.5235987756)

# ---- group: unary force
uforce = UnaryForce(Point=demesh.Vertices, Force=Z)

# ---- group: all physical objects
merge = Merge(Data1=springsfrommesh, Data2=uforce)

# ----
trigger_frame = Panel("120")
static_value = Panel("0")
subtraction = Subtraction(A="240", B=trigger_frame)
subtraction_2 = Subtraction(A="240")
range = Range(Domain=D, Steps=subtraction)
repeat = RepeatData(Data=static_value, Length=trigger_frame)
remap = RemapNumbers(Value=Slider(0.999, range=0.001..0.999), Source=Domain(0, 1), Target=subtraction_2)  # -> Mapped, Clipped
merge_2 = Merge(Data1=repeat, Data2=range)
current_frame_2 = Panel(remap.Mapped)
eval = EvaluateCurve(Curve=crv, Parameter=merge_2)  # -> Point, Tangent, Angle
item = ListItem(List=eval.Point, Index=remap.Mapped, Wrap=True)

# ---- group: number of frames
sequence = Sequence(Frames="240")

# ---- group: all anchors
merge_3 = Merge(Data1=meshcorners, Data2=pt, Data3=item)  # -> flatten(Result)

# ----
item_2 = ListItem(List=sequence, Index=remap.Mapped, Wrap=True)

# ---- group: physics engine
kangaroo = KangarooPhysics(ForceObjects=merge, AnchorPoints=merge_3, Settings=kangaroo_settings, Geometry=demesh.Vertices, SimulationReset=item_2)  # -> Out, Iterations, ParticlesOut, GeometryOut, KE

# ----
lng = ListLength(List=demesh.Vertices)
repeat_2 = RepeatData(Data=lng, Length="240")
partition = PartitionList(List=kangaroo.GeometryOut, Size=repeat_2)
tstat = TreeStatistics(Tree=partition)  # -> Paths, Length, Count
item_3 = ListItem(List=tstat.Paths, Index=current_frame, Wrap=True)
branch = TreeBranch(Tree=partition, Path=item_3, MaintainPaths=True)

# ---- group: color option 1 / pt deconstruct
pdecon = Deconstruct(Point=branch)  # -> XComponent, YComponent, ZComponent

# ---- group: color option 1 / bounds
bnd = Bounds(Numbers=pdecon.ZComponent)

# ---- group: color option 1 / deconstruct domian
dedomain = DeconstructDomain(Domain=bnd)  # -> Start, End

# ---- group: color option 1 / gradient
gradient = Gradient(
    LowerLimit=dedomain.Start,
    UpperLimit=dedomain.End,
    Parameter=pdecon.ZComponent,
    stops=[0: RGB(234, 38, 0), 0: RGB(234, 126, 0), 0.553: RGB(254, 244, 84), 1: RGB(173, 203, 249), 1: RGB(75, 107, 169)])

# ---- group: color option 1
conmesh = ConstructMesh(Vertices=branch, Faces=demesh.Faces, Colours=gradient)

# ==== cluster SpringsFromMesh: Turns all edges of a mesh into springs
M = ClusterInput()
medges = MeshEdges(Mesh=M)  # -> NakedEdges, InteriorEdges, NonManifoldEdges
crv = Curve([medges.NakedEdges, medges.InteriorEdges])
B = ClusterInput()
len = Length(Curve=crv)
multiplication = Multiplication(A=len, B=B)
stiffness = ClusterInput()
springs = SpringsFromLine(Connection=crv, Stiffness=stiffness, Damping=10, RestLength=multiplication, UpperCutoff=0, LowerCutoff=0, Plasticity=0)
S = ClusterOutput(springs)

# ==== cluster MeshCorners: Finds the corners of the boundary of a mesh
M = ClusterInput()
medges = MeshEdges(Mesh=M)  # -> NakedEdges, InteriorEdges, NonManifoldEdges
join = JoinCurves(Curves=medges.NakedEdges, Preserve=False)
explode = Explode(Curve=join, Recursive=True)  # -> simplify(Segments), Vertices
shift = ShiftList(List=explode.Segments, Shift=1, Wrap=True)  # -> simplify(List)
end = EndPoints(Curve=explode.Segments)  # -> Start, End
angle = Angle(VectorA=explode.Segments, VectorB=shift)  # -> Angle, Reflex
A = ClusterInput()
smaller = SmallerThan(FirstNumber=A, SecondNumber=angle.Angle)  # -> SmallerThan, OrEqualTo
cull = CullPattern(List=end.End, CullPattern=smaller.SmallerThan)  # -> flatten(List)
L = ClusterOutput(cull)
