# Grasshopper definition Utilities_Basic Inflatable.gh (Grasshopper 1.0.7)
# plug-ins: Kangaroo2 Components

# ----
# Very basic inflatable example of a cube
mesh_box = MeshBox(Base={Plane=PlaneXY(0, 0, 0), X=Domain(-10, 10), Y=Domain(-10, 10), Z=Domain(-10, 10)}, XCount=10, YCount=10, ZCount=10)
triangulate = Triangulate(Mesh=mesh_box)  # -> Mesh, Count
mesh_edges = MeshEdges(Mesh=triangulate.Mesh)  # -> NakedEdges, InteriorEdges, NonManifoldEdges
nakedvertices = NakedVertices(Mesh=triangulate.Mesh)  # -> ClothedIndex, NakedIndex, ClothedPts, NakedPts
deconstruct_mesh = DeconstructMesh(Mesh=mesh_box)  # -> Vertices, Faces, Colours, Normals

negative = Negative(Value=Slider(0.13, range=0.001..1))
unit_z = UnitZ(Factor=negative)

geometry = Geometry(nakedvertices.NakedPts)

mesh_join = MeshJoin(Meshes=triangulate.Mesh)

pressure = Pressure(M=mesh_join, Strength=Slider(0.12, range=0..1))
load = Load(Point=deconstruct_mesh.Vertices, ForceVector=unit_z)
length_line = LengthLine(Line=mesh_edges.InteriorEdges, Strength=10)
anchor = Anchor(Point=geometry, Strength=Slider(15, range=0..100))
show = Show(G=triangulate.Mesh)
solver = Solver(
    GoalObjects=flatten([show, length_line, pressure, load, anchor]),
    Reset=Button(),
    Threshold=1e-15,
    Tolerance=0.01,
    On=Toggle(True))  # -> I, V, O
list_item = ListItem(List=solver.O, Index=0, Wrap=True)
