# Grasshopper definition Utilities_Collection of working c# codes.gh (Grasshopper 1.0.7)

# ----
# Exporting frames to a folder(used with kangaroo2 step solver)
file_path = FilePath("C:\Users\User\Desktop\Thesis Drive\Graphics\2_Animation\200430\TestTimerCapture\")
panel = Panel(file_path)
timer = Timer(TimerInterval=6000, Target=c_script)  # disabled
c_script = CSharpScript(iReset=Button(), iStart=Toggle(False), Path=panel, Name="image", iFrames=Slider(1700, range=0..1700))  # -> out; inputs iReset: Boolean, iStart: Boolean, Path: String, Name: String, iFrames: Int32
# ---------- c_script: C# usings ----------
using Rhino.Display;
using System.Threading;
# ---------- c_script: C# ----------
    
    if(iReset) counter = 0;
    
    if(iStart) {
      var view = doc.Views.ActiveView;
      var view_capture = new ViewCapture
        {
          Width = view.ActiveViewport.Size.Width,
          Height = view.ActiveViewport.Size.Height,
          ScaleScreenItems = false,
          DrawAxes = false,
          DrawGrid = false,
          DrawGridAxes = false,
          TransparentBackground = true
          };

      if(counter < iFrames){
        var screenshot = view_capture.CaptureToBitmap(view);
        if(screenshot != null)
        {
          string filename = Path + Name + counter + ".png";
          screenshot.Save(filename, System.Drawing.Imaging.ImageFormat.Png);
          Print("Count: " + counter);
          counter += 1;
        }
      }
    }
# ---------- c_script: C# additional code ----------
  int counter = 0;
# ---------- end c_script ----------
panel_2 = Panel(c_script)

# ----
# A LIST OF C# CODE THAT WORKS
# filter data type of a list
c_script_2 = CSharpScript()  # -> out, A; inputs x: list
# ---------- c_script_2: C# usings ----------
using System.Linq;
# ---------- c_script_2: C# ----------
    //List <double> output = new List<double>{};

    A = getRadius(x);

    //A = output;
# ---------- c_script_2: C# additional code ----------
  public List<double> getRadius(List<object> item)
  {
    return item.OfType<double>().ToList();
  }
# ---------- end c_script_2 ----------

# ----
# Tree branch/data management static function
c_script_3 = CSharpScript(
    iMeshCenter=simplify(Tree({0}: [Point(411.3007822, 45.39276252, 4.15297924), Point(420.107178, 55.42222948, 13.39229825), Point(430.1976168, 60.64522429, 20.12127214), Point(440.05629, 62.629842, 24.77677696), Point(448.4608312, 61.59618388, 27.06844244), Point(454.6987166, 57.92491041, 26.98231864)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], {1}: [Point(756.8884178, -154.5903087, -6.539782457), Point(749.4620648, -141.9756363, -13.55605216), Point(742.8159822, -130.6863408, -15.21624202), Point(737.249299, -121.2305646, -13.66504635), Point(733.3136981, -114.5454059, -9.569162142), Point(731.2557437, -111.0496912, -3.574014801)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], {2}: [Point(639.1425042, 35.9952351, 273.4931726), Point(634.5169082, 27.82429377, 273.3105298), Point(631.2174246, 21.99591212, 276.1778342), Point(629.0990072, 18.25380598, 282.0007278), Point(628.4705037, 17.14358089, 290.679955), Point(629.5518737, 19.05379972, 301.5421635)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], {3}: [Point(761.1208219, 238.1732339, 4.152970758), Point(765.4034131, 225.5319382, 13.39229101), Point(764.8814957, 214.1818564, 20.12127856), Point(761.6708931, 204.6516823, 24.77678782), Point(756.573423, 197.889984, 27.068442), Point(750.2750534, 194.3234482, 26.98231148)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])),
    iDivider=simplify(Tree({0}: [Point(462.5105027, 39.27859274, 0.8352496898), Point(454.4313845, 25.00718652, 24.02771255), Point(454.190657, 53.41102022, 24.02771277)], {1}: [Point(749.2526994, -113.6250807, 24.02771459), Point(724.7746304, -128.035475, 24.02771517), Point(732.8537409, -113.7640696, 0.835251062)], {2}: [Point(633.7826039, 26.52722982, 277.6777688), Point(633.5418835, 54.93106545, 277.6777698), Point(658.2606872, 40.9376245, 277.6777676)], {3}: [Point(730.2209391, 196.8813815, 0.8352502383), Point(721.901099, 211.013806, 24.02771567), Point(746.6198979, 197.0203725, 24.02771694)])))  # -> out, AllLines, AllLengths; inputs iMeshCenter: tree of Point3d, iDivider: tree of Point3d
# ---------- c_script_3: C# ----------
    for(int i = 0; i < iDivider.BranchCount; i++){
      List<List<Line>> linesBranch = new List<List<Line>>();
      List<List<double>> lengthsBranch = new List<List<double>>();


      for(int j = 0; j < iDivider.Branch(i).Count; j++){
        List<Line> lines = new List<Line>();
        List<double> lengths = new List<double>();


        for(int k = 0; k < iMeshCenter.Branch(i).Count; k++){
          Line line = new Line(iDivider.Branch(i)[j], iMeshCenter.Branch(i)[k]);
          double length = line.Length;

          lines.Add(line);
          lengths.Add(length);
        }

        linesBranch.Add(lines);
        lengthsBranch.Add(lengths);
      }


      allLines.Add(linesBranch);
      allLengths.Add(lengthsBranch);
    }


    AllLines = allLines;
    AllLines = allLengths;


    AllLines = ListOfListsOfListsToTree(allLines);
    AllLengths = ListOfListsOfListsToTree(allLengths);
# ---------- c_script_3: C# additional code ----------
  List<List<List<Line>>> allLines = new List<List<List<Line>>>();
  List<List<List<double>>> allLengths = new List<List<List<double>>>();



  DataTree<T> ListOfListsOfListsToTree<T>(List<List<List<T>>> list){
  DataTree<T> tree = new DataTree<T>();
  int i = 0;
  int j = 0;

  foreach(List<List<T>> innerList in list){
  foreach(List<T> innestList in innerList){
tree.AddRange(innestList, new GH_Path(new int[]{i,j}));
        j++;
        }
      i++;
      }
     return tree;
   }
# ---------- end c_script_3 ----------
c_script_4 = CSharpScript()  # -> out, A
# ---------- c_script_4: C# ----------
    //ListOfListsToTree("name of listof list");
# ---------- c_script_4: C# additional code ----------
  static Grasshopper.DataTree<T> ListOfListsToTree<T > (List < List < T >> s){
  Grasshopper.DataTree<T> tree = new DataTree<T>();
  for(int i = 0;i < s.Count; i++){
  tree.AddRange(s[i], new GH_Path(i));
}
      return tree;
    }
# ---------- end c_script_4 ----------

boolean_toggle = BooleanToggle(False)
button = Button()
c_script_5 = CSharpScript(iReset=button, iRun=boolean_toggle)  # -> out, A; inputs iReset: Boolean, iRun: Boolean
# ---------- c_script_5: C# ----------
    if(iReset){
      counter = 0.0;}
    
    if(iRun){
      counter += 0.1;
    }
    A = counter;
# ---------- c_script_5: C# additional code ----------
  double counter = 0.0;
# ---------- end c_script_5 ----------
panel_3 = Panel(c_script_5.A)

file_path_2 = FilePath("C:\Users\User\Desktop\Thesis Drive\Graphics\2_Animation\200430\Animation_Agent Nodes\")
panel_4 = Panel(file_path_2)
c_script_6 = CSharpScript(iReset=button, iStart=boolean_toggle, Path=panel_4, Name="image", iFrames=Slider(300, range=0..1700))  # -> out; inputs iReset: Boolean, iStart: Boolean, Path: String, Name: String, iFrames: Int32
# ---------- c_script_6: C# ----------
    if(iReset) counter = 0;

    if(iStart) {
      var view = doc.Views.ActiveView;
      var view_capture = new ViewCapture
        {
          Width = view.ActiveViewport.Size.Width,
          Height = view.ActiveViewport.Size.Height,
          ScaleScreenItems = false,
          DrawAxes = false,
          DrawGrid = false,
          DrawGridAxes = false,
          TransparentBackground = false
          };

      if(counter < iFrames){
        var screenshot = view_capture.CaptureToBitmap(view);
        if(screenshot != null)
        {
          string filename = Path + Name + counter + ".png";
          screenshot.Save(filename, System.Drawing.Imaging.ImageFormat.Png);
          Print("Count: " + counter);
          counter += 1;
        }
      }
    }
# ---------- c_script_6: C# additional code ----------
    int counter = 0;
# ---------- end c_script_6 ----------
panel_5 = Panel(c_script_6)

# ----
# Loop/iterate through Data Tree
c_script_7 = CSharpScript()  # -> out, A; inputs x: tree
# ---------- c_script_7: C# ----------
    for(int i = 0; i < x.BranchCount; i++){
      for(int j = 0; j < x.Branch(i).Count; j++){
        
      }
    }
# ---------- end c_script_7 ----------

# ----
# Squish command calling
toggle = BooleanToggle(True)  # disabled
id = Guid(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)  # disabled
python = PythonScript(geo=id, squish=toggle)  # -> out, a; inputs squish: Boolean; disabled
# ---------- python: Python ----------
import rhinoscriptsyntax as rs

if squish:
    rs.Command("_-Squish _SelId %s _Enter _Enter" % geo)
# ---------- end python ----------
toggle_2 = BooleanToggle(False)  # disabled
brep = Brep([<brep referenced from the Rhino model> x3])  # disabled
lng = ListLength(List=brep)  # disabled
panel_6 = Panel("0.5,0.5")  # disabled
id_2 = Guid(brep)  # disabled
series = Series(Start=0, Step=1, Count=lng)  # disabled
python_2 = PythonScript(ids=id_2, squish=toggle_2)  # -> out, squishedObjs; inputs ids: list, squish: Boolean; disabled
# ---------- python_2: Python ----------
import rhinoscriptsyntax as rs
import scriptcontext as sc
import Rhino

if squish:
    sc.doc = Rhino.RhinoDoc.ActiveDoc
    rs.EnableRedraw(False)
    squishedIdsMoved = []
    squishedObjs = []
    echo = False
    for i,id in enumerate(ids):
        rs.Command("_-Squish _SelId %s _Decorate=Yes _Enter _Enter" % id, echo)
        squishedId = rs.FirstObject()
        squishedIdMoved = rs.MoveObject(squishedId, [i*20,0,0])
        squishedIdsMoved.append(squishedIdMoved)
        squishedObj = sc.doc.Objects.Find(squishedIdMoved).Geometry
        squishedObjs.append(squishedObj)
    rs.DeleteObjects(squishedIdsMoved)
    rs.EnableRedraw(True)
    sc.doc = ghdoc
# ---------- end python_2 ----------
evalsrf = EvaluateSurface(Surface=reparameterize(brep), Point=panel_6)  # -> Point, Normal, Frame; disabled
int = Integer(series)  # disabled
tag = TextTag(Location=evalsrf.Point, Text=int)  # disabled
