# Grasshopper definition Utilities_Fractal Branching.gh (Grasshopper 1.0.7)
# plug-ins: Anemone, Weaverbird

curve = Curve([<curve referenced from the Rhino model> x4])
loft = Loft(Curves=curve, Options={Adjust=False, Closed=False, LoftEnds=0, LoftSimp=0, LoftType=0, Rebuild=10, Refit=0.01})
deconstruct_brep = DeconstructBrep(Brep=loft)  # -> Faces, Edges, Vertices
area = Area(Geometry=loft)  # -> Area, Centroid
vector_2pt = Vector2Pt(PointA=deconstruct_brep.Vertices, PointB=area.Centroid, Unitize=False)  # -> Vector, Length
amplitude = Amplitude(Vector=vector_2pt.Vector, Amplitude=Slider(2.31, range=0..10))
move = Move(Geometry=deconstruct_brep.Vertices, Motion=amplitude)  # -> Geometry, Transform
curve_2 = Curve([<curve referenced from the Rhino model> x4])

number_slider = Slider(10, range=0..100)  # disabled
B = Base(PlaneXY(0, 0, 0))  # disabled
number_slider_2 = Slider(3, range=0..10)  # disabled
sph = Sphere(Base=B, Radius=number_slider)  # disabled
popgeo = PopulateGeometry(Geometry=sph, Count=number_slider_2, Seed=1)  # disabled
ln = Line(StartPoint=B, EndPoint=popgeo)  # disabled

B_2 = Base(PlaneXY(0, 0, 0))
sph_2 = Sphere(Base=B_2, Radius=Slider(10, range=0..100))
popgeo_2 = PopulateGeometry(Geometry=sph_2, Count=Slider(3, range=0..10), Seed=1)
ln_2 = Line(StartPoint=B_2, EndPoint=popgeo_2)

surface_closest_point = SurfaceClosestPoint(Point=move.Geometry, Surface=loft)  # -> Point, UVPoint, Distance
line = Line(StartPoint=deconstruct_brep.Vertices, EndPoint=surface_closest_point.Point)
loft_2 = Loft(Curves=curve_2, Options={Adjust=False, Closed=False, LoftEnds=0, LoftSimp=0, LoftType=0, Rebuild=10, Refit=0.01})

# ---- group: initial line
line_2 = Line(ln)  # disabled

# ----
separation = Slider(0.617, range=0..1)

# ---- group: initial line
line_3 = Line(line)

# ----
number_slider_3 = Slider(1, range=0..10)
distance = Slider(0.364, range=0..1)
loop_start = LoopStart(Repeat=Slider(4, range=0..10), Trigger=Button(), Data=line_3)  # -> port, Counter, Data
end = EndPoints(Curve=loop_start.Data)  # -> Start, End
vec2pt = Vector2Pt(PointA=end.Start, PointB=end.End, Unitize=False)  # -> Vector, Length
multiplication = Multiplication(A=vec2pt.Length, B=separation)
surface_closest_point_2 = SurfaceClosestPoint(Point=end.End, Surface=loft)  # -> Point, UVPoint, Distance
circle = CircleCNR(Center=end.End, Normal=vec2pt.Vector, Radius=multiplication)
evaluate_surface = EvaluateSurface(Surface=loft, Point=surface_closest_point_2.UVPoint)  # -> Point, Normal, UDirection, VDirection, Frame
multiplication_2 = Multiplication(A=vec2pt.Vector, B=distance)
circle_cnr = CircleCNR(Center=end.End, Normal=evaluate_surface.Normal, Radius=multiplication)
domain = Panel("0.0 to 0.5")
random_seeder_from_counter = Integer(loop_start.Counter)
move_2 = Move(Geometry=circle_cnr, Motion=multiplication_2)  # -> graft(Geometry), Transform
lng = ListLength(List=move_2.Geometry)
random = Random(Range=domain, Number=lng, Seed=random_seeder_from_counter)
addition = Addition(A=random, B=Slider(0.5, range=0..1))
eval = EvaluateLength(Curve=move_2.Geometry, Length=[random, addition], Normalized=True)  # -> Point, Tangent, Parameter
surface_closest_point_3 = SurfaceClosestPoint(Point=eval.Point, Surface=loft)  # -> Point, UVPoint, Distance
ln_3 = Line(StartPoint=graft(end.End), EndPoint=surface_closest_point_3.Point)
loop_end = LoopEnd(port=loop_start.port, Exit=False, Data=ln_3, TimeOutVal=0, pausedState=False, state="Constant & Record")
merge = Merge(Data1=line_3, Data2=flatten(loop_end))

# ---- group: press play to parse data
dam = DataDam(DataA=merge, BufferDelay=10000000, BufferMode=1)

# ----
flatten = FlattenTree(Tree=dam, Path="{0}")
panel = Panel("0.1 to 0.45")  # disabled
number_slider_4 = Slider(36, range=0..100)  # disabled
xy = XYPlane(Origin=Point(0, 0, 0))  # disabled
end_2 = EndPoints(Curve=flatten)  # -> Start, End
number_slider_5 = Slider(36, range=0..100)
xy_2 = XYPlane(Origin=Point(0, 0, 0))
entwine = Entwine(Branch00=end_2.Start, Branch01=end_2.End, FlattenInputs=True)
remap = RemapNumbers(Source=Domain(0, 1), Target=panel)  # -> Mapped, Clipped; disabled
remap_2 = RemapNumbers(Source=Domain(0, 1), Target="0.1 to 0.45")  # -> Mapped, Clipped
number_slider_6 = Slider(4, range=0..10)  # disabled
number_slider_7 = Slider(0.3, range=0..1)  # disabled
number_slider_8 = Slider(1, range=0..10)  # disabled
bang = ExplodeTree(Data=remap.Mapped)  # -> flatten(Branch0), flatten(Branch1); disabled
number_slider_9 = Slider(4, range=0..10)
number_slider_10 = Slider(0.3, range=0..1)
number_slider_11 = Slider(1, range=0..10)
bang_2 = ExplodeTree(Data=remap_2.Mapped)  # -> flatten(Branch0), flatten(Branch1)
wblaplace = WeaverbirdsLaplacianSmoothing(Level=1, SmoothNakedEdges=1, Thin=1)  # disabled
wblaplace_2 = WeaverbirdsLaplacianSmoothing(Level=1, SmoothNakedEdges=1, Thin=1)
wbcatmullclark = WeaverbirdsCatmullClarkSubdivision(MeshCurves=wblaplace, Level=1, SmoothNakedEdges=1)  # disabled
wbcatmullclark_2 = WeaverbirdsCatmullClarkSubdivision(MeshCurves=wblaplace_2, Level=1, SmoothNakedEdges=1)

button = Button()  # disabled
number_slider_12 = Slider(10, range=0..10)  # disabled
separation_2 = Slider(0.617, range=0..1)  # disabled
distance_2 = Slider(0.364, range=0..1)  # disabled
domain_2 = Panel("0.0 to 0.5")  # disabled
number_slider_13 = Slider(0.5, range=0..1)  # disabled

loop_start_2 = LoopStart(Repeat=number_slider_12, Trigger=button, Data=line_2)  # -> port, Counter, Data; disabled

end_3 = EndPoints(Curve=loop_start_2.Data)  # -> Start, End; disabled
vec2pt_2 = Vector2Pt(PointA=end_3.Start, PointB=end_3.End, Unitize=False)  # -> Vector, Length; disabled
multiplication_3 = Multiplication(A=vec2pt_2.Length, B=separation_2)  # disabled
multiplication_4 = Multiplication(A=vec2pt_2.Vector, B=distance_2)  # disabled
circle_2 = CircleCNR(Center=end_3.End, Normal=vec2pt_2.Vector, Radius=multiplication_3)  # disabled
random_seeder_from_counter_2 = Integer(loop_start_2.Counter)  # disabled
move_3 = Move(Geometry=circle_2, Motion=multiplication_4)  # -> graft(Geometry), Transform; disabled
lng_2 = ListLength(List=move_3.Geometry)  # disabled
random_2 = Random(Range=domain_2, Number=lng_2, Seed=random_seeder_from_counter_2)  # disabled
addition_2 = Addition(A=random_2, B=number_slider_13)  # disabled
eval_2 = EvaluateLength(Curve=move_3.Geometry, Length=[random_2, addition_2], Normalized=True)  # -> Point, Tangent, Parameter; disabled
ln_4 = Line(StartPoint=graft(end_3.End), EndPoint=eval_2.Point)  # disabled

loop_end_2 = LoopEnd(port=loop_start_2.port, Exit=False, Data=ln_4, TimeOutVal=0, pausedState=False, state="Constant & Record")  # disabled
merge_2 = Merge(Data1=line_2, Data2=flatten(loop_end_2))  # disabled

# ---- group: press play to parse data
dam_2 = DataDam(DataA=merge_2, BufferDelay=10000000, BufferMode=1)  # disabled

# ----
flatten_2 = FlattenTree(Tree=dam_2, Path="{0}")  # disabled
end_4 = EndPoints(Curve=flatten_2)  # -> Start, End; disabled
entwine_2 = Entwine(Branch00=end_4.Start, Branch01=end_4.End, FlattenInputs=True)  # disabled
