# Grasshopper definition Utilities_Gyroid Surface.gh (Grasshopper 1.0.7)
# plug-ins: Millipede

number_slider = Slider(14, range=0..100)  # disabled
panel = Panel("cos(x)+cos(y)+cos(z)")  # disabled
panel_2 = Panel("cos(x)*sin(y)+cos(y)*sin(z)+cos(z)*sin(x)")  # disabled
range = Range(Domain=Domain(-3.141592654, 3.141592654), Steps=number_slider)  # disabled
cross_reference = CrossReference(ListListA=range, ListListB=range, ListA=range, CrossMode=1)  # -> ListListA, ListListB, ListA; disabled
box = Box({Plane=PlaneXY(29.22284206, -0.5686024694, -1.125280471), X=Domain(0, 4), Y=Domain(0, 4), Z=Domain(0, 4)})  # disabled
area = Area(Geometry=box)  # -> Area, Centroid; disabled
deconstruct = Deconstruct(Point=area.Centroid)  # -> XComponent, YComponent, ZComponent; disabled
addition = Addition(A=cross_reference.ListA, B=deconstruct.ZComponent)  # disabled
addition_2 = Addition(A=cross_reference.ListListA, B=deconstruct.XComponent)  # disabled
addition_3 = Addition(A=cross_reference.ListListB, B=deconstruct.YComponent)  # disabled
number_slider_2 = Slider(1, range=0..1)  # disabled
evaluate = Evaluate(Expression=panel, x=addition_2, y=addition_3, z=addition)  # disabled
construct_point = ConstructPoint(XCoordinate=addition_2, YCoordinate=addition_3, ZCoordinate=addition)  # disabled
number_slider_3 = Slider(0.14, range=0..1)  # disabled
addition_4 = Addition(A=number_slider, B=number_slider_2)  # disabled
boolean_toggle = BooleanToggle(True)  # disabled
iso_surface = IsoSurface(
    Box=box,
    Values=evaluate,
    XResolution=addition_4,
    YResolution=addition_4,
    ZResolution=addition_4,
    IsoValue=number_slider_3,
    MergeVertices=boolean_toggle)  # disabled
