# Grasshopper definition Utilities_Mesh Machine.gh (Grasshopper 1.0.7)
# plug-ins: Kangaroo Components, PlanktonGh

# Mesh Machine tries to make all edges equal length.
# The script might break if the desired length is too long/short and it cannot find a solution to equalise the line.
mesh = Mesh(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)
nakedvertices = NakedVertices(Mesh=mesh)  # -> ClothedIndex, NakedIndex, ClothedPts, NakedPts
geometry = Geometry(nakedvertices.NakedPts)
timer = Timer(TimerInterval=1000, Target=meshmachine)  # disabled
meshmachine = MeshMachine(
    Geometry=mesh,
    Length=Slider(104, range=0..1000),
    FixVertices=geometry,
    Flip=1,
    PullStrength=0.8,
    CurvatureAdaptivity=0,
    BoundaryScale=1,
    BoundaryDistance=5,
    Exponent=2,
    Background=0.5,
    Iterations=1,
    Reset=Toggle(False))
planktonmesh = PlanktonMesh(meshmachine)
mesh_edges = MeshEdges(Mesh=planktonmesh)  # -> NakedEdges, InteriorEdges, NonManifoldEdges
