# Grasshopper definition Utilities_Shrink Wrap.gh (Grasshopper 1.0.7)
# plug-ins: MeshEdit Components, Weaverbird, Kangaroo2 Components

geometry = Geometry([<curve referenced from the Rhino model> x2])
brep = Brep(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)
debrep = DeconstructBrep(Brep=brep)  # -> Faces, Edges, Vertices
convexhull = _3DConvexHull(Points=debrep.Vertices)
bounding_box = BoundingBox(Content=geometry, Plane=PlaneXY(0, 0, 0), UnionBox=True)  # -> Box, Box_2
wbtriangles = WeaverbirdsSplitTrianglesSubdivision(MeshCurves=convexhull, Level=3)
divide_curve = DivideCurve(Curve=geometry, Count=Slider(37, range=0..100), Kinks=False)  # -> Points, Tangents, Parameters
convexhull_2 = _3DConvexHull(Points=flatten(divide_curve.Points))
end_points = EndPoints(Curve=geometry)  # -> Start, End
mesh_box = MeshBox(Base=bounding_box.Box, XCount=10, YCount=10, ZCount=10)
geometry_2 = Geometry(debrep.Edges)
geometry_3 = Geometry(flatten([end_points.Start, end_points.End]))
wbtriangles_2 = WeaverbirdsSplitTrianglesSubdivision(MeshCurves=convexhull_2, Level=3)
wbtriangles_3 = WeaverbirdsSplitTrianglesSubdivision(MeshCurves=mesh_box, Level=3)
mesh_edges = MeshEdges(Mesh=wbtriangles)  # -> NakedEdges, InteriorEdges, NonManifoldEdges
simpleremesh = SimpleRemesh(Geometry=wbtriangles_2, Length=1, Creases=geometry, Corners=flatten(divide_curve.Points), Steps=50)
simpleremesh_2 = SimpleRemesh(Geometry=wbtriangles, Length=1, Creases=debrep.Edges, Corners=debrep.Vertices, Steps=50)
demesh = DeconstructMesh(Mesh=simpleremesh)  # -> graft(Vertices), Faces, Colours, Normals
demesh_2 = DeconstructMesh(Mesh=simpleremesh_2)  # -> graft(Vertices), Faces, Colours, Normals
deconstruct_mesh = DeconstructMesh(Mesh=wbtriangles_3)  # -> Vertices, Faces, Colours, Normals
crv_cp = CurveClosestPoint(Point=demesh_2.Vertices, Curve=debrep.Edges)  # -> Point, Parameter, Distance
closest_point = ClosestPoint(Point=divide_curve.Points, Cloud=flatten(demesh.Vertices))  # -> ClosestPoint, CPIndex, Distance
sort = SortList(Keys=crv_cp.Distance)  # -> Keys, ValuesA
item = ListItem(List=sort.Keys, Index=0, Wrap=True)
edgelengths = EdgeLengths(Mesh=simpleremesh, LengthFactor=Slider(0.173, range=0..1), Strength=1)
anchor = Anchor(Point=flatten(closest_point.ClosestPoint), Target=flatten(divide_curve.Points), Strength=10000)
smaller = SmallerThan(FirstNumber=item, SecondNumber=0.1)  # -> SmallerThan, OrEqualTo
show = Show(G=simpleremesh)
cull = CullPattern(List=flatten(demesh_2.Vertices), CullPattern=flatten(smaller.SmallerThan))
edgelengths_2 = EdgeLengths(Mesh=simpleremesh_2, LengthFactor=Slider(0.173, range=0..1), Strength=1)
spc = SolidPointCollide(Points=flatten(demesh_2.Vertices), Solid=brep, Interior=False, Unidirectional=True, Strength=100)
show_2 = Show(G=simpleremesh_2)
anchor_2 = Anchor(Point=cull, Strength=1e+14)
solver = Solver(GoalObjects=flatten([edgelengths, show, anchor]), Reset=Button(), Threshold=1e-15, Tolerance=0.01, On=Toggle(False))  # -> I, V, O
solver_2 = Solver(GoalObjects=[anchor_2, edgelengths_2, show_2, spc], Reset=Button(), Threshold=1e-15, Tolerance=0.01, On=Toggle(False))  # -> I, V, O
mesh = Mesh(solver.O)
mesh_2 = Mesh(solver_2.O)
mesh_edges_2 = MeshEdges(Mesh=mesh)  # -> NakedEdges, InteriorEdges, NonManifoldEdges
custom_preview = CustomPreview(
    Geometry=mesh,
    Material={diffuse=RGB(221, 160, 221), emission=RGB(66, 48, 66), shine=0.5, specular=RGB(255, 255, 255), transparency=0})
