# Grasshopper definition Utilities_Timer.gh (Grasshopper 1.0.7)

timer = Timer(TimerInterval=20, Target=c_script)
c_script = CSharpScript(iReset=Toggle(False), y=Slider(0.2, range=0..1))  # -> out, A; inputs iReset: Boolean, y: Double
# ---------- c_script: C# ----------
    if(iReset){
      x += y;
    }
    A = x;
# ---------- c_script: C# additional code ----------
  double x;
# ---------- end c_script ----------
panel = Panel(c_script.A)
