# Grasshopper definition Utilities_Unroll and Nest Developable Surface.gh (Grasshopper 1.0.7)
# plug-ins: OpenNest, LunchBox

# ---- group: Input Geometry
brep = Brep(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)

# ----
# Unroll_ only works for developable surface
deconstruct_brep = DeconstructBrep(Brep=brep)  # -> Faces, Edges, Vertices
unroll_brep = UnrollBrep(Brep=deconstruct_brep.Faces, JoinUnrolled=False)
brep_wireframe = BrepWireframe(Brep=unroll_brep, Density=-1)
join_curves = JoinCurves(Curves=brep_wireframe, Preserve=False)  # -> flatten(Curves)

# ---- group: Spacing between nested objects
number_slider = Slider(0.4, range=0..1)

# ---- group: Sheets to lay on(curve only)
# nesting, moving flatten curves onto sheets
crv = Curve(<curve referenced from the Rhino model>)

# ----
opennest = OpenNest(
    Sheets=crv,
    Geo=join_curves,
    Spacing=number_slider,
    Placement=1,
    Tolerance=0.1,
    Rotations=4,
    Iterations=1,
    Seed=1,
    Reset=True,
    Run=False)  # -> Sheets, Geo, ID, Transform, IDS
transform = Transform(Geometry=join_curves, Transform=opennest.Transform)
boundary_surfaces = BoundarySurfaces(Edges=opennest.Geo)

number_slider_2 = Slider(0.6, range=0..1)
area = Area(Geometry=[boundary_surfaces, deconstruct_brep.Faces])  # -> Area, Centroid
