# Grasshopper definition Utilities_WriteToExcel_tttoolbox_re.gh (Grasshopper 0.9.76)
# plug-ins: CORE.GH

pt = Point(Tree({0;0;0}: [Point(5.347419373, 1.847792495, 17.02772055)], {0;0;1}: [Point(10.5871671, 19.34127501, 36.31050841)], {0;0;2}: [Point(21.43380631, 22.28572337, 13.19089711)], {0;0;3}: [Point(2.371956537, 21.18459408, 5.978336521)], {0;0;4}: [Point(13.97871972, -0.06431797995, 36.21701305)], {0;0;5}: [Point(21.06736775, 7.082549735, 0.4807764617)]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))
panel = Panel(pt)
pdecon = Deconstruct(Point=pt)  # -> XComponent, YComponent, ZComponent
entwine = Entwine(Branch00=pdecon.XComponent, Branch01=pdecon.YComponent, Branch02=pdecon.ZComponent, FlattenInputs=True)
viewer = ParamViewer(entwine)

# ---- group: Input Your File Path
panel_2 = Panel("")

# ----
tstat = TreeStatistics(Tree=entwine)  # -> Paths, Length, Count
item = ListItem(List=tstat.Length, Index=0, Wrap=True)
series = Series(Start="1", Step=1, Count=item)
wo = WriteOptions(
    FilePath=panel_2,
    ClearDataOverwrite=True,
    SaveAfterWrite=Toggle(True),
    CloseAfterWrite=Toggle(False),
    ColumnStartPosition=Slider(1, range=0..10),
    RowStartPosition=Slider(1, range=0..10))  # -> UserMessages, WriteOptions
int = Integer(series)
writexl = WriteToExcel(
    Run=Toggle(False),
    ExcelWorksheet="1",
    ColumnNames=tstat.Paths,
    RowNames=int,
    WriteOptions=wo.WriteOptions,
    ColumnnsOrRows=Toggle(False),
    DataToWriteIntoColumns=entwine)
