# Grasshopper definition Utilities_developable_strips_tutorial_k2.gh (Grasshopper 1.0.7)
# plug-ins: MeshEdit Components, Kangaroo2 Components

# Kangaroo unrolling example
# Unroll a mesh into strips
mesh = Mesh(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)
refine = Refine(Mesh=mesh, Level="2")
clean = CombineClean(Meshes=refine)
md = MeshDirection(Mesh=clean)
turn = MeshTurn(Mesh=md)
mesh_2 = Mesh(md)
strips = RefineStrips(Mesh=mesh_2, Level="3")
strength = Strength(0.1)
warpweft = WarpWeft(Mesh=strips)  # -> Warp, Weft, NakedA, NakedB
medges = MeshEdges(Mesh=mesh_2)  # -> NakedEdges, InteriorEdges, NonManifoldEdges
multiplication = Multiplication(A=strength, B=64)
planarize = Planarize(M=strips, Strength=100)
join = JoinCurves(Curves=medges.NakedEdges, Preserve=False)
length = Length(0)
explode = Explode(Curve=join, Recursive=True)  # -> Segments, Vertices
length_line = LengthLine(Line=warpweft.Warp, Length=length, Strength=strength)
length_line_2 = LengthLine(Line=warpweft.Weft, Length=length, Strength=multiplication)
end = EndPoints(Curve=explode.Segments)  # -> Start, End
fcircle = CircleFit(Points=end.Start)  # -> Circle, Radius, Deviation
equallength = EqualLength(Line=explode.Segments, Strength=1)
oncurve = OnCurve(Points=end.Start, Curve=fcircle.Circle, Strength=100)
show = Show(G=strips)
entwine = Entwine(Branch00=show, Branch01=[length_line, length_line_2, oncurve, planarize, equallength], FlattenInputs=True)
solver = Solver(GoalObjects=entwine, Reset=Button(), Threshold=1e-15, Tolerance=0.01, On=True)  # -> I, V, O
bang = ExplodeTree(Data=solver.O)  # -> Branch0, Branch1
mesh_3 = Mesh(bang.Branch0)
# Wait until the solver shows 'converged'
dam = DataDam(DataA=mesh_3, BufferDelay=10000000, BufferMode=0)
# Data Dams can be used
# to avoid having the
# whole layout process
# recalculate continuously
# as Kangaroo is solving.
stripper = Stripper(Mesh=dam)
unroller = Unroller(Strip=stripper, Unroll=Slider(1, range=0..1))  # -> graft(Unrolled)
dam_2 = DataDam(DataA=unroller, BufferDelay=10000000, BufferMode=0)

# ---- group: laying out
explode_2 = MeshExplode(Mesh=dam_2, Interpolate=False)
item = ListItem(List=explode_2, Index=0, Wrap=True)
item_2 = ListItem(List=explode_2, Index=-1, Wrap=True)
facen = FaceNormals(Mesh=item)  # -> Centers, Normals
facen_2 = FaceNormals(Mesh=item_2)  # -> Centers, Normals
pl = PlaneNormal(Origin=facen.Centers, ZAxis=facen.Normals)
vec2pt = Vector2Pt(PointA=facen.Centers, PointB=facen_2.Centers, Unitize=False)  # -> Vector, Length
align = AlignPlane(Plane=pl, Direction=vec2pt.Vector)  # -> flatten(Plane), Angle
bbox = BoundingBox(Content=dam_2, Plane=graft(align.Plane))  # -> flatten(Box), Box_2
box_corners = BoxCorners(Box=bbox.Box)  # -> CornerA, CornerB, CornerC, CornerD, CornerE, CornerF, CornerG, CornerH
pl_origin = PlaneOrigin(Base=align.Plane, Origin=box_corners.CornerD)
debox = DeconstructBox(Box=bbox.Box)  # -> Plane, X, Y, Z
dedomain = DeconstructDomain(Domain=debox.Y)  # -> Start, End
subtraction = Subtraction(A=dedomain.End, B=dedomain.Start)
ma = MassAddition(Input=subtraction)  # -> Result, PartialResults
xy = XYPlane(Origin=Point(0, 0, 0))
X = UnitX(Factor=ma.PartialResults)
rotate = Rotate(Geometry=xy, Angle=1.570796327, Plane=PlaneXY(0, 0, 0))  # -> Geometry, Transform
neg = Negative(Value=X)
move = Move(Geometry=rotate.Geometry, Motion=neg)  # -> Geometry, Transform
pln = Plane(move.Geometry)

# ----
orient = Orient(Geometry=flatten(dam_2), Source=pl_origin, Target=pln)  # -> Geometry, Transform
mesh_4 = Mesh(orient.Geometry)
