# Grasshopper definition 200223_Inflate to Shape_Arches.gh (Grasshopper 1.0.7)
# plug-ins: MarchingCubes, MeshEdit Components, Pufferfish, LunchBoxML, Kangaroo Components, OpenNest, PlanktonGh, LunchBox, Weaverbird, Kangaroo2 Components, TT Toolbox

number_slider = Slider(40, range=0..100)  # disabled
curve = Curve([<curve referenced from the Rhino model> x25])  # disabled

curve_2 = Curve(<curve referenced from the Rhino model>)  # disabled
number_slider_2 = Slider(143, range=0..1000)  # disabled
number_slider_3 = Slider(4, range=0..10)  # disabled
divide_length = DivideLength(Curve=curve_2, Length=number_slider_2)  # -> Points, Tangents, Parameters; disabled
cluster = Cluster(curve=curve_2, A=number_slider_2, list=divide_length.Points)  # -> result, result_2; disabled
panel = Panel(cluster.result)  # disabled
panel_2 = Panel(cluster.result_2)  # disabled
divide_curve = DivideCurve(Curve=curve_2, Count=number_slider_3, Kinks=False)  # -> Points, Tangents, Parameters; disabled

# ----
# Varying Stiffness SImulation
# (Didn't Work)
# Trying to model yulia's thesis  on how varying stiffness of a surface when inflated will take a desired/programmed shape.
# Step: Draw Pipe
diameter = Slider(100, range=0..100)  # disabled
curve_3 = Curve(<curve referenced from the Rhino model>)  # disabled

number_slider_4 = Slider(4, range=0..10)  # disabled
# SINGLE ARCH SIMULATION (WORKED)
curve_4 = Curve(<curve referenced from the Rhino model>)  # disabled
divide_curve_2 = DivideCurve(Curve=curve_4, Count=number_slider_4, Kinks=False)  # -> Points, Tangents, Parameters; disabled
number_slider_5 = Slider(20, range=0..100)  # disabled
polyline = PolyLine(Vertices=divide_curve_2.Points, Closed=False)  # disabled
pipe = Pipe(Curve=polyline, Radius=number_slider_5, Caps=0)  # disabled

number_slider_6 = Slider(0, range=0..1)  # disabled
number_slider_7 = Slider(137, range=0..1000)  # disabled
# Step2: Evaluation
number_slider_8 = Slider(40, range=0..100)  # disabled
curvature = Curvature(Curve=reparameterize(curve_3), Parameter=number_slider_6)  # -> Point, Curvature, Curvature_2; disabled
curvature_graph = CurvatureGraph(Curve=curve_3, Density=number_slider_8, Scale=number_slider_7)  # disabled

surface = Surface(<surface referenced from the Rhino model>)  # disabled
explode = Explode(Curve=curve, Recursive=True)  # -> Segments, Vertices; disabled

number_slider_9 = Slider(4, range=0..10)  # disabled
# DOUBLE ARCH SIMULATION (WORKED)
curve_5 = Curve(<curve referenced from the Rhino model>)  # disabled
divide_curve_3 = DivideCurve(Curve=curve_5, Count=number_slider_9, Kinks=False)  # -> Points, Tangents, Parameters; disabled
number_slider_10 = Slider(20, range=0..100)  # disabled
polyline_2 = PolyLine(Vertices=divide_curve_3.Points, Closed=False)  # disabled
pipe_2 = Pipe(Curve=polyline_2, Radius=number_slider_10, Caps=0)  # disabled

number_slider_11 = Slider(4, range=0..10)  # disabled
curve_6 = Curve(<curve referenced from the Rhino model>)  # disabled
divide_curve_4 = DivideCurve(Curve=curve_6, Count=number_slider_11, Kinks=False)  # -> Points, Tangents, Parameters; disabled
number_slider_12 = Slider(20, range=0..100)  # disabled
polyline_3 = PolyLine(Vertices=divide_curve_4.Points, Closed=False)  # disabled
pipe_3 = Pipe(Curve=polyline_3, Radius=number_slider_12, Caps=0)  # disabled

pi = Pi(Factor=1)  # disabled
multiplication = Multiplication(A=diameter, B=pi)  # disabled
integer = Integer(multiplication)  # disabled

interpolate = Interpolate(Vertices=explode.Vertices, Degree=3, Periodic=False, KnotStyle=1)  # -> Curve, Length, Domain; disabled

number_slider_13 = Slider(25, range=0..100)  # disabled
curve_charge = CurveCharge(Curve=flatten(interpolate.Curve), Radius=number_slider, ChargeStrengths=number_slider_13)  # disabled
number_slider_14 = Slider(1, range=0..100)  # disabled
number_slider_15 = Slider(25, range=0..100)  # disabled
boolean_toggle = BooleanToggle(True)  # disabled
cocoon = Cocoon(Charges=curve_charge, Iso=number_slider_14, CellSize=number_slider_15, Execute=boolean_toggle, Simple=False)  # -> Mesh, RefinementData; disabled
mesh_edges = MeshEdges(Mesh=cocoon.Mesh)  # -> NakedEdges, InteriorEdges, NonManifoldEdges; disabled

number_slider_16 = Slider(300, range=0..1000)  # disabled
divide_length_2 = DivideLength(Curve=flatten(interpolate.Curve), Length=number_slider_16)  # -> Points, Tangents, Parameters; disabled
end_points = EndPoints(Curve=flatten(interpolate.Curve))  # -> Start, graft(End); disabled
point = Point([divide_length_2.Points, end_points.End])  # disabled
sort_along_curve = SortAlongCurve(Points=point, Curve=graft(interpolate.Curve))  # -> Points, Indices; disabled
polyline_4 = PolyLine(Vertices=sort_along_curve.Points, Closed=False)  # disabled

pipe_4 = Pipe(Curve=interpolate.Curve, Radius=number_slider, Caps=0)  # disabled

division = Division(A=diameter, B=2)  # disabled
pipe_5 = Pipe(Curve=curve_3, Radius=division, Caps=0)  # disabled

number_slider_17 = Slider(40, range=0..100)  # disabled
number_slider_18 = Slider(6, range=0..10)  # disabled
surface_2 = Surface(pipe_5)  # disabled
divide_surface = DivideSurface(Surface=reparameterize(surface_2), UCount=number_slider_17, VCount=number_slider_18)  # -> Points, Normals, Parameters; disabled
principal_curvature = PrincipalCurvature(Surface=reparameterize(surface_2), Point=flatten(divide_surface.Parameters))  # -> Frame, Min, Max, MinDirection, MaxDirection; disabled
surface_curvature = SurfaceCurvature(Surface=reparameterize(surface_2), Point=flatten(divide_surface.Parameters))  # -> Frame, Gaussian, Mean; disabled
panel_3 = Panel(surface_curvature.Gaussian)  # disabled
plane = Plane(principal_curvature.Frame)  # disabled

divide_surface_2 = DivideSurface(Surface=reparameterize(surface), UCount=number_slider_17, VCount=number_slider_18)  # -> Points, Normals, Parameters; disabled

number_slider_19 = Slider(2, range=0..11)  # disabled
tree_branch = TreeBranch(Tree=simplify(polyline_4), Path=number_slider_19, MaintainPaths=True)  # disabled

plane_normal = PlaneNormal(Origin=point, ZAxis=divide_length_2.Tangents)  # disabled
number_slider_20 = Slider(120, range=0..1100)  # disabled
plane_surface = PlaneSurface(Plane=plane_normal, XSize=number_slider_20, YSize=number_slider_20)  # disabled
area = Area(Geometry=plane_surface)  # -> Area, Centroid; disabled
vector_2pt = Vector2Pt(PointA=area.Centroid, PointB=plane_normal, Unitize=False)  # -> Vector, Length; disabled
move = Move(Geometry=plane_surface, Motion=vector_2pt.Vector)  # -> flatten(Geometry), Transform; disabled

deconstruct_brep = DeconstructBrep(Brep=pipe)  # -> Faces, Edges, Vertices; disabled
number_slider_21 = Slider(0, range=0..100)  # disabled
ghpython_script = GhPythonScript(data=deconstruct_brep.Edges)  # -> out, a, b; inputs data: GeometryBase; disabled
# ---------- ghpython_script: Python ----------
import rhinoscriptsyntax as rs
import Rhino.Geometry as rg

lines = []
curves = []

if (data.IsLinear()):
    lines.append(data)
elif(data.IsArc() or data.IsPlanar()):
    curves.append(data)


a = lines
b = curves
# ---------- end ghpython_script ----------
geometry = Geometry(flatten(ghpython_script.b))  # disabled
geometry_2 = Geometry(ghpython_script.a)  # disabled
join_curves = JoinCurves(Curves=geometry, Preserve=False)  # disabled
rebuild_curve = RebuildCurve(Curve=join_curves, Count=10, Tangents=False)  # disabled
sort_curves_along_crv = SortCurvesAlongCrv(Curves=rebuild_curve, GuideCrv=curve_4, CrvParam=number_slider_21)  # -> SortedCurves, CurveIndex; disabled
shift_list = ShiftList(List=sort_curves_along_crv.SortedCurves, Shift=1, Wrap=False)  # disabled
graft_tree = GraftTree(Tree=sort_curves_along_crv.SortedCurves, IncludeEmptyLists=True, IncludeNullItems=True)  # -> simplify(Tree); disabled
graft_tree_2 = GraftTree(Tree=shift_list, IncludeEmptyLists=True, IncludeNullItems=True)  # -> simplify(Tree); disabled
merge = Merge(Data1=graft_tree, Data2=graft_tree_2)  # disabled
number_slider_22 = Slider(14, range=0..100)  # disabled
number_slider_23 = Slider(12, range=0..100)  # disabled
loft = Loft(Curves=merge, Options={Adjust=True, Closed=False, LoftEnds=0, LoftSimp=0, LoftType=5, Rebuild=10, Refit=0.01})  # disabled
mesh_surface = MeshSurface(Surface=loft, UCount=number_slider_22, VCount=number_slider_23, Overhang=True, Equalize=False)  # disabled
mesh_edges_2 = MeshEdges(Mesh=mesh_surface)  # -> NakedEdges, InteriorEdges, NonManifoldEdges; disabled

brep_join = BrepJoin(Breps=flatten(loft))  # -> Breps, Closed; disabled
brep = Brep(brep_join.Breps)  # disabled

deconstruct_mesh = DeconstructMesh(Mesh=cocoon.Mesh)  # -> Vertices, Faces, Colours, Normals; disabled
number_slider_24 = Slider(45, range=0..100)  # disabled
create_rtree = CreateRTree(InputGeometry=flatten(deconstruct_mesh.Vertices))  # disabled
rtree_points_in_range = RTreePointsInRange(SearchPoints=flatten(divide_length_2.Points), SearchDistance=number_slider_24, RTree=create_rtree)  # -> PointsWithinRange, IndicesWithinRange; disabled

number_slider_25 = Slider(60, range=0..100)  # disabled
surface_3 = Surface(<surface referenced from the Rhino model>)  # disabled

deconstruct_brep_2 = DeconstructBrep(Brep=pipe_2)  # -> Faces, Edges, Vertices; disabled
number_slider_26 = Slider(0, range=0..100)  # disabled
ghpython_script_2 = GhPythonScript(data=deconstruct_brep_2.Edges)  # -> out, a, b; inputs data: GeometryBase; disabled; same code as ghpython_script
geometry_3 = Geometry(flatten(ghpython_script_2.b))  # disabled
geometry_4 = Geometry(ghpython_script_2.a)  # disabled
join_curves_2 = JoinCurves(Curves=geometry_3, Preserve=False)  # disabled
rebuild_curve_2 = RebuildCurve(Curve=join_curves_2, Count=10, Tangents=False)  # disabled
sort_curves_along_crv_2 = SortCurvesAlongCrv(Curves=rebuild_curve_2, GuideCrv=curve_5, CrvParam=number_slider_26)  # -> SortedCurves, CurveIndex; disabled
shift_list_2 = ShiftList(List=sort_curves_along_crv_2.SortedCurves, Shift=1, Wrap=False)  # disabled
graft_tree_3 = GraftTree(Tree=sort_curves_along_crv_2.SortedCurves, IncludeEmptyLists=True, IncludeNullItems=True)  # -> simplify(Tree); disabled
graft_tree_4 = GraftTree(Tree=shift_list_2, IncludeEmptyLists=True, IncludeNullItems=True)  # -> simplify(Tree); disabled
merge_2 = Merge(Data1=graft_tree_3, Data2=graft_tree_4)  # disabled
number_slider_27 = Slider(16, range=0..100)  # disabled
number_slider_28 = Slider(8, range=0..100)  # disabled
loft_2 = Loft(Curves=merge_2, Options={Adjust=True, Closed=False, LoftEnds=0, LoftSimp=0, LoftType=5, Rebuild=10, Refit=0.01})  # disabled
mesh_surface_2 = MeshSurface(Surface=loft_2, UCount=number_slider_28, VCount=number_slider_27, Overhang=True, Equalize=False)  # disabled
mesh_edges_3 = MeshEdges(Mesh=mesh_surface_2)  # -> NakedEdges, InteriorEdges, NonManifoldEdges; disabled

deconstruct_brep_3 = DeconstructBrep(Brep=pipe_3)  # -> Faces, Edges, Vertices; disabled
number_slider_29 = Slider(0, range=0..100)  # disabled
ghpython_script_3 = GhPythonScript(data=deconstruct_brep_3.Edges)  # -> out, a, b; inputs data: GeometryBase; disabled
# ---------- ghpython_script_3: Python ----------
import rhinoscriptsyntax as rs
import Rhino.Geometry as rg

lines = []
curves = []

if (data.IsLinear()):
    lines.append(data)
else:
    curves.append(data)


a = lines
b = curves
# ---------- end ghpython_script_3 ----------
geometry_5 = Geometry(ghpython_script_3.a)  # disabled
geometry_6 = Geometry(flatten(ghpython_script_3.b))  # disabled
join_curves_3 = JoinCurves(Curves=geometry_6, Preserve=False)  # disabled
rebuild_curve_3 = RebuildCurve(Curve=join_curves_3, Count=10, Tangents=False)  # disabled
sort_curves_along_crv_3 = SortCurvesAlongCrv(Curves=rebuild_curve_3, GuideCrv=curve_6, CrvParam=number_slider_29)  # -> SortedCurves, CurveIndex; disabled
shift_list_3 = ShiftList(List=sort_curves_along_crv_3.SortedCurves, Shift=1, Wrap=False)  # disabled
graft_tree_5 = GraftTree(Tree=sort_curves_along_crv_3.SortedCurves, IncludeEmptyLists=True, IncludeNullItems=True)  # -> simplify(Tree); disabled
graft_tree_6 = GraftTree(Tree=shift_list_3, IncludeEmptyLists=True, IncludeNullItems=True)  # -> simplify(Tree); disabled
merge_3 = Merge(Data1=graft_tree_5, Data2=graft_tree_6)  # disabled
number_slider_30 = Slider(16, range=0..100)  # disabled
number_slider_31 = Slider(8, range=0..100)  # disabled
loft_3 = Loft(Curves=merge_3, Options={Adjust=True, Closed=False, LoftEnds=0, LoftSimp=0, LoftType=5, Rebuild=10, Refit=0.01})  # disabled
mesh_surface_3 = MeshSurface(Surface=loft_3, UCount=number_slider_31, VCount=number_slider_30, Overhang=True, Equalize=False)  # disabled
mesh_edges_4 = MeshEdges(Mesh=mesh_surface_3)  # -> NakedEdges, InteriorEdges, NonManifoldEdges; disabled

# ----
# Unroll + Nest
unroll_brep = UnrollBrep(Brep=brep, JoinUnrolled=False)  # disabled
deconstruct_brep_4 = DeconstructBrep(Brep=brep)  # -> Faces, Edges, Vertices; disabled
brep_wireframe = BrepWireframe(Brep=unroll_brep, Density=-1)  # disabled
join_curves_4 = JoinCurves(Curves=brep_wireframe, Preserve=False)  # -> flatten(Curves); disabled
number_slider_32 = Slider(11, range=0..100)  # disabled
crv = Curve(<curve referenced from the Rhino model>)  # disabled
opennest = OpenNest(
    Sheets=crv,
    Geo=join_curves_4,
    Spacing=number_slider_32,
    Placement=1,
    Tolerance=0.1,
    Rotations=4,
    Iterations=1,
    Seed=1,
    Reset=True,
    Run=False)  # -> Sheets, Geo, ID, Transform, IDS; disabled
transform = Transform(Geometry=opennest.Geo, Transform=opennest.Transform)  # disabled

number_slider_33 = Slider(15, range=0..100)  # disabled
number_slider_34 = Slider(6, range=0..100)  # disabled

# ----
# Step2.5: correlate curvature to straight pipe
mesh_surface_4 = MeshSurface(Surface=surface, UCount=number_slider_17, VCount=number_slider_18, Overhang=True, Equalize=False)  # disabled
mesh_caps = MeshCaps(M=mesh_surface_4, W=True, O=True, D=0)  # -> out, A, E; inputs M: Mesh, clr: Color; disabled
# ---------- mesh_caps: VB ----------
    Component.Params.Input(0).Name = "Mesh"
    Component.Params.Input(0).Description = "An open mesh"
    Component.Params.Input(1).Name = "Join and Weld"
    Component.Params.Input(1).Description = "If true the original mesh will be joined and welded to the new caps, else the caps will be output as a list of new meshes"
    Component.Params.Input(2).Name = "Simplify Faces"
    Component.Params.Input(2).Description = "If true, naked edges consisting of 3 to 4 segments will be replaced with a single face, else faces will use new center vertex method"
    Component.Params.Input(3).Name = "Distance (Optional, Rhino Units)"
    Component.Params.Input(3).Description = "A single number which sets the Rhino unit based distance that the center point will be offset from the vertex averages"

    Component.Params.Output(1).Name = "Mesh"
    Component.Params.Output(1).Description = "If successful, a list or single of valid meshes"
    Component.Params.Output(2).Name = "Polylines"
    Component.Params.Output(2).Description = "If successful, a list of valid edge polylines"

    If M IsNot Nothing Then
      Dim i,j,k,kk,ka As Integer
      Dim arrP() As polyline
      Dim P As polyline
      Dim arrM As New list(Of Mesh)
      Dim mj As New mesh
      Dim clrB,clrC,blnN() As Boolean
      Dim oc,tcc As New list(Of color)
      If (clr <> Nothing) Then clrC = True
      If ((m.VertexColors.count() > 0) Or (clr <> Nothing)) Then clrB = True
      If (m.VertexColors.count() = 0) Then  m.vertexcolors.CreateMonotoneMesh(color.LightGray)
      oc = m.VertexColors.ToArray.tolist()
      Dim mv() As point3d
      Dim mo As New list(Of mesh)
      Dim fc As New list(Of MeshFace)
      Dim np As New list(Of point3d)
      Dim ni As New list(Of Integer)
      Dim ind(3) As Integer

      mv = m.Vertices.ToPoint3dArray()
      blnN = m.GetNakedEdgePointStatus()
      arrP = m.GetNakedEdges()

      For i = 0 To ubound(blnN) Step 1
        If blnN(i) Then
          np.add(mv(i))
          ni.add(i)
        End If
      Next

      Dim cld As New pointcloud(np.toarray())
      For i = 0 To ubound(arrP) Step 1
        Dim tm As New mesh
        tm.Vertices.Clear()
        tm.Faces.Clear()

        p = arrP(i)
        If (O And (p.count() < 6)) Then
          ind(0) = ni(cld.ClosestPoint(p(0)))
          ind(1) = ni(cld.ClosestPoint(p(1)))
          ind(2) = ni(cld.ClosestPoint(p(2)))
          ind(3) = ni(cld.ClosestPoint(p(3)))
          tm.Vertices.Add(mv(ind(0)))
          tm.Vertices.Add(mv(ind(1)))
          tm.Vertices.Add(mv(ind(2)))

          tm.VertexColors.Add(oc(ind(0)))
          tm.VertexColors.Add(oc(ind(1)))
          tm.VertexColors.Add(oc(ind(2)))
          If p.count() = 5 Then
            fc.add(New meshface(ind(0), ind(1), ind(2), ind(3)))
            tm.Vertices.Add(mv(ind(3)))
            tm.VertexColors.Add(oc(ind(3)))
            tm.Faces.addface(New meshface(0, 1, 2, 3))
          ElseIf p.count() = 4 Then
            fc.add(New meshface(ind(0), ind(1), ind(2)))
            tm.Faces.addface(New meshface(0, 1, 2))
          End If
          tm.FaceNormals.ComputeFaceNormals()
          tm.Normals.ComputeNormals()
          mo.add(tm)

        Else
          Dim tx As New mesh
          Dim vec As New vector3d
          Dim tv As New list(Of point3d)
          Dim tc As New list(Of color)
          Dim tfc As New list(Of meshface)
          Dim r,g,b As Integer
          Dim tcl As color
          k = cld.ClosestPoint(p(0))
          ka = k
          tx.Vertices.AddVertices(p.ToArray())
          tx.Faces.AddFaces(p.TriangulateClosedPolyline())
          tx.Normals.ComputeNormals()

          vec = tx.Normals(0)

          tv.add(p(0))
          tc.add(oc(k))
          r = oc(ni(k)).R
          g = oc(ni(k)).G
          b = oc(ni(k)).B
          For j = 1 To p.count() - 2 Step 1
            kk = cld.ClosestPoint(p(j))
            fc.add(New meshface(m.Vertices.count(), ni(k), ni(kk)))
            vec += tx.Normals(j)
            k = kk

            tv.add(p(j))
            tc.add(oc(k))
            r += oc(ni(k)).R
            g += oc(ni(k)).G
            b += oc(ni(k)).B
            tfc.add(New meshface(p.count() - 1, j - 1, j))
          Next
          fc.add(New meshface(m.Vertices.count(), ni(k), ni(ka)))
          vec.Unitize()
          vec *= D
          m.Vertices.add(p.CenterPoint() + vec)

          r /= (p.count() - 1)
          g /= (p.count() - 1)
          b /= (p.count() - 1)
          If r > 255 Then r = 255 Else If r < 0 Then r = 0
          If g > 255 Then g = 255 Else If g < 0 Then g = 0
          If b > 255 Then b = 255 Else If b < 0 Then b = 0
          If clrC Then tcl = clr Else tcl = color.FromArgb(r, g, b)
          m.VertexColors.Add(tcl)

          tv.add(p.CenterPoint() + vec)
          tc.add(tcl)
          tfc.add(New meshface(p.count() - 1, p.count() - 2, 0))
          tm.vertices.AddVertices(tv.toarray())
          If clrB Then tm.VertexColors.AppendColors(tc.toarray())
          tm.faces.addfaces(tfc)
          tm.FaceNormals.ComputeFaceNormals()
          tm.Normals.ComputeNormals()
          mo.add(tm)
        End If
      Next

      If w Then
        m.Faces.AddFaces(fc)
        m.FaceNormals.ComputeFaceNormals()
        m.UnifyNormals()
        m.Normals.ComputeNormals()
        If Not clrB Then m.VertexColors.Clear()
        A = m
      Else
        A = mo
      End If
      E = arrP
    End If
# ---------- mesh_caps: VB additional code ----------
  Private Function avgC(ByVal R As Double, ByVal G As Double, ByVal B As Double, ByVal T As Integer)

    R /= t
    G /= t
    B /= t
    If R > 255 Then R = 255 Else If R < 0 Then R = 0
    If G > 255 Then G = 255 Else If G < 0 Then G = 0
    If B > 255 Then B = 255 Else If B < 0 Then B = 0

    Return color.FromArgb(CInt(R), CInt(G), CInt(B))
  End Function
# ---------- end mesh_caps ----------
triangulate = Triangulate(Mesh=mesh_caps.A)  # -> Mesh, Count; disabled
mesh_edges_5 = MeshEdges(Mesh=triangulate.Mesh)  # -> NakedEdges, InteriorEdges, NonManifoldEdges; disabled

# ----
# Step2.5: identify curvature on curve pipe with gradient
bounds = Bounds(Numbers=panel_3)  # disabled
deconstruct_domain = DeconstructDomain(Domain=bounds)  # -> Start, End; disabled
gradient = Gradient(
    LowerLimit=deconstruct_domain.Start,
    UpperLimit=deconstruct_domain.End,
    Parameter=surface_curvature.Gaussian,
    stops=[0: RGB(234, 38, 0), 0.25: RGB(234, 126, 0), 0.5: RGB(254, 244, 84), 0.75: RGB(173, 203, 249), 1: RGB(75, 107, 169)])  # disabled
custom_preview = CustomPreview(Geometry=flatten(divide_surface.Points), Material=gradient)  # disabled

curve_7 = Curve(flatten([mesh_edges_5.NakedEdges, mesh_edges_5.InteriorEdges]))  # disabled
point_on_curve = PointOnCurve(curve_7, parameter=0.5)  # disabled
closest_points = ClosestPoints(Point=point_on_curve, Cloud=flatten(divide_surface_2.Points), Count=1)  # -> ClosestPoint, CPIndex, Distance; disabled
list_item = ListItem(List=gradient, Index=closest_points.CPIndex, Wrap=True)  # disabled
custom_preview_2 = CustomPreview(Geometry=flatten(curve_7), Material=flatten(list_item))  # disabled

mesh_surface_5 = MeshSurface(Surface=surface_2, UCount=number_slider_17, VCount=number_slider_18, Overhang=True, Equalize=False)  # disabled
mesh_caps_2 = MeshCaps(M=mesh_surface_5, W=True, O=True, D=0)  # -> out, A, E; inputs M: Mesh, clr: Color; disabled; same code as mesh_caps
triangulate_2 = Triangulate(Mesh=mesh_caps_2.A)  # -> Mesh, Count; disabled
mesh_edges_6 = MeshEdges(Mesh=triangulate_2.Mesh)  # -> NakedEdges, InteriorEdges, NonManifoldEdges; disabled

curve_8 = Curve(flatten([mesh_edges_6.NakedEdges, mesh_edges_6.InteriorEdges]))  # disabled
point_on_curve_2 = PointOnCurve(curve_8, parameter=0.5)  # disabled
closest_points_2 = ClosestPoints(Point=point_on_curve_2, Cloud=flatten(divide_surface.Points), Count=1)  # -> ClosestPoint, CPIndex, Distance; disabled
list_item_2 = ListItem(List=gradient, Index=closest_points_2.CPIndex, Wrap=True)  # disabled
custom_preview_3 = CustomPreview(Geometry=flatten(curve_8), Material=flatten(list_item_2))  # disabled

number_slider_35 = Slider(30, range=0..100)  # disabled
boolean_toggle_2 = BooleanToggle(False)  # disabled
timer = Timer(TimerInterval=50, Target=meshmachine)  # disabled
meshmachine = MeshMachine(
    Geometry=cocoon.Mesh,
    Length=number_slider_35,
    Flip=1,
    PullStrength=0.8,
    CurvatureAdaptivity=0,
    BoundaryScale=1,
    BoundaryDistance=5,
    Exponent=2,
    Background=0.5,
    Iterations=1,
    Reset=boolean_toggle_2)  # disabled
planktonmesh = PlanktonMesh(meshmachine)  # disabled
mesh = Mesh(planktonmesh)  # disabled
mesh_edges_7 = MeshEdges(Mesh=mesh)  # -> NakedEdges, InteriorEdges, NonManifoldEdges; disabled

collision_many_many = CollisionManyMany(Colliders=move.Geometry)  # -> Collision, Indices; disabled

number_slider_36 = Slider(0, range=0..4)  # disabled
list_item_3 = ListItem(List=deconstruct_brep_4.Faces, Index=number_slider_36, Wrap=True)  # disabled
list_item_4 = ListItem(List=unroll_brep, Index=number_slider_36, Wrap=True)  # disabled

mesh_surface_6 = MeshSurface(Surface=surface_3, UCount=number_slider_34, VCount=number_slider_33, Overhang=True, Equalize=False)  # disabled
dispatch = Dispatch(List=move.Geometry, DispatchPattern=collision_many_many.Collision)  # -> ListA, ListB; disabled
mjoin = MeshJoin(Meshes=flatten(mesh_surface_6))  # disabled
weld_mesh = WeldMesh(Mesh=triangulate_2.Mesh, Angle=3.141592654)  # disabled
weld_mesh_2 = WeldMesh(Mesh=triangulate.Mesh, Angle=3.141592654)  # disabled
geometry_7 = Geometry(dispatch.ListB)  # disabled
mesh_surface_7 = MeshSurface(Surface=geometry_7, UCount=5, VCount=5, Overhang=True, Equalize=False)  # disabled
mesh_mesh = MeshMesh(MeshA=cocoon.Mesh, MeshB=mesh_surface_7, UseMeshMeshFast=True)  # -> flatten(Intersections); disabled
colour_swatch = ColourSwatch(SwatchColor=RGB(0, 0, 255))  # disabled
triangulate_3 = Triangulate(Mesh=mjoin)  # -> Mesh, Count; disabled
deconstruct_brep_5 = DeconstructBrep(Brep=opennest.Geo)  # -> Faces, Edges, Vertices; disabled
mesh_2 = Mesh(weld_mesh)  # disabled
md_slider = MDSlider(SliderMode=0, slider_value=Point(0.5, 0.5, 0.5), x_domain=Domain(0, 1), y_domain=Domain(0, 1), z_domain=Domain(0, 1))  # disabled
list_item_5 = ListItem(List=deconstruct_brep_5.Edges, Index=0, Wrap=True)  # -> Item, Item1, Item2, Item3; disabled
mesh_3 = Mesh(weld_mesh_2)  # disabled
custom_preview_4 = CustomPreview(Geometry=mesh_mesh, Material=colour_swatch)  # disabled
evaluate_surface = EvaluateSurface(Surface=reparameterize(surface_3), Point=md_slider)  # -> Point, Normal, UDirection, VDirection, Frame; disabled
mesh_split = MeshSplit(Mesh=cocoon.Mesh, Splitters=flatten(mesh_surface_7))  # disabled
edge_surface = EdgeSurface(CurveA=list_item_5.Item, CurveB=list_item_5.Item1, CurveC=list_item_5.Item2, CurveD=list_item_5.Item3)  # disabled
deconstruct_brep_6 = DeconstructBrep(Brep=surface_3)  # -> Faces, Edges, Vertices; disabled
mesh_edges_8 = MeshEdges(Mesh=mesh_3)  # -> NakedEdges, InteriorEdges, NonManifoldEdges; disabled
weaverbird_s_naked_boundary = WeaverbirdsNakedBoundary(MeshClosedPolylines=triangulate_3.Mesh)  # disabled
deconstruct_mesh_2 = DeconstructMesh(Mesh=mesh_3)  # -> Vertices, Faces, Colours, Normals; disabled

weaverbird_s_face_polylines = WeaverbirdsFacePolylines(Mesh=mesh_3)  # disabled
deconstruct_brep_7 = DeconstructBrep(Brep=weaverbird_s_face_polylines)  # -> Faces, Edges, Vertices; disabled
closest_points_3 = ClosestPoints(Point=simplify(deconstruct_brep_7.Vertices), Cloud=flatten(divide_surface_2.Points), Count=1)  # -> ClosestPoint, CPIndex, Distance; disabled
area_2 = Area(Geometry=weaverbird_s_face_polylines)  # -> Area, Centroid; disabled
shift_paths = ShiftPaths(Data=closest_points_3.ClosestPoint, Offset=-1)  # disabled
list_item_6 = ListItem(List=gradient, Index=shift_paths, Wrap=True)  # disabled

mesh_4 = Mesh(<mesh referenced from the Rhino model>)  # disabled
edges_from_directions = EdgesFromDirections(Brep=surface_3, Directions=evaluate_surface.UDirection, Reflex=True, Angle=0)  # -> Edges, Indices, Map; disabled
surface_4 = Surface(<surface referenced from the Rhino model>)  # disabled
mjoin_2 = MeshJoin(Meshes=flatten(mesh_surface))  # disabled
surface_5 = Surface(<surface referenced from the Rhino model>)  # disabled
cull_index = CullIndex(List=deconstruct_brep_6.Edges, Indices=edges_from_directions.Indices, Wrap=True)  # disabled
weld_mesh_3 = WeldMesh(Mesh=mesh_4, Angle=3.141592654)  # disabled
line = Line(flatten([mesh_edges_8.NakedEdges, mesh_edges_8.InteriorEdges]))  # disabled
mjoin_3 = MeshJoin(Meshes=flatten(mesh_surface_2))  # disabled
number_slider_37 = Slider(5, range=0..100)  # disabled
join = JoinCurves(Curves=weaverbird_s_naked_boundary, Preserve=False)  # disabled
mjoin_4 = MeshJoin(Meshes=flatten(mesh_surface_3))  # disabled
weaverbird_s_unify_face_windings = WeaverbirdsUnifyFaceWindings(MeshCurves=mjoin_2)  # disabled
weaverbird_s_unify_face_windings_2 = WeaverbirdsUnifyFaceWindings(MeshCurves=weld_mesh_3)  # disabled
cp = ControlPoints(Curve=join)  # -> Points, Weights, Knots; disabled
list_item_7 = ListItem(List=surface_curvature.Gaussian, Index=shift_paths, Wrap=True)  # disabled
weaverbird_s_unify_face_windings_3 = WeaverbirdsUnifyFaceWindings(MeshCurves=mjoin_3)  # disabled
weaverbird_s_unify_face_windings_4 = WeaverbirdsUnifyFaceWindings(MeshCurves=mjoin_4)  # disabled
pipe_6 = Pipe(Curve=cull_index, Radius=number_slider_37, Caps=1)  # disabled
number_slider_38 = Slider(1, range=0..1)  # disabled
mesh_flip = MeshFlip(Mesh=weaverbird_s_unify_face_windings_2)  # disabled
weaverbird_s_face_polylines_2 = WeaverbirdsFacePolylines(Mesh=mesh_2)  # disabled
boolean_toggle_3 = BooleanToggle(True)  # disabled
average = Average(Input=list_item_7)  # -> flatten(ArithmeticMean); disabled
duppt = RemoveDuplicatePts(Points=cp.Points, Tolerance=0.01)  # disabled
mesh_triangulate = MeshTriangulate(Mesh=weaverbird_s_unify_face_windings, ShortDiagonal=False)  # disabled
mesh_edges_9 = MeshEdges(Mesh=mesh_triangulate)  # -> NakedEdges, InteriorEdges, NonManifoldEdges; disabled
number_slider_39 = Slider(0, range=0..1)  # disabled
mesh_5 = Mesh(weaverbird_s_unify_face_windings_2)  # disabled
gradient_2 = Gradient(
    LowerLimit=deconstruct_domain.Start,
    UpperLimit=deconstruct_domain.End,
    Parameter=average,
    stops=[0: RGB(234, 38, 0), 0.25: RGB(234, 126, 0), 0.5: RGB(254, 244, 84), 0.75: RGB(173, 203, 249), 1: RGB(75, 107, 169)])  # disabled
point_in_brep = PointInBrep(Brep=pipe_6, Point=duppt, Strict=False)  # disabled
demesh = DeconstructMesh(Mesh=mesh_5)  # -> Vertices, Faces, Colours, Normals; disabled

number_slider_40 = Slider(15, range=0..100)  # disabled
number_slider_41 = Slider(11, range=0..100)  # disabled
mesh_surface_8 = MeshSurface(Surface=surface_5, UCount=number_slider_41, VCount=number_slider_40, Overhang=True, Equalize=False)  # disabled
md_slider_2 = MDSlider(SliderMode=0, slider_value=Point(0.5, 0.5, 0.5), x_domain=Domain(0, 1), y_domain=Domain(0, 1), z_domain=Domain(0, 1))  # disabled
mjoin_5 = MeshJoin(Meshes=flatten(mesh_surface_8))  # disabled
evaluate_surface_2 = EvaluateSurface(Surface=reparameterize(surface_5), Point=md_slider_2)  # -> Point, Normal, UDirection, VDirection, Frame; disabled
edges_from_directions_2 = EdgesFromDirections(Brep=surface_5, Directions=evaluate_surface_2.UDirection, Reflex=True, Angle=0)  # -> Edges, Indices, Map; disabled
deconstruct_brep_8 = DeconstructBrep(Brep=surface_5)  # -> Faces, Edges, Vertices; disabled
weaverbird_s_naked_boundary_2 = WeaverbirdsNakedBoundary(MeshClosedPolylines=mjoin_5)  # disabled
cull_index_2 = CullIndex(List=deconstruct_brep_8.Edges, Indices=edges_from_directions_2.Indices, Wrap=True)  # disabled
number_slider_42 = Slider(5, range=0..100)  # disabled
join_2 = JoinCurves(Curves=weaverbird_s_naked_boundary_2, Preserve=False)  # disabled
cp_2 = ControlPoints(Curve=join_2)  # -> Points, Weights, Knots; disabled
duppt_2 = RemoveDuplicatePts(Points=cp_2.Points, Tolerance=0.01)  # disabled
pipe_7 = Pipe(Curve=cull_index_2, Radius=number_slider_42, Caps=1)  # disabled
point_in_brep_2 = PointInBrep(Brep=pipe_7, Point=duppt_2, Strict=False)  # disabled
cull_pattern = CullPattern(List=duppt_2, CullPattern=point_in_brep_2)  # disabled
closest_points_4 = ClosestPoints(Point=flatten(cull_pattern), Cloud=flatten(demesh.Vertices), Count=1)  # -> simplify(ClosestPoint), CPIndex, Distance; disabled

swap_surface_directions = SwapSurfaceDirections(Surface=edge_surface, ReverseU=False, ReverseV=False, SwapUV=boolean_toggle_3)  # disabled
bounds_2 = Bounds(Numbers=flatten(average))  # disabled
panel_4 = Panel("1 to 5")  # disabled
cull_pattern_2 = CullPattern(List=duppt, CullPattern=point_in_brep)  # disabled
vector_display = VectorDisplay(Anchor=demesh.Vertices, Vector=demesh.Normals)  # disabled
triangulate_4 = Triangulate(Mesh=[weaverbird_s_unify_face_windings_3, weaverbird_s_unify_face_windings_4])  # -> Mesh, Count; disabled
demesh_2 = DeconstructMesh(Mesh=triangulate_4.Mesh)  # -> Vertices, Faces, Colours, Normals; disabled
demesh_3 = DeconstructMesh(Mesh=mesh_triangulate)  # -> Vertices, Faces, Colours, Normals; disabled
closest_points_5 = ClosestPoints(Point=flatten(cull_pattern_2), Cloud=flatten(demesh_2.Vertices), Count=1)  # -> simplify(ClosestPoint), CPIndex, Distance; disabled
tween_two_surfaces = TweenTwoSurfaces(
    SurfaceA=graft(deconstruct_brep_4.Faces),
    SurfaceB=graft(swap_surface_directions),
    Factor=number_slider_38,
    Refit=False,
    SamplePoint=0)  # disabled
area_3 = Area(Geometry=flatten(tween_two_surfaces))  # -> Area, Centroid; disabled

number_slider_43 = Slider(41, range=0..1000)  # disabled
points = PointList(Points=area_3.Centroid, Size=number_slider_43)  # disabled

remap_numbers = RemapNumbers(Value=flatten(average), Source=bounds_2, Target=panel_4)  # -> Mapped, Clipped; disabled
panel_5 = Panel(remap_numbers.Mapped)  # disabled
colour_swatch_2 = ColourSwatch(SwatchColor=RGB(255, 0, 255))  # disabled
custom_preview_5 = CustomPreview(Geometry=tween_two_surfaces, Material=colour_swatch_2)  # disabled
multiplication_2 = Multiplication(A=remap_numbers.Mapped, B=area_2.Area)  # disabled
mesh_edges_10 = MeshEdges(Mesh=mesh_2)  # -> NakedEdges, InteriorEdges, NonManifoldEdges; disabled
list_length = ListLength(List=deconstruct_mesh_2.Vertices)  # disabled

brep_2 = Brep(<brep referenced from the Rhino model>)  # disabled
point_in_brep_3 = PointInBrep(Brep=brep_2, Point=deconstruct_mesh_2.Vertices, Strict=False)  # disabled
dispatch_2 = Dispatch(List=deconstruct_mesh_2.Vertices, DispatchPattern=point_in_brep_3)  # -> ListA, ListB; disabled

list_item_8 = ListItem(List=surface_curvature.Gaussian, Index=closest_points.CPIndex, Wrap=True)  # disabled
bounds_3 = Bounds(Numbers=flatten(list_item_8))  # disabled
panel_6 = Panel("0.80 to 1.2")  # disabled
remap_numbers_2 = RemapNumbers(Value=flatten(list_item_8), Source=bounds_3, Target=panel_6)  # -> Mapped, Clipped; disabled

mesh_edges_11 = MeshEdges(Mesh=mjoin_5)  # -> NakedEdges, InteriorEdges, NonManifoldEdges; disabled
list_length_2 = ListLength(List=demesh.Vertices)  # disabled

weaverbird_s_face_polylines_3 = WeaverbirdsFacePolylines(Mesh=mesh_triangulate)  # disabled
area_4 = Area(Geometry=weaverbird_s_face_polylines_3)  # -> Area, Centroid; disabled
number_slider_44 = Slider(167, range=0..500)  # disabled
cull_pattern_3 = CullPattern(List=weaverbird_s_face_polylines_3, CullPattern=[False, False, True, True])  # disabled
polygonarea = PolygonArea(Polyline=cull_pattern_3, Area=area_4.Area, Strength=number_slider_44)  # disabled

mesh_edges_12 = MeshEdges(Mesh=mesh_triangulate)  # -> NakedEdges, InteriorEdges, NonManifoldEdges; disabled
number_slider_45 = Slider(3000, range=0..3000)  # disabled
line_2 = Line([mesh_edges_12.NakedEdges, mesh_edges_12.InteriorEdges])  # disabled
length_line = LengthLine(Line=line_2, Strength=number_slider_45)  # disabled

number_slider_46 = Slider(1, range=1..131.01)  # disabled
unit_z = UnitZ(Factor=number_slider_46)  # disabled
load = Load(Point=demesh_3.Vertices, ForceVector=expr("-x", unit_z))  # disabled

mesh_edges_13 = MeshEdges(Mesh=mesh_2)  # -> NakedEdges, InteriorEdges, NonManifoldEdges; disabled
series = Series(Start=0, Step=1, Count=list_length)  # disabled
series_2 = Series(Start=0, Step=1, Count=list_length_2)  # disabled
line_3 = Line(flatten([mesh_edges_10.NakedEdges, mesh_edges_10.InteriorEdges]))  # disabled

brep_3 = Brep([<brep referenced from the Rhino model> x4])  # disabled
point_in_breps = PointInBreps(Brep=brep_3, Point=demesh_3.Vertices, Strict=False)  # -> Inside, Index; disabled
cull_pattern_4 = CullPattern(List=demesh_3.Vertices, CullPattern=point_in_breps.Inside)  # disabled
anchor = Anchor(Point=cull_pattern_4, Strength=1000)  # disabled

dispatch_3 = Dispatch(List=demesh_3.Vertices, DispatchPattern=point_in_breps.Inside)  # -> ListA, ListB; disabled
number_slider_47 = Slider(3, range=0..100)  # disabled
number_slider_48 = Slider(5000, range=0..10000)  # disabled
sort_duplicate_points = SortDuplicatePoints(Points=dispatch_3.ListB)  # -> UniquePoints, Indices; disabled
spherecollide = SphereCollide(Points=sort_duplicate_points.UniquePoints, Radius=number_slider_47, Strength=number_slider_48)  # disabled

mesh_edges_14 = MeshEdges(Mesh=triangulate_4.Mesh)  # -> NakedEdges, InteriorEdges, NonManifoldEdges; disabled

weaverbird_s_face_polylines_4 = WeaverbirdsFacePolylines(Mesh=triangulate_4.Mesh)  # disabled
number_slider_49 = Slider(184, range=0..500)  # disabled
area_5 = Area(Geometry=weaverbird_s_face_polylines_4)  # -> Area, Centroid; disabled
polygonarea_2 = PolygonArea(Polyline=weaverbird_s_face_polylines_4, Area=area_5.Area, Strength=number_slider_49)  # disabled

data = Data(graft(demesh.Vertices))  # disabled
number_slider_50 = Slider(25, range=0..100)  # disabled
mesh_edges_15 = MeshEdges(Mesh=triangulate_3.Mesh)  # -> NakedEdges, InteriorEdges, NonManifoldEdges; disabled
mesh_edges_16 = MeshEdges(Mesh=mesh_5)  # -> NakedEdges, InteriorEdges, NonManifoldEdges; disabled

brep_4 = Brep([<brep referenced from the Rhino model> x4])  # disabled
point_in_breps_2 = PointInBreps(Brep=brep_4, Point=demesh_2.Vertices, Strict=False)  # -> Inside, Index; disabled
cull_pattern_5 = CullPattern(List=demesh_2.Vertices, CullPattern=point_in_breps_2.Inside)  # disabled
anchor_2 = Anchor(Point=cull_pattern_5, Strength=1000)  # disabled

area_6 = Area(Geometry=weaverbird_s_face_polylines_2)  # -> Area, Centroid; disabled

number_slider_51 = Slider(1, range=1..131.01)  # disabled
unit_z_2 = UnitZ(Factor=number_slider_51)  # disabled
load_2 = Load(Point=demesh_2.Vertices, ForceVector=expr("-x", unit_z_2))  # disabled

number_slider_52 = Slider(1310, range=0..3000)  # disabled
line_4 = Line([mesh_edges_11.NakedEdges, mesh_edges_11.InteriorEdges])  # disabled
length_line_2 = LengthLine(Line=line_4, Strength=number_slider_52)  # disabled

flatten_tree = FlattenTree(Tree=cull_pattern_2, Path="{0}")  # disabled

deconstruct_mesh_3 = DeconstructMesh(Mesh=triangulate_3.Mesh)  # -> Vertices, Faces, Colours, Normals; disabled
number_slider_53 = Slider(1, range=0.1..131.01)  # disabled
unit_z_3 = UnitZ(Factor=number_slider_53)  # disabled
load_3 = Load(Point=deconstruct_mesh_3.Vertices, ForceVector=expr("-x", unit_z_3))  # disabled

flatten_tree_2 = FlattenTree(Tree=closest_points_5.ClosestPoint, Path="{0}")  # disabled
vertexneighbours = VertexNeighbours(Mesh=mesh_3, VertexNumber=series)  # -> Vertex, simplify(Neighbours), Normal; disabled

number_slider_54 = Slider(25, range=0..100)  # disabled
list_item_9 = ListItem(List=deconstruct_mesh_2.Vertices, Index=number_slider_54, Wrap=True)  # disabled
tree_branch_2 = TreeBranch(Tree=simplify(vertexneighbours.Neighbours), Path=number_slider_54, MaintainPaths=True)  # disabled
line_5 = Line(StartPoint=list_item_9, EndPoint=tree_branch_2)  # disabled

number_slider_55 = Slider(500, range=0..1000)  # disabled
flatten_tree_3 = FlattenTree(Tree=cull_pattern, Path="{0}")  # disabled
number_slider_56 = Slider(3, range=0..100)  # disabled

deconstruct_mesh_4 = DeconstructMesh(Mesh=mjoin_5)  # -> Vertices, Faces, Colours, Normals; disabled
number_slider_57 = Slider(0.2, range=0.1..131.01)  # disabled
unit_z_4 = UnitZ(Factor=number_slider_57)  # disabled
load_4 = Load(Point=deconstruct_mesh_4.Vertices, ForceVector=expr("-x", unit_z_4))  # disabled

flatten_tree_4 = FlattenTree(Tree=closest_points_4.ClosestPoint, Path="{0}")  # disabled
line_6 = Line(flatten([mesh_edges_13.NakedEdges, mesh_edges_13.InteriorEdges]))  # disabled

number_slider_58 = Slider(1000, range=0..1000)  # disabled
floor = Floor(Strength=number_slider_58)  # disabled

number_slider_59 = Slider(5000, range=0..10000)  # disabled
brep_5 = Brep([<brep referenced from the Rhino model> x4])  # disabled
solidpointcollide = SolidPointCollide(Points=demesh_3.Vertices, Solid=brep_5, Interior=False, Unidirectional=True, Strength=number_slider_59)  # disabled

dispatch_4 = Dispatch(List=demesh_2.Vertices, DispatchPattern=point_in_breps_2.Inside)  # -> ListA, ListB; disabled

weaverbird_s_face_polylines_5 = WeaverbirdsFacePolylines(Mesh=mesh_5)  # disabled
area_7 = Area(Geometry=weaverbird_s_face_polylines_5)  # -> Area, Centroid; disabled
number_slider_60 = Slider(4004, range=0..20500)  # disabled
polygonarea_3 = PolygonArea(Polyline=weaverbird_s_face_polylines_5, Area=area_7.Area, Strength=number_slider_60)  # disabled

vertexneighbours_2 = VertexNeighbours(Mesh=mesh_5, VertexNumber=series_2)  # -> Vertex, simplify(Neighbours), Normal; disabled

number_slider_61 = Slider(10, range=0..12)  # disabled
pressure = Pressure(M=mesh_triangulate, Strength=number_slider_61)  # disabled

length = Length(Curve=line_3)  # disabled

brep_6 = Brep(<brep referenced from the Rhino model>)  # disabled
point_in_breps_3 = PointInBreps(Brep=brep_6, Point=demesh.Vertices, Strict=False)  # -> Inside, Index; disabled
cull_pattern_6 = CullPattern(List=demesh.Vertices, CullPattern=point_in_breps_3.Inside)  # disabled
anchor_3 = Anchor(Point=cull_pattern_6, Strength=1000)  # disabled

data_2 = Data(graft(deconstruct_mesh_2.Vertices))  # disabled

number_slider_62 = Slider(0.1, range=0.1..22131.01)  # disabled
unit_z_5 = UnitZ(Factor=number_slider_62)  # disabled
load_5 = Load(Point=demesh.Vertices, ForceVector=expr("-x", unit_z_5))  # disabled

hingepoints = HingePoints(Mesh=mesh_triangulate)  # -> _1, _2, _3, _4; disabled
number_slider_63 = Slider(65, range=0..100)  # disabled
length_2 = Length(Curve=line_6)  # disabled
number_slider_64 = Slider(5000, range=0..10000)  # disabled
geometry_8 = Geometry(flatten_tree_2)  # disabled
geometry_9 = Geometry(flatten_tree)  # disabled

number_slider_65 = Slider(10, range=0..100)  # disabled
dispatch_5 = Dispatch(List=demesh.Vertices, DispatchPattern=point_in_breps_3.Inside)  # -> ListA, ListB; disabled
number_slider_66 = Slider(10000, range=0..10000)  # disabled
sort_duplicate_points_2 = SortDuplicatePoints(Points=dispatch_5.ListB)  # -> UniquePoints, Indices; disabled
spherecollide_2 = SphereCollide(Points=sort_duplicate_points_2.UniquePoints, Radius=number_slider_65, Strength=number_slider_66)  # disabled

number_slider_67 = Slider(7661, range=0..13000)  # disabled
line_7 = Line([mesh_edges_16.NakedEdges, mesh_edges_16.InteriorEdges])  # disabled
length_line_3 = LengthLine(Line=line_7, Strength=number_slider_67)  # disabled

number_slider_68 = Slider(2106, range=0..3000)  # disabled
line_8 = Line([mesh_edges_14.NakedEdges, mesh_edges_14.InteriorEdges])  # disabled
length_line_4 = LengthLine(Line=line_8, Strength=number_slider_68)  # disabled

hingepoints_2 = HingePoints(Mesh=mesh_5)  # -> _1, _2, _3, _4; disabled
number_slider_69 = Slider(5000, range=0..10000)  # disabled
nofoldthrough = NoFoldThrough(
    FoldStart=hingepoints_2._1,
    FoldEnd=hingepoints_2._2,
    Tip1=hingepoints_2._3,
    Tip2=hingepoints_2._4,
    Strength=number_slider_69)  # disabled
hinge = Hinge(
    FoldStart=hingepoints_2._1,
    FoldEnd=hingepoints_2._2,
    Tip1=hingepoints_2._3,
    Tip2=hingepoints_2._4,
    Strength=number_slider_69)  # disabled

number_slider_70 = Slider(21000, range=0..21000)  # disabled
list_item_10 = ListItem(List=demesh.Vertices, Index=number_slider_50, Wrap=True)  # disabled

number_slider_71 = Slider(206, range=0..3000)  # disabled
line_9 = Line([mesh_edges_15.NakedEdges, mesh_edges_15.InteriorEdges])  # disabled
length_line_5 = LengthLine(Line=line_9, Strength=number_slider_71)  # disabled

geometry_10 = Geometry(flatten_tree_4)  # disabled
number_slider_72 = Slider(21000, range=0..21000)  # disabled
geometry_11 = Geometry(flatten_tree_3)  # disabled

number_slider_73 = Slider(500, range=0..1000)  # disabled
floor_2 = Floor(Strength=number_slider_73)  # disabled

number_slider_74 = Slider(5000, range=0..10000)  # disabled
brep_7 = Brep([<brep referenced from the Rhino model> x4])  # disabled
solidpointcollide_2 = SolidPointCollide(Points=demesh_2.Vertices, Solid=brep_7, Interior=False, Unidirectional=True, Strength=number_slider_74)  # disabled

number_slider_75 = Slider(500, range=0..1000)  # disabled
floor_3 = Floor(Strength=number_slider_75)  # disabled

number_slider_76 = Slider(21000, range=0..21000)  # disabled

number_slider_77 = Slider(58.08, range=0.055..112)  # disabled
pressure_2 = Pressure(M=mesh_3, Strength=number_slider_77)  # disabled

multiplication_3 = Multiplication(A=length, B=remap_numbers_2.Mapped)  # disabled

number_slider_78 = Slider(10, range=0..10)  # disabled
pressure_3 = Pressure(M=triangulate_4.Mesh, Strength=number_slider_78)  # disabled

nofoldthrough_2 = NoFoldThrough(FoldStart=hingepoints._1, FoldEnd=hingepoints._2, Tip1=hingepoints._3, Tip2=hingepoints._4, Strength=number_slider_55)  # disabled

number_slider_79 = Slider(500, range=0..1000)  # disabled
floor_4 = Floor(Strength=number_slider_79)  # disabled

number_slider_80 = Slider(10000, range=0..10000)  # disabled
number_slider_81 = Slider(15, range=0..100)  # disabled
spherecollide_3 = SphereCollide(Points=dispatch_2.ListB, Radius=number_slider_81, Strength=number_slider_80)  # disabled

number_slider_82 = Slider(5000, range=0..10000)  # disabled
bounds_4 = Bounds(Numbers=length_2)  # disabled
sort_duplicate_points_3 = SortDuplicatePoints(Points=dispatch_4.ListB)  # -> UniquePoints, Indices; disabled

number_slider_83 = Slider(5000, range=0..10000)  # disabled
anchor_4 = Anchor(Point=dispatch_2.ListA, Strength=number_slider_83)  # disabled

number_slider_84 = Slider(10000, range=0..10000)  # disabled
hingepoints_3 = HingePoints(Mesh=mesh_3)  # -> _1, _2, _3, _4; disabled
nofoldthrough_3 = NoFoldThrough(
    FoldStart=hingepoints_3._1,
    FoldEnd=hingepoints_3._2,
    Tip1=hingepoints_3._3,
    Tip2=hingepoints_3._4,
    Strength=number_slider_84)  # disabled

tree_branch_3 = TreeBranch(Tree=simplify(vertexneighbours_2.Neighbours), Path=number_slider_50, MaintainPaths=True)  # disabled
number_slider_85 = Slider(10000, range=0..10000)  # disabled
line_10 = Line(StartPoint=data_2, EndPoint=vertexneighbours.Neighbours)  # disabled

number_slider_86 = Slider(2070, range=0..10000)  # disabled
polygonarea_4 = PolygonArea(Polyline=weaverbird_s_face_polylines, Area=area_6.Area, Strength=number_slider_86)  # disabled

number_slider_87 = Slider(0, range=0..100000)  # disabled
shift_list_4 = ShiftList(List=line_10, Shift=1, Wrap=True)  # disabled
number_slider_88 = Slider(10000, range=0..10000)  # disabled

number_slider_89 = Slider(500, range=0..1000)  # disabled
floor_5 = Floor(Strength=number_slider_89)  # disabled

show = Show(G=mesh_triangulate)  # disabled

number_slider_90 = Slider(5000, range=0..10000)  # disabled
solidpointcollide_3 = SolidPointCollide(Points=demesh.Vertices, Solid=brep_6, Interior=False, Unidirectional=True, Strength=number_slider_90)  # disabled

line_11 = Line(StartPoint=data, EndPoint=vertexneighbours_2.Neighbours)  # disabled
length_3 = Length(Curve=line_7)  # disabled
constanttension = ConstantTension(Line=line_9, Strength=number_slider_63)  # disabled
shift_list_5 = ShiftList(List=line_11, Shift=1, Wrap=True)  # disabled

number_slider_91 = Slider(10, range=0..134)  # disabled
pressure_4 = Pressure(M=mesh_5, Strength=number_slider_91)  # disabled

number_slider_92 = Slider(8237, range=0..10000)  # disabled
deconstruct_domain_2 = DeconstructDomain(Domain=bounds_4)  # -> Start, End; disabled
line_12 = Line(StartPoint=list_item_10, EndPoint=tree_branch_3)  # disabled
coincident = Coincident(Point0=geometry_9, Point1=geometry_8, Strength=number_slider_70)  # disabled
show_2 = Show(G=triangulate_4.Mesh)  # disabled
coincident_2 = Coincident(Point0=geometry_11, Point1=geometry_10, Strength=number_slider_76)  # disabled
spherecollide_4 = SphereCollide(Points=sort_duplicate_points_3.UniquePoints, Radius=number_slider_56, Strength=number_slider_64)  # disabled
show_3 = Show(G=triangulate_3.Mesh)  # disabled
show_4 = Show(G=mjoin_5)  # disabled
mesh_sphere = MeshSphere(Base=deconstruct_mesh_2.Vertices, Radius=number_slider_81, UCount=10, VCount=20)  # disabled
grab = Grab(On=True, Strength=number_slider_82, Range=3)  # -> Grab, Anchors; disabled
length_line_6 = LengthLine(Line=line, Strength=number_slider_85)  # disabled
clamplength = ClampLength(Line=line, LowerLimit=deconstruct_domain_2.Start, UpperLimit=deconstruct_domain_2.End, Strength=number_slider_87)  # disabled
angle = Angle(LineA=line_11, LineB=shift_list_5, Strength=number_slider_92)  # disabled
angle_2 = Angle(LineA=line_10, LineB=shift_list_4, Strength=number_slider_88)  # -> flatten(Angle); disabled
show_5 = Show(G=mesh_5)  # disabled
show_6 = Show(G=mesh_3)  # disabled
merge_4 = Merge(
    Data1=spherecollide,
    Data2=flatten(show),
    Data3=flatten(anchor),
    Data4=floor,
    Data5=flatten(length_line),
    Data6=load,
    Data8=pressure,
    Data9=polygonarea,
    Data11=solidpointcollide)  # disabled
boolean_toggle_4 = BooleanToggle(False)  # disabled
merge_5 = Merge(
    Data1=spherecollide_4,
    Data2=flatten(show_2),
    Data3=flatten(anchor_2),
    Data4=floor_2,
    Data5=flatten(length_line_4),
    Data6=load_2,
    Data7=flatten(constanttension),
    Data8=pressure_3,
    Data9=polygonarea_2,
    Data10=show_3,
    Data11=coincident,
    Data12=load_3,
    Data13=solidpointcollide_2,
    Data14=length_line_5)  # disabled

button = Button()  # disabled
toggle = BooleanToggle(False)  # disabled

button_2 = Button()  # disabled
solver = Solver(GoalObjects=flatten(merge_4), Reset=button, Threshold=1e-15, Tolerance=0.01, On=toggle)  # -> I, V, O; disabled
solver_2 = Solver(
    GoalObjects=flatten([floor_4, anchor_4, show_6, pressure_2, length_line_6, spherecollide_3, polygonarea_4, clamplength, angle_2, nofoldthrough_3]),
    Reset=button_2,
    Threshold=1e-15,
    Tolerance=0.01,
    On=boolean_toggle_4)  # -> I, V, O; disabled
boolean_toggle_5 = BooleanToggle(True)  # disabled

button_3 = Button()  # disabled
toggle_2 = BooleanToggle(False)  # disabled

solver_3 = Solver(GoalObjects=flatten(merge_5), Reset=button_3, Threshold=1e-15, Tolerance=0.01, On=toggle_2)  # -> I, V, O; disabled
merge_6 = Merge(
    Data1=spherecollide_2,
    Data2=flatten(show_5),
    Data3=flatten(anchor_3),
    Data4=floor_5,
    Data5=flatten(length_line_3),
    Data6=load_5,
    Data7=pressure_4,
    Data8=polygonarea_3,
    Data10=solidpointcollide_3)  # disabled

button_4 = Button()  # disabled
toggle_3 = BooleanToggle(False)  # disabled

mesh_6 = Mesh(solver_2.O)  # disabled
mesh_7 = Mesh(solver.O)  # disabled
boolean_toggle_6 = BooleanToggle(True)  # disabled
mesh_edges_17 = MeshEdges(Mesh=mesh_6)  # -> NakedEdges, InteriorEdges, NonManifoldEdges; disabled

button_5 = Button()  # disabled
toggle_4 = BooleanToggle(False)  # disabled

solver_4 = Solver(GoalObjects=flatten(merge_6), Reset=button_5, Threshold=1e-15, Tolerance=0.01, On=toggle_4)  # -> I, V, O; disabled
boolean_toggle_7 = BooleanToggle(True)  # disabled
clean_tree = CleanTree(RemoveNulls=boolean_toggle_5, RemoveInvalid=boolean_toggle_5, RemoveEmpty=boolean_toggle_5, Tree=mesh_7)  # disabled
list_item_11 = ListItem(List=clean_tree, Index=0, Wrap=True)  # -> Item, Item1, Item2; disabled
mesh_8 = Mesh(solver_3.O)  # disabled
weaverbird_s_face_polylines_6 = WeaverbirdsFacePolylines(Mesh=mesh_6)  # disabled
boolean_toggle_8 = BooleanToggle(True)  # disabled
weaverbird_s_catmull_clark_subdivision = WeaverbirdsCatmullClarkSubdivision(MeshCurves=list_item_11.Item, Level=1, SmoothNakedEdges=1)  # disabled
geometry_12 = Geometry(flatten([mesh_edges_17.NakedEdges, mesh_edges_17.InteriorEdges]))  # disabled
clean_tree_2 = CleanTree(RemoveNulls=boolean_toggle_6, RemoveInvalid=boolean_toggle_6, RemoveEmpty=boolean_toggle_6, Tree=mesh_8)  # disabled
list_item_12 = ListItem(List=clean_tree_2, Index=0, Wrap=True)  # -> Item, Item1, Item2; disabled
mesh_9 = Mesh(solver_4.O)  # disabled
boundary_surfaces = BoundarySurfaces(Edges=weaverbird_s_face_polylines_6)  # disabled
weaverbird_s_catmull_clark_subdivision_2 = WeaverbirdsCatmullClarkSubdivision(MeshCurves=list_item_12.Item2, Level=1, SmoothNakedEdges=1)  # disabled
clean_tree_3 = CleanTree(RemoveNulls=boolean_toggle_8, RemoveInvalid=boolean_toggle_8, RemoveEmpty=boolean_toggle_8, Tree=mesh_9)  # disabled
list_item_13 = ListItem(List=clean_tree_3, Index=0, Wrap=True)  # -> Item, Item1, Item2; disabled
weaverbird_s_catmull_clark_subdivision_3 = WeaverbirdsCatmullClarkSubdivision(MeshCurves=list_item_13.Item, Level=1, SmoothNakedEdges=1)  # disabled
deconstruct_mesh_5 = DeconstructMesh(Mesh=list_item_11.Item)  # -> Vertices, Faces, Colours, Normals; disabled
custom_preview_6 = CustomPreview(Geometry=geometry_12, Material=flatten(list_item))  # disabled
custom_preview_7 = CustomPreview(Geometry=flatten(boundary_surfaces), Material=flatten(gradient_2))  # disabled
colour_swatch_3 = ColourSwatch(SwatchColor=RGB(255, 0, 255))  # disabled
colour_swatch_4 = ColourSwatch(SwatchColor=RGB(255, 255, 255))  # disabled
deconstruct_mesh_6 = DeconstructMesh(Mesh=list_item_12.Item)  # -> Vertices, Faces, Colours, Normals; disabled
mesh_sphere_2 = MeshSphere(Base=deconstruct_mesh_5.Vertices, Radius=number_slider_47, UCount=10, VCount=20)  # disabled
colour_swatch_5 = ColourSwatch(SwatchColor=RGB(255, 0, 255))  # disabled
colour_swatch_6 = ColourSwatch(SwatchColor=RGB(255, 255, 255))  # disabled
medges = MeshEdges(Mesh=list_item_11.Item2)  # -> NakedEdges, InteriorEdges, NonManifoldEdges; disabled
colour_swatch_7 = ColourSwatch(SwatchColor=RGB(255, 255, 255))  # disabled
medges_2 = MeshEdges(Mesh=list_item_11.Item)  # -> NakedEdges, InteriorEdges, NonManifoldEdges; disabled
custom_preview_8 = CustomPreview(Geometry=list_item_11.Item2, Material=colour_swatch_4)  # disabled
custom_preview_9 = CustomPreview(Geometry=[list_item_11.Item, list_item_11.Item1], Material=colour_swatch_3)  # disabled
deconstruct_mesh_7 = DeconstructMesh(Mesh=list_item_13.Item)  # -> Vertices, Faces, Colours, Normals; disabled
colour_swatch_8 = ColourSwatch(SwatchColor=RGB(255, 0, 255))  # disabled
medges_3 = MeshEdges(Mesh=list_item_12.Item)  # -> NakedEdges, InteriorEdges, NonManifoldEdges; disabled
colour_swatch_9 = ColourSwatch(SwatchColor=RGB(255, 255, 255))  # disabled
custom_preview_10 = CustomPreview(Geometry=weaverbird_s_catmull_clark_subdivision_2, Material=colour_swatch_6)  # disabled
custom_preview_11 = CustomPreview(Geometry=[list_item_12.Item, list_item_12.Item1], Material=colour_swatch_5)  # disabled
medges_4 = MeshEdges(Mesh=weaverbird_s_catmull_clark_subdivision_2)  # -> NakedEdges, InteriorEdges, NonManifoldEdges; disabled
mesh_sphere_3 = MeshSphere(Base=deconstruct_mesh_6.Vertices, Radius=number_slider_56, UCount=10, VCount=20)  # disabled
colour_swatch_10 = ColourSwatch(SwatchColor=RGB(255, 0, 255))  # disabled
mesh_sphere_4 = MeshSphere(Base=deconstruct_mesh_7.Vertices, Radius=number_slider_65, UCount=10, VCount=20)  # disabled
medges_5 = MeshEdges(Mesh=list_item_13.Item2)  # -> NakedEdges, InteriorEdges, NonManifoldEdges; disabled
custom_preview_12 = CustomPreview(Geometry=list_item_13.Item2, Material=colour_swatch_9)  # disabled
custom_preview_13 = CustomPreview(Geometry=[list_item_13.Item, list_item_13.Item1], Material=colour_swatch_10)  # disabled
medges_6 = MeshEdges(Mesh=list_item_13.Item)  # -> NakedEdges, InteriorEdges, NonManifoldEdges; disabled
mesh_10 = Mesh(<mesh referenced from the Rhino model>)
brep_8 = Brep(<brep referenced from the Rhino model>)
nakedvertices = NakedVertices(Mesh=mesh_10)  # -> ClothedIndex, NakedIndex, ClothedPts, NakedPts
# COMPLICATED
mesh_11 = Mesh(<mesh referenced from the Rhino model>)
weld_mesh_4 = WeldMesh(Mesh=mesh_11, Angle=3.141592654)
geometry_13 = Geometry(nakedvertices.NakedPts)
weaverbird_s_unify_face_windings_5 = WeaverbirdsUnifyFaceWindings(MeshCurves=weld_mesh_4)
timer_2 = Timer(TimerInterval=1000, Target=meshmachine_2)
mesh_flip_2 = MeshFlip(Mesh=weaverbird_s_unify_face_windings_5)
meshmachine_2 = MeshMachine(
    Geometry=mesh_10,
    Length=Slider(200, range=0..1000),
    FixVertices=geometry_13,
    Flip=1,
    PullStrength=0.8,
    CurvatureAdaptivity=0,
    BoundaryScale=1,
    BoundaryDistance=5,
    Exponent=2,
    Background=0.5,
    Iterations=1,
    Reset=Toggle(True))
mesh_12 = Mesh(weaverbird_s_unify_face_windings_5)
planktonmesh_2 = PlanktonMesh(meshmachine_2)
mesh_edges_18 = MeshEdges(Mesh=planktonmesh_2)  # -> NakedEdges, InteriorEdges, NonManifoldEdges
merge_7 = Merge()  # disabled

button_6 = Button()  # disabled
toggle_5 = BooleanToggle(False)  # disabled

solver_5 = Solver(GoalObjects=flatten(merge_7), Reset=button_6, Threshold=1e-15, Tolerance=0.01, On=toggle_5)  # -> I, V, O; disabled
boolean_toggle_9 = BooleanToggle(True)  # disabled
mesh_13 = Mesh(solver_5.O)  # disabled
clean_tree_4 = CleanTree(RemoveNulls=boolean_toggle_9, RemoveInvalid=boolean_toggle_9, RemoveEmpty=boolean_toggle_9, Tree=mesh_13)  # disabled
list_item_14 = ListItem(List=clean_tree_4, Index=0, Wrap=True)  # -> Item, Item1, Item2; disabled
weaverbird_s_catmull_clark_subdivision_4 = WeaverbirdsCatmullClarkSubdivision(MeshCurves=list_item_14.Item, Level=1, SmoothNakedEdges=1)  # disabled
deconstruct_mesh_8 = DeconstructMesh(Mesh=list_item_14.Item)  # -> Vertices, Faces, Colours, Normals; disabled
colour_swatch_11 = ColourSwatch(SwatchColor=RGB(255, 255, 255))  # disabled
colour_swatch_12 = ColourSwatch(SwatchColor=RGB(255, 0, 255))  # disabled
medges_7 = MeshEdges(Mesh=list_item_14.Item2)  # -> NakedEdges, InteriorEdges, NonManifoldEdges; disabled
custom_preview_14 = CustomPreview(Geometry=list_item_14.Item2, Material=colour_swatch_11)  # disabled
custom_preview_15 = CustomPreview(Geometry=[list_item_14.Item, list_item_14.Item1], Material=colour_swatch_12)  # disabled
medges_8 = MeshEdges(Mesh=list_item_14.Item)  # -> NakedEdges, InteriorEdges, NonManifoldEdges; disabled

curve_9 = Curve([<curve referenced from the Rhino model> x2])  # disabled
number_slider_93 = Slider(4, range=0..10)  # disabled
number_slider_94 = Slider(20, range=0..100)  # disabled
number_slider_95 = Slider(8, range=0..40)  # disabled
number_slider_96 = Slider(16, range=0..100)  # disabled
settings_custom = SettingsCustom(
    StitchSeams=True,
    SimplePlanes=True,
    Refine=True,
    MinCount=16,
    MaxCount=400,
    AspectRatio=20,
    MaxDistance=0,
    MaxAngle=number_slider_25,
    MinEdge=number_slider_95,
    MaxEdge=number_slider_96)  # disabled
number_slider_97 = Slider(9, range=0..15)  # disabled
boolean_toggle_10 = BooleanToggle(False)  # disabled
timer_3 = Timer(TimerInterval=20, Target=remesh)  # disabled

multiple_curves = MultipleCurves(Curves=curve_9)  # -> Points, IndexA, IndexB, ParamA, ParamB; disabled
curve_closest_point = CurveClosestPoint(Point=multiple_curves.Points, Curve=graft(curve_9))  # -> Point, Parameter, Distance; disabled
# CROSS ARCH SIMULATION (WORKED)
shatter = Shatter(Curve=graft(curve_9), Parameters=curve_closest_point.Parameter)  # disabled

multiple_curves_2 = MultipleCurves(Curves=curve)  # -> Points, IndexA, IndexB, ParamA, ParamB; disabled
curve_closest_point_2 = CurveClosestPoint(Point=multiple_curves_2.Points, Curve=graft(curve))  # -> Point, Parameter, Distance; disabled

# ----
# COMPLICATED INFLATABLE NETWORK SIMULATION
# 
# Didn't work. Structure didnt lift and found a midway equilibrium
panel_7 = Panel("x<0.001")  # disabled
evaluate = Evaluate(Expression=panel_7, x=curve_closest_point_2.Distance)  # disabled
cull_pattern_7 = CullPattern(List=curve_closest_point_2.Parameter, CullPattern=evaluate)  # disabled

shatter_2 = Shatter(Curve=graft(curve), Parameters=cull_pattern_7)  # disabled

divide_curve_5 = DivideCurve(Curve=flatten(shatter), Count=number_slider_93, Kinks=False)  # -> Points, Tangents, Parameters; disabled
polyline_5 = PolyLine(Vertices=divide_curve_5.Points, Closed=False)  # disabled
pipe_8 = Pipe(Curve=polyline_5, Radius=number_slider_94, Caps=2)  # disabled
solid_union = SolidUnion(Breps=flatten(pipe_8))  # disabled
mesh_brep = MeshBrep(Brep=solid_union, Settings=settings_custom)  # disabled

deconstruct_brep_9 = DeconstructBrep(Brep=solid_union)  # -> Faces, Edges, Vertices; disabled

# ----
# Unroll + Nest
deconstruct_brep_10 = DeconstructBrep(Brep=solid_union)  # -> Faces, Edges, Vertices; disabled
unroll_brep_2 = UnrollBrep(Brep=deconstruct_brep_9.Faces, JoinUnrolled=False)  # disabled
brep_wireframe_2 = BrepWireframe(Brep=unroll_brep_2, Density=-1)  # disabled
join_curves_5 = JoinCurves(Curves=brep_wireframe_2, Preserve=False)  # -> flatten(Curves); disabled
number_slider_98 = Slider(11, range=0..100)  # disabled
crv_2 = Curve(<curve referenced from the Rhino model>)  # disabled
opennest_2 = OpenNest(
    Sheets=crv_2,
    Geo=join_curves_5,
    Spacing=number_slider_98,
    Placement=1,
    Tolerance=0.1,
    Rotations=4,
    Iterations=1,
    Seed=1,
    Reset=True,
    Run=False)  # -> Sheets, Geo, ID, Transform, IDS; disabled
transform_2 = Transform(Geometry=opennest_2.Geo, Transform=opennest_2.Transform)  # disabled

weld_mesh_5 = WeldMesh(Mesh=mesh_brep, Angle=3.141592654)  # disabled

number_slider_99 = Slider(0, range=0..4)  # disabled
list_item_15 = ListItem(List=deconstruct_brep_10.Faces, Index=number_slider_99, Wrap=True)  # disabled
list_item_16 = ListItem(List=unroll_brep_2, Index=number_slider_99, Wrap=True)  # disabled

triangulate_5 = Triangulate(Mesh=weld_mesh_5)  # -> Mesh, Count; disabled

remesh = ReMesh(
    InitialMesh=triangulate_5.Mesh,
    EdgeLength=number_slider_97,
    Tolerance=0.1,
    PullStrength=1,
    TargetMesh=triangulate_5.Mesh,
    Reset=boolean_toggle_10)  # -> ReMesh, Iterations; disabled
mesh_edges_19 = MeshEdges(Mesh=remesh.ReMesh)  # -> NakedEdges, InteriorEdges, NonManifoldEdges; disabled

mesh_14 = Mesh(remesh.ReMesh)  # disabled
weld_mesh_6 = WeldMesh(Mesh=mesh_14, Angle=3.141592654)  # disabled
deconstruct_brep_11 = DeconstructBrep(Brep=opennest_2.Geo)  # -> Faces, Edges, Vertices; disabled
weaverbird_s_unify_face_windings_6 = WeaverbirdsUnifyFaceWindings(MeshCurves=weld_mesh_6)  # disabled
boundary_surfaces_2 = BoundarySurfaces(Edges=deconstruct_brep_11.Edges)  # disabled
mesh_flip_3 = MeshFlip(Mesh=weaverbird_s_unify_face_windings_6)  # disabled
mesh_15 = Mesh(weaverbird_s_unify_face_windings_6)  # disabled
tween_two_surfaces_2 = TweenTwoSurfaces(
    SurfaceA=graft(deconstruct_brep_10.Faces),
    SurfaceB=graft(boundary_surfaces_2),
    Factor=number_slider_39,
    Refit=False,
    SamplePoint=0)  # disabled
demesh_4 = DeconstructMesh(Mesh=mesh_15)  # -> Vertices, Faces, Colours, Normals; disabled

number_slider_100 = Slider(15, range=0..100)  # disabled
number_slider_101 = Slider(11, range=0..100)  # disabled
mesh_surface_9 = MeshSurface(Surface=surface_4, UCount=number_slider_101, VCount=number_slider_100, Overhang=True, Equalize=False)  # disabled
md_slider_3 = MDSlider(SliderMode=0, slider_value=Point(0.5, 0.5, 0.5), x_domain=Domain(0, 1), y_domain=Domain(0, 1), z_domain=Domain(0, 1))  # disabled
mjoin_6 = MeshJoin(Meshes=flatten(mesh_surface_9))  # disabled
evaluate_surface_3 = EvaluateSurface(Surface=reparameterize(surface_4), Point=md_slider_3)  # -> Point, Normal, UDirection, VDirection, Frame; disabled
edges_from_directions_3 = EdgesFromDirections(Brep=surface_4, Directions=evaluate_surface_3.UDirection, Reflex=True, Angle=0)  # -> Edges, Indices, Map; disabled
deconstruct_brep_12 = DeconstructBrep(Brep=surface_4)  # -> Faces, Edges, Vertices; disabled
weaverbird_s_naked_boundary_3 = WeaverbirdsNakedBoundary(MeshClosedPolylines=mjoin_6)  # disabled
cull_index_3 = CullIndex(List=deconstruct_brep_12.Edges, Indices=edges_from_directions_3.Indices, Wrap=True)  # disabled
number_slider_102 = Slider(5, range=0..100)  # disabled
join_3 = JoinCurves(Curves=weaverbird_s_naked_boundary_3, Preserve=False)  # disabled
cp_3 = ControlPoints(Curve=join_3)  # -> Points, Weights, Knots; disabled
duppt_3 = RemoveDuplicatePts(Points=cp_3.Points, Tolerance=0.01)  # disabled
pipe_9 = Pipe(Curve=cull_index_3, Radius=number_slider_102, Caps=1)  # disabled
point_in_brep_4 = PointInBrep(Brep=pipe_9, Point=duppt_3, Strict=False)  # disabled
cull_pattern_8 = CullPattern(List=duppt_3, CullPattern=point_in_brep_4)  # disabled
closest_points_6 = ClosestPoints(Point=flatten(cull_pattern_8), Cloud=flatten(demesh_4.Vertices), Count=1)  # -> simplify(ClosestPoint), CPIndex, Distance; disabled

vector_display_2 = VectorDisplay(Anchor=demesh_4.Vertices, Vector=demesh_4.Normals)  # disabled
area_8 = Area(Geometry=flatten(tween_two_surfaces_2))  # -> Area, Centroid; disabled

number_slider_103 = Slider(41, range=0..1000)  # disabled
points_2 = PointList(Points=area_8.Centroid, Size=number_slider_103)  # disabled

mesh_edges_20 = MeshEdges(Mesh=mesh_15)  # -> NakedEdges, InteriorEdges, NonManifoldEdges; disabled

weaverbird_s_face_polylines_7 = WeaverbirdsFacePolylines(Mesh=mesh_15)  # disabled
area_9 = Area(Geometry=weaverbird_s_face_polylines_7)  # -> Area, Centroid; disabled
number_slider_104 = Slider(279, range=0..500)  # disabled
polygonarea_5 = PolygonArea(Polyline=weaverbird_s_face_polylines_7, Area=area_9.Area, Strength=number_slider_104)  # disabled

mesh_edges_21 = MeshEdges(Mesh=mjoin_6)  # -> NakedEdges, InteriorEdges, NonManifoldEdges; disabled

brep_9 = Brep([<brep referenced from the Rhino model> x4])  # disabled
point_in_breps_4 = PointInBreps(Brep=brep_9, Point=demesh_4.Vertices, Strict=False)  # -> Inside, Index; disabled
cull_pattern_9 = CullPattern(List=demesh_4.Vertices, CullPattern=point_in_breps_4.Inside)  # disabled
anchor_5 = Anchor(Point=cull_pattern_9, Strength=1000)  # disabled

number_slider_105 = Slider(1, range=1..131.01)  # disabled
unit_z_6 = UnitZ(Factor=number_slider_105)  # disabled
load_6 = Load(Point=demesh_4.Vertices, ForceVector=expr("-x", unit_z_6))  # disabled

flatten_tree_5 = FlattenTree(Tree=cull_pattern_8, Path="{0}")  # disabled

deconstruct_mesh_9 = DeconstructMesh(Mesh=mjoin_6)  # -> Vertices, Faces, Colours, Normals; disabled
number_slider_106 = Slider(0.2, range=0.1..131.01)  # disabled
unit_z_7 = UnitZ(Factor=number_slider_106)  # disabled
load_7 = Load(Point=deconstruct_mesh_9.Vertices, ForceVector=expr("-x", unit_z_7))  # disabled

flatten_tree_6 = FlattenTree(Tree=closest_points_6.ClosestPoint, Path="{0}")  # disabled

number_slider_107 = Slider(3, range=0..100)  # disabled
dispatch_6 = Dispatch(List=demesh_4.Vertices, DispatchPattern=point_in_breps_4.Inside)  # -> ListA, ListB; disabled
number_slider_108 = Slider(5000, range=0..10000)  # disabled
sort_duplicate_points_4 = SortDuplicatePoints(Points=dispatch_6.ListB)  # -> UniquePoints, Indices; disabled
spherecollide_5 = SphereCollide(Points=sort_duplicate_points_4.UniquePoints, Radius=number_slider_107, Strength=number_slider_108)  # disabled

geometry_14 = Geometry(flatten_tree_6)  # disabled
geometry_15 = Geometry(flatten_tree_5)  # disabled

number_slider_109 = Slider(2242, range=0..3000)  # disabled
line_13 = Line([mesh_edges_20.NakedEdges, mesh_edges_20.InteriorEdges])  # disabled
length_line_7 = LengthLine(Line=line_13, Strength=number_slider_109)  # disabled

number_slider_110 = Slider(5000, range=0..10000)  # disabled
solidpointcollide_4 = SolidPointCollide(Points=demesh_4.Vertices, Solid=brep_9, Interior=False, Unidirectional=True, Strength=number_slider_110)  # disabled

number_slider_111 = Slider(1310, range=0..3000)  # disabled
line_14 = Line([mesh_edges_21.NakedEdges, mesh_edges_21.InteriorEdges])  # disabled
length_line_8 = LengthLine(Line=line_14, Strength=number_slider_111)  # disabled

number_slider_112 = Slider(20, range=0..20)  # disabled
pressure_5 = Pressure(M=mesh_15, Strength=number_slider_112)  # disabled

coincident_3 = Coincident(Point0=geometry_15, Point1=geometry_14, Strength=number_slider_72)  # disabled
show_7 = Show(G=mesh_15)  # disabled
show_8 = Show(G=mjoin_6)  # disabled
merge_8 = Merge(
    Data1=spherecollide_5,
    Data2=flatten(show_7),
    Data3=flatten(anchor_5),
    Data4=floor_3,
    Data5=flatten(length_line_7),
    Data6=load_6,
    Data8=pressure_5,
    Data9=polygonarea_5,
    Data13=solidpointcollide_4)  # disabled
solver_6 = Solver(GoalObjects=flatten(merge_8), Reset=button_4, Threshold=1e-15, Tolerance=0.01, On=toggle_3)  # -> I, V, O; disabled
mesh_16 = Mesh(solver_6.O)  # disabled
clean_tree_5 = CleanTree(RemoveNulls=boolean_toggle_7, RemoveInvalid=boolean_toggle_7, RemoveEmpty=boolean_toggle_7, Tree=mesh_16)  # disabled
list_item_17 = ListItem(List=clean_tree_5, Index=0, Wrap=True)  # -> Item, Item1, Item2; disabled
weaverbird_s_catmull_clark_subdivision_5 = WeaverbirdsCatmullClarkSubdivision(MeshCurves=list_item_17.Item, Level=1, SmoothNakedEdges=1)  # disabled
deconstruct_mesh_10 = DeconstructMesh(Mesh=list_item_17.Item)  # -> Vertices, Faces, Colours, Normals; disabled
medges_9 = MeshEdges(Mesh=list_item_17.Item2)  # -> NakedEdges, InteriorEdges, NonManifoldEdges; disabled
custom_preview_16 = CustomPreview(Geometry=list_item_17.Item2, Material=colour_swatch_7)  # disabled
mesh_sphere_5 = MeshSphere(Base=deconstruct_mesh_10.Vertices, Radius=number_slider_107, UCount=10, VCount=20)  # disabled
custom_preview_17 = CustomPreview(Geometry=[list_item_17.Item, list_item_17.Item1], Material=colour_swatch_8)  # disabled
medges_10 = MeshEdges(Mesh=list_item_17.Item)  # -> NakedEdges, InteriorEdges, NonManifoldEdges; disabled

# ==== cluster Cluster
list = ClusterInput()
list_length = ListLength(List=list)
subtraction = Subtraction(A=list_length, B=1)
A = ClusterInput()
multiplication = Multiplication(A=A, B=subtraction)
curve = ClusterInput()
length = Length(Curve=curve)
subtraction_2 = Subtraction(A=length, B=multiplication)
concatenate = Concatenate(FragmentA="Length: ", FragmentB=length)
concatenate_2 = Concatenate(FragmentA="Remainder: ", FragmentB=subtraction_2)
result = ClusterOutput(concatenate)
result_2 = ClusterOutput(concatenate_2)
