# Grasshopper definition 200331_Channel Detail Study_Membrane Wrapping Channel.gh (Grasshopper 1.0.7)
# plug-ins: MarchingCubes, Pufferfish, OpenNest, LunchBox, Weaverbird, Kangaroo2 Components

number_slider = Slider(0.2, range=0..1)
curve = Curve(<curve referenced from the Rhino model>)
pipe = Pipe(Curve=curve, Radius=number_slider, Caps=0)  # disabled

# ---- group: Input Geometry
brep = Brep(pipe)  # disabled

# ----
# Unroll + Nest
deconstruct_brep = DeconstructBrep(Brep=brep)  # -> Faces, Edges, Vertices; disabled
unroll_brep = UnrollBrep(Brep=deconstruct_brep.Faces, JoinUnrolled=False)  # disabled
brep_wireframe = BrepWireframe(Brep=unroll_brep, Density=-1)  # disabled
join_curves = JoinCurves(Curves=brep_wireframe, Preserve=False)  # -> flatten(Curves); disabled

curve_charge = CurveCharge(Curve=flatten(curve), Radius=number_slider, ChargeStrengths=Slider(22, range=0..100))
cocoon = Cocoon(Charges=curve_charge, Iso=Slider(0.11, range=0..1), CellSize=Slider(0.1, range=0..1), Execute=Toggle(True), Simple=False)  # -> Mesh, RefinementData

# ---- group: Spacing between nested objects
number_slider_2 = Slider(0.17, range=0..1)  # disabled

# ---- group: Sheets to lay on(curve only)
crv = Curve(<curve referenced from the Rhino model>)  # disabled

# ----
mesh_edges = MeshEdges(Mesh=cocoon.Mesh)  # -> NakedEdges, InteriorEdges, NonManifoldEdges
opennest = OpenNest(
    Sheets=crv,
    Geo=join_curves,
    Spacing=number_slider_2,
    Placement=1,
    Tolerance=0.1,
    Rotations=4,
    Iterations=1,
    Seed=1,
    Reset=True,
    Run=False)  # -> Sheets, Geo, ID, Transform, IDS; disabled
mesh = Mesh(<mesh referenced from the Rhino model>)
mesh_join = MeshJoin(Meshes=mesh)
surface = Surface([<surface referenced from the Rhino model> x2])
transform = Transform(Geometry=join_curves, Transform=opennest.Transform)  # disabled
boundary_surfaces = BoundarySurfaces(Edges=opennest.Geo)  # disabled

number_slider_3 = Slider(0.6, range=0..1)  # disabled
area = Area(Geometry=[boundary_surfaces, deconstruct_brep.Faces])  # -> Area, Centroid; disabled
points = PointList(Points=area.Centroid, Size=number_slider_3)  # disabled

weld_mesh = WeldMesh(Mesh=mesh_join, Angle=3.141592654)

mesh_surface = MeshSurface(Surface=surface, UCount=Slider(28, range=0..100), VCount=Slider(20, range=0..100), Overhang=True, Equalize=False)

deconstruct_brep_2 = DeconstructBrep(Brep=surface)  # -> Faces, Edges, Vertices
list_item = ListItem(List=deconstruct_brep_2.Edges, Index=Slider(1, range=0..3), Wrap=True)
nakedvertices = NakedVertices(Mesh=mesh_surface)  # -> ClothedIndex, NakedIndex, ClothedPts, NakedPts
curve_closest_point = CurveClosestPoint(Point=nakedvertices.NakedPts, Curve=list_item)  # -> Point, Parameter, Distance
geometry = Geometry(nakedvertices.NakedPts)
evaluate = Evaluate(Expression="x<0.05", x=curve_closest_point.Distance)
cull_pattern = CullPattern(List=geometry, CullPattern=evaluate)

mesh_2 = Mesh(weld_mesh)
deconstruct_mesh = DeconstructMesh(Mesh=mesh_surface)  # -> Vertices, Faces, Colours, Normals
deconstruct_mesh_2 = DeconstructMesh(Mesh=mesh_2)  # -> Vertices, Faces, Colours, Normals

brep_2 = Brep([<brep referenced from the Rhino model> x2])
point_in_breps = PointInBreps(Brep=brep_2, Point=deconstruct_mesh_2.Vertices, Strict=False)  # -> Inside, Index
cull_pattern_2 = CullPattern(List=deconstruct_mesh_2.Vertices, CullPattern=point_in_breps.Inside)

mesh_edges_2 = MeshEdges(Mesh=mesh_2)  # -> NakedEdges, InteriorEdges, NonManifoldEdges

negative = Negative(Value=Slider(0.009, range=0.001..1))
unit_z = UnitZ(Factor=negative)

weaverbird_s_face_polylines = WeaverbirdsFacePolylines()
area_2 = Area(Geometry=weaverbird_s_face_polylines)  # -> Area, Centroid
polygonarea = PolygonArea(Polyline=weaverbird_s_face_polylines, Area=area_2.Area, Strength=Slider(184, range=0..500))

number_slider_4 = Slider(100, range=0..100)
geometry_2 = Geometry(cull_pattern_2)

line = Line([mesh_edges_2.NakedEdges, mesh_edges_2.InteriorEdges])
brep_3 = Brep(<brep referenced from the Rhino model>)

tree_branch = TreeBranch(Tree=simplify(cull_pattern), Path=Slider(0, range=0..1), MaintainPaths=True)
point_in_breps_2 = PointInBreps(Brep=brep_3, Point=tree_branch, Strict=False)  # -> Inside, Index
cull_pattern_3 = CullPattern(List=tree_branch, CullPattern=point_in_breps_2.Inside)

tree_branch_2 = TreeBranch(Tree=simplify(cull_pattern), Path=Slider(1, range=0..1), MaintainPaths=True)
point_in_breps_3 = PointInBreps(Brep=brep_3, Point=tree_branch_2, Strict=False)  # -> Inside, Index
cull_pattern_4 = CullPattern(List=tree_branch_2, CullPattern=point_in_breps_3.Inside)

pressure = Pressure(M=mesh_2, Strength=Slider(20, range=1..20))
length_line = LengthLine(Line=line, Strength=Slider(26, range=0..100))
load = Load(Point=deconstruct_mesh_2.Vertices, ForceVector=unit_z)
anchor = Anchor(Point=geometry_2, Strength=Slider(5000, range=0..10000))
floor = Floor(Strength=Slider(500, range=0..1000))
show = Show(G=mesh_2)

tree_branch_3 = TreeBranch(Tree=simplify(deconstruct_mesh.Vertices), Path=Slider(1, range=0..1), MaintainPaths=True)

tree_branch_4 = TreeBranch(Tree=simplify(deconstruct_mesh.Vertices), Path=Slider(0, range=0..1), MaintainPaths=True)

solver = Solver(
    GoalObjects=flatten([show, length_line, anchor, pressure, floor, load]),
    Reset=Button(),
    Threshold=1e-15,
    Tolerance=0.01,
    On=Toggle(False))  # -> I, V, O
closest_point = ClosestPoint(Point=cull_pattern_4, Cloud=tree_branch_4)  # -> ClosestPoint, CPIndex, Distance
closest_point_2 = ClosestPoint(Point=cull_pattern_3, Cloud=tree_branch_3)  # -> ClosestPoint, CPIndex, Distance

brep_4 = Brep([<brep referenced from the Rhino model> x2])
point_in_breps_4 = PointInBreps(Brep=brep_4, Point=deconstruct_mesh.Vertices, Strict=False)  # -> Inside, Index
cull_pattern_5 = CullPattern(List=deconstruct_mesh.Vertices, CullPattern=point_in_breps_4.Inside)

list_item_2 = ListItem(List=solver.O, Index=0, Wrap=True)

mesh_edges_3 = MeshEdges(Mesh=mesh_surface)  # -> NakedEdges, InteriorEdges, NonManifoldEdges
line_2 = Line([mesh_edges_3.NakedEdges, mesh_edges_3.InteriorEdges])

offset_mesh = OffsetMesh(Mesh=list_item_2, Distance=Slider(0.03, range=0..1), BothSides=False, CreateSolid=False)

length_line_2 = LengthLine(Line=line_2, Strength=Slider(100, range=0..100))
coincident = Coincident(Point0=cull_pattern_4, Point1=closest_point.ClosestPoint, Strength=Slider(996, range=0..1000))
anchor_2 = Anchor(Point=cull_pattern_5, Strength=Slider(1000, range=0..1000))
coincident_2 = Coincident(Point0=cull_pattern_3, Point1=closest_point_2.ClosestPoint, Strength=Slider(996, range=0..1000))
solidpointcollide = SolidPointCollide(
    Points=deconstruct_mesh.Vertices,
    Solid=offset_mesh,
    Interior=False,
    Unidirectional=True,
    Strength=Slider(1000, range=0..1000))
show_2 = Show(G=mesh_surface)
solver_2 = Solver(
    GoalObjects=flatten([solidpointcollide, show_2, coincident_2, length_line_2, anchor_2, coincident]),
    Reset=Button(),
    Threshold=1e-15,
    Tolerance=0.01,
    On=Toggle(False))  # -> I, V, O
mesh_3 = Mesh(solver_2.O)
mesh_edges_4 = MeshEdges(Mesh=mesh_3)  # -> NakedEdges, InteriorEdges, NonManifoldEdges
custom_preview = CustomPreview(Geometry=mesh_3, Material=ColourSwatch(SwatchColor=RGBA(255, 255, 255, 196)))
