# Grasshopper definition 200408_Channel_Flat Y junction.gh (Grasshopper 1.0.7)
# plug-ins: MeshEdit Components, Kangaroo Components, LunchBox, Weaverbird, Kangaroo2 Components

mesh = Mesh(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)
refine = Refine(Mesh=mesh, Level=3)
quad = Quadrangulate(Mesh=refine, Angle=0.03490658504, Ratio=0.875)  # -> Mesh, Count

number_slider = Slider(6.1, range=0..51)
negative = Negative(Value=number_slider)
merge = Merge(Data1=negative, Data2=number_slider)  # -> graft(Result)
unit_z = UnitZ(Factor=merge)  # -> simplify(UnitVector)

nv = NakedVertices(Mesh=quad.Mesh)  # -> ClothedIndex, NakedIndex, ClothedPts, NakedPts
pt = Point(nv.NakedPts)
panel = Panel("""0
1
2
3
5
6
7
9
10
29
31
32
34
36
37
39
40
50
61
62
64
65
66
68
69
70
71""")
item = ListItem(List=pt, Index=panel, Wrap=True)
anchor = Anchor(Point=item, Strength=Slider(10000, range=0..10000))

weld_mesh = WeldMesh(Mesh=quad.Mesh, Angle=3.141592654)
weaverbird_s_naked_boundary = WeaverbirdsNakedBoundary(MeshClosedPolylines=weld_mesh)
mesh_edges = MeshEdges(Mesh=weld_mesh)  # -> NakedEdges, InteriorEdges, NonManifoldEdges
deconstruct_mesh = DeconstructMesh(Mesh=weld_mesh)  # -> Vertices, Faces, Colours, Normals

join_curves = JoinCurves(Curves=mesh_edges.NakedEdges, Preserve=False)
control_points = ControlPoints(Curve=join_curves)  # -> Points, Weights, Knots
removeduplicatepts = RemoveDuplicatePts(Points=control_points.Points, Tolerance=0.01)

closest_point = ClosestPoint(Point=deconstruct_mesh.Vertices, Cloud=removeduplicatepts)  # -> ClosestPoint, CPIndex, Distance
larger_than = LargerThan(FirstNumber=closest_point.Distance, SecondNumber=0)  # -> LargerThan, OrEqualTo
dispatch = Dispatch(List=deconstruct_mesh.Vertices, DispatchPattern=larger_than.LargerThan)  # -> ListA, ListB
move = Move(Geometry=dispatch.ListA, Motion=unit_z)  # -> simplify(Geometry), Transform
weave = Weave(Pattern=larger_than.LargerThan, Stream0=dispatch.ListB, Stream1=move.Geometry, NullGaps=False)  # -> simplify(Weave)
construct_mesh = ConstructMesh(Vertices=weave, Faces=deconstruct_mesh.Faces)  # -> simplify(Mesh)
explode_tree = ExplodeTree(Data=construct_mesh)  # -> Branch0, Branch1
mesh_flip = MeshFlip(Mesh=explode_tree.Branch0)
mesh_2 = Mesh(explode_tree.Branch1)
merge_2 = Merge(Data1=mesh_flip, Data2=explode_tree.Branch1)  # -> flatten(Result)
mesh_join = MeshJoin(Meshes=merge_2)

mesh_edges_2 = MeshEdges(Mesh=mesh_2)  # -> NakedEdges, InteriorEdges, NonManifoldEdges
mesh_edges_3 = MeshEdges(Mesh=mesh_flip)  # -> NakedEdges, InteriorEdges, NonManifoldEdges
geometry = Geometry([mesh_edges_3.NakedEdges, mesh_edges_3.InteriorEdges])
geometry_2 = Geometry([mesh_edges_2.NakedEdges, mesh_edges_2.InteriorEdges])
number_slider_2 = Slider(0.051, range=0..1)
strength = Slider(124, range=0..5000)
length = Length(Curve=geometry_2)
length_2 = Length(Curve=geometry)
neg = Negative(Value=number_slider_2)
multiplication = Multiplication(A=length, B=number_slider_2)
multiplication_2 = Multiplication(A=length_2, B=neg)
clamplength = ClampLength(Line=geometry_2, LowerLimit=length, UpperLimit=multiplication, Strength=strength)
clamplength_2 = ClampLength(Line=geometry, LowerLimit=length_2, UpperLimit=multiplication_2, Strength=strength)

mesh_3 = Mesh(mesh_join)
weld_mesh_2 = WeldMesh(Mesh=mesh_3, Angle=3.141592654)
deconstruct_mesh_2 = DeconstructMesh(Mesh=weld_mesh_2)  # -> Vertices, Faces, Colours, Normals

pressure = Pressure(M=weld_mesh_2, Strength=Slider(1.932, range=0..11))

sort_duplicate_points = SortDuplicatePoints(Points=deconstruct_mesh_2.Vertices)  # -> UniquePoints, Indices
spherecollide = SphereCollide(Points=sort_duplicate_points.UniquePoints, Radius=Slider(4, range=0..100), Strength=Slider(50, range=0..10000))

show = Show(G=weld_mesh_2)
solver = Solver(
    GoalObjects=flatten([show, clamplength, spherecollide, pressure, clamplength_2, anchor]),
    Reset=Button(),
    Threshold=1e-15,
    Tolerance=0.01,
    On=Toggle(True))  # -> I, V, O
mesh_4 = Mesh(solver.O)
mesh_edges_4 = MeshEdges(Mesh=mesh_4)  # -> NakedEdges, InteriorEdges, NonManifoldEdges
geometry_3 = Geometry(flatten([mesh_edges_4.NakedEdges, mesh_edges_4.InteriorEdges]))
