# Grasshopper definition 200410_Inflatable_Deflate.gh (Grasshopper 1.0.7)
# plug-ins: MeshEdit Components, Pufferfish, Fattener, Kangaroo Components, PlanktonGh, LunchBox, Millipede, Weaverbird, Kangaroo2 Components

curve = Curve([<curve referenced from the Rhino model> x41])

number_slider = Slider(0, range=0..0.1)
length = Length(Curve=curve)
list_length = ListLength(List=curve)
duplicate_data = DuplicateData(Data=number_slider, Number=list_length, Order=True)
subtraction = Subtraction(A=length, B=number_slider)
merge = Merge(Data1=simplify(graft(subtraction)), Data2=simplify(graft(duplicate_data)))
evaluate_length = EvaluateLength(Curve=graft(curve), Length=merge, Normalized=False)  # -> Point, Tangent, Parameter
shatter = Shatter(Curve=graft(curve), Parameters=evaluate_length.Parameter)
list_item = ListItem(List=shatter, Index=Slider(1, range=0..1), Wrap=True)

curve_2 = Curve([<curve referenced from the Rhino model> x24])
brep = Brep(<brep referenced from the Rhino model>)
settings_custom = SettingsCustom(
    StitchSeams=True,
    SimplePlanes=False,
    Refine=True,
    MinCount=16,
    MaxCount=400,
    AspectRatio=20,
    MaxDistance=0,
    MaxAngle=20,
    MinEdge=Slider(0.013, range=0..0.1),
    MaxEdge=Slider(0.044, range=0..0.1))
fatten = Fatten(
    Skeleton=curve_2,
    Thickness=Slider(0.09, range=0..0.1),
    LengthSubdivisions=Slider(3, range=0..10),
    EndType=Slider(3, range=0..3),
    AdjustForAngle=False)
mesh_brep = MeshBrep(Brep=brep, Settings=settings_custom)
surface = Surface(<surface referenced from the Rhino model>)
brep_2 = Brep(<brep referenced from the Rhino model>)
settings_custom_2 = SettingsCustom(
    StitchSeams=True,
    SimplePlanes=False,
    Refine=True,
    MinCount=16,
    MaxCount=400,
    AspectRatio=20,
    MaxDistance=0,
    MaxAngle=20,
    MinEdge=Slider(0.013, range=0..0.1),
    MaxEdge=Slider(0.044, range=0..0.1))
weld_mesh = WeldMesh(Mesh=mesh_brep, Angle=3.141592654)
deconstruct_mesh = DeconstructMesh(Mesh=weld_mesh)  # -> Vertices, Faces, Colours, Normals
point_on_curve = PointOnCurve(list_item, parameter=0.5)
weaverbird_s_loop_subdivision = WeaverbirdsLoopSubdivision(MeshCurves=fatten, Level=1, SmoothNakedEdges=1)
end_points = EndPoints(Curve=list_item)  # -> Start, End
mesh_brep_2 = MeshBrep(Brep=brep_2, Settings=settings_custom_2)
mesh_edges = MeshEdges(Mesh=mesh_brep)  # -> NakedEdges, InteriorEdges, NonManifoldEdges
surface_closest_point = SurfaceClosestPoint(Point=point_on_curve, Surface=surface)  # -> Point, UVPoint, Distance
weld_mesh_2 = WeldMesh(Mesh=mesh_brep_2, Angle=3.141592654)
vector_2pt = Vector2Pt(PointA=end_points.Start, PointB=end_points.End, Unitize=False)  # -> Vector, Length
nakedvertices = NakedVertices(Mesh=weld_mesh)  # -> ClothedIndex, NakedIndex, ClothedPts, NakedPts
deconstruct_mesh_2 = DeconstructMesh(Mesh=weld_mesh_2)  # -> Vertices, Faces, Colours, Normals
mesh_edges_2 = MeshEdges(Mesh=fatten)  # -> NakedEdges, InteriorEdges, NonManifoldEdges
geometry = Geometry(mesh_edges.NakedEdges)
evaluate_surface = EvaluateSurface(Surface=surface, Point=surface_closest_point.UVPoint)  # -> Point, Normal, UDirection, VDirection, Frame
mesh = Mesh(weaverbird_s_loop_subdivision)

weld_mesh_3 = WeldMesh(Mesh=mesh, Angle=3.141592654)
deconstruct_mesh_3 = DeconstructMesh(Mesh=weld_mesh_3)  # -> Vertices, Faces, Colours, Normals

brep_3 = Brep(<brep referenced from the Rhino model>)
point_in_breps = PointInBreps(Brep=brep_3, Point=deconstruct_mesh_3.Vertices, Strict=False)  # -> Inside, Index
dispatch = Dispatch(List=deconstruct_mesh_3.Vertices, DispatchPattern=point_in_breps.Inside)  # -> ListA, ListB
geometry_2 = Geometry(dispatch.ListA)  # disabled
geometry_3 = Geometry(dispatch.ListB)  # disabled

number_slider_2 = Slider(0.056, range=0..0.1)  # disabled
boolean_toggle = BooleanToggle(True)  # disabled
geometry_4 = Geometry(geometry_2)  # disabled
meshmachine = MeshMachine(
    Geometry=mesh,
    Length=number_slider_2,
    FixVertices=geometry_4,
    Flip=1,
    PullStrength=0.8,
    CurvatureAdaptivity=0,
    BoundaryScale=1,
    BoundaryDistance=5,
    Exponent=2,
    Background=0.5,
    Iterations=1,
    Reset=boolean_toggle)  # disabled
timer = Timer(TimerInterval=20, Target=meshmachine)  # disabled
planktonmesh = PlanktonMesh(meshmachine)  # disabled
mesh_edges_3 = MeshEdges(Mesh=planktonmesh)  # -> NakedEdges, InteriorEdges, NonManifoldEdges; disabled
mesh_2 = Mesh(planktonmesh)  # disabled

mesh_edges_4 = MeshEdges(Mesh=mesh_brep_2)  # -> NakedEdges, InteriorEdges, NonManifoldEdges
align_plane = AlignPlane(Plane=evaluate_surface.Frame, Direction=vector_2pt.Vector)  # -> Plane, Angle
nakedvertices_2 = NakedVertices(Mesh=weld_mesh_2)  # -> ClothedIndex, NakedIndex, ClothedPts, NakedPts
geometry_5 = Geometry(nakedvertices.NakedPts)
number_slider_3 = Slider(0.07, range=0..0.1)
geometry_6 = Geometry(mesh_edges_4.NakedEdges)
plane_origin = PlaneOrigin(Base=align_plane.Plane, Origin=point_on_curve)

geometry_7 = Geometry(geometry_5)
meshmachine_2 = MeshMachine(
    Geometry=weld_mesh,
    Length=Slider(0.04, range=0..0.1),
    FixVertices=geometry_7,
    Flip=1,
    PullStrength=0.8,
    CurvatureAdaptivity=0,
    BoundaryScale=1,
    BoundaryDistance=5,
    Exponent=2,
    Background=0.5,
    Iterations=1,
    Reset=Toggle(False))
timer_2 = Timer(TimerInterval=20, Target=meshmachine_2)
planktonmesh_2 = PlanktonMesh(meshmachine_2)
mesh_3 = Mesh(planktonmesh_2)
mesh_edges_5 = MeshEdges(Mesh=mesh_3)  # -> NakedEdges, InteriorEdges, NonManifoldEdges

amplitude = Amplitude(Vector=evaluate_surface.Normal, Amplitude=Slider(0.05, range=0..0.1))
offset_curve = OffsetCurve(
    Curve=list_item,
    Distance=Slider(0.06, range=0..0.1),
    Plane=align_plane.Plane,
    BothSides=True,
    Kinks=0,
    CapType=Slider(0, range=0..3))
geometry_8 = Geometry(nakedvertices_2.NakedPts)
deconstruct_plane = DeconstructPlane(Plane=plane_origin)  # -> Origin, XAxis, YAxis, ZAxis
multiplication = Multiplication(A=number_slider_3, B=Slider(1.2, range=0..10))
fatten_2 = Fatten(Skeleton=curve, Thickness=number_slider_3, LengthSubdivisions=0, EndType=Slider(0, range=0..3), AdjustForAngle=False)

geometry_9 = Geometry(geometry_8)
meshmachine_3 = MeshMachine(
    Geometry=weld_mesh_2,
    Length=Slider(0.04, range=0..0.1),
    FixVertices=geometry_9,
    Flip=1,
    PullStrength=0.8,
    CurvatureAdaptivity=0,
    BoundaryScale=1,
    BoundaryDistance=5,
    Exponent=2,
    Background=0.5,
    Iterations=1,
    Reset=Toggle(False))
timer_3 = Timer(TimerInterval=20, Target=meshmachine_3)  # disabled
planktonmesh_3 = PlanktonMesh(meshmachine_3)
mesh_4 = Mesh(planktonmesh_3)
mesh_edges_6 = MeshEdges(Mesh=mesh_4)  # -> NakedEdges, InteriorEdges, NonManifoldEdges

negative = Negative(Value=multiplication)
extrude = Extrude(Base=offset_curve, Direction=amplitude)
merge_2 = Merge(Data1=multiplication, Data2=negative)
mesh_edges_7 = MeshEdges(Mesh=fatten_2)  # -> NakedEdges, InteriorEdges, NonManifoldEdges
line_sdl = LineSDL(Start=plane_origin, Direction=deconstruct_plane.YAxis, Length=merge_2)
pipe = Pipe(Curve=line_sdl, Radius=Slider(0.0287, range=0..0.04), Caps=1)
geometry_10 = Geometry(mesh_edges_7.InteriorEdges)
solid_union = SolidUnion(Breps=flatten(pipe))
collision_one_many = CollisionOneMany(Collider=simplify(flatten(geometry_10)), Obstacles=simplify(graft(solid_union)))  # -> Collision, Index
mesh_5 = Mesh(<mesh referenced from the Rhino model>)  # disabled
mesh_6 = Mesh(<mesh referenced from the Rhino model>)
number_slider_4 = Slider(0.05, range=0..0.1)  # disabled
triangulate = Triangulate(Mesh=mesh_5)  # -> Mesh, Count; disabled
weld_mesh_4 = WeldMesh(Mesh=mesh_6, Angle=3.141592654)
cull_pattern = CullPattern(List=geometry_10, CullPattern=collision_one_many.Collision)
weld_mesh_5 = WeldMesh(Mesh=triangulate.Mesh, Angle=3.141592654)  # disabled
flip_mesh = FlipMesh(Mesh=weld_mesh_5, VertexNormals=True, FaceNormals=True, FaceOrientation=True)  # disabled
deconstruct_mesh_4 = DeconstructMesh(Mesh=flip_mesh)  # -> Vertices, Faces, Colours, Normals; disabled
mesh_7 = Mesh(<mesh referenced from the Rhino model>)  # disabled
multiplication_2 = Multiplication(A=deconstruct_mesh_4.Normals, B=number_slider_4)  # disabled
loft = Loft(Curves=cull_pattern, Options={Adjust=False, Closed=False, LoftEnds=0, LoftSimp=0, LoftType=0, Rebuild=10, Refit=0.01})
weaverbird_s_naked_boundary = WeaverbirdsNakedBoundary(MeshClosedPolylines=weld_mesh_4)
weld_mesh_6 = WeldMesh(Mesh=mesh_7, Angle=3.141592654)  # disabled
vector_display = VectorDisplay(Anchor=deconstruct_mesh_4.Vertices, Vector=multiplication_2)  # disabled
mesh_edges_8 = MeshEdges(Mesh=weld_mesh_4)  # -> NakedEdges, InteriorEdges, NonManifoldEdges
deconstruct_mesh_5 = DeconstructMesh(Mesh=weld_mesh_4)  # -> Vertices, Faces, Colours, Normals
weaverbird_s_naked_boundary_2 = WeaverbirdsNakedBoundary(MeshClosedPolylines=weld_mesh_6)  # disabled
mesh_edges_9 = MeshEdges(Mesh=weld_mesh_6)  # -> NakedEdges, InteriorEdges, NonManifoldEdges; disabled

join_curves = JoinCurves(Curves=mesh_edges_8.NakedEdges, Preserve=False)
control_points = ControlPoints(Curve=join_curves)  # -> Points, Weights, Knots
removeduplicatepts = RemoveDuplicatePts(Points=control_points.Points, Tolerance=0.01)

deconstruct_mesh_6 = DeconstructMesh(Mesh=weld_mesh_6)  # -> Vertices, Faces, Colours, Normals; disabled
number_slider_5 = Slider(14, range=0..100)  # disabled
number_slider_6 = Slider(1, range=0.001..1)  # disabled

brep_4 = Brep(<brep referenced from the Rhino model>)  # disabled
point_in_breps_2 = PointInBreps(Brep=brep_4, Point=deconstruct_mesh_4.Vertices, Strict=False)  # -> Inside, Index; disabled
dispatch_2 = Dispatch(List=deconstruct_mesh_4.Vertices, DispatchPattern=point_in_breps_2.Inside)  # -> ListA, ListB; disabled
geometry_11 = Geometry(dispatch_2.ListB)  # disabled
geometry_12 = Geometry(dispatch_2.ListA)  # disabled

join_curves_2 = JoinCurves(Curves=mesh_edges_9.NakedEdges, Preserve=False)  # disabled
control_points_2 = ControlPoints(Curve=join_curves_2)  # -> Points, Weights, Knots; disabled
removeduplicatepts_2 = RemoveDuplicatePts(Points=control_points_2.Points, Tolerance=0.01)  # disabled

number_slider_7 = Slider(0.017, range=0..0.2)
negative_2 = Negative(Value=number_slider_7)
merge_3 = Merge(Data1=negative_2, Data2=number_slider_7)  # -> graft(Result)
unit_z = UnitZ(Factor=merge_3)  # -> simplify(UnitVector)

panel = Panel("cos(x)*sin(y)+cos(y)*sin(z)+cos(z)*sin(x)")  # disabled
panel_2 = Panel("cos(x)+cos(y)+cos(z)")  # disabled
range = Range(Domain=Domain(-3.141592654, 3.141592654), Steps=number_slider_5)  # disabled
closest_point = ClosestPoint(Point=deconstruct_mesh_5.Vertices, Cloud=removeduplicatepts)  # -> ClosestPoint, CPIndex, Distance

number_slider_8 = Slider(0.01, range=0..0.2)  # disabled
negative_3 = Negative(Value=number_slider_8)  # disabled
merge_4 = Merge(Data1=negative_3, Data2=number_slider_8)  # -> graft(Result); disabled

cross_reference = CrossReference(ListListA=range, ListListB=range, ListA=range, CrossMode=1)  # -> ListListA, ListListB, ListA; disabled
box = Box({Plane=PlaneXY(29.22284206, -0.5686024694, -1.125280471), X=Domain(0, 4), Y=Domain(0, 4), Z=Domain(0, 4)})  # disabled
larger_than = LargerThan(FirstNumber=closest_point.Distance, SecondNumber=0)  # -> LargerThan, OrEqualTo
dispatch_3 = Dispatch(List=deconstruct_mesh_5.Normals, DispatchPattern=larger_than.LargerThan)  # -> ListA, ListB

number_slider_9 = Slider(2611.21, range=0..10200)  # disabled
number_slider_10 = Slider(50, range=-201..200)  # disabled
construct_domain = ConstructDomain(DomainStart=number_slider_10, DomainEnd=number_slider_9)  # disabled
remap_numbers = RemapNumbers(Value=number_slider_6, Source=Domain(0, 1), Target=construct_domain)  # -> Mapped, Clipped; disabled

dispatch_4 = Dispatch(List=deconstruct_mesh_5.Vertices, DispatchPattern=larger_than.LargerThan)  # -> ListA, ListB
area = Area(Geometry=box)  # -> Area, Centroid; disabled
deconstruct = Deconstruct(Point=area.Centroid)  # -> XComponent, YComponent, ZComponent; disabled
number_slider_11 = Slider(1, range=0..1)  # disabled
closest_point_2 = ClosestPoint(Point=deconstruct_mesh_6.Vertices, Cloud=flatten(removeduplicatepts_2))  # -> ClosestPoint, CPIndex, Distance; disabled
addition = Addition(A=cross_reference.ListA, B=deconstruct.ZComponent)  # disabled
addition_2 = Addition(A=cross_reference.ListListA, B=deconstruct.XComponent)  # disabled
addition_3 = Addition(A=cross_reference.ListListB, B=deconstruct.YComponent)  # disabled
number_slider_12 = Slider(1, range=0..1)  # disabled
evaluate = Evaluate(Expression=panel_2, x=addition_2, y=addition_3, z=addition)  # disabled
geometry_13 = Geometry(dispatch_4.ListA)
amplitude_2 = Amplitude(Vector=dispatch_3.ListA, Amplitude=merge_3)
number_slider_13 = Slider(7920, range=0..110000)  # disabled
larger_than_2 = LargerThan(FirstNumber=closest_point_2.Distance, SecondNumber=0)  # -> LargerThan, OrEqualTo; disabled
dispatch_5 = Dispatch(List=deconstruct_mesh_6.Vertices, DispatchPattern=larger_than_2.LargerThan)  # -> ListA, ListB; disabled
dispatch_6 = Dispatch(List=deconstruct_mesh_6.Normals, DispatchPattern=larger_than_2.LargerThan)  # -> ListA, ListB; disabled

volume = Volume(Geometry=flip_mesh)  # -> Volume, Centroid; disabled
number_slider_14 = Slider(236884, range=0..1000000)  # disabled
multiplication_3 = Multiplication(A=volume.Volume, B=number_slider_6)  # disabled
volume_2 = Volume(Mesh=flip_mesh, Volume=multiplication_3, Strength=number_slider_14)  # disabled

move = Move(Geometry=dispatch_4.ListA, Motion=amplitude_2)  # -> simplify(Geometry), Transform
construct_point = ConstructPoint(XCoordinate=addition_2, YCoordinate=addition_3, ZCoordinate=addition)  # disabled
geometry_14 = Geometry(dispatch_5.ListA)  # disabled

mesh_edges_10 = MeshEdges(Mesh=flip_mesh)  # -> NakedEdges, InteriorEdges, NonManifoldEdges; disabled
number_slider_15 = Slider(7840, range=0..10000)  # disabled
geometry_15 = Geometry([mesh_edges_10.NakedEdges, mesh_edges_10.InteriorEdges])  # disabled
length_line = LengthLine(Line=geometry_15, Strength=number_slider_15)  # disabled

subtraction_2 = Subtraction(A=number_slider_11, B=number_slider_6)  # disabled

number_slider_16 = Slider(5000, range=0..10000)  # disabled
solidpointcollide = SolidPointCollide(Points=geometry_11, Solid=brep_4, Interior=False, Unidirectional=True, Strength=number_slider_16)  # disabled

number_slider_17 = Slider(0.14, range=0..1)  # disabled
addition_4 = Addition(A=number_slider_5, B=number_slider_12)  # disabled

number_slider_18 = Slider(500, range=0..1000)  # disabled
floor = Floor(Strength=number_slider_18)  # disabled

amplitude_3 = Amplitude(Vector=dispatch_6.ListA, Amplitude=merge_4)  # disabled

number_slider_19 = Slider(500, range=0..1000)  # disabled
boolean_toggle_2 = BooleanToggle(True)  # disabled
grab = Grab(On=boolean_toggle_2, Strength=number_slider_19, Range=3)  # -> Grab, Anchors; disabled

weave = Weave(Pattern=larger_than.LargerThan, Stream0=dispatch_4.ListB, Stream1=move.Geometry, NullGaps=False)  # -> simplify(Weave)
construct_mesh = ConstructMesh(Vertices=weave, Faces=deconstruct_mesh_5.Faces)  # -> simplify(Mesh)

unit_z_2 = UnitZ(Factor=expr("-x", subtraction_2))  # disabled
load = Load(Point=geometry_11, ForceVector=unit_z_2)  # disabled

number_slider_20 = Slider(5200, range=0..10000)  # disabled
anchor = Anchor(Point=geometry_12, Strength=number_slider_20)  # disabled

number_slider_21 = Slider(0.015, range=0..0.05)  # disabled
number_slider_22 = Slider(10000, range=0..10000)  # disabled
sort_duplicate_points = SortDuplicatePoints(Points=geometry_11)  # -> UniquePoints, Indices; disabled
spherecollide = SphereCollide(Points=sort_duplicate_points.UniquePoints, Radius=number_slider_21, Strength=number_slider_22)  # disabled

boolean_toggle_3 = BooleanToggle(True)  # disabled
multiplication_4 = Multiplication(A=number_slider_6, B=number_slider_13)  # disabled
hingepoints = HingePoints(Mesh=flip_mesh)  # -> _1, _2, _3, _4; disabled
explode_tree = ExplodeTree(Data=construct_mesh)  # -> Branch0, Branch1
move_2 = Move(Geometry=dispatch_5.ListA, Motion=amplitude_3)  # -> simplify(Geometry), Transform; disabled

pressure = Pressure(M=flip_mesh, Strength=remap_numbers.Mapped)  # disabled

mesh_flip = MeshFlip(Mesh=explode_tree.Branch0)
hinge = Hinge(FoldStart=hingepoints._1, FoldEnd=hingepoints._2, Tip1=hingepoints._3, Tip2=hingepoints._4, Strength=multiplication_4)  # disabled
show = Show(G=flip_mesh)  # disabled
iso_surface = IsoSurface(
    Box=box,
    Values=evaluate,
    XResolution=addition_4,
    YResolution=addition_4,
    ZResolution=addition_4,
    IsoValue=number_slider_17,
    MergeVertices=boolean_toggle_3)  # disabled
merge_5 = Merge(Data1=mesh_flip, Data2=explode_tree.Branch1)  # -> flatten(Result)
weave_2 = Weave(Pattern=larger_than_2.LargerThan, Stream0=dispatch_5.ListB, Stream1=move_2.Geometry, NullGaps=False)  # -> simplify(Weave); disabled
construct_mesh_2 = ConstructMesh(Vertices=weave_2, Faces=deconstruct_mesh_6.Faces)  # -> simplify(Mesh); disabled
explode_tree_2 = ExplodeTree(Data=construct_mesh_2)  # -> Branch0, Branch1; disabled
mesh_8 = Mesh(explode_tree.Branch1)
mesh_join = MeshJoin(Meshes=merge_5)
mesh_flip_2 = MeshFlip(Mesh=explode_tree_2.Branch0)  # disabled

boolean_toggle_4 = BooleanToggle(False)  # disabled
button = Button()  # disabled

mesh_9 = Mesh(mesh_join)
nakedvertices_3 = NakedVertices(Mesh=mesh_join)  # -> ClothedIndex, NakedIndex, ClothedPts, NakedPts
weld_mesh_7 = WeldMesh(Mesh=mesh_9, Angle=3.141592654)
merge_6 = Merge(Data1=mesh_flip_2, Data2=explode_tree_2.Branch1)  # -> flatten(Result); disabled
solver = Solver(
    GoalObjects=flatten([show, anchor, load, floor, solidpointcollide, grab.Grab, hinge, length_line, pressure]),
    Reset=button,
    Threshold=1e-15,
    Tolerance=0.01,
    On=boolean_toggle_4)  # -> I, V, O; disabled
mesh_join_2 = MeshJoin(Meshes=merge_6)  # disabled

mesh_10 = Mesh(mesh_join_2)  # disabled
boolean_toggle_5 = BooleanToggle(False)  # disabled
weld_mesh_8 = WeldMesh(Mesh=mesh_10, Angle=3.141592654)  # disabled
flip_mesh_2 = FlipMesh(Mesh=weld_mesh_8, VertexNormals=boolean_toggle_5, FaceNormals=boolean_toggle_5, FaceOrientation=boolean_toggle_5)  # disabled

mesh_11 = Mesh(solver.O)  # disabled
deconstruct_mesh_7 = DeconstructMesh(Mesh=weld_mesh_7)  # -> Vertices, Faces, Colours, Normals
mesh_edges_11 = MeshEdges(Mesh=mesh_join)  # -> NakedEdges, InteriorEdges, NonManifoldEdges
deconstruct_mesh_8 = DeconstructMesh(Mesh=mesh_11)  # -> Vertices, Faces, Colours, Normals; disabled
mesh_edges_12 = MeshEdges(Mesh=mesh_11)  # -> NakedEdges, InteriorEdges, NonManifoldEdges; disabled
multiplication_5 = Multiplication(A=deconstruct_mesh_7.Normals, B=Slider(0.001, range=0..0.1))
pt = Point(nakedvertices_3.NakedPts)

brep_5 = Brep(<brep referenced from the Rhino model>)
point_in_breps_3 = PointInBreps(Brep=brep_5, Point=pt, Strict=False)  # -> Inside, Index
dispatch_7 = Dispatch(List=pt, DispatchPattern=point_in_breps_3.Inside)  # -> ListA, ListB
geometry_16 = Geometry(dispatch_7.ListA)
geometry_17 = Geometry(dispatch_7.ListB)

mesh_edges_13 = MeshEdges(Mesh=mesh_8)  # -> NakedEdges, InteriorEdges, NonManifoldEdges
mesh_edges_14 = MeshEdges(Mesh=mesh_flip)  # -> NakedEdges, InteriorEdges, NonManifoldEdges
geometry_18 = Geometry([mesh_edges_13.NakedEdges, mesh_edges_13.InteriorEdges])
geometry_19 = Geometry([mesh_edges_14.NakedEdges, mesh_edges_14.InteriorEdges])
strength = Slider(124, range=0..5000)
number_slider_23 = Slider(0.452, range=0..1)
length_2 = Length(Curve=geometry_18)
length_3 = Length(Curve=geometry_19)
multiplication_6 = Multiplication(A=length_2, B=number_slider_23)
neg = Negative(Value=number_slider_23)
multiplication_7 = Multiplication(A=length_3, B=neg)
clamplength = ClampLength(Line=geometry_18, LowerLimit=multiplication_6, UpperLimit=length_2, Strength=strength)
clamplength_2 = ClampLength(Line=geometry_19, LowerLimit=multiplication_7, UpperLimit=length_3, Strength=strength)

number_slider_24 = Slider(0.001, range=0..0.1)  # disabled
dispatch_8 = Dispatch(List=deconstruct_mesh_8.Vertices, DispatchPattern=point_in_breps_2.Inside)  # -> ListA, ListB; disabled
nakedvertices_4 = NakedVertices(Mesh=flip_mesh_2)  # -> ClothedIndex, NakedIndex, ClothedPts, NakedPts; disabled
mesh_edges_15 = MeshEdges(Mesh=flip_mesh_2)  # -> NakedEdges, InteriorEdges, NonManifoldEdges; disabled
deconstruct_mesh_9 = DeconstructMesh(Mesh=flip_mesh_2)  # -> Vertices, Faces, Colours, Normals; disabled
vector_display_2 = VectorDisplay(Anchor=deconstruct_mesh_7.Vertices, Vector=multiplication_5)
geometry_20 = Geometry([mesh_edges_11.NakedEdges, mesh_edges_11.InteriorEdges])
geometry_21 = Geometry(flatten([mesh_edges_12.NakedEdges, mesh_edges_12.InteriorEdges]))  # disabled
mesh_sphere = MeshSphere(Base=dispatch_8.ListB, Radius=number_slider_21, UCount=10, VCount=20)  # disabled
multiplication_8 = Multiplication(A=deconstruct_mesh_9.Normals, B=number_slider_24)  # disabled
pt_2 = Point(nakedvertices_4.NakedPts)  # disabled

brep_6 = Brep(<brep referenced from the Rhino model>)  # disabled
point_in_breps_4 = PointInBreps(Brep=brep_6, Point=pt_2, Strict=False)  # -> Inside, Index; disabled
dispatch_9 = Dispatch(List=pt_2, DispatchPattern=point_in_breps_4.Inside)  # -> ListA, ListB; disabled
geometry_22 = Geometry(dispatch_9.ListA)  # disabled
geometry_23 = Geometry(dispatch_9.ListB)  # disabled

vector_display_3 = VectorDisplay(Anchor=deconstruct_mesh_9.Vertices, Vector=multiplication_8)  # disabled
geometry_24 = Geometry([mesh_edges_15.NakedEdges, mesh_edges_15.InteriorEdges])  # disabled

pressure_2 = Pressure(M=weld_mesh_7, Strength=Slider(61, range=-1..61))

anchor_2 = Anchor(Point=geometry_16, Strength=Slider(10000, range=0..10000))

number_slider_25 = Slider(80, range=-1..80)  # disabled
pressure_3 = Pressure(M=flip_mesh_2, Strength=number_slider_25)  # disabled

number_slider_26 = Slider(0.011, range=0..0.025)
sort_duplicate_points_2 = SortDuplicatePoints(Points=deconstruct_mesh_7.Vertices)  # -> UniquePoints, Indices
spherecollide_2 = SphereCollide(Points=sort_duplicate_points_2.UniquePoints, Radius=number_slider_26, Strength=Slider(50, range=0..10000))

negative_4 = Negative(Value=Slider(0.001, range=-0.001..0.001))
number_slider_27 = Slider(0, range=-0.001..0.101)  # disabled
number_slider_28 = Slider(500, range=0..1000)  # disabled
length_line_2 = LengthLine(Line=geometry_20, Strength=Slider(42, range=0..1000))

number_slider_29 = Slider(1600, range=0..10000)  # disabled
anchor_3 = Anchor(Point=geometry_22, Strength=number_slider_29)  # disabled

vertexloads = VertexLoads(Mesh=weld_mesh_7, Strength=negative_4)
number_slider_30 = Slider(42, range=0..1000)  # disabled
hingepoints_2 = HingePoints(Mesh=flip_mesh_2)  # -> _1, _2, _3, _4; disabled
number_slider_31 = Slider(500, range=0..1000)  # disabled
show_2 = Show(G=weld_mesh_7)

number_slider_32 = Slider(0.015, range=0..0.025)  # disabled
number_slider_33 = Slider(10000, range=0..10000)  # disabled
sort_duplicate_points_3 = SortDuplicatePoints(Points=deconstruct_mesh_9.Vertices)  # -> UniquePoints, Indices; disabled
spherecollide_3 = SphereCollide(Points=sort_duplicate_points_3.UniquePoints, Radius=number_slider_32, Strength=number_slider_33)  # disabled

number_slider_34 = Slider(5000, range=0..10000)  # disabled
boolean_toggle_6 = BooleanToggle(True)  # disabled
negative_5 = Negative(Value=number_slider_27)  # disabled
length_line_3 = LengthLine(Line=geometry_24, Strength=number_slider_30)  # disabled
nofoldthrough = NoFoldThrough(
    FoldStart=hingepoints_2._1,
    FoldEnd=hingepoints_2._2,
    Tip1=hingepoints_2._3,
    Tip2=hingepoints_2._4,
    Strength=number_slider_28)  # disabled
hinge_2 = Hinge(
    FoldStart=hingepoints_2._1,
    FoldEnd=hingepoints_2._2,
    Tip1=hingepoints_2._3,
    Tip2=hingepoints_2._4,
    Strength=number_slider_28)  # disabled
grab_2 = Grab(On=boolean_toggle_6, Strength=number_slider_31, Range=3)  # -> Grab, Anchors; disabled
floor_2 = Floor(Strength=number_slider_34)  # disabled
vertexloads_2 = VertexLoads(Mesh=flip_mesh_2, Strength=negative_5)  # disabled
show_3 = Show(G=flip_mesh_2)  # disabled
solver_2 = Solver(
    GoalObjects=flatten([show_2, spherecollide_2, pressure_2, length_line_2, anchor_2, vertexloads]),
    Reset=Button(),
    Threshold=1e-15,
    Tolerance=0.01,
    On=Toggle(False))  # -> I, V, O
mesh_12 = Mesh(solver_2.O)
deconstruct_mesh_10 = DeconstructMesh(Mesh=mesh_12)  # -> Vertices, Faces, Colours, Normals

button_2 = Button()  # disabled
boolean_toggle_7 = BooleanToggle(False)  # disabled

solver_3 = Solver(
    GoalObjects=flatten([show_3, pressure_3, length_line_3, anchor_3, floor_2, grab_2.Grab]),
    Reset=button_2,
    Threshold=1e-15,
    Tolerance=0.01,
    On=boolean_toggle_7)  # -> I, V, O; disabled
weaverbird_s_loop_subdivision_2 = WeaverbirdsLoopSubdivision(MeshCurves=mesh_12, Level=1, SmoothNakedEdges=1)
mesh_sphere_2 = MeshSphere(Base=deconstruct_mesh_10.Vertices, Radius=number_slider_26, UCount=10, VCount=20)
mesh_13 = Mesh(solver_3.O)  # disabled
deconstruct_mesh_11 = DeconstructMesh(Mesh=mesh_13)  # -> Vertices, Faces, Colours, Normals; disabled
weaverbird_s_loop_subdivision_3 = WeaverbirdsLoopSubdivision(MeshCurves=mesh_13, Level=1, SmoothNakedEdges=1)  # disabled
mesh_edges_16 = MeshEdges(Mesh=weaverbird_s_loop_subdivision_2)  # -> NakedEdges, InteriorEdges, NonManifoldEdges
mesh_sphere_3 = MeshSphere(Base=deconstruct_mesh_11.Vertices, Radius=number_slider_32, UCount=10, VCount=20)  # disabled
geometry_25 = Geometry(flatten([mesh_edges_16.NakedEdges, mesh_edges_16.InteriorEdges]))
mesh_edges_17 = MeshEdges(Mesh=mesh_13)  # -> NakedEdges, InteriorEdges, NonManifoldEdges; disabled
geometry_26 = Geometry(flatten([mesh_edges_17.NakedEdges, mesh_edges_17.InteriorEdges]))  # disabled
number_slider_35 = Slider(5, range=0..10)  # disabled
curve_3 = Curve([<curve referenced from the Rhino model> x24])  # disabled
discontinuity = Discontinuity(Curve=curve_3, Level=1)  # -> Points, Parameters; disabled
divide_curve = DivideCurve(Curve=curve_3, Count=number_slider_35, Kinks=False)  # -> Points, Tangents, Parameters; disabled
sort_duplicate_points_4 = SortDuplicatePoints(Points=flatten(divide_curve.Points))  # -> UniquePoints, Indices; disabled
curve_4 = Curve([<curve referenced from the Rhino model> x2])
curve_5 = Curve([<curve referenced from the Rhino model> x2])

brep_7 = Brep(<brep referenced from the Rhino model>)  # disabled
point_in_breps_5 = PointInBreps(Brep=brep_7, Point=sort_duplicate_points_4.UniquePoints, Strict=False)  # -> Inside, Index; disabled
dispatch_10 = Dispatch(List=sort_duplicate_points_4.UniquePoints, DispatchPattern=point_in_breps_5.Inside)  # -> ListA, ListB; disabled
geometry_27 = Geometry(dispatch_10.ListB)  # disabled
geometry_28 = Geometry(dispatch_10.ListA)  # disabled

list_item_2 = ListItem(List=curve_4, Index=0, Wrap=True)  # -> Item, Item1
geometry_29 = Geometry(curve_3)  # disabled
number_slider_36 = Slider(1, range=0..1)  # disabled
sweep2 = Sweep2(Rail1=list_item_2.Item, Rail2=list_item_2.Item1, Sections=curve_5, SameHeight=False)
number_slider_37 = Slider(1, range=0..1000)  # disabled
number_slider_38 = Slider(1, range=-0.01..1)  # disabled
end_points_2 = EndPoints(Curve=geometry_29)  # -> Start, End; disabled
vector_2pt_2 = Vector2Pt(PointA=end_points_2.Start, PointB=end_points_2.End, Unitize=False)  # -> Vector, Length; disabled
multiplication_9 = Multiplication(A=number_slider_36, B=number_slider_37)  # disabled
subtraction_3 = Subtraction(A=number_slider_38, B=number_slider_36)  # disabled
number_slider_39 = Slider(10000, range=0..10000)  # disabled

number_slider_40 = Slider(500, range=0..1000)  # disabled
floor_3 = Floor(Strength=number_slider_40)  # disabled

number_slider_41 = Slider(5000, range=0..10000)  # disabled
panel_3 = Panel(multiplication_9)  # disabled

unit_z_3 = UnitZ(Factor=expr("-x", subtraction_3))  # disabled
load_2 = Load(Point=geometry_27, ForceVector=unit_z_3)  # disabled

number_slider_42 = Slider(5000, range=0..10000)  # disabled
boolean_toggle_8 = BooleanToggle(True)  # disabled
grab_3 = Grab(On=boolean_toggle_8, Strength=number_slider_42, Range=3)  # -> Grab, Anchors; disabled

number_slider_43 = Slider(5200, range=0..10000)  # disabled
anchor_4 = Anchor(Point=geometry_28, Strength=number_slider_43)  # disabled

number_slider_44 = Slider(0.025, range=0..0.05)  # disabled
number_slider_45 = Slider(10000, range=0..10000)  # disabled
direction = Direction(Line=geometry_29, Direction=vector_2pt_2.Vector, Strength=1)  # disabled
length_line_4 = LengthLine(Line=geometry_29, Strength=number_slider_39)  # disabled
anchor_5 = Anchor(Point=geometry_27, Target=geometry_27, Strength=multiplication_9)  # disabled
solidpointcollide_2 = SolidPointCollide(Points=geometry_27, Solid=brep_7, Interior=False, Unidirectional=True, Strength=number_slider_41)  # disabled
spherecollide_4 = SphereCollide(Points=geometry_27, Radius=number_slider_44, Strength=number_slider_45)  # disabled
show_4 = Show(G=curve_3)  # disabled

boolean_toggle_9 = BooleanToggle(True)  # disabled
button_3 = Button()  # disabled

solver_4 = Solver(
    GoalObjects=flatten([show_4, length_line_4, anchor_4, load_2, floor_3, grab_3.Grab, solidpointcollide_2, spherecollide_4, anchor_5]),
    Reset=button_3,
    Threshold=1e-15,
    Tolerance=0.01,
    On=boolean_toggle_9)  # -> I, V, O; disabled
curve_6 = Curve(solver_4.O)  # disabled

number_slider_46 = Slider(0.09, range=0..0.1)  # disabled
number_slider_47 = Slider(3, range=0..3)  # disabled
number_slider_48 = Slider(2, range=0..10)  # disabled
fatten_3 = Fatten(
    Skeleton=curve_6,
    Thickness=number_slider_46,
    LengthSubdivisions=number_slider_48,
    EndType=number_slider_47,
    AdjustForAngle=False)  # disabled
weaverbird_s_loop_subdivision_4 = WeaverbirdsLoopSubdivision(MeshCurves=fatten_3, Level=1, SmoothNakedEdges=1)  # disabled

mesh_edges_18 = MeshEdges(Mesh=weaverbird_s_loop_subdivision_4)  # -> NakedEdges, InteriorEdges, NonManifoldEdges; disabled
geometry_30 = Geometry(flatten([mesh_edges_18.NakedEdges, mesh_edges_18.InteriorEdges]))  # disabled
