# Grasshopper definition 200413_Inflatable_Saddle.gh (Grasshopper 1.0.7)
# plug-ins: MeshEdit Components, Pufferfish, Fattener, Topologizer, Kangaroo Components, PlanktonGh, LunchBox, Millipede, Weaverbird, Kangaroo2 Components, TT Toolbox

curve = Curve([<curve referenced from the Rhino model> x2])
curve_2 = Curve([<curve referenced from the Rhino model> x2])
list_item = ListItem(List=curve, Index=0, Wrap=True)  # -> Item, Item1
sweep2 = Sweep2(Rail1=list_item.Item, Rail2=list_item.Item1, Sections=curve_2, SameHeight=False)

# ----
# INPUT GEOMETRY
number_slider = Slider(30, range=0..100)
mesh_surface = MeshSurface(Surface=sweep2, UCount=number_slider, VCount=Slider(38, range=0..100), Overhang=True, Equalize=False)
mesh_edges = MeshEdges(Mesh=mesh_surface)  # -> NakedEdges, InteriorEdges, NonManifoldEdges

# ---- group: EVEN!
number_slider_2 = Slider(6, range=0..100)

# ----
srf = Surface(sweep2)
wires = BrepWireframe(Brep=srf, Density=-1)
trib = TrianglePanelsB(Surface=srf, UDivisions=number_slider_2, VDivisions=Slider(8, range=0..100))
disc = Discontinuity(Curve=trib, Level=1)  # -> Points, Parameters
triangle = MeshTriangle(CornerA=0, CornerB=1, CornerC=2)
conmesh = ConstructMesh(Vertices=disc.Points, Faces=triangle)
wbjoin = WeaverbirdsJoinMeshesAndWeld(Mesh=flatten(conmesh), Weld=Toggle(True))
unim = UnifyMesh(Mesh=wbjoin)  # -> Result, Count
wbdual = WeaverbirdsDualGraph(MeshCurves=unim.Result, DualMode=0)

mesh = Mesh(<mesh referenced from the Rhino model>)
# ANALYSIS W/ MILLIPEDE
mesh_2 = Mesh(mesh_surface)

# ---- group: EVEN!
number_slider_3 = Slider(6, range=0..100)

# ----
# MAKE HEXAGON ON GEOMETRY
srf_2 = Surface(sweep2)
wires_2 = BrepWireframe(Brep=srf_2, Density=-1)
trib_2 = TrianglePanelsB(Surface=srf_2, UDivisions=number_slider_3, VDivisions=Slider(8, range=0..100))
disc_2 = Discontinuity(Curve=trib_2, Level=1)  # -> Points, Parameters
triangle_2 = MeshTriangle(CornerA=0, CornerB=1, CornerC=2)
conmesh_2 = ConstructMesh(Vertices=disc_2.Points, Faces=triangle_2)
wbjoin_2 = WeaverbirdsJoinMeshesAndWeld(Mesh=flatten(conmesh_2), Weld=Toggle(True))
unim_2 = UnifyMesh(Mesh=wbjoin_2)  # -> Result, Count
wbdual_2 = WeaverbirdsDualGraph(MeshCurves=unim_2.Result, DualMode=0)

triangulate = Triangulate(Mesh=mesh_2)  # -> Mesh, Count
geometry_pipeline = GeometryPipeline(
    GroupByLayer=False,
    GroupByType=False,
    IncludeHidden=True,
    IncludeLocked=True,
    LayerFilter="Support",
    NameFilter="*",
    SublayerFiltering=True,
    TypeFilter=1073741848)

brep = Brep(geometry_pipeline)
deconstruct_mesh = DeconstructMesh(Mesh=triangulate.Mesh)  # -> Vertices, Faces, Colours, Normals
point_in_breps = PointInBreps(Brep=brep, Point=deconstruct_mesh.Vertices, Strict=False)  # -> Inside, Index
cull_pattern = CullPattern(List=deconstruct_mesh.Vertices, CullPattern=point_in_breps.Inside)

brep_2 = Brep(<brep referenced from the Rhino model>)
deconstruct_mesh_2 = DeconstructMesh(Mesh=triangulate.Mesh)  # -> Vertices, Faces, Colours, Normals
point_in_breps_2 = PointInBreps(Brep=brep_2, Point=deconstruct_mesh_2.Vertices, Strict=False)  # -> Inside, Index
cull_pattern_2 = CullPattern(List=deconstruct_mesh_2.Vertices, CullPattern=point_in_breps_2.Inside)

brep_3 = Brep(<brep referenced from the Rhino model>)
deconstruct_mesh_3 = DeconstructMesh(Mesh=triangulate.Mesh)  # -> Vertices, Faces, Colours, Normals
point_in_breps_3 = PointInBreps(Brep=brep_3, Point=deconstruct_mesh_3.Vertices, Strict=False)  # -> Inside, Index
cull_pattern_3 = CullPattern(List=deconstruct_mesh_3.Vertices, CullPattern=point_in_breps_3.Inside)

explode = Explode(Curve=wbdual, Recursive=True)  # -> flatten(Segments), Vertices

remove_duplicate_points = RemoveDuplicatePoints(InputPoints=flatten(explode.Vertices), Tolerance=0.001)  # -> OutputPoints, FirstPointIndexes
boolean_toggle = BooleanToggle(True)
clean_tree = CleanTree(
    RemoveNulls=boolean_toggle,
    RemoveInvalid=boolean_toggle,
    RemoveEmpty=boolean_toggle,
    Tree=remove_duplicate_points.OutputPoints)

# ---- group: Self Load Points(on all vertices)
geometry = Geometry(deconstruct_mesh.Vertices)

# ---- group: Mesh Global Geometry
mesh_3 = Mesh(triangulate.Mesh)

# ---- group: Support Points
geometry_2 = Geometry(cull_pattern)

# ---- group: Load Points(external load)
geometry_3 = Geometry(cull_pattern_2)

# ----
toggle = BooleanToggle(True)
mat = MillC_StockSupportType(X=True, Y=True, Z=True, RX=toggle, RY=toggle, RZ=toggle)
fepointsupports = FEPointSupports(Point=geometry_2, SupportType=mat)

Z = UnitZ(Factor=Slider(-30, range=-10000..1))
fepointload = FEPointLoad(Point=geometry, Load=Z)

Z_2 = UnitZ(Factor=Slider(-100, range=-10000..1))
fepointload_2 = FEPointLoad(Point=geometry_3, Load=Z_2)

mat_2 = Material(MaterialType=2)
femesh = FEMesh(Meshes=mesh_3, Material=mat_2, Thickness=Slider(1, range=0..1), AreaLoad=Vector(0, 0, 0), NormalAreaLoad=0)

mesh_4 = Mesh(<mesh referenced from the Rhino model>)
deconstruct_mesh_4 = DeconstructMesh(Mesh=mesh_4)  # -> Vertices, Faces, Colours, Normals

construct_domain = ConstructDomain(DomainStart=Slider(0, range=-1..4), DomainEnd=Slider(-6, range=-6..207))

split_ahsl = SplitAHSL(Colour=deconstruct_mesh_4.Colours)  # -> Alpha, Hue, Saturation, Luminance
optimization_steps = Slider(5, range=0..5)
selfweight = Slider(1, range=0..1)
fea_system = FEASystem(
    ModelComponents=flatten([femesh, fepointsupports, fepointload, fepointload_2]),
    IntersectAddedCurves=True,
    MergeTolerance=0.0001,
    MinimumCurveSpan=0.05,
    MaximumCurveSpan=10000,
    CurveTolerance=0.1)
bounds = Bounds(Numbers=split_ahsl.Luminance)
fe_solver = FESolver(
    FEModel=fea_system,
    SelfWeightCoefficient=selfweight,
    BeamOptimisationIterations=0,
    QuadOptimisationIterations=optimization_steps,
    OptimizationTarget=0.3,
    OptimizationPenalization=1.5,
    LoadCase=0,
    AllCases=True)  # -> FEModel, MaxDeflection, Weight; disabled
remap_numbers = RemapNumbers(Value=split_ahsl.Luminance, Source=bounds, Target=construct_domain)  # -> Mapped, Clipped
point_charge = PointCharge(Point=deconstruct_mesh_4.Vertices, Charge=remap_numbers.Mapped, Decay=2)

panel = Panel("visualization")
division = Division(A=Slider(0, range=0..101), B=fe_solver.MaxDeflection)
mesh_visualization = MeshVisualization(FEModel=fe_solver.FEModel, Deflection=division, Plane=1, ShowThickness=Toggle(False), ColorMode=8)  # -> Mesh, CompleteRange, VisibleRange

merge_fields = MergeFields(Fields=point_charge)

weaverbird_s_naked_boundary = WeaverbirdsNakedBoundary(MeshClosedPolylines=wbdual)
discontinuity = Discontinuity(Curve=weaverbird_s_naked_boundary, Level=1)  # -> Points, Parameters

brep_4 = Brep([<brep referenced from the Rhino model> x2])  # disabled
point_in_breps_4 = PointInBreps(Brep=brep_4, Point=clean_tree, Strict=False)  # -> Inside, Index; disabled
cull_pattern_4 = CullPattern(List=clean_tree, CullPattern=point_in_breps_4.Inside)  # disabled

stress_pattern = StressPattern(
    FEModel=fe_solver.FEModel,
    Omega=Slider(5, range=0..5),
    Scalefield=Toggle(True),
    Uselambda=Toggle(False),
    Smoothfactor=Toggle(False),
    SmoothModulo=1,
    Iterations=Slider(0, range=0..5000),
    MeshDenisty=1,
    Layer=Slider(1, range=-1..1),
    Thickness=0,
    Bending=Toggle(False))
crv = Curve([<curve referenced from the Rhino model> x4])
pattern = Pattern(System=stress_pattern, Pattern=crv)  # -> Patterns, PatternPoints

evaluate_field = EvaluateField(Field=merge_fields, Point=clean_tree)  # -> Tensor, Strength
number_slider_4 = Slider(0.22, range=0..1)
amplitude = Amplitude(Vector=evaluate_field.Tensor, Amplitude=Slider(58, range=0..510))
hingepoints = HingePoints(Mesh=unim.Result)  # -> _1, _2, _3, _4

quad_results = QuadResults(FEModel=fe_solver.FEModel, Plane=1)  # -> PrincipalStressFrame, Area, NormalDisplacement, MaxVonMisesStress, PS1, PS2, StiffnessMultiplier, Bending
stresslines = StressLines(FEModel=fe_solver.FEModel, Points=quad_results.PrincipalStressFrame, Plane=1)  # -> Stress1, Stress2

length_line = LengthLine(Line=explode.Segments, Strength=Slider(146, range=0..1000))
nofoldthrough = NoFoldThrough(
    FoldStart=hingepoints._1,
    FoldEnd=hingepoints._2,
    Tip1=hingepoints._3,
    Tip2=hingepoints._4,
    Strength=Slider(1000, range=0..1000))
load = Load(Point=clean_tree, ForceVector=amplitude)
onmesh = OnMesh(Points=clean_tree, Mesh=mesh_4, Strength=Slider(925, range=0..1000))
anchor = Anchor(Point=flatten(discontinuity.Points), Strength=Slider(261064, range=0..301000))
spherecollide = SphereCollide(Points=clean_tree, Radius=number_slider_4, Strength=Slider(112, range=0..1000))
show = Show(G=clean_tree)
show_2 = Show(G=explode.Segments)

panel_2 = Panel("visualization of thickness")
slider = Slider(-1, range=-1..61)
c_script = CSharpScript(m=mesh_visualization.Mesh)  # -> out, A; inputs m: Mesh, dh: Double
# ---------- c_script: C# usings ----------
using System.IO;
using System.Linq;
using System.Data;
using System.Drawing;
using System.Reflection;
using System.Windows.Forms;
using System.Xml;
using System.Xml.Linq;
using System.Runtime.InteropServices;

using Rhino.DocObjects;
using Rhino.Collections;
using GH_IO;
using GH_IO.Serialization;
# ---------- c_script: C# ----------
    m.FaceNormals.ComputeFaceNormals();
    m.Normals.ComputeNormals();

    for(int i = 0; i < m.Vertices.Count; ++i) {
      Point3d p = new Point3d(m.Vertices[i]);
      Vector3d n = new Vector3d(m.Normals[i]);

      m.Vertices.SetVertex(i, p + n * dh * m.TextureCoordinates[i].X);
    }

    m.VertexColors.Clear();

    m.FaceNormals.ComputeFaceNormals();
    m.Normals.ComputeNormals();


    A = m;
# ---------- end c_script ----------

preview = CustomPreview(Geometry=c_script.A, Shader=ColourSwatch(SwatchColor=RGB(255, 255, 255)))

preview_2 = CustomPreview(Geometry=stresslines.Stress1, Shader=ColourSwatch(SwatchColor=RGBA(255, 3, 255, 177)))

preview_3 = CustomPreview(Geometry=pattern.Patterns, Shader=ColourSwatch(SwatchColor=RGB(0, 0, 0)))

explode_2 = Explode(Curve=wbdual_2, Recursive=True)  # -> flatten(Segments), Vertices
removeduplicatelines = RemoveDuplicateLines(Lines=explode_2.Segments, Tolerance=0.01)

surface = Surface(srf_2)

# ----
# MESHING CHANNEL POCKETS
brep_5 = Brep(<brep referenced from the Rhino model>)
settings_custom = SettingsCustom(
    StitchSeams=True,
    SimplePlanes=False,
    Refine=True,
    MinCount=16,
    MaxCount=400,
    AspectRatio=20,
    MaxDistance=0,
    MaxAngle=20,
    MinEdge=Slider(0.12, range=0..1),
    MaxEdge=Slider(0.24, range=0..1))
mesh_brep = MeshBrep(Brep=brep_5, Settings=settings_custom)

mesh_edges_2 = MeshEdges(Mesh=mesh_brep)  # -> NakedEdges, InteriorEdges, NonManifoldEdges
weld_mesh = WeldMesh(Mesh=mesh_brep, Angle=3.141592654)
nakedvertices = NakedVertices(Mesh=weld_mesh)  # -> ClothedIndex, NakedIndex, ClothedPts, NakedPts

geometry_4 = Geometry(nakedvertices.NakedPts)
timer = Timer(TimerInterval=20, Target=meshmachine)  # disabled
meshmachine = MeshMachine(
    Geometry=weld_mesh,
    Length=Slider(0.16, range=0..1),
    FixVertices=geometry_4,
    Flip=1,
    PullStrength=0.8,
    CurvatureAdaptivity=0,
    BoundaryScale=1,
    BoundaryDistance=5,
    Exponent=2,
    Background=0.5,
    Iterations=1,
    Reset=Toggle(False))
planktonmesh = PlanktonMesh(meshmachine)
mesh_5 = Mesh(planktonmesh)
mesh_edges_3 = MeshEdges(Mesh=mesh_5)  # -> NakedEdges, InteriorEdges, NonManifoldEdges

# ----
# SIMULATING INFLATABLE
number_slider_5 = Slider(1, range=0..1)
number_slider_6 = Slider(500, range=0..1000)
grab = Grab(On=Toggle(False), Strength=Slider(5000, range=0..10000), Range=3)  # -> Grab, Anchors
floor = Floor(Strength=Slider(500, range=0..1000))
number_slider_7 = Slider(1, range=0..1)
subtraction = Subtraction(A=number_slider_5, B=number_slider_7)
negative = Negative(Value=subtraction)

# ----
# EXPORTING FRAMES TO LOCAL FOLDER
file_path = FilePath("C:\Users\User\Desktop\Thesis Drive\Graphics\2_Animation\200430\Animation_Saddle Inflation\")
panel_3 = Panel(file_path)
c_script_2 = CSharpScript(iReset=Button(), iStart=Toggle(False), Path=panel_3, Name="image", iFrames=Slider(1700, range=0..1700))  # -> out; inputs iReset: Boolean, iStart: Boolean, Path: String, Name: String, iFrames: Int32
# ---------- c_script_2: C# usings ----------
using Rhino.Display;
using System.Threading;
# ---------- c_script_2: C# ----------
    if(iReset) counter = 0;

    if(iStart) {
      var view = doc.Views.ActiveView;
      var view_capture = new ViewCapture
        {
          Width = view.ActiveViewport.Size.Width,
          Height = view.ActiveViewport.Size.Height,
          ScaleScreenItems = false,
          DrawAxes = false,
          DrawGrid = false,
          DrawGridAxes = false,
          TransparentBackground = false
          };

      if(counter < iFrames){
        var screenshot = view_capture.CaptureToBitmap(view);
        if(screenshot != null)
        {
          string filename = Path + Name + counter + ".png";
          screenshot.Save(filename, System.Drawing.Imaging.ImageFormat.Png);
          Print("Count: " + counter);
          counter += 1;
        }
      }
    }
# ---------- c_script_2: C# additional code ----------
    int counter = 0;
# ---------- end c_script_2 ----------
panel_4 = Panel(c_script_2)

timer_2 = Timer(TimerInterval=2000, Target=[c_script_2, c_script_3])  # disabled
c_script_3 = CSharpScript(iReset=Button(), iRun=Toggle(False))  # -> out, A; inputs iReset: Boolean, iRun: Boolean
# ---------- c_script_3: C# ----------
    if(iReset){
      counter = 0.0;}
    
    if(iRun){
      counter += 0.1;
    }
    A = counter;
# ---------- c_script_3: C# additional code ----------
  double counter = 0.0;
# ---------- end c_script_3 ----------
panel_5 = Panel(c_script_3.A)

# ----
# OPTIMISATION:
# MOVING NODES ACCORDING TO
# ANALYSIS COLOUR FIELD
number_slider_8 = Slider(0.3, range=0..1)

length = Length(Curve=explode.Segments)

multiplication = Multiplication(A=length, B=number_slider_8)

multiplication_2 = Multiplication(A=length, B=Slider(1, range=0..1.5))

clamplength = ClampLength(Line=explode.Segments, LowerLimit=multiplication, UpperLimit=multiplication_2, Strength=Slider(892, range=0..1000))

merge = Merge(
    Data1=show_2,
    Data2=show,
    Data3=clamplength,
    Data4=onmesh,
    Data5=spherecollide,
    Data6=anchor,
    Data7=load,
    Data8=nofoldthrough)
solver = Solver(GoalObjects=flatten(merge), Reset=Button(), Threshold=1e-15, Tolerance=0.01, On=Toggle(False))  # -> I, V, O
curve_3 = Curve(solver.O)

number_slider_9 = Slider(0.15, range=0..1)  # disabled
topologizer = Topologizer(LinesInput=curve_3, Tolerance=number_slider_9)  # -> Lines, Points, LineStart, LineStart_2, Neighbours, Incoming, Outgoing, Graph; disabled

boolean_toggle_2 = BooleanToggle(True)
point = Point(solver.O)
clean_tree_2 = CleanTree(RemoveNulls=boolean_toggle_2, RemoveInvalid=boolean_toggle_2, RemoveEmpty=boolean_toggle_2, Tree=point)

c_script_4 = CSharpScript(x=solver.O)  # -> out, A; inputs x: list; disabled
# ---------- c_script_4: C# usings ----------
using System.Linq;
# ---------- c_script_4: C# ----------
    //List <double> output = new List<double>{};

    A = getRadius(x);

    //A = output;
# ---------- c_script_4: C# additional code ----------
  public List<double> getRadius(List<object> item)
  {
    return item.OfType<double>().ToList();
  }
# ---------- end c_script_4 ----------

pipe = Pipe(Curve=curve_3, Radius=Slider(0.07, range=0..1), Caps=0)

mesh_sphere = MeshSphere(Base=clean_tree_2, Radius=number_slider_4, UCount=10, VCount=20)

boolean_toggle_3 = BooleanToggle(True)
clean_tree_3 = CleanTree(RemoveNulls=boolean_toggle_3, RemoveInvalid=boolean_toggle_3, RemoveEmpty=boolean_toggle_3, Tree=curve_3)
removeduplicatelines_2 = RemoveDuplicateLines(Lines=clean_tree_3, Tolerance=0.01)

# ----
# MAKING CHANNEL POCKETS STAGE1
curve_4 = Curve(removeduplicatelines_2)
curve_5 = Curve(curve_4)

number_slider_10 = Slider(0, range=0..0.1)
length_2 = Length(Curve=curve_5)
list_length = ListLength(List=curve_5)
duplicate_data = DuplicateData(Data=number_slider_10, Number=list_length, Order=True)
subtraction_2 = Subtraction(A=length_2, B=number_slider_10)
merge_2 = Merge(Data1=simplify(graft(subtraction_2)), Data2=simplify(graft(duplicate_data)))
evaluate_length = EvaluateLength(Curve=graft(curve_5), Length=merge_2, Normalized=False)  # -> Point, Tangent, Parameter
shatter = Shatter(Curve=graft(curve_5), Parameters=evaluate_length.Parameter)
list_item_2 = ListItem(List=shatter, Index=Slider(1, range=0..1), Wrap=True)

point_on_curve = PointOnCurve(list_item_2, parameter=0.5)
end_points = EndPoints(Curve=list_item_2)  # -> Start, End
surface_closest_point = SurfaceClosestPoint(Point=point_on_curve, Surface=surface)  # -> Point, UVPoint, Distance
vector_2pt = Vector2Pt(PointA=end_points.Start, PointB=end_points.End, Unitize=False)  # -> Vector, Length
evaluate_surface = EvaluateSurface(Surface=surface, Point=surface_closest_point.UVPoint)  # -> Point, Normal, UDirection, VDirection, Frame
align_plane = AlignPlane(Plane=evaluate_surface.Frame, Direction=vector_2pt.Vector)  # -> Plane, Angle

offset_curve = OffsetCurve(
    Curve=list_item_2,
    Distance=Slider(0.06, range=0..0.1),
    Plane=align_plane.Plane,
    BothSides=True,
    Kinks=0,
    CapType=Slider(0, range=0..3))

plane_origin = PlaneOrigin(Base=align_plane.Plane, Origin=point_on_curve)
deconstruct_plane = DeconstructPlane(Plane=plane_origin)  # -> Origin, XAxis, YAxis, ZAxis

number_slider_11 = Slider(0.25, range=0..1.1)
fatten = Fatten(
    Skeleton=curve_4,
    Thickness=number_slider_11,
    LengthSubdivisions=Slider(0, range=0..10),
    EndType=Slider(0, range=0..10),
    AdjustForAngle=False)

number_slider_12 = Slider(0.1, range=0..0.1)
negative_2 = Negative(Value=number_slider_11)
merge_3 = Merge(Data1=number_slider_11, Data2=negative_2)
line_sdl = LineSDL(Start=deconstruct_plane.Origin, Direction=deconstruct_plane.YAxis, Length=merge_3)

fatten_2 = Fatten(
    Skeleton=curve_4,
    Thickness=Slider(0.25, range=0..1.1),
    LengthSubdivisions=Slider(1, range=0..10),
    EndType=Slider(0, range=0..10),
    AdjustForAngle=False)

pipe_2 = Pipe(Curve=line_sdl, Radius=Slider(0.076, range=0..0.1), Caps=1)

mesh_edges_4 = MeshEdges(Mesh=fatten)  # -> NakedEdges, InteriorEdges, NonManifoldEdges
weaverbird_s_loop_subdivision = WeaverbirdsLoopSubdivision(MeshCurves=fatten_2, Level=1, SmoothNakedEdges=1)
mesh_edges_5 = MeshEdges(Mesh=weaverbird_s_loop_subdivision)  # -> NakedEdges, InteriorEdges, NonManifoldEdges
collision_one_many = CollisionOneMany(Collider=flatten(mesh_edges_4.InteriorEdges), Obstacles=pipe_2)  # -> Collision, Index
cull_pattern_5 = CullPattern(List=simplify(mesh_edges_4.InteriorEdges), CullPattern=collision_one_many.Collision)
mesh_volume = MeshVolume(Mesh=weaverbird_s_loop_subdivision)  # -> Volume, Centroid
shift_paths = ShiftPaths(Data=cull_pattern_5, Offset=-1)
loft = Loft(Curves=shift_paths, Options={Adjust=False, Closed=False, LoftEnds=0, LoftSimp=0, LoftType=0, Rebuild=10, Refit=0.01})
absolute = Absolute(Value=mesh_volume.Volume)
data = Data(absolute)
multiplication_3 = Multiplication(A=number_slider_7, B=data)

# ----
# MAKING CHANNEL POCKETS STAGE2
mesh_6 = Mesh(<mesh referenced from the Rhino model>)
weld_mesh_2 = WeldMesh(Mesh=mesh_6, Angle=3.141592654)
weaverbird_s_naked_boundary_2 = WeaverbirdsNakedBoundary(MeshClosedPolylines=weld_mesh_2)
mesh_edges_6 = MeshEdges(Mesh=weld_mesh_2)  # -> NakedEdges, InteriorEdges, NonManifoldEdges
deconstruct_mesh_5 = DeconstructMesh(Mesh=weld_mesh_2)  # -> Vertices, Faces, Colours, Normals
number_slider_13 = Slider(0.073, range=0..0.1)

join_curves = JoinCurves(Curves=mesh_edges_6.NakedEdges, Preserve=False)
control_points = ControlPoints(Curve=join_curves)  # -> Points, Weights, Knots
removeduplicatepts = RemoveDuplicatePts(Points=control_points.Points, Tolerance=0.01)

negative_3 = Negative(Value=number_slider_13)
merge_4 = Merge(Data1=negative_3, Data2=number_slider_13)  # -> graft(Result)
unit_z = UnitZ(Factor=merge_4)  # -> simplify(UnitVector)

closest_point = ClosestPoint(Point=deconstruct_mesh_5.Vertices, Cloud=flatten(removeduplicatepts))  # -> ClosestPoint, CPIndex, Distance
larger_than = LargerThan(FirstNumber=closest_point.Distance, SecondNumber=0)  # -> LargerThan, OrEqualTo
dispatch = Dispatch(List=deconstruct_mesh_5.Vertices, DispatchPattern=larger_than.LargerThan)  # -> ListA, ListB
move = Move(Geometry=dispatch.ListA, Motion=unit_z)  # -> simplify(Geometry), Transform
weave = Weave(Pattern=larger_than.LargerThan, Stream0=dispatch.ListB, Stream1=move.Geometry, NullGaps=False)  # -> simplify(Weave)
construct_mesh = ConstructMesh(Vertices=weave, Faces=deconstruct_mesh_5.Faces)  # -> simplify(Mesh)
explode_tree = ExplodeTree(Data=construct_mesh)  # -> Branch0, Branch1
mesh_flip = MeshFlip(Mesh=explode_tree.Branch0)
merge_5 = Merge(Data1=mesh_flip, Data2=explode_tree.Branch1)  # -> flatten(Result)
mesh_join = MeshJoin(Meshes=merge_5)

mesh_7 = Mesh(mesh_join)
weld_mesh_3 = WeldMesh(Mesh=mesh_7, Angle=3.141592654)
unify_mesh = UnifyMesh(Mesh=weld_mesh_3)  # -> Result, Count

brep_6 = Brep([<brep referenced from the Rhino model> x2])
deconstruct_mesh_6 = DeconstructMesh(Mesh=unify_mesh.Result)  # -> Vertices, Faces, Colours, Normals
point_in_breps_5 = PointInBreps(Brep=brep_6, Point=deconstruct_mesh_6.Vertices, Strict=False)  # -> Inside, Index
dispatch_2 = Dispatch(List=deconstruct_mesh_6.Vertices, DispatchPattern=point_in_breps_5.Inside)  # -> ListA, ListB

multiplication_4 = Multiplication(A=deconstruct_mesh_6.Normals, B=Slider(0.005, range=0..0.01))
vector_display = VectorDisplay(Anchor=deconstruct_mesh_6.Vertices, Vector=multiplication_4)

mesh_edges_7 = MeshEdges(Mesh=unify_mesh.Result)  # -> NakedEdges, InteriorEdges, NonManifoldEdges
geometry_5 = Geometry([mesh_edges_7.NakedEdges, mesh_edges_7.InteriorEdges])
pt = Point(dispatch_2.ListA)

sort_duplicate_points = SortDuplicatePoints(Points=dispatch_2.ListB)  # -> UniquePoints, Indices
number_slider_14 = Slider(0.029, range=0.005..0.25)
spherecollide_2 = SphereCollide(Points=sort_duplicate_points.UniquePoints, Radius=number_slider_14, Strength=Slider(7810, range=0..10000))

volume = Volume(Mesh=unify_mesh.Result, Volume=multiplication_3, Strength=Slider(500, range=0..1000))
solidpointcollide = SolidPointCollide(
    Points=sort_duplicate_points.UniquePoints,
    Solid=brep_6,
    Interior=False,
    Unidirectional=True,
    Strength=Slider(1000, range=0..1000))
anchor_2 = Anchor(Point=pt, Strength=Slider(10000, range=0..10000))
show_3 = Show(G=unify_mesh.Result)
vertexloads = VertexLoads(Mesh=unify_mesh.Result, Strength=negative)
length_line_2 = LengthLine(Line=geometry_5, Strength=number_slider_6)

length_3 = Length(Curve=geometry_5)
multiplication_5 = Multiplication(A=length_3, B=Slider(0.986, range=0..1))

multiplication_6 = Multiplication(A=length_3, B=Slider(1.005, range=0..1.01))

clamplength_2 = ClampLength(Line=geometry_5, LowerLimit=multiplication_5, UpperLimit=multiplication_6, Strength=number_slider_6)

multiplication_7 = Multiplication(A=number_slider_7, B=Slider(181, range=0..181))

pressure = Pressure(M=unify_mesh.Result, Strength=multiplication_7)

stream_gate = StreamGate(
    Stream=[show_3, clamplength_2, pressure, anchor_2, floor, vertexloads, spherecollide_2, grab.Grab, volume, solidpointcollide],
    Gate=Slider(0, range=0..1))  # -> Target0, Target1
solver_2 = Solver(GoalObjects=flatten(stream_gate.Target1), Reset=Button(), Threshold=1e-15, Tolerance=0.01, On=Toggle(False))  # -> I, V, O
stepsolver = StepSolver(
    GoalObjects=flatten(stream_gate.Target0),
    Tolerance=0.01,
    Momentum=False,
    Damping=0.99,
    SubIterations=Slider(200, range=0..10000),
    Animate=c_script_3.A)  # -> I, V, O

boolean_toggle_4 = BooleanToggle(True)
mesh_8 = Mesh(stepsolver.O)
clean_tree_4 = CleanTree(RemoveNulls=boolean_toggle_4, RemoveInvalid=boolean_toggle_4, RemoveEmpty=boolean_toggle_4, Tree=mesh_8)

weaverbird_s_loop_subdivision_2 = WeaverbirdsLoopSubdivision(MeshCurves=clean_tree_4, Level=1, SmoothNakedEdges=1)
mesh_edges_8 = MeshEdges(Mesh=weaverbird_s_loop_subdivision_2)  # -> NakedEdges, InteriorEdges, NonManifoldEdges
deconstruct_mesh_7 = DeconstructMesh(Mesh=clean_tree_4)  # -> Vertices, Faces, Colours, Normals; disabled
mesh_sphere_2 = MeshSphere(Base=deconstruct_mesh_7.Vertices, Radius=number_slider_14, UCount=10, VCount=20)  # disabled
geometry_6 = Geometry(flatten([mesh_edges_8.NakedEdges, mesh_edges_8.InteriorEdges]))

custom_preview = CustomPreview(Geometry=weaverbird_s_loop_subdivision_2, Material=ColourSwatch(SwatchColor=RGB(255, 0, 255)))
