# Grasshopper definition 200510_Global Design_V3.gh (Grasshopper 1.0.7)
# plug-ins: MeshEdit Components, Pufferfish, Kangaroo Components, PlanktonGh, LunchBox, Millipede, Weaverbird, Kangaroo2 Components, Nursery, Shortest Walk in Gh, karambaGH

curve = Curve([<curve referenced from the Rhino model> x7])

join_curves = JoinCurves(Curves=curve, Preserve=False)
minimal_surface_from_edges = MinimalSurfaceFromEdges(InputCurves=curve, Iterations=4, MeanStep=0.04, RelaxStep=0, Resolution=6)
mesh_edges = MeshEdges(Mesh=minimal_surface_from_edges)  # -> NakedEdges, InteriorEdges, NonManifoldEdges

mesh = Mesh(minimal_surface_from_edges)

timer = Timer(TimerInterval=20, Target=meshmachine)  # disabled
meshcorners = MeshCorners(Mesh=mesh, Angle=2.35619449)
meshmachine = MeshMachine(
    Geometry=mesh,
    Length=Slider(1.7, range=0..10),
    FixCurves=join_curves,
    FixVertices=meshcorners,
    Flip=1,
    PullStrength=0.8,
    CurvatureAdaptivity=0,
    BoundaryScale=1,
    BoundaryDistance=5,
    Exponent=2,
    Background=0.5,
    Iterations=1,
    Reset=Toggle(False))
planktonmesh = PlanktonMesh(meshmachine)

mesh_2 = Mesh(planktonmesh)

weaverbird_s_naked_boundary = WeaverbirdsNakedBoundary(MeshClosedPolylines=mesh_2)
explode = Explode(Curve=weaverbird_s_naked_boundary, Recursive=True)  # -> Segments, flatten(Vertices)
sort_duplicate_points = SortDuplicatePoints(Points=explode.Vertices)  # -> UniquePoints, Indices

curve_2 = Curve([<curve referenced from the Rhino model> x3])
pipe = Pipe(Curve=curve_2, Radius=Slider(0.1, range=0..1), Caps=2)
point_in_breps = PointInBreps(Brep=flatten(pipe), Point=sort_duplicate_points.UniquePoints, Strict=True)  # -> Inside, Index
cull_pattern = CullPattern(List=sort_duplicate_points.UniquePoints, CullPattern=point_in_breps.Inside)

mesh_edges_2 = MeshEdges(Mesh=mesh_2)  # -> NakedEdges, InteriorEdges, NonManifoldEdges
geometry = Geometry([mesh_edges_2.InteriorEdges, mesh_edges_2.NakedEdges, mesh_edges_2.NonManifoldEdges])

number_slider = Slider(100, range=0..100)
edgelengths = EdgeLengths(Mesh=mesh_2, LengthFactor=Slider(0.71, range=0..1), Strength=number_slider)
length_line = LengthLine(Line=geometry, Strength=number_slider)
anchor = Anchor(Point=cull_pattern, Strength=Slider(10000, range=0..10000))
vertexloads = VertexLoads(Mesh=mesh_2, Strength=Slider(0, range=-10..10))
show = Show(G=mesh_2)
solver = Solver(
    GoalObjects=flatten([show, anchor, edgelengths, vertexloads]),
    Reset=Button(),
    Threshold=1e-15,
    Tolerance=0.01,
    On=Toggle(False))  # -> I, V, O

boolean_toggle = BooleanToggle(True)
mesh_3 = Mesh(solver.O)
clean_tree = CleanTree(RemoveNulls=boolean_toggle, RemoveInvalid=boolean_toggle, RemoveEmpty=boolean_toggle, Tree=mesh_3)

combine_clean = CombineClean(Meshes=clean_tree)
mesh_4 = Mesh(combine_clean)
mesh_5 = Mesh(mesh_4)
weaverbird_s_naked_boundary_2 = WeaverbirdsNakedBoundary(MeshClosedPolylines=mesh_5)
join_curves_2 = JoinCurves(Curves=weaverbird_s_naked_boundary_2, Preserve=False)
close_curve = CloseCurve(Curve=join_curves_2, CloseType=0, Bulge=0.5, Tolerance=0)  # -> Closed, ResultBoolean

timer_2 = Timer(TimerInterval=20, Target=meshmachine_2)  # disabled
meshcorners_2 = MeshCorners(Mesh=mesh_5, Angle=2.35619449)
meshmachine_2 = MeshMachine(
    Geometry=mesh_5,
    Length=Slider(1.9, range=0..10),
    FixCurves=close_curve.Closed,
    FixVertices=meshcorners_2,
    Flip=1,
    PullStrength=0.8,
    CurvatureAdaptivity=0,
    BoundaryScale=1,
    BoundaryDistance=5,
    Exponent=2,
    Background=0.5,
    Iterations=1,
    Reset=Toggle(False))
planktonmesh_2 = PlanktonMesh(meshmachine_2)

mesh_6 = Mesh(planktonmesh_2)
mesh_edges_3 = MeshEdges(Mesh=mesh_6)  # -> NakedEdges, InteriorEdges, NonManifoldEdges
weaverbird_s_dual_graph = WeaverbirdsDualGraph(MeshCurves=mesh_6, DualMode=Slider(1, range=0..1))
weaverbird_s_naked_boundary_3 = WeaverbirdsNakedBoundary(MeshClosedPolylines=weaverbird_s_dual_graph)
explode_2 = Explode(Curve=weaverbird_s_naked_boundary_3, Recursive=True)  # -> Segments, Vertices
end_points = EndPoints(Curve=graft(explode_2.Segments))  # -> Start, End
point = Point([end_points.Start, end_points.End])
mesh_edges_4 = MeshEdges(Mesh=mesh_4)  # -> NakedEdges, InteriorEdges, NonManifoldEdges

deconstruct_mesh = DeconstructMesh(Mesh=mesh_4)  # -> flatten(Vertices), Faces, Colours, Normals
point_in_breps_2 = PointInBreps(Brep=flatten(pipe), Point=deconstruct_mesh.Vertices, Strict=True)  # -> Inside, Index
cull_pattern_2 = CullPattern(List=deconstruct_mesh.Vertices, CullPattern=invert(point_in_breps_2.Inside))

brep = Brep(<brep referenced from the Rhino model>)
point_in_breps_3 = PointInBreps(Brep=flatten(brep), Point=deconstruct_mesh.Vertices, Strict=True)  # -> Inside, Index
cull_pattern_3 = CullPattern(List=deconstruct_mesh.Vertices, CullPattern=point_in_breps_3.Inside)

mesh_7 = Mesh(<mesh referenced from the Rhino model>)  # disabled
explode_3 = Explode(Curve=weaverbird_s_dual_graph, Recursive=True)  # -> flatten(Segments), Vertices
weaverbird_s_loop_subdivision = WeaverbirdsLoopSubdivision(MeshCurves=mesh_7, Level=1, SmoothNakedEdges=1)  # disabled
mesh_edges_5 = MeshEdges(Mesh=weaverbird_s_loop_subdivision)  # -> NakedEdges, InteriorEdges, NonManifoldEdges; disabled
deconstruct_mesh_2 = DeconstructMesh(Mesh=weaverbird_s_loop_subdivision)  # -> Vertices, Faces, Colours, Normals; disabled

brep_2 = Brep(<brep referenced from the Rhino model>)  # disabled
point_in_brep = PointInBrep(Brep=brep_2, Point=deconstruct_mesh_2.Vertices, Strict=False)  # disabled
cull_pattern_4 = CullPattern(List=deconstruct_mesh_2.Vertices, CullPattern=point_in_brep)  # disabled

# ----
# press repeatedly on the "step" button until a shape emerges
panel = Panel("analysis and optimization")
toggle = BooleanToggle(True)
mat = MillC_StockSupportType(X=True, Y=True, Z=True, RX=toggle, RY=toggle, RZ=toggle)
mat_2 = Material(MaterialType=2)
Z = UnitZ(Factor=Slider(-100, range=-10000..1))
fepointload = FEPointLoad(Point=cull_pattern_2, Load=Z)
femesh = FEMesh(Meshes=mesh_4, Material=mat_2, Thickness=Slider(1, range=0..1), AreaLoad=Vector(0, 0, 0), NormalAreaLoad=0)
fepointsupports = FEPointSupports(Point=cull_pattern, SupportType=mat)
optimization_steps = Slider(3, range=0..5)
selfweight = Slider(1, range=0..1)
fea_system = FEASystem(
    ModelComponents=flatten([femesh, fepointsupports, fepointload]),
    IntersectAddedCurves=True,
    MergeTolerance=0.0001,
    MinimumCurveSpan=0.05,
    MaximumCurveSpan=10000,
    CurveTolerance=0.1)
fe_solver = FESolver(
    FEModel=fea_system,
    SelfWeightCoefficient=selfweight,
    BeamOptimisationIterations=0,
    QuadOptimisationIterations=optimization_steps,
    OptimizationTarget=0.3,
    OptimizationPenalization=1.5,
    LoadCase=0,
    AllCases=True)  # -> FEModel, MaxDeflection, Weight

Z_2 = UnitZ(Factor=Slider(-300, range=-10000..1))
fepointload_2 = FEPointLoad(Point=cull_pattern_3, Load=Z_2)

# ---- group: Define Materials
matselect = MaterialSelectionKaramba3D(menu=[dropdown(2), dropdown(6)])  # disabled

# ----
number_slider_2 = Slider(0.29, range=0..1)  # disabled

# ---- group: define cross sections
panel_2 = Panel("10 to 110")  # disabled
range = Range(Domain=panel_2, Steps=20)  # disabled
panel_3 = Panel("Shell")  # disabled
expression = Expression(x=panel_3, y=range, Expression="x&\" \"&y")  # disabled
cross_section = CrossSectionKaramba3D(
    FamilyNameOfCrossSection=panel_3,
    NameOfCrossSection=graft(expression),
    Material=matselect,
    Height_cm=graft(range),
    mode="Shell - Const")  # -> flatten(CrossSection); disabled
panel_4 = Panel("S")  # disabled
crosecselect = CrossSectionSelectorKaramba3D(CrossSections=cross_section, ElementsIdentifiers=panel_4)  # -> CrossSection, Info; disabled

# ----
curve_3 = Curve([<curve referenced from the Rhino model> x3])  # disabled
mesh_8 = Mesh(mesh_4)
pipe_2 = Pipe(Curve=curve_3, Radius=number_slider_2, Caps=2)  # disabled
point_in_brep_2 = PointInBrep(Brep=pipe_2, Point=deconstruct_mesh_2.Vertices, Strict=False)  # disabled
cull_pattern_5 = CullPattern(List=deconstruct_mesh_2.Vertices, CullPattern=point_in_brep_2)  # disabled
panel_5 = Panel("-5")  # disabled

quad_results = QuadResults(FEModel=fe_solver.FEModel, Plane=Slider(-1, range=-1..1))  # -> PrincipalStressFrame, Area, NormalDisplacement, MaxVonMisesStress, PS1, PS2, StiffnessMultiplier, Bending

Z_3 = UnitZ(Factor=panel_5)  # disabled

# ---- group: Define Elements
panel_6 = Panel("S")  # disabled
meshtoshell = MeshToShellKaramba3D(Mesh=weaverbird_s_loop_subdivision, Identifier=panel_6, CrossSection=crosecselect.CrossSection, LimitDistance_m=0.005)  # -> Element, Points, Info; disabled

# ----
supp = SupportKaramba(PosInd=cull_pattern_5, menu=[buttons(on, on, on, off, off, off)])  # disabled
loads = LoadsKaramba3D(
    Vector=Z_3,
    Mesh=weaverbird_s_loop_subdivision,
    LCase=0,
    mode="MeshLoad -Const.",
    menu=[buttons(on, off, off), buttons(on, on)])  # disabled
loads_2 = LoadsKaramba3D(Vector=Vector(0, 0, -1), LCase=0, mode="Gravity")  # disabled

panel_7 = Panel("visualization")
division = Division(A=Slider(0, range=0..101), B=fe_solver.MaxDeflection)
mesh_visualization = MeshVisualization(FEModel=fe_solver.FEModel, Deflection=division, Plane=1, ShowThickness=Toggle(False), ColorMode=2)  # -> Mesh, CompleteRange, VisibleRange

load = LoadKaramba3D(flatten([loads_2, loads]))  # disabled

# ---- group: Assemble Model
assemble = AssembleModelKaramba(Elem=flatten(meshtoshell.Element), Support=flatten(supp), Load=flatten(load), LimitDistance_m=0.005)  # -> Model, Info, Mass_kg, CenterOfGravity; disabled

# ----
bounds = Bounds(Numbers=quad_results.MaxVonMisesStress)
deconstruct_domain = DeconstructDomain(Domain=bounds)  # -> Start, End
multiplication = Multiplication(A=deconstruct_domain.End, B=Slider(0.3, range=0..1))

# ---- group: Optimize Cross Sections
panel_8 = Panel("1")  # disabled
opticrosec = OptimizeCrossSectionKaramba3D(
    Model=assemble.Model,
    CrossSections=cross_section,
    MaximumUtilization=1,
    MaximumDisplacement_cm=panel_8,
    UltimateLimitStateIterations=5,
    DisplacementIterations=5,
    NumberOfSamplePoints=3,
    ElasticDesign=True,
    GammaM0=1,
    GammaM1=1)  # -> ModelWithOptimizedCrossSections, Info, Mass_kg, MaximumDisplacement_cm, ElasticEnergy_kNm; disabled
panel_9 = Panel(opticrosec.MaximumDisplacement_cm)  # disabled

# ---- group: Analyze Model - FREE VERSION
analyzethii = AnalyzeThIIKaramba3D(Model=assemble.Model, LoadCase=-1, RTolerance=1e-07, MaxIterations=50, NoTensionalNII=False)  # -> CalculatedModel, MaximumDisplacement_cm, ResultingForceOfGravity_kN, ElasticEnergy_kNm; disabled
panel_10 = Panel(analyzethii.MaximumDisplacement_cm)  # disabled

# ----
panel_11 = Panel("""0
0
0
0
0
1""")  # disabled

larger_than = LargerThan(FirstNumber=quad_results.MaxVonMisesStress, SecondNumber=multiplication)  # -> LargerThan, OrEqualTo
cull_pattern_6 = CullPattern(List=quad_results.PrincipalStressFrame, CullPattern=larger_than.OrEqualTo)

number_slider_3 = Slider(1, range=0..1)
deconstruct_mesh_3 = DeconstructMesh(Mesh=mesh_8)  # -> flatten(Vertices), Faces, Colours, Normals
closest_points = ClosestPoints(Point=cull_pattern_6, Cloud=deconstruct_mesh_3.Vertices, Count=number_slider_3)  # -> flatten(ClosestPoint), CPIndex, Distance

cull = CullPattern(List=meshtoshell.Points, CullPattern=panel_11)  # disabled

# ---- group: Check Beam Displacements
panel_12 = Panel("""0
0
0
0
0
1""")  # disabled
cull_2 = CullPattern(List=meshtoshell.Points, CullPattern=panel_12)  # disabled
shelllineresults = LineResultsOnShellsKaramba3D(
    AnalyzedModel=opticrosec.ModelWithOptimizedCrossSections,
    ListOfSourcesOfForceFlowLinesLinesPoints=cull_2,
    SegmentLength_m=0.5,
    DA_deg=5,
    mode="PrincMoment")  # -> AnalyzedModel, Lines1, Lines2; disabled
panel_13 = Panel("250")  # disabled
rgb = ColourRGB(Alpha=255, Red=0, Green=0, Blue=panel_13)  # disabled
rgb_2 = ColourRGB(Alpha=255, Red=panel_13, Green=0, Blue=0)  # disabled
preview = CustomPreview(Geometry=shelllineresults.Lines1, Shader=rgb)  # disabled
preview_2 = CustomPreview(Geometry=shelllineresults.Lines2, Shader=rgb_2)  # disabled

# ----
shelllineresults_2 = LineResultsOnShellsKaramba3D(
    AnalyzedModel=opticrosec.ModelWithOptimizedCrossSections,
    LayerPosition=0,
    ListOfSourcesOfPrincipalStressLinesLinesPoints=cull,
    SegmentLength_m=0.5,
    DA_deg=5,
    mode="PrincStress")  # -> AnalyzedModel, Lines1, Lines2; disabled

# ---- group: View Results
modelview = ModelViewKaramba3D(Model=opticrosec.ModelWithOptimizedCrossSections, LoadCaseFactorsForLinearSuperposition=1, IndexOfVisibleLoadcase=-1)  # -> Model, DeformedMesh, DeformedAxes, DeformedModel; disabled
shellview = ShellViewKaramba3D(Model=modelview.Model, IndexOfLayer=0)  # -> Model, MeshesOfRenderedShells, LegendColors, LegendTags; disabled
legend = Legend(Colour=shellview.LegendColors, Tags=shellview.LegendTags, LegendType=1)  # disabled

# ----
number_slider_4 = Slider(2.12, range=0..4)  # disabled
join_curves_3 = JoinCurves(Curves=shelllineresults_2.Lines1, Preserve=False)  # -> simplify(Curves); disabled
divide_length = DivideLength(Curve=join_curves_3, Length=number_slider_4)  # -> simplify(Points), Tangents, Parameters; disabled
end_points_2 = EndPoints(Curve=join_curves_3)  # -> simplify(Start), simplify(End); disabled
merge = Merge(Data1=divide_length.Points, Data2=end_points_2.End)  # disabled
interpolate = Interpolate(Vertices=merge, Degree=3, Periodic=False, KnotStyle=1)  # -> Curve, Length, Domain; disabled

number_slider_5 = Slider(2, range=0..4)  # disabled
join_curves_4 = JoinCurves(Curves=flatten(interpolate.Curve), Preserve=False)  # disabled
divide_length_2 = DivideLength(Curve=join_curves_4, Length=number_slider_5)  # -> simplify(Points), Tangents, Parameters; disabled
end_points_3 = EndPoints(Curve=join_curves_4)  # -> simplify(Start), simplify(graft(End)); disabled
merge_2 = Merge(Data1=divide_length_2.Points, Data2=end_points_3.End)  # disabled
interpolate_2 = Interpolate(Vertices=merge_2, Degree=3, Periodic=False, KnotStyle=1)  # -> Curve, Length, Domain; disabled

mesh_edges_6 = MeshEdges(Mesh=mesh_8)  # -> NakedEdges, InteriorEdges, NonManifoldEdges
geometry_2 = Geometry(flatten([mesh_edges_6.NakedEdges, mesh_edges_6.InteriorEdges, mesh_edges_6.NonManifoldEdges]))

custom_preview = CustomPreview(Geometry=closest_points.ClosestPoint, Material=ColourSwatch(SwatchColor=RGB(255, 0, 0)))

panel_14 = Panel("250")  # disabled
rgb_3 = ColourRGB(Alpha=255, Red=panel_14, Green=0, Blue=0)  # disabled
rgb_4 = ColourRGB(Alpha=255, Red=0, Green=0, Blue=panel_14)  # disabled
preview_3 = CustomPreview(Geometry=shelllineresults_2.Lines2, Shader=rgb_3)  # disabled
preview_4 = CustomPreview(Geometry=interpolate_2.Curve, Shader=rgb_4)  # disabled
boolean_toggle_2 = BooleanToggle(True)

number_slider_6 = Slider(36, range=0..100)  # disabled
split_list = SplitList(List=flatten(interpolate_2.Curve), Index=number_slider_6)  # -> ListA, ListB; disabled
geometry_3 = Geometry(split_list.ListA)  # disabled

weaverbird_s_naked_boundary_4 = WeaverbirdsNakedBoundary(MeshClosedPolylines=mesh_6)

join_curves_5 = JoinCurves(Curves=weaverbird_s_naked_boundary_4, Preserve=False)

list_item = ListItem(List=join_curves_5, Index=Slider(0, range=0..1), Wrap=True)

join_curves_6 = JoinCurves(Curves=join_curves_5, Preserve=False)
close_curve_2 = CloseCurve(Curve=join_curves_6, CloseType=0, Bulge=0.5, Tolerance=0)  # -> Closed, ResultBoolean

curve_closest_point = CurveClosestPoint(Point=point, Curve=close_curve_2.Closed)  # -> Point, Parameter, Distance
sort_list = SortList(Keys=curve_closest_point.Distance, ValuesValuesA=curve_closest_point.Point, ValuesA=point)  # -> Keys, ValuesValuesA, ValuesA
panel_15 = Panel(curve_closest_point.Distance)
list_item_2 = ListItem(List=sort_list.ValuesValuesA, Index=0, Wrap=True)
list_item_3 = ListItem(List=sort_list.ValuesA, Index=0, Wrap=True)
line = Line(StartPoint=list_item_2, EndPoint=list_item_3)  # -> flatten(Line)
curve_4 = Curve([explode_3.Segments, line])

end_points_4 = EndPoints(Curve=curve_4)  # -> Start, End
point_2 = Point(flatten([end_points_4.Start, end_points_4.End]))

sort_duplicate_points_2 = SortDuplicatePoints(Points=point_2)  # -> UniquePoints, Indices

curve_5 = Curve([<curve referenced from the Rhino model> x3])
pipe_3 = Pipe(Curve=curve_5, Radius=Slider(0.1, range=0..1), Caps=2)
point_in_breps_4 = PointInBreps(Brep=pipe_3, Point=sort_duplicate_points_2.UniquePoints, Strict=True)  # -> Inside, Index
cull_pattern_7 = CullPattern(List=sort_duplicate_points_2.UniquePoints, CullPattern=point_in_breps_4.Inside)  # -> graft(List)

closest_points_2 = ClosestPoints(Point=closest_points.ClosestPoint, Cloud=flatten(cull_pattern_7), Count=number_slider_3)  # -> flatten(ClosestPoint), CPIndex, Distance
line_2 = Line(StartPoint=closest_points_2.ClosestPoint, EndPoint=closest_points.ClosestPoint)

custom_preview_2 = CustomPreview(Geometry=closest_points_2.ClosestPoint, Material=ColourSwatch(SwatchColor=RGB(63, 255, 0)))

point_3 = Point(flatten([closest_points.ClosestPoint, cull_pattern_7]))
_3d_delaunay = _3DDelaunay(Points=point_3)  # -> TopologicalEdges, Connectivity
sort_duplicate_curves = SortDuplicateCurves(Curves=curve_4)  # -> UniqueCurves, Indices
shortwalk = ShortestWalk(Curves=sort_duplicate_curves.UniqueCurves, WantedPath=graft(_3d_delaunay.TopologicalEdges))  # -> ShortestWalk, Succession, Direction, Length

# ---- group: Division of Curve(how smooth)
len = Length(Curve=shortwalk.ShortestWalk)
division_2 = Division(A=len, B=Slider(7, range=1..7))
divide = DivideCurve(Curve=shortwalk.ShortestWalk, Count=division_2, Kinks=False)  # -> Points, Tangents, Parameters

# ----
intcrv = Interpolate(Vertices=divide.Points, Degree=3, Periodic=False, KnotStyle=1)  # -> flatten(Curve), Length, Domain

clean_tree_2 = CleanTree(RemoveNulls=boolean_toggle_2, RemoveInvalid=boolean_toggle_2, RemoveEmpty=boolean_toggle_2, Tree=intcrv.Curve)
mesh_pipe = MeshPipe(Curve=clean_tree_2, NumberOfSections=Slider(80, range=1..80), Radius=Slider(0.05, range=0..0.1), NumberOfSides=4)

custom_preview_3 = CustomPreview(Geometry=mesh_pipe, Material=ColourSwatch(SwatchColor=RGB(255, 255, 255)))

# ----
# Input Curve
# Elasticity
crv = Curve(geometry_3)  # disabled

divide_2 = DivideCurve(Curve=crv, Count=10, Kinks=False)  # -> Points, Tangents, Parameters; disabled
end = EndPoints(Curve=crv)  # -> Start, End; disabled
pline = PolyLine(Vertices=divide_2.Points, Closed=False)  # disabled
pt = Point([end.Start, end.End])  # disabled
explode_4 = Explode(Curve=pline, Recursive=True)  # -> Segments, Vertices; disabled

slider = Slider(0.86, range=0..2)  # disabled
len_2 = Length(Curve=explode_4.Segments)  # disabled
multiplication_2 = Multiplication(A=len_2, B=slider)  # disabled
springs = SpringsFromLine(
    Connection=explode_4.Segments,
    Stiffness=1000,
    Damping=10,
    RestLength=multiplication_2,
    Cutoff=0,
    CompressionFail=0,
    TensileFail=0,
    Plasticity=0)  # disabled

# ----
# Attraction
slider_2 = Slider(28.495, range=0..100)  # disabled
slider_3 = Slider(-0.5, range=-500..0)  # disabled
inter = InterconnectPoints(Pts=flatten(explode_4.Vertices))  # disabled
powerlaw = PowerLaw(Connection=inter, Exponent=0, Strength=slider_3, Cutoff=slider_2)  # disabled

toggle_2 = BooleanToggle(True)  # disabled
timer_3 = Timer(TimerInterval=20, Target=kangaroo)  # disabled
pt_2 = Point(explode_4.Vertices)  # disabled
kangaroo = KangarooPhysics(ForceObjects=flatten([springs, powerlaw]), AnchorPoints=pt, Settings=null, Geometry=pt_2, SimulationReset=toggle_2)  # -> Out, Iterations, ParticlesOut, GeometryOut, KE; disabled

pline_2 = PolyLine(Vertices=kangaroo.GeometryOut, Closed=False)  # disabled
