# Grasshopper definition 200529_Table_V1_Connector_TestData Generation.gh (Grasshopper 1.0.7)
# plug-ins: MeshEdit Components, Pufferfish, Fattener, LunchBoxML, EleFront, LunchBox, Weaverbird, GH_CPython, Kangaroo2 Components, TT Toolbox

curve = Curve([<curve referenced from the Rhino model> x3])

discontinuity = Discontinuity(Curve=curve, Level=1)  # -> Points, Parameters
create_rtree = CreateRTree(InputGeometry=flatten(discontinuity.Points))
cull_duplicates = CullDuplicates(Points=flatten(discontinuity.Points), Tolerance=0.1, CullMode=3)  # -> Points, Indices, Valence
rtree_points_in_range = RTreePointsInRange(SearchPoints=cull_duplicates.Points, SearchDistance=Slider(50, range=0..100), RTree=create_rtree)  # -> simplify(PointsWithinRange), IndicesWithinRange

c_script = CSharpScript(x=rtree_points_in_range.PointsWithinRange)  # -> out, A; inputs x: tree of Point3d
# ---------- c_script: C# ----------
    for(int i = 0; i < x.BranchCount; i++){
      if(x.Branch(i).Count > 2){
        points.Add(x.Branch(i));
      }
    }

    A = ListOfListsToTree(points);
# ---------- c_script: C# additional code ----------
  List<List<Point3d>> points = new List<List<Point3d>>();


  static Grasshopper.DataTree<T> ListOfListsToTree<T > (List < List < T >> s){
  Grasshopper.DataTree<T> tree = new DataTree<T>();
  for(int i = 0;i < s.Count; i++){
  tree.AddRange(s[i], new GH_Path(i));
}
        return tree;
      }
# ---------- end c_script ----------
cull_duplicates_2 = CullDuplicates(Points=flatten(c_script.A), Tolerance=0.1, CullMode=3)  # -> Points, Indices, Valence

sphere = Sphere(Base=cull_duplicates_2.Points, Radius=Slider(60, range=0..1000))

surface_curve = SurfaceCurve(Surface=graft(sphere), Curve=curve)  # -> Curves, simplify(Points), UVPoints, Normals, Parameters, Tangents
shift_paths = ShiftPaths(Data=surface_curve.Points, Offset=-1)
# Fatten lines into mesh
line = Line(StartPoint=graft(cull_duplicates_2.Points), EndPoint=surface_curve.Points)

fatten = Fatten(
    Skeleton=flatten(line),
    Thickness=Slider(30, range=0..1000),
    LengthSubdivisions=0,
    EndType=Slider(0, range=0..3),
    AdjustForAngle=False)
mesh_edges = MeshEdges(Mesh=fatten)  # -> NakedEdges, InteriorEdges, NonManifoldEdges

refine = Refine(Mesh=fatten, Level="1")
clean = CombineClean(Meshes=refine)
md = MeshDirection(Mesh=clean)
turn = MeshTurn(Mesh=md)

boolean_toggle = BooleanToggle(True)
flip_mesh = FlipMesh(Mesh=md, VertexNormals=boolean_toggle, FaceNormals=boolean_toggle, FaceOrientation=boolean_toggle)
mesh = Mesh(flip_mesh)

face_normals = FaceNormals(Mesh=flip_mesh)  # -> Centers, Normals
vector_display = VectorDisplay(Anchor=face_normals.Centers, Vector=face_normals.Normals)

# ----
# Relaxing & Inflating Y Connectors
strips = RefineStrips(Mesh=mesh, Level="2")

medges = MeshEdges(Mesh=strips)  # -> NakedEdges, InteriorEdges, NonManifoldEdges
warpweft = WarpWeft(Mesh=strips)  # -> Warp, Weft, NakedA, NakedB
join = JoinCurves(Curves=medges.NakedEdges, Preserve=False)
number_slider = Slider(0, range=0..100)
explode = Explode(Curve=join, Recursive=True)  # -> Segments, Vertices
strength = Strength(0.1)
end = EndPoints(Curve=explode.Segments)  # -> Start, End
multiplication = Multiplication(A=strength, B=64)
fcircle = CircleFit(Points=end.Start)  # -> Circle, Radius, Deviation
pressure = Pressure(M=strips, Strength=Slider(0.1, range=0..1.1))
oncurve = OnCurve(Points=end.Start, Curve=graft(fcircle.Circle), Strength=100)
planarize = Planarize(M=strips, Strength=100)
length_line = LengthLine(Line=warpweft.Warp, Length=number_slider, Strength=strength)
length_line_2 = LengthLine(Line=warpweft.Weft, Length=number_slider, Strength=multiplication)
equallength = EqualLength(Line=explode.Segments, Strength=1)
length_line_3 = LengthLine(Line=medges.InteriorEdges, Strength=Slider(1100, range=0..1100))
show = Show(G=strips)
entwine = Entwine(Branch00=show, Branch01=[oncurve, planarize, equallength, pressure, length_line_3], FlattenInputs=True)
solver = Solver(GoalObjects=entwine, Reset=Button(), Threshold=1e-15, Tolerance=0.01, On=Toggle(False))  # -> I, V, O
bang = ExplodeTree(Data=solver.O)  # -> Branch0, Branch1
mesh_edges_2 = MeshEdges(Mesh=bang.Branch0)  # -> NakedEdges, InteriorEdges, NonManifoldEdges
dam = DataDam(DataA=graft(bang.Branch0), BufferDelay=10000000, BufferMode=0)
stripper = Stripper(Mesh=dam)
mesh_2 = Mesh(stripper)
wbnaked = WeaverbirdsNakedBoundary(MeshClosedPolylines=mesh_2)
medges_2 = MeshEdges(Mesh=mesh_2)  # -> NakedEdges, InteriorEdges, NonManifoldEdges
# DATASET FOR ML_Y CONNECTOR SEPARATOR
geometry = Geometry([<mesh referenced from the Rhino model> x6])
geometry_2 = Geometry([<mesh referenced from the Rhino model> x6])
geometry_3 = Geometry(cull_duplicates_2.Points)
merge = Merge(Data1=geometry, Data2=geometry_2)
mesh_3 = Mesh(merge)

mesh_area = MeshArea(Mesh=geometry)  # -> Area, Centroid
mesh_closest_point = MeshClosestPoint(Point=mesh_area.Centroid, Mesh=geometry)  # -> Point, Index, Parameter

mesh_area_2 = MeshArea(Mesh=geometry_2)  # -> Area, Centroid
mesh_closest_point_2 = MeshClosestPoint(Point=mesh_area_2.Centroid, Mesh=geometry_2)  # -> Point, Index, Parameter

wbnaked_2 = WeaverbirdsNakedBoundary(MeshClosedPolylines=mesh_3)

mesh_area_3 = MeshArea(Mesh=mesh_3)  # -> Area, Centroid
mesh_closest_point_3 = MeshClosestPoint(Point=mesh_area_3.Centroid, Mesh=mesh_3)  # -> Point, Index, Parameter

define_text_dot = DefineTextDot(Text="1", Location=mesh_closest_point_2.Point, Font="Arial", Size=14)

define_text_dot_2 = DefineTextDot(Text="0", Location=mesh_closest_point.Point, Font="Arial", Size=14)

merge_2 = Merge(Data1=define_text_dot_2, Data2=define_text_dot)  # -> graft(Result)

# ----
# Distance from Center(strips) to Center(connector)
line_2 = Line(StartPoint=graft(geometry_3), EndPoint=mesh_closest_point_3.Point)  # -> simplify(Line)

geometry_4 = Geometry(line_2)
end_points = EndPoints(Curve=geometry_4)  # -> Start, End
vector_2pt = Vector2Pt(PointA=end_points.Start, PointB=end_points.End, Unitize=False)  # -> Vector, Length
vector_display_2 = VectorDisplay(Anchor=end_points.Start, Vector=vector_2pt.Vector)
weaverbird_s_naked_boundary = WeaverbirdsNakedBoundary(MeshClosedPolylines=mesh_3)  # -> graft(NakedCurves)

list_length = ListLength(List=define_text_dot)
duplicate_data = DuplicateData(Data="1", Number=list_length, Order=True)

list_length_2 = ListLength(List=define_text_dot_2)
duplicate_data_2 = DuplicateData(Data="0", Number=list_length_2, Order=True)

length = Length(Curve=line_2)  # -> simplify(graft(Length))
merge_3 = Merge(Data1=duplicate_data_2, Data2=duplicate_data)  # -> simplify(graft(Result))

# ---- group: Input Your File Path
panel = Panel("C:\Users\User\Desktop\Thesis Drive\Model_Digital\ML\CSV\YConnector_TestData.xlsx")

# ----
wo = WriteOptions(
    FilePath=panel,
    ClearDataOverwrite=True,
    SaveAfterWrite=Toggle(True),
    CloseAfterWrite=Toggle(False),
    ColumnStartPosition=Slider(1, range=0..10),
    RowStartPosition=Slider(1, range=0..10))  # -> UserMessages, WriteOptions

file_path = FilePath("C:\Users\User\Desktop\Thesis Drive\Model_Digital\ML\yconnectorpredict_model.h5")  # disabled
text = Text(file_path)  # disabled
panel_2 = Panel(text)  # disabled
gh_cpython = GH_CPython(Model=file_path)  # -> output; inputs Model: list; disabled
#   port output: indicate your output description here. refers to a new line.
# ---------- gh_cpython: Python ----------
import pandas as pd
from tensorflow.keras.models import load_model
import numpy as np

#load saved model
model = load_model(Model,compile=False)

#model = load_model('User\Desktop\Thesis Drive\Model_Digital\ML\yconnectorpredict_model.h5py',compile=False)


#loading data for predicting
Predictdata_path = 'User\Desktop\Thesis Drive\Model_Digital\ML\CSV\YConnectorTestData.csv'
pdf = pd.read_csv(Predictdata_path)
Predict_data = pdf.iloc[:,1:6].values

predictions = model.predict(Predict_data)
#print(predictions)

output = []
for item in predictions:
    output.append(np.argmax(item))
#predictions = np.argmax(predictions)
print(output)
# ---------- end gh_cpython ----------

deconstruct_mesh = DeconstructMesh(Mesh=simplify(mesh_3))  # -> Vertices, Faces, Colours, Normals
shift_paths_2 = ShiftPaths(Data=deconstruct_mesh.Vertices, Offset=-1)
sort_duplicate_points = SortDuplicatePoints(Points=shift_paths_2)  # -> UniquePoints, Indices
mesh_sphere = MeshSphere(Base=sort_duplicate_points.UniquePoints, Radius=Slider(0.5, range=0..0.5), UCount=10, VCount=20)
mesh_inclusion = MeshInclusion(Mesh=graft(mesh_sphere), Point=flatten(shift_paths_2), Strict=False)
cull_pattern = CullPattern(List=flatten(shift_paths_2), CullPattern=mesh_inclusion)
boolean_toggle_2 = BooleanToggle(True)
clean_tree = CleanTree(RemoveNulls=boolean_toggle_2, RemoveInvalid=boolean_toggle_2, RemoveEmpty=boolean_toggle_2, Tree=cull_pattern)  # -> simplify(Tree)
param_viewer = ParamViewer(clean_tree)

list_length_3 = ListLength(List=clean_tree)
evaluate = Evaluate(Expression="x>2", x=list_length_3)

dispatch = Dispatch(List=flatten(param_viewer), DispatchPattern=flatten(evaluate))  # -> ListA, ListB
tree_branch = TreeBranch(Tree=clean_tree, Path=dispatch.ListA, MaintainPaths=True)
shift_paths_3 = ShiftPaths(Data=tree_branch, Offset=-1)
cull_duplicates_3 = CullDuplicates(Points=tree_branch, Tolerance=0.1, CullMode=3)  # -> simplify(flatten(Points)), Indices, Valence

line_3 = Line(StartPoint=graft(geometry_3), EndPoint=cull_duplicates_3.Points)  # -> simplify(Line)
list_item = ListItem(List=line_3, Index=0, Wrap=True)  # -> Item, Item1
list_item_2 = ListItem(List=cull_duplicates_3.Points, Index=0, Wrap=True)  # -> Item, Item1

# ----
# POLE A
geometry_5 = Geometry(list_item.Item)

# ----
# POLE B
geometry_6 = Geometry(list_item.Item1)

end_points_2 = EndPoints(Curve=geometry_6)  # -> Start, End
end_points_3 = EndPoints(Curve=geometry_5)  # -> Start, End
vector_2pt_2 = Vector2Pt(PointA=end_points_2.Start, PointB=end_points_2.End, Unitize=False)  # -> Vector, Length
vector_2pt_3 = Vector2Pt(PointA=end_points_3.Start, PointB=end_points_3.End, Unitize=False)  # -> Vector, Length
vector_display_3 = VectorDisplay(Anchor=end_points_2.Start, Vector=vector_2pt_2.Vector)
vector_display_4 = VectorDisplay(Anchor=end_points_3.Start, Vector=vector_2pt_3.Vector)

# ----
# Distance from Center(strips) to Pole B
line_4 = Line(StartPoint=mesh_closest_point_3.Point, EndPoint=list_item_2.Item1)  # -> simplify(Line)

# ----
# Distance from Center(strips) to Pole A
line_5 = Line(StartPoint=mesh_closest_point_3.Point, EndPoint=list_item_2.Item)  # -> simplify(Line)

# ----
# Angle from Center(strips) to Pole A
angle = Angle(VectorA=vector_2pt_3.Vector, VectorB=vector_2pt.Vector)  # -> Angle, Reflex
# Angle from Center(strips) to Pole B
angle_2 = Angle(VectorA=vector_2pt_2.Vector, VectorB=vector_2pt.Vector)  # -> Angle, Reflex
degrees = Degrees(Radians=angle.Angle)  # -> simplify(graft(Degrees))
degrees_2 = Degrees(Radians=angle_2.Angle)  # -> simplify(graft(Degrees))
length_2 = Length(Curve=line_5)  # -> simplify(graft(Length))
length_3 = Length(Curve=line_4)  # -> simplify(graft(Length))
merge_4 = Merge(Data1=length, Data2=length_2, Data3=length_3, Data4=degrees, Data5=degrees_2)
round_to_decimal_place = RoundToDecimalPlace(NumberX=merge_4, DecimalPlace=2, RoundType=0)  # -> Rounded, Difference
merge_5 = Merge(Data1=simplify(merge_3), Data2=simplify(round_to_decimal_place.Rounded))
panel_3 = Panel(merge_5)

param_viewer_2 = ParamViewer(merge_5)
jitter = Jitter(List=param_viewer_2, Jitter=1, Seed=Slider(396, range=0..1000))  # -> Values, Indices

flatten_tree = FlattenTree(Tree=degrees, Path="{0}")  # -> graft(Tree)
flatten_tree_2 = FlattenTree(Tree=length_3, Path="{0}")  # -> graft(Tree)
flatten_tree_3 = FlattenTree(Tree=degrees_2, Path="{0}")  # -> graft(Tree)
flatten_tree_4 = FlattenTree(Tree=weaverbird_s_naked_boundary, Path="{0}")  # -> graft(Tree)
flatten_tree_5 = FlattenTree(Tree=length, Path="{0}")  # -> graft(Tree)
flatten_tree_6 = FlattenTree(Tree=length_2, Path="{0}")  # -> graft(Tree)
flatten_tree_7 = FlattenTree(Tree=merge_2, Path="{0}")  # -> graft(Tree)
merge_6 = Merge(
    Data1=flatten_tree_4,
    Data2=flatten_tree_7,
    Data3=flatten_tree_5,
    Data4=flatten_tree_6,
    Data5=flatten_tree_2,
    Data6=flatten_tree,
    Data7=flatten_tree_3)
tree_branch_2 = TreeBranch(Tree=simplify(merge_6), Path=Slider(0, range=0..12), MaintainPaths=True)
panel_4 = Panel(merge_6)

tree_branch_3 = TreeBranch(Tree=merge_5, Path=jitter.Values, MaintainPaths=False)
panel_5 = Panel(tree_branch_3)
flip_matrix = FlipMatrix(Data=tree_branch_3)

panel_6 = Panel("""LABEL
DIST_SC
DIST_SA
DIST_SB
ANGLE_SA
ANGLE_SB""")
writexl = WriteToExcel(
    Run=Toggle(False),
    ExcelWorksheet="1",
    ColumnNames=panel_6,
    WriteOptions=wo.WriteOptions,
    ColumnnsOrRows=Toggle(False),
    DataToWriteIntoColumns=flip_matrix)
panel_7 = Panel(writexl)

panel_8 = Panel(flip_matrix)
