# Grasshopper definition 200606_Table_V2.gh (Grasshopper 1.0.7)
# plug-ins: Fattener, LunchBox, Weaverbird

curve = Curve([<curve referenced from the Rhino model> x7])
number_slider = Slider(0.03, range=0..0.1)

number_slider_2 = Slider(0.1, range=0..0.1)
divide_length = DivideLength(Curve=curve, Length=Slider(100, range=0..100))  # -> Points, Tangents, Parameters
end_points = EndPoints(Curve=curve)  # -> Start, End
merge = Merge(Data1=graft(end_points.Start), Data2=divide_length.Points, Data3=graft(end_points.End))
sort_duplicate_points = SortDuplicatePoints(Points=merge)  # -> UniquePoints, Indices

sort_along_curve = SortAlongCurve(Points=sort_duplicate_points.UniquePoints, Curve=graft(curve))  # -> Points, Indices
polyline = PolyLine(Vertices=sort_along_curve.Points, Closed=False)
fatten = Fatten(Skeleton=flatten(polyline), Thickness=Slider(30, range=0..1000), LengthSubdivisions=0, EndType=2, AdjustForAngle=False)
weaverbird_s_loop_subdivision = WeaverbirdsLoopSubdivision(MeshCurves=fatten, Level=1, SmoothNakedEdges=1)
mesh_edges = MeshEdges(Mesh=fatten)  # -> NakedEdges, InteriorEdges, NonManifoldEdges
