# Grasshopper definition 200617_Pyramid.gh (Grasshopper 1.0.7)
# plug-ins: MeshEdit Components, Pufferfish, Fattener, LunchBoxML, Kangaroo Components, EleFront, LunchBox, Weaverbird, Kangaroo2 Components

curve = Curve([<curve referenced from the Rhino model> x6])
# LONGEST
curve_2 = Curve([<curve referenced from the Rhino model> x6])  # disabled
curve_3 = Curve([<curve referenced from the Rhino model> x6])  # disabled

# ----
# SMALLEST
# Y JUNCTION LINES
discontinuity = Discontinuity(Curve=curve, Level=1)  # -> Points, Parameters
create_rtree = CreateRTree(InputGeometry=flatten(discontinuity.Points))
cull_duplicates = CullDuplicates(Points=flatten(discontinuity.Points), Tolerance=0.1, CullMode=3)  # -> Points, Indices, Valence
rtree_points_in_range = RTreePointsInRange(SearchPoints=cull_duplicates.Points, SearchDistance=Slider(50, range=0..100), RTree=create_rtree)  # -> simplify(PointsWithinRange), IndicesWithinRange

number_slider = Slider(0.05, range=0..0.1)

# ----
# Y JUNCTION LINES
discontinuity_2 = Discontinuity(Curve=curve_2, Level=1)  # -> Points, Parameters; disabled
number_slider_2 = Slider(50, range=0..100)  # disabled
create_rtree_2 = CreateRTree(InputGeometry=flatten(discontinuity_2.Points))  # disabled
cull_duplicates_2 = CullDuplicates(Points=flatten(discontinuity_2.Points), Tolerance=0.1, CullMode=3)  # -> Points, Indices, Valence; disabled
rtree_points_in_range_2 = RTreePointsInRange(SearchPoints=cull_duplicates_2.Points, SearchDistance=number_slider_2, RTree=create_rtree_2)  # -> simplify(PointsWithinRange), IndicesWithinRange; disabled

number_slider_3 = Slider(0.05, range=0..0.1)  # disabled

# ----
# Y JUNCTION LINES
discontinuity_3 = Discontinuity(Curve=curve_3, Level=1)  # -> Points, Parameters; disabled
number_slider_4 = Slider(50, range=0..100)  # disabled
create_rtree_3 = CreateRTree(InputGeometry=flatten(discontinuity_3.Points))  # disabled
cull_duplicates_3 = CullDuplicates(Points=flatten(discontinuity_3.Points), Tolerance=0.1, CullMode=3)  # -> Points, Indices, Valence; disabled
rtree_points_in_range_3 = RTreePointsInRange(SearchPoints=cull_duplicates_3.Points, SearchDistance=number_slider_4, RTree=create_rtree_3)  # -> simplify(PointsWithinRange), IndicesWithinRange; disabled

c_script = CSharpScript(x=rtree_points_in_range.PointsWithinRange)  # -> out, A; inputs x: tree of Point3d
# ---------- c_script: C# ----------
    List<List<Point3d>> points = new List<List<Point3d>>();
    
    for(int i = 0; i < x.BranchCount; i++){
      if(x.Branch(i).Count > 2){
        points.Add(x.Branch(i));
      }
    }

    A = ListOfListsToTree(points);
# ---------- c_script: C# additional code ----------
  


  static Grasshopper.DataTree<T> ListOfListsToTree<T > (List < List < T >> s){
  Grasshopper.DataTree<T> tree = new DataTree<T>();
  for(int i = 0;i < s.Count; i++){
  tree.AddRange(s[i], new GH_Path(i));
}
        return tree;
      }
# ---------- end c_script ----------
cull_duplicates_4 = CullDuplicates(Points=flatten(c_script.A), Tolerance=0.1, CullMode=3)  # -> Points, Indices, Valence

number_slider_5 = Slider(0.06, range=0..0.1)
sphere = Sphere(Base=cull_duplicates_4.Points, Radius=Slider(100, range=0..1000))

surface_curve = SurfaceCurve(Surface=graft(sphere), Curve=curve)  # -> Curves, simplify(Points), UVPoints, Normals, Parameters, Tangents
shift_paths = ShiftPaths(Data=surface_curve.Points, Offset=-1)

# ----
# SINGLE LIEANR ELEMENT
point = Point(flatten(surface_curve.Points))

curve_closest_point = CurveClosestPoint(Point=point, Curve=reparameterize(graft(curve)))  # -> Point, Parameter, Distance
evaluate = Evaluate(Expression="x < 0.1", x=curve_closest_point.Distance)
cull_pattern = CullPattern(List=curve_closest_point.Parameter, CullPattern=evaluate)  # -> simplify(List)

shatter = Shatter(Curve=reparameterize(graft(curve)), Parameters=cull_pattern)  # -> simplify(Segments)
number_slider_6 = Slider(0.05, range=0..0.1)  # disabled
c_script_2 = CSharpScript(x=rtree_points_in_range_2.PointsWithinRange)  # -> out, A; inputs x: tree of Point3d; disabled
# ---------- c_script_2: C# ----------
    for(int i = 0; i < x.BranchCount; i++){
      if(x.Branch(i).Count > 2){
        points.Add(x.Branch(i));
      }
    }

    A = ListOfListsToTree(points);
# ---------- c_script_2: C# additional code ----------
  List<List<Point3d>> points = new List<List<Point3d>>();


  static Grasshopper.DataTree<T> ListOfListsToTree<T > (List < List < T >> s){
  Grasshopper.DataTree<T> tree = new DataTree<T>();
  for(int i = 0;i < s.Count; i++){
  tree.AddRange(s[i], new GH_Path(i));
}
        return tree;
      }
# ---------- end c_script_2 ----------
cull_duplicates_5 = CullDuplicates(Points=flatten(c_script_2.A), Tolerance=0.1, CullMode=3)  # -> Points, Indices, Valence; disabled

number_slider_7 = Slider(200, range=0..1000)  # disabled
number_slider_8 = Slider(0.06, range=0..0.1)  # disabled
sphere_2 = Sphere(Base=cull_duplicates_5.Points, Radius=number_slider_7)  # disabled

surface_curve_2 = SurfaceCurve(Surface=graft(sphere_2), Curve=curve_2)  # -> Curves, simplify(Points), UVPoints, Normals, Parameters, Tangents; disabled
shift_paths_2 = ShiftPaths(Data=surface_curve_2.Points, Offset=-1)  # disabled

# ----
# SINGLE LIEANR ELEMENT
point_2 = Point(flatten(surface_curve_2.Points))  # disabled

curve_closest_point_2 = CurveClosestPoint(Point=point_2, Curve=reparameterize(graft(curve_2)))  # -> Point, Parameter, Distance; disabled
panel = Panel("x < 0.1")  # disabled
evaluate_2 = Evaluate(Expression=panel, x=curve_closest_point_2.Distance)  # disabled
cull_pattern_2 = CullPattern(List=curve_closest_point_2.Parameter, CullPattern=evaluate_2)  # -> simplify(List); disabled

shatter_2 = Shatter(Curve=reparameterize(graft(curve_2)), Parameters=cull_pattern_2)  # -> simplify(Segments); disabled
line = Line(StartPoint=graft(cull_duplicates_4.Points), EndPoint=shift_paths)

point_on_curve = PointOnCurve(line, parameter=0.5)
sphere_3 = Sphere(Base=point_on_curve, Radius=1)

collision_one_many = CollisionOneMany(Collider=shatter, Obstacles=flatten(sphere_3))  # -> Collision, Index
dispatch = Dispatch(List=shatter, DispatchPattern=collision_one_many.Collision)  # -> ListA, ListB
geometry = Geometry(dispatch.ListB)

number_slider_9 = Slider(0.03, range=0..0.1)
fatten = Fatten(
    Skeleton=geometry,
    Thickness=Slider(30, range=0..1000),
    LengthSubdivisions=0,
    EndType=Slider(0, range=0..3),
    AdjustForAngle=False)
disjoint_mesh = DisjointMesh(Mesh=fatten)  # -> graft(Meshes)

c_script_3 = CSharpScript(x=rtree_points_in_range_3.PointsWithinRange)  # -> out, A; inputs x: tree of Point3d; disabled; same code as c_script_2
line_2 = Line(StartPoint=graft(cull_duplicates_5.Points), EndPoint=shift_paths_2)  # disabled

point_on_curve_2 = PointOnCurve(line_2, parameter=0.5)  # disabled
sphere_4 = Sphere(Base=point_on_curve_2, Radius=1)  # disabled

collision_one_many_2 = CollisionOneMany(Collider=shatter_2, Obstacles=flatten(sphere_4))  # -> Collision, Index; disabled
dispatch_2 = Dispatch(List=shatter_2, DispatchPattern=collision_one_many_2.Collision)  # -> ListA, ListB; disabled
weaverbird_s_catmull_clark_subdivision = WeaverbirdsCatmullClarkSubdivision(MeshCurves=disjoint_mesh, Level=1, SmoothNakedEdges=1)
cull_duplicates_6 = CullDuplicates(Points=flatten(c_script_3.A), Tolerance=expr("0.5", 0.1), CullMode=1)  # -> Points, Indices, Valence; disabled

number_slider_10 = Slider(150, range=0..1000)  # disabled
number_slider_11 = Slider(0.06, range=0..0.1)  # disabled
sphere_5 = Sphere(Base=cull_duplicates_6.Points, Radius=number_slider_10)  # disabled

surface_curve_3 = SurfaceCurve(Surface=simplify(graft(sphere_5)), Curve=curve_3)  # -> Curves, simplify(Points), UVPoints, Normals, Parameters, Tangents; disabled
shift_paths_3 = ShiftPaths(Data=surface_curve_3.Points, Offset=-1)  # disabled

# ----
# SINGLE LIEANR ELEMENT
point_3 = Point(flatten(surface_curve_3.Points))  # disabled

curve_closest_point_3 = CurveClosestPoint(Point=point_3, Curve=reparameterize(graft(curve_3)))  # -> Point, Parameter, Distance; disabled
panel_2 = Panel("x < 0.1")  # disabled
evaluate_3 = Evaluate(Expression=panel_2, x=curve_closest_point_3.Distance)  # disabled
cull_pattern_3 = CullPattern(List=curve_closest_point_3.Parameter, CullPattern=evaluate_3)  # -> simplify(List); disabled

shatter_3 = Shatter(Curve=reparameterize(graft(curve_3)), Parameters=cull_pattern_3)  # -> simplify(Segments); disabled

# ----
# FATTENER
number_slider_12 = Slider(0.03, range=0..0.1)
fatten_2 = Fatten(
    Skeleton=flatten(line),
    Thickness=Slider(40, range=0..1000),
    LengthSubdivisions=0,
    EndType=Slider(0, range=0..3),
    AdjustForAngle=False)
disjoint_mesh_2 = DisjointMesh(Mesh=fatten_2)  # -> graft(Meshes)

geometry_2 = Geometry(dispatch_2.ListB)  # disabled

number_slider_13 = Slider(0.03, range=0..0.1)  # disabled
number_slider_14 = Slider(30, range=0..1000)  # disabled
number_slider_15 = Slider(0, range=0..3)  # disabled
fatten_3 = Fatten(Skeleton=geometry_2, Thickness=number_slider_14, LengthSubdivisions=0, EndType=number_slider_15, AdjustForAngle=False)  # disabled
disjoint_mesh_3 = DisjointMesh(Mesh=fatten_3)  # -> graft(Meshes); disabled

weaverbird_s_catmull_clark_subdivision_2 = WeaverbirdsCatmullClarkSubdivision(MeshCurves=disjoint_mesh_3, Level=1, SmoothNakedEdges=1)  # disabled

# ----
# FATTENER
number_slider_16 = Slider(0.03, range=0..0.1)  # disabled
number_slider_17 = Slider(30, range=0..1000)  # disabled
number_slider_18 = Slider(0, range=0..3)  # disabled
fatten_4 = Fatten(
    Skeleton=flatten(line_2),
    Thickness=number_slider_17,
    LengthSubdivisions=0,
    EndType=number_slider_18,
    AdjustForAngle=False)  # disabled
disjoint_mesh_4 = DisjointMesh(Mesh=fatten_4)  # -> graft(Meshes); disabled

line_3 = Line(StartPoint=graft(cull_duplicates_6.Points), EndPoint=shift_paths_3)  # disabled

point_on_curve_3 = PointOnCurve(line_3, parameter=0.5)  # disabled
sphere_6 = Sphere(Base=point_on_curve_3, Radius=1)  # disabled

collision_one_many_3 = CollisionOneMany(Collider=shatter_3, Obstacles=flatten(sphere_6))  # -> Collision, Index; disabled
dispatch_3 = Dispatch(List=shatter_3, DispatchPattern=collision_one_many_3.Collision)  # -> ListA, ListB; disabled

weaverbird_s_naked_boundary = WeaverbirdsNakedBoundary(MeshClosedPolylines=disjoint_mesh_2)
join = JoinCurves(Curves=weaverbird_s_naked_boundary, Preserve=False)
explode = Explode(Curve=join, Recursive=True)  # -> Segments, Vertices
cull_duplicates_7 = CullDuplicates(Points=explode.Vertices, Tolerance=0.1, CullMode=3)  # -> simplify(Points), Indices, Valence
shift_paths_4 = ShiftPaths(Data=cull_duplicates_7.Points, Offset=-1)  # -> flatten(Data)

face_normals = FaceNormals(Mesh=disjoint_mesh_2)  # -> Centers, Normals
mesh_edges = MeshEdges(Mesh=disjoint_mesh_2)  # -> NakedEdges, InteriorEdges, NonManifoldEdges
vector_display = VectorDisplay(Anchor=face_normals.Centers, Vector=face_normals.Normals)

geometry_3 = Geometry(dispatch_3.ListB)  # disabled

face_normals_2 = FaceNormals(Mesh=weaverbird_s_catmull_clark_subdivision_2)  # -> Centers, Normals; disabled
mesh_edges_2 = MeshEdges(Mesh=weaverbird_s_catmull_clark_subdivision_2)  # -> NakedEdges, InteriorEdges, NonManifoldEdges; disabled
vector_display_2 = VectorDisplay(Anchor=face_normals_2.Centers, Vector=face_normals_2.Normals)  # disabled

weaverbird_s_naked_boundary_2 = WeaverbirdsNakedBoundary(MeshClosedPolylines=disjoint_mesh)
join_2 = JoinCurves(Curves=weaverbird_s_naked_boundary_2, Preserve=False)
explode_2 = Explode(Curve=join_2, Recursive=True)  # -> Segments, Vertices
cull_duplicates_8 = CullDuplicates(Points=explode_2.Vertices, Tolerance=0.1, CullMode=3)  # -> simplify(Points), Indices, Valence

number_slider_19 = Slider(0.03, range=0..0.1)  # disabled
number_slider_20 = Slider(40, range=0..1000)  # disabled
number_slider_21 = Slider(0, range=0..3)  # disabled
fatten_5 = Fatten(Skeleton=geometry_3, Thickness=number_slider_20, LengthSubdivisions=0, EndType=number_slider_21, AdjustForAngle=False)  # disabled
disjoint_mesh_5 = DisjointMesh(Mesh=fatten_5)  # -> graft(Meshes); disabled

weaverbird_s_catmull_clark_subdivision_3 = WeaverbirdsCatmullClarkSubdivision(MeshCurves=disjoint_mesh_5, Level=1, SmoothNakedEdges=1)  # disabled

weaverbird_s_naked_boundary_3 = WeaverbirdsNakedBoundary(MeshClosedPolylines=disjoint_mesh_4)  # disabled
join_3 = JoinCurves(Curves=weaverbird_s_naked_boundary_3, Preserve=False)  # disabled
explode_3 = Explode(Curve=join_3, Recursive=True)  # -> Segments, Vertices; disabled
cull_duplicates_9 = CullDuplicates(Points=explode_3.Vertices, Tolerance=0.1, CullMode=3)  # -> simplify(Points), Indices, Valence; disabled
shift_paths_5 = ShiftPaths(Data=cull_duplicates_9.Points, Offset=-1)  # -> flatten(Data); disabled

face_normals_3 = FaceNormals(Mesh=disjoint_mesh_4)  # -> Centers, Normals; disabled
mesh_edges_3 = MeshEdges(Mesh=disjoint_mesh_4)  # -> NakedEdges, InteriorEdges, NonManifoldEdges; disabled
vector_display_3 = VectorDisplay(Anchor=face_normals_3.Centers, Vector=face_normals_3.Normals)  # disabled

# ----
# FATTENER
number_slider_22 = Slider(0.03, range=0..0.1)  # disabled
number_slider_23 = Slider(40, range=0..1000)  # disabled
number_slider_24 = Slider(0, range=0..3)  # disabled
fatten_6 = Fatten(
    Skeleton=flatten(line_3),
    Thickness=number_slider_23,
    LengthSubdivisions=0,
    EndType=number_slider_24,
    AdjustForAngle=False)  # disabled
disjoint_mesh_6 = DisjointMesh(Mesh=fatten_6)  # -> graft(Meshes); disabled

weaverbird_s_naked_boundary_4 = WeaverbirdsNakedBoundary(MeshClosedPolylines=disjoint_mesh_3)  # disabled
join_4 = JoinCurves(Curves=weaverbird_s_naked_boundary_4, Preserve=False)  # disabled
explode_4 = Explode(Curve=join_4, Recursive=True)  # -> Segments, Vertices; disabled
cull_duplicates_10 = CullDuplicates(Points=explode_4.Vertices, Tolerance=0.1, CullMode=3)  # -> simplify(Points), Indices, Valence; disabled

number_slider_25 = Slider(2, range=0..10)
weaverbird_s_catmull_clark_subdivision_4 = WeaverbirdsCatmullClarkSubdivision(MeshCurves=disjoint_mesh_2, Level=number_slider_25, SmoothNakedEdges=Slider(2, range=0..10))

# ----
# PREPARE WEFT AND WARP
panel_3 = Panel("1")
refine = Refine(Mesh=disjoint_mesh_2, Level=panel_3)
clean = CombineClean(Meshes=refine)
md = MeshDirection(Mesh=clean)
turn = MeshTurn(Mesh=md)

weaverbird_s_naked_boundary_5 = WeaverbirdsNakedBoundary(MeshClosedPolylines=disjoint_mesh_6)  # disabled
join_5 = JoinCurves(Curves=weaverbird_s_naked_boundary_5, Preserve=False)  # disabled
explode_5 = Explode(Curve=join_5, Recursive=True)  # -> Segments, Vertices; disabled
cull_duplicates_11 = CullDuplicates(Points=explode_5.Vertices, Tolerance=0.1, CullMode=3)  # -> simplify(Points), Indices, Valence; disabled
shift_paths_6 = ShiftPaths(Data=cull_duplicates_11.Points, Offset=-1)  # -> flatten(Data); disabled

face_normals_4 = FaceNormals(Mesh=disjoint_mesh_6)  # -> Centers, Normals; disabled
mesh_edges_4 = MeshEdges(Mesh=disjoint_mesh_6)  # -> NakedEdges, InteriorEdges, NonManifoldEdges; disabled
vector_display_4 = VectorDisplay(Anchor=face_normals_4.Centers, Vector=face_normals_4.Normals)  # disabled

number_slider_26 = Slider(2, range=0..10)  # disabled
number_slider_27 = Slider(2, range=0..10)  # disabled
weaverbird_s_catmull_clark_subdivision_5 = WeaverbirdsCatmullClarkSubdivision(MeshCurves=disjoint_mesh_4, Level=number_slider_26, SmoothNakedEdges=number_slider_27)  # disabled

closest_point = ClosestPoint(Point=cull_duplicates_8.Points, Cloud=shift_paths_4)  # -> ClosestPoint, CPIndex, Distance
deconstruct_mesh = DeconstructMesh(Mesh=disjoint_mesh)  # -> Vertices, Faces, Colours, Normals
shift_paths_7 = ShiftPaths(Data=cull_duplicates_8.Points, Offset=-1)
shift_paths_8 = ShiftPaths(Data=closest_point.ClosestPoint, Offset=-1)
closest_point_2 = ClosestPoint(Point=simplify(shift_paths_7), Cloud=simplify(deconstruct_mesh.Vertices))  # -> ClosestPoint, CPIndex, Distance
replace_items = ReplaceItems(List=deconstruct_mesh.Vertices, Item=shift_paths_8, Indices=closest_point_2.CPIndex, Wrap=False)
construct_mesh = ConstructMesh(Vertices=replace_items, Faces=deconstruct_mesh.Faces, Colours=deconstruct_mesh.Colours)

weaverbird_s_catmull_clark_subdivision_6 = WeaverbirdsCatmullClarkSubdivision(MeshCurves=construct_mesh, Level=number_slider_25, SmoothNakedEdges=Slider(2, range=0..10))

panel_4 = Panel("1")  # disabled
# PREPARE WEFT AND WARP
refine_2 = Refine(Mesh=disjoint_mesh_4, Level=panel_4)  # disabled
clean_2 = CombineClean(Meshes=refine_2)  # disabled
md_2 = MeshDirection(Mesh=clean_2)  # disabled
turn_2 = MeshTurn(Mesh=md_2)  # disabled

weaverbird_s_naked_boundary_6 = WeaverbirdsNakedBoundary(MeshClosedPolylines=disjoint_mesh_5)  # disabled
join_6 = JoinCurves(Curves=weaverbird_s_naked_boundary_6, Preserve=False)  # disabled
explode_6 = Explode(Curve=join_6, Recursive=True)  # -> Segments, Vertices; disabled
cull_duplicates_12 = CullDuplicates(Points=explode_6.Vertices, Tolerance=0.1, CullMode=3)  # -> simplify(Points), Indices, Valence; disabled

boolean_toggle = BooleanToggle(True)
flip_mesh = FlipMesh(Mesh=md, VertexNormals=boolean_toggle, FaceNormals=boolean_toggle, FaceOrientation=boolean_toggle)
mesh = Mesh(flip_mesh)

boolean_toggle_2 = BooleanToggle(True)
flip_mesh_2 = FlipMesh(
    Mesh=weaverbird_s_catmull_clark_subdivision_6,
    VertexNormals=boolean_toggle_2,
    FaceNormals=boolean_toggle_2,
    FaceOrientation=boolean_toggle_2)

boolean_toggle_3 = BooleanToggle(True)
flip_mesh_3 = FlipMesh(
    Mesh=weaverbird_s_catmull_clark_subdivision_4,
    VertexNormals=boolean_toggle_3,
    FaceNormals=boolean_toggle_3,
    FaceOrientation=boolean_toggle_3)

closest_point_3 = ClosestPoint(Point=cull_duplicates_10.Points, Cloud=shift_paths_5)  # -> ClosestPoint, CPIndex, Distance; disabled
deconstruct_mesh_2 = DeconstructMesh(Mesh=disjoint_mesh_3)  # -> Vertices, Faces, Colours, Normals; disabled
shift_paths_9 = ShiftPaths(Data=cull_duplicates_10.Points, Offset=-1)  # disabled
shift_paths_10 = ShiftPaths(Data=closest_point_3.ClosestPoint, Offset=-1)  # disabled
closest_point_4 = ClosestPoint(Point=simplify(shift_paths_9), Cloud=simplify(deconstruct_mesh_2.Vertices))  # -> ClosestPoint, CPIndex, Distance; disabled
replace_items_2 = ReplaceItems(List=deconstruct_mesh_2.Vertices, Item=shift_paths_10, Indices=closest_point_4.CPIndex, Wrap=False)  # disabled
construct_mesh_2 = ConstructMesh(Vertices=replace_items_2, Faces=deconstruct_mesh_2.Faces, Colours=deconstruct_mesh_2.Colours)  # disabled

number_slider_28 = Slider(2, range=0..10)  # disabled
weaverbird_s_catmull_clark_subdivision_7 = WeaverbirdsCatmullClarkSubdivision(MeshCurves=construct_mesh_2, Level=number_slider_26, SmoothNakedEdges=number_slider_28)  # disabled

number_slider_29 = Slider(2, range=0..10)  # disabled
number_slider_30 = Slider(2, range=0..10)  # disabled
weaverbird_s_catmull_clark_subdivision_8 = WeaverbirdsCatmullClarkSubdivision(MeshCurves=disjoint_mesh_6, Level=number_slider_29, SmoothNakedEdges=number_slider_30)  # disabled

boolean_toggle_4 = BooleanToggle(True)  # disabled
flip_mesh_4 = FlipMesh(Mesh=md_2, VertexNormals=boolean_toggle_4, FaceNormals=boolean_toggle_4, FaceOrientation=boolean_toggle_4)  # disabled
mesh_2 = Mesh(flip_mesh_4)  # disabled

# ----
# PREPARE WEFT AND WARP
panel_5 = Panel("1")  # disabled
refine_3 = Refine(Mesh=disjoint_mesh_6, Level=panel_5)  # disabled
clean_3 = CombineClean(Meshes=refine_3)  # disabled
md_3 = MeshDirection(Mesh=clean_3)  # disabled
turn_3 = MeshTurn(Mesh=md_3)  # disabled

boolean_toggle_5 = BooleanToggle(True)  # disabled
flip_mesh_5 = FlipMesh(
    Mesh=weaverbird_s_catmull_clark_subdivision_7,
    VertexNormals=boolean_toggle_5,
    FaceNormals=boolean_toggle_5,
    FaceOrientation=boolean_toggle_5)  # disabled

boolean_toggle_6 = BooleanToggle(True)  # disabled
flip_mesh_6 = FlipMesh(
    Mesh=weaverbird_s_catmull_clark_subdivision_5,
    VertexNormals=boolean_toggle_6,
    FaceNormals=boolean_toggle_6,
    FaceOrientation=boolean_toggle_6)  # disabled

strips = RefineStrips(Mesh=flip_mesh_2, Level="2")

colour_swatch = ColourSwatch(SwatchColor=RGB(84, 84, 84))  # disabled
custom_preview = CustomPreview(Geometry=strips, Material=colour_swatch)  # disabled

face_normals_5 = FaceNormals(Mesh=weaverbird_s_catmull_clark_subdivision)  # -> Centers, Normals; disabled
mesh_edges_5 = MeshEdges(Mesh=strips)  # -> NakedEdges, InteriorEdges, NonManifoldEdges; disabled
vector_display_5 = VectorDisplay(Anchor=face_normals_5.Centers, Vector=face_normals_5.Normals)  # disabled

strips_2 = RefineStrips(Mesh=flip_mesh_3, Level="2")

mesh_edges_6 = MeshEdges(Mesh=strips_2)  # -> NakedEdges, InteriorEdges, NonManifoldEdges
face_normals_6 = FaceNormals(Mesh=strips_2)  # -> Centers, Normals
vector_display_6 = VectorDisplay(Anchor=face_normals_6.Centers, Vector=face_normals_6.Normals)

strips_3 = RefineStrips(Mesh=mesh, Level="2")

closest_point_5 = ClosestPoint(Point=cull_duplicates_12.Points, Cloud=shift_paths_6)  # -> ClosestPoint, CPIndex, Distance; disabled
deconstruct_mesh_3 = DeconstructMesh(Mesh=disjoint_mesh_5)  # -> Vertices, Faces, Colours, Normals; disabled
shift_paths_11 = ShiftPaths(Data=cull_duplicates_12.Points, Offset=-1)  # disabled
shift_paths_12 = ShiftPaths(Data=closest_point_5.ClosestPoint, Offset=-1)  # disabled
closest_point_6 = ClosestPoint(Point=simplify(shift_paths_11), Cloud=simplify(deconstruct_mesh_3.Vertices))  # -> ClosestPoint, CPIndex, Distance; disabled
replace_items_3 = ReplaceItems(List=deconstruct_mesh_3.Vertices, Item=shift_paths_12, Indices=closest_point_6.CPIndex, Wrap=False)  # disabled
construct_mesh_3 = ConstructMesh(Vertices=replace_items_3, Faces=deconstruct_mesh_3.Faces, Colours=deconstruct_mesh_3.Colours)  # disabled

number_slider_31 = Slider(2, range=0..10)  # disabled
weaverbird_s_catmull_clark_subdivision_9 = WeaverbirdsCatmullClarkSubdivision(MeshCurves=construct_mesh_3, Level=number_slider_29, SmoothNakedEdges=number_slider_31)  # disabled

boolean_toggle_7 = BooleanToggle(True)  # disabled
flip_mesh_7 = FlipMesh(Mesh=md_3, VertexNormals=boolean_toggle_7, FaceNormals=boolean_toggle_7, FaceOrientation=boolean_toggle_7)  # disabled
mesh_3 = Mesh(flip_mesh_7)  # disabled

panel_6 = Panel("2")  # disabled
strips_4 = RefineStrips(Mesh=flip_mesh_5, Level=panel_6)  # disabled

panel_7 = Panel("2")  # disabled
strips_5 = RefineStrips(Mesh=flip_mesh_6, Level=panel_7)  # disabled

mesh_edges_7 = MeshEdges(Mesh=strips_5)  # -> NakedEdges, InteriorEdges, NonManifoldEdges; disabled
face_normals_7 = FaceNormals(Mesh=strips_5)  # -> Centers, Normals; disabled
vector_display_7 = VectorDisplay(Anchor=face_normals_7.Centers, Vector=face_normals_7.Normals)  # disabled

panel_8 = Panel("2")  # disabled
strips_6 = RefineStrips(Mesh=mesh_2, Level=panel_8)  # disabled

boolean_toggle_8 = BooleanToggle(True)  # disabled
flip_mesh_8 = FlipMesh(
    Mesh=weaverbird_s_catmull_clark_subdivision_9,
    VertexNormals=boolean_toggle_8,
    FaceNormals=boolean_toggle_8,
    FaceOrientation=boolean_toggle_8)  # disabled

boolean_toggle_9 = BooleanToggle(True)  # disabled
flip_mesh_9 = FlipMesh(
    Mesh=weaverbird_s_catmull_clark_subdivision_8,
    VertexNormals=boolean_toggle_9,
    FaceNormals=boolean_toggle_9,
    FaceOrientation=boolean_toggle_9)  # disabled

panel_9 = Panel("2")  # disabled
strips_7 = RefineStrips(Mesh=flip_mesh_8, Level=panel_9)  # disabled

face_normals_8 = FaceNormals(Mesh=weaverbird_s_catmull_clark_subdivision_3)  # -> Centers, Normals; disabled
mesh_edges_8 = MeshEdges(Mesh=strips_7)  # -> NakedEdges, InteriorEdges, NonManifoldEdges; disabled
vector_display_8 = VectorDisplay(Anchor=face_normals_8.Centers, Vector=face_normals_8.Normals)  # disabled

panel_10 = Panel("2")  # disabled
strips_8 = RefineStrips(Mesh=flip_mesh_9, Level=panel_10)  # disabled

mesh_edges_9 = MeshEdges(Mesh=strips_8)  # -> NakedEdges, InteriorEdges, NonManifoldEdges; disabled
face_normals_9 = FaceNormals(Mesh=strips_8)  # -> Centers, Normals; disabled
vector_display_9 = VectorDisplay(Anchor=face_normals_9.Centers, Vector=face_normals_9.Normals)  # disabled

panel_11 = Panel("2")  # disabled
strips_9 = RefineStrips(Mesh=mesh_3, Level=panel_11)  # disabled

mesh_4 = Mesh(simplify(strips_2))
mesh_5 = Mesh(simplify(strips_2))
mesh_6 = Mesh(simplify(strips_5))  # disabled

number_slider_32 = Slider(0.03, range=0..0.1)
# KANGAROO FORM RELAXATION
fatten_7 = Fatten(
    Skeleton=flatten(line),
    Thickness=Slider(35, range=30..100),
    LengthSubdivisions=0,
    EndType=Slider(3, range=0..3),
    AdjustForAngle=False)
disjoint_mesh_7 = DisjointMesh(Mesh=fatten_7)  # -> simplify(graft(Meshes))

mesh_7 = Mesh(simplify(strips_5))  # disabled
mesh_edges_10 = MeshEdges(Mesh=mesh_4)  # -> NakedEdges, InteriorEdges, NonManifoldEdges
deconstruct_mesh_4 = DeconstructMesh(Mesh=mesh_4)  # -> simplify(Vertices), Faces, Colours, Normals

number_slider_33 = Slider(0.03, range=0..0.1)  # disabled
number_slider_34 = Slider(32, range=30..100)  # disabled
number_slider_35 = Slider(3, range=0..3)  # disabled
# KANGAROO FORM RELAXATION
fatten_8 = Fatten(
    Skeleton=flatten(line_2),
    Thickness=number_slider_34,
    LengthSubdivisions=0,
    EndType=number_slider_35,
    AdjustForAngle=False)  # disabled
disjoint_mesh_8 = DisjointMesh(Mesh=fatten_8)  # -> graft(Meshes); disabled

warpweft = WarpWeft(Mesh=mesh_4)  # -> Warp, Weft, NakedA, NakedB
tree_branch = TreeBranch(Tree=simplify(deconstruct_mesh_4.Vertices), Path=Slider(0, range=0..3), MaintainPaths=True)
mesh_edges_11 = MeshEdges(Mesh=mesh_6)  # -> NakedEdges, InteriorEdges, NonManifoldEdges; disabled
mesh_8 = Mesh(simplify(strips_8))  # disabled
deconstruct_mesh_5 = DeconstructMesh(Mesh=mesh_6)  # -> simplify(Vertices), Faces, Colours, Normals; disabled
warpweft_2 = WarpWeft(Mesh=mesh_6)  # -> Warp, Weft, NakedA, NakedB; disabled

number_slider_36 = Slider(0.03, range=0..0.1)  # disabled
number_slider_37 = Slider(3, range=0..3)  # disabled
number_slider_38 = Slider(40, range=30..100)  # disabled
fatten_9 = Fatten(
    Skeleton=flatten(line_3),
    Thickness=number_slider_38,
    LengthSubdivisions=0,
    EndType=number_slider_37,
    AdjustForAngle=False)  # disabled
disjoint_mesh_9 = DisjointMesh(Mesh=fatten_9)  # -> graft(Meshes); disabled

end_points = EndPoints(Curve=line_3)  # -> Start, End; disabled
# KANGAROO FORM RELAXATION
vector_2pt = Vector2Pt(PointA=end_points.End, PointB=end_points.Start, Unitize=True)  # -> Vector, Length; disabled
average = Average(Input=vector_2pt.Vector)  # disabled
vector_display_10 = VectorDisplay(Anchor=end_points.Start, Vector=average)  # disabled

mesh_9 = Mesh(simplify(strips_8))  # disabled

number_slider_39 = Slider(10, range=0..1000)  # disabled
amplitude = Amplitude(Vector=average, Amplitude=number_slider_39)  # disabled

join_7 = JoinCurves(Curves=mesh_edges_10.NakedEdges, Preserve=False)
explode_7 = Explode(Curve=join_7, Recursive=True)  # -> Segments, Vertices
end = EndPoints(Curve=explode_7.Segments)  # -> Start, End

weaverbird_s_catmull_clark_subdivision_10 = WeaverbirdsCatmullClarkSubdivision(MeshCurves=disjoint_mesh_7, Level=Slider(2, range=0..10), SmoothNakedEdges=Slider(2, range=0..10))

mesh_edges_12 = MeshEdges(Mesh=mesh_5)  # -> NakedEdges, InteriorEdges, NonManifoldEdges
# FIND PEAK AND VALLEY
# OF Y CONNECTOR
cluster = Cluster(M=mesh_5)
mesh_edges_13 = MeshEdges(Mesh=mesh_9)  # -> NakedEdges, InteriorEdges, NonManifoldEdges; disabled
deconstruct_mesh_6 = DeconstructMesh(Mesh=mesh_9)  # -> simplify(Vertices), Faces, Colours, Normals; disabled

join_8 = JoinCurves(Curves=mesh_edges_11.NakedEdges, Preserve=False)  # disabled
explode_8 = Explode(Curve=join_8, Recursive=True)  # -> Segments, Vertices; disabled
end_2 = EndPoints(Curve=explode_8.Segments)  # -> Start, End; disabled

# ----
# FIND PEAK AND VALLEY
# OF Y CONNECTOR
cluster_2 = Cluster(M=mesh_7)  # disabled

nakedvertices = NakedVertices(Mesh=mesh_7)  # -> ClothedIndex, NakedIndex, ClothedPts, NakedPts; disabled
geometry_4 = Geometry(nakedvertices.NakedPts)  # disabled
find_similar_member = FindSimilarMember(Data=geometry_4, Set=cluster_2)  # -> Hit, Index; disabled
cull_index = CullIndex(List=cluster_2, Indices=find_similar_member.Index, Wrap=True)  # disabled

warpweft_3 = WarpWeft(Mesh=mesh_9)  # -> Warp, Weft, NakedA, NakedB; disabled

number_slider_40 = Slider(2, range=0..10)  # disabled
number_slider_41 = Slider(2, range=0..10)  # disabled
weaverbird_s_catmull_clark_subdivision_11 = WeaverbirdsCatmullClarkSubdivision(MeshCurves=disjoint_mesh_8, Level=number_slider_40, SmoothNakedEdges=number_slider_41)  # disabled

move = Move(Geometry=mesh_8, Motion=amplitude)  # -> simplify(Geometry), Transform; disabled

mesh_edges_14 = MeshEdges(Mesh=mesh_7)  # -> NakedEdges, InteriorEdges, NonManifoldEdges; disabled
geometry_5 = Geometry(warpweft.Warp)
geometry_6 = Geometry(warpweft.Weft)
cluster_3 = Cluster_2(point=cluster, geometry=[mesh_edges_12.NakedEdges, mesh_edges_12.InteriorEdges, mesh_edges_12.NonManifoldEdges])  # -> valley_2, peak_2

length = Length(Curve=geometry_5)
multiplication = Multiplication(A=length, B=Slider(0, range=0..1))

length_2 = Length(Curve=geometry_5)
multiplication_2 = Multiplication(A=length_2, B=Slider(0.944, range=0..1))

geometry_7 = Geometry(warpweft_2.Warp)  # disabled

number_slider_42 = Slider(2, range=0..10)  # disabled
number_slider_43 = Slider(2, range=0..10)  # disabled
weaverbird_s_catmull_clark_subdivision_12 = WeaverbirdsCatmullClarkSubdivision(MeshCurves=disjoint_mesh_9, Level=number_slider_42, SmoothNakedEdges=number_slider_43)  # disabled

geometry_8 = Geometry(warpweft_2.Weft)  # disabled
geometry_9 = Geometry(cluster_3.peak_2)
cluster_4 = Cluster_2(point=cull_index, geometry=[mesh_edges_14.NakedEdges, mesh_edges_14.InteriorEdges, mesh_edges_14.NonManifoldEdges])  # -> valley_2, peak_2; disabled
length_3 = Length(Curve=geometry_6)

join_9 = JoinCurves(Curves=mesh_edges_13.NakedEdges, Preserve=False)  # disabled
explode_9 = Explode(Curve=join_9, Recursive=True)  # -> Segments, Vertices; disabled
end_3 = EndPoints(Curve=explode_9.Segments)  # -> Start, End; disabled

mesh_10 = Mesh(move.Geometry)  # disabled
mesh_edges_15 = MeshEdges(Mesh=mesh_10)  # -> NakedEdges, InteriorEdges, NonManifoldEdges; disabled
cluster_5 = Cluster(M=mesh_10)  # disabled
cluster_6 = Cluster_2(point=cluster_5, geometry=[mesh_edges_15.NakedEdges, mesh_edges_15.InteriorEdges, mesh_edges_15.NonManifoldEdges])  # -> valley_2, peak_2; disabled
geometry_10 = Geometry(cluster_6.peak_2)  # disabled

number_slider_44 = Slider(5, range=0..1000)  # disabled
amplitude_2 = Amplitude(Vector=average, Amplitude=number_slider_44)  # disabled

mesh_closest_point = MeshClosestPoint(Point=geometry_9, Mesh=simplify(weaverbird_s_catmull_clark_subdivision_10))  # -> Point, Index, Parameter

number_slider_45 = Slider(0, range=0..1)  # disabled
length_4 = Length(Curve=geometry_7)  # disabled
multiplication_3 = Multiplication(A=length_4, B=number_slider_45)  # disabled

number_slider_46 = Slider(0.944, range=0..1)  # disabled
length_5 = Length(Curve=geometry_7)  # disabled
multiplication_4 = Multiplication(A=length_5, B=number_slider_46)  # disabled

number_slider_47 = Slider(0.521, range=0..1)  # disabled
multiplication_5 = Multiplication(A=length_3, B=Slider(0.521, range=0..1))

custom_preview_2 = CustomPreview(Geometry=weaverbird_s_catmull_clark_subdivision_10, Material=ColourSwatch(SwatchColor=RGBA(255, 255, 255, 95)))

number_slider_48 = Slider(9.7, range=0.5..20)  # disabled
geometry_11 = Geometry(cluster_4.peak_2)  # disabled
length_6 = Length(Curve=geometry_8)  # disabled
number_slider_49 = Slider(1, range=0.1..20)  # disabled

mesh_edges_16 = MeshEdges(Mesh=mesh_8)  # -> NakedEdges, InteriorEdges, NonManifoldEdges; disabled
cluster_7 = Cluster(M=mesh_8)  # disabled
cluster_8 = Cluster_2(point=cluster_7, geometry=[mesh_edges_16.NakedEdges, mesh_edges_16.InteriorEdges, mesh_edges_16.NonManifoldEdges])  # -> valley_2, peak_2; disabled
geometry_12 = Geometry(cluster_8.peak_2)  # disabled

number_slider_50 = Slider(1000, range=0..1000)  # disabled
number_slider_51 = Slider(0.02, range=0..0.1)  # disabled
number_slider_52 = Slider(1000, range=0..1000)  # disabled
number_slider_53 = Slider(201000, range=0..201000)  # disabled
number_slider_54 = Slider(97, range=0..1000)  # disabled
mesh_closest_point_2 = MeshClosestPoint(Point=geometry_11, Mesh=simplify(weaverbird_s_catmull_clark_subdivision_11))  # -> Point, Index, Parameter; disabled
number_slider_55 = Slider(384, range=0..1000)  # disabled
solidpointcollide = SolidPointCollide(
    Points=deconstruct_mesh_4.Vertices,
    Solid=simplify(weaverbird_s_catmull_clark_subdivision_10),
    Interior=False,
    Unidirectional=True,
    Strength=Slider(1000, range=0..1000))
pressure = Pressure(M=mesh_4, Strength=Slider(0.03, range=0..0.1))
clamplength = ClampLength(Line=geometry_5, LowerLimit=multiplication, UpperLimit=multiplication_2, Strength=Slider(1, range=0.1..20))
length_line = LengthLine(Line=geometry_6, Length=multiplication_5, Strength=Slider(9.7, range=0.5..20))
anchor = Anchor(Point=simplify(end.Start), Strength=Slider(201000, range=0..201000))
equallength = EqualLength(Line=simplify(explode_7.Segments), Strength=Slider(97, range=0..1000))
multiplication_6 = Multiplication(A=length_6, B=number_slider_47)  # disabled
anchor_2 = Anchor(Point=geometry_9, Target=mesh_closest_point.Point, Strength=Slider(1000, range=0..1000))
planarize = Planarize(M=mesh_4, Strength=Slider(384, range=0..1000))

colour_swatch_2 = ColourSwatch(SwatchColor=RGBA(255, 255, 255, 95))  # disabled
custom_preview_3 = CustomPreview(Geometry=weaverbird_s_catmull_clark_subdivision_11, Material=colour_swatch_2)  # disabled

show = Show(G=mesh_4)
geometry_13 = Geometry(warpweft_3.Warp)  # disabled
# FIND PEAK AND VALLEY
# OF Y CONNECTOR
geometry_14 = Geometry(warpweft_3.Weft)  # disabled
move_2 = Move(Geometry=weaverbird_s_catmull_clark_subdivision_12, Motion=amplitude_2)  # -> simplify(Geometry), Transform; disabled
solidpointcollide_2 = SolidPointCollide(
    Points=deconstruct_mesh_5.Vertices,
    Solid=simplify(weaverbird_s_catmull_clark_subdivision_11),
    Interior=False,
    Unidirectional=True,
    Strength=number_slider_50)  # disabled
pressure_2 = Pressure(M=mesh_6, Strength=number_slider_51)  # disabled
clamplength_2 = ClampLength(Line=geometry_7, LowerLimit=multiplication_3, UpperLimit=multiplication_4, Strength=number_slider_49)  # disabled
length_line_2 = LengthLine(Line=geometry_8, Length=multiplication_6, Strength=number_slider_48)  # disabled

number_slider_56 = Slider(0, range=0..1)  # disabled
length_7 = Length(Curve=geometry_13)  # disabled
multiplication_7 = Multiplication(A=length_7, B=number_slider_56)  # disabled

anchor_3 = Anchor(Point=simplify(end_2.Start), Strength=number_slider_53)  # disabled

number_slider_57 = Slider(0.944, range=0..1)  # disabled
length_8 = Length(Curve=geometry_13)  # disabled
multiplication_8 = Multiplication(A=length_8, B=number_slider_57)  # disabled

equallength_2 = EqualLength(Line=simplify(explode_8.Segments), Strength=number_slider_54)  # disabled
number_slider_58 = Slider(0.521, range=0..1)  # disabled
anchor_4 = Anchor(Point=geometry_11, Target=mesh_closest_point_2.Point, Strength=number_slider_52)  # disabled
planarize_2 = Planarize(M=mesh_6, Strength=number_slider_55)  # disabled
show_2 = Show(G=mesh_6)  # disabled
number_slider_59 = Slider(9.7, range=0.5..20)  # disabled
length_9 = Length(Curve=geometry_14)  # disabled
number_slider_60 = Slider(1, range=0.1..20)  # disabled
number_slider_61 = Slider(1000, range=0..1000)  # disabled
number_slider_62 = Slider(0.01, range=0..0.1)  # disabled
number_slider_63 = Slider(11000, range=0..11000)  # disabled
number_slider_64 = Slider(201000, range=0..201000)  # disabled
number_slider_65 = Slider(97, range=0..1000)  # disabled
number_slider_66 = Slider(384, range=0..1000)  # disabled
multiplication_9 = Multiplication(A=length_9, B=number_slider_58)  # disabled

colour_swatch_3 = ColourSwatch(SwatchColor=RGBA(255, 255, 255, 95))  # disabled
custom_preview_4 = CustomPreview(Geometry=move_2.Geometry, Material=colour_swatch_3)  # disabled

entwine = Entwine(
    Branch00=show,
    Branch01=flatten([pressure, anchor, planarize, equallength, clamplength, length_line, solidpointcollide, anchor_2]),
    FlattenInputs=True)
show_3 = Show(G=mesh_9)  # disabled
solidpointcollide_3 = SolidPointCollide(
    Points=deconstruct_mesh_6.Vertices,
    Solid=simplify(move_2.Geometry),
    Interior=False,
    Unidirectional=True,
    Strength=number_slider_61)  # disabled
pressure_3 = Pressure(M=mesh_9, Strength=number_slider_62)  # disabled
clamplength_3 = ClampLength(Line=geometry_13, LowerLimit=multiplication_7, UpperLimit=multiplication_8, Strength=number_slider_60)  # disabled
length_line_3 = LengthLine(Line=geometry_14, Length=multiplication_9, Strength=number_slider_59)  # disabled
anchor_5 = Anchor(Point=simplify(end_3.Start), Strength=number_slider_64)  # disabled
equallength_3 = EqualLength(Line=simplify(explode_9.Segments), Strength=number_slider_65)  # disabled
anchor_6 = Anchor(Point=geometry_12, Target=geometry_10, Strength=number_slider_63)  # disabled
planarize_3 = Planarize(M=mesh_9, Strength=number_slider_66)  # disabled
boolean_toggle_10 = BooleanToggle(False)  # disabled
solver = Solver(GoalObjects=entwine, Reset=Button(), Threshold=1e-15, Tolerance=0.01, On=Toggle(False))  # -> I, V, O
button = Button()  # disabled
entwine_2 = Entwine(
    Branch00=show_2,
    Branch01=flatten([pressure_2, anchor_3, planarize_2, equallength_2, clamplength_2, length_line_2, solidpointcollide_2, anchor_4]),
    FlattenInputs=True)  # disabled
bang = ExplodeTree(Data=solver.O)  # -> Branch0, Branch1
solver_2 = Solver(GoalObjects=entwine_2, Reset=button, Threshold=1e-15, Tolerance=0.01, On=boolean_toggle_10)  # -> I, V, O; disabled
mesh_11 = Mesh(bang.Branch0)
bang_2 = ExplodeTree(Data=solver_2.O)  # -> Branch0, Branch1; disabled
mesh_edges_17 = MeshEdges(Mesh=mesh_11)  # -> NakedEdges, InteriorEdges, NonManifoldEdges
boolean_toggle_11 = BooleanToggle(False)  # disabled
button_2 = Button()  # disabled
entwine_3 = Entwine(
    Branch00=show_3,
    Branch01=flatten([pressure_3, anchor_5, planarize_3, equallength_3, clamplength_3, length_line_3, solidpointcollide_3, anchor_6]),
    FlattenInputs=True)  # disabled
mesh_12 = Mesh(bang_2.Branch0)  # disabled
mesh_edges_18 = MeshEdges(Mesh=mesh_12)  # -> NakedEdges, InteriorEdges, NonManifoldEdges; disabled
solver_3 = Solver(GoalObjects=entwine_3, Reset=button_2, Threshold=1e-15, Tolerance=0.01, On=boolean_toggle_11)  # -> I, V, O; disabled
bang_3 = ExplodeTree(Data=solver_3.O)  # -> Branch0, Branch1; disabled
mesh_13 = Mesh(bang_3.Branch0)  # disabled
mesh_edges_19 = MeshEdges(Mesh=mesh_13)  # -> NakedEdges, InteriorEdges, NonManifoldEdges; disabled

# ----
# DIVIDE INTO STRIPS
dam = DataDam(DataA=graft(mesh_11), BufferDelay=10000000, BufferMode=0)  # -> flatten(DataA)
stripper = Stripper(Mesh=dam)
unroller = Unroller(Strip=stripper, Unroll=Slider(0, range=0..1))  # -> graft(Unrolled)
weaverbird_s_naked_boundary_7 = WeaverbirdsNakedBoundary(MeshClosedPolylines=unroller)
mesh_edges_20 = MeshEdges(Mesh=unroller)  # -> NakedEdges, InteriorEdges, NonManifoldEdges
dam_2 = DataDam(DataA=unroller, BufferDelay=10000000, BufferMode=0)

# ----
# DIVIDE INTO STRIPS
dam_3 = DataDam(DataA=graft(mesh_12), BufferDelay=10000000, BufferMode=0)  # -> flatten(DataA); disabled
number_slider_67 = Slider(0, range=0..1)  # disabled
stripper_2 = Stripper(Mesh=dam_3)  # disabled
unroller_2 = Unroller(Strip=stripper_2, Unroll=number_slider_67)  # -> graft(Unrolled); disabled
mesh_edges_21 = MeshEdges(Mesh=unroller_2)  # -> NakedEdges, InteriorEdges, NonManifoldEdges; disabled
dam_4 = DataDam(DataA=unroller_2, BufferDelay=10000000, BufferMode=0)  # disabled

# ----
# DIVIDE INTO STRIPS
dam_5 = DataDam(DataA=graft(mesh_13), BufferDelay=10000000, BufferMode=1)  # -> flatten(DataA); disabled
number_slider_68 = Slider(0, range=0..1)  # disabled
stripper_3 = Stripper(Mesh=dam_5)  # disabled
unroller_3 = Unroller(Strip=stripper_3, Unroll=number_slider_68)  # -> graft(Unrolled); disabled
mesh_edges_22 = MeshEdges(Mesh=unroller_3)  # -> NakedEdges, InteriorEdges, NonManifoldEdges; disabled
dam_6 = DataDam(DataA=unroller_3, BufferDelay=10000000, BufferMode=0)  # disabled

mesh_14 = Mesh(simplify(dam_2))
mesh_15 = Mesh(simplify(dam_2))
shift_paths_13 = ShiftPaths(Data=mesh_14, Offset=-1)
mesh_16 = Mesh(simplify(dam_4))  # disabled
mesh_join = MeshJoin(Meshes=shift_paths_13)  # disabled

# ----
# Splitting into 3 faces
mesh_join_2 = MeshJoin(Meshes=shift_paths_13)
mesh_edges_23 = MeshEdges(Mesh=shift_paths_13)  # -> NakedEdges, InteriorEdges, NonManifoldEdges
cluster_9 = Cluster(M=mesh_join_2)
cluster_10 = Cluster_2(
    point=cluster_9,
    geometry=simplify([mesh_edges_23.NakedEdges, mesh_edges_23.InteriorEdges, mesh_edges_23.NonManifoldEdges]))  # -> valley_2, peak_2

# ----
# Splitting top & bottom face
shift_paths_14 = ShiftPaths(Data=mesh_16, Offset=-1)  # disabled

# ----
# Splitting top & bottom face
mesh_area = MeshArea(Mesh=shift_paths_13)  # -> Area, Centroid; disabled
mesh_closest_point_3 = MeshClosestPoint(Point=mesh_area.Centroid, Mesh=shift_paths_13)  # -> Point, Index, Parameter; disabled

cluster_11 = Cluster(M=mesh_join)  # disabled
weaverbird_s_naked_boundary_8 = WeaverbirdsNakedBoundary(MeshClosedPolylines=shift_paths_13)  # disabled
mesh_edges_24 = MeshEdges(Mesh=shift_paths_13)  # -> NakedEdges, InteriorEdges, NonManifoldEdges; disabled
mesh_17 = Mesh(simplify(dam_6))  # disabled
mesh_join_3 = MeshJoin(Meshes=shift_paths_14)  # disabled

mesh_area_2 = MeshArea(Mesh=shift_paths_14)  # -> Area, Centroid; disabled
mesh_closest_point_4 = MeshClosestPoint(Point=mesh_area_2.Centroid, Mesh=shift_paths_14)  # -> Point, Index, Parameter; disabled

cluster_12 = Cluster(M=mesh_join_3)  # disabled
weaverbird_s_naked_boundary_9 = WeaverbirdsNakedBoundary(MeshClosedPolylines=shift_paths_14)  # disabled
mesh_edges_25 = MeshEdges(Mesh=shift_paths_14)  # -> NakedEdges, InteriorEdges, NonManifoldEdges; disabled

tree_statistics = TreeStatistics(Tree=mesh_closest_point_3.Point)  # -> Paths, Length, Count; disabled
series = Series(Start=0, Step=1, Count=tree_statistics.Count)  # disabled
duplicate_data = DuplicateData(Data=graft(series), Number=2, Order=True)  # -> simplify(Data); disabled

# ----
# Splitting top & bottom face
shift_paths_15 = ShiftPaths(Data=mesh_17, Offset=-1)  # disabled
mesh_join_4 = MeshJoin(Meshes=shift_paths_15)  # disabled

geometry_15 = Geometry(cluster_10.valley_2)
sphere_7 = Sphere(Base=geometry_15, Radius=1)

geometry_16 = Geometry(cluster_10.peak_2)
sphere_8 = Sphere(Base=geometry_16, Radius=1)

tree_statistics_2 = TreeStatistics(Tree=mesh_closest_point_4.Point)  # -> Paths, Length, Count; disabled
series_2 = Series(Start=0, Step=1, Count=tree_statistics_2.Count)  # disabled
duplicate_data_2 = DuplicateData(Data=graft(series_2), Number=2, Order=True)  # -> simplify(Data); disabled

mesh_area_3 = MeshArea(Mesh=shift_paths_15)  # -> Area, Centroid; disabled
mesh_closest_point_5 = MeshClosestPoint(Point=mesh_area_3.Centroid, Mesh=shift_paths_15)  # -> Point, Index, Parameter; disabled

cluster_13 = Cluster(M=mesh_join_4)  # disabled
weaverbird_s_naked_boundary_10 = WeaverbirdsNakedBoundary(MeshClosedPolylines=shift_paths_15)  # disabled
mesh_edges_26 = MeshEdges(Mesh=shift_paths_15)  # -> NakedEdges, InteriorEdges, NonManifoldEdges; disabled

tree_branch_2 = TreeBranch(Tree=mesh_closest_point_3.Point, Path=graft(duplicate_data), MaintainPaths=False)  # disabled

radians = Radians(Degrees=Slider(140, range=0..140))
meshcorners = MeshCorners(Mesh=mesh_15, Angle=radians)  # -> simplify(Corners)

radians_2 = Radians(Degrees=Slider(140, range=0..140))
meshcorners_2 = MeshCorners(Mesh=mesh_15, Angle=radians_2)  # -> simplify(Corners)

line_4 = Line(StartPoint=graft(cluster_11), EndPoint=tree_branch_2)  # -> simplify(Line); disabled
cluster_14 = Cluster_2(
    point=cluster_11,
    geometry=simplify([mesh_edges_24.NakedEdges, mesh_edges_24.InteriorEdges, mesh_edges_24.NonManifoldEdges]))  # -> valley_2, peak_2; disabled

tree_branch_3 = TreeBranch(Tree=mesh_closest_point_4.Point, Path=graft(duplicate_data_2), MaintainPaths=False)  # disabled

tree_statistics_3 = TreeStatistics(Tree=mesh_closest_point_5.Point)  # -> Paths, Length, Count; disabled
series_3 = Series(Start=0, Step=1, Count=tree_statistics_3.Count)  # disabled
duplicate_data_3 = DuplicateData(Data=graft(series_3), Number=2, Order=True)  # -> simplify(Data); disabled

tree_branch_4 = TreeBranch(Tree=shift_paths_13, Path=graft(duplicate_data), MaintainPaths=False)  # disabled
length_10 = Length(Curve=line_4)  # disabled

weaverbird_s_naked_boundary_11 = WeaverbirdsNakedBoundary(MeshClosedPolylines=mesh_15)
curve_closest_point_4 = CurveClosestPoint(Point=meshcorners, Curve=weaverbird_s_naked_boundary_11)  # -> Point, Parameter, Distance
shatter_4 = Shatter(Curve=weaverbird_s_naked_boundary_11, Parameters=curve_closest_point_4.Parameter)  # -> simplify(Segments)
length_11 = Length(Curve=shatter_4)  # -> simplify(Length)
panel_12 = Panel("""0
1""")
sort_list = SortList(Keys=length_11, ValuesValuesA=shatter_4)  # -> Keys, ValuesValuesA
cull_index_2 = CullIndex(List=sort_list.ValuesValuesA, Indices=panel_12, Wrap=True)  # -> simplify(List)
rebuild_curve = RebuildCurve(Curve=cull_index_2, Count=Slider(15, range=0..100), Degree=3, EndTangents=False)  # -> flatten(Rebuilt)
shift_paths_16 = ShiftPaths(Data=cull_index_2, Offset=-1)
collision_one_many_4 = CollisionOneMany(Collider=shift_paths_16, Obstacles=sphere_7)  # -> Collision, Index
cull_pattern_4 = CullPattern(List=shift_paths_16, CullPattern=collision_one_many_4.Collision)

weaverbird_s_naked_boundary_12 = WeaverbirdsNakedBoundary(MeshClosedPolylines=mesh_15)
curve_closest_point_5 = CurveClosestPoint(Point=meshcorners_2, Curve=weaverbird_s_naked_boundary_12)  # -> Point, Parameter, Distance
shatter_5 = Shatter(Curve=weaverbird_s_naked_boundary_12, Parameters=curve_closest_point_5.Parameter)  # -> simplify(Segments)
length_12 = Length(Curve=shatter_5)  # -> simplify(Length)
panel_13 = Panel("""0
1""")
sort_list_2 = SortList(Keys=length_12, ValuesValuesA=shatter_5)  # -> Keys, ValuesValuesA
cull_index_3 = CullIndex(List=sort_list_2.ValuesValuesA, Indices=panel_13, Wrap=True)  # -> simplify(List)
rebuild_curve_2 = RebuildCurve(Curve=cull_index_3, Count=Slider(15, range=0..100), Degree=3, EndTangents=False)  # -> flatten(Rebuilt)
shift_paths_17 = ShiftPaths(Data=cull_index_3, Offset=-1)
collision_one_many_5 = CollisionOneMany(Collider=shift_paths_17, Obstacles=sphere_8)  # -> Collision, Index
cull_pattern_5 = CullPattern(List=shift_paths_17, CullPattern=collision_one_many_5.Collision)

line_5 = Line(StartPoint=graft(cluster_12), EndPoint=tree_branch_3)  # -> simplify(Line); disabled

number_slider_69 = Slider(2, range=0..10)  # disabled
list_length = ListLength(List=length_10)  # disabled
division = Division(A=list_length, B=number_slider_69)  # disabled

cluster_15 = Cluster_2(
    point=cluster_12,
    geometry=simplify([mesh_edges_25.NakedEdges, mesh_edges_25.InteriorEdges, mesh_edges_25.NonManifoldEdges]))  # -> valley_2, peak_2; disabled

geometry_17 = Geometry(cluster_14.valley_2)  # disabled
sphere_9 = Sphere(Base=geometry_17, Radius=1)  # disabled

geometry_18 = Geometry(cluster_14.peak_2)  # disabled
sphere_10 = Sphere(Base=geometry_18, Radius=1)  # disabled

tree_branch_5 = TreeBranch(Tree=shift_paths_14, Path=graft(duplicate_data_2), MaintainPaths=False)  # disabled
length_13 = Length(Curve=line_5)  # disabled
sort_list_3 = SortList(Keys=length_10, ValuesValuesA=line_4, ValuesA=tree_branch_4)  # -> Keys, ValuesValuesA, ValuesA; disabled

tree_branch_6 = TreeBranch(Tree=mesh_closest_point_5.Point, Path=graft(duplicate_data_3), MaintainPaths=False)  # disabled

number_slider_70 = Slider(2, range=0..10)  # disabled
list_length_2 = ListLength(List=length_13)  # disabled
division_2 = Division(A=list_length_2, B=number_slider_70)  # disabled

geometry_19 = Geometry(cluster_15.valley_2)  # disabled
sphere_11 = Sphere(Base=geometry_19, Radius=1)  # disabled

line_6 = Line(StartPoint=graft(cluster_13), EndPoint=tree_branch_6)  # -> simplify(Line); disabled

geometry_20 = Geometry(cluster_15.peak_2)  # disabled
sphere_12 = Sphere(Base=geometry_20, Radius=1)  # disabled

sort_list_4 = SortList(Keys=length_13, ValuesValuesA=line_5, ValuesA=tree_branch_5)  # -> Keys, ValuesValuesA, ValuesA; disabled
cluster_16 = Cluster_2(
    point=cluster_13,
    geometry=simplify([mesh_edges_26.NakedEdges, mesh_edges_26.InteriorEdges, mesh_edges_26.NonManifoldEdges]))  # -> valley_2, peak_2; disabled
tree_branch_7 = TreeBranch(Tree=shift_paths_15, Path=graft(duplicate_data_3), MaintainPaths=False)  # disabled
length_14 = Length(Curve=line_6)  # disabled

number_slider_71 = Slider(2, range=0..10)  # disabled
list_length_3 = ListLength(List=length_14)  # disabled
division_3 = Division(A=list_length_3, B=number_slider_71)  # disabled

geometry_21 = Geometry(cluster_16.valley_2)  # disabled
sphere_13 = Sphere(Base=geometry_21, Radius=1)  # disabled

geometry_22 = Geometry(cluster_16.peak_2)  # disabled
sphere_14 = Sphere(Base=geometry_22, Radius=1)  # disabled

sort_list_5 = SortList(Keys=length_14, ValuesValuesA=line_6, ValuesA=tree_branch_7)  # -> Keys, ValuesValuesA, ValuesA; disabled

end_points_2 = EndPoints(Curve=cull_pattern_4)  # -> Start, End
cull_duplicates_13 = CullDuplicates(Points=simplify(end_points_2.Start), Tolerance=0.1, CullMode=2)  # -> Points, Indices, Valence
cull_index_4 = CullIndex(List=cull_pattern_4, Indices=cull_duplicates_13.Indices, Wrap=True)

end_points_3 = EndPoints(Curve=cull_pattern_5)  # -> Start, End
cull_duplicates_14 = CullDuplicates(Points=simplify(end_points_3.Start), Tolerance=0.1, CullMode=2)  # -> Points, Indices, Valence
cull_index_5 = CullIndex(List=cull_pattern_5, Indices=cull_duplicates_14.Indices, Wrap=True)

mesh_18 = Mesh(strips_4)  # disabled
# POLE A
mesh_edges_27 = MeshEdges(Mesh=mesh_18)  # -> NakedEdges, InteriorEdges, NonManifoldEdges; disabled
nakedvertices_2 = NakedVertices(Mesh=mesh_18)  # -> ClothedIndex, NakedIndex, ClothedPts, NakedPts; disabled
geometry_23 = Geometry(simplify(nakedvertices_2.NakedPts))  # disabled
point_on_curve_4 = PointOnCurve(cull_index_4, parameter=1)
c_script_4 = CSharpScript(iPeakEdges=simplify(cull_index_5), iValleyEdgePts=simplify(point_on_curve_4))  # -> out, A; inputs iPeakEdges: tree of Curve, iValleyEdgePts: tree of Point3d
# ---------- c_script_4: C# ----------
    List<List<int>> allIndexes = new List<List<int>>();
    
    double param;
    double dist = 10000;
    int index = -1;




    for(int i = 0; i < iPeakEdges.BranchCount; i++){
      List<int> indexes = new List<int>();


      for(int j = 0; j < iPeakEdges.Branch(i).Count; j++){

        //index = -1;


        for(int k = 0; k < iValleyEdgePts.Branch(i).Count; k++){
          iPeakEdges.Branch(i)[j].Domain = new Interval(0, 1.0);

          iPeakEdges.Branch(i)[j].ClosestPoint(iValleyEdgePts.Branch(i)[k], out param);
          Point3d closestPt = iPeakEdges.Branch(i)[j].PointAt(param);

          double tempDist = iValleyEdgePts.Branch(i)[k].DistanceTo(closestPt);

          if(tempDist < dist){
            dist = tempDist;
            index = k;
          }

        }
        indexes.Add(index);

        dist = 100000;
        param = 0;
      }
      allIndexes.Add(indexes);
    }





    A = ListOfListsToTree(allIndexes);
# ---------- c_script_4: C# additional code ----------
  


  static Grasshopper.DataTree<T> ListOfListsToTree<T > (List < List < T >> s){
  Grasshopper.DataTree<T> tree = new DataTree<T>();
  for(int i = 0;i < s.Count; i++){
  tree.AddRange(s[i], new GH_Path(i));
}
        return tree;
      }
# ---------- end c_script_4 ----------
list_item = ListItem(List=cull_index_4, Index=c_script_4.A, Wrap=True)
merge = Merge(Data1=simplify(graft(cull_index_5)), Data2=simplify(graft(list_item)))

loft = Loft(Curves=merge, Options={Adjust=False, Closed=False, LoftEnds=0, LoftSimp=0, LoftType=0, Rebuild=10, Refit=0.01})
deconstruct_brep = DeconstructBrep(Brep=loft)  # -> Faces, Edges, Vertices
mesh_surface = MeshSurface(
    Surface=simplify(deconstruct_brep.Faces),
    UCount=Slider(6, range=0..10),
    VCount=Slider(1, range=0..1),
    Overhang=True,
    Equalize=False)
mesh_edges_28 = MeshEdges(Mesh=mesh_surface)  # -> NakedEdges, InteriorEdges, NonManifoldEdges

mesh_join_5 = MeshJoin(Meshes=mesh_surface)
shift_paths_18 = ShiftPaths(Data=mesh_join_5, Offset=-1)
mesh_area_4 = MeshArea(Mesh=shift_paths_18)  # -> Area, Centroid

polyline = PolyLine(Vertices=mesh_area_4.Centroid, Closed=True)
explode_10 = Explode(Curve=polyline, Recursive=True)  # -> Segments, Vertices
point_on_curve_5 = PointOnCurve(explode_10.Segments, parameter=0.5)

# ----
# TABS FOR Y CONNECTORS
geometry_24 = Geometry(merge)
# TABS FOR STRAIGHT ELEMENTS
mesh_19 = Mesh(mesh_11)
explode_11 = Explode(Curve=geometry_24, Recursive=True)  # -> simplify(Segments), Vertices
deconstruct_mesh_7 = DeconstructMesh(Mesh=graft(mesh_19))  # -> Vertices, Faces, Colours, Normals
mesh_20 = Mesh(shift_paths_13)
mesh_21 = Mesh(strips)
mesh_strips_center_point = MeshStripsCenterPoint(mesh=mesh_20)
deconstruct_mesh_8 = DeconstructMesh(Mesh=simplify(graft(mesh_21)))  # -> Vertices, Faces, Colours, Normals

c_script_5 = CSharpScript(iMeshCenter=simplify(mesh_strips_center_point), iDivider=simplify(point_on_curve_5))  # -> out, AllLines, AllLengths; inputs iMeshCenter: tree of Point3d, iDivider: tree of Point3d
# ---------- c_script_5: C# ----------
    
    List<List<List<Line>>> allLines = new List<List<List<Line>>>();
    List<List<List<double>>> allLengths = new List<List<List<double>>>();



    for(int i = 0; i < iDivider.BranchCount; i++){
      List<List<Line>> linesBranch = new List<List<Line>>();
      List<List<double>> lengthsBranch = new List<List<double>>();


      for(int j = 0; j < iDivider.Branch(i).Count; j++){
        List<Line> lines = new List<Line>();
        List<double> lengths = new List<double>();


        for(int k = 0; k < iMeshCenter.Branch(i).Count; k++){
          Line line = new Line(iDivider.Branch(i)[j], iMeshCenter.Branch(i)[k]);
          double length = line.Length;

          lines.Add(line);
          lengths.Add(length);
        }

        linesBranch.Add(lines);
        lengthsBranch.Add(lengths);
      }


      allLines.Add(linesBranch);
      allLengths.Add(lengthsBranch);
    }


    AllLines = allLines;
    AllLines = allLengths;


    AllLines = ListOfListsOfListsToTree(allLines);
    AllLengths = ListOfListsOfListsToTree(allLengths);
# ---------- c_script_5: C# additional code ----------
  //List<List<Line>> allLines = new List<List<Line>>();
  //List<List<double>> allLengths = new List<List<double>>();





  /*static Grasshopper.DataTree<T> ListOfListsToTree<T > (List < List < T >> s){
  Grasshopper.DataTree<T> tree = new DataTree<T>();
  for(int i = 0;i < s.Count; i++){
  tree.AddRange(s[i], new GH_Path(i));
}
        return tree;
      }*/

  DataTree<T> ListOfListsOfListsToTree<T>(List<List<List<T>>> list){
  DataTree<T> tree = new DataTree<T>();
  int i = 0;
  int j = 0;

  foreach(List<List<T>> innerList in list){
  foreach(List<T> innestList in innerList){
tree.AddRange(innestList, new GH_Path(new int[]{i,j}));
        j++;
        }
      i++;
      }
     return tree;
   }
# ---------- end c_script_5 ----------
param_viewer = ParamViewer(c_script_5.AllLines)

number_slider_72 = Slider(6, range=0..10)
tree_statistics_4 = TreeStatistics(Tree=deconstruct_mesh_7.Normals)  # -> Paths, Length, Count
duplicate_data_4 = DuplicateData(Data=graft(tree_statistics_4.Paths), Number=number_slider_72, Order=False)  # -> simplify(graft(Data))
tree_branch_8 = TreeBranch(Tree=deconstruct_mesh_7.Normals, Path=duplicate_data_4, MaintainPaths=False)
shiftmatch = ShiftMatch(Data=tree_branch_8, Guide=explode_11.Vertices)

warpweft_4 = WarpWeft(Mesh=simplify(mesh_21))  # -> Warp, Weft, NakedA, NakedB

tree_statistics_5 = TreeStatistics(Tree=deconstruct_mesh_7.Vertices)  # -> Paths, Length, Count
duplicate_data_5 = DuplicateData(Data=graft(tree_statistics_5.Paths), Number=number_slider_72, Order=False)  # -> simplify(graft(Data))
tree_branch_9 = TreeBranch(Tree=deconstruct_mesh_7.Vertices, Path=duplicate_data_5, MaintainPaths=False)
shiftmatch_2 = ShiftMatch(Data=tree_branch_9, Guide=explode_11.Vertices)

join_curves = JoinCurves(Curves=warpweft_4.Weft, Preserve=False)  # -> simplify(Curves)
mesh_join_6 = MeshJoin(Meshes=shift_paths_18)
tree_statistics_6 = TreeStatistics(Tree=c_script_5.AllLines)  # -> Paths, Length, Count
collision_one_many_6 = CollisionOneMany(Collider=c_script_5.AllLines, Obstacles=flatten(mesh_join_6))  # -> Collision, Index
series_4 = Series(Start=0, Step=1, Count=tree_statistics_6.Length)  # -> simplify(Series)
curve_4 = Curve([<curve referenced from the Rhino model> x6])  # disabled

tree_statistics_7 = TreeStatistics(Tree=mesh_20)  # -> Paths, Length, Count
duplicate_data_6 = DuplicateData(Data=graft(tree_statistics_7.Paths), Number=Slider(3, range=0..10), Order=False)  # -> simplify(graft(Data))
tree_branch_10 = TreeBranch(Tree=mesh_20, Path=duplicate_data_6, MaintainPaths=False)
shiftmatch_3 = ShiftMatch(Data=tree_branch_10, Guide=duplicate_data_6)

closest_point_7 = ClosestPoint(Point=simplify(explode_11.Vertices), Cloud=simplify(shiftmatch_2))  # -> ClosestPoint, CPIndex, Distance
dispatch_4 = Dispatch(List=c_script_5.AllLines, DispatchPattern=collision_one_many_6.Collision)  # -> ListA, ListB
dispatch_5 = Dispatch(List=series_4, DispatchPattern=collision_one_many_6.Collision)  # -> ListA, ListB

number_slider_73 = Slider(2.5, range=0..100)
list_item_2 = ListItem(List=shiftmatch, Index=closest_point_7.CPIndex, Wrap=True)
amplitude_3 = Amplitude(Vector=list_item_2, Amplitude=number_slider_73)
move_3 = Move(Geometry=closest_point_7.ClosestPoint, Motion=amplitude_3)  # -> Geometry, Transform

geometry_25 = Geometry(dispatch_4.ListB)
list_item_3 = ListItem(List=shiftmatch_3, Index=dispatch_5.ListB, Wrap=True)
mesh_join_7 = MeshJoin(Meshes=list_item_3)
shift_paths_19 = ShiftPaths(Data=mesh_join_7, Offset=-1)

tree_statistics_8 = TreeStatistics(Tree=shift_paths_19)  # -> Paths, Length, Count
series_5 = Series(Start=0, Step=1, Count=tree_statistics_8.Length)
bounds = Bounds(Numbers=series_5)
remap_numbers = RemapNumbers(Value=series_5, Source=bounds, Target=Domain(0, 1))  # -> Mapped, Clipped
gradient = Gradient(
    LowerLimit=0,
    UpperLimit=1,
    Parameter=remap_numbers.Mapped,
    stops=[0: RGB(234, 38, 0), 0.22: RGB(234, 126, 0), 0.5: RGB(254, 244, 84), 0.75: RGB(173, 203, 249), 1: RGB(75, 107, 169)])
mesh_edges_29 = MeshEdges(Mesh=shift_paths_19)  # -> NakedEdges, InteriorEdges, NonManifoldEdges
custom_preview_5 = CustomPreview(Geometry=shift_paths_19, Material=simplify(gradient))

# ----
# Y JUNCTION LINES
discontinuity_4 = Discontinuity(Curve=curve_4, Level=1)  # -> Points, Parameters; disabled
number_slider_74 = Slider(50, range=0..100)  # disabled
create_rtree_4 = CreateRTree(InputGeometry=flatten(discontinuity_4.Points))  # disabled
cull_duplicates_15 = CullDuplicates(Points=flatten(discontinuity_4.Points), Tolerance=0.1, CullMode=3)  # -> Points, Indices, Valence; disabled
rtree_points_in_range_4 = RTreePointsInRange(SearchPoints=cull_duplicates_15.Points, SearchDistance=number_slider_74, RTree=create_rtree_4)  # -> simplify(PointsWithinRange), IndicesWithinRange; disabled

interpolate = Interpolate(Vertices=move_3.Geometry, Degree=3, Periodic=False, KnotStyle=1)  # -> Curve, Length, Domain
shiftmatch_4 = ShiftMatch(Data=interpolate.Curve, Guide=geometry_24)

merge_2 = Merge(Data1=graft(geometry_24), Data2=graft(shiftmatch_4))
rebuild_curve_3 = RebuildCurve(Curve=merge_2, Degree=3, Count=Slider(10, range=0..100), Tangents=False)
loft_2 = Loft(Curves=rebuild_curve_3, Options={Adjust=False, Closed=False, LoftEnds=0, LoftSimp=0, LoftType=0, Rebuild=10, Refit=0.01})

collision_one_many_7 = CollisionOneMany(Collider=join_curves, Obstacles=flatten(loft_2))  # -> Collision, Index
cull_pattern_6 = CullPattern(List=join_curves, CullPattern=collision_one_many_7.Collision)
explode_12 = Explode(Curve=cull_pattern_6, Recursive=True)  # -> Segments, Vertices

number_slider_75 = Slider(2, range=0..10)
tree_statistics_9 = TreeStatistics(Tree=deconstruct_mesh_8.Vertices)  # -> Paths, Length, Count
duplicate_data_7 = DuplicateData(Data=graft(tree_statistics_9.Paths), Number=number_slider_75, Order=False)  # -> simplify(graft(Data))
tree_branch_11 = TreeBranch(Tree=deconstruct_mesh_8.Vertices, Path=duplicate_data_7, MaintainPaths=False)
shiftmatch_5 = ShiftMatch(Data=tree_branch_11, Guide=explode_12.Vertices)

tree_statistics_10 = TreeStatistics(Tree=deconstruct_mesh_8.Normals)  # -> Paths, Length, Count
duplicate_data_8 = DuplicateData(Data=graft(tree_statistics_10.Paths), Number=number_slider_75, Order=False)  # -> simplify(graft(Data))
tree_branch_12 = TreeBranch(Tree=deconstruct_mesh_8.Normals, Path=duplicate_data_8, MaintainPaths=False)
shiftmatch_6 = ShiftMatch(Data=tree_branch_12, Guide=explode_12.Vertices)

geometry_26 = Geometry(cull_pattern_6)
closest_point_8 = ClosestPoint(Point=simplify(explode_12.Vertices), Cloud=simplify(shiftmatch_5))  # -> ClosestPoint, CPIndex, Distance

list_item_4 = ListItem(List=shiftmatch_6, Index=closest_point_8.CPIndex, Wrap=True)
amplitude_4 = Amplitude(Vector=list_item_4, Amplitude=number_slider_73)
move_4 = Move(Geometry=closest_point_8.ClosestPoint, Motion=amplitude_4)  # -> Geometry, Transform
interpolate_2 = Interpolate(Vertices=move_4.Geometry, Degree=3, Periodic=False, KnotStyle=1)  # -> Curve, Length, Domain

merge_3 = Merge(Data1=simplify(graft(cull_pattern_6)), Data2=simplify(graft(interpolate_2.Curve)))
rebuild_curve_4 = RebuildCurve(Curve=merge_3, Degree=3, Count=Slider(10, range=0..100), Tangents=False)
loft_3 = Loft(Curves=rebuild_curve_4, Options={Adjust=False, Closed=False, LoftEnds=0, LoftSimp=0, LoftType=0, Rebuild=10, Refit=0.01})

number_slider_76 = Slider(0.05, range=0..0.1)  # disabled

custom_preview_6 = CustomPreview(Geometry=loft_3, Material=ColourSwatch(SwatchColor=RGB(84, 84, 84)))

custom_preview_7 = CustomPreview(Geometry=loft_2, Material=ColourSwatch(SwatchColor=RGB(84, 84, 84)))

c_script_6 = CSharpScript(x=rtree_points_in_range_4.PointsWithinRange)  # -> out, A; inputs x: tree of Point3d; disabled; same code as c_script_2
cull_duplicates_16 = CullDuplicates(Points=flatten(c_script_6.A), Tolerance=0.1, CullMode=3)  # -> Points, Indices, Valence; disabled

number_slider_77 = Slider(150, range=0..1000)  # disabled
number_slider_78 = Slider(0.06, range=0..0.1)  # disabled
sphere_15 = Sphere(Base=cull_duplicates_16.Points, Radius=number_slider_77)  # disabled

surface_curve_4 = SurfaceCurve(Surface=graft(sphere_15), Curve=curve_4)  # -> Curves, simplify(Points), UVPoints, Normals, Parameters, Tangents; disabled
shift_paths_20 = ShiftPaths(Data=surface_curve_4.Points, Offset=-1)  # disabled

# ----
# SINGLE LIEANR ELEMENT
point_4 = Point(flatten(surface_curve_4.Points))  # disabled

curve_closest_point_6 = CurveClosestPoint(Point=point_4, Curve=reparameterize(graft(curve_4)))  # -> Point, Parameter, Distance; disabled
panel_14 = Panel("x < 0.1")  # disabled
evaluate_4 = Evaluate(Expression=panel_14, x=curve_closest_point_6.Distance)  # disabled
cull_pattern_7 = CullPattern(List=curve_closest_point_6.Parameter, CullPattern=evaluate_4)  # -> simplify(List); disabled

shatter_6 = Shatter(Curve=reparameterize(graft(curve_4)), Parameters=cull_pattern_7)  # -> simplify(Segments); disabled
line_7 = Line(StartPoint=graft(cull_duplicates_16.Points), EndPoint=shift_paths_20)  # disabled

point_on_curve_6 = PointOnCurve(line_7, parameter=0.5)  # disabled
sphere_16 = Sphere(Base=point_on_curve_6, Radius=1)  # disabled

collision_one_many_8 = CollisionOneMany(Collider=shatter_6, Obstacles=flatten(sphere_16))  # -> Collision, Index; disabled
dispatch_6 = Dispatch(List=shatter_6, DispatchPattern=collision_one_many_8.Collision)  # -> ListA, ListB; disabled
geometry_27 = Geometry(dispatch_6.ListB)  # disabled

number_slider_79 = Slider(0.03, range=0..0.1)  # disabled
number_slider_80 = Slider(40, range=0..1000)  # disabled
number_slider_81 = Slider(0, range=0..3)  # disabled
fatten_10 = Fatten(Skeleton=geometry_27, Thickness=number_slider_80, LengthSubdivisions=0, EndType=number_slider_81, AdjustForAngle=False)  # disabled
disjoint_mesh_10 = DisjointMesh(Mesh=fatten_10)  # -> graft(Meshes); disabled

weaverbird_s_catmull_clark_subdivision_13 = WeaverbirdsCatmullClarkSubdivision(MeshCurves=disjoint_mesh_10, Level=1, SmoothNakedEdges=1)  # disabled

# ----
# FATTENER
number_slider_82 = Slider(0.03, range=0..0.1)  # disabled
number_slider_83 = Slider(40, range=0..1000)  # disabled
number_slider_84 = Slider(0, range=0..3)  # disabled
fatten_11 = Fatten(
    Skeleton=flatten(line_7),
    Thickness=number_slider_83,
    LengthSubdivisions=0,
    EndType=number_slider_84,
    AdjustForAngle=False)  # disabled
disjoint_mesh_11 = DisjointMesh(Mesh=fatten_11)  # -> graft(Meshes); disabled

weaverbird_s_naked_boundary_13 = WeaverbirdsNakedBoundary(MeshClosedPolylines=disjoint_mesh_11)  # disabled
join_10 = JoinCurves(Curves=weaverbird_s_naked_boundary_13, Preserve=False)  # disabled
explode_13 = Explode(Curve=join_10, Recursive=True)  # -> Segments, Vertices; disabled
cull_duplicates_17 = CullDuplicates(Points=explode_13.Vertices, Tolerance=0.1, CullMode=3)  # -> simplify(Points), Indices, Valence; disabled
shift_paths_21 = ShiftPaths(Data=cull_duplicates_17.Points, Offset=-1)  # -> flatten(Data); disabled

face_normals_10 = FaceNormals(Mesh=disjoint_mesh_11)  # -> Centers, Normals; disabled
mesh_edges_30 = MeshEdges(Mesh=disjoint_mesh_11)  # -> NakedEdges, InteriorEdges, NonManifoldEdges; disabled
vector_display_11 = VectorDisplay(Anchor=face_normals_10.Centers, Vector=face_normals_10.Normals)  # disabled

weaverbird_s_naked_boundary_14 = WeaverbirdsNakedBoundary(MeshClosedPolylines=disjoint_mesh_10)  # disabled
join_11 = JoinCurves(Curves=weaverbird_s_naked_boundary_14, Preserve=False)  # disabled
explode_14 = Explode(Curve=join_11, Recursive=True)  # -> Segments, Vertices; disabled
cull_duplicates_18 = CullDuplicates(Points=explode_14.Vertices, Tolerance=0.1, CullMode=3)  # -> simplify(Points), Indices, Valence; disabled

number_slider_85 = Slider(2, range=0..10)  # disabled
number_slider_86 = Slider(2, range=0..10)  # disabled
weaverbird_s_catmull_clark_subdivision_14 = WeaverbirdsCatmullClarkSubdivision(MeshCurves=disjoint_mesh_11, Level=number_slider_85, SmoothNakedEdges=number_slider_86)  # disabled

# ----
# PREPARE WEFT AND WARP
panel_15 = Panel("1")  # disabled
refine_4 = Refine(Mesh=disjoint_mesh_11, Level=panel_15)  # disabled
clean_4 = CombineClean(Meshes=refine_4)  # disabled
md_4 = MeshDirection(Mesh=clean_4)  # disabled
turn_4 = MeshTurn(Mesh=md_4)  # disabled

closest_point_9 = ClosestPoint(Point=cull_duplicates_18.Points, Cloud=shift_paths_21)  # -> ClosestPoint, CPIndex, Distance; disabled
deconstruct_mesh_9 = DeconstructMesh(Mesh=disjoint_mesh_10)  # -> Vertices, Faces, Colours, Normals; disabled
shift_paths_22 = ShiftPaths(Data=cull_duplicates_18.Points, Offset=-1)  # disabled
shift_paths_23 = ShiftPaths(Data=closest_point_9.ClosestPoint, Offset=-1)  # disabled
closest_point_10 = ClosestPoint(Point=simplify(shift_paths_22), Cloud=simplify(deconstruct_mesh_9.Vertices))  # -> ClosestPoint, CPIndex, Distance; disabled
replace_items_4 = ReplaceItems(List=deconstruct_mesh_9.Vertices, Item=shift_paths_23, Indices=closest_point_10.CPIndex, Wrap=False)  # disabled
construct_mesh_4 = ConstructMesh(Vertices=replace_items_4, Faces=deconstruct_mesh_9.Faces, Colours=deconstruct_mesh_9.Colours)  # disabled

number_slider_87 = Slider(2, range=0..10)  # disabled
weaverbird_s_catmull_clark_subdivision_15 = WeaverbirdsCatmullClarkSubdivision(MeshCurves=construct_mesh_4, Level=number_slider_85, SmoothNakedEdges=number_slider_87)  # disabled

boolean_toggle_12 = BooleanToggle(True)  # disabled
flip_mesh_10 = FlipMesh(Mesh=md_4, VertexNormals=boolean_toggle_12, FaceNormals=boolean_toggle_12, FaceOrientation=boolean_toggle_12)  # disabled
mesh_22 = Mesh(flip_mesh_10)  # disabled

boolean_toggle_13 = BooleanToggle(True)  # disabled
flip_mesh_11 = FlipMesh(
    Mesh=weaverbird_s_catmull_clark_subdivision_15,
    VertexNormals=boolean_toggle_13,
    FaceNormals=boolean_toggle_13,
    FaceOrientation=boolean_toggle_13)  # disabled

boolean_toggle_14 = BooleanToggle(True)  # disabled
flip_mesh_12 = FlipMesh(
    Mesh=weaverbird_s_catmull_clark_subdivision_14,
    VertexNormals=boolean_toggle_14,
    FaceNormals=boolean_toggle_14,
    FaceOrientation=boolean_toggle_14)  # disabled

panel_16 = Panel("2")  # disabled
strips_10 = RefineStrips(Mesh=flip_mesh_11, Level=panel_16)  # disabled

face_normals_11 = FaceNormals(Mesh=weaverbird_s_catmull_clark_subdivision_13)  # -> Centers, Normals; disabled
mesh_edges_31 = MeshEdges(Mesh=strips_10)  # -> NakedEdges, InteriorEdges, NonManifoldEdges; disabled
vector_display_12 = VectorDisplay(Anchor=face_normals_11.Centers, Vector=face_normals_11.Normals)  # disabled

panel_17 = Panel("2")  # disabled
strips_11 = RefineStrips(Mesh=flip_mesh_12, Level=panel_17)  # disabled

mesh_edges_32 = MeshEdges(Mesh=strips_11)  # -> NakedEdges, InteriorEdges, NonManifoldEdges; disabled
face_normals_12 = FaceNormals(Mesh=strips_11)  # -> Centers, Normals; disabled
vector_display_13 = VectorDisplay(Anchor=face_normals_12.Centers, Vector=face_normals_12.Normals)  # disabled

panel_18 = Panel("2")  # disabled
strips_12 = RefineStrips(Mesh=mesh_22, Level=panel_18)  # disabled

# ----
# DIVIDE INTO STRIPS
dam_7 = DataDam(DataA=graft(strips_11), BufferDelay=10000000, BufferMode=1)  # -> flatten(DataA); disabled
number_slider_88 = Slider(0, range=0..1)  # disabled
stripper_4 = Stripper(Mesh=dam_7)  # disabled
unroller_4 = Unroller(Strip=stripper_4, Unroll=number_slider_88)  # -> graft(Unrolled); disabled
mesh_edges_33 = MeshEdges(Mesh=unroller_4)  # -> NakedEdges, InteriorEdges, NonManifoldEdges; disabled
dam_8 = DataDam(DataA=unroller_4, BufferDelay=10000000, BufferMode=1)  # disabled

number_slider_89 = Slider(1, range=0..1)  # disabled
unroller_5 = Unroller(Strip=stripper_4, Unroll=number_slider_89)  # -> graft(Unrolled); disabled
mesh_23 = Mesh(simplify(dam_8))  # disabled

number_slider_90 = Slider(95, range=0..100)  # disabled
radians_3 = Radians(Degrees=number_slider_90)  # disabled
meshcorners_3 = MeshCorners(Mesh=mesh_23, Angle=radians_3)  # -> simplify(Corners); disabled

weaverbird_s_naked_boundary_15 = WeaverbirdsNakedBoundary(MeshClosedPolylines=mesh_23)  # disabled
curve_closest_point_7 = CurveClosestPoint(Point=meshcorners_3, Curve=weaverbird_s_naked_boundary_15)  # -> Point, Parameter, Distance; disabled
shatter_7 = Shatter(Curve=weaverbird_s_naked_boundary_15, Parameters=curve_closest_point_7.Parameter)  # disabled
length_15 = Length(Curve=shatter_7)  # disabled
sort_list_6 = SortList(Keys=length_15, ValuesValuesA=shatter_7)  # -> Keys, ValuesValuesA; disabled
panel_19 = Panel("""0
1""")  # disabled
number_slider_91 = Slider(15, range=0..100)  # disabled
cull_index_6 = CullIndex(List=sort_list_6.ValuesValuesA, Indices=panel_19, Wrap=True)  # disabled
panel_20 = Panel("""2
3""")  # disabled
rebuild_curve_5 = RebuildCurve(Curve=cull_index_6, Count=number_slider_91, Degree=3, EndTangents=False)  # disabled

# ----
# Splitting top & bottom face
shift_paths_24 = ShiftPaths(Data=mesh_23, Offset=-1)  # disabled

md_slider = MDSlider(SliderMode=0, slider_value=Point(0.5, 0.5, 0.5), x_domain=Domain(0, 1), y_domain=Domain(0, 1), z_domain=Domain(0, 1))  # disabled
evaluate_surface = EvaluateSurface(Point=md_slider)  # -> Point, Normal, UDirection, VDirection, Frame; disabled
shift_paths_25 = ShiftPaths(Data=evaluate_surface.Point, Offset=-1)  # disabled
mesh_closest_point_6 = MeshClosestPoint(Point=shift_paths_25, Mesh=shift_paths_24)  # -> Point, Index, Parameter; disabled

tree_statistics_11 = TreeStatistics(Tree=mesh_closest_point_6.Point)  # -> Paths, Length, Count; disabled
series_6 = Series(Start=0, Step=1, Count=tree_statistics_11.Count)  # disabled
duplicate_data_9 = DuplicateData(Data=graft(series_6), Number=2, Order=True)  # -> simplify(Data); disabled

mesh_join_8 = MeshJoin(Meshes=shift_paths_24)  # disabled
mesh_edges_34 = MeshEdges(Mesh=shift_paths_24)  # -> NakedEdges, InteriorEdges, NonManifoldEdges; disabled

tree_branch_13 = TreeBranch(Tree=mesh_closest_point_6.Point, Path=graft(duplicate_data_9), MaintainPaths=False)  # disabled

cluster_17 = Cluster(M=mesh_join_8)  # disabled
line_8 = Line(StartPoint=graft(cluster_17), EndPoint=tree_branch_13)  # -> simplify(Line); disabled
cluster_18 = Cluster_2(
    point=cluster_17,
    geometry=simplify([mesh_edges_34.NakedEdges, mesh_edges_34.InteriorEdges, mesh_edges_34.NonManifoldEdges]))  # -> valley_2, peak_2; disabled
tree_branch_14 = TreeBranch(Tree=shift_paths_24, Path=graft(duplicate_data_9), MaintainPaths=False)  # disabled
length_16 = Length(Curve=line_8)  # disabled

number_slider_92 = Slider(2, range=0..10)  # disabled
list_length_4 = ListLength(List=length_16)  # disabled
division_4 = Division(A=list_length_4, B=number_slider_92)  # disabled

geometry_28 = Geometry(cluster_18.valley_2)  # disabled
sphere_17 = Sphere(Base=geometry_28, Radius=1)  # disabled

geometry_29 = Geometry(cluster_18.peak_2)  # disabled
sphere_18 = Sphere(Base=geometry_29, Radius=1)  # disabled

sort_list_7 = SortList(Keys=length_16, ValuesValuesA=line_8, ValuesA=tree_branch_14)  # -> Keys, ValuesValuesA, ValuesA; disabled

number_slider_93 = Slider(0.03, range=0..0.1)  # disabled
number_slider_94 = Slider(3, range=0..3)  # disabled
number_slider_95 = Slider(40, range=30..100)  # disabled
fatten_12 = Fatten(
    Skeleton=flatten(line_7),
    Thickness=number_slider_95,
    LengthSubdivisions=0,
    EndType=number_slider_94,
    AdjustForAngle=False)  # disabled
disjoint_mesh_12 = DisjointMesh(Mesh=fatten_12)  # -> graft(Meshes); disabled

end_points_4 = EndPoints(Curve=line_7)  # -> Start, End; disabled
vector_2pt_2 = Vector2Pt(PointA=end_points_4.End, PointB=end_points_4.Start, Unitize=True)  # -> Vector, Length; disabled
# KANGAROO FORM RELAXATION
average_2 = Average(Input=vector_2pt_2.Vector)  # disabled
vector_display_14 = VectorDisplay(Anchor=end_points_4.Start, Vector=average_2)  # disabled

number_slider_96 = Slider(10, range=0..1000)  # disabled
amplitude_5 = Amplitude(Vector=average_2, Amplitude=number_slider_96)  # disabled

mesh_24 = Mesh()  # disabled

move_5 = Move(Geometry=mesh_24, Motion=amplitude_5)  # -> simplify(Geometry), Transform; disabled

number_slider_97 = Slider(2, range=0..10)  # disabled
number_slider_98 = Slider(2, range=0..10)  # disabled
weaverbird_s_catmull_clark_subdivision_16 = WeaverbirdsCatmullClarkSubdivision(MeshCurves=disjoint_mesh_12, Level=number_slider_97, SmoothNakedEdges=number_slider_98)  # disabled

mesh_25 = Mesh(move_5.Geometry)  # disabled
mesh_edges_35 = MeshEdges(Mesh=mesh_25)  # -> NakedEdges, InteriorEdges, NonManifoldEdges; disabled
cluster_19 = Cluster(M=mesh_25)  # disabled
cluster_20 = Cluster_2(point=cluster_19, geometry=[mesh_edges_35.NakedEdges, mesh_edges_35.InteriorEdges, mesh_edges_35.NonManifoldEdges])  # -> valley_2, peak_2; disabled
geometry_30 = Geometry(cluster_20.peak_2)  # disabled

number_slider_99 = Slider(10, range=0..1000)  # disabled
amplitude_6 = Amplitude(Vector=average_2, Amplitude=number_slider_99)  # disabled

# ----
# FIND PEAK AND VALLEY
# OF Y CONNECTOR
mesh_edges_36 = MeshEdges(Mesh=mesh_24)  # -> NakedEdges, InteriorEdges, NonManifoldEdges; disabled
cluster_21 = Cluster(M=mesh_24)  # disabled
cluster_22 = Cluster_2(point=cluster_21, geometry=[mesh_edges_36.NakedEdges, mesh_edges_36.InteriorEdges, mesh_edges_36.NonManifoldEdges])  # -> valley_2, peak_2; disabled
geometry_31 = Geometry(cluster_22.peak_2)  # disabled

move_6 = Move(Geometry=weaverbird_s_catmull_clark_subdivision_16, Motion=amplitude_6)  # -> simplify(Geometry), Transform; disabled
number_slider_100 = Slider(0.931, range=0..1)  # disabled
number_slider_101 = Slider(0.931, range=0..1)  # disabled
number_slider_102 = Slider(1, range=0.1..20)  # disabled
number_slider_103 = Slider(28, range=0..1000)  # disabled
number_slider_104 = Slider(28, range=0..1000)  # disabled
number_slider_105 = Slider(1000, range=0..1000)  # disabled
number_slider_106 = Slider(0.1, range=0..0.1)  # disabled
number_slider_107 = Slider(201000, range=0..201000)  # disabled
number_slider_108 = Slider(11000, range=0..11000)  # disabled
number_slider_109 = Slider(97, range=0..1000)  # disabled
number_slider_110 = Slider(384, range=0..1000)  # disabled

colour_swatch_4 = ColourSwatch(SwatchColor=RGBA(255, 255, 255, 95))  # disabled
custom_preview_8 = CustomPreview(Geometry=move_6.Geometry, Material=colour_swatch_4)  # disabled

anchor_7 = Anchor(Point=geometry_31, Target=geometry_30, Strength=number_slider_108)  # disabled
boolean_toggle_15 = BooleanToggle(False)  # disabled
button_3 = Button()  # disabled

# ----
# ALL LINES
curve_5 = Curve(curve)
number_slider_111 = Slider(0.03, range=0..0.1)

number_slider_112 = Slider(0.1, range=0..0.1)
divide_length = DivideLength(Curve=curve_5, Length=Slider(100, range=0..100))  # -> Points, Tangents, Parameters
end_points_5 = EndPoints(Curve=curve_5)  # -> Start, End
merge_4 = Merge(Data1=graft(end_points_5.Start), Data2=divide_length.Points, Data3=graft(end_points_5.End))
sort_duplicate_points = SortDuplicatePoints(Points=merge_4)  # -> UniquePoints, Indices

sort_along_curve = SortAlongCurve(Points=sort_duplicate_points.UniquePoints, Curve=graft(curve_5))  # -> Points, Indices
polyline_2 = PolyLine(Vertices=sort_along_curve.Points, Closed=False)
fatten_13 = Fatten(
    Skeleton=flatten(polyline_2),
    Thickness=Slider(30, range=0..1000),
    LengthSubdivisions=0,
    EndType=Slider(0, range=0..100),
    AdjustForAngle=False)
weaverbird_s_catmull_clark_subdivision_17 = WeaverbirdsCatmullClarkSubdivision(MeshCurves=fatten_13, Level=1, SmoothNakedEdges=1)
weaverbird_s_loop_subdivision = WeaverbirdsLoopSubdivision(MeshCurves=fatten_13, Level=1, SmoothNakedEdges=1)
mesh_edges_37 = MeshEdges(Mesh=fatten_13)  # -> NakedEdges, InteriorEdges, NonManifoldEdges

# ----
# ALL LINES
curve_6 = Curve(curve_2)  # disabled
number_slider_113 = Slider(100, range=0..100)  # disabled
number_slider_114 = Slider(30, range=0..1000)  # disabled
number_slider_115 = Slider(0.03, range=0..0.1)  # disabled
number_slider_116 = Slider(0, range=0..100)  # disabled

number_slider_117 = Slider(0.1, range=0..0.1)  # disabled
divide_length_2 = DivideLength(Curve=curve_6, Length=number_slider_113)  # -> Points, Tangents, Parameters; disabled
end_points_6 = EndPoints(Curve=curve_6)  # -> Start, End; disabled
merge_5 = Merge(Data1=graft(end_points_6.Start), Data2=divide_length_2.Points, Data3=graft(end_points_6.End))  # disabled
sort_duplicate_points_2 = SortDuplicatePoints(Points=merge_5)  # -> UniquePoints, Indices; disabled

sort_along_curve_2 = SortAlongCurve(Points=sort_duplicate_points_2.UniquePoints, Curve=graft(curve_6))  # -> Points, Indices; disabled
polyline_3 = PolyLine(Vertices=sort_along_curve_2.Points, Closed=False)  # disabled
fatten_14 = Fatten(
    Skeleton=flatten(polyline_3),
    Thickness=number_slider_114,
    LengthSubdivisions=0,
    EndType=number_slider_116,
    AdjustForAngle=False)  # disabled
weaverbird_s_catmull_clark_subdivision_18 = WeaverbirdsCatmullClarkSubdivision(MeshCurves=fatten_14, Level=1, SmoothNakedEdges=1)  # disabled
weaverbird_s_loop_subdivision_2 = WeaverbirdsLoopSubdivision(MeshCurves=fatten_14, Level=1, SmoothNakedEdges=1)  # disabled
mesh_edges_38 = MeshEdges(Mesh=fatten_14)  # -> NakedEdges, InteriorEdges, NonManifoldEdges; disabled

# ----
# ALL LINES
curve_7 = Curve(curve_3)  # disabled
number_slider_118 = Slider(100, range=0..100)  # disabled
number_slider_119 = Slider(30, range=0..1000)  # disabled
number_slider_120 = Slider(0.03, range=0..0.1)  # disabled
number_slider_121 = Slider(0, range=0..100)  # disabled

number_slider_122 = Slider(0.1, range=0..0.1)  # disabled
divide_length_3 = DivideLength(Curve=curve_7, Length=number_slider_118)  # -> Points, Tangents, Parameters; disabled
end_points_7 = EndPoints(Curve=curve_7)  # -> Start, End; disabled
merge_6 = Merge(Data1=graft(end_points_7.Start), Data2=divide_length_3.Points, Data3=graft(end_points_7.End))  # disabled
sort_duplicate_points_3 = SortDuplicatePoints(Points=merge_6)  # -> UniquePoints, Indices; disabled

sort_along_curve_3 = SortAlongCurve(Points=sort_duplicate_points_3.UniquePoints, Curve=graft(curve_7))  # -> Points, Indices; disabled
polyline_4 = PolyLine(Vertices=sort_along_curve_3.Points, Closed=False)  # disabled
fatten_15 = Fatten(
    Skeleton=flatten(polyline_4),
    Thickness=number_slider_119,
    LengthSubdivisions=0,
    EndType=number_slider_121,
    AdjustForAngle=False)  # disabled
weaverbird_s_catmull_clark_subdivision_19 = WeaverbirdsCatmullClarkSubdivision(MeshCurves=fatten_15, Level=1, SmoothNakedEdges=1)  # disabled
weaverbird_s_loop_subdivision_3 = WeaverbirdsLoopSubdivision(MeshCurves=fatten_15, Level=1, SmoothNakedEdges=1)  # disabled
mesh_edges_39 = MeshEdges(Mesh=fatten_15)  # -> NakedEdges, InteriorEdges, NonManifoldEdges; disabled

split_list = SplitList(List=simplify(sort_list_3.ValuesA), Index=division)  # -> simplify(ListA), ListB; disabled
geometry_32 = Geometry(split_list.ListA)  # disabled

split_list_2 = SplitList(List=sort_list_3.ValuesValuesA, Index=division)  # -> simplify(ListA), ListB; disabled
geometry_33 = Geometry(split_list_2.ListA)  # disabled
# Peak face
collision_one_many_9 = CollisionOneMany(Collider=simplify(flatten(geometry_33)), Obstacles=graft(sphere_10))  # -> simplify(Collision), Index; disabled
dispatch_7 = Dispatch(List=flatten(geometry_32), DispatchPattern=simplify(collision_one_many_9.Collision))  # -> ListA, ListB; disabled
geometry_34 = Geometry(dispatch_7.ListA)  # disabled
mesh_join_9 = MeshJoin(Meshes=geometry_34)  # disabled
mesh_edges_40 = MeshEdges(Mesh=mesh_join_9)  # -> NakedEdges, InteriorEdges, NonManifoldEdges; disabled

# ----
# Valley face
collision_one_many_10 = CollisionOneMany(Collider=simplify(flatten(geometry_33)), Obstacles=graft(sphere_9))  # -> simplify(Collision), Index; disabled
dispatch_8 = Dispatch(List=flatten(geometry_32), DispatchPattern=simplify(collision_one_many_10.Collision))  # -> ListA, ListB; disabled
geometry_35 = Geometry(dispatch_8.ListA)  # disabled
mesh_join_10 = MeshJoin(Meshes=geometry_35)  # disabled
mesh_edges_41 = MeshEdges(Mesh=mesh_join_10)  # -> NakedEdges, InteriorEdges, NonManifoldEdges; disabled

merge_7 = Merge(Data1=mesh_join_10, Data2=mesh_join_9)  # disabled

colour_swatch_5 = ColourSwatch(SwatchColor=RGBA(0, 255, 255, 206))  # disabled
custom_preview_9 = CustomPreview(
    Geometry=[mesh_join_10, mesh_edges_41.NakedEdges, mesh_edges_41.InteriorEdges, mesh_edges_41.NonManifoldEdges],
    Material=colour_swatch_5)  # disabled

colour_swatch_6 = ColourSwatch(SwatchColor=RGBA(255, 0, 255, 94))  # disabled
custom_preview_10 = CustomPreview(
    Geometry=[mesh_join_9, mesh_edges_40.NakedEdges, mesh_edges_40.InteriorEdges, mesh_edges_40.NonManifoldEdges],
    Material=colour_swatch_6)  # disabled

split_list_3 = SplitList(List=simplify(sort_list_4.ValuesA), Index=division_2)  # -> simplify(ListA), ListB; disabled
geometry_36 = Geometry(split_list_3.ListA)  # disabled

split_list_4 = SplitList(List=sort_list_4.ValuesValuesA, Index=division_2)  # -> simplify(ListA), ListB; disabled
geometry_37 = Geometry(split_list_4.ListA)  # disabled
collision_one_many_11 = CollisionOneMany(Collider=simplify(flatten(geometry_37)), Obstacles=graft(sphere_12))  # -> simplify(Collision), Index; disabled
dispatch_9 = Dispatch(List=flatten(geometry_36), DispatchPattern=simplify(collision_one_many_11.Collision))  # -> ListA, ListB; disabled
geometry_38 = Geometry(dispatch_9.ListA)  # disabled
mesh_join_11 = MeshJoin(Meshes=geometry_38)  # disabled
mesh_edges_42 = MeshEdges(Mesh=mesh_join_11)  # -> NakedEdges, InteriorEdges, NonManifoldEdges; disabled

# ----
# Distance from Center(strips) to Center(connector)
# Distance from Center(strips) to Pole A
# Distance from Center(strips) to Pole B
collision_one_many_12 = CollisionOneMany(Collider=simplify(flatten(geometry_37)), Obstacles=graft(sphere_11))  # -> simplify(Collision), Index; disabled
# Valley face
# Peak face
dispatch_10 = Dispatch(List=flatten(geometry_36), DispatchPattern=simplify(collision_one_many_12.Collision))  # -> ListA, ListB; disabled
geometry_39 = Geometry(dispatch_10.ListA)  # disabled
mesh_join_12 = MeshJoin(Meshes=geometry_39)  # disabled
mesh_edges_43 = MeshEdges(Mesh=mesh_join_12)  # -> NakedEdges, InteriorEdges, NonManifoldEdges; disabled

meshcorners_4 = MeshCorners(Mesh=mesh_join_11, Angle=2.35619449)  # disabled
meshcorners_5 = MeshCorners(Mesh=mesh_join_12, Angle=2.35619449)  # disabled
merge_8 = Merge(Data1=meshcorners_5, Data2=meshcorners_4)  # disabled
cull_duplicates_19 = CullDuplicates(Points=merge_8, Tolerance=0.1, CullMode=3)  # -> Points, Indices, Valence; disabled
closest_point_11 = ClosestPoint(Point=cull_duplicates_19.Points)  # -> ClosestPoint, CPIndex, Distance; disabled
merge_9 = Merge(Data1=mesh_join_12, Data2=mesh_join_11)  # disabled

split_list_5 = SplitList(List=simplify(sort_list_5.ValuesA), Index=division_3)  # -> simplify(ListA), ListB; disabled
geometry_40 = Geometry(split_list_5.ListA)  # disabled

split_list_6 = SplitList(List=sort_list_5.ValuesValuesA, Index=division_3)  # -> simplify(ListA), ListB; disabled
geometry_41 = Geometry(split_list_6.ListA)  # disabled
collision_one_many_13 = CollisionOneMany(Collider=simplify(flatten(geometry_41)), Obstacles=graft(sphere_14))  # -> simplify(Collision), Index; disabled
dispatch_11 = Dispatch(List=flatten(geometry_40), DispatchPattern=simplify(collision_one_many_13.Collision))  # -> ListA, ListB; disabled
geometry_42 = Geometry(dispatch_11.ListA)  # disabled
mesh_join_13 = MeshJoin(Meshes=geometry_42)  # disabled
mesh_edges_44 = MeshEdges(Mesh=mesh_join_13)  # -> NakedEdges, InteriorEdges, NonManifoldEdges; disabled

collision_one_many_14 = CollisionOneMany(Collider=simplify(flatten(geometry_41)), Obstacles=graft(sphere_13))  # -> simplify(Collision), Index; disabled
dispatch_12 = Dispatch(List=flatten(geometry_40), DispatchPattern=simplify(collision_one_many_14.Collision))  # -> ListA, ListB; disabled
geometry_43 = Geometry(dispatch_12.ListA)  # disabled
mesh_join_14 = MeshJoin(Meshes=geometry_43)  # disabled
mesh_edges_45 = MeshEdges(Mesh=mesh_join_14)  # -> NakedEdges, InteriorEdges, NonManifoldEdges; disabled

merge_10 = Merge(Data1=mesh_join_14, Data2=mesh_join_13)  # disabled

# ----
# ALL LINES
curve_8 = Curve(curve_4)  # disabled
number_slider_123 = Slider(100, range=0..100)  # disabled
number_slider_124 = Slider(30, range=0..1000)  # disabled
number_slider_125 = Slider(0.03, range=0..0.1)  # disabled
number_slider_126 = Slider(0, range=0..100)  # disabled

number_slider_127 = Slider(0.1, range=0..0.1)  # disabled
divide_length_4 = DivideLength(Curve=curve_8, Length=number_slider_123)  # -> Points, Tangents, Parameters; disabled
end_points_8 = EndPoints(Curve=curve_8)  # -> Start, End; disabled
merge_11 = Merge(Data1=graft(end_points_8.Start), Data2=divide_length_4.Points, Data3=graft(end_points_8.End))  # disabled
sort_duplicate_points_4 = SortDuplicatePoints(Points=merge_11)  # -> UniquePoints, Indices; disabled

sort_along_curve_4 = SortAlongCurve(Points=sort_duplicate_points_4.UniquePoints, Curve=graft(curve_8))  # -> Points, Indices; disabled
polyline_5 = PolyLine(Vertices=sort_along_curve_4.Points, Closed=False)  # disabled
fatten_16 = Fatten(
    Skeleton=flatten(polyline_5),
    Thickness=number_slider_124,
    LengthSubdivisions=0,
    EndType=number_slider_126,
    AdjustForAngle=False)  # disabled
weaverbird_s_catmull_clark_subdivision_20 = WeaverbirdsCatmullClarkSubdivision(MeshCurves=fatten_16, Level=1, SmoothNakedEdges=1)  # disabled
weaverbird_s_loop_subdivision_4 = WeaverbirdsLoopSubdivision(MeshCurves=fatten_16, Level=1, SmoothNakedEdges=1)  # disabled
mesh_edges_46 = MeshEdges(Mesh=fatten_16)  # -> NakedEdges, InteriorEdges, NonManifoldEdges; disabled

split_list_7 = SplitList(List=simplify(sort_list_7.ValuesA), Index=division_4)  # -> simplify(ListA), ListB; disabled
geometry_44 = Geometry(split_list_7.ListA)  # disabled

split_list_8 = SplitList(List=sort_list_7.ValuesValuesA, Index=division_4)  # -> simplify(ListA), ListB; disabled
geometry_45 = Geometry(split_list_8.ListA)  # disabled
collision_one_many_15 = CollisionOneMany(Collider=simplify(flatten(geometry_45)), Obstacles=graft(sphere_18))  # -> simplify(Collision), Index; disabled
dispatch_13 = Dispatch(List=flatten(geometry_44), DispatchPattern=simplify(collision_one_many_15.Collision))  # -> ListA, ListB; disabled
geometry_46 = Geometry(dispatch_13.ListA)  # disabled
mesh_join_15 = MeshJoin(Meshes=geometry_46)  # disabled
mesh_edges_47 = MeshEdges(Mesh=mesh_join_15)  # -> NakedEdges, InteriorEdges, NonManifoldEdges; disabled

collision_one_many_16 = CollisionOneMany(Collider=simplify(flatten(geometry_45)), Obstacles=graft(sphere_17))  # -> simplify(Collision), Index; disabled
dispatch_14 = Dispatch(List=flatten(geometry_44), DispatchPattern=simplify(collision_one_many_16.Collision))  # -> ListA, ListB; disabled
geometry_47 = Geometry(dispatch_14.ListA)  # disabled
mesh_join_16 = MeshJoin(Meshes=geometry_47)  # disabled
mesh_edges_48 = MeshEdges(Mesh=mesh_join_16)  # -> NakedEdges, InteriorEdges, NonManifoldEdges; disabled

merge_12 = Merge(Data1=mesh_join_16, Data2=mesh_join_15)  # disabled
mesh_join_17 = MeshJoin(Meshes=geometry_47)  # disabled
combine_clean = CombineClean(Meshes=mesh_join_17)  # disabled
mesh_unifynormals = MeshUnifyNormals(Mesh=combine_clean)  # disabled
mesh_26 = Mesh(simplify(mesh_unifynormals))  # disabled
face_normals_13 = FaceNormals(Mesh=mesh_26)  # -> Centers, Normals; disabled
vector_display_15 = VectorDisplay(Anchor=face_normals_13.Centers, Vector=face_normals_13.Normals)  # disabled
mesh_edges_49 = MeshEdges(Mesh=mesh_26)  # -> NakedEdges, InteriorEdges, NonManifoldEdges; disabled
nakedvertices_3 = NakedVertices(Mesh=mesh_26)  # -> ClothedIndex, NakedIndex, ClothedPts, NakedPts; disabled
deconstruct_mesh_10 = DeconstructMesh(Mesh=mesh_26)  # -> simplify(Vertices), Faces, Colours, Normals; disabled
warpweft_5 = WarpWeft(Mesh=mesh_26)  # -> Warp, Weft, NakedA, NakedB; disabled
geometry_48 = Geometry(nakedvertices_3.NakedPts)  # disabled

join_12 = JoinCurves(Curves=mesh_edges_49.NakedEdges, Preserve=False)  # disabled
explode_15 = Explode(Curve=join_12, Recursive=True)  # -> Segments, Vertices; disabled
end_4 = EndPoints(Curve=explode_15.Segments)  # -> Start, End; disabled

geometry_49 = Geometry(warpweft_5.Weft)  # disabled
geometry_50 = Geometry([mesh_edges_49.NakedEdges, mesh_edges_49.InteriorEdges, mesh_edges_49.NonManifoldEdges])  # disabled
geometry_51 = Geometry(warpweft_5.Warp)  # disabled

number_slider_128 = Slider(0, range=0..1)  # disabled
length_17 = Length(Curve=geometry_51)  # disabled
multiplication_10 = Multiplication(A=length_17, B=number_slider_128)  # disabled

number_slider_129 = Slider(0.944, range=0..1)  # disabled
length_18 = Length(Curve=geometry_51)  # disabled
multiplication_11 = Multiplication(A=length_18, B=number_slider_129)  # disabled

length_19 = Length(Curve=geometry_49)  # disabled
length_20 = Length(Curve=geometry_50)  # disabled
multiplication_12 = Multiplication(A=length_19, B=number_slider_100)  # disabled
multiplication_13 = Multiplication(A=length_20, B=number_slider_101)  # disabled
length_line_4 = LengthLine(Line=geometry_49, Length=multiplication_12, Strength=number_slider_103)  # disabled
solidpointcollide_4 = SolidPointCollide(
    Points=deconstruct_mesh_10.Vertices,
    Solid=simplify(move_6.Geometry),
    Interior=False,
    Unidirectional=True,
    Strength=number_slider_105)  # disabled
pressure_4 = Pressure(M=mesh_26, Strength=number_slider_106)  # disabled
length_line_5 = LengthLine(Line=geometry_50, Strength=number_slider_104)  # disabled
clamplength_4 = ClampLength(Line=geometry_51, LowerLimit=multiplication_10, UpperLimit=multiplication_11, Strength=number_slider_102)  # disabled
anchor_8 = Anchor(Point=simplify(geometry_48), Strength=number_slider_107)  # disabled
equallength_4 = EqualLength(Line=simplify(explode_15.Segments), Strength=number_slider_109)  # disabled
planarize_4 = Planarize(M=mesh_26, Strength=number_slider_110)  # disabled
show_4 = Show(G=mesh_26)  # disabled
entwine_4 = Entwine(Branch00=show_4, Branch01=flatten([planarize_4, length_line_5, anchor_8]), FlattenInputs=True)  # disabled
solver_4 = Solver(GoalObjects=entwine_4, Reset=button_3, Threshold=1e-15, Tolerance=0.01, On=boolean_toggle_15)  # -> I, V, O; disabled
bang_4 = ExplodeTree(Data=solver_4.O)  # -> Branch0, Branch1; disabled
mesh_27 = Mesh(bang_4.Branch0)  # disabled
mesh_edges_50 = MeshEdges(Mesh=mesh_27)  # -> NakedEdges, InteriorEdges, NonManifoldEdges; disabled

# ==== cluster Cluster
M = ClusterInput()
stripper = Stripper(Mesh=M)
deconstruct_mesh = DeconstructMesh(Mesh=simplify(stripper))  # -> Vertices, Faces, Colours, Normals
shift_paths = ShiftPaths(Data=deconstruct_mesh.Vertices, Offset=-1)
sort_duplicate_points = SortDuplicatePoints(Points=shift_paths)  # -> UniquePoints, Indices
c_script = CSharpScript(iPoints=sort_duplicate_points.UniquePoints, iVertex=shift_paths)  # -> out, A; inputs iPoints: tree of Point3d, iVertex: tree of Point3d
# ---------- c_script: C# ----------
    List<List<Point3d>> allPoints = new List<List<Point3d>>();
    
    
    
    for(int i = 0; i < iPoints.BranchCount; i++){
      List<Point3d> extremePoints = new List<Point3d>();

      for(int j = 0; j < iPoints.Branch(i).Count; j++){
        Point3d point1 = iPoints.Branch(i)[j];
        List<Point3d> points = new List<Point3d>();
        int count = 0;


        for(int k = 0; k < iVertex.Branch(i).Count; k++){
          double dist = point1.DistanceTo(iVertex.Branch(i)[k]);

          if(dist < 0.0001){
            //points.Add(iVertex.Branch(i)[k]);
            count += 1;}

        }
        if(count > 2){
          extremePoints.Add(point1);
        }
      }
      allPoints.Add(extremePoints);
    }


    A = ListOfListsToTree(allPoints);
# ---------- c_script: C# additional code ----------
  

  static Grasshopper.DataTree<T> ListOfListsToTree<T > (List < List < T >> s){
  Grasshopper.DataTree<T> tree = new DataTree<T>();
  for(int i = 0;i < s.Count; i++){
  tree.AddRange(s[i], new GH_Path(i));
}
      return tree;
    }
# ---------- end c_script ----------
A = ClusterOutput(c_script.A)

# ==== cluster Cluster_2
point = ClusterInput()
geometry = ClusterInput()
point_2 = Point(point)
geometry_2 = Geometry(geometry)
shift_paths = ShiftPaths(Data=geometry_2, Offset=-1)

sphere = Sphere(Base=graft(point_2), Radius=Slider(1, range=0..1))

collision_one_many = CollisionOneMany(Collider=shift_paths, Obstacles=point_2)  # -> Collision, Index
cull_pattern = CullPattern(List=shift_paths, CullPattern=collision_one_many.Collision)  # -> simplify(List)

collision_one_many_2 = CollisionOneMany(Collider=flatten(cull_pattern), Obstacles=sphere)  # -> Collision, Index
cull_pattern_2 = CullPattern(List=flatten(cull_pattern), CullPattern=collision_one_many_2.Collision)

length = Length(Curve=cull_pattern_2)
mass_addition = MassAddition(Input=length)  # -> Result, PartialResults
shift_paths_2 = ShiftPaths(Data=mass_addition.Result, Offset=-1)
sort_list = SortList(Keys=shift_paths_2, ValuesValuesA=point_2)  # -> Keys, ValuesValuesA
list_item = ListItem(List=sort_list.ValuesValuesA, Index=0, Wrap=True)  # -> Item, Item1
valley = Data(list_item.Item)
peak = Data(list_item.Item1)
valley_2 = ClusterOutput(valley)
peak_2 = ClusterOutput(peak)

# ==== cluster MeshStripsCenterPoint
mesh = ClusterInput()
mesh_2 = Mesh(mesh)

radians = Radians(Degrees=Slider(130, range=0..130))
meshcorners = MeshCorners(Mesh=mesh_2, Angle=radians)  # -> simplify(Corners)

weaverbird_s_naked_boundary = WeaverbirdsNakedBoundary(MeshClosedPolylines=mesh_2)
curve_closest_point = CurveClosestPoint(Point=meshcorners, Curve=graft(weaverbird_s_naked_boundary))  # -> Point, Parameter, Distance
shatter = Shatter(Curve=graft(weaverbird_s_naked_boundary), Parameters=curve_closest_point.Parameter)
length = Length(Curve=shatter)
panel = Panel("""0
1""")
sort_list = SortList(Keys=length, ValuesValuesA=shatter)  # -> Keys, simplify(ValuesValuesA)
cull_index = CullIndex(List=sort_list.ValuesValuesA, Indices=panel, Wrap=True)
list_item = ListItem(List=sort_list.ValuesValuesA, Index=panel, Wrap=True)
join_curves = JoinCurves(Curves=cull_index, Preserve=False)
rebuild_curve = RebuildCurve(Curve=join_curves, Count=Slider(49, range=0..100), Degree=3, EndTangents=False)  # -> simplify(Rebuilt)

merge = Merge(Data1=list_item, Data2=rebuild_curve)
list_item_2 = ListItem(List=merge, Index=0, Wrap=True)  # -> Item, Item1, Item2, Item3
edge_surface = EdgeSurface(CurveA=list_item_2.Item, CurveB=list_item_2.Item1, CurveC=list_item_2.Item2, CurveD=list_item_2.Item3)

md_slider = MDSlider(SliderMode=0, slider_value=Point(0.5, 0.5, 0.5), x_domain=Domain(0, 1), y_domain=Domain(0, 1), z_domain=Domain(0, 1))
evaluate_surface = EvaluateSurface(Surface=reparameterize(edge_surface), Point=md_slider)  # -> Point, Normal, UDirection, VDirection, Frame
shift_paths = ShiftPaths(Data=evaluate_surface.Point, Offset=-1)
mesh_closest_point = MeshClosestPoint(Point=shift_paths, Mesh=mesh_2)  # -> Point, Index, Parameter

point = ClusterOutput(mesh_closest_point.Point)
