# Grasshopper definition 200629_Table_V4_3_Cutting Pattern_Edge Labels.gh (Grasshopper 1.0.7)
# plug-ins: EleFront, Weaverbird, Kangaroo2 Components

surface = Surface(<surface referenced from the Rhino model>)
mesh = Mesh(<mesh referenced from the Rhino model>)
deconstruct_brep = DeconstructBrep(Brep=surface)  # -> Faces, Edges, Vertices
weaverbird_s_naked_boundary = WeaverbirdsNakedBoundary(MeshClosedPolylines=mesh)
geometry = Geometry(<curve referenced from the Rhino model>)
radians = Radians(Degrees=Slider(22.51, range=0..105))
splitatcorners = SplitAtCorners(Poly=deconstruct_brep.Edges, Angle=radians)  # -> Corners, Parts
splitatcorners_2 = SplitAtCorners(Poly=geometry, Angle=radians)  # -> Corners, Parts
shift_list = ShiftList(List=splitatcorners_2.Parts, Shift=Slider(6, range=0..6), Wrap=True)
shift_list_2 = ShiftList(List=deconstruct_brep.Edges, Shift=Slider(3, range=0..4), Wrap=True)
list_length = ListLength(List=shift_list_2)
point_on_curve = PointOnCurve(shift_list, parameter=0.5)
list_length_2 = ListLength(List=shift_list)
number_slider = Slider(0, range=0..1)
point_on_curve_2 = PointOnCurve(shift_list_2, parameter=0.5)
panel = Panel(list_length_2)
panel_2 = Panel(list_length)
stream_filter = StreamFilter(Gate=number_slider, Stream0=list_length_2, Stream1=list_length)
stream_filter_2 = StreamFilter(Gate=number_slider, Stream0=point_on_curve, Stream1=point_on_curve_2)

series = Series(Start=0, Step=1, Count=stream_filter)
concatenate = Concatenate(FragmentA="P3.1_", FragmentB=series)

define_text_dot = DefineTextDot(Text=concatenate, Location=stream_filter_2, Font="Arial", Size=Slider(10, range=0..10))
