# Grasshopper definition 200629_Table_V4_3_Inflate.gh (Grasshopper 1.0.7)
# plug-ins: MeshEdit Components, Fattener, Kangaroo Components, PlanktonGh, LunchBox, Weaverbird, Kangaroo2 Components

# MAKING CHANNEL POCKETS STAGE1
curve = Curve([<curve referenced from the Rhino model> x15])
number_slider = Slider(60, range=0..100)

fatten = Fatten(
    Skeleton=curve,
    Thickness=number_slider,
    LengthSubdivisions=Slider(0, range=0..10),
    EndType=Slider(0, range=0..10),
    AdjustForAngle=False)

fatten_2 = Fatten(
    Skeleton=curve,
    Thickness=number_slider,
    LengthSubdivisions=Slider(1, range=0..10),
    EndType=Slider(2, range=0..3),
    AdjustForAngle=False)

mesh_edges = MeshEdges(Mesh=fatten)  # -> NakedEdges, InteriorEdges, NonManifoldEdges
weaverbird_s_loop_subdivision = WeaverbirdsLoopSubdivision(MeshCurves=fatten_2, Level=1, SmoothNakedEdges=1)
mesh_edges_2 = MeshEdges(Mesh=weaverbird_s_loop_subdivision)  # -> NakedEdges, InteriorEdges, NonManifoldEdges
geometry = Geometry([mesh_edges.NakedEdges, mesh_edges.InteriorEdges, mesh_edges.NonManifoldEdges])
mesh_volume = MeshVolume(Mesh=weaverbird_s_loop_subdivision)  # -> Volume, Centroid
absolute = Absolute(Value=mesh_volume.Volume)
number_slider_2 = Slider(41, range=0..100)  # disabled
number_slider_3 = Slider(15, range=0..100)  # disabled
number_slider_4 = Slider(30, range=0..100)  # disabled
# MESHING CHANNEL POCKETS
brep = Brep(<brep referenced from the Rhino model>)  # disabled
settings_custom = SettingsCustom(
    StitchSeams=True,
    SimplePlanes=False,
    Refine=True,
    MinCount=16,
    MaxCount=400,
    AspectRatio=20,
    MaxDistance=0,
    MaxAngle=number_slider_2,
    MinEdge=number_slider_3,
    MaxEdge=number_slider_4)  # disabled
mesh_brep = MeshBrep(Brep=brep, Settings=settings_custom)  # disabled
mesh_edges_3 = MeshEdges(Mesh=mesh_brep)  # -> NakedEdges, InteriorEdges, NonManifoldEdges; disabled
weld_mesh = WeldMesh(Mesh=mesh_brep, Angle=3.141592654)  # disabled
nakedvertices = NakedVertices(Mesh=weld_mesh)  # -> ClothedIndex, NakedIndex, ClothedPts, NakedPts; disabled
number_slider_5 = Slider(20, range=0..100)  # disabled
boolean_toggle = BooleanToggle(False)  # disabled
geometry_2 = Geometry(nakedvertices.NakedPts)  # disabled
timer = Timer(TimerInterval=20, Target=meshmachine)  # disabled
meshmachine = MeshMachine(
    Geometry=weld_mesh,
    Length=number_slider_5,
    FixVertices=geometry_2,
    Flip=1,
    PullStrength=0.8,
    CurvatureAdaptivity=0,
    BoundaryScale=1,
    BoundaryDistance=5,
    Exponent=2,
    Background=0.5,
    Iterations=1,
    Reset=boolean_toggle)  # disabled
planktonmesh = PlanktonMesh(meshmachine)  # disabled
mesh = Mesh(planktonmesh)  # disabled
mesh_edges_4 = MeshEdges(Mesh=mesh)  # -> NakedEdges, InteriorEdges, NonManifoldEdges; disabled
# SIMULATING INFLATABLE
number_slider_6 = Slider(1.01, range=0..1.1)
number_slider_7 = Slider(500, range=0..1000)
number_slider_8 = Slider(500, range=0..1000)  # disabled
data = Data(absolute)  # disabled
floor = Floor(Strength=Slider(500, range=0..1000))
number_slider_9 = Slider(0, range=0..1)
number_slider_10 = Slider(1, range=0..1)
subtraction = Subtraction(A=number_slider_10, B=number_slider_6)
negative = Negative(Value=subtraction)
multiplication = Multiplication(A=number_slider_10, B=data)  # disabled
timer_2 = Timer(TimerInterval=1000, Target=[c_script, c_script_2])  # disabled
boolean_toggle_2 = BooleanToggle(False)
button = Button()

# ----
# EXPORTING FRAMES TO LOCAL FOLDER
file_path = FilePath("C:\Users\User\Desktop\Thesis Drive\Graphics\2_Animation\200626\Simulation_Table Inflation\")
panel = Panel(file_path)
c_script = CSharpScript(iReset=button, iStart=boolean_toggle_2, Path=panel, Name="image", iFrames=Slider(1700, range=0..1700))  # -> out; inputs iReset: Boolean, iStart: Boolean, Path: String, Name: String, iFrames: Int32
# ---------- c_script: C# usings ----------
using Rhino.Display;
using System.Threading;
# ---------- c_script: C# ----------
    if(iReset) counter = 0;

    if(iStart) {
      var view = doc.Views.ActiveView;
      var view_capture = new ViewCapture
        {
          Width = view.ActiveViewport.Size.Width,
          Height = view.ActiveViewport.Size.Height,
          ScaleScreenItems = false,
          DrawAxes = false,
          DrawGrid = false,
          DrawGridAxes = false,
          TransparentBackground = false
          };

      if(counter < iFrames){
        var screenshot = view_capture.CaptureToBitmap(view);
        if(screenshot != null)
        {
          string filename = Path + Name + counter + ".png";
          screenshot.Save(filename, System.Drawing.Imaging.ImageFormat.Png);
          Print("Count: " + counter);
          counter += 1;
        }
      }
    }
# ---------- c_script: C# additional code ----------
    int counter = 0;
# ---------- end c_script ----------
panel_2 = Panel(c_script)

c_script_2 = CSharpScript(iReset=button, iRun=boolean_toggle_2)  # -> out, A; inputs iReset: Boolean, iRun: Boolean
# ---------- c_script_2: C# ----------
    if(iReset){
      counter = 0.0;}
    
    if(iRun){
      counter += 0.1;
    }
    A = counter;
# ---------- c_script_2: C# additional code ----------
  double counter = 0.0;
# ---------- end c_script_2 ----------
panel_3 = Panel(c_script_2.A)

# ----
# MAKING CHANNEL POCKETS STAGE2
mesh_2 = Mesh(<mesh referenced from the Rhino model>)
weld_mesh_2 = WeldMesh(Mesh=mesh_2, Angle=3.141592654)
weaverbird_s_naked_boundary = WeaverbirdsNakedBoundary(MeshClosedPolylines=weld_mesh_2)
mesh_edges_5 = MeshEdges(Mesh=weld_mesh_2)  # -> NakedEdges, InteriorEdges, NonManifoldEdges
deconstruct_mesh = DeconstructMesh(Mesh=weld_mesh_2)  # -> Vertices, Faces, Colours, Normals
number_slider_11 = Slider(9.075, range=0..10)

join_curves = JoinCurves(Curves=mesh_edges_5.NakedEdges, Preserve=False)
control_points = ControlPoints(Curve=join_curves)  # -> Points, Weights, Knots
removeduplicatepts = RemoveDuplicatePts(Points=control_points.Points, Tolerance=0.01)

negative_2 = Negative(Value=number_slider_11)
merge = Merge(Data1=negative_2, Data2=number_slider_11)  # -> graft(Result)
unit_z = UnitZ(Factor=merge)  # -> simplify(UnitVector)

closest_point = ClosestPoint(Point=deconstruct_mesh.Vertices, Cloud=flatten(removeduplicatepts))  # -> ClosestPoint, CPIndex, Distance
larger_than = LargerThan(FirstNumber=closest_point.Distance, SecondNumber=0)  # -> LargerThan, OrEqualTo
dispatch = Dispatch(List=deconstruct_mesh.Vertices, DispatchPattern=larger_than.LargerThan)  # -> ListA, ListB
move = Move(Geometry=dispatch.ListA, Motion=unit_z)  # -> simplify(Geometry), Transform
weave = Weave(Pattern=larger_than.LargerThan, Stream0=dispatch.ListB, Stream1=move.Geometry, NullGaps=False)  # -> simplify(Weave)
construct_mesh = ConstructMesh(Vertices=weave, Faces=deconstruct_mesh.Faces)  # -> simplify(Mesh)
explode_tree = ExplodeTree(Data=construct_mesh)  # -> Branch0, Branch1
mesh_flip = MeshFlip(Mesh=explode_tree.Branch0)
merge_2 = Merge(Data1=mesh_flip, Data2=explode_tree.Branch1)  # -> flatten(Result)
mesh_join = MeshJoin(Meshes=merge_2)

mesh_3 = Mesh(mesh_join)
data_dam = DataDam(DataA=mesh_3, BufferDelay=10000000, BufferMode=0)
mesh_weldvertices = MeshWeldVertices(Mesh=data_dam, Tolerance=0.01)  # -> RuntimeMessage, Mesh
weld_mesh_3 = WeldMesh(Mesh=mesh_weldvertices.Mesh, Angle=3.141592654)
unify_mesh = UnifyMesh(Mesh=weld_mesh_3)  # -> Result, Count
mesh_unifynormals = MeshUnifyNormals(Mesh=weld_mesh_3)

brep_2 = Brep(<brep referenced from the Rhino model>)
deconstruct_mesh_2 = DeconstructMesh(Mesh=mesh_unifynormals)  # -> Vertices, Faces, Colours, Normals
point_in_breps = PointInBreps(Brep=brep_2, Point=deconstruct_mesh_2.Vertices, Strict=False)  # -> Inside, Index
dispatch_2 = Dispatch(List=deconstruct_mesh_2.Vertices, DispatchPattern=point_in_breps.Inside)  # -> ListA, ListB

multiplication_2 = Multiplication(A=deconstruct_mesh_2.Normals, B=Slider(0.005, range=0..0.01))
vector_display = VectorDisplay(Anchor=deconstruct_mesh_2.Vertices, Vector=multiplication_2)

mesh_edges_6 = MeshEdges(Mesh=mesh_unifynormals)  # -> NakedEdges, InteriorEdges, NonManifoldEdges
geometry_3 = Geometry([mesh_edges_6.NakedEdges, mesh_edges_6.InteriorEdges])

sort_duplicate_points = SortDuplicatePoints(Points=dispatch_2.ListB)  # -> UniquePoints, Indices
number_slider_12 = Slider(10, range=0..100)
spherecollide = SphereCollide(Points=sort_duplicate_points.UniquePoints, Radius=number_slider_12, Strength=Slider(2839, range=0..10000))

pt = Point(dispatch_2.ListA)
volume = Volume(Mesh=mesh_unifynormals, Volume=multiplication, Strength=number_slider_8)  # disabled
anchor = Anchor(Point=pt, Strength=Slider(10000, range=0..10000))
show = Show(G=mesh_unifynormals)
vertexloads = VertexLoads(Mesh=mesh_unifynormals, Strength=subtraction)
length_line = LengthLine(Line=geometry_3, Strength=number_slider_7)
mesh_sphere = MeshSphere(Base=sort_duplicate_points.UniquePoints, Radius=number_slider_12, UCount=10, VCount=20)

length = Length(Curve=geometry_3)
multiplication_3 = Multiplication(A=length, B=Slider(0.589, range=0..1))

multiplication_4 = Multiplication(A=length, B=Slider(0.95, range=0..1.01))

clamplength = ClampLength(Line=geometry_3, LowerLimit=multiplication_3, UpperLimit=multiplication_4, Strength=number_slider_7)

multiplication_5 = Multiplication(A=number_slider_10, B=Slider(1, range=0..181))

pressure = Pressure(M=mesh_unifynormals, Strength=multiplication_5)

stream_gate = StreamGate(Stream=[show, clamplength, pressure, anchor, floor, vertexloads, spherecollide], Gate=number_slider_9)  # -> Target0, Target1
stepsolver = StepSolver(
    GoalObjects=flatten(stream_gate.Target0),
    Tolerance=0.01,
    Momentum=False,
    Damping=0.99,
    SubIterations=Slider(200, range=0..10000),
    Animate=c_script_2.A)  # -> I, V, O; disabled
solver = Solver(GoalObjects=flatten(stream_gate.Target1), Reset=Button(), Threshold=1e-15, Tolerance=0.01, On=Toggle(False))  # -> I, V, O
stream_filter = StreamFilter(Gate=number_slider_9, Stream0=stepsolver.O, Stream1=solver.O)

boolean_toggle_3 = BooleanToggle(True)
mesh_4 = Mesh(stream_filter)
clean_tree = CleanTree(RemoveNulls=boolean_toggle_3, RemoveInvalid=boolean_toggle_3, RemoveEmpty=boolean_toggle_3, Tree=mesh_4)

weaverbird_s_loop_subdivision_2 = WeaverbirdsLoopSubdivision(MeshCurves=clean_tree, Level=1, SmoothNakedEdges=1)
mesh_edges_7 = MeshEdges(Mesh=weaverbird_s_loop_subdivision_2)  # -> NakedEdges, InteriorEdges, NonManifoldEdges

custom_preview = CustomPreview(Geometry=weaverbird_s_loop_subdivision_2, Material=ColourSwatch(SwatchColor=RGB(84, 84, 84)))

geometry_4 = Geometry(flatten([mesh_edges_7.NakedEdges, mesh_edges_7.InteriorEdges]))
