# Grasshopper definition 200818_Bridge Design.gh (Grasshopper 1.0.7)
# plug-ins: MeshEdit Components, Fattener, LunchBoxML, Kangaroo Components, PlanktonGh, LunchBox, Weaverbird, Kangaroo2 Components

geometry_pipeline = GeometryPipeline(
    GroupByLayer=False,
    GroupByType=False,
    IncludeHidden=True,
    IncludeLocked=True,
    LayerFilter="1",
    NameFilter="*",
    SublayerFiltering=True,
    TypeFilter=4)
discontinuity = Discontinuity(Curve=geometry_pipeline, Level=1)  # -> Points, Parameters
curve_closest_point = CurveClosestPoint(Point=flatten(discontinuity.Points), Curve=reparameterize(graft(geometry_pipeline)))  # -> Point, Parameter, Distance
geometry_pipeline_2 = GeometryPipeline(
    GroupByLayer=False,
    GroupByType=False,
    IncludeHidden=True,
    IncludeLocked=True,
    LayerFilter="2",
    NameFilter="*",
    SublayerFiltering=True,
    TypeFilter=4)
evaluate = Evaluate(Expression="x<0.05", x=curve_closest_point.Distance)
cull_pattern = CullPattern(List=curve_closest_point.Parameter, CullPattern=evaluate)
discontinuity_2 = Discontinuity(Curve=geometry_pipeline_2, Level=1)  # -> Points, Parameters
shatter = Shatter(Curve=reparameterize(graft(geometry_pipeline)), Parameters=cull_pattern)
curve_closest_point_2 = CurveClosestPoint(Point=flatten(discontinuity_2.Points), Curve=reparameterize(graft(geometry_pipeline_2)))  # -> Point, Parameter, Distance
evaluate_2 = Evaluate(Expression="x<0.05", x=curve_closest_point_2.Distance)
cull_pattern_2 = CullPattern(List=curve_closest_point_2.Parameter, CullPattern=evaluate_2)
end_points = EndPoints(Curve=shatter)  # -> Start, End
line = Line(StartPoint=end_points.Start, EndPoint=end_points.End)  # -> flatten(Line)
shatter_2 = Shatter(Curve=reparameterize(graft(geometry_pipeline_2)), Parameters=cull_pattern_2)
number_slider = Slider(0.05, range=0..0.1)
end_points_2 = EndPoints(Curve=shatter_2)  # -> Start, End
line_2 = Line(StartPoint=end_points_2.Start, EndPoint=end_points_2.End)  # -> flatten(Line)
number_slider_2 = Slider(0.05, range=0..0.1)
number_slider_3 = Slider(3, range=0..10)  # disabled
geometry_pipeline_3 = GeometryPipeline(
    GroupByLayer=False,
    GroupByType=False,
    IncludeHidden=True,
    IncludeLocked=True,
    LayerFilter="Lines",
    NameFilter="*",
    SublayerFiltering=True,
    TypeFilter=4)  # disabled
surface = Surface(<surface referenced from the Rhino model>)  # disabled
plane = Plane(surface)  # disabled
curve = Curve(line)
# MAKING CHANNEL POCKETS STAGE1
curve_2 = Curve([<curve referenced from the Rhino model> x15])
mirror = Mirror(Geometry=geometry_pipeline_3, Plane=plane)  # -> Geometry, Transform; disabled
curve_3 = Curve(reparameterize(<curve referenced from the Rhino model>))  # disabled
curve_4 = Curve(reparameterize([geometry_pipeline_3, mirror.Geometry]))  # disabled
divide_curve = DivideCurve(Curve=geometry_pipeline_3, Count=number_slider_3, Kinks=False)  # -> Points, Tangents, Parameters; disabled
divide_curve_2 = DivideCurve(Curve=mirror.Geometry, Count=number_slider_3, Kinks=False)  # -> Points, Tangents, Parameters; disabled
curve_5 = Curve(line_2)
panel = Panel("x>0.5")  # disabled
curve_6 = Curve(reparameterize(<curve referenced from the Rhino model>))  # disabled
curve_7 = Curve(reparameterize(<curve referenced from the Rhino model>))  # disabled
mirror_2 = Mirror(Geometry=curve_6, Plane=plane)  # -> Geometry, Transform; disabled
gene_pool = GenePool(Decimals=2, Maximum=1, Minimum=0, Value=[0.23, 0.54, 0.8028078819])  # disabled
gene_pool_2 = GenePool(Decimals=2, Maximum=1, Minimum=0, Value=[0.22, 0.47])  # disabled
mirror_3 = Mirror(Geometry=curve_7, Plane=plane)  # -> Geometry, Transform; disabled
curve_8 = Curve(reparameterize([curve_6, mirror_2.Geometry]))  # disabled
curve_9 = Curve(reparameterize([curve_7, mirror_3.Geometry]))  # disabled
number_slider_4 = Slider(0.1, range=0..1)  # disabled
evaluate_curve = EvaluateCurve(Curve=reparameterize(graft(curve_9)), Parameter=gene_pool_2)  # -> Point, Tangent, Angle; disabled
evaluate_curve_2 = EvaluateCurve(Curve=reparameterize(graft(curve_8)), Parameter=gene_pool)  # -> Point, Tangent, Angle; disabled
number_slider_5 = Slider(60, range=0..100)

fatten = Fatten(
    Skeleton=curve_2,
    Thickness=number_slider_5,
    LengthSubdivisions=Slider(0, range=0..10),
    EndType=Slider(0, range=0..10),
    AdjustForAngle=False)

fatten_2 = Fatten(
    Skeleton=curve_2,
    Thickness=number_slider_5,
    LengthSubdivisions=Slider(1, range=0..10),
    EndType=Slider(2, range=0..3),
    AdjustForAngle=False)

point = Point(flatten([divide_curve.Points, evaluate_curve.Point, divide_curve_2.Points, evaluate_curve_2.Point]))  # disabled
pt = Point(point)  # disabled
inter = InterconnectPoints(Pts=pt)  # disabled
len = Length(Curve=inter)  # disabled
evaluate_3 = Evaluate(Expression=panel, x=len)  # disabled
cull_pattern_3 = CullPattern(List=inter, CullPattern=evaluate_3)  # disabled
len_2 = Length(Curve=cull_pattern_3)  # disabled
division = Division(A=len_2, B=number_slider_4)  # disabled
loft = Loft(
    Curves=[geometry_pipeline_3, curve_3, mirror.Geometry],
    Options={Adjust=False, Closed=False, LoftEnds=0, LoftSimp=0, LoftType=0, Rebuild=10, Refit=0.01})  # disabled
round = Round(Number=division)  # -> Nearest, Floor, Ceiling; disabled
panel_2 = Panel(round.Ceiling)  # disabled
divide = DivideCurve(Curve=cull_pattern_3, Count=round.Ceiling, Kinks=False)  # -> flatten(Points), Tangents, Parameters; disabled

# ----
# Y JUNCTION LINES
discontinuity_3 = Discontinuity(Curve=curve, Level=1)  # -> Points, Parameters
number_slider_6 = Slider(50, range=0..100)
create_rtree = CreateRTree(InputGeometry=flatten(discontinuity_3.Points))
cull_duplicates = CullDuplicates(Points=flatten(discontinuity_3.Points), Tolerance=0.1, CullMode=3)  # -> Points, Indices, Valence
rtree_points_in_range = RTreePointsInRange(SearchPoints=cull_duplicates.Points, SearchDistance=Slider(0.05, range=0..0.1), RTree=create_rtree)  # -> simplify(PointsWithinRange), IndicesWithinRange

end_points_3 = EndPoints(Curve=curve_8)  # -> Start, End; disabled
mesh_edges = MeshEdges(Mesh=fatten)  # -> NakedEdges, InteriorEdges, NonManifoldEdges
weaverbird_s_loop_subdivision = WeaverbirdsLoopSubdivision(MeshCurves=fatten_2, Level=1, SmoothNakedEdges=1)
shatter_3 = Shatter(Curve=graft(cull_pattern_3), Parameters=divide.Parameters)  # disabled
number_slider_7 = Slider(1000, range=0..1000)  # disabled
number_slider_8 = Slider(1.5, range=0..2)  # disabled
mesh_edges_2 = MeshEdges(Mesh=weaverbird_s_loop_subdivision)  # -> NakedEdges, InteriorEdges, NonManifoldEdges
number_slider_9 = Slider(0, range=0..1)  # disabled
number_slider_10 = Slider(10000, range=0..10000)  # disabled
len_3 = Length(Curve=shatter_3)  # disabled
point_2 = Point(flatten([end_points_3.Start, end_points_3.End, divide_curve_2.Points, divide_curve.Points]))  # disabled
number_slider_11 = Slider(500, range=0..1000)  # disabled
multiplication = Multiplication(A=len_3, B=number_slider_9)  # disabled
geometry = Geometry([mesh_edges.NakedEdges, mesh_edges.InteriorEdges, mesh_edges.NonManifoldEdges])

# ----
# Y JUNCTION LINES
discontinuity_4 = Discontinuity(Curve=curve_5, Level=1)  # -> Points, Parameters
number_slider_12 = Slider(50, range=0..100)
create_rtree_2 = CreateRTree(InputGeometry=flatten(discontinuity_4.Points))
cull_duplicates_2 = CullDuplicates(Points=flatten(discontinuity_4.Points), Tolerance=0.1, CullMode=3)  # -> Points, Indices, Valence
rtree_points_in_range_2 = RTreePointsInRange(SearchPoints=cull_duplicates_2.Points, SearchDistance=Slider(0.05, range=0..0.1), RTree=create_rtree_2)  # -> simplify(PointsWithinRange), IndicesWithinRange

c_script = CSharpScript(
    Pts=divide.Points,
    InteractionRadius=number_slider_8,
    Strength=number_slider_7,
    Reference="C:\Program Files\Rhino 6\Plug-ins\Grasshopper\Components\KangarooSolver.dll")  # -> out, A; inputs Pts: list of Point3d, InteractionRadius: Double, Strength: Double; disabled
# ---------- c_script: C# ----------
    A = new RangedAttraction(Pts, InteractionRadius, Strength);
# ---------- c_script: C# additional code ----------
  public class RangedAttraction : GoalObject
  {
    public double Strength;
    public double SqDiam;
    public double Diam;

    public RangedAttraction(List<Point3d> V, double r, double k)
    {
      int L = V.Count;
      PPos = V.ToArray();
      Move = new Vector3d[L];
      Weighting = new double[L];  
      Diam = r + r;
      SqDiam = Diam * Diam;
      Strength = k;
    }

    public override void Calculate(List<KangarooSolver.Particle> p)
    {
      int L = PIndex.Length;
      double[] Xcoord = new double[L];
      for (int i = 0; i < L; i++)
      {
        Xcoord[i] = p[PIndex[i]].Position.X;
      }
      Array.Sort(Xcoord, PIndex); //by sorting in X first we can quickly rule out all pairs more than Diam apart

      for (int i = 0; i < L; i++)
      {
        Move[i] = Vector3d.Zero;
        Weighting[i] = 0;
      }

      for (int i = 0; i < (PIndex.Length - 1); i++)
      {
        for (int j = 1; (i + j) < PIndex.Length; j++)
        {
          int k = i + j;
          Vector3d Separation = p[PIndex[k]].Position - p[PIndex[i]].Position;
          if (Separation.X < Diam)
          {
            if (Separation.SquareLength < SqDiam)
            {
              double LengthNow = Separation.Length;

              double Limited = Math.Max(LengthNow, 0.001);
              double RaisedToPower = Math.Pow(Limited, -3); //other powers will give different results
              double FadeOut = RaisedToPower * (Diam - LengthNow);
              double WeightingFactor = Strength * FadeOut;

              Move[i] += WeightingFactor * 0.5 * Separation; //the target is the midpt between the 2 points
              Move[k] -= WeightingFactor * 0.5 * Separation;

              Weighting[i] += WeightingFactor;
              Weighting[k] += WeightingFactor;
            }
          }
          else
          {
            break;
          }
        }
      }

      for (int i = 0; i < L; i++)
      {
        if(Weighting[i] != 0)
        {
          Move[i] = Move[i] * (1.0 / Weighting[i]);
          Weighting[i] = Math.Min(Strength * Weighting[i], 50);
        }
      }
    }

  }
# ---------- end c_script ----------
mesh_volume = MeshVolume(Mesh=weaverbird_s_loop_subdivision)  # -> Volume, Centroid
anchor = Anchor(Point=point_2, Strength=number_slider_10)  # disabled
absolute = Absolute(Value=mesh_volume.Volume)
length_line = LengthLine(Line=shatter_3, Length=multiplication, Strength=number_slider_11)  # disabled
button = Button()  # disabled
toggle = BooleanToggle(False)  # disabled
c_script_2 = CSharpScript(x=rtree_points_in_range.PointsWithinRange)  # -> out, A; inputs x: tree of Point3d
# ---------- c_script_2: C# ----------
    List<List<Point3d>> points = new List<List<Point3d>>();
    
    for(int i = 0; i < x.BranchCount; i++){
      if(x.Branch(i).Count > 2){
        points.Add(x.Branch(i));
      }
    }

    A = ListOfListsToTree(points);
# ---------- c_script_2: C# additional code ----------
  


  static Grasshopper.DataTree<T> ListOfListsToTree<T > (List < List < T >> s){
  Grasshopper.DataTree<T> tree = new DataTree<T>();
  for(int i = 0;i < s.Count; i++){
  tree.AddRange(s[i], new GH_Path(i));
}
        return tree;
      }
# ---------- end c_script_2 ----------
solver = Solver(GoalObjects=[length_line, anchor, c_script.A], Reset=button, Threshold=1e-09, Tolerance=0.01, On=toggle)  # -> I, V, O; disabled
cull_duplicates_3 = CullDuplicates(Points=flatten(c_script_2.A), Tolerance=0.1, CullMode=3)  # -> Points, Indices, Valence

number_slider_13 = Slider(100, range=0..1000)
sphere = Sphere(Base=cull_duplicates_3.Points, Radius=Slider(0.1, range=0..0.1))

surface_curve = SurfaceCurve(Surface=graft(sphere), Curve=curve)  # -> Curves, simplify(Points), UVPoints, Normals, Parameters, Tangents
shift_paths = ShiftPaths(Data=surface_curve.Points, Offset=-1)

# ----
# SINGLE LIEANR ELEMENT
point_3 = Point(flatten(surface_curve.Points))

curve_closest_point_3 = CurveClosestPoint(Point=point_3, Curve=reparameterize(graft(curve)))  # -> Point, Parameter, Distance
evaluate_4 = Evaluate(Expression="x < 0.01", x=curve_closest_point_3.Distance)
cull_pattern_4 = CullPattern(List=curve_closest_point_3.Parameter, CullPattern=evaluate_4)  # -> simplify(List)

shatter_4 = Shatter(Curve=reparameterize(graft(curve)), Parameters=cull_pattern_4)  # -> simplify(Segments)
crv = Curve(solver.O)  # disabled
line_3 = Line(StartPoint=graft(cull_duplicates_3.Points), EndPoint=shift_paths)

point_on_curve = PointOnCurve(line_3, parameter=0.5)
sphere_2 = Sphere(Base=point_on_curve, Radius=Slider(0.001, range=0..0.001))

collision_one_many = CollisionOneMany(Collider=shatter_4, Obstacles=flatten(sphere_2))  # -> Collision, Index
colour_swatch = ColourSwatch(SwatchColor=RGB(255, 255, 255))  # disabled
c_script_3 = CSharpScript(x=rtree_points_in_range_2.PointsWithinRange)  # -> out, A; inputs x: tree of Point3d; same code as c_script_2
dispatch = Dispatch(List=shatter_4, DispatchPattern=collision_one_many.Collision)  # -> ListA, ListB
number_slider_14 = Slider(41, range=0..100)  # disabled
number_slider_15 = Slider(15, range=0..100)  # disabled

# ----
# Diameter of channels
number_slider_16 = Slider(0.06, range=0..0.1)

number_slider_17 = Slider(30, range=0..100)  # disabled
# MESHING CHANNEL POCKETS
brep = Brep(<brep referenced from the Rhino model>)  # disabled
cull_duplicates_4 = CullDuplicates(Points=flatten(c_script_3.A), Tolerance=0.1, CullMode=3)  # -> Points, Indices, Valence

number_slider_18 = Slider(100, range=0..1000)
sphere_3 = Sphere(Base=cull_duplicates_4.Points, Radius=Slider(0.1, range=0..0.1))

surface_curve_2 = SurfaceCurve(Surface=graft(sphere_3), Curve=curve_5)  # -> Curves, simplify(Points), UVPoints, Normals, Parameters, Tangents
shift_paths_2 = ShiftPaths(Data=surface_curve_2.Points, Offset=-1)

# ----
# SINGLE LIEANR ELEMENT
point_4 = Point(flatten(surface_curve_2.Points))

curve_closest_point_4 = CurveClosestPoint(Point=point_4, Curve=reparameterize(graft(curve_5)))  # -> Point, Parameter, Distance
evaluate_5 = Evaluate(Expression="x < 0.01", x=curve_closest_point_4.Distance)
cull_pattern_5 = CullPattern(List=curve_closest_point_4.Parameter, CullPattern=evaluate_5)  # -> simplify(List)

shatter_5 = Shatter(Curve=reparameterize(graft(curve_5)), Parameters=cull_pattern_5)  # -> simplify(Segments)
custom_preview = CustomPreview(Geometry=crv, Material=colour_swatch)  # disabled
line_4 = Line(StartPoint=graft(cull_duplicates_4.Points), EndPoint=shift_paths_2)

point_on_curve_2 = PointOnCurve(line_4, parameter=0.5)
sphere_4 = Sphere(Base=point_on_curve_2, Radius=Slider(0.001, range=0..0.001))

collision_one_many_2 = CollisionOneMany(Collider=shatter_5, Obstacles=flatten(sphere_4))  # -> Collision, Index

fatten_3 = Fatten(
    Skeleton=flatten(dispatch.ListB),
    Thickness=number_slider_16,
    LengthSubdivisions=0,
    EndType=Slider(0, range=0..3),
    AdjustForAngle=False)
disjoint_mesh = DisjointMesh(Mesh=fatten_3)  # -> graft(Meshes)

settings_custom = SettingsCustom(
    StitchSeams=True,
    SimplePlanes=False,
    Refine=True,
    MinCount=16,
    MaxCount=400,
    AspectRatio=20,
    MaxDistance=0,
    MaxAngle=number_slider_14,
    MinEdge=number_slider_15,
    MaxEdge=number_slider_17)  # disabled
dispatch_2 = Dispatch(List=shatter_5, DispatchPattern=collision_one_many_2.Collision)  # -> ListA, ListB

# ----
# Diameter of channels
number_slider_19 = Slider(0.06, range=0..0.1)

# ----
# FATTENER
number_slider_20 = Slider(0, range=0..3)
fatten_4 = Fatten(
    Skeleton=flatten(line_3),
    Thickness=number_slider_16,
    LengthSubdivisions=0,
    EndType=number_slider_20,
    AdjustForAngle=False)
disjoint_mesh_2 = DisjointMesh(Mesh=fatten_4)  # -> graft(Meshes)

mesh_brep = MeshBrep(Brep=brep, Settings=settings_custom)  # disabled

weaverbird_s_naked_boundary = WeaverbirdsNakedBoundary(MeshClosedPolylines=simplify(disjoint_mesh_2))
join = JoinCurves(Curves=weaverbird_s_naked_boundary, Preserve=False)
explode = Explode(Curve=join, Recursive=True)  # -> Segments, Vertices
cull_duplicates_5 = CullDuplicates(Points=explode.Vertices, Tolerance=0.1, CullMode=3)  # -> simplify(Points), Indices, Valence
shift_paths_3 = ShiftPaths(Data=cull_duplicates_5.Points, Offset=-1)  # -> flatten(Data)

mesh_edges_3 = MeshEdges(Mesh=mesh_brep)  # -> NakedEdges, InteriorEdges, NonManifoldEdges; disabled

fatten_5 = Fatten(
    Skeleton=flatten(dispatch_2.ListB),
    Thickness=number_slider_19,
    LengthSubdivisions=0,
    EndType=Slider(0, range=0..3),
    AdjustForAngle=False)
disjoint_mesh_3 = DisjointMesh(Mesh=fatten_5)  # -> graft(Meshes)

weld_mesh = WeldMesh(Mesh=mesh_brep, Angle=3.141592654)  # disabled
nakedvertices = NakedVertices(Mesh=weld_mesh)  # -> ClothedIndex, NakedIndex, ClothedPts, NakedPts; disabled

# ----
# FATTENER
number_slider_21 = Slider(0, range=0..3)
fatten_6 = Fatten(
    Skeleton=flatten(line_4),
    Thickness=number_slider_19,
    LengthSubdivisions=0,
    EndType=number_slider_21,
    AdjustForAngle=False)
disjoint_mesh_4 = DisjointMesh(Mesh=fatten_6)  # -> graft(Meshes)

face_normals = FaceNormals(Mesh=disjoint_mesh_2)  # -> Centers, Normals; disabled
mesh_edges_4 = MeshEdges(Mesh=disjoint_mesh_2)  # -> NakedEdges, InteriorEdges, NonManifoldEdges; disabled
vector_display = VectorDisplay(Anchor=face_normals.Centers, Vector=face_normals.Normals)  # disabled

weaverbird_s_catmull_clark_subdivision = WeaverbirdsCatmullClarkSubdivision(MeshCurves=disjoint_mesh, Level=1, SmoothNakedEdges=1)

brep_2 = Brep(<brep referenced from the Rhino model>)
colom = CollisionOneMany(Collider=simplify(disjoint_mesh), Obstacles=brep_2)  # -> Collision, Index
dispatch_3 = Dispatch(List=disjoint_mesh, DispatchPattern=colom.Collision)  # -> ListA, ListB

number_slider_22 = Slider(20, range=0..100)  # disabled

weaverbird_s_naked_boundary_2 = WeaverbirdsNakedBoundary(MeshClosedPolylines=simplify(disjoint_mesh_4))
join_2 = JoinCurves(Curves=weaverbird_s_naked_boundary_2, Preserve=False)
explode_2 = Explode(Curve=join_2, Recursive=True)  # -> Segments, Vertices
cull_duplicates_6 = CullDuplicates(Points=explode_2.Vertices, Tolerance=0.1, CullMode=3)  # -> simplify(Points), Indices, Valence
shift_paths_4 = ShiftPaths(Data=cull_duplicates_6.Points, Offset=-1)  # -> flatten(Data)

boolean_toggle = BooleanToggle(False)  # disabled
geometry_2 = Geometry(nakedvertices.NakedPts)  # disabled
geo = Geometry(dispatch_3.ListA)
geo_2 = Geometry(dispatch_3.ListB)

weaverbird_s_naked_boundary_3 = WeaverbirdsNakedBoundary(MeshClosedPolylines=simplify(geo_2))
join_3 = JoinCurves(Curves=weaverbird_s_naked_boundary_3, Preserve=False)
explode_3 = Explode(Curve=join_3, Recursive=True)  # -> Segments, Vertices
cull_duplicates_7 = CullDuplicates(Points=explode_3.Vertices, Tolerance=0.1, CullMode=3)  # -> simplify(Points), Indices, Valence

face_normals_2 = FaceNormals(Mesh=disjoint_mesh_4)  # -> Centers, Normals; disabled
mesh_edges_5 = MeshEdges(Mesh=disjoint_mesh_4)  # -> NakedEdges, InteriorEdges, NonManifoldEdges; disabled
vector_display_2 = VectorDisplay(Anchor=face_normals_2.Centers, Vector=face_normals_2.Normals)  # disabled

timer = Timer(TimerInterval=20, Target=meshmachine)  # disabled
meshmachine = MeshMachine(
    Geometry=weld_mesh,
    Length=number_slider_22,
    FixVertices=geometry_2,
    Flip=1,
    PullStrength=0.8,
    CurvatureAdaptivity=0,
    BoundaryScale=1,
    BoundaryDistance=5,
    Exponent=2,
    Background=0.5,
    Iterations=1,
    Reset=boolean_toggle)  # disabled
weaverbird_s_catmull_clark_subdivision_2 = WeaverbirdsCatmullClarkSubdivision(MeshCurves=disjoint_mesh_3, Level=1, SmoothNakedEdges=1)

number_slider_23 = Slider(2, range=0..10)
weaverbird_s_catmull_clark_subdivision_3 = WeaverbirdsCatmullClarkSubdivision(MeshCurves=disjoint_mesh_2, Level=number_slider_23, SmoothNakedEdges=Slider(2, range=0..10))

brep_3 = Brep(<brep referenced from the Rhino model>)
colom_2 = CollisionOneMany(Collider=simplify(disjoint_mesh_3), Obstacles=brep_3)  # -> Collision, Index
dispatch_4 = Dispatch(List=disjoint_mesh_3, DispatchPattern=colom_2.Collision)  # -> ListA, ListB

# ----
# PREPARE WEFT AND WARP
panel_3 = Panel("1")  # disabled
refine = Refine(Mesh=disjoint_mesh_2, Level=panel_3)  # disabled
clean = CombineClean(Meshes=refine)  # disabled
md = MeshDirection(Mesh=clean)  # disabled
turn = MeshTurn(Mesh=md)  # disabled

planktonmesh = PlanktonMesh(meshmachine)  # disabled
geo_3 = Geometry(dispatch_4.ListA)
geo_4 = Geometry(dispatch_4.ListB)

weaverbird_s_naked_boundary_4 = WeaverbirdsNakedBoundary(MeshClosedPolylines=simplify(geo_4))
join_4 = JoinCurves(Curves=weaverbird_s_naked_boundary_4, Preserve=False)
explode_4 = Explode(Curve=join_4, Recursive=True)  # -> Segments, Vertices
cull_duplicates_8 = CullDuplicates(Points=explode_4.Vertices, Tolerance=0.1, CullMode=3)  # -> simplify(Points), Indices, Valence

deconstruct_mesh = DeconstructMesh(Mesh=geo_2)  # -> Vertices, Faces, Colours, Normals
closest_point = ClosestPoint(Point=cull_duplicates_7.Points, Cloud=shift_paths_3)  # -> ClosestPoint, CPIndex, Distance
shift_paths_5 = ShiftPaths(Data=cull_duplicates_7.Points, Offset=-1)
shift_paths_6 = ShiftPaths(Data=closest_point.ClosestPoint, Offset=-1)
closest_point_2 = ClosestPoint(Point=simplify(shift_paths_5), Cloud=simplify(deconstruct_mesh.Vertices))  # -> ClosestPoint, CPIndex, Distance
replace_items = ReplaceItems(List=deconstruct_mesh.Vertices, Item=shift_paths_6, Indices=closest_point_2.CPIndex, Wrap=False)
construct_mesh = ConstructMesh(Vertices=replace_items, Faces=deconstruct_mesh.Faces, Colours=deconstruct_mesh.Colours)  # -> simplify(Mesh)

mesh = Mesh(planktonmesh)  # disabled
mesh_edges_6 = MeshEdges(Mesh=mesh)  # -> NakedEdges, InteriorEdges, NonManifoldEdges; disabled

number_slider_24 = Slider(2, range=0..10)
weaverbird_s_catmull_clark_subdivision_4 = WeaverbirdsCatmullClarkSubdivision(MeshCurves=disjoint_mesh_4, Level=number_slider_24, SmoothNakedEdges=Slider(2, range=0..10))

# ----
# PREPARE WEFT AND WARP
panel_4 = Panel("1")  # disabled
refine_2 = Refine(Mesh=disjoint_mesh_4, Level=panel_4)  # disabled
clean_2 = CombineClean(Meshes=refine_2)  # disabled
md_2 = MeshDirection(Mesh=clean_2)  # disabled
turn_2 = MeshTurn(Mesh=md_2)  # disabled

boolean_toggle_2 = BooleanToggle(True)  # disabled
flip_mesh = FlipMesh(Mesh=md, VertexNormals=boolean_toggle_2, FaceNormals=boolean_toggle_2, FaceOrientation=boolean_toggle_2)  # disabled
mesh_2 = Mesh(flip_mesh)  # disabled

boolean_toggle_3 = BooleanToggle(True)  # disabled
flip_mesh_2 = FlipMesh(
    Mesh=weaverbird_s_catmull_clark_subdivision_3,
    VertexNormals=boolean_toggle_3,
    FaceNormals=boolean_toggle_3,
    FaceOrientation=boolean_toggle_3)  # disabled

deconstruct_mesh_2 = DeconstructMesh(Mesh=geo_4)  # -> Vertices, Faces, Colours, Normals
closest_point_3 = ClosestPoint(Point=cull_duplicates_8.Points, Cloud=shift_paths_4)  # -> ClosestPoint, CPIndex, Distance
shift_paths_7 = ShiftPaths(Data=cull_duplicates_8.Points, Offset=-1)
shift_paths_8 = ShiftPaths(Data=closest_point_3.ClosestPoint, Offset=-1)
closest_point_4 = ClosestPoint(Point=simplify(shift_paths_7), Cloud=simplify(deconstruct_mesh_2.Vertices))  # -> ClosestPoint, CPIndex, Distance
replace_items_2 = ReplaceItems(List=deconstruct_mesh_2.Vertices, Item=shift_paths_8, Indices=closest_point_4.CPIndex, Wrap=False)
construct_mesh_2 = ConstructMesh(Vertices=replace_items_2, Faces=deconstruct_mesh_2.Faces, Colours=deconstruct_mesh_2.Colours)  # -> simplify(Mesh)

boolean_toggle_4 = BooleanToggle(True)  # disabled
flip_mesh_3 = FlipMesh(Mesh=md_2, VertexNormals=boolean_toggle_4, FaceNormals=boolean_toggle_4, FaceOrientation=boolean_toggle_4)  # disabled
mesh_3 = Mesh(flip_mesh_3)  # disabled

boolean_toggle_5 = BooleanToggle(True)  # disabled
flip_mesh_4 = FlipMesh(
    Mesh=weaverbird_s_catmull_clark_subdivision_4,
    VertexNormals=boolean_toggle_5,
    FaceNormals=boolean_toggle_5,
    FaceOrientation=boolean_toggle_5)  # disabled

panel_5 = Panel("2")  # disabled
strips = RefineStrips(Mesh=flip_mesh_2, Level=panel_5)  # disabled

mesh_edges_7 = MeshEdges(Mesh=strips)  # -> NakedEdges, InteriorEdges, NonManifoldEdges; disabled
face_normals_3 = FaceNormals(Mesh=strips)  # -> Centers, Normals; disabled
vector_display_3 = VectorDisplay(Anchor=face_normals_3.Centers, Vector=face_normals_3.Normals)  # disabled

panel_6 = Panel("2")  # disabled
strips_2 = RefineStrips(Mesh=mesh_2, Level=panel_6)  # disabled

panel_7 = Panel("2")  # disabled
strips_3 = RefineStrips(Mesh=flip_mesh_4, Level=panel_7)  # disabled

mesh_edges_8 = MeshEdges(Mesh=strips_3)  # -> NakedEdges, InteriorEdges, NonManifoldEdges; disabled
face_normals_4 = FaceNormals(Mesh=strips_3)  # -> Centers, Normals; disabled
vector_display_4 = VectorDisplay(Anchor=face_normals_4.Centers, Vector=face_normals_4.Normals)  # disabled

panel_8 = Panel("2")  # disabled
strips_4 = RefineStrips(Mesh=mesh_3, Level=panel_8)  # disabled

clean_3 = CombineClean(Meshes=construct_mesh)  # disabled
disjoint = DisjointMesh(Mesh=clean_3)  # disabled

number_slider_25 = Slider(2, range=0..10)  # disabled
weaverbird_s_catmull_clark_subdivision_5 = WeaverbirdsCatmullClarkSubdivision(MeshCurves=[disjoint, geo], Level=number_slider_23, SmoothNakedEdges=number_slider_25)  # disabled

boolean_toggle_6 = BooleanToggle(True)  # disabled
flip_mesh_5 = FlipMesh(
    Mesh=weaverbird_s_catmull_clark_subdivision_5,
    VertexNormals=boolean_toggle_6,
    FaceNormals=boolean_toggle_6,
    FaceOrientation=boolean_toggle_6)  # -> simplify(flatten(Result)); disabled

null_item = NullItem(Item=flip_mesh_5)  # -> NullFlags, InvalidFlags, Description; disabled
clean_4 = CombineClean(Meshes=construct_mesh_2)  # disabled
dispatch_5 = Dispatch(List=flatten(flip_mesh_5), DispatchPattern=null_item.NullFlags)  # -> ListA, ListB; disabled

panel_9 = Panel("2")  # disabled
strips_5 = RefineStrips(Mesh=dispatch_5.ListB, Level=panel_9)  # disabled

colour_swatch_2 = ColourSwatch(SwatchColor=RGB(84, 84, 84))  # disabled
custom_preview_2 = CustomPreview(Geometry=strips_5, Material=colour_swatch_2)  # disabled

face_normals_5 = FaceNormals()  # -> Centers, Normals; disabled
mesh_edges_9 = MeshEdges(Mesh=strips_5)  # -> NakedEdges, InteriorEdges, NonManifoldEdges; disabled
vector_display_5 = VectorDisplay(Anchor=face_normals_5.Centers, Vector=face_normals_5.Normals)  # disabled

disjoint_2 = DisjointMesh(Mesh=clean_4)  # disabled

number_slider_26 = Slider(2, range=0..10)  # disabled
weaverbird_s_catmull_clark_subdivision_6 = WeaverbirdsCatmullClarkSubdivision(MeshCurves=[disjoint_2, geo_3], Level=number_slider_24, SmoothNakedEdges=number_slider_26)  # disabled

boolean_toggle_7 = BooleanToggle(True)  # disabled
flip_mesh_6 = FlipMesh(
    Mesh=weaverbird_s_catmull_clark_subdivision_6,
    VertexNormals=boolean_toggle_7,
    FaceNormals=boolean_toggle_7,
    FaceOrientation=boolean_toggle_7)  # -> simplify(flatten(Result)); disabled

panel_10 = Panel("Straight Elements")  # disabled
button_2 = Button()  # disabled
null_item_2 = NullItem(Item=flip_mesh_6)  # -> NullFlags, InvalidFlags, Description; disabled
object_bake = ObjectBake(
    BakeToggle=button_2,
    GeometryObjects=strips_5,
    Layer=panel_10,
    ObjectName="GH_Obj",
    ObjectColor=colour_swatch_2,
    LayerColor=RGB(255, 255, 255))  # disabled
dispatch_6 = Dispatch(List=flatten(flip_mesh_6), DispatchPattern=null_item_2.NullFlags)  # -> ListA, ListB; disabled

panel_11 = Panel("2")  # disabled
strips_6 = RefineStrips(Mesh=dispatch_6.ListB, Level=panel_11)  # disabled

colour_swatch_3 = ColourSwatch(SwatchColor=RGB(84, 84, 84))  # disabled
custom_preview_3 = CustomPreview(Geometry=strips_6, Material=colour_swatch_3)  # disabled

face_normals_6 = FaceNormals()  # -> Centers, Normals; disabled
mesh_edges_10 = MeshEdges(Mesh=strips_6)  # -> NakedEdges, InteriorEdges, NonManifoldEdges; disabled
vector_display_6 = VectorDisplay(Anchor=face_normals_6.Centers, Vector=face_normals_6.Normals)  # disabled

panel_12 = Panel("Straight Elements")  # disabled
button_3 = Button()  # disabled
object_bake_2 = ObjectBake(
    BakeToggle=button_3,
    GeometryObjects=strips_6,
    Layer=panel_12,
    ObjectName="GH_Obj",
    ObjectColor=colour_swatch_3,
    LayerColor=RGB(255, 255, 255))  # disabled
# SIMULATING INFLATABLE
number_slider_27 = Slider(1.01, range=0..1.1)
number_slider_28 = Slider(500, range=0..1000)
number_slider_29 = Slider(500, range=0..1000)  # disabled
data = Data(absolute)  # disabled
floor = Floor(Strength=Slider(500, range=0..1000))
number_slider_30 = Slider(0, range=0..1)
number_slider_31 = Slider(1, range=0..1)
subtraction = Subtraction(A=number_slider_31, B=number_slider_27)
negative = Negative(Value=subtraction)
multiplication_2 = Multiplication(A=number_slider_31, B=data)  # disabled
timer_2 = Timer(TimerInterval=1000, Target=[c_script_4, c_script_5])  # disabled
boolean_toggle_8 = BooleanToggle(False)
button_4 = Button()

# ----
# EXPORTING FRAMES TO LOCAL FOLDER
file_path = FilePath("C:\Users\User\Desktop\Thesis Drive\Graphics\2_Animation\200626\Simulation_Table Inflation\")
panel_13 = Panel(file_path)
c_script_4 = CSharpScript(iReset=button_4, iStart=boolean_toggle_8, Path=panel_13, Name="image", iFrames=Slider(1700, range=0..1700))  # -> out; inputs iReset: Boolean, iStart: Boolean, Path: String, Name: String, iFrames: Int32
# ---------- c_script_4: C# usings ----------
using Rhino.Display;
using System.Threading;
# ---------- c_script_4: C# ----------
    if(iReset) counter = 0;

    if(iStart) {
      var view = doc.Views.ActiveView;
      var view_capture = new ViewCapture
        {
          Width = view.ActiveViewport.Size.Width,
          Height = view.ActiveViewport.Size.Height,
          ScaleScreenItems = false,
          DrawAxes = false,
          DrawGrid = false,
          DrawGridAxes = false,
          TransparentBackground = false
          };

      if(counter < iFrames){
        var screenshot = view_capture.CaptureToBitmap(view);
        if(screenshot != null)
        {
          string filename = Path + Name + counter + ".png";
          screenshot.Save(filename, System.Drawing.Imaging.ImageFormat.Png);
          Print("Count: " + counter);
          counter += 1;
        }
      }
    }
# ---------- c_script_4: C# additional code ----------
    int counter = 0;
# ---------- end c_script_4 ----------
panel_14 = Panel(c_script_4)

c_script_5 = CSharpScript(iReset=button_4, iRun=boolean_toggle_8)  # -> out, A; inputs iReset: Boolean, iRun: Boolean
# ---------- c_script_5: C# ----------
    if(iReset){
      counter = 0.0;}
    
    if(iRun){
      counter += 0.1;
    }
    A = counter;
# ---------- c_script_5: C# additional code ----------
  double counter = 0.0;
# ---------- end c_script_5 ----------
panel_15 = Panel(c_script_5.A)

# ----
# MAKING CHANNEL POCKETS STAGE2
mesh_4 = Mesh(<mesh referenced from the Rhino model>)
weld_mesh_2 = WeldMesh(Mesh=mesh_4, Angle=3.141592654)
weaverbird_s_naked_boundary_5 = WeaverbirdsNakedBoundary(MeshClosedPolylines=weld_mesh_2)
mesh_edges_11 = MeshEdges(Mesh=weld_mesh_2)  # -> NakedEdges, InteriorEdges, NonManifoldEdges
deconstruct_mesh_3 = DeconstructMesh(Mesh=weld_mesh_2)  # -> Vertices, Faces, Colours, Normals
number_slider_32 = Slider(9.075, range=0..10)

join_curves = JoinCurves(Curves=mesh_edges_11.NakedEdges, Preserve=False)
control_points = ControlPoints(Curve=join_curves)  # -> Points, Weights, Knots
removeduplicatepts = RemoveDuplicatePts(Points=control_points.Points, Tolerance=0.01)

negative_2 = Negative(Value=number_slider_32)
merge = Merge(Data1=negative_2, Data2=number_slider_32)  # -> graft(Result)
unit_z = UnitZ(Factor=merge)  # -> simplify(UnitVector)

closest_point_5 = ClosestPoint(Point=deconstruct_mesh_3.Vertices, Cloud=flatten(removeduplicatepts))  # -> ClosestPoint, CPIndex, Distance
larger_than = LargerThan(FirstNumber=closest_point_5.Distance, SecondNumber=0)  # -> LargerThan, OrEqualTo
dispatch_7 = Dispatch(List=deconstruct_mesh_3.Vertices, DispatchPattern=larger_than.LargerThan)  # -> ListA, ListB
move = Move(Geometry=dispatch_7.ListA, Motion=unit_z)  # -> simplify(Geometry), Transform
weave = Weave(Pattern=larger_than.LargerThan, Stream0=dispatch_7.ListB, Stream1=move.Geometry, NullGaps=False)  # -> simplify(Weave)
construct_mesh_3 = ConstructMesh(Vertices=weave, Faces=deconstruct_mesh_3.Faces)  # -> simplify(Mesh)
explode_tree = ExplodeTree(Data=construct_mesh_3)  # -> Branch0, Branch1
mesh_flip = MeshFlip(Mesh=explode_tree.Branch0)
merge_2 = Merge(Data1=mesh_flip, Data2=explode_tree.Branch1)  # -> flatten(Result)
mesh_join = MeshJoin(Meshes=merge_2)

mesh_5 = Mesh(mesh_join)
data_dam = DataDam(DataDataA=mesh_5, BufferDelay=10000000, BufferMode=0)
mesh_weldvertices = MeshWeldVertices(Mesh=data_dam, Tolerance=0.01)  # -> RuntimeMessage, Mesh
weld_mesh_3 = WeldMesh(Mesh=mesh_weldvertices.Mesh, Angle=3.141592654)
unify_mesh = UnifyMesh(Mesh=weld_mesh_3)  # -> Result, Count
mesh_unifynormals = MeshUnifyNormals(Mesh=weld_mesh_3)

brep_4 = Brep(<brep referenced from the Rhino model>)
deconstruct_mesh_4 = DeconstructMesh(Mesh=mesh_unifynormals)  # -> Vertices, Faces, Colours, Normals
point_in_breps = PointInBreps(Brep=brep_4, Point=deconstruct_mesh_4.Vertices, Strict=False)  # -> Inside, Index
dispatch_8 = Dispatch(List=deconstruct_mesh_4.Vertices, DispatchPattern=point_in_breps.Inside)  # -> ListA, ListB

multiplication_3 = Multiplication(A=deconstruct_mesh_4.Normals, B=Slider(0.005, range=0..0.01))
vector_display_7 = VectorDisplay(Anchor=deconstruct_mesh_4.Vertices, Vector=multiplication_3)

mesh_edges_12 = MeshEdges(Mesh=mesh_unifynormals)  # -> NakedEdges, InteriorEdges, NonManifoldEdges
geometry_3 = Geometry([mesh_edges_12.NakedEdges, mesh_edges_12.InteriorEdges])

sort_duplicate_points = SortDuplicatePoints(Points=dispatch_8.ListB)  # -> UniquePoints, Indices
number_slider_33 = Slider(10, range=0..100)
spherecollide = SphereCollide(Points=sort_duplicate_points.UniquePoints, Radius=number_slider_33, Strength=Slider(2839, range=0..10000))

pt_2 = Point(dispatch_8.ListA)
volume = Volume(Mesh=mesh_unifynormals, Volume=multiplication_2, Strength=number_slider_29)  # disabled
anchor_2 = Anchor(Point=pt_2, Strength=Slider(10000, range=0..10000))
show = Show(G=mesh_unifynormals)
vertexloads = VertexLoads(Mesh=mesh_unifynormals, Strength=subtraction)
length_line_2 = LengthLine(Line=geometry_3, Strength=number_slider_28)
mesh_sphere = MeshSphere(Base=sort_duplicate_points.UniquePoints, Radius=number_slider_33, UCount=10, VCount=20)

length = Length(Curve=geometry_3)
multiplication_4 = Multiplication(A=length, B=Slider(0.589, range=0..1))

multiplication_5 = Multiplication(A=length, B=Slider(0.95, range=0..1.01))

clamplength = ClampLength(Line=geometry_3, LowerLimit=multiplication_4, UpperLimit=multiplication_5, Strength=number_slider_28)

multiplication_6 = Multiplication(A=number_slider_31, B=Slider(1, range=0..181))

pressure = Pressure(M=mesh_unifynormals, Strength=multiplication_6)

stream_gate = StreamGate(Stream=[show, clamplength, pressure, anchor_2, floor, vertexloads, spherecollide], Gate=number_slider_30)  # -> Target0, Target1
stepsolver = StepSolver(
    GoalObjects=flatten(stream_gate.Target0),
    Tolerance=0.01,
    Momentum=False,
    Damping=0.99,
    SubIterations=Slider(200, range=0..10000),
    Animate=c_script_5.A)  # -> I, V, O; disabled
solver_2 = Solver(GoalObjects=flatten(stream_gate.Target1), Reset=Button(), Threshold=1e-15, Tolerance=0.01, On=Toggle(False))  # -> I, V, O
stream_filter = StreamFilter(Gate=number_slider_30, Stream0=stepsolver.O, Stream1=solver_2.O)

boolean_toggle_9 = BooleanToggle(True)
mesh_6 = Mesh(stream_filter)
clean_tree = CleanTree(RemoveNulls=boolean_toggle_9, RemoveInvalid=boolean_toggle_9, RemoveEmpty=boolean_toggle_9, Tree=mesh_6)

weaverbird_s_loop_subdivision_2 = WeaverbirdsLoopSubdivision(MeshCurves=clean_tree, Level=1, SmoothNakedEdges=1)
mesh_edges_13 = MeshEdges(Mesh=weaverbird_s_loop_subdivision_2)  # -> NakedEdges, InteriorEdges, NonManifoldEdges

custom_preview_4 = CustomPreview(Geometry=weaverbird_s_loop_subdivision_2, Material=ColourSwatch(SwatchColor=RGB(84, 84, 84)))

geometry_4 = Geometry(flatten([mesh_edges_13.NakedEdges, mesh_edges_13.InteriorEdges]))
