# Grasshopper definition 200823_Design Narrative.gh (Grasshopper 1.0.7)
# plug-ins: Exoskeleton2, Weaverbird

geometry_pipeline = GeometryPipeline(
    GroupByLayer=False,
    GroupByType=False,
    IncludeHidden=True,
    IncludeLocked=True,
    LayerFilter="Stage 3",
    NameFilter="*",
    SublayerFiltering=True,
    TypeFilter=4)
geometry_pipeline_2 = GeometryPipeline(
    GroupByLayer=False,
    GroupByType=False,
    IncludeHidden=True,
    IncludeLocked=True,
    LayerFilter="Stage 5",
    NameFilter="*",
    SublayerFiltering=True,
    TypeFilter=4)
geometry = Geometry(geometry_pipeline)
discontinuity = Discontinuity(Curve=geometry, Level=1)  # -> Points, Parameters
geometry_2 = Geometry(geometry_pipeline_2)
geometry_3 = Geometry([<curve referenced from the Rhino model> x24])
curve_closest_point = CurveClosestPoint(Point=flatten(discontinuity.Points), Curve=reparameterize(graft(geometry)))  # -> Point, Parameter, Distance
discontinuity_2 = Discontinuity(Curve=geometry_2, Level=1)  # -> Points, Parameters
evaluate = Evaluate(Expression="x<0.05", x=curve_closest_point.Distance)
curve_closest_point_2 = CurveClosestPoint(Point=flatten(discontinuity_2.Points), Curve=reparameterize(graft(geometry_2)))  # -> Point, Parameter, Distance
cull_pattern = CullPattern(List=curve_closest_point.Parameter, CullPattern=evaluate)

# ----
# Diameter of channels
number_slider = Slider(0.2, range=0..1.1)

geometry_4 = Geometry([<curve referenced from the Rhino model> x4])
evaluate_2 = Evaluate(Expression="x<0.05", x=curve_closest_point_2.Distance)

# ----
# Diameter of channels
number_slider_2 = Slider(0.2, range=0..1.1)

geometry_5 = Geometry(geometry_pipeline)
number_slider_3 = Slider(10, range=0..10)
shatter = Shatter(Curve=reparameterize(graft(geometry)), Parameters=cull_pattern)
cull_pattern_2 = CullPattern(List=curve_closest_point_2.Parameter, CullPattern=evaluate_2)
shatter_2 = Shatter(Curve=reparameterize(graft(geometry_2)), Parameters=cull_pattern_2)
end_points = EndPoints(Curve=shatter)  # -> Start, End
number_slider_4 = Slider(0.2, range=0..1.1)
exowireframe = ExoWireframe(
    Lines=flatten(geometry_4),
    Sides=6,
    StartRadius=number_slider,
    EndRadius=number_slider,
    NodeDepth=Slider(0.71, range=0..1),
    Division=Slider(10, range=0..10),
    Open=True)
line = Line(StartPoint=end_points.Start, EndPoint=end_points.End)  # -> flatten(Line)
exowireframe_2 = ExoWireframe(
    Lines=flatten(geometry_5),
    Sides=6,
    StartRadius=number_slider_2,
    EndRadius=number_slider_2,
    NodeDepth=Slider(0.67, range=0..5),
    Division=number_slider_3,
    Open=True)
end_points_2 = EndPoints(Curve=shatter_2)  # -> Start, End
number_slider_5 = Slider(0.2, range=0..1.1)
line_2 = Line(StartPoint=end_points_2.Start, EndPoint=end_points_2.End)  # -> flatten(Line)
exowireframe_3 = ExoWireframe(
    Lines=flatten(line),
    Sides=6,
    StartRadius=number_slider_4,
    EndRadius=number_slider_4,
    NodeDepth=Slider(0.47, range=0..5),
    Division=number_slider_3,
    Open=True)
mesh_edges = MeshEdges(Mesh=exowireframe)  # -> NakedEdges, InteriorEdges, NonManifoldEdges
weaverbird_s_catmull_clark_subdivision = WeaverbirdsCatmullClarkSubdivision(MeshCurves=exowireframe, Level=Slider(2, range=0..10), SmoothNakedEdges=Slider(0, range=0..2))
exowireframe_4 = ExoWireframe(
    Lines=flatten(line_2),
    Sides=6,
    StartRadius=number_slider_5,
    EndRadius=number_slider_5,
    NodeDepth=Slider(0.53, range=0..5),
    Division=Slider(10, range=0..10),
    Open=True)
weaverbird_s_catmull_clark_subdivision_2 = WeaverbirdsCatmullClarkSubdivision(MeshCurves=exowireframe_2, Level=Slider(2, range=0..10), SmoothNakedEdges=Slider(0, range=0..2))
weaverbird_s_catmull_clark_subdivision_3 = WeaverbirdsCatmullClarkSubdivision(MeshCurves=exowireframe_3, Level=Slider(2, range=0..10), SmoothNakedEdges=Slider(0, range=0..2))
surface = Surface(<surface referenced from the Rhino model>)
plane = Plane(surface)
number_slider_6 = Slider(1, range=0..1)
number_slider_7 = Slider(3, range=0..10)
number_slider_8 = Slider(1, range=0..10)
weaverbird_s_catmull_clark_subdivision_4 = WeaverbirdsCatmullClarkSubdivision(MeshCurves=exowireframe_4, Level=Slider(2, range=0..10), SmoothNakedEdges=Slider(0, range=0..2))
mirror = Mirror(Geometry=weaverbird_s_catmull_clark_subdivision, Plane=plane)  # -> Geometry, Transform
mirror_2 = Mirror(Geometry=geometry_4, Plane=plane)  # -> Geometry, Transform
geometry_6 = Geometry(<brep referenced from the Rhino model>)
geometry_7 = Geometry([mirror.Geometry, weaverbird_s_catmull_clark_subdivision])
box_array = BoxArray(Geometry=geometry_7, Cell=geometry_6, XCount=number_slider_8, YCount=number_slider_7, ZCount=number_slider_6)  # -> Geometry, Transform
box_array_2 = BoxArray(
    Geometry=[mirror_2.Geometry, geometry_4],
    Cell=geometry_6,
    XCount=number_slider_8,
    YCount=number_slider_7,
    ZCount=number_slider_6)  # -> Geometry, Transform
surface_2 = Surface(<surface referenced from the Rhino model>)
plane_2 = Plane(surface_2)
mirror_3 = Mirror(Geometry=box_array.Geometry, Plane=plane_2)  # -> Geometry, Transform
mirror_4 = Mirror(Geometry=box_array_2.Geometry, Plane=plane_2)  # -> Geometry, Transform
geometry_8 = Geometry(flatten([box_array_2.Geometry, mirror_4.Geometry, geometry_4, mirror_2.Geometry]))
geometry_9 = Geometry(flatten([mirror_3.Geometry, box_array.Geometry]))
